# Grasshopper definition demo1.gh (Grasshopper 1.0.7)
# plug-ins: treesloth01, ShapeDiverForGrasshopper

sddp = ShapeDiverDocumentPayload({AbsoluteTolerance=0, AngleTolerance=0, DistanceDisplayPrecision=0, GltfVersion="Gltf2", GrasshopperVersion="1.0.0007", InputGroups="{}", OutputGroups="{}", RelativeTolerance=0, RhinoVersion="7.30.23163.13001", UnitSystem=0, VersionCreated="1.16.1.0", VersionSaved="1.16.1.0"})
# user wants width
# user wants length
number_slider = Slider(300, range=0..1000)
# user wants many kinds
number_slider_2 = Slider(5, range=0..10)
brep = Brep(<brep referenced from the Rhino model>)
brep_2 = Brep(<brep referenced from the Rhino model>)
c__grasshoppername = CSharpScript(inputName="tempWallGenerate")  # -> pyFilePath; inputs inputName: String
# ---------- c__grasshoppername: C# usings ----------
using System.IO;
# ---------- c__grasshoppername: C# ----------
    if(this.GrasshopperDocument.IsFilePathDefined)
    {
      string p = this.GrasshopperDocument.FilePath;
      string fileName = Path.GetFileName(p);
      string filePath = p;
      string path = Path.GetDirectoryName(p);

      pyFilePath = string.Format("{0}\\{1}.py", path, inputName);
    }
# ---------- end c__grasshoppername ----------
c__grasshoppername_2 = CSharpScript(inputName="compoundMaterialDefinition")  # -> pyFilePath; inputs inputName: String; same code as c__grasshoppername
c__grasshoppername_3 = CSharpScript(inputName="boardDefinition")  # -> pyFilePath; inputs inputName: String; same code as c__grasshoppername
c__grasshoppername_4 = CSharpScript(inputName="structAndFillDefinition")  # -> pyFilePath; inputs inputName: String; same code as c__grasshoppername
c__grasshoppername_5 = CSharpScript(inputName="substructionDefinition")  # -> pyFilePath; inputs inputName: String; same code as c__grasshoppername
c__grasshoppername_6 = CSharpScript(inputName="paintDefinition")  # -> pyFilePath; inputs inputName: String; same code as c__grasshoppername
c__grasshoppername_7 = CSharpScript(inputName="claddingDefinition")  # -> pyFilePath; inputs inputName: String; same code as c__grasshoppername
brep_3 = Brep(<brep referenced from the Rhino model>)
windowdb = WindowDB()
brep_4 = Brep(<brep referenced from the Rhino model>)
tiledb = TileDB()
# verticalOverlap
number_slider_3 = Slider(0, range=0..1000)
# horizontalAngle
number_slider_4 = Slider(7, range=0..100)
# horizontalOverlap
number_slider_5 = Slider(50, range=0..100)
# verticalAngle
number_slider_6 = Slider(1, range=0..10)
c__grasshoppername_8 = CSharpScript(inputName="claddingDefinition2")  # -> pyFilePath; inputs inputName: String; same code as c__grasshoppername
data = Data(simplify(tiledb))
geo = Geometry(windowdb)
merge = Merge(Data1=brep, Data2=brep_2, Data3=brep_3)
int = Integer(number_slider)
int_2 = Integer(Slider(350, range=0..1000))
int_3 = Integer(number_slider_2)
file = ReadFile(File=c__grasshoppername_8, PerLineParse=False)

# ----
# tempWallGenerate
path = FilePath(c__grasshoppername)

# ----
# paint
path_2 = FilePath(c__grasshoppername_6)

# ----
# cladding
path_3 = FilePath(c__grasshoppername_7)

# ----
# compound material
path_4 = FilePath(c__grasshoppername_2)

# ----
# board
path_5 = FilePath(c__grasshoppername_3)

# ----
# subStruct + infill
path_6 = FilePath(c__grasshoppername_4)

# ----
# subStruct
path_7 = FilePath(c__grasshoppername_5)

file_2 = ReadFile(File=path, PerLineParse=False)
file_3 = ReadFile(File=path_2, PerLineParse=False)
file_4 = ReadFile(File=path_3, PerLineParse=False)
file_5 = ReadFile(File=path_4, PerLineParse=False)
file_6 = ReadFile(File=path_5, PerLineParse=False)
file_7 = ReadFile(File=path_6, PerLineParse=False)
file_8 = ReadFile(File=path_7, PerLineParse=False)
num = Number(number_slider_6)
data_2 = Data(data)
int_4 = Integer(int_3)
num_2 = Number(Slider(4, range=2..6))
num_3 = Number(number_slider_5)
num_4 = Number(number_slider_3)
geo_2 = Geometry(geo)
brep_5 = Brep(brep_4)
brep_6 = Brep(merge)
int_5 = Integer(int)
int_6 = Integer(int_2)
num_5 = Number(Slider(5, range=2..6))
num_6 = Number(number_slider_4)
# width
# thickness
# direction
toggle = BooleanToggle(False)
# thickness
# distance
# direction
toggle_2 = BooleanToggle(True)
# thickness
# distance
# direction
toggle_3 = BooleanToggle(True)
# width
# thickness
# direction
# width
toggle_4 = BooleanToggle(True)
# width
# thickness
# direction
toggle_5 = BooleanToggle(True)
# thickness
# distance
# direction
toggle_6 = BooleanToggle(False)
# width
# thickness
# direction
toggle_7 = BooleanToggle(True)
# length
panel = Panel("2400")
# subStruct + infill
# width
panel_2 = Panel("20")
# thickness
panel_3 = Panel("5")
# width
panel_4 = Panel("20")
# length
panel_5 = Panel("1000")
# length
panel_6 = Panel("1000")
# length
panel_7 = Panel("1000")
# cladding
cladding_material = GhPythonScript(Code=file_4, Length=panel, Width="100", Thickness="10", Direction=toggle)  # -> Out, Cladding_obj
# subStruct
substruct_infill_material = GhPythonScript(Code=file_8, Width="30", Thickness="10", Distance="300", Direction=toggle_6)  # -> Out, Substruct_obj
# subStruct
substruct_infill_material_2 = GhPythonScript(Code=file_8, Width=panel_4, Thickness="50", Distance="500", Direction=toggle_3)  # -> Out, Substruct_obj
# paint
paint_material = GhPythonScript(Code=file_3, Thickness=panel_3)  # -> Out, Paint_obj
# board
board_material = GhPythonScript(Code=file_6, Length=panel_6, Width="600", Thickness="19", Direction=toggle_5)  # -> Out, Board_obj
# board
board_material_2 = GhPythonScript(Code=file_6, Length=panel_5, Width="600", Thickness="20", Direction=toggle_7)  # -> Out, Board_obj
substruct_infill_material_3 = GhPythonScript(Code=file_7, Width=panel_2, Thickness="50", Distance="500", Direction=toggle_2)  # -> Out, SubstructInfill_obj
# board
board_material_3 = GhPythonScript(Code=file_6, Length=panel_7, Width="600", Thickness="10", Direction=toggle_4)  # -> Out, Board_obj
python = GhPythonScript(
    Code=file,
    WindowData=geo_2,
    CladdingData=data_2,
    WallGeo=brep_5,
    WindowGeo=brep_6,
    CladdingWidth=int_5,
    CladdingLength=int_6,
    KindNum=int_4,
    WWeight=num_5,
    LWeight=num_2,
    HoriOverlap=num_3,
    VertiOverlap=num_4,
    HoriAngle=num_6,
    VertiAngle=num,
    Init=Button())  # -> Out, Comb, OriginalLine, TileLocation, WallFrame, OriginalCoTileGeo, WindowForFinalList, Substructure, TargetLines, WallFrame_2
merge_2 = Merge(
    Data1=board_material_2.Board_obj,
    Data2=substruct_infill_material_3.SubstructInfill_obj,
    Data3=board_material.Board_obj,
    Data4=paint_material.Paint_obj,
    Data5=substruct_infill_material_2.Substruct_obj,
    Data6=board_material_3.Board_obj,
    Data7=substruct_infill_material.Substruct_obj,
    Data8=cladding_material.Cladding_obj)
merge_3 = Merge(
    Data1=substruct_infill_material_3.SubstructInfill_obj,
    Data4=board_material_3.Board_obj,
    Data5=cladding_material.Cladding_obj)
compound_material = GhPythonScript(Code=file_5, Material_collection=merge_2)  # -> Out, MaterialList, Material_thickness
panel_8 = Panel(python.Out)
python_2 = GhPythonScript(x=python.Substructure)  # -> out, a
# ---------- python_2: Python ----------
a = x
# ---------- end python_2 ----------
python_3 = GhPythonScript(x=python.Comb)  # -> out, a; same code as python_2
python_4 = GhPythonScript(x=python.TileLocation)  # -> out, a; same code as python_2
python_5 = GhPythonScript(x=python.OriginalLine)  # -> out, a; same code as python_2
python_6 = GhPythonScript(x=python.OriginalCoTileGeo)  # -> out, a; same code as python_2
geo_3 = Geometry(python.WindowForFinalList)
pln = Plane(python.WallFrame_2)
geo_4 = Geometry(<brep referenced from the Rhino model>)
ma = MassAddition(Input=compound_material.Material_thickness)  # -> Result, PartialResults
python_7 = GhPythonScript(x=python_2.a)  # -> out, a; same code as python_2
python_8 = GhPythonScript(x=python_3.a)  # -> out, a; same code as python_2
deplane = DeconstructPlane(Plane=pln)  # -> Origin, XAxis, YAxis, ZAxis
python_9 = GhPythonScript(x=python_4.a)  # -> out, a; same code as python_2
python_10 = GhPythonScript(x=python_6.a)  # -> out, a; same code as python_2
panel_9 = Panel("""200
100""")
crv = Curve(geo_3)
num_7 = Number(ma.PartialResults)
neg = Negative(Value=deplane.ZAxis)
dash = DashPattern(Curve=crv, Pattern=panel_9)  # -> Dashes, Gaps
cluster = Cluster_2(geo=geo_4, num=num_7)
crv_2 = Curve(python_7.a)
graft = GraftTree(Tree=compound_material.MaterialList, IncludeEmptyLists=True, IncludeNullItems=True)
graft_2 = GraftTree(Tree=compound_material.Material_thickness, IncludeEmptyLists=True, IncludeNullItems=True)
amp = Amplitude(Vector=neg, Amplitude=Slider(11, range=0..100))
cluster_2 = Cluster(G=dash.Dashes, x=Slider(150, range=0..1000))
geo_5 = Geometry(cluster)
move = Move(Geometry=crv_2, Motion=amp)  # -> Geometry, Transform
preview = CustomPreview(Geometry=cluster_2, Material=ColourSwatch(SwatchColor=RGB(0, 255, 238)))
cluster_3 = BranchLook(data=geo_5, i=0)
pipe = Pipe(Curve=move.Geometry, Radius=Slider(19, range=0..100), Caps=0)
temp_wall_generate = GhPythonScript(Code=file_2, SurfaceList=geo_5, MaterialList=graft, ThicknessList=graft_2)  # -> Out, BasePlane, BoardGeoList, SubstructInfillGeoList, PaintGeoList, SubstructGeoList, CladdingGeoList, AllTypeMaterial
int_7 = Integer(flatten(python_8.a))
panel_10 = Panel("""board
substructInfill
board
paint
substruct
board
cladding""")
cset = CreateSet(List=int_7)  # -> Set, Map
preview_2 = CustomPreview(Geometry=pipe, Material=ColourSwatch(SwatchColor=RGB(255, 255, 255)))
sort = SortList(Keys=cset.Set)  # -> Keys, ValuesA
lng = ListLength(List=cset.Set)
series = Series(Start=0, Step=1, Count=lng)
python_11 = GhPythonScript(become=series, changed=sort.Keys, changeList=python_8.a)  # -> out, newList; inputs become: list, changed: list, changeList: tree of Int32
# ---------- python_11: Python ----------
import ghpythonlib.treehelpers as th

width = become
length = changed

number_mapping = {}
for w, l in zip(width, length):
    number_mapping[l] = w

newList = []
for chList in changeList.Branches:
    newList.append([number_mapping[number] if number in number_mapping else number for number in chList])

newList = th.list_to_tree(newList)
# ---------- end python_11 ----------
tstat = TreeStatistics(Tree=temp_wall_generate.AllTypeMaterial)  # -> Paths, Length, Count
python_12 = GhPythonScript(x=temp_wall_generate.AllTypeMaterial)  # -> out, a
# ---------- python_12: Python ----------
a =x
# ---------- end python_12 ----------
plnaxis = PlaneAxis(P=temp_wall_generate.BasePlane, B="800")
shift = ShiftPaths(Data=python_12.a, Offset=-1)
series_2 = Series(Start=0, Step=Slider(1000, range=0..1000), Count=tstat.Count)  # -> graft(Series)
series_3 = Series(Start=0, Step=1, Count=tstat.Count)
unflatten = UnflattenTree(Tree=python_11.newList, Guide=python_8.a)
geo_6 = Geometry(flatten(python_10.a))
flatten = FlattenTree(Tree=unflatten, Path="{0}")  # -> graft(Tree)
bnd = Bounds(Numbers=flatten(unflatten))
Y = UnitY(Factor=expr("-x", series_2))
graft_3 = GraftTree(Tree=geo_6, IncludeEmptyLists=True, IncludeNullItems=True)
path_8 = ConstructPath(Indices=flatten)  # -> flatten(Branch)
gradient = Gradient(
    LowerLimit="0",
    UpperLimit=tstat.Count,
    Parameter=series_3,
    stops=[0: RGB(234, 38, 0), 0.25: RGB(234, 126, 0), 0.5: RGB(254, 244, 84), 0.75: RGB(173, 203, 249), 1: RGB(75, 107, 169)])
dedomain = DeconstructDomain(Domain=bnd)  # -> Start, End
move_2 = Move(Geometry=shift, Motion=Y)  # -> Geometry, Transform
tstat_2 = TreeStatistics(Tree=graft_3)  # -> Paths, Length, Count
gradient_2 = Gradient(
    LowerLimit=dedomain.Start,
    UpperLimit=dedomain.End,
    Parameter=unflatten,
    stops=[0: RGB(145, 107, 64), 0.267: RGB(234, 126, 0), 0.498: RGB(245, 207, 81), 0.772: RGB(235, 221, 185), 1: RGB(199, 98, 58)])
X = UnitX(Factor="10000")
replace = ReplacePaths(Data=graft_3, Search=tstat_2.Paths, Replace=path_8)
edges = BrepEdges(Brep=python_10.a)  # -> Naked, Interior, NonManifold
move_3 = Move(Geometry=move_2.Geometry, Motion=X)  # -> Geometry, Transform
geo_7 = Geometry(replace)
bang = ExplodeTree(Data=geo_7)  # -> Branch0, Branch1, Branch2, Branch3
preview_3 = CustomPreview(Geometry=python_10.a, Material=gradient_2)
number_slider_7 = Slider(1, range=0..10)
preview_4 = CustomPreview(Geometry=edges.Naked, Material=ColourSwatch(SwatchColor=RGB(0, 0, 0)))
edges_2 = BrepEdges(Brep=[move_3.Geometry, shift])  # -> Naked, Interior, NonManifold
preview_5 = CustomPreview(Geometry=[edges_2.Interior, edges_2.Naked, edges_2.NonManifold], Material=ColourSwatch(SwatchColor=RGB(0, 0, 0)))

preview_6 = CustomPreview(Geometry=move_3.Geometry, Material=graft(gradient))
preview_7 = CustomPreview(Geometry=shift, Material=graft(gradient))

# ==== cluster WindowDB
dom = ConstructDomain(DomainStart="1000", DomainEnd="2000")
dom_2 = ConstructDomain(DomainStart="1000", DomainEnd="2000")
random = Random(Range=dom_2, Number="500", Seed=2)
random_2 = Random(Range=dom, Number="500", Seed=Slider(11, range=0..100))
rectangle = Rectangle(Plane=PlaneXY(0, 0, 0), XSize=random, YSize=random_2, Radius=0)  # -> Rectangle, Length
R = ClusterOutput(rectangle.Rectangle)

# ==== cluster TileDB
number_slider = Slider(200, range=0..1000)
series = Series(Start=0, Step=1, Count="3")
item = ListItem(List=series, Index=0, Wrap=True)  # -> Item, Item1, Item2
dom = ConstructDomain(DomainStart=Slider(100, range=0..1000), DomainEnd=Slider(600, range=0..1000))
dom_2 = ConstructDomain(DomainStart=Slider(100, range=0..1000), DomainEnd=Slider(1200, range=0..10000))
dom_3 = ConstructDomain(DomainStart=Slider(191, range=0..300), DomainEnd=Slider(262, range=0..300))
# width
random = Random(Range=dom, Number=number_slider, Seed=item.Item, Integers=True)
# length
random_2 = Random(Range=dom_2, Number=number_slider, Seed=item.Item1, Integers=True)
# quantity
random_3 = Random(Range=dom_3, Number=number_slider, Seed=item.Item2, Integers=True)
rectangle = Rectangle(Plane=PlaneXY(0, 0, 0), XSize=random, YSize=random_2, Radius=0)  # -> graft(Rectangle), Length
graft = GraftTree(Tree=random_3, IncludeEmptyLists=True, IncludeNullItems=True)
merge = Merge(Data1=rectangle.Rectangle, Data2=graft)
R = ClusterOutput(merge)

# ==== cluster Cluster
x = ClusterInput()
neg = Negative(Value=x)
G = ClusterInput()
Y = UnitY(Factor=neg)
move = Move(Geometry=G, Motion=Y)  # -> Geometry, Transform
G_2 = ClusterOutput(move.Geometry)

# ==== cluster PlaneAxis: show plane X Y Z axis.
P = ClusterInput()
B = ClusterInput()
deplane = DeconstructPlane(Plane=graft(P))  # -> Origin, XAxis, YAxis, ZAxis
multiplication = Multiplication(A=[deplane.XAxis, deplane.YAxis, deplane.ZAxis], B=B)
vdisex = VectorDisplayEx(
    Point=deplane.Origin,
    Vector=multiplication,
    Colour=[ColourSwatch(SwatchColor=RGB(235, 52, 52)), ColourSwatch(SwatchColor=RGB(90, 207, 48)), ColourSwatch(SwatchColor=RGB(54, 126, 227))],
    Width=2)

# ==== cluster BranchLook: To see the condition of branch data.
data = ClusterInput()
data_2 = Data(data)
tstat = TreeStatistics(Tree=data_2)  # -> Paths, Length, Count
i = ClusterInput()
item = ListItem(List=tstat.Paths, Index=i, Wrap=True)
branch = TreeBranch(Tree=data_2, Path=item, MaintainPaths=True)
B = ClusterOutput(branch)

# ==== cluster Cluster_2
geo = ClusterInput()
geo_2 = Geometry(geo)
python = GhPythonScript(geoList=geo_2)  # -> out, boolList; inputs geoList: list of Brep; disabled
# ---------- python: Python ----------
import Rhino.Geometry as rg
import rhinoscriptsyntax as rs

boolList = []
for geo in geoList:
    for face in geo.Faces:
        boolList.append(face.IsPlanar(0.01))
# ---------- end python ----------
smesh = SimpleMesh(Brep=geo_2)
num = ClusterInput()
num_2 = Number(num)
python_2 = GhPythonScript(input_mesh=smesh, distances=num_2)  # -> out, offsetted_meshes; inputs input_mesh: Mesh, distances: list
# ---------- python_2: Python ----------
import Rhino.Geometry as rg

def offset_mesh(mesh, distances):
    # Ensure the mesh has vertex normals calculated
    mesh.Normals.ComputeNormals()
    
    # List to store the offset meshes
    offset_meshes = []
    
    for distance in distances:
        # Duplicate the original mesh to keep its structure while modifying the vertices
        offset_mesh = mesh.DuplicateMesh()
        
        # Move each vertex along its normal by the specified distance
        for i, vertex in enumerate(offset_mesh.Vertices):
            # Convert vertex to Point3d for compatibility with Vector3d operations
            vertex_point3d = rg.Point3d(vertex.X, vertex.Y, vertex.Z)
            
            # Get the normal for this vertex, ensuring it's treated as a Vector3d
            normal = rg.Vector3d(offset_mesh.Normals[i])
            
            # Calculate the new position by moving the vertex along the normal
            new_position = vertex_point3d + normal * distance
            
            # Update the vertex position in the mesh
            offset_mesh.Vertices.SetVertex(i, new_position.X, new_position.Y, new_position.Z)
        
        # Add the modified mesh to the list of offset meshes
        offset_meshes.append(offset_mesh)
    
    return offset_meshes

offsetted_meshes = offset_mesh(input_mesh, distances)
# ---------- end python_2 ----------
lng = ListLength(List=python_2.offsetted_meshes)
culln = CullNth(List=python_2.offsetted_meshes, CullFrequency=lng)  # -> simplify(List)
entwine = Entwine(Branch00=smesh, Branch01=culln, FlattenInputs=True)  # -> flatten(Result)
faceb = FaceBoundaries(Mesh=entwine)
explode = Explode(Curve=faceb, Recursive=True)  # -> Segments, Vertices
plfit = PlaneFit(Points=explode.Vertices)  # -> Plane, Deviation
deplane = DeconstructPlane(Plane=plfit.Plane)  # -> Origin, XAxis, YAxis, ZAxis
projecta = ProjectAlong(Geometry=graft(faceb), Plane=plfit.Plane, Direction=deplane.ZAxis)  # -> Geometry, Transform
shift = ShiftPaths(Data=projecta.Geometry, Offset=-1)
boundary = BoundarySurfaces(Edges=shift)
S = ClusterOutput(boundary)
