# Grasshopper definition seeDataInGh_demo.gh (Grasshopper 1.0.7)
# plug-ins: Human, Human UI

panel = Panel("C:\Users\User\Documents\GitHub\BFH_Reuse24\Kevin\DB\BFH_DB\Pictures_gruner\1_221114_Foto_Bau09\Foto_Bau09")  # disabled
panel_2 = Panel("DB\JSON_data\data_xlsx_csv\2024-02-14_roche_data.csv")  # disabled

# ----
# json folder path
c__grasshoppername = CSharpScript(inputName="DB\JSON_data\JSON")  # -> ghParentPath, filePath; inputs inputName: String
# ---------- c__grasshoppername: C# usings ----------
using System.IO;
# ---------- c__grasshoppername: C# ----------
    if(this.GrasshopperDocument.IsFilePathDefined)
    {
      string p = this.GrasshopperDocument.FilePath;
      DirectoryInfo directoryInfo = new DirectoryInfo(p);
      string parentFolderPath = directoryInfo.Parent.Parent.FullName;

      string filePath_ = string.Format("{0}\\{1}", parentFolderPath, inputName);

      ghParentPath = parentFolderPath;
      filePath = filePath_;

    }
# ---------- end c__grasshoppername ----------

python = GhPythonScript(folder_path=panel)  # -> out, image_paths; disabled
# ---------- python: Python ----------
import os

def get_image_paths(folder_path):
    # Define a list of common image file extensions
    image_extensions = ['.jpg', '.jpeg', '.png', '.gif', '.bmp', '.tiff']
    
    # List to store the paths of image files
    image_paths = []
    
    # Iterate over all files in the given folder
    for filename in os.listdir(folder_path):
        print(filename)
        # Check if the file is an image by comparing its extension
        if any(filename.lower().endswith(ext) for ext in image_extensions):
            # If it is, add its full path to the list
            full_path = os.path.join(folder_path, filename)
            image_paths.append(full_path)
    
    return image_paths


# Example usage
image_paths = get_image_paths(folder_path)
# ---------- end python ----------
number_slider = Slider(20, range=0..100)  # disabled

# ----
# csv file path
c__grasshoppername_2 = CSharpScript(inputName=panel_2)  # -> ghParentPath, filePath; inputs inputName: String; disabled; same code as c__grasshoppername

panel_3 = Panel(c__grasshoppername_2.filePath)  # disabled

# ----
# Title List
panel_4 = Panel("""bauteil_obergruppe
bauteil_gruner
uuid
kosten
zustand
material
ref_gebauede_geschoss
breite
hoehe
tiefe
flaeche
masse
anzahl
foto1
foto2
co2
url""")

# ----
# img folder path
c__grasshoppername_3 = CSharpScript(inputName="DB\Pictures_gruner")  # -> ghParentPath, filePath; inputs inputName: String; same code as c__grasshoppername

# ----
# read json file
python_2 = GhPythonScript(folder_path=c__grasshoppername.filePath)  # -> title, data
# ---------- python_2: Python ----------
import os
import json
import ghpythonlib.treehelpers as th

item_list = ['bauteil_obergruppe', 'bauteil_gruner', 'uuid', 'kosten', 'zustand', 'material', 'ref_gebauede_geschoss', 'breite', 'hoehe', 'tiefe', 'flaeche', 'masse', 'anzahl', 'foto1', 'foto2', 'co2', "kategorie"]

nameDict = {
"Befoerderungsanlage.json":"Befoerderungs_Anlage", #
"Bodenbelag.json":"Bodenbelag", #
"Deckenbekleidung.json":"Deckenbekleidung", #
"Deckenkonstruktion Dachkonstruktion.json":"Deckenkonstruktion", #
"Einbauten Schutzeinrichtung zu Ausbau.json":"Schutzeinrichtung", #
"Element in Aussenwand.json":"Aussenwand", #
"Element zu Dach.json":"ElementZuDach", #
"Fundament Bodenplatte.json":"Bodenplatte", #
#"Gastechnische Anlage.json":"Gastechnische_Anlage", 
"Gruenflaeche.json":"Gruenflaeche", #
"Kleininventar.json":"Kleininventar", #
"Lufttechnische Anlage.json":"Lufttechnische_Anlage", #
"Mobiliar.json":"Mobiliar", #
#"Sicherheitsanlage.json":"Sicherheit_Anlage", 
"Stuetzenkonstruktion.json":"Stuetzenkonstruktion", #
"Textilien.json":"Textilien", #
"Trennwand Innentuer Innentor.json":"Trennwand", #
"Waermetechnische Anlage.json":"Waermetechnische_Anlage", #
"Wandbekleidung.json":"Wandbekleidung", #
"Wandkonstruktion.json":"Wandkonstruktion", #
"Wassertechnische Anlage.json":"Wassertechnische_Anlage", #
"Weitere nutzungsspezifische Anlage.json":"Nutzungsspezifische_Anlage" #
}

def read_json_files(folder_path):
    # List to hold all items, with each item's sub-items as sub-lists
    all_items = []
    
    # Iterate over all files in the given folder
    for file_name in os.listdir(folder_path):
        # Check if the file is a JSON file
        if file_name.endswith('.json'):
            full_path = os.path.join(folder_path, file_name)
            
            # Read the JSON file
            with open(full_path, 'r') as json_file:
                data = json.load(json_file)
                
                # Assuming 'data' is a list of items
                for item in data:
                    # Add each item (and its sub-items, if any) to the list
                    
                    if file_name not in nameDict.keys():
                        continue
                    item["kategorie"] = nameDict[file_name]
                    temp = []
                    for key in item_list:
                        if key not in item.keys():
                            temp.append("FALSE")
                        else:
                            temp.append(item[key])
                    
                    all_items.append(temp)
    
    # Convert the list of lists into a data tree, with each top-level list as a branch
    return th.list_to_tree(all_items)

# Call the function and store the result
data = read_json_files(folder_path)

# The 'data_tree' can now be used as output in your Grasshopper Python component
title = item_list
# ---------- end python_2 ----------

split = SplitList(List=python.image_paths, Index=number_slider)  # -> ListA, ListB; disabled

# ----
# read csv file
python_3 = GhPythonScript(file_path=c__grasshoppername_2.filePath)  # -> title, data; disabled
# ---------- python_3: Python ----------
import csv
import codecs
import ghpythonlib.treehelpers as th

# Initialize a list to hold the rows of the CSV
data = []
title = []

# Open the file with UTF-8 encoding
with codecs.open(file_path, 'r', 'utf-8') as csvfile:
    # Create a CSV reader object
    csvreader = csv.reader(csvfile, delimiter=';')
    
    # Iterate over each row in the CSV and append it to the data list
    for i, row in enumerate(csvreader):
        if i == 0:
            title.append([item for item in row])
        else:
            # Since we're using IronPython (Python 2.7), row items are read as unicode objects
            # If necessary, you can encode them back to UTF-8 or work with them as unicode
            data.append([item for item in row])
print(title)
title = th.list_to_tree(title)
data = th.list_to_tree(data)
# ---------- end python_3 ----------

toggle = BooleanToggle(False)  # disabled
python_4 = GhPythonScript(open=toggle, imagePaths=split.ListA)  # -> out, selectedIndices; inputs open: Boolean, imagePaths: list; disabled
# ---------- python_4: Python ----------
import Rhino
import Eto.Forms as forms
import Eto.Drawing as drawing

# Assume 'selectedIndices' is a global list defined outside this class 
# to store the indices of selected items. This is a simplification for demonstration.

selectedIndices = []  # This will be used to store the indices of selected items.

class TestWindow(forms.Dialog[bool]):  # Use Dialog[bool] for a modal dialog
    def __init__(self, imagePaths):
        super(TestWindow, self).__init__()
        self.Title = "Image Viewer"
        self.MinimumSize = drawing.Size(100, 100)
        
        self.Location = drawing.Point(100, 100)

        self.button = forms.Button(Text="Check Selected")
        self.button.Click += self.on_button_click

        self.checkBoxes = []

        self.layout = forms.DynamicLayout()
        self.layout.AddRow(self.button)

        self.scrollable = forms.Scrollable()
        self.imageLayout = forms.DynamicLayout()
        self.scrollable.Content = self.imageLayout
        self.layout.AddRow(self.scrollable)

        self.Content = self.layout

        self.imagePaths = imagePaths
        self.populate_images()

    def populate_images(self):
        images_per_row = 4
        row = []
        count = 0

        for path in self.imagePaths:
            try:
                unitLayout = forms.StackLayout()
                unitLayout.Orientation = forms.Orientation.Vertical
                unitLayout.Spacing = 5
                unitLayout.Padding = drawing.Padding(10)

                image = drawing.Bitmap(path)
                imageView = forms.ImageView()
                imageView.Image = image
                imageView.Size = drawing.Size(190, 190)

                checkBox = forms.CheckBox(Text="Select me")
                self.checkBoxes.append(checkBox)

                unitLayout.Items.Add(imageView)
                unitLayout.Items.Add(forms.Label(Text="Image Description1"))
                unitLayout.Items.Add(forms.Label(Text="Image Description2"))
                unitLayout.Items.Add(forms.Label(Text="Image Description3"))
                unitLayout.Items.Add(forms.Label(Text="Image Description4"))
                unitLayout.Items.Add(checkBox)

                row.append(unitLayout)

                count += 1
                if count == images_per_row:
                    self.imageLayout.AddRow(*row)
                    row = []
                    count = 0

            except Exception as e:
                forms.MessageBox.Show("Failed to load image: " + str(e))

        if row:
            self.imageLayout.AddRow(*row)

    def on_button_click(self, sender, e):
#        selectedIndices.clear()  # Clear the global list first
        for index, checkBox in enumerate(self.checkBoxes):
            if checkBox.Checked:
                selectedIndices.append(index)  # Update the global list with selected indices
        self.Close(True)  # Close the dialog

# Assuming 'showForm' is a boolean input to trigger the form display
if open:
    form = TestWindow(imagePaths)
    dialogResult = form.ShowModal(Rhino.UI.RhinoEtoApp.MainWindow)
# ---------- end python_4 ----------
panel_5 = Panel(python_4.selectedIndices)  # disabled
changeimgpath = ChangeImgPath(parent_folder=c__grasshoppername_3.filePath, relay=python_2.data)
data = Data(changeimgpath)
title = Data(panel_4)

# ----
# Filter for Category
# This filter module is specifically for content that is 'category.'
list = ValueList({"bauteil_obergruppe", "bauteil_gruner", "material"}, selected="bauteil_obergruppe")
# Filter Block
# Filter Blocks can be copied to apply multiple filters.
# Users can select a topic to view the involved items.
# By selecting the items, materials whose content matches the filter will be retained.
panel_6 = Panel("""bauteil_obergruppe
bauteil_gruner
material""")
cluster = Cluster(S=title, M=list, data=data)  # -> S_2, M_2, L
panel_7 = Panel(cluster.L)
list_2 = ItemSelector(
    cluster.S_2,
    {"Befoerderungsanlage", "Bodenbelag", "Deckenbekleidung", "Deckenkonstruktion, Dachkonstruktion", "Einbauten, Schutzeinrichtung zu Ausbau", "Element in Aussenwand", "Element zu Dach", "Fundament, Bodenplatte", "Gruenflaeche", "Kleininventar", "Lufttechnische Anlage", "Mobiliar", "Stuetzenkonstruktion", "Textilien", "Trennwand, Innentuer, Innentor", "Waermetechnische Anlage", "Wandbekleidung", "Wandkonstruktion", "Wassertechnische Anlage", "Weitere nutzungsspezifische Anlage"}, selected="Stuetzenkonstruktion")
cluster_2 = Cluster_2(category=cluster.S_2, chosenitem=list_2, dataid=cluster.M_2)

data_topic = Data(title)
alldata = Data(data)

# ----
# UI item setting
# Tick the items which you
# want  to show inside UI.
list_3 = ValueList({"bauteil_obergruppe", "bauteil_gruner", "uuid", "kosten", "zustand", "material", "ref_gebauede_geschoss", "breite", "hoehe", "tiefe", "flaeche", "masse", "anzahl"}, selected=["bauteil_obergruppe", "bauteil_gruner", "uuid", "material", "breite", "hoehe", "tiefe", "anzahl"])

# ----
# Sort list by which item,
# Original order if disable.
list_4 = ValueList({"breite", "hoehe", "tiefe", "anzahl"}, selected="breite")

# ----
# True: Large -> Small
# False: Small -> Large
toggle_2 = BooleanToggle(False)

# ----
# click this button to
# bake brep
button = Button()

# ----
# Filter for Dimension
# This filter module is specifically for content that is 'number.'
# breite [cm]
# hoehe [cm]
# tiefe [cm]
# anzahl
list_5 = ValueList({"breite [cm]": "breite", "hoehe [cm]": "hoehe", "tiefe [cm]": "tiefe"}, selected="breite [cm]")
cluster_3 = Cluster_3(S=title, M=list_5, data=data)  # -> S_2, M_2, S_3
number_slider_2 = Slider(5, range=0..1000)
number_slider_3 = Slider(100, range=0..1000)

# ----
# Here is the range for the item you selected.
panel_8 = Panel(cluster_3.S_3)

# ----
# You can input minimum and maximum numbers (minNum and maxNum)
#  to find items within the domain.
# Alternatively, you can leave either minNum or maxNum blank.
number_filter = GhPythonScript(Category=cluster_3.S_2)  # -> out, chosenItem; inputs Category: list
# ---------- number_filter: Python ----------
"""
This component is used for finding item that within minNum and maxNum.
If the item is "FALSE" or the one that can't transfer to float, this item will still be output.
"""
import Grasshopper.Kernel as ghkernel
import math

if len(Category) == 0:
    ghenv.Component.AddRuntimeMessage(ghkernel.GH_RuntimeMessageLevel.Warning, "Category is empty.")

else:
    if minNum is None:
        minNum = float('-inf')
    if maxNum is None:
        maxNum = float('inf')
    
    if minNum > maxNum:
        ghenv.Component.AddRuntimeMessage(ghkernel.GH_RuntimeMessageLevel.Warning, "minNum should smaller than or equal to maxNum.")
    
    matchedItem = []
    for item in Category:
        try:
            float_item = float(item)
            if float_item>=minNum and float_item<=maxNum:
                matchedItem.append(item)
        except:
            matchedItem.append(item)
            
    if len(matchedItem) == 0:
        ghenv.Component.AddRuntimeMessage(ghkernel.GH_RuntimeMessageLevel.Warning, "Nothing matches filter.")

    chosenItem = matchedItem
# ---------- end number_filter ----------

cluster_4 = Cluster_2(category=cluster_3.S_2, chosenitem=number_filter.chosenItem, dataid=cluster_3.M_2)

entwine = Entwine(Branch00=cluster_2, Branch01=cluster_4, FlattenInputs=True)
python_5 = GhPythonScript(data=entwine)  # -> union, quan; inputs data: tree
# ---------- python_5: Python ----------
def intersection_of_lists(nested_list):
    # Check if the nested list is empty or contains only empty lists
    if not nested_list or all(len(sublist) == 0 for sublist in nested_list):
        return [], 0

    # Initialize the intersection set with the first sublist to compare with others
    intersection_set = set(nested_list[0])
    
    # Iterate over each sublist in the nested list starting from the second sublist
    for sublist in nested_list[1:]:
        # Update the intersection set to keep only elements also found in the current sublist
        intersection_set.intersection_update(sublist)
    
    # Convert the set back to a list to get the final intersection list
    intersection_list = list(intersection_set)
    
    # Return the intersection list and the number of elements in the intersection
    return intersection_list, len(intersection_list)

listList = []
for d in data.Branches:
    if len(d) == 0:
        continue
    listList.append(d)

union, quan = intersection_of_lists(listList)
# ---------- end python_5 ----------

# ----
# Quantity of items matching filters
panel_9 = Panel(python_5.quan)

cluster_5 = BranchLook(data=alldata, i=python_5.union)

# ----
# UI Engine
# OpenUI => Opens the Menu Window.
# OpenImg => Reading an image takes a lot of time; you can turn it off to speed up the process.
# ShowItemNum => Specifies the number of items displayed in the Menu.
number_slider_4 = Slider(84, range=0..100)
cluster_6 = Cluster_4(
    openui=Toggle(True),
    openimg=Toggle(True),
    showitemnum=number_slider_4,
    topic=data_topic,
    chosenitem=list_3,
    data=cluster_5,
    sortitem=list_4,
    sortreverse=toggle_2)  # -> data_5, chosenbool_2
values = ValueListener(Elements=flatten(cluster_6.chosenbool_2), SomeProperty=True)  # -> Values, Indices

# ----
# Show/Bake in Rhino
number_slider_5 = Slider(23, range=0..100)
show_in_rh = ShowInRh(x=number_slider_5, y=Slider(8, range=0..100), L=cluster_6.data_5, P=values.Values)  # -> geo_2, layername_2, text_2, data_2
objattr = ObjAttr(b=button, layername=show_in_rh.layername_2, data=show_in_rh.data_2)
item = ListItem(List=show_in_rh.text_2, Index=0, Wrap=True)  # -> Item, Item1
geo = Geometry(show_in_rh.geo_2)
bake = BakeGeometry(Bake=button, Geometry=geo, Attributes=objattr, DeleteOldBakes=False, PreserveTrees=False)
justified_text = JustifiedText3d(
    Location=item.Item,
    Text=item.Item1,
    Size=1,
    HorizontalAlignment=0,
    VerticalAlginment=0,
    UseMeshes=False,
    Attributes=objattr,
    Bake=button)

# ----
# Filter for Quantity
# This filter module is specifically for content that is 'number.'
list_6 = ValueList({"anzahl"}, selected="anzahl")
panel_10 = Panel("anzahl")
cluster_7 = Cluster_3(S=title, M=list_6, data=data)  # -> S_2, M_2, S_3
number_slider_6 = Slider(5, range=0..1000)
number_slider_7 = Slider(100, range=0..1000)

# ----
# Here is the range for the item you selected.
panel_11 = Panel(cluster_7.S_3)

# ----
# You can input minimum and maximum numbers (minNum and maxNum)
#  to find items within the domain.
# Alternatively, you can leave either minNum or maxNum blank.
number_filter_2 = GhPythonScript(Category=cluster_7.S_2)  # -> out, chosenItem; inputs Category: list; same code as number_filter

cluster_8 = Cluster_2(category=cluster_7.S_2, chosenitem=number_filter_2.chosenItem, dataid=cluster_7.M_2)

# ==== cluster Cluster
S = ClusterInput()
M = ClusterInput()
data = ClusterInput()
mindex = MemberIndex(Set=S, Member=M)  # -> Index, Count
data_2 = Data(data)
item = ListItem(List=data_2, Index=mindex.Index, Wrap=True)
cset = CreateSet(List=flatten(item))  # -> Set, Map
lng = ListLength(List=cset.Set)
S_2 = ClusterOutput(cset.Set)
M_2 = ClusterOutput(cset.Map)
L = ClusterOutput(lng)

# ==== cluster BranchLook: To see the condition of branch data.
data = ClusterInput()
data_2 = Data(data)
tstat = TreeStatistics(Tree=data_2)  # -> Paths, Length, Count
i = ClusterInput()
item = ListItem(List=tstat.Paths, Index=i, Wrap=True)
branch = TreeBranch(Tree=data_2, Path=item, MaintainPaths=True)
B = ClusterOutput(branch)

# ==== cluster Cluster_2
category = ClusterInput()
chosenitem = ClusterInput()
dataid = ClusterInput()
category_2 = Data(category)
chosenitem_2 = Data(chosenitem)
dataid_2 = Data(dataid)
null = NullItem(Item=chosenitem_2)  # -> flatten(NullFlags), InvalidFlags, Description
item = ListItem(List=null.NullFlags, Index=0, Wrap=True)
filter = StreamFilter(Gate=item, Stream0=chosenitem_2, Stream1=category_2)
mindex = MemberIndex(Set=category_2, Member=filter)  # -> flatten(Index), Count
python = GhPythonScript(choose=mindex.Index, data=dataid_2)  # -> out, a; inputs choose: list, data: list
# ---------- python: Python ----------
a = []
for id, d in enumerate(data):
    if d in choose:
        a.append(id)
# ---------- end python ----------
a = ClusterOutput(python.a)

# ==== cluster Cluster_3
S = ClusterInput()
M = ClusterInput()
data = ClusterInput()
mindex = MemberIndex(Set=S, Member=M)  # -> Index, Count
data_2 = Data(data)
item = ListItem(List=data_2, Index=mindex.Index, Wrap=True)
cset = CreateSet(List=flatten(item))  # -> Set, Map
bnd = Bounds(Numbers=cset.Map)
dedomain = DeconstructDomain(Domain=bnd)  # -> Start, End
S_2 = ClusterOutput(cset.Set)
M_2 = ClusterOutput(cset.Map)
S_3 = ClusterOutput([dedomain.Start, dedomain.End])

# ==== cluster ChangeImgPath
relay = ClusterInput()
panel = Panel("""13
14""")
parent_folder = ClusterInput()
item = ListItem(List=relay, Index=panel, Wrap=True)

# ----
# alter img
python = GhPythonScript(parent_folder=parent_folder, picture_path=item)  # -> out, found_path_list; inputs picture_path: tree
# ---------- python: Python ----------
import os
import ghpythonlib.treehelpers as th

def build_file_map(parent_folder):
    file_map = {}
    for root, dirs, files in os.walk(parent_folder):
        for file in files:
            if file not in file_map:  # This check adds the first found instance if multiple files with the same name exist
                file_map[file] = os.path.join(root, file)
    return file_map

def find_picture(file_map, picture_name):
    return file_map.get(picture_name, None)

# Assuming 'parent_folder' and 'picture_path' are defined
file_map = build_file_map(parent_folder)

total_found = 0
total_not_found = 0

found_path_list = []
for pic_path in picture_path.Branches:
    temp = []
    for pic in pic_path:
        file_name = os.path.basename(pic)
        found_path = find_picture(file_map, file_name)
        if found_path:
            total_found += 1
            temp.append(found_path)
        else:
            total_not_found += 1
            temp.append(os.path.join(parent_folder, "notFound.jpg"))
    found_path_list.append(temp)

found_path_list = th.list_to_tree(found_path_list)
print("found img: %d" % (total_found))
print("not found img: %d" % (total_not_found))
# ---------- end python ----------

panel_2 = Panel("""16
2""")
replace = ReplaceItems(List=relay, Item=python.found_path_list, Indices=panel, Wrap=False)
item_2 = ListItem(List=replace, Index=panel_2, Wrap=True)
panel_3 = Panel(item_2)

# ----
# alter url
python_2 = GhPythonScript(data=item_2)  # -> out, simplify(graft(urlList)); inputs data: tree
# ---------- python_2: Python ----------
import ghpythonlib.treehelpers as th
urlList = []
for d in data.Branches:
    bautStr = d[0]
    if bautStr.find(","):
        print("heee")
        print(bautStr)
    alterStr = str(d[0]).replace(" ", "_")
    urlString = "https://bfhreuse24.site/shop/" + alterStr + "/" + str(d[1])
    url = urlString 
    urlList.append(url)

urlList = th.list_to_tree(urlList)
# ---------- end python_2 ----------

replace_2 = ReplaceItems(List=replace, Item=python_2.urlList, Indices="16", Wrap=False)
L = ClusterOutput(replace_2)

# ==== cluster Cluster_4
showitemnum = ClusterInput()
sortreverse = ClusterInput()
chosenitem = ClusterInput()
openimg = ClusterInput()
sortitem = ClusterInput()
openui = ClusterInput()
topic = ClusterInput()
data = ClusterInput()
showitemnum_2 = Data(showitemnum)
sortreverse_2 = Data(sortreverse)
chosenitem_2 = Data(chosenitem)
openimg_2 = Data(openimg)
sortitem_2 = Data(sortitem)
openui_2 = Data(openui)
topic_2 = Data(topic)
data_2 = Data(data)
item = ListItem(List=flatten(sortitem_2), Index=0, Wrap=True)
mindex = MemberIndex(Set=topic_2, Member=item)  # -> flatten(Index), Count
null = NullItem(Item=item)  # -> NullFlags, InvalidFlags, Description
python = GhPythonScript(Data=data_2, item=mindex.Index, sortReverse=sortreverse_2)  # -> out, sorted_branches; inputs Data: tree, sortReverse: Boolean
# ---------- python: Python ----------
import ghpythonlib.treehelpers as th

def sort_branches_by_item(branches, index, reverseBool):
    
    branches_with_false = []
    other_branches = []
    for branch in branches:
        try:
            floatItem = float(branch[index])
            other_branches.append(branch)
        except:
            branches_with_false.append(branch)
    
    # Sort the valid branches based on the item at the specified index
    sorted_other_branches = sorted(other_branches, key=lambda branch: float(branch[index]), reverse=reverseBool)
    
    # Append the branches with False at the end
    sorted_branches = sorted_other_branches + branches_with_false
    
    return sorted_branches

# Example usage
branches = [list(b) for b in Data.Branches]
sorted_branches = sort_branches_by_item(branches, item, sortReverse)
sorted_branches = th.list_to_tree(sorted_branches)
# ---------- end python ----------
filter = StreamFilter(Gate=null.NullFlags, Stream0=python.sorted_branches, Stream1=data_2)
data_3 = Data(filter)
null_2 = NullItem(Item=chosenitem_2)  # -> flatten(NullFlags), InvalidFlags, Description
item_2 = ListItem(List=null_2.NullFlags, Index=0, Wrap=True)
filter_2 = StreamFilter(Gate=item_2, Stream0=chosenitem_2, Stream1=topic_2)

# ----
# search Image & url path
panel = Panel("foto1")
mindex_2 = MemberIndex(Set=topic_2, Member="foto2")  # -> flatten(Index), Count
mindex_3 = MemberIndex(Set=topic_2, Member=panel)  # -> flatten(Index), Count
item_3 = ListItem(List=data_3, Index=mindex_2.Index, Wrap=True)
item_4 = ListItem(List=data_3, Index=mindex_3.Index, Wrap=True)
merge = Merge(Data1=item_4, Data2=item_3)

mindex_4 = MemberIndex(Set=topic_2, Member=filter_2)  # -> flatten(Index), Count
tstat = TreeStatistics(Tree=data_3)  # -> Paths, Length, Count
item_5 = ListItem(List=data_3, Index=mindex_4.Index, Wrap=True)
dup = DuplicateData(Data=filter_2, Number=tstat.Count, Order=True)
unflatten = UnflattenTree(Tree=dup, Guide=item_5)
graft = GraftTree(Tree=item_5, IncludeEmptyLists=True, IncludeNullItems=True)
graft_2 = GraftTree(Tree=unflatten, IncludeEmptyLists=True, IncludeNullItems=True)
merge_2 = Merge(Data1=graft_2, Data2=graft)
join = TextJoin(Text=merge_2, Join=": ")
pshift = ShiftPaths(Data=join, Offset=-1)
tstat_2 = TreeStatistics(Tree=pshift)  # -> Paths, Length, Count
min = Minimum(A=showitemnum_2, B=tstat_2.Count)
series = Series(Start=0, Step=1, Count=min)
cluster = BranchLook(data=data_3, i=series)
cluster_2 = BranchLook(data=pshift, i=series)
cluster_3 = BranchLook(data=merge, i=series)
and = GateAnd(A=openimg_2, B=openui_2)
panel_2 = Panel("https://bfhreuse24.site/shop/")
panel_3 = Panel("https://bfhreuse24.site/shop/Lufttechnische_Anlage/9e33803a-b9b6-4519-b2b1-4e7e99ade434")
item_6 = ListItem(List=cluster, Index="16", Wrap=True)
filter_3 = StreamFilter(Gate=and, Stream1=cluster_3)
item_7 = ListItem(List=cluster_3, Index=0, Wrap=True)
python_2 = GhPythonScript(data=item_6)  # -> out, simplify(graft(urlList)); inputs data: tree
# ---------- python_2: Python ----------
import ghpythonlib.treehelpers as th
urlList = []
for d in data.Branches:
    urlString = d[0]
    url = "[Link to website](" + urlString + ")"
    urlList.append(url)

urlList = th.list_to_tree(urlList)
# ---------- end python_2 ----------
repeat = RepeatData(Data="Show in Rhino", Length=min)  # -> graft(Data)
repeat_2 = RepeatData(Length=min)
item_8 = ListItem(List=filter_3, Index=0, Wrap=True)
checkbox = CreateCheckbox(Label=repeat_2, StartingValue=False)  # -> graft(Checkbox)
label = CreateLabel(LabelText=repeat, LabelSize=18, Justification=0)
tstat_3 = TreeStatistics(Tree=item_7)  # -> Paths, Length, Count
tstat_4 = TreeStatistics(Tree=python_2.urlList)  # -> Paths, Length, Count
stack = CreateStack(UIElements=[checkbox, label], Horizontal=True)
label_2 = CreateLabel(LabelText=cluster_2, LabelSize=18, Justification=0)
image = CreateImage(ImageSource=item_8, ImageWidth=300)
replace = ReplacePaths(Data=python_2.urlList, Search=tstat_4.Paths, Replace=tstat_3.Paths)
mdv = CreateMarkdownViewer(Text=replace)
scrollviewer = CreateScrollViewer(UIElements=label_2, HorizontalScrollBarVisibility=0, VerticalScrollBarVisibility=0)
unflatten_2 = UnflattenTree(Tree=stack, Guide=item_7)
scrollviewer_2 = CreateScrollViewer(UIElements=image, HorizontalScrollBarVisibility=2, VerticalScrollBarVisibility=0, Height=Slider(246, range=0..1000))
merge_3 = Merge(Data1=scrollviewer_2, Data2=scrollviewer, Data3=mdv, Data4=unflatten_2)
stack_2 = CreateStack(UIElements=merge_3, Horizontal=invert(True))
border = CreateBorder(
    UIElement=stack_2,
    BorderThickness=Slider(1, range=0..10),
    BorderColor=RGB(0, 0, 0),
    CornerRadius=Slider(10, range=0..10))
adjustpos = AdjustElementPositioning(
    ElementsToAdjust=stack_2,
    Margin="20,20,10,10",
    AbsolutePositioning=False,
    Width=Slider(321, range=0..1000),
    HorizontalAlignment=Slider(0, range=0..10))
wrappanel = CreateWrapPanel(UIElements=flatten(border), Horizontal=True)
launchwin = LaunchWindow(
    Show=openui_2,
    Name="Menu Window",
    Width=Slider(806, range=0..1000),
    Height=Slider(746, range=0..1000),
    ChildStatus=0,
    EnableHorizScroll=False)
accent_colors = ValueList({"Amber", "Blue", "Brown", "Cobalt", "Crimson", "Cyan", "Emerald", "Green", "Indigo", "Lime", "Magenta", "Mauve", "Olive", "Orange", "Pink", "Purple", "Red", "Sienna", "Steel", "Taupe", "Teal", "Violet", "Yellow"}, selected="Steel")
adjustpos_2 = AdjustElementPositioning(
    ElementsToAdjust=flatten(border),
    Margin="5,5,5,5",
    AbsolutePositioning=False,
    Width=Slider(367, range=0..1000),
    HorizontalAlignment=Slider(0, range=0..10))
addelems = AddElements(Window=launchwin, Elements=flatten(wrappanel), DoVLChecking=True)  # -> AddedElements, ElementNames
winprops = SetWindowProperties(Window=launchwin, AccentColor=accent_colors, ShowTitleBar=True, ScaleFactor=1)
chosenbool = Data(checkbox)
data_4 = Data(cluster)
data_5 = ClusterOutput(data_4)
chosenbool_2 = ClusterOutput(chosenbool)

# ==== cluster ShowInRh
L = ClusterInput()
P = ClusterInput()
dispatch = Dispatch(List=L, DispatchPattern=P)  # -> ListA, ListB
clean = CleanTree(RemoveNulls=True, RemoveInvalid=True, RemoveEmpty=invert(False), Tree=dispatch.ListA)
panel = Panel("""bauteil_obergruppe
bauteil_gruner
uuid
kosten
zustand
material
ref_ge_gebauede_geschoss
breite
hoehe
tiefe
flaeche
masse
anzahl
foto1
foto2
co2
url""")
panel_2 = Panel("""7
8
9""")
item = ListItem(List=clean, Index=panel_2, Wrap=True)
item_2 = ListItem(List=clean, Index="12", Wrap=True)
x = ClusterInput()
y = ClusterInput()
number_slider = Slider(10, range=0..10)
number_slider_2 = Slider(23, range=0..100)
alterfalse = GhPythonScript(data=item)  # -> a; inputs data: tree
# ---------- alterfalse: Python ----------
import ghpythonlib.treehelpers as th
o = []
for dd in data.Branches:
    temp = []
    for d in dd:
        if d == 0:
            d = 1
        temp.append(d)
    o.append(temp)

a = th.list_to_tree(o)
# ---------- end alterfalse ----------
y_2 = Data(y)
x_2 = Data(x)
item_3 = ListItem(List=alterfalse, Index=0, Wrap=True)  # -> Item, Item1, Item2
rectangle = Rectangle(Plane=PlaneXY(0, 0, 0), XSize=item_3.Item, YSize=item_3.Item1, Radius=0)  # -> Rectangle, Length
ma = MassAddition(Input=flatten(item_3.Item))  # -> Result, PartialResults
panel_3 = Panel(ma.PartialResults)
boundary = BoundarySurfaces(Edges=rectangle.Rectangle)
Z = UnitZ(Factor=item_3.Item2)
addition = Addition(A=item_3.Item1, B=y_2)
extr = Extrude(Base=boundary, Direction=Z)
python = GhPythonScript(x=ma.PartialResults, y=x_2)  # -> a; inputs x: list
# ---------- python: Python ----------
x = [i + y * (id+1) for id, i in enumerate(x)]
x.insert(0,0)
a = x[:-1]
# ---------- end python ----------
series = Series(Start=0, Step=addition, Count=item_2)
panel_4 = Panel(python)

panel_5 = Panel("""bauteil_gruner
uuid
material""")
panel_6 = Panel("""1
2
5""")

X = UnitX(Factor=python)
item_4 = ListItem(List=clean, Index=panel_6, Wrap=True)
item_5 = ListItem(List=clean, Index=0, Wrap=True)  # -> Item, Item1
move = Move(Geometry=extr, Motion=graft(X))  # -> Geometry, Transform
Y = UnitY(Factor=series)
xy = XYPlane(Origin=Point(0, 0, 0))
python_2 = GhPythonScript(data=item_4, name=panel_5)  # -> out, treeContainer; inputs data: tree, name: list
# ---------- python_2: Python ----------
from Grasshopper.Kernel.Data import GH_Path
import System.Array as array
from Grasshopper import DataTree

treeContainer = DataTree[object]()

for id, d in enumerate(data.Branches):
    new_d = ""
    for n, info in zip(name, d):
        st = " : ".join((n, info)) + "\n"
        new_d += st
    path = data.Paths[id]
    treeContainer.AddRange([new_d], path)
# ---------- end python_2 ----------
pt = Point(xy)
join = TextJoin(Text=[item_5.Item, item_5.Item1], Join=" _ ")
move_2 = Move(Geometry=move.Geometry, Motion=Y)  # -> Geometry, Transform
move_3 = Move(Geometry=pt, Motion=graft(X))  # -> Geometry, Transform
Y_2 = UnitY(Factor=expr("-x", Slider(4, range=0..10)))
move_4 = Move(Geometry=move_3.Geometry, Motion=Y_2)  # -> Geometry, Transform
renumber = RenumberPaths(Data=python_2.treeContainer)
renumber_2 = RenumberPaths(Data=move_4.Geometry)
merge = Merge(Data1=renumber_2, Data2=renumber)
layername = Data(join)
text = Data(merge)
data = Data(clean)
geo = Geometry(move_2.Geometry)
text_2 = ClusterOutput(text)
data_2 = ClusterOutput(data)
geo_2 = ClusterOutput(geo)
layername_2 = ClusterOutput(layername)

# ==== cluster ObjAttr
layername = ClusterInput()
data = ClusterInput()
layername_2 = Data(layername)
data_2 = Data(data)
b = ClusterInput()
emptyreplace = GhPythonScript(x=data_2)  # -> a; inputs x: tree
# ---------- emptyreplace: Python ----------
import ghpythonlib.treehelpers as th

a = []
for b in x.Branches:
    t = []
    for i in b:
        if i == "":
            t.append("FALSE")
        else:
            t.append(i)
    a.append(t)

a = th.list_to_tree(a)
# ---------- end emptyreplace ----------
ghpython_script = GhPythonScript(b=b, data=layername_2)  # -> oData; inputs b: Boolean, data: tree
# ---------- ghpython_script: Python ----------
if b:
    oData = data
# ---------- end ghpython_script ----------
panel = Panel("""bauteil_obergruppe
bauteil_gruner
uuid
kosten
zustand
material
ref_ge_gebauede_geschoss
breite
hoehe
tiefe
flaeche
masse
anzahl
foto1
foto2
co2
url""")
create_modify_layers = CreateModifyLayers(LayerName=ghpython_script, DeleteLayer=False, enableFullPath=True)  # -> LayerNames, LayerFullPath
createattributes = CreateAttributes(
    Name=create_modify_layers.LayerNames,
    LayerName=create_modify_layers.LayerNames,
    UserDataKeys=panel,
    UserDataValues=emptyreplace,
    enableFullPath=False)
object_attributes = ClusterOutput(createattributes)
