# Grasshopper definition teach_wallSystem_normalFacade_advance.gh (Grasshopper 1.0.7)
# plug-ins: Human, ShapeDiverForGrasshopper

sddp = ShapeDiverDocumentPayload({AbsoluteTolerance=0, AngleTolerance=0, DistanceDisplayPrecision=0, GltfVersion="Gltf2", GrasshopperVersion="1.0.0007", InputGroups="{}", OutputGroups="{}", RelativeTolerance=0, RhinoVersion="7.30.23163.13001", UnitSystem=0, VersionCreated="1.16.1.0", VersionSaved="1.16.1.0"})

# ----
# Connection to Data base.
# It is important to keep the folder structure of the original file
panel = Panel("DB\JSON_data\24-03-07_V2_JSON")
c__grasshoppername = CSharpScript(inputName=panel)  # -> ghParentPath, filePath; inputs inputName: String
# ---------- c__grasshoppername: C# usings ----------
using System.IO;
# ---------- c__grasshoppername: C# ----------
    if(this.GrasshopperDocument.IsFilePathDefined)
    {
      string p = this.GrasshopperDocument.FilePath;
      DirectoryInfo directoryInfo = new DirectoryInfo(p);
      string parentFolderPath = directoryInfo.Parent.Parent.FullName;

      string filePath_ = string.Format("{0}\\{1}", parentFolderPath, inputName);

      ghParentPath = parentFolderPath;
      filePath = filePath_;

    }
# ---------- end c__grasshoppername ----------
c__grasshoppername_2 = CSharpScript(inputName="DB\Pictures_gruner_compressed")  # -> ghParentPath, filePath; inputs inputName: String; same code as c__grasshoppername
python = GhPythonScript(folder_path=c__grasshoppername.filePath)  # -> title, data
# ---------- python: Python ----------
import os
import json
import ghpythonlib.treehelpers as th

item_list = ['bauteil_obergruppe', 'bauteil_gruner', 'uuid', 'kosten', 'zustand', 'material', 'ref_gebauede_geschoss', 'breite', 'hoehe', 'tiefe', 'flaeche', 'masse', 'anzahl', 'foto1', 'foto2', 'co2', "kategorie"]

nameDict = {
"Befoerderungsanlage.json":"Befoerderungs_Anlage", #
"Bodenbelag.json":"Bodenbelag", #
"Deckenbekleidung.json":"Deckenbekleidung", #
"Deckenkonstruktion Dachkonstruktion.json":"Deckenkonstruktion", #
"Einbauten Schutzeinrichtung zu Ausbau.json":"Schutzeinrichtung", #
"Element in Aussenwand.json":"Aussenwand", #
"Element zu Dach.json":"ElementZuDach", #
"Fundament Bodenplatte.json":"Bodenplatte", #
#"Gastechnische Anlage.json":"Gastechnische_Anlage", 
"Gruenflaeche.json":"Gruenflaeche", #
"Kleininventar.json":"Kleininventar", #
"Lufttechnische Anlage.json":"Lufttechnische_Anlage", #
"Mobiliar.json":"Mobiliar", #
#"Sicherheitsanlage.json":"Sicherheit_Anlage", 
"Stuetzenkonstruktion.json":"Stuetzenkonstruktion", #
"Textilien.json":"Textilien", #
"Trennwand Innentuer Innentor.json":"Trennwand", #
"Waermetechnische Anlage.json":"Waermetechnische_Anlage", #
"Wandbekleidung.json":"Wandbekleidung", #
"Wandkonstruktion.json":"Wandkonstruktion", #
"Wassertechnische Anlage.json":"Wassertechnische_Anlage", #
"Weitere nutzungsspezifische Anlage.json":"Nutzungsspezifische_Anlage" #
}

def read_json_files(folder_path):
    # List to hold all items, with each item's sub-items as sub-lists
    all_items = []
    
    # Iterate over all files in the given folder
    for file_name in os.listdir(folder_path):
        # Check if the file is a JSON file
        if file_name.endswith('.json'):
            full_path = os.path.join(folder_path, file_name)
            
            # Read the JSON file
            with open(full_path, 'r') as json_file:
                data = json.load(json_file)
                
                # Assuming 'data' is a list of items
                for item in data:
                    # Add each item (and its sub-items, if any) to the list
                    
                    if file_name not in nameDict.keys():
                        continue
                    item["kategorie"] = nameDict[file_name]
                    temp = []
                    for key in item_list:
                        if key not in item.keys():
                            temp.append("FALSE")
                        else:
                            temp.append(item[key])
                    
                    all_items.append(temp)
    
    # Convert the list of lists into a data tree, with each top-level list as a branch
    return th.list_to_tree(all_items)

# Call the function and store the result
data = read_json_files(folder_path)

# The 'data_tree' can now be used as output in your Grasshopper Python component
title = item_list
# ---------- end python ----------
changeimgpath = ChangeImgPath(parent_folder=c__grasshoppername_2.filePath, relay=python.data)
cluster = Cluster_3(bauteil_obergruppe="Trennwand Innentuer Innentor", bauteil_obergruppe_2="Innentuer", data=changeimgpath)  # -> data_4, num_2
cluster_2 = Cluster_3(bauteil_obergruppe="Element in Aussenwand", bauteil_obergruppe_2="Fenster", data=changeimgpath)  # -> data_4, num_2
panel_2 = Panel(cluster.num_2)
panel_3 = Panel(cluster_2.num_2)
doordb = DoorDB(data=cluster.data_4)
windowdb = WindowDB(data=cluster_2.data_4)

cluster_3 = Cluster_3(bauteil_obergruppe="Trennwand Innentuer Innentor", bauteil_obergruppe_2="Innentuer", data=changeimgpath)  # -> data_4, num_2
panel_4 = Panel(cluster_3.num_2)
boarddb = BoardDB(data=cluster_3.data_4)

tilemockdata = TileMockData(num=Slider(200, range=0..1000))

# ----
# Wall_Normal Facade
# DataBase_Receiver
# Input available material from the database
windowdb_2 = Data(windowdb)
# Carrier and Openings
boarddb_2 = Data(boarddb)
doordb_2 = Data(doordb)
tiledb = Data(tilemockdata)  # disabled
db_collection = GhPythonScript(windowDB=windowdb_2, doorDB=doordb_2, tileDB=tiledb, boardDB=boarddb_2)  # -> out, allDB; inputs windowDB: list, doorDB: list, tileDB: list, boardDB: list
# ---------- db_collection: Python ----------
allDict = {}
allDict["windowDB"] = windowDB
allDict["doorDB"] = doorDB
allDict["tileDB"] = tileDB
allDict["boardDB"] = boardDB

class classForOutput:
    def __init__(self):
        pass

allData = classForOutput()
allData.all_DB = allDict

allDB = allData
# ---------- end db_collection ----------

# ----
# Module Setting
# You have three options for configuring the module:
# - No Interval or Curves: If you input no interval distance or curves for the
#  module, the system will generate a completed panel.
# - Interval Distance: By inputting an interval distance, the system will divide
#  the inner materials according to the specified intervals.
# - Curves: When you input curves, the system will split the inner materials
#  based on these curves.
# 
# ModuleCrvDist: Specify the seam width for walls segmented into modules
interval_distances_between_the_modules = Slider(200, range=0..1000)  # disabled
curves_splitting_the_modules = Curve([<curve referenced from the Rhino model> x4])

# ----
# Substructure Type Material
number_slider = Slider(30, range=20..50)
substructure_material = GhPythonScript(width=Slider(3, range=1..10), thickness=Slider(5, range=1..10), distance=number_slider, direction=Toggle(True))  # -> out, substruct_obj; inputs searchDB: Boolean, direction: Boolean
# ---------- substructure_material: Python ----------
fileName = "substructionDefinition.py"
folderName = "py"

import sys
import os
import Grasshopper

# Access the current Grasshopper document
gh_doc = ghenv.Component.OnPingDocument()

# Get the file path of the current document
file_path = gh_doc.FilePath

# Verify that the document has been saved and file_path is valid
if not file_path:
    raise ValueError("The Grasshopper document needs to be saved to access its path.")

# Construct the path to the external script
script_dir = os.path.dirname(file_path)  # One level up from the file
script_dir = os.path.dirname(script_dir)  # Two levels up from the file
script_path = os.path.join(script_dir, folderName, fileName)  # Path to the script

# Ensure the script directory is in sys.path
script_dir = os.path.dirname(script_path)
if script_dir not in sys.path:
    sys.path.append(script_dir)

# Read and execute the script safely
try:
    with open(script_path, 'r') as file:
        script_content = file.read()
        exec(script_content, globals())
except IOError:
    print("Failed to open or read the script file at {}".format(script_path))
except Exception as e:
    print("Error executing the script: {}".format(e))
# ---------- end substructure_material ----------

# ----
# Set brep containing
#  info from rhino
input_brep_for_the_inner_layers = Brep(<brep referenced from the Rhino model>)

# ----
# Set point for alignment
# of material
starting_point_for_the_division_of_the_f = Point(<point referenced from the Rhino model>)  # "Starting point for the division of the facade inner layers"

# ----
# Set surfaces or breps for carriers
brep = Brep([<brep referenced from the Rhino model> x3])

# ----
# Set surfaces or breps for windows.
# Search from DB
brep_2 = Brep([<brep referenced from the Rhino model> x3])

# ----
# Set informational breps for windows
brep_3 = Brep([<brep referenced from the Rhino model> x2])

# ----
# Set surfaces or breps for windows.
# Create customized windows.
# You can set objAttr for it.
brep_4 = Brep([<brep referenced from the Rhino model> x3])

# ----
# Set surfaces or breps for doors.
# Search from DB.
door_edyta = Brep([<brep referenced from the Rhino model> x2])

# ----
# Set informational breps for doors
brep_5 = Brep([<brep referenced from the Rhino model> x2])

# ----
# Set surfaces or breps for doors.
# Create customized doors.
# You can set objAttr for it.
brep_6 = Brep([<brep referenced from the Rhino model> x2])

# ----
# Board Type Material
geofromrh = GhPythonScript(brep=input_brep_for_the_inner_layers)  # -> out, newObj, width, height, depth; inputs brep: Guid
# ---------- geofromrh: Python ----------
import Rhino
import scriptcontext as sc
import rhinoscriptsyntax as rs
import Grasshopper.Kernel as ghkernel

class ObjFromRH:
    def __init__(self, **kwargs):
        for key, value in kwargs.items():
            setattr(self, key, value)


# Set scriptcontext.doc to Rhino's document to access its objects
sc.doc = Rhino.RhinoDoc.ActiveDoc

def get_attribute(object_id, key=None):
    """
    Get user text from an object by its ID.
    """
    if object_id is None:
        print("No object ID provided.")
        return None

    rhino_object = sc.doc.Objects.Find(object_id)
    if not rhino_object:
        print("Object not found.")
        return None

    if key:
        value = rhino_object.Attributes.GetUserString(key)
        print("User text for key '{}': {}".format(key, value))
        return value
    else:
        all_user_text = rhino_object.Attributes.GetUserStrings()
        objDict = {}
        for k in all_user_text.AllKeys:
            objDict[k] =  all_user_text[k]
        return objDict


if brep == None:
    ghenv.Component.AddRuntimeMessage(ghkernel.GH_RuntimeMessageLevel.Warning, "brep is empty.")
else:
    # To get user text
    obj_dict = get_attribute(brep)
    newObj = ObjFromRH(**obj_dict)
    
    
    width = get_attribute(brep, "breite")
    height = get_attribute(brep, "hoehe")
    depth = get_attribute(brep, "tiefe")
    
    width = width if width != "FALSE" else 1
    height = height if height != "FALSE" else 1
    depth = depth if depth != "FALSE" else 1
    
    width = int(width)
    height = int(height)
    depth = int(depth)
# ---------- end geofromrh ----------
# Board Type Material
# There are three methods available for setting up the board:
# - Input Information Geometry from Rhino: Once you bake geometry from the material
# menu, the geometries will contain information. You can then use this method to utilize
# the data embedded within the geometries.
# - Customize by Random Dimension: This method allows you to create customized
# material with dimensions. Ensure the toggle is set to False in the "SearchDB" input.
# You can then input attributes via "objAttr" to set the properties of this customized material.
# - Search from Database: To use this method, input your desired dimensions, and
# ensure the toggle is set to True in the "SearchDB" input. The system will then
# search the database for a suitable material that matches the specified dimensions.
toggle = BooleanToggle(True)
board_material = GhPythonScript(
    objAttr=geofromrh.newObj,
    width=geofromrh.width,
    length=geofromrh.height,
    thickness=geofromrh.depth,
    pt=starting_point_for_the_division_of_the_f,
    searchDB=Toggle(False),
    direction=toggle)  # -> out, board_obj; inputs pt: Point3d, searchDB: Boolean, direction: Boolean
# ---------- board_material: Python ----------
fileName = "boardDefinition.py"
folderName = "py"

import sys
import os
import Grasshopper

# Access the current Grasshopper document
gh_doc = ghenv.Component.OnPingDocument()

# Get the file path of the current document
file_path = gh_doc.FilePath

# Verify that the document has been saved and file_path is valid
if not file_path:
    raise ValueError("The Grasshopper document needs to be saved to access its path.")

# Construct the path to the external script
script_dir = os.path.dirname(file_path)  # One level up from the file
script_dir = os.path.dirname(script_dir)  # Two levels up from the file
script_path = os.path.join(script_dir, folderName, fileName)  # Path to the script

# Ensure the script directory is in sys.path
script_dir = os.path.dirname(script_path)
if script_dir not in sys.path:
    sys.path.append(script_dir)

# Read and execute the script safely
try:
    with open(script_path, 'r') as file:
        script_content = file.read()
        exec(script_content, globals())
except IOError:
    print("Failed to open or read the script file at {}".format(script_path))
except Exception as e:
    print("Error executing the script: {}".format(e))
# ---------- end board_material ----------

# ----
# Windows
createwindow = GhPythonScript(windowGeo=brep_4)  # -> out, newObj; inputs windowGeo: Brep
# ---------- createwindow: Python ----------
import Rhino.Geometry as rg
from copy import copy
from ghpythonlib.components import AlignPlane
import math
import Grasshopper.Kernel as ghkernel
import uuid


class ObjFromRH:
    def __init__(self, **kwargs):
        for key, value in kwargs.items():
            setattr(self, key, value)

run = True
if windowGeo == None:
    ghenv.Component.AddRuntimeMessage(ghkernel.GH_RuntimeMessageLevel.Warning, "Input windowGeo")
    run = False
if objAttr == None:
    attr_dict = {
    'bauteil_obergruppe': 'other_' + str(uuid.uuid4()),
    'bauteil_gruner': 'other_' + str(uuid.uuid4()),
    'uuid': 'board_uuid_' + str(uuid.uuid4()),
    'kosten': 'unknown',
    'zustand': 'unknown',
    'material': 'unknown',
    'ref_gebauede_geschoss': 'unknown',
    'breite': 'unknown',
    'hoehe': 'unknown',
    'tiefe': 'unknown',
    'flaeche': 'unknown',
    'masse': 'unknown',
    'anzahl': 'unknown',
    'foto1': 'unknown',
    'foto2': 'unknown',
    'co2': 'unknown',
    'url': 'unknown'}
    objAttr = ObjFromRH(**attr_dict)
    objAttr.attrDict = attr_dict




def alignToZ(targetPlane):
    finalPlane = copy(targetPlane)
    finalPlane = AlignPlane(finalPlane, rg.Vector3d.ZAxis)[0]
    finalPlane.Rotate(-math.pi/2, finalPlane.ZAxis, finalPlane.Origin)

    return finalPlane

def _sortPoints(points, surf):
    if isinstance(surf, rg.Surface) or isinstance(surf, rg.Brep):
        # Ensure surf is a Surface for the operations (if Brep, use its faces)
        if isinstance(surf, rg.Brep):
            surf = surf.Faces[0]

        area_properties = rg.AreaMassProperties.Compute(surf)
        if area_properties is not None:
            centroid = area_properties.Centroid
            success, uvPU, uvPV = surf.ClosestPoint(centroid)
            if success:
                success, surf_Frame = surf.FrameAt(uvPU, uvPV)
                surf_Frame = alignToZ(surf_Frame)

            else:
                print("Failed to find the closest point on the surface.")
        else:
            print("Failed to compute area properties.")
    else:
        print("The input 'surf' is not a valid surface or brep.")


    rTo = rg.Transform.ChangeBasis(rg.Plane.WorldXY, surf_Frame)
    rFro = rg.Transform.ChangeBasis(surf_Frame, rg.Plane.WorldXY)
    
    for pt in points:
        pt.Transform(rTo)
        if pt.X>0 and pt.Y>0:
            pt.Transform(rFro)
            pointHighFirst = pt
        elif pt.X<0 and pt.Y>0:
            pt.Transform(rFro)
            pointHighSecond = pt
        elif pt.X>0 and pt.Y<0:
            pt.Transform(rFro)
            pointLowFirst = pt
        elif pt.X<0 and pt.Y<0:
            pt.Transform(rFro)
            pointLowSecond = pt
    surf_Frame.Rotate(math.pi/2, surf_Frame.ZAxis)
    return (pointLowSecond, pointHighSecond, pointLowFirst, pointHighFirst, surf_Frame)

if run:
    ptList = [vertex.Location for vertex in windowGeo.Vertices]
    ptList = _sortPoints(ptList, windowGeo)
    height = int(ptList[0].DistanceTo(ptList[1]))
    width = int(ptList[0].DistanceTo(ptList[2]))
    
    newObj = copy(objAttr)
    if objAttr.hoehe == "unknown":
        objAttr.hoehe = height
        objAttr.attrDict['hoehe'] = height
        newObj.hoehe = height
    if abs(height - float(objAttr.hoehe))>1:
        ghenv.Component.AddRuntimeMessage(ghkernel.GH_RuntimeMessageLevel.Warning, "Height is not match. We will take Geometry dimension")
        newObj.hoehe = height
        objAttr.attrDict['hoehe'] = height
    
    if objAttr.breite == "unknown":
        objAttr.breite = width
        objAttr.attrDict['breite'] = width
        newObj.breite = width
    if abs(width - float(objAttr.breite))>1:
        ghenv.Component.AddRuntimeMessage(ghkernel.GH_RuntimeMessageLevel.Warning, "Width is not match. We will take Geometry dimension")
        newObj.breite = width
        objAttr.attrDict['breite'] = width
    
    newObj.geo = windowGeo
    newObj.attr = objAttr.attrDict
    if hasattr(newObj, 'attrDict'):
        delattr(newObj, 'attrDict')
# ---------- end createwindow ----------
windowinfogeo = GhPythonScript(brep=brep_3)  # -> out, newObj, width, height, depth; inputs brep: Guid
# ---------- windowinfogeo: Python ----------
import Rhino
import scriptcontext as sc
import rhinoscriptsyntax as rs
import Grasshopper.Kernel as ghkernel

class ObjFromRH:
    def __init__(self, **kwargs):
        for key, value in kwargs.items():
            setattr(self, key, value)


# Set scriptcontext.doc to Rhino's document to access its objects
sc.doc = Rhino.RhinoDoc.ActiveDoc

def get_attribute(object_id, key=None):
    """
    Get user text from an object by its ID.
    """
    if object_id is None:
        print("No object ID provided.")
        return None

    rhino_object = sc.doc.Objects.Find(object_id)
    if not rhino_object:
        print("Object not found.")
        return None

    if key:
        value = rhino_object.Attributes.GetUserString(key)
        print("User text for key '{}': {}".format(key, value))
        return value
    else:
        all_user_text = rhino_object.Attributes.GetUserStrings()
        objDict = {}
        for k in all_user_text.AllKeys:
            objDict[k] =  all_user_text[k]
        
        objDict["geo"] = rhino_object.Geometry
        return objDict


if brep == None:
    ghenv.Component.AddRuntimeMessage(ghkernel.GH_RuntimeMessageLevel.Warning, "brep is empty.")
else:
    # To get user text
    obj_dict = get_attribute(brep)
    newObj = ObjFromRH(**obj_dict)
    newObj.attr = obj_dict
    
    
    
    width = get_attribute(brep, "breite")
    height = get_attribute(brep, "hoehe")
    depth = get_attribute(brep, "tiefe")
    
    width = width if width != "FALSE" else 1
    height = height if height != "FALSE" else 1
    depth = depth if depth != "FALSE" else 1
    
    width = int(width)
    height = int(height)
    depth = int(depth)
# ---------- end windowinfogeo ----------
brep_windows = Brep(brep_2)
data = Data(createwindow.newObj)
data_2 = Data(windowinfogeo.newObj)
merge = Merge(Data1=brep_windows, Data2=data_2, Data3=data)

# ----
# Doors
createdoor = GhPythonScript(doorGeo=brep_6)  # -> out, newObj; inputs doorGeo: Brep
# ---------- createdoor: Python ----------
import Rhino.Geometry as rg
from copy import copy
from ghpythonlib.components import AlignPlane
import math
import Grasshopper.Kernel as ghkernel
import uuid


class ObjFromRH:
    def __init__(self, **kwargs):
        for key, value in kwargs.items():
            setattr(self, key, value)

run = True
if doorGeo == None:
    ghenv.Component.AddRuntimeMessage(ghkernel.GH_RuntimeMessageLevel.Warning, "Input doorGeo")
    run = False
if objAttr == None:
    attr_dict = {
    'bauteil_obergruppe': 'other_' + str(uuid.uuid4()),
    'bauteil_gruner': 'other_' + str(uuid.uuid4()),
    'uuid': 'board_uuid_' + str(uuid.uuid4()),
    'kosten': 'unknown',
    'zustand': 'unknown',
    'material': 'unknown',
    'ref_gebauede_geschoss': 'unknown',
    'breite': 'unknown',
    'hoehe': 'unknown',
    'tiefe': 'unknown',
    'flaeche': 'unknown',
    'masse': 'unknown',
    'anzahl': 'unknown',
    'foto1': 'unknown',
    'foto2': 'unknown',
    'co2': 'unknown',
    'url': 'unknown'}
    objAttr = ObjFromRH(**attr_dict)
    objAttr.attrDict = attr_dict




def alignToZ(targetPlane):
    finalPlane = copy(targetPlane)
    finalPlane = AlignPlane(finalPlane, rg.Vector3d.ZAxis)[0]
    finalPlane.Rotate(-math.pi/2, finalPlane.ZAxis, finalPlane.Origin)

    return finalPlane

def _sortPoints(points, surf):
    if isinstance(surf, rg.Surface) or isinstance(surf, rg.Brep):
        # Ensure surf is a Surface for the operations (if Brep, use its faces)
        if isinstance(surf, rg.Brep):
            surf = surf.Faces[0]

        area_properties = rg.AreaMassProperties.Compute(surf)
        if area_properties is not None:
            centroid = area_properties.Centroid
            success, uvPU, uvPV = surf.ClosestPoint(centroid)
            if success:
                success, surf_Frame = surf.FrameAt(uvPU, uvPV)
                surf_Frame = alignToZ(surf_Frame)

            else:
                print("Failed to find the closest point on the surface.")
        else:
            print("Failed to compute area properties.")
    else:
        print("The input 'surf' is not a valid surface or brep.")


    rTo = rg.Transform.ChangeBasis(rg.Plane.WorldXY, surf_Frame)
    rFro = rg.Transform.ChangeBasis(surf_Frame, rg.Plane.WorldXY)
    
    for pt in points:
        pt.Transform(rTo)
        if pt.X>0 and pt.Y>0:
            pt.Transform(rFro)
            pointHighFirst = pt
        elif pt.X<0 and pt.Y>0:
            pt.Transform(rFro)
            pointHighSecond = pt
        elif pt.X>0 and pt.Y<0:
            pt.Transform(rFro)
            pointLowFirst = pt
        elif pt.X<0 and pt.Y<0:
            pt.Transform(rFro)
            pointLowSecond = pt
    surf_Frame.Rotate(math.pi/2, surf_Frame.ZAxis)
    return (pointLowSecond, pointHighSecond, pointLowFirst, pointHighFirst, surf_Frame)

if run:
    ptList = [vertex.Location for vertex in doorGeo.Vertices]
    ptList = _sortPoints(ptList, doorGeo)
    height = int(ptList[0].DistanceTo(ptList[1]))
    width = int(ptList[0].DistanceTo(ptList[2]))
    
    newObj = copy(objAttr)
    if objAttr.hoehe == "unknown":
        objAttr.hoehe = height
        objAttr.attrDict['hoehe'] = height
        newObj.hoehe = height
    if abs(height - float(objAttr.hoehe))>1:
        ghenv.Component.AddRuntimeMessage(ghkernel.GH_RuntimeMessageLevel.Warning, "Height is not match. We will take Geometry dimension")
        newObj.hoehe = height
        objAttr.attrDict['hoehe'] = height
    
    if objAttr.breite == "unknown":
        objAttr.breite = width
        objAttr.attrDict['breite'] = width
        newObj.breite = width
    if abs(width - float(objAttr.breite))>1:
        ghenv.Component.AddRuntimeMessage(ghkernel.GH_RuntimeMessageLevel.Warning, "Width is not match. We will take Geometry dimension")
        newObj.breite = width
        objAttr.attrDict['breite'] = width
    
    newObj.geo = doorGeo
    newObj.attr = objAttr.attrDict
    if hasattr(newObj, 'attrDict'):
        delattr(newObj, 'attrDict')
# ---------- end createdoor ----------
doorinfogeo = GhPythonScript(brep=brep_5)  # -> out, newObj, width, height, depth; inputs brep: Guid
# ---------- doorinfogeo: Python ----------
import Rhino
import scriptcontext as sc
import rhinoscriptsyntax as rs
import Grasshopper.Kernel as ghkernel

class ObjFromRH:
    def __init__(self, **kwargs):
        for key, value in kwargs.items():
            setattr(self, key, value)


# Set scriptcontext.doc to Rhino's document to access its objects
sc.doc = Rhino.RhinoDoc.ActiveDoc

def get_attribute(object_id, key=None):
    """
    Get user text from an object by its ID.
    """
    if object_id is None:
        print("No object ID provided.")
        return None

    rhino_object = sc.doc.Objects.Find(object_id)
    if not rhino_object:
        print("Object not found.")
        return None

    if key:
        value = rhino_object.Attributes.GetUserString(key)
        print("User text for key '{}': {}".format(key, value))
        return value
    else:
        all_user_text = rhino_object.Attributes.GetUserStrings()
        objDict = {}
        for k in all_user_text.AllKeys:
            objDict[k] =  all_user_text[k]
        
        objDict["geo"] = rhino_object.Geometry
        return objDict


if brep == None:
    ghenv.Component.AddRuntimeMessage(ghkernel.GH_RuntimeMessageLevel.Warning, "brep is empty.")
else:
    # To get user text
    obj_dict = get_attribute(brep)
    newObj = ObjFromRH(**obj_dict)
    newObj.attr = obj_dict
    
    
    width = get_attribute(brep, "breite")
    height = get_attribute(brep, "hoehe")
    depth = get_attribute(brep, "tiefe")
    
    width = width if width != "FALSE" else 1
    height = height if height != "FALSE" else 1
    depth = depth if depth != "FALSE" else 1
    
    width = int(width)
    height = int(height)
    depth = int(depth)
# ---------- end doorinfogeo ----------
brep_doors = Brep(door_edyta)
data_3 = Data(doorinfogeo.newObj)
data_4 = Data(createdoor.newObj)
merge_2 = Merge(Data1=brep_doors, Data2=data_3, Data3=data_4)

# ----
# Substructure with Infill Type Material
number_slider_2 = Slider(50, range=20..50)
substruct_infill_material = GhPythonScript(width=Slider(2, range=1..10), thickness=Slider(5, range=1..10), distance=number_slider_2, direction=Toggle(True))  # -> out, substructInfill_obj; inputs searchDB: Boolean, direction: Boolean
# ---------- substruct_infill_material: Python ----------
fileName = "structAndFillDefinition.py"
folderName = "py"

import sys
import os
import Grasshopper

# Access the current Grasshopper document
gh_doc = ghenv.Component.OnPingDocument()

# Get the file path of the current document
file_path = gh_doc.FilePath

# Verify that the document has been saved and file_path is valid
if not file_path:
    raise ValueError("The Grasshopper document needs to be saved to access its path.")

# Construct the path to the external script
script_dir = os.path.dirname(file_path)  # One level up from the file
script_dir = os.path.dirname(script_dir)  # Two levels up from the file
script_path = os.path.join(script_dir, folderName, fileName)  # Path to the script

# Ensure the script directory is in sys.path
script_dir = os.path.dirname(script_path)
if script_dir not in sys.path:
    sys.path.append(script_dir)

# Read and execute the script safely
try:
    with open(script_path, 'r') as file:
        script_content = file.read()
        exec(script_content, globals())
except IOError:
    print("Failed to open or read the script file at {}".format(script_path))
except Exception as e:
    print("Error executing the script: {}".format(e))
# ---------- end substruct_infill_material ----------

# ----
# Substructure Type Material
number_slider_3 = Slider(30, range=20..50)
substructure_material_2 = GhPythonScript(width=Slider(3, range=1..10), thickness=Slider(5, range=1..10), distance=number_slider_3, direction=Toggle(False))  # -> out, substruct_obj; inputs searchDB: Boolean, direction: Boolean; same code as substructure_material

# ----
# Set brep containing
#  info from rhino
input_brep_for_the_inner_layers_2 = Brep(<brep referenced from the Rhino model>)

# ----
# Paint Type Material
panel_5 = Panel("0.5")
paint_material = GhPythonScript(thickness=panel_5)  # -> out, paint_obj
# ---------- paint_material: Python ----------
fileName = "paintDefinition.py"
folderName = "py"

import sys
import os
import Grasshopper

# Access the current Grasshopper document
gh_doc = ghenv.Component.OnPingDocument()

# Get the file path of the current document
file_path = gh_doc.FilePath

# Verify that the document has been saved and file_path is valid
if not file_path:
    raise ValueError("The Grasshopper document needs to be saved to access its path.")

# Construct the path to the external script
script_dir = os.path.dirname(file_path)  # One level up from the file
script_dir = os.path.dirname(script_dir)  # Two levels up from the file
script_path = os.path.join(script_dir, folderName, fileName)  # Path to the script

# Ensure the script directory is in sys.path
script_dir = os.path.dirname(script_path)
if script_dir not in sys.path:
    sys.path.append(script_dir)

# Read and execute the script safely
try:
    with open(script_path, 'r') as file:
        script_content = file.read()
        exec(script_content, globals())
except IOError:
    print("Failed to open or read the script file at {}".format(script_path))
except Exception as e:
    print("Error executing the script: {}".format(e))
# ---------- end paint_material ----------

# ----
# Carriers
brep_facade_outline = Brep(brep)

# ----
# Cladding Normal Type
# Here are the settings for the outer material components.
# The material components are the same as the one used in inner material part.
merge_3 = Merge(Data1=substructure_material.substruct_obj, Data2=board_material.board_obj)

# ----
# InnerMaterial Setting
# Here are the settings for the inner material components. We have four distinct types
# available: board, substructure, substructure with infill, and paint, each representing a
# different kind of material. You can modify their order or use them repeatedly to create
# various combinations for constructing the inner material part.
number_slider_4 = Slider(999, range=0..1000)
number_slider_5 = Slider(248, range=200..400)
number_slider_6 = Slider(3, range=3..10)
number_slider_7 = Slider(57, range=50..100)
# Set point for alignment
# of material
starting_point_for_the_division_of_the_f_2 = Point(<point referenced from the Rhino model>)  # "Starting point for the division of the facade inner layers"
objattr = GhPythonScript(
    bauteil_obergruppe="NameTheBauteilObergruppe",
    bauteil_gruner="NameTheBauteilGruner",
    uuid="Random_customized_uuid",
    breite=number_slider_7,
    hoehe=number_slider_5,
    tiefe=number_slider_6,
    anzahl=number_slider_4)  # -> newObj; inputs anzahl: Int32
# ---------- objattr: Python ----------
import uuid as uu

class customizedObj:
    def __init__(self, **kwargs):
        for key, value in kwargs.items():
            setattr(self, key, value)


variables = {
    'bauteil_obergruppe': bauteil_obergruppe,
    'bauteil_gruner': bauteil_gruner,
    'uuid': uuid,
    'kosten': kosten,
    'zustand': zustand,
    'material': material,
    'ref_gebauede_geschoss': ref_gebauede_geschoss,
    'breite': breite,
    'hoehe': hoehe,
    'tiefe': tiefe,
    'flaeche': flaeche,
    'masse': masse,
    'anzahl': anzahl,
    'foto1': foto1,
    'foto2': foto2,
    'co2': co2,
    'url': url,
}

# Update each variable in the dictionary if it's None
for key in variables:
    if variables[key] is None:
        variables[key] = "unknown"
        if key == 'uuid':
            variables[key] = "customizedObj_" + str(uu.uuid4())



newObj = customizedObj(**variables)
newObj.attrDict = variables
# ---------- end objattr ----------

# ----
# Method 3:
# Search from DB by inputing dimension
number_slider_8 = Slider(2, range=2..10)
board_material_2 = GhPythonScript(
    width=Slider(69, range=50..150),
    length=Slider(200, range=200..400),
    thickness=number_slider_8,
    pt=starting_point_for_the_division_of_the_f_2,
    searchDB=Toggle(True),
    direction=Toggle(True))  # -> out, board_obj; inputs pt: Point3d, searchDB: Boolean, direction: Boolean; same code as board_material

# ----
# Method 2:
# Customize by random dimension
toggle_2 = BooleanToggle(False)
board_material_3 = GhPythonScript(
    objAttr=objattr,
    width=number_slider_7,
    length=number_slider_5,
    thickness=number_slider_6,
    pt=starting_point_for_the_division_of_the_f_2,
    searchDB=toggle_2,
    direction=Toggle(True))  # -> out, board_obj; inputs pt: Point3d, searchDB: Boolean, direction: Boolean; same code as board_material

# ----
# Method 1:
# Input information Geometry from rhino
geofromrh_2 = GhPythonScript(brep=input_brep_for_the_inner_layers_2)  # -> out, newObj, width, height, depth; inputs brep: Guid; same code as geofromrh
board_material_4 = GhPythonScript(
    objAttr=geofromrh_2.newObj,
    width=geofromrh_2.width,
    length=geofromrh_2.height,
    thickness=geofromrh_2.depth,
    pt=starting_point_for_the_division_of_the_f_2,
    searchDB=Toggle(False),
    direction=Toggle(True))  # -> out, board_obj; inputs pt: Point3d, searchDB: Boolean, direction: Boolean; same code as board_material

entwine = Entwine(
    Branch00=board_material_4.board_obj,
    Branch01=substructure_material_2.substruct_obj,
    Branch02=board_material_3.board_obj,
    Branch03=substruct_infill_material.substructInfill_obj,
    Branch04=board_material_2.board_obj,
    Branch05=paint_material.paint_obj,
    FlattenInputs=True)  # -> flatten(Result)

# ----
# Cladding Engine
# The core process for calculating the normal facade. Inputting too many carriers at once can significantly
# increase processing time. Therefore, I recommend testing and adjusting with just one carrier initially
# before proceeding to input all carriers. This approach will help optimize the setup and ensure
# accuracy in the calculations.
toggle_3 = BooleanToggle(False)
normalfacade = GhPythonScript(
    Database_collection=db_collection.allDB,
    Carrier_Geometry=brep_facade_outline,
    Window_Geometry=merge,
    Door_Geometry=merge_2,
    setTile=merge_3,
    claddingDirection=toggle_3,
    material_collection=entwine,
    moduleDistance=interval_distances_between_the_modules,
    moduleCurve=curves_splitting_the_modules,
    moduleCrvDist=Slider(15, range=10..30),
    init=Button())  # -> out, oRuler, oVisualObj, allTypeMaterialModule, oMatRecordObj; inputs Carrier_Geometry: list of Brep, Window_Geometry: list, Door_Geometry: list, setTile: list, claddingDirection: Boolean, material_collection: list, moduleCurve: list of Curve
#   port Database_collection: Input a database collection (DB_Collection) to access the material database
#   port Carrier_Geometry: Geometry for carriers. You need to input geometry (Brep) of walls or roofs
#   port Window_Geometry: Input window geometry (Brep) or Rhino objects (newObj from windowFromRH)
#   port Door_Geometry: Input door geometry (Brep) or Rhino objects (newObj from doorFromRH)
#   port setTile: Configure settings for tiles or facades. Input customized tiles (customizeTile), database tiles (searchDBTile) for tile mode, or material collections for facade mode
#   port claddingDirection: Boolean to determine the direction of cladding
#   port material_collection: Input the collection of materials for the interior
#   port moduleDistance: Specify the module width to determine intervals for wall segmentation.
#   port moduleCurve: Input curves to define how walls are segmented into modules
#   port moduleCrvDist: Specify the seam width for walls segmented into modules
#   port allTypeMaterialModule: Visual representation of wall modules. Connect this output to the module visualization component
# ---------- normalfacade: Python ----------
fileName = "wallDefinition3.py"
folderName = "py"

import sys
import os
import Grasshopper

# Access the current Grasshopper document
gh_doc = ghenv.Component.OnPingDocument()

# Get the file path of the current document
file_path = gh_doc.FilePath

# Verify that the document has been saved and file_path is valid
if not file_path:
    raise ValueError("The Grasshopper document needs to be saved to access its path.")

# Construct the path to the external script
script_dir = os.path.dirname(file_path)  # One level up from the file
script_dir = os.path.dirname(script_dir)  # Two levels up from the file
script_path = os.path.join(script_dir, folderName, fileName)  # Path to the script

# Ensure the script directory is in sys.path
script_dir = os.path.dirname(script_path)
if script_dir not in sys.path:
    sys.path.append(script_dir)

# Read and execute the script safely
try:
    with open(script_path, 'r') as file:
        script_content = file.read()
        exec(script_content, globals())
except IOError:
    print("Failed to open or read the script file at {}".format(script_path))
except Exception as e:
    print("Error executing the script: {}".format(e))
# ---------- end normalfacade ----------
crv = Curve(normalfacade.oRuler)
panel_6 = Panel(normalfacade.out)

# ----
# Show materials used from the data base
# This block is designed to monitor the material usage in your model, displaying
# the status information and attributes of the used materials. To access the user
# interface, click the "open" toggle. The "showType" option offers three
# categories—opening, innerMaterial, and outerMaterial—which you can select to
# display in the UI. The "showDes" toggle determines whether the attributes of
# the materials are visible. You can also customize the dimensions of the display
#  window using "windHeight" and "rowNum" to adjust the window height and the
#  number of rows, respectively. In the "chosenItem" section, select the items you
# wish to display in the UI.
panel_7 = Panel("py\UI_usedMaterial2.py")
list = ValueList({"bauteil_obergruppe", "bauteil_gruner", "uuid", "kosten", "zustand", "material", "ref_gebauede_geschoss", "breite", "hoehe", "tiefe", "flaeche", "masse", "anzahl"}, selected=["bauteil_obergruppe", "bauteil_gruner", "uuid", "material", "breite", "hoehe", "tiefe", "anzahl"])
c__grasshoppername_3 = CSharpScript(inputName=panel_7)  # -> ghParentPath, filePath; inputs inputName: String; same code as c__grasshoppername
list_2 = ValueList({"InnerMaterial": "innerMaterial", "outerMaterial", "Opening": "opening"}, selected="Opening")
file = ReadFile(File=c__grasshoppername_3.filePath, PerLineParse=False)
chosenitem = Data(list)
winheight = Data(Slider(8, range=6..10, expression="x*100"))
openui = Data(Toggle(False))
showdata = Data(normalfacade.oMatRecordObj)
rownum = Data(Slider(4, range=0..10))
python_2 = GhPythonScript(
    Code=file,
    Open=openui,
    ShowType=list_2,
    ShowDes=Toggle(True),
    WinHeight=winheight,
    RowNum=rownum,
    ChosenItem=chosenitem,
    ShowData=flatten(showdata))
panel_8 = Panel(python_2)

# ----
# Material Visualization and Bake
# You should input visualObj into this block. Here, you can assign
# different bakeNames, and all the baked objects will be organized
# under a newly created layer named after the bakeName.
# Additionally, you can use the explodeDist parameter to control
# the explosion effect of walls.
number_slider_9 = Slider(0, range=0..100)
button = Button()
normalfacadeviewer = NormalFacadeViewer(
    b=button,
    username="Kevin",
    relay=flatten(normalfacade.oVisualObj),
    relay_2=Slider(0, range=0..100),
    relay_3=number_slider_9)  # -> R_2, R, movegeo, D, crv_3, s_0, s_0_2, door_2, window_2
bake = BakeGeometry(Bake=button, Geometry=normalfacadeviewer.R_2, Attributes=normalfacadeviewer.R, DeleteOldBakes=False, PreserveTrees=False)
preview = CustomPreview(Geometry=normalfacadeviewer.s_0, Material=graft(normalfacadeviewer.s_0_2))
previewlw = CustomPreviewLineweights(
    Geometry=[normalfacadeviewer.door_2, normalfacadeviewer.window_2],
    Shader=ColourSwatch(SwatchColor=RGB(0, 255, 238)),
    Thickness=Slider(4, range=0..10),
    Absolute=False)
previewmat = CustomPreviewMaterials(Geometry=normalfacadeviewer.movegeo, DiffuseColor=normalfacadeviewer.D)
previewlw_2 = CustomPreviewLineweights(Geometry=normalfacadeviewer.crv_3, Shader=ColourSwatch(SwatchColor=RGB(0, 0, 0)), Absolute=False)

# ==== cluster NormalFacadeViewer
# This component is the visualization of normal facade style.
# This one can input mutiple wall information
relay = ClusterInput()
relay_2 = ClusterInput()
relay_3 = ClusterInput()
python = GhPythonScript(visualObj=relay)  # -> out, comb, tileGeometry, allTypeMaterial, substructureGeo, wallFrame, offsetCladdingDist, doorGeo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; inputs visualObj: list
# ---------- python: Python ----------
from Grasshopper.Kernel.Data import GH_Path
from Grasshopper import DataTree
import System.Array as array
import ghpythonlib.treehelpers as th

attrList = ['comb', 'tileGeometry', 'allTypeMaterial', 'substructureGeo', 'wallFrame', 'offsetCladdingDist', 'doorGeo', 'windowGeo', 'usedMatDict', 'visualEmpty']
for name in attrList:
    globals()[name] = DataTree[object]()

for i, obj in enumerate(visualObj):
    def treeGenerate(obj, name):
        data = getattr(obj, name)
        
        if isinstance(data, DataTree[object]):
            for j, (d, pList) in enumerate(zip(data.Branches, data.Paths)):
                pList[0] = i
                path = GH_Path(array[int](list(pList)))
                globals()[name].AddRange(d, path)
                
        elif isinstance(data, list):
            path = GH_Path(array[int]([i]))
            globals()[name].AddRange(data, path)
        
        elif len([data])==1:
            path = GH_Path(array[int]([i]))
            globals()[name].AddRange([data], path)
            
        
    for n in attrList:
        treeGenerate(obj, n)
# ---------- end python ----------
item = ListItem(List=flatten(python.visualEmpty), Index=0, Wrap=True)
deplane = DeconstructPlane(Plane=python.wallFrame)  # -> Origin, XAxis, YAxis, ZAxis
neg = Negative(Value=deplane.ZAxis)
amp = Amplitude(Vector=neg, Amplitude=python.offsetCladdingDist)
lng = ListLength(List=flatten(python.wallFrame))
tstat = TreeStatistics(Tree=python.allTypeMaterial)  # -> Paths, Length, Count
division = Division(A=tstat.Count, B=lng)
python_2 = GhPythonScript(x=python.allTypeMaterial)  # -> out, a
# ---------- python_2: Python ----------
a =x
# ---------- end python_2 ----------
series = Series(Start=0, Step=relay_2, Count=expr("x+1", division))
series_2 = Series(Start=0, Step=1, Count=division)
python_3 = GhPythonScript(x=series)  # -> out, a, b; inputs x: list
# ---------- python_3: Python ----------
a = x[:-1]
b = x[-1]
# ---------- end python_3 ----------
deplane_2 = DeconstructPlane(Plane=python.wallFrame)  # -> Origin, XAxis, YAxis, ZAxis
python_4 = GhPythonScript(x=python.tileGeometry)  # -> out, a; same code as python_2
item_2 = ListItem(List=flatten(python.comb), Index=0, Wrap=True)
move_ver1 = GhPythonScript(geoData=python_2.a, vecData=amp)  # -> out, moveGeo; inputs geoData: tree of Brep, vecData: tree
# ---------- move_ver1: Python ----------
import Rhino.Geometry as rg
from Grasshopper.Kernel.Data import GH_Path
from Grasshopper import DataTree
import System.Array as array
import ghpythonlib.treehelpers as th

moveGeo = DataTree[object]()
for geoList, path in zip(geoData.Branches, geoData.Paths):
    n = path[0]
    vec = vecData.Branches[n][0]
    matrix = rg.Transform.Translation(vec)

    for geo in geoList:
        geo.Transform(matrix)
    
    moveGeo.AddRange(geoList, path)
# ---------- end move_ver1 ----------
null = NullItem(Item=item_2)  # -> NullFlags, InvalidFlags, Description
openingdist = Data(relay_3)
geo = Geometry(python.doorGeo)
geo_2 = Geometry(python.windowGeo)
cladding_catergory = CladdingCatergory(data=python.comb, geo=python.tileGeometry)  # -> geo_5, data_4; disabled
gradient = Gradient(
    LowerLimit="0",
    UpperLimit=division,
    Parameter=series_2,
    stops=[0: RGB(234, 38, 0), 0.25: RGB(234, 126, 0), 0.5: RGB(254, 244, 84), 0.75: RGB(173, 203, 249), 1: RGB(75, 107, 169)])
pshift = ShiftPaths(Data=move_ver1.moveGeo, Offset=-1)
amp_2 = Amplitude(Vector=deplane_2.ZAxis, Amplitude=python_3.a)
pln = Plane(python.wallFrame)
panel = Panel("""bauteil_obergruppe
bauteil_gruner
uuid
kosten
zustand
material
ref_gebauede_geschoss
breite
hoehe
tiefe
flaeche
masse
anzahl
foto1
foto2
co2
url""")
amp_3 = Amplitude(Vector=deplane_2.ZAxis, Amplitude=python_3.b)  # -> graft(Vector)
tstat_2 = TreeStatistics(Tree=cladding_catergory.geo_5)  # -> Paths, Length, Count
filter = StreamFilter(Gate=null.NullFlags, Stream0=cladding_catergory.geo_5, Stream1=python_4.a)
filter_2 = StreamFilter(Gate=null.NullFlags, Stream0=cladding_catergory.geo_5, Stream1=python_4.a)
move_ver2 = GhPythonScript(geoData=pshift, vecData=amp_2)  # -> out, moveGeo; inputs geoData: tree of Brep, vecData: tree
# ---------- move_ver2: Python ----------
import Rhino.Geometry as rg
from Grasshopper.Kernel.Data import GH_Path
from Grasshopper import DataTree
import System.Array as array
import ghpythonlib.treehelpers as th

moveGeo = DataTree[object]()
for geoList, path in zip(geoData.Branches, geoData.Paths):
    wallNum = path[0]
    layerNum = path[path.Length-1]
    vec = vecData.Branches[wallNum]
    matrix = rg.Transform.Translation(vec[layerNum])

    for geo in geoList:
        geo.Transform(matrix)
    
    moveGeo.AddRange(geoList, path)
# ---------- end move_ver2 ----------
deplane_3 = DeconstructPlane(Plane=pln)  # -> Origin, XAxis, YAxis, ZAxis
tstat_3 = TreeStatistics(Tree=filter)  # -> Paths, Length, Count
dup = DuplicateData(Data=gradient, Number=lng, Order=True)  # -> graft(Data)
amp_4 = Amplitude(Vector=deplane_3.ZAxis, Amplitude=openingdist)
move_ver1_2 = GhPythonScript(geoData=filter_2, vecData=amp)  # -> out, moveGeo; inputs geoData: tree of Brep, vecData: tree; same code as move_ver1
division_2 = Division(A=tstat_2.Count, B=lng)
username = ClusterInput()
b = ClusterInput()
division_3 = Division(A=tstat_3.Count, B=lng)
move = Move(Geometry=python.substructureGeo, Motion=amp)  # -> Geometry, Transform
move_ver1_3 = GhPythonScript(geoData=geo, vecData=amp_4)  # -> out, moveGeo; inputs geoData: tree of Brep, vecData: tree; same code as move_ver1
move_ver1_4 = GhPythonScript(geoData=geo_2, vecData=amp_4)  # -> out, moveGeo; inputs geoData: tree of Brep, vecData: tree; same code as move_ver1
edges = BrepEdges(Brep=move_ver2.moveGeo)  # -> Naked, Interior, NonManifold
series_3 = Series(Start=0, Step=1, Count=division_3)  # -> graft(Series)
move_ver1_5 = GhPythonScript(geoData=move_ver1_2.moveGeo, vecData=amp_3)  # -> out, moveGeo; inputs geoData: tree of Brep, vecData: tree; same code as move_ver1
move_2 = Move(Geometry=move.Geometry, Motion=amp_3)  # -> Geometry, Transform
geo_3 = Geometry(move_ver1_5.moveGeo)
crv = Curve([edges.Interior, edges.Naked])
geo_4 = Geometry(move_ver2.moveGeo)
filter_3 = StreamFilter(Gate=null.NullFlags, Stream0=division_2, Stream1=division_3)
filter_4 = StreamFilter(Gate=null.NullFlags, Stream0=cladding_catergory.data_4, Stream1=series_3)
move_ver1_6 = GhPythonScript(geoData=move_ver1_3.moveGeo, vecData=amp)  # -> out, moveGeo; inputs geoData: tree of Brep, vecData: tree; same code as move_ver1
move_ver1_7 = GhPythonScript(geoData=move_ver1_4.moveGeo, vecData=amp)  # -> out, moveGeo; inputs geoData: tree of Brep, vecData: tree; same code as move_ver1
geo_5 = Geometry(move_2.Geometry)
filter_5 = StreamFilter(Gate=item, Stream0=geo_4)
geo_6 = Geometry(filter_5)
python_5 = GhPythonScript(usedMatDict=python.usedMatDict, innerMatGeo=geo_6, normalGeo=geo_3, dataItems=panel, userName=username)  # -> out, innerLayerNameTree, innerLayerDataTree, normalLayerNameTree, normalLayerDataTree; inputs usedMatDict: tree, innerMatGeo: tree, normalGeo: tree, dataItems: list
# ---------- python_5: Python ----------
#print(usedMatDict.Branches[0][0]['outerMaterial']['matInfo'])
#print(usedMatDict.Branches[0][0]['innerMaterial'][0][0]['info'])
#print(usedMatDict.Branches[0][0]['window'])
#print(usedMatDict.Branches[0][0]['door'])

from Grasshopper.Kernel.Data import GH_Path
from Grasshopper import DataTree
import System.Array as array

if userName == None:
    userName = ""

innerLayerNameTree = DataTree[object]()
innerLayerDataTree = DataTree[object]()
normalLayerNameTree = DataTree[object]()
normalLayerDataTree = DataTree[object]()

for layerId in innerMatGeo.Paths:
    infoObj = usedMatDict.Branches[0][0]['innerMaterial'][layerId[2]][0]['info']
    bauteil_obergruppe = infoObj.bauteil_obergruppe
    bauteil_gruner = infoObj.bauteil_gruner
    layerName = userName + ":innerMaterial:" + "layer_" + str(layerId[2]) + ":" + bauteil_obergruppe + "_" + bauteil_gruner + "_" + infoObj.uuid[-5:]
    innerLayerNameTree.AddRange([layerName], layerId)
    
    temp = []
    for item in dataItems:
        data = getattr(infoObj, item)
        temp.append(data)
    innerLayerDataTree.AddRange(temp, layerId)


for layerId in normalGeo.Paths:
    infoObj = usedMatDict.Branches[0][0]['outerMaterial']['matInfo'][layerId[2]][0]['info']
    bauteil_obergruppe = infoObj.bauteil_obergruppe
    bauteil_gruner = infoObj.bauteil_gruner
    layerName = userName + ":normalFacadeMaterial:" + "layer_" + str(layerId[2]) + ":" + bauteil_obergruppe + "_" + bauteil_gruner + "_" + infoObj.uuid[-5:]
    normalLayerNameTree.AddRange([layerName], layerId)
    
    temp = []
    for item in dataItems:
        data = getattr(infoObj, item)
        temp.append(data)
    normalLayerDataTree.AddRange(temp, layerId)
# ---------- end python_5 ----------
filter_6 = StreamFilter(Gate=item, Stream0=crv)
filter_7 = StreamFilter(Gate=item, Stream0=dup)
edges_2 = BrepEdges(Brep=move_ver1_5.moveGeo)  # -> Naked, Interior, NonManifold
edges_3 = BrepEdges(Brep=geo_5)  # -> Naked, Interior, NonManifold
gradient_2 = Gradient(
    LowerLimit=0,
    UpperLimit=filter_3,
    Parameter=filter_4,
    stops=[0: RGB(145, 107, 64), 0.267: RGB(234, 126, 0), 0.498: RGB(245, 207, 81), 0.772: RGB(235, 221, 185), 1: RGB(199, 98, 58)])
panel_2 = Panel("""20
10""")
panel_3 = Panel("""20
10""")
dash = DashPattern(Curve=move_ver1_6.moveGeo, Pattern=panel_2)  # -> Dashes, Gaps
dash_2 = DashPattern(Curve=move_ver1_7.moveGeo, Pattern=panel_3)  # -> Dashes, Gaps
crv_2 = Curve([edges_2.Naked, edges_2.Interior, filter_6, edges_3.Naked, edges_3.Interior])
ghpython_script = GhPythonScript(b=b, data=python_5.normalLayerNameTree)  # -> oData; inputs b: Boolean, data: tree
# ---------- ghpython_script: Python ----------
if b:
    oData = data
# ---------- end ghpython_script ----------
ghpython_script_2 = GhPythonScript(b=b, data=python_5.innerLayerNameTree)  # -> oData; inputs b: Boolean, data: tree; same code as ghpython_script
panel_4 = Panel(gradient_2)
unflatten = UnflattenTree(Tree=gradient_2, Guide=move_ver1_5.moveGeo)  # disabled
door = Data(dash.Dashes)
dup_2 = DuplicateData(Data=flatten(gradient_2), Number=lng, Order=True)  # -> graft(Data)
window = Data(dash_2.Dashes)
create_modify_layers = CreateModifyLayers(LayerName=ghpython_script, LayerColor=dup_2, DeleteLayer=False, enableFullPath=True)  # -> LayerNames, LayerFullPath
create_modify_layers_2 = CreateModifyLayers(LayerName=ghpython_script_2, LayerColor=filter_7, DeleteLayer=False, enableFullPath=True)  # -> LayerNames, LayerFullPath
createattributes = CreateAttributes(
    Name=create_modify_layers_2.LayerNames,
    LayerName=create_modify_layers_2.LayerNames,
    UserDataKeys=panel,
    UserDataValues=python_5.innerLayerDataTree,
    enableFullPath=False)
createattributes_2 = CreateAttributes(
    Name=create_modify_layers.LayerNames,
    LayerName=create_modify_layers.LayerNames,
    UserDataKeys=panel,
    UserDataValues=python_5.normalLayerDataTree,
    enableFullPath=False)
filter_8 = StreamFilter(Gate=item, Stream0=createattributes)
entwine = Entwine(Branch0X=geo_6, Branch1X=geo_3, FlattenInputs=False)
entwine_2 = Entwine(Branch0X=filter_8, Branch1X=createattributes_2, FlattenInputs=False)
R = ClusterOutput(entwine_2)
R_2 = ClusterOutput(entwine)
window_2 = ClusterOutput(window)
movegeo = ClusterOutput(move_ver1_5.moveGeo)
D = ClusterOutput(dup_2)
crv_3 = ClusterOutput(crv_2)
s_0 = ClusterOutput(filter_5)
s_0_2 = ClusterOutput(filter_7)
door_2 = ClusterOutput(door)

# ==== cluster ChangeImgPath
relay = ClusterInput()
panel = Panel("""13
14""")
parent_folder = ClusterInput()
item = ListItem(List=relay, Index=panel, Wrap=True)

# ----
# alter img
python = GhPythonScript(parent_folder=parent_folder, picture_path=item)  # -> out, found_path_list; inputs picture_path: tree
# ---------- python: Python ----------
import os
import ghpythonlib.treehelpers as th

def build_file_map(parent_folder):
    file_map = {}
    for root, dirs, files in os.walk(parent_folder):
        for file in files:
            if file not in file_map:  # This check adds the first found instance if multiple files with the same name exist
                file_map[file] = os.path.join(root, file)
    return file_map

def find_picture(file_map, picture_name):
    return file_map.get(picture_name, None)

# Assuming 'parent_folder' and 'picture_path' are defined
file_map = build_file_map(parent_folder)

total_found = 0
total_not_found = 0

found_path_list = []
for pic_path in picture_path.Branches:
    temp = []
    for pic in pic_path:
        file_name = os.path.basename(pic)
        found_path = find_picture(file_map, file_name)
        if found_path:
            total_found += 1
            temp.append(found_path)
        else:
            total_not_found += 1
            temp.append(os.path.join(parent_folder, "notFound.jpg"))
    found_path_list.append(temp)

found_path_list = th.list_to_tree(found_path_list)
print("found img: %d" % (total_found))
print("not found img: %d" % (total_not_found))
# ---------- end python ----------

panel_2 = Panel("""16
2""")
replace = ReplaceItems(List=relay, Item=python.found_path_list, Indices=panel, Wrap=False)
item_2 = ListItem(List=replace, Index=panel_2, Wrap=True)

# ----
# alter url
python_2 = GhPythonScript(data=item_2)  # -> out, simplify(graft(urlList)); inputs data: tree
# ---------- python_2: Python ----------
import ghpythonlib.treehelpers as th
urlList = []
for d in data.Branches:
    bautStr = d[0]
    if bautStr.find(","):
        print("heee")
        print(bautStr)
    alterStr = str(d[0]).replace(" ", "_")
    urlString = "https://bfhreuse24.site/shop/" + alterStr + "/" + str(d[1])
    url = urlString 
    urlList.append(url)

urlList = th.list_to_tree(urlList)
# ---------- end python_2 ----------

replace_2 = ReplaceItems(List=replace, Item=python_2.urlList, Indices="16", Wrap=False)
L = ClusterOutput(replace_2)

# ==== cluster Cluster_3

# ----
# Title List
panel = Panel("""bauteil_obergruppe
bauteil_gruner
uuid
kosten
zustand
material
ref_gebauede_geschoss
breite
hoehe
tiefe
flaeche
masse
anzahl
foto1
foto2
co2
url""")

bauteil_obergruppe = ClusterInput()
bauteil_obergruppe_2 = ClusterInput()
data = ClusterInput()
data_2 = Data(data)
title = Data(panel)
bauteil_obergruppe_3 = Data(bauteil_obergruppe)
bauteil_gruner = Data(bauteil_obergruppe_2)
list = ValueList({"bauteil_obergruppe", "bauteil_gruner", "material"}, selected="bauteil_gruner")
list_2 = ValueList({"bauteil_obergruppe", "bauteil_gruner", "material"}, selected="bauteil_obergruppe")
panel_2 = Panel("""bauteil_obergruppe
bauteil_gruner
material""")
cluster = Cluster(S=title, M=list_2, data=data_2)  # -> S_2, M_2, L
panel_4 = Panel(cluster.L)
cluster_2 = Cluster_2(category=cluster.S_2, chosenitem=bauteil_obergruppe_3, dataid=cluster.M_2)
data_topic = Data(title)
alldata = Data(data_2)
python = GhPythonScript(data=cluster_2)  # -> union, quan; inputs data: tree
# ---------- python: Python ----------
def intersection_of_lists(nested_list):
    # Check if the nested list is empty or contains only empty lists
    if not nested_list or all(len(sublist) == 0 for sublist in nested_list):
        return [], 0

    # Initialize the intersection set with the first sublist to compare with others
    intersection_set = set(nested_list[0])
    
    # Iterate over each sublist in the nested list starting from the second sublist
    for sublist in nested_list[1:]:
        # Update the intersection set to keep only elements also found in the current sublist
        intersection_set.intersection_update(sublist)
    
    # Convert the set back to a list to get the final intersection list
    intersection_list = list(intersection_set)
    
    # Return the intersection list and the number of elements in the intersection
    return intersection_list, len(intersection_list)

listList = []
for d in data.Branches:
    if len(d) == 0:
        continue
    listList.append(d)

union, quan = intersection_of_lists(listList)
# ---------- end python ----------

# ----
# Quantity of items matching filters
panel_5 = Panel(python.quan)

cluster_3 = BranchLook(data=alldata, i=python.union)
cluster_4 = Cluster(S=title, M=list, data=cluster_3)  # -> S_2, M_2, L
panel_6 = Panel(cluster_4.L)
cluster_5 = Cluster_2(category=cluster_4.S_2, chosenitem=bauteil_gruner, dataid=cluster_4.M_2)
python_2 = GhPythonScript(data=cluster_5)  # -> union, quan; inputs data: tree; same code as python

# ----
# Quantity of items matching filters
panel_7 = Panel(python_2.quan)

cluster_6 = BranchLook(data=cluster_3, i=python_2.union)
data_3 = Data(cluster_6)
num = Data(python_2.quan)
data_4 = ClusterOutput(data_3)
num_2 = ClusterOutput(num)

# ==== cluster DoorDB
data = ClusterInput()
data_2 = Data(data)
panel = Panel("""7
8
12""")
item = ListItem(List=data_2, Index=panel, Wrap=True)
panel_2 = Panel("""bauteil_obergruppe
bauteil_gruner
uuid
kosten
zustand
material
ref_gebauede_geschoss
breite
hoehe
tiefe
flaeche
masse
anzahl
foto1
foto2
co2
url""")
python = GhPythonScript(x=item, y=data_2)  # -> out, filt_data, filt_attr; inputs x: tree, y: tree
# ---------- python: Python ----------
import ghpythonlib.treehelpers as th

filt_data = []
filt_attr = []
for data, attr in zip(x.Branches, y.Branches):
    addBool = 1
    for d in data:
        if str(d) == "FALSE":
            addBool = 0

    if addBool:
        filt_data.append(data)
        filt_attr.append(attr)

filt_data = th.list_to_tree(filt_data)
filt_attr = th.list_to_tree(filt_attr)
# ---------- end python ----------
item_2 = ListItem(List=python.filt_data, Index=0, Wrap=True)  # -> flatten(Item), flatten(Item1), flatten(Item2)
python_2 = GhPythonScript(attr=python.filt_attr, item=panel_2)  # -> out, graft(all_dict_list); inputs attr: tree, item: list
# ---------- python_2: Python ----------
import ghpythonlib.treehelpers as th

class openingAttr:
    def __init__(self, attr, **kwargs):
        self.attr = attr
        for key, value in kwargs.items():
            setattr(self, key, value)

all_dict_list = []
for at in attr.Branches:
    tempDict = {}
    for key, data in zip(item, at):
        tempDict[key] = data
        
    attrObj = openingAttr(tempDict, **tempDict) 
    all_dict_list.append(attrObj)

all_dict_list = th.list_to_tree(all_dict_list)
# ---------- end python_2 ----------
rectangle = Rectangle(Plane=PlaneXY(0, 0, 0), XSize=item_2.Item, YSize=item_2.Item1, Radius=0)  # -> simplify(graft(Rectangle)), Length
graft = GraftTree(Tree=item_2.Item2, IncludeEmptyLists=True, IncludeNullItems=True)  # -> simplify(Tree)
python_3 = GhPythonScript(identity="door", geometry=rectangle.Rectangle, quantity=graft, attr=python_2.all_dict_list)  # -> out, objList; inputs geometry: tree of Rectangle3d, quantity: tree of Int32, attr: tree
# ---------- python_3: Python ----------
class BuildingComponent:
    def __init__(self, identity, geometry, quantity, attr):
        self.identity = identity
        self.geometry = geometry
        self.quantity = quantity
        self.attr = attr.attr
        for key, value in attr.attr.items():
            setattr(self, key, value)

objList = []
for geo, qua, at in zip(geometry.Branches, quantity.Branches, attr.Branches):
    obj = BuildingComponent(identity, geo[0], qua[0], at[0])
    objList.append(obj)
# ---------- end python_3 ----------
data_3 = Data(python_3.objList)
data_4 = ClusterOutput(data_3)

# ==== cluster WindowDB
data = ClusterInput()
data_2 = Data(data)
panel = Panel("""7
8
12""")
item = ListItem(List=data_2, Index=panel, Wrap=True)
panel_2 = Panel("""bauteil_obergruppe
bauteil_gruner
uuid
kosten
zustand
material
ref_gebauede_geschoss
breite
hoehe
tiefe
flaeche
masse
anzahl
foto1
foto2
co2
url""")
python = GhPythonScript(x=item, y=data_2)  # -> out, filt_data, filt_attr; inputs x: tree, y: tree; same code as python
item_2 = ListItem(List=python.filt_data, Index=0, Wrap=True)  # -> flatten(Item), flatten(Item1), flatten(Item2)
python_2 = GhPythonScript(attr=python.filt_attr, item=panel_2)  # -> out, graft(all_dict_list); inputs attr: tree, item: list; same code as python_2
rectangle = Rectangle(Plane=PlaneXY(0, 0, 0), XSize=item_2.Item, YSize=item_2.Item1, Radius=0)  # -> simplify(graft(Rectangle)), Length
graft = GraftTree(Tree=item_2.Item2, IncludeEmptyLists=True, IncludeNullItems=True)  # -> simplify(Tree)
python_3 = GhPythonScript(identity="window", geometry=rectangle.Rectangle, quantity=graft, attr=python_2.all_dict_list)  # -> out, objList; inputs geometry: tree of Rectangle3d, quantity: tree of Int32, attr: tree; same code as python_3
data_3 = Data(python_3.objList)
data_4 = ClusterOutput(data_3)

# ==== cluster TileMockData
num = ClusterInput()
num_2 = Data(num)
series = Series(Start=0, Step=1, Count="3")
panel = Panel("""bauteil_obergruppe
bauteil_gruner
uuid
kosten
zustand
material
ref_gebauede_geschoss
breite
hoehe
tiefe
flaeche
masse
anzahl
foto1
foto2
co2
url""")
item = ListItem(List=series, Index=0, Wrap=True)  # -> Item, Item1, Item2
dom = ConstructDomain(DomainStart=Slider(10, range=0..10), DomainEnd=Slider(60, range=0..100))
dom_2 = ConstructDomain(DomainStart=Slider(10, range=0..10), DomainEnd=Slider(1120, range=0..10000))
dom_3 = ConstructDomain(DomainStart=Slider(191, range=0..300), DomainEnd=Slider(262, range=0..300))
# width
random = Random(Range=dom, Number=num_2, Seed=item.Item, Integers=True)
# length
random_2 = Random(Range=dom_2, Number=num_2, Seed=item.Item1, Integers=True)
# quantity
random_3 = Random(Range=dom_3, Number=num_2, Seed=item.Item2, Integers=True)
python = GhPythonScript(x=num_2)  # -> out, a; inputs x: Int32
# ---------- python: Python ----------
import uuid
a = []
for i in range(x):
    a.append("MockTile_uuid_" + str(uuid.uuid4()))
# ---------- end python ----------
panel_2 = Panel("""7
8
12
2""")
python_2 = GhPythonScript(x=panel)  # -> out, a; inputs x: list
# ---------- python_2: Python ----------
a = []
for st in x:
    a.append("MockData_"+st)
# ---------- end python_2 ----------
dup = DuplicateData(Data=graft(python_2.a), Number=num_2, Order=True)
merge = Merge(
    Data1=simplify(graft(random)),
    Data2=simplify(graft(random_2)),
    Data3=simplify(graft(random_3)),
    Data4=simplify(graft(python.a)))
flip = FlipMatrix(Data=dup)
replace = ReplaceItems(List=flip, Item=merge, Indices=panel_2, Wrap=False)
data = Data(replace)
item_2 = ListItem(List=data, Index=panel_2, Wrap=True)
python_3 = GhPythonScript(x=item_2, y=data)  # -> out, filt_data, filt_attr; inputs x: tree, y: tree; same code as python
item_3 = ListItem(List=python_3.filt_data, Index=0, Wrap=True)  # -> flatten(Item), flatten(Item1), flatten(Item2)
python_4 = GhPythonScript(attr=python_3.filt_attr, item=panel)  # -> out, graft(all_dict_list); inputs attr: tree, item: list; same code as python_2
rectangle = Rectangle(Plane=PlaneXY(0, 0, 0), XSize=item_3.Item, YSize=item_3.Item1, Radius=0)  # -> simplify(graft(Rectangle)), Length
graft = GraftTree(Tree=item_3.Item2, IncludeEmptyLists=True, IncludeNullItems=True)  # -> simplify(Tree)
# Should check if I need to add attrObj
panel_3 = Panel("tile")
python_5 = GhPythonScript(identity=panel_3, geometry=rectangle.Rectangle, quantity=graft, attr=python_4.all_dict_list)  # -> out, objList; inputs geometry: tree of Rectangle3d, quantity: tree of Int32, attr: tree
# ---------- python_5: Python ----------
class BuildingComponent:
    def __init__(self, identity, geometry, quantity, attr):
        self.identity = identity
        self.geometry = geometry
        self.quantity = quantity
        self.attr = attr.attr
        self.attrObj = attr

objList = []
for geo, qua, at in zip(geometry.Branches, quantity.Branches, attr.Branches):
    obj = BuildingComponent(identity, geo[0], qua[0], at[0])
    objList.append(obj)
# ---------- end python_5 ----------
data_2 = Data(python_5.objList)
data_3 = ClusterOutput(data_2)

# ==== cluster BoardDB
data = ClusterInput()
data_2 = Data(data)
panel = Panel("""7
8
12""")
item = ListItem(List=data_2, Index=panel, Wrap=True)
panel_2 = Panel("""bauteil_obergruppe
bauteil_gruner
uuid
kosten
zustand
material
ref_gebauede_geschoss
breite
hoehe
tiefe
flaeche
masse
anzahl
foto1
foto2
co2
url""")
python = GhPythonScript(x=item, y=data_2)  # -> out, filt_data, filt_attr; inputs x: tree, y: tree
# ---------- python: Python ----------
import ghpythonlib.treehelpers as th

filt_data = []
filt_attr = []
for data, attr in zip(x.Branches, y.Branches):
    addBool = 1
    for d in data:
        if str(d) == "FALSE":
            addBool = 0
    
    # check if tiefe is FALSE
    if attr[9] == "FALSE":
        attr[9] = 1
    
    if addBool:
        attr[7] = float(attr[7])
        attr[8] = float(attr[8])
        attr[9] = float(attr[9])
        filt_data.append(data)
        filt_attr.append(attr)

filt_data = th.list_to_tree(filt_data)
filt_attr = th.list_to_tree(filt_attr)
# ---------- end python ----------
item_2 = ListItem(List=python.filt_data, Index=0, Wrap=True)  # -> flatten(Item), flatten(Item1), flatten(Item2)
python_2 = GhPythonScript(attr=python.filt_attr, item=panel_2)  # -> out, graft(all_dict_list); inputs attr: tree, item: list; same code as python_2
rectangle = Rectangle(Plane=PlaneXY(0, 0, 0), XSize=item_2.Item, YSize=item_2.Item1, Radius=0)  # -> simplify(graft(Rectangle)), Length
graft = GraftTree(Tree=item_2.Item2, IncludeEmptyLists=True, IncludeNullItems=True)  # -> simplify(Tree)
python_3 = GhPythonScript(identity="door", geometry=rectangle.Rectangle, quantity=graft, attr=python_2.all_dict_list)  # -> out, objList; inputs geometry: tree of Rectangle3d, quantity: tree of Int32, attr: tree; same code as python_3
data_3 = Data(python_3.objList)
data_4 = ClusterOutput(data_3)

# ==== cluster CladdingCatergory
sddp = ShapeDiverDocumentPayload()
geo = ClusterInput()
data = ClusterInput()
geo_2 = Geometry(geo)
data_2 = Data(data)
int = Integer(flatten(data_2))
cset = CreateSet(List=int)  # -> Set, Map
sort = SortList(Keys=cset.Set)  # -> Keys, ValuesA
lng = ListLength(List=cset.Set)
series = Series(Start=0, Step=1, Count=lng)
python = GhPythonScript(become=series, changed=sort.Keys, changeList=data_2)  # -> out, newList; inputs become: list, changed: list, changeList: tree of Int32
# ---------- python: Python ----------
import ghpythonlib.treehelpers as th

width = become
length = changed

number_mapping = {}
for w, l in zip(width, length):
    number_mapping[l] = w

newList = []
for chList in changeList.Branches:
    newList.append([number_mapping[number] if number in number_mapping else number for number in chList])

newList = th.list_to_tree(newList)
# ---------- end python ----------
unflatten = UnflattenTree(Tree=python.newList, Guide=data_2)
tstat = TreeStatistics(Tree=graft(unflatten))  # -> Paths, Length, Count
dpath = DeconstructPath(Branch=tstat.Paths)
flatten = FlattenTree(Tree=unflatten, Path="{0}")  # -> simplify(graft(Tree))
geo_3 = Geometry(graft(geo_2))
item = ListItem(List=dpath, Index=0, Wrap=True)  # -> simplify(Item)
merge = Merge(Data1=item, Data2=flatten)
tstat_2 = TreeStatistics(Tree=geo_3)  # -> Paths, Length, Count
path = ConstructPath(Indices=merge)  # -> flatten(Branch)
tstat_3 = TreeStatistics(Tree=flatten)  # -> Paths, Length, Count
replace = ReplacePaths(Data=flatten, Search=tstat_3.Paths, Replace=path)
replace_2 = ReplacePaths(Data=geo_3, Search=tstat_2.Paths, Replace=path)
data_3 = Data(replace)
geo_4 = Geometry(replace_2)
geo_5 = ClusterOutput(geo_4)
data_4 = ClusterOutput(data_3)

# ==== cluster BranchLook: To see the condition of branch data.
data = ClusterInput()
data_2 = Data(data)
tstat = TreeStatistics(Tree=data_2)  # -> Paths, Length, Count
i = ClusterInput()
item = ListItem(List=tstat.Paths, Index=i, Wrap=True)
branch = TreeBranch(Tree=data_2, Path=item, MaintainPaths=True)
B = ClusterOutput(branch)

# ==== cluster Cluster
S = ClusterInput()
M = ClusterInput()
data = ClusterInput()
mindex = MemberIndex(Set=S, Member=M)  # -> Index, Count
data_2 = Data(data)
item = ListItem(List=data_2, Index=mindex.Index, Wrap=True)
cset = CreateSet(List=flatten(item))  # -> Set, Map
lng = ListLength(List=cset.Set)
S_2 = ClusterOutput(cset.Set)
M_2 = ClusterOutput(cset.Map)
L = ClusterOutput(lng)

# ==== cluster Cluster_2
category = ClusterInput()
chosenitem = ClusterInput()
dataid = ClusterInput()
category_2 = Data(category)
chosenitem_2 = Data(chosenitem)
dataid_2 = Data(dataid)
null = NullItem(Item=chosenitem_2)  # -> flatten(NullFlags), InvalidFlags, Description
item = ListItem(List=null.NullFlags, Index=0, Wrap=True)
filter = StreamFilter(Gate=item, Stream0=chosenitem_2, Stream1=category_2)
mindex = MemberIndex(Set=category_2, Member=filter)  # -> flatten(Index), Count
python = GhPythonScript(choose=mindex.Index, data=dataid_2)  # -> out, a; inputs choose: list, data: list
# ---------- python: Python ----------
a = []
for id, d in enumerate(data):
    if d in choose:
        a.append(id)
# ---------- end python ----------
a = ClusterOutput(python.a)
