# Grasshopper definition wallSystem.gh (Grasshopper 1.0.7)
# plug-ins: Human, treesloth01

# ----
# Script Reader
panel = Panel("py\tileDefinition.py")
c__grasshoppername = CSharpScript(inputName="py\wallDefinition3.py")  # -> ghParentPath, filePath; inputs inputName: String
# ---------- c__grasshoppername: C# usings ----------
using System.IO;
# ---------- c__grasshoppername: C# ----------
    if(this.GrasshopperDocument.IsFilePathDefined)
    {
      string p = this.GrasshopperDocument.FilePath;
      DirectoryInfo directoryInfo = new DirectoryInfo(p);
      string parentFolderPath = directoryInfo.Parent.Parent.FullName;

      string filePath_ = string.Format("{0}\\{1}", parentFolderPath, inputName);

      ghParentPath = parentFolderPath;
      filePath = filePath_;

    }
# ---------- end c__grasshoppername ----------
c__grasshoppername_2 = CSharpScript(inputName=panel)  # -> ghParentPath, filePath; inputs inputName: String; same code as c__grasshoppername
c__grasshoppername_3 = CSharpScript(inputName="py\boardDefinition.py")  # -> ghParentPath, filePath; inputs inputName: String; same code as c__grasshoppername
c__grasshoppername_4 = CSharpScript(inputName="py\structAndFillDefinition.py")  # -> ghParentPath, filePath; inputs inputName: String; same code as c__grasshoppername
c__grasshoppername_5 = CSharpScript(inputName="py\substructionDefinition.py")  # -> ghParentPath, filePath; inputs inputName: String; same code as c__grasshoppername
c__grasshoppername_6 = CSharpScript(inputName="py\paintDefinition.py")  # -> ghParentPath, filePath; inputs inputName: String; same code as c__grasshoppername

# ----
# paint
file = ReadFile(File=c__grasshoppername_6.filePath, PerLineParse=False)

# ----
# board
file_2 = ReadFile(File=c__grasshoppername_3.filePath, PerLineParse=False)

# ----
# subStruct + infill
file_3 = ReadFile(File=c__grasshoppername_4.filePath, PerLineParse=False)

# ----
# subStruct
file_4 = ReadFile(File=c__grasshoppername_5.filePath, PerLineParse=False)

# ----
# Geometry of Opening
brep = Brep(<brep referenced from the Rhino model>)
brep_2 = Brep(<brep referenced from the Rhino model>)
brep_3 = Brep(<brep referenced from the Rhino model>)
brep_4 = Brep(<brep referenced from the Rhino model>)
brep_5 = Brep(<brep referenced from the Rhino model>)
brep_6 = Brep(<brep referenced from the Rhino model>)
merge = Merge(Data1=brep, Data2=brep_2, Data3=brep_5)
merge_2 = Merge(Data1=brep_3, Data2=brep_4)
brep_7 = Brep(merge_2)
brep_8 = Brep(brep_6)
brep_9 = Brep(merge)
cluster = Cluster(brep=[merge, brep_7])
cluster_2 = Cluster(brep=brep_8)
plnaxis = PlaneAxis(P=cluster, B=Slider(700, range=0..1000))
plnaxis_2 = PlaneAxis(P=cluster_2, B=Slider(957, range=0..1000))

# ----
# claddingLength
number_slider = Slider(600, range=0..1000)
int = Integer(number_slider)

# ----
# claddingWidth
number_slider_2 = Slider(333, range=0..1000)
int_2 = Integer(number_slider_2)

# ----
# substructThickness
number_slider_3 = Slider(20, range=0..100)

# ----
# kindNum
number_slider_4 = Slider(4, range=0..10)
int_3 = Integer(number_slider_4)

# ----
# substructWidth
number_slider_5 = Slider(41, range=0..100)

# ----
# vertiAngle
number_slider_6 = Slider(0, range=0..60)

# ----
# wWeight
number_slider_7 = Slider(5, range=2..6)

# ----
# horiAngle
number_slider_8 = Slider(5, range=0..100)

# ----
# lWeight
number_slider_9 = Slider(4, range=2..6)

# ----
# vertiOverlap
number_slider_10 = Slider(0, range=0..1000)

# ----
# horiOverlap
number_slider_11 = Slider(1, range=0..100)

# ----
# Mock DataBase
doordb = DoorDB()
windowdb = WindowDB()
tiledb = TileDB()
boarddb = BoardDB()
data = Data(simplify(tiledb))
data_2 = Data(simplify(boarddb))
geo = Geometry(windowdb)
geo_2 = Geometry(doordb)
db_collection = GhPythonScript(windowDB=geo, doorDB=geo_2, tileDB=data, boardDB=data_2)  # -> out, allDB; inputs windowDB: list of Rectangle3d, doorDB: list of Rectangle3d, tileDB: tree, boardDB: tree
# ---------- db_collection: Python ----------
allDict = {}
allDict["windowDB"] = windowDB
allDict["doorDB"] = doorDB
allDict["tileDB"] = tileDB
allDict["boardDB"] = boardDB

class classForOutput:
    def __init__(self):
        pass

allData = classForOutput()
allData.all_DB = allDict

allDB = allData
# ---------- end db_collection ----------

# ----
# Inner Material Setting
# board
# length
# width
# thickness
# direction
# subStruct + infill
# width
# thickness
# distance
# direction
# board
# length
# width
# thickness
# direction
# paint
# thickness
# subStruct
# width
# thickness
# distance
# direction
# board
# length
# width
# thickness
# direction
# subStruct
# width
# thickness
# distance
# direction
toggle = BooleanToggle(True)
board_material = GhPythonScript(Code=file_2, Length="1000", Width="600", Thickness="20", SearchDB=toggle, Direction=Toggle(True))  # -> Out, Board_obj
substruct_infill_material = GhPythonScript(Code=file_4, Width="30", Thickness="10", Distance="300", Direction=Toggle(True))  # -> Out, Substruct_obj
substruct_infill_material_2 = GhPythonScript(Code=file_4, Width="20", Thickness="50", Distance="200", Direction=Toggle(False))  # -> Out, Substruct_obj
paint_material = GhPythonScript(Code=file, Thickness="5")  # -> Out, Paint_obj
substruct_infill_material_3 = GhPythonScript(Code=file_3, Width="20", Thickness="50", Distance="500", Direction=Toggle(False))  # -> Out, SubstructInfill_obj
board_material_2 = GhPythonScript(Code=file_2, Length="1000", Width="600", Thickness="20", SearchDB=Toggle(True), Direction=Toggle(True))  # -> Out, Board_obj
board_material_3 = GhPythonScript(Code=file_2, Length="1000", Width="800", Thickness="20", SearchDB=Toggle(True), Direction=Toggle(True))  # -> Out, Board_obj
merge_3 = Merge(
    Data1=board_material_3.Board_obj,
    Data2=substruct_infill_material_3.SubstructInfill_obj,
    Data3=board_material_2.Board_obj,
    Data4=paint_material.Paint_obj,
    Data5=substruct_infill_material_2.Substruct_obj,
    Data6=board_material.Board_obj,
    Data7=substruct_infill_material.Substruct_obj)

# ----
# Cladding Setting
num = Number(number_slider_10)
num_2 = Number(number_slider_11)
num_3 = Number(number_slider_8)
num_4 = Number(number_slider_6)
num_5 = Number(number_slider_5)
num_6 = Number(number_slider_3)

# ----
# Module Setting
number_slider_12 = Slider(1800, range=0..10000)
crv = Curve([<curve referenced from the Rhino model> x3])

# ----
# Explode wall
number_slider_13 = Slider(453, range=0..3000)

# ----
# Module Index
number_slider_14 = Slider(1, range=0..10)

# ----
# Layer Index
number_slider_15 = Slider(4, range=0..10)

# ----
# Material Index
number_slider_16 = Slider(0, range=0..10)

# ----
# Module Index
number_slider_17 = Slider(0, range=0..10)

# ----
# Wall_2
# Script Reader
panel_2 = Panel("py\wallDefinition3.py")
c__grasshoppername_7 = CSharpScript(inputName=panel_2)  # -> ghParentPath, filePath; inputs inputName: String; same code as c__grasshoppername
c__grasshoppername_8 = CSharpScript(inputName="py\tileDefinition.py")  # -> ghParentPath, filePath; inputs inputName: String; same code as c__grasshoppername
c__grasshoppername_9 = CSharpScript(inputName="py\boardDefinition.py")  # -> ghParentPath, filePath; inputs inputName: String; same code as c__grasshoppername
c__grasshoppername_10 = CSharpScript(inputName="py\structAndFillDefinition.py")  # -> ghParentPath, filePath; inputs inputName: String; same code as c__grasshoppername
c__grasshoppername_11 = CSharpScript(inputName="py\substructionDefinition.py")  # -> ghParentPath, filePath; inputs inputName: String; same code as c__grasshoppername
c__grasshoppername_12 = CSharpScript(inputName="py\paintDefinition.py")  # -> ghParentPath, filePath; inputs inputName: String; same code as c__grasshoppername

# ----
# paint
file_5 = ReadFile(File=c__grasshoppername_12.filePath, PerLineParse=False)

# ----
# board
file_6 = ReadFile(File=c__grasshoppername_9.filePath, PerLineParse=False)

# ----
# subStruct + infill
file_7 = ReadFile(File=c__grasshoppername_10.filePath, PerLineParse=False)

# ----
# subStruct
file_8 = ReadFile(File=c__grasshoppername_11.filePath, PerLineParse=False)

# ----
# claddingWidth
number_slider_18 = Slider(333, range=0..1000)
int_4 = Integer(number_slider_18)

# ----
# claddingLength
number_slider_19 = Slider(600, range=0..1000)
int_5 = Integer(number_slider_19)

# ----
# substructThickness
number_slider_20 = Slider(20, range=0..100)

# ----
# kindNum
number_slider_21 = Slider(4, range=0..10)
int_6 = Integer(number_slider_21)

# ----
# Geometry of Opening
brep_10 = Brep([<brep referenced from the Rhino model> x3])
brep_11 = Brep(<brep referenced from the Rhino model>)
brep_12 = Brep(<brep referenced from the Rhino model>)
brep_13 = Brep(brep_11)
brep_14 = Brep(brep_12)
brep_15 = Brep(brep_10)
cluster_3 = Cluster(brep=[brep_10, brep_13])
cluster_4 = Cluster(brep=brep_14)
plnaxis_3 = PlaneAxis(P=cluster_3, B=Slider(700, range=0..1000))
plnaxis_4 = PlaneAxis(P=cluster_4, B=Slider(957, range=0..1000))

# ----
# substructWidth
number_slider_22 = Slider(41, range=0..100)

# ----
# vertiAngle
number_slider_23 = Slider(0, range=0..60)

# ----
# wWeight
number_slider_24 = Slider(5, range=2..6)

# ----
# horiAngle
number_slider_25 = Slider(5, range=0..100)

# ----
# lWeight
number_slider_26 = Slider(4, range=2..6)

# ----
# vertiOverlap
number_slider_27 = Slider(0, range=0..1000)

# ----
# horiOverlap
number_slider_28 = Slider(1, range=0..100)

# ----
# Mock DataBase
doordb_2 = DoorDB()
windowdb_2 = WindowDB()
tiledb_2 = TileDB()
boarddb_2 = BoardDB()
data_3 = Data(simplify(tiledb_2))
data_4 = Data(simplify(boarddb_2))
geo_3 = Geometry(windowdb_2)
geo_4 = Geometry(doordb_2)
db_collection_2 = GhPythonScript(windowDB=geo_3, doorDB=geo_4, tileDB=data_3, boardDB=data_4)  # -> out, allDB; inputs windowDB: list of Rectangle3d, doorDB: list of Rectangle3d, tileDB: tree, boardDB: tree; same code as db_collection

# ----
# Inner Material Setting
# board
# length
# width
# thickness
# direction
# subStruct + infill
# width
# thickness
# distance
# direction
# board
# length
# width
# thickness
# direction
# paint
# thickness
# subStruct
# width
# thickness
# distance
# direction
# board
# length
# width
# thickness
# direction
# subStruct
# width
# thickness
# distance
# direction
toggle_2 = BooleanToggle(True)
board_material_4 = GhPythonScript(Code=file_6, Length="1000", Width="600", Thickness="20", SearchDB=toggle_2, Direction=Toggle(True))  # -> Out, Board_obj
substruct_infill_material_4 = GhPythonScript(Code=file_8, Width="30", Thickness="10", Distance="300", Direction=Toggle(True))  # -> Out, Substruct_obj
substruct_infill_material_5 = GhPythonScript(Code=file_8, Width="20", Thickness="50", Distance="200", Direction=Toggle(False))  # -> Out, Substruct_obj
paint_material_2 = GhPythonScript(Code=file_5, Thickness="5")  # -> Out, Paint_obj
substruct_infill_material_6 = GhPythonScript(Code=file_7, Width="20", Thickness="50", Distance="500", Direction=Toggle(False))  # -> Out, SubstructInfill_obj
board_material_5 = GhPythonScript(Code=file_6, Length="1000", Width="600", Thickness="20", SearchDB=Toggle(True), Direction=Toggle(True))  # -> Out, Board_obj
board_material_6 = GhPythonScript(Code=file_6, Length="1000", Width="800", Thickness="20", SearchDB=Toggle(True), Direction=Toggle(True))  # -> Out, Board_obj
merge_4 = Merge(
    Data1=board_material_6.Board_obj,
    Data2=substruct_infill_material_6.SubstructInfill_obj,
    Data3=board_material_5.Board_obj,
    Data4=paint_material_2.Paint_obj,
    Data5=substruct_infill_material_5.Substruct_obj,
    Data6=board_material_4.Board_obj,
    Data7=substruct_infill_material_4.Substruct_obj)

# ----
# Cladding Setting
num_7 = Number(number_slider_27)
num_8 = Number(number_slider_25)
num_9 = Number(number_slider_22)
num_10 = Number(number_slider_28)
num_11 = Number(number_slider_23)
num_12 = Number(number_slider_20)

file_9 = ReadFile(File=c__grasshoppername_7.filePath, PerLineParse=False)

# ----
# Explode wall
number_slider_29 = Slider(0, range=0..3000)

# ----
# Module Index
number_slider_30 = Slider(3, range=0..10)

# ----
# Layer Index
number_slider_31 = Slider(4, range=0..10)

# ----
# Material Index
number_slider_32 = Slider(0, range=0..10)

# ----
# Module Index
number_slider_33 = Slider(0, range=0..10)

# ----
# Roof_1
# Script Reader
panel_3 = Panel("py\wallDefinition3.py")
c__grasshoppername_13 = CSharpScript(inputName=panel_3)  # -> ghParentPath, filePath; inputs inputName: String; same code as c__grasshoppername
c__grasshoppername_14 = CSharpScript(inputName="py\tileDefinition.py")  # -> ghParentPath, filePath; inputs inputName: String; same code as c__grasshoppername
c__grasshoppername_15 = CSharpScript(inputName="py\boardDefinition.py")  # -> ghParentPath, filePath; inputs inputName: String; same code as c__grasshoppername
c__grasshoppername_16 = CSharpScript(inputName="py\structAndFillDefinition.py")  # -> ghParentPath, filePath; inputs inputName: String; same code as c__grasshoppername
c__grasshoppername_17 = CSharpScript(inputName="py\substructionDefinition.py")  # -> ghParentPath, filePath; inputs inputName: String; same code as c__grasshoppername
c__grasshoppername_18 = CSharpScript(inputName="py\paintDefinition.py")  # -> ghParentPath, filePath; inputs inputName: String; same code as c__grasshoppername

# ----
# paint
file_10 = ReadFile(File=c__grasshoppername_18.filePath, PerLineParse=False)

# ----
# Inner Material Setting
# board
file_11 = ReadFile(File=c__grasshoppername_15.filePath, PerLineParse=False)

# ----
# subStruct + infill
file_12 = ReadFile(File=c__grasshoppername_16.filePath, PerLineParse=False)

# ----
# subStruct
file_13 = ReadFile(File=c__grasshoppername_17.filePath, PerLineParse=False)

# ----
# claddingWidth
number_slider_34 = Slider(333, range=0..1000)
int_7 = Integer(number_slider_34)

# ----
# claddingLength
number_slider_35 = Slider(600, range=0..1000)
int_8 = Integer(number_slider_35)

# ----
# substructThickness
number_slider_36 = Slider(20, range=0..100)

# ----
# kindNum
number_slider_37 = Slider(4, range=0..10)
int_9 = Integer(number_slider_37)

# ----
# Geometry of Opening
brep_16 = Brep([<brep referenced from the Rhino model> x6])
brep_17 = Brep(<brep referenced from the Rhino model>)
brep_18 = Brep()
brep_19 = Brep(brep_17)
brep_20 = Brep(brep_16)
cluster_5 = Cluster(brep=[brep_16, brep_18])
cluster_6 = Cluster(brep=brep_19)
plnaxis_5 = PlaneAxis(P=cluster_5, B=Slider(700, range=0..1000))
plnaxis_6 = PlaneAxis(P=cluster_6, B=Slider(957, range=0..1000))

# ----
# substructWidth
number_slider_38 = Slider(41, range=0..100)

# ----
# vertiAngle
number_slider_39 = Slider(0, range=0..60)

# ----
# wWeight
number_slider_40 = Slider(5, range=2..6)

# ----
# horiAngle
number_slider_41 = Slider(5, range=0..100)

# ----
# lWeight
number_slider_42 = Slider(4, range=2..6)

# ----
# vertiOverlap
number_slider_43 = Slider(0, range=0..1000)

# ----
# horiOverlap
number_slider_44 = Slider(50, range=0..100)

# ----
# Mock DataBase
doordb_3 = DoorDB()
windowdb_3 = WindowDB()
tiledb_3 = TileDB()
boarddb_3 = BoardDB()
data_5 = Data(simplify(tiledb_3))
data_6 = Data(simplify(boarddb_3))
geo_5 = Geometry(windowdb_3)
geo_6 = Geometry(doordb_3)
db_collection_3 = GhPythonScript(windowDB=geo_5, doorDB=geo_6, tileDB=data_5, boardDB=data_6)  # -> out, allDB; inputs windowDB: list of Rectangle3d, doorDB: list of Rectangle3d, tileDB: tree, boardDB: tree; same code as db_collection

# ----
# width
# thickness
toggle_3 = BooleanToggle(True)
# direction
toggle_4 = BooleanToggle(True)
# thickness
# distance
# direction
# length
toggle_5 = BooleanToggle(False)
# width
# thickness
toggle_6 = BooleanToggle(True)
# direction
toggle_7 = BooleanToggle(True)
# length
panel_4 = Panel("1000")
# subStruct + infill
# width
panel_5 = Panel("20")

# ----
# Cladding Setting
num_13 = Number(number_slider_43)
num_14 = Number(number_slider_41)
num_15 = Number(number_slider_38)
num_16 = Number(number_slider_44)
num_17 = Number(number_slider_39)
num_18 = Number(number_slider_36)

substruct_infill_material_7 = GhPythonScript(Code=file_12, Width=panel_5, Thickness="50", Distance="500", Direction=toggle_5)  # -> Out, SubstructInfill_obj
# board
board_material_7 = GhPythonScript(Code=file_11, Length="1000", Width="600", Thickness="20", SearchDB=toggle_3, Direction=toggle_4)  # -> Out, Board_obj
# board
board_material_8 = GhPythonScript(Code=file_11, Length=panel_4, Width="800", Thickness="20", SearchDB=toggle_6, Direction=toggle_7)  # -> Out, Board_obj
merge_5 = Merge(
    Data1=board_material_8.Board_obj,
    Data2=substruct_infill_material_7.SubstructInfill_obj,
    Data3=board_material_7.Board_obj)
file_14 = ReadFile(File=c__grasshoppername_13.filePath, PerLineParse=False)

# ----
# Explode wall
number_slider_45 = Slider(0, range=0..3000)

# ----
# Module Index
number_slider_46 = Slider(1, range=0..10)

# ----
# Layer Index
number_slider_47 = Slider(4, range=0..10)

# ----
# Material Index
number_slider_48 = Slider(0, range=0..10)

# ----
# Module Index
number_slider_49 = Slider(0, range=0..10)

# ----
# Tile Setting
file_15 = ReadFile(File=c__grasshoppername_2.filePath, PerLineParse=False)
search_tile = GhPythonScript(claddingWidth=int_2, claddingLength=int, kindNum=int_3, wWeight=number_slider_7, lWeight=number_slider_9)  # -> out, searchTileSetting; inputs kindNum: Int32, wWeight: Int32, lWeight: Int32
# ---------- search_tile: Python ----------
allDict = {}
allDict["claddingWidth"] = claddingWidth
allDict["claddingLength"] = claddingLength
allDict["kindNum"] = kindNum
allDict["wWeight"] = wWeight
allDict["lWeight"] = lWeight


class classForOutput:
    def __init__(self):
        pass

allData = classForOutput()
allData.searchTileData = allDict

searchTileSetting = allData
# ---------- end search_tile ----------

# ----
# Customized Tile Component
number_slider_50 = Slider(80, range=0..100)
customizetile = GhPythonScript(Code=file_15, Width=Slider(300, range=0..1000), Height=Slider(350, range=0..1000), Quantity=number_slider_50)  # -> Out, Tile_obj
customizetile_2 = GhPythonScript(Code=file_15, Width=Slider(313, range=0..1000), Height=Slider(322, range=0..1000), Quantity=Slider(60, range=0..100))  # -> Out, Tile_obj
customizetile_3 = GhPythonScript(Code=file_15, Width=Slider(385, range=0..1000), Height=Slider(405, range=0..1000), Quantity=Slider(70, range=0..100))  # -> Out, Tile_obj
customizetile_4 = GhPythonScript(Code=file_15, Width=Slider(423, range=0..1000), Height=Slider(444, range=0..1000), Quantity=Slider(90, range=0..100))  # -> Out, Tile_obj
customizetile_5 = GhPythonScript(Code=file_15, Width=Slider(378, range=0..1000), Height=Slider(381, range=0..1000), Quantity=Slider(90, range=0..100))  # -> Out, Tile_obj

merge_6 = Merge(
    Data1=customizetile.Tile_obj,
    Data2=customizetile_2.Tile_obj,
    Data3=customizetile_3.Tile_obj,
    Data4=customizetile_4.Tile_obj,
    Data5=customizetile_5.Tile_obj)

# ----
# Wall_1
# Opening Visualization
toggle_8 = BooleanToggle(True)
file_16 = ReadFile(File=c__grasshoppername.filePath, PerLineParse=False)

# ----
# Cladding Engine
python = GhPythonScript(
    Code=file_16,
    DB=db_collection.allDB,
    WallGeo=brep_8,
    WindowGeo=brep_9,
    DoorGeo=brep_7,
    CustomizeTile=merge_6,
    SearchTile=search_tile.searchTileSetting,
    CladdingDirection=toggle_8,
    HoriOverlap=num_2,
    VertiOverlap=num,
    HoriAngle=num_3,
    VertiAngle=num_4,
    SubstructWidth=num_5,
    SubstructThickness=num_6,
    Material_collection=merge_3,
    ModuleDistance=number_slider_12,
    ModuleCurve=crv,
    ModuleCrvDist=Slider(266, range=0..1000),
    Init=Button())  # -> Out, Comb, OriginalCoTileGeo, WallFrame, WindowForFinalList, DoorForFinalList, SubstructureGeo, AllTypeMaterial, AllTypeMaterialModule, MaterialInfo

panel_6 = Panel(python.MaterialInfo)
geo_7 = Geometry([python.WindowForFinalList, python.DoorForFinalList])
cluster_7 = Cluster_2(crv=geo_7, pln=python.WallFrame, A=Slider(123, range=0..1000))
previewlw = CustomPreviewLineweights(Geometry=cluster_7, Shader=ColourSwatch(SwatchColor=RGB(0, 255, 238)), Thickness=Slider(8, range=0..10), Absolute=False)

# ----
# Wall Visualization
python_2 = GhPythonScript(x=python.AllTypeMaterial)  # -> out, a
# ---------- python_2: Python ----------
a =x
# ---------- end python_2 ----------
tstat = TreeStatistics(Tree=python.AllTypeMaterial)  # -> Paths, Length, Count
series = Series(Start=0, Step=number_slider_13, Count=expr("x+1", tstat.Count))
series_2 = Series(Start=0, Step=1, Count=tstat.Count)
shift = ShiftPaths(Data=python_2.a, Offset=-1)
python_3 = GhPythonScript(x=series)  # -> out, a, b; inputs x: list
# ---------- python_3: Python ----------
a = x[:-1]
b = x[-1]
# ---------- end python_3 ----------
deplane = DeconstructPlane(Plane=python.WallFrame)  # -> Origin, XAxis, YAxis, ZAxis
amp = Amplitude(Vector=deplane.ZAxis, Amplitude=python_3.a)  # -> graft(Vector)
gradient = Gradient(
    LowerLimit="0",
    UpperLimit=tstat.Count,
    Parameter=series_2,
    stops=[0: RGB(234, 38, 0), 0.25: RGB(234, 126, 0), 0.5: RGB(254, 244, 84), 0.75: RGB(173, 203, 249), 1: RGB(75, 107, 169)])
move = Move(Geometry=shift, Motion=amp)  # -> Geometry, Transform
cladding_catergory = CladdingCatergory(data=python.Comb, geo=python.OriginalCoTileGeo)  # -> geo_5, data_4
amp_2 = Amplitude(Vector=deplane.ZAxis, Amplitude=python_3.b)  # -> graft(Vector)
tstat_2 = TreeStatistics(Tree=cladding_catergory.geo_5)  # -> Paths, Length, Count
geo_8 = Geometry(cladding_catergory.geo_5)
move_2 = Move(Geometry=python.SubstructureGeo, Motion=amp_2)  # -> Geometry, Transform
move_3 = Move(Geometry=geo_8, Motion=amp_2)  # -> Geometry, Transform
edges = BrepEdges(Brep=move.Geometry)  # -> Naked, Interior, NonManifold
geo_9 = Geometry(move.Geometry)
geo_10 = Geometry(move_2.Geometry)
crv_2 = Curve([edges.Interior, edges.Naked])
gradient_2 = Gradient(
    LowerLimit=0,
    UpperLimit=tstat_2.Count,
    Parameter=cladding_catergory.data_4,
    stops=[0: RGB(145, 107, 64), 0.267: RGB(234, 126, 0), 0.498: RGB(245, 207, 81), 0.772: RGB(235, 221, 185), 1: RGB(199, 98, 58)])
edges_2 = BrepEdges(Brep=move_3.Geometry)  # -> Naked, Interior, NonManifold
previewmat = CustomPreviewMaterials(Geometry=move_3.Geometry, DiffuseColor=gradient_2)
previewmat_2 = CustomPreviewMaterials(Geometry=geo_10, DiffuseColor=RGB(255, 255, 255))
previewlw_2 = CustomPreviewLineweights(Geometry=[edges_2.Naked, edges_2.Interior], Shader=ColourSwatch(SwatchColor=RGB(0, 0, 0)), Absolute=False)

# ----
# Module Visualization
data_7 = Data(simplify(python.AllTypeMaterialModule))
findmodule = GhPythonScript(data=data_7, y=number_slider_14)  # -> out, A; inputs data: tree, y: Int32
# ---------- findmodule: Python ----------
from Grasshopper import DataTree
from Grasshopper.Kernel.Data import GH_Path
from System import Object
import ghpythonlib.treehelpers as th

selected = []
for path in data.Paths:
    if path[1] == y:
        items = data.Branch(path)
        selected.append(items)
    else:
        print("cannot find")

# Output the selected data
A = th.list_to_tree(selected)
# ---------- end findmodule ----------
findlayer = GhPythonScript(data=data_7, y=number_slider_15)  # -> out, A; inputs data: tree, y: Int32
# ---------- findlayer: Python ----------
from Grasshopper import DataTree
from Grasshopper.Kernel.Data import GH_Path
from System import Object
import ghpythonlib.treehelpers as th

selected = []
for path in data.Paths:
    if path[0] == y:
        items = data.Branch(path)
        selected.append(items)
    else:
        print("cannot find")

# Output the selected data
A = th.list_to_tree(selected)
# ---------- end findlayer ----------
cluster_8 = BranchLook(data=findmodule.A, i=number_slider_16)
cluster_9 = BranchLook(data=findlayer.A, i=number_slider_17)

preview = CustomPreview(Geometry=geo_9, Material=graft(gradient))
previewlw_3 = CustomPreviewLineweights(Geometry=flatten(crv_2), Shader=ColourSwatch(SwatchColor=RGB(0, 0, 0)), Thickness=Slider(1, range=0..10), Absolute=False)

# ----
# Tile Setting
file_17 = ReadFile(File=c__grasshoppername_8.filePath, PerLineParse=False)
search_tile_2 = GhPythonScript(claddingWidth=int_4, claddingLength=int_5, kindNum=int_6, wWeight=number_slider_24, lWeight=number_slider_26)  # -> out, searchTileSetting; inputs kindNum: Int32, wWeight: Int32, lWeight: Int32; same code as search_tile

# ----
# Customized Tile Component
number_slider_51 = Slider(80, range=0..100)
customizetile_6 = GhPythonScript(Code=file_17, Width=Slider(300, range=0..1000), Height=Slider(350, range=0..1000), Quantity=number_slider_51)  # -> Out, Tile_obj
customizetile_7 = GhPythonScript(Code=file_17, Width=Slider(313, range=0..1000), Height=Slider(322, range=0..1000), Quantity=Slider(60, range=0..100))  # -> Out, Tile_obj
customizetile_8 = GhPythonScript(Code=file_17, Width=Slider(385, range=0..1000), Height=Slider(405, range=0..1000), Quantity=Slider(70, range=0..100))  # -> Out, Tile_obj
customizetile_9 = GhPythonScript(Code=file_17, Width=Slider(423, range=0..1000), Height=Slider(444, range=0..1000), Quantity=Slider(90, range=0..100))  # -> Out, Tile_obj
customizetile_10 = GhPythonScript(Code=file_17, Width=Slider(378, range=0..1000), Height=Slider(381, range=0..1000), Quantity=Slider(90, range=0..100))  # -> Out, Tile_obj

merge_7 = Merge(
    Data1=customizetile_6.Tile_obj,
    Data2=customizetile_7.Tile_obj,
    Data3=customizetile_8.Tile_obj,
    Data4=customizetile_9.Tile_obj,
    Data5=customizetile_10.Tile_obj)

# ----
# Cladding Engine
python_4 = GhPythonScript(
    Code=file_9,
    DB=db_collection_2.allDB,
    WallGeo=brep_14,
    WindowGeo=brep_15,
    DoorGeo=brep_13,
    CustomizeTile=merge_7,
    SearchTile=search_tile_2.searchTileSetting,
    CladdingDirection=Toggle(False),
    HoriOverlap=num_10,
    VertiOverlap=num_7,
    HoriAngle=num_8,
    VertiAngle=num_11,
    SubstructWidth=num_9,
    SubstructThickness=num_12,
    Material_collection=merge_4,
    ModuleDistance=Slider(2000, range=0..10000),
    Init=Button())  # -> Out, Comb, OriginalCoTileGeo, WallFrame, WindowForFinalList, DoorForFinalList, SubstructureGeo, AllTypeMaterial, AllTypeMaterialModule, MaterialInfo

panel_7 = Panel(python_4.MaterialInfo)
panel_8 = Panel(python_4.Out)

# ----
# Opening Visualization
number_slider_52 = Slider(123, range=0..1000)
geo_11 = Geometry([python_4.WindowForFinalList, python_4.DoorForFinalList])
cluster_10 = Cluster_2(crv=geo_11, pln=python_4.WallFrame, A=number_slider_52)
previewlw_4 = CustomPreviewLineweights(Geometry=cluster_10, Shader=ColourSwatch(SwatchColor=RGB(0, 255, 238)), Thickness=Slider(5, range=0..10), Absolute=False)

# ----
# Wall Visualization
python_5 = GhPythonScript(x=python_4.AllTypeMaterial)  # -> out, a; same code as python_2
tstat_3 = TreeStatistics(Tree=python_4.AllTypeMaterial)  # -> Paths, Length, Count
series_3 = Series(Start=0, Step=number_slider_29, Count=expr("x+1", tstat_3.Count))
series_4 = Series(Start=0, Step=1, Count=tstat_3.Count)
shift_2 = ShiftPaths(Data=python_5.a, Offset=-1)
python_6 = GhPythonScript(x=series_3)  # -> out, a, b; inputs x: list; same code as python_3
deplane_2 = DeconstructPlane(Plane=python_4.WallFrame)  # -> Origin, XAxis, YAxis, ZAxis
amp_3 = Amplitude(Vector=deplane_2.ZAxis, Amplitude=python_6.a)  # -> graft(Vector)
gradient_3 = Gradient(
    LowerLimit="0",
    UpperLimit=tstat_3.Count,
    Parameter=series_4,
    stops=[0: RGB(234, 38, 0), 0.25: RGB(234, 126, 0), 0.5: RGB(254, 244, 84), 0.75: RGB(173, 203, 249), 1: RGB(75, 107, 169)])
move_4 = Move(Geometry=shift_2, Motion=amp_3)  # -> Geometry, Transform
cladding_catergory_2 = CladdingCatergory(data=python_4.Comb, geo=python_4.OriginalCoTileGeo)  # -> geo_5, data_4
amp_4 = Amplitude(Vector=deplane_2.ZAxis, Amplitude=python_6.b)  # -> graft(Vector)
tstat_4 = TreeStatistics(Tree=cladding_catergory_2.geo_5)  # -> Paths, Length, Count
geo_12 = Geometry(cladding_catergory_2.geo_5)
move_5 = Move(Geometry=python_4.SubstructureGeo, Motion=amp_4)  # -> Geometry, Transform
move_6 = Move(Geometry=geo_12, Motion=amp_4)  # -> Geometry, Transform
edges_3 = BrepEdges(Brep=move_4.Geometry)  # -> Naked, Interior, NonManifold
geo_13 = Geometry(move_4.Geometry)
geo_14 = Geometry(move_5.Geometry)
crv_3 = Curve([edges_3.Interior, edges_3.Naked])
gradient_4 = Gradient(
    LowerLimit=0,
    UpperLimit=tstat_4.Count,
    Parameter=cladding_catergory_2.data_4,
    stops=[0: RGB(145, 107, 64), 0.267: RGB(234, 126, 0), 0.498: RGB(245, 207, 81), 0.772: RGB(235, 221, 185), 1: RGB(199, 98, 58)])
edges_4 = BrepEdges(Brep=move_6.Geometry)  # -> Naked, Interior, NonManifold
previewmat_3 = CustomPreviewMaterials(Geometry=move_6.Geometry, DiffuseColor=gradient_4)
previewmat_4 = CustomPreviewMaterials(Geometry=geo_14, DiffuseColor=RGB(255, 255, 255))
previewlw_5 = CustomPreviewLineweights(Geometry=[edges_4.Naked, edges_4.Interior], Shader=ColourSwatch(SwatchColor=RGB(0, 0, 0)), Absolute=False)

# ----
# Module Visualization
data_8 = Data(simplify(python_4.AllTypeMaterialModule))
findmodule_2 = GhPythonScript(data=data_8, y=number_slider_30)  # -> out, A; inputs data: tree, y: Int32; same code as findmodule
findlayer_2 = GhPythonScript(data=data_8, y=number_slider_31)  # -> out, A; inputs data: tree, y: Int32; same code as findlayer
cluster_11 = BranchLook(data=findmodule_2.A, i=number_slider_32)
cluster_12 = BranchLook(data=findlayer_2.A, i=number_slider_33)

preview_2 = CustomPreview(Geometry=geo_13, Material=graft(gradient_3))
previewlw_6 = CustomPreviewLineweights(Geometry=flatten(crv_3), Shader=ColourSwatch(SwatchColor=RGB(0, 0, 0)), Thickness=Slider(1, range=0..10), Absolute=False)

# ----
# Tile Setting
file_18 = ReadFile(File=c__grasshoppername_14.filePath, PerLineParse=False)
search_tile_3 = GhPythonScript(claddingWidth=int_7, claddingLength=int_8, kindNum=int_9, wWeight=number_slider_40, lWeight=number_slider_42)  # -> out, searchTileSetting; inputs kindNum: Int32, wWeight: Int32, lWeight: Int32; same code as search_tile

# ----
# Customized Tile Component
number_slider_53 = Slider(80, range=0..100)
customizetile_11 = GhPythonScript(Code=file_18, Width=Slider(300, range=0..1000), Height=Slider(350, range=0..1000), Quantity=number_slider_53)  # -> Out, Tile_obj
customizetile_12 = GhPythonScript(Code=file_18, Width=Slider(313, range=0..1000), Height=Slider(322, range=0..1000), Quantity=Slider(60, range=0..100))  # -> Out, Tile_obj
customizetile_13 = GhPythonScript(Code=file_18, Width=Slider(385, range=0..1000), Height=Slider(405, range=0..1000), Quantity=Slider(70, range=0..100))  # -> Out, Tile_obj
customizetile_14 = GhPythonScript(Code=file_18, Width=Slider(423, range=0..1000), Height=Slider(444, range=0..1000), Quantity=Slider(90, range=0..100))  # -> Out, Tile_obj
customizetile_15 = GhPythonScript(Code=file_18, Width=Slider(378, range=0..1000), Height=Slider(381, range=0..1000), Quantity=Slider(90, range=0..100))  # -> Out, Tile_obj

merge_8 = Merge(
    Data1=customizetile_11.Tile_obj,
    Data2=customizetile_12.Tile_obj,
    Data3=customizetile_13.Tile_obj,
    Data4=customizetile_14.Tile_obj,
    Data5=customizetile_15.Tile_obj)

# ----
# Cladding Engine
python_7 = GhPythonScript(
    Code=file_14,
    DB=db_collection_3.allDB,
    WallGeo=brep_19,
    WindowGeo=brep_20,
    DoorGeo=brep_18,
    CustomizeTile=merge_8,
    SearchTile=search_tile_3.searchTileSetting,
    CladdingDirection=Toggle(False),
    HoriOverlap=num_16,
    VertiOverlap=num_13,
    HoriAngle=num_14,
    VertiAngle=num_17,
    SubstructWidth=num_15,
    SubstructThickness=num_18,
    Material_collection=merge_5,
    ModuleDistance=Slider(1800, range=0..10000),
    Init=Button())  # -> Out, Comb, OriginalCoTileGeo, WallFrame, WindowForFinalList, DoorForFinalList, SubstructureGeo, AllTypeMaterial, AllTypeMaterialModule, MaterialInfo

panel_9 = Panel(python_7.MaterialInfo)

# ----
# Opening Visualization
number_slider_54 = Slider(123, range=0..1000)
geo_15 = Geometry([python_7.WindowForFinalList, python_7.DoorForFinalList])
cluster_13 = Cluster_2(crv=geo_15, pln=python_7.WallFrame, A=number_slider_54)
previewlw_7 = CustomPreviewLineweights(Geometry=cluster_13, Shader=ColourSwatch(SwatchColor=RGB(0, 255, 238)), Thickness=Slider(5, range=0..10), Absolute=False)

# ----
# Wall Visualization
python_8 = GhPythonScript(x=python_7.AllTypeMaterial)  # -> out, a; same code as python_2
tstat_5 = TreeStatistics(Tree=python_7.AllTypeMaterial)  # -> Paths, Length, Count
series_5 = Series(Start=0, Step=number_slider_45, Count=expr("x+1", tstat_5.Count))
series_6 = Series(Start=0, Step=1, Count=tstat_5.Count)
shift_3 = ShiftPaths(Data=python_8.a, Offset=-1)
python_9 = GhPythonScript(x=series_5)  # -> out, a, b; inputs x: list; same code as python_3
deplane_3 = DeconstructPlane(Plane=python_7.WallFrame)  # -> Origin, XAxis, YAxis, ZAxis
amp_5 = Amplitude(Vector=deplane_3.ZAxis, Amplitude=python_9.a)  # -> graft(Vector)
gradient_5 = Gradient(
    LowerLimit="0",
    UpperLimit=tstat_5.Count,
    Parameter=series_6,
    stops=[0: RGB(234, 38, 0), 0.25: RGB(234, 126, 0), 0.5: RGB(254, 244, 84), 0.75: RGB(173, 203, 249), 1: RGB(75, 107, 169)])
move_7 = Move(Geometry=shift_3, Motion=amp_5)  # -> Geometry, Transform
cladding_catergory_3 = CladdingCatergory(data=python_7.Comb, geo=python_7.OriginalCoTileGeo)  # -> geo_5, data_4
amp_6 = Amplitude(Vector=deplane_3.ZAxis, Amplitude=python_9.b)  # -> graft(Vector)
tstat_6 = TreeStatistics(Tree=cladding_catergory_3.geo_5)  # -> Paths, Length, Count
geo_16 = Geometry(cladding_catergory_3.geo_5)
move_8 = Move(Geometry=python_7.SubstructureGeo, Motion=amp_6)  # -> Geometry, Transform
move_9 = Move(Geometry=geo_16, Motion=amp_6)  # -> Geometry, Transform
edges_5 = BrepEdges(Brep=move_7.Geometry)  # -> Naked, Interior, NonManifold
geo_17 = Geometry(move_7.Geometry)
geo_18 = Geometry(move_8.Geometry)
crv_4 = Curve([edges_5.Interior, edges_5.Naked])
gradient_6 = Gradient(
    LowerLimit=0,
    UpperLimit=tstat_6.Count,
    Parameter=cladding_catergory_3.data_4,
    stops=[0: RGB(145, 107, 64), 0.267: RGB(234, 126, 0), 0.498: RGB(245, 207, 81), 0.772: RGB(235, 221, 185), 1: RGB(199, 98, 58)])
edges_6 = BrepEdges(Brep=move_9.Geometry)  # -> Naked, Interior, NonManifold
previewmat_5 = CustomPreviewMaterials(Geometry=move_9.Geometry, DiffuseColor=gradient_6)
previewmat_6 = CustomPreviewMaterials(Geometry=geo_18, DiffuseColor=RGB(255, 255, 255))
previewlw_8 = CustomPreviewLineweights(Geometry=[edges_6.Naked, edges_6.Interior], Shader=ColourSwatch(SwatchColor=RGB(0, 0, 0)), Absolute=False)

# ----
# Module Visualization
data_9 = Data(simplify(python_7.AllTypeMaterialModule))
findmodule_3 = GhPythonScript(data=data_9, y=number_slider_46)  # -> out, A; inputs data: tree, y: Int32; same code as findmodule
findlayer_3 = GhPythonScript(data=data_9, y=number_slider_47)  # -> out, A; inputs data: tree, y: Int32; same code as findlayer
cluster_14 = BranchLook(data=findmodule_3.A, i=number_slider_48)
cluster_15 = BranchLook(data=findlayer_3.A, i=number_slider_49)

preview_3 = CustomPreview(Geometry=geo_17, Material=graft(gradient_5))
previewlw_9 = CustomPreviewLineweights(Geometry=flatten(crv_4), Shader=ColourSwatch(SwatchColor=RGB(0, 0, 0)), Thickness=Slider(1, range=0..10), Absolute=False)

# ==== cluster WindowDB
dom = ConstructDomain(DomainStart="1000", DomainEnd="2000")
dom_2 = ConstructDomain(DomainStart="1000", DomainEnd="2000")
random = Random(Range=dom_2, Number="500", Seed=2)
random_2 = Random(Range=dom, Number="500", Seed=Slider(11, range=0..100))
rectangle = Rectangle(Plane=PlaneXY(0, 0, 0), XSize=random, YSize=random_2, Radius=0)  # -> Rectangle, Length
R = ClusterOutput(rectangle.Rectangle)

# ==== cluster TileDB
number_slider = Slider(200, range=0..1000)
series = Series(Start=0, Step=1, Count="3")
item = ListItem(List=series, Index=0, Wrap=True)  # -> Item, Item1, Item2
dom = ConstructDomain(DomainStart=Slider(100, range=0..1000), DomainEnd=Slider(600, range=0..1000))
dom_2 = ConstructDomain(DomainStart=Slider(100, range=0..1000), DomainEnd=Slider(1200, range=0..10000))
dom_3 = ConstructDomain(DomainStart=Slider(191, range=0..300), DomainEnd=Slider(262, range=0..300))
# width
random = Random(Range=dom, Number=number_slider, Seed=item.Item, Integers=True)
# length
random_2 = Random(Range=dom_2, Number=number_slider, Seed=item.Item1, Integers=True)
# quantity
random_3 = Random(Range=dom_3, Number=number_slider, Seed=item.Item2, Integers=True)
rectangle = Rectangle(Plane=PlaneXY(0, 0, 0), XSize=random, YSize=random_2, Radius=0)  # -> graft(Rectangle), Length
graft = GraftTree(Tree=random_3, IncludeEmptyLists=True, IncludeNullItems=True)
merge = Merge(Data1=rectangle.Rectangle, Data2=graft)
R = ClusterOutput(merge)

# ==== cluster DoorDB
dom = ConstructDomain(DomainStart="1900", DomainEnd="2500")
dom_2 = ConstructDomain(DomainStart="1000", DomainEnd="2000")
random = Random(Range=dom_2, Number="500", Seed=2)
random_2 = Random(Range=dom, Number="500", Seed=Slider(11, range=0..100))
rectangle = Rectangle(Plane=PlaneXY(0, 0, 0), XSize=random, YSize=random_2, Radius=0)  # -> Rectangle, Length
R = ClusterOutput(rectangle.Rectangle)

# ==== cluster BranchLook: To see the condition of branch data.
data = ClusterInput()
data_2 = Data(data)
tstat = TreeStatistics(Tree=data_2)  # -> Paths, Length, Count
i = ClusterInput()
item = ListItem(List=tstat.Paths, Index=i, Wrap=True)
branch = TreeBranch(Tree=data_2, Path=item, MaintainPaths=True)
B = ClusterOutput(branch)

# ==== cluster PlaneAxis: show plane X Y Z axis.
P = ClusterInput()
B = ClusterInput()
deplane = DeconstructPlane(Plane=graft(P))  # -> Origin, XAxis, YAxis, ZAxis
multiplication = Multiplication(A=[deplane.XAxis, deplane.YAxis, deplane.ZAxis], B=B)
vdisex = VectorDisplayEx(
    Point=deplane.Origin,
    Vector=multiplication,
    Colour=[ColourSwatch(SwatchColor=RGB(235, 52, 52)), ColourSwatch(SwatchColor=RGB(90, 207, 48)), ColourSwatch(SwatchColor=RGB(54, 126, 227))],
    Width=2)

# ==== cluster Cluster
brep = ClusterInput()
brep_2 = Brep(brep)
area = Area(Geometry=brep_2)  # -> Area, Centroid
srf_cp = SurfaceClosestPoint(Point=area.Centroid, Surface=brep_2)  # -> Point, UVPoint, Distance
evalsrf = EvaluateSurface(Surface=brep_2, Point=srf_cp.UVPoint)  # -> Point, Normal, UDirection, VDirection, Frame
F = ClusterOutput(evalsrf.Frame)
vdis = VectorDisplay(Anchor=evalsrf.Point, Vector=evalsrf.Normal)

# ==== cluster CladdingCatergory
geo = ClusterInput()
data = ClusterInput()
geo_2 = Geometry(geo)
data_2 = Data(data)
int = Integer(flatten(data_2))
cset = CreateSet(List=int)  # -> Set, Map
sort = SortList(Keys=cset.Set)  # -> Keys, ValuesA
lng = ListLength(List=cset.Set)
series = Series(Start=0, Step=1, Count=lng)
panel = Panel(sort.Keys)
python = GhPythonScript(become=series, changed=sort.Keys, changeList=data_2)  # -> out, newList; inputs become: list, changed: list, changeList: tree of Int32
# ---------- python: Python ----------
import ghpythonlib.treehelpers as th

width = become
length = changed

number_mapping = {}
for w, l in zip(width, length):
    number_mapping[l] = w

newList = []
for chList in changeList.Branches:
    newList.append([number_mapping[number] if number in number_mapping else number for number in chList])

newList = th.list_to_tree(newList)
# ---------- end python ----------
unflatten = UnflattenTree(Tree=python.newList, Guide=data_2)
geo_3 = Geometry(flatten(geo_2))
flatten = FlattenTree(Tree=unflatten, Path="{0}")  # -> graft(Tree)
graft = GraftTree(Tree=geo_3, IncludeEmptyLists=True, IncludeNullItems=True)
path = ConstructPath(Indices=flatten)  # -> flatten(Branch)
tstat = TreeStatistics(Tree=graft)  # -> Paths, Length, Count
replace = ReplacePaths(Data=graft, Search=tstat.Paths, Replace=path)
replace_2 = ReplacePaths(Data=flatten, Search=tstat.Paths, Replace=path)
data_3 = Data(replace_2)
geo_4 = Geometry(replace)
data_4 = ClusterOutput(data_3)
geo_5 = ClusterOutput(geo_4)

# ==== cluster BoardDB
number_slider = Slider(700, range=0..1000)
series = Series(Start=0, Step=1, Count="3")
item = ListItem(List=series, Index=0, Wrap=True)  # -> Item, Item1, Item2
dom = ConstructDomain(DomainStart=Slider(400, range=0..1000), DomainEnd=Slider(1000, range=0..1000))
dom_2 = ConstructDomain(DomainStart=Slider(800, range=0..1000), DomainEnd=Slider(1500, range=0..10000))
dom_3 = ConstructDomain(DomainStart=Slider(116, range=0..300), DomainEnd=Slider(177, range=0..300))
# width
random = Random(Range=dom, Number=number_slider, Seed=item.Item, Integers=True)
# length
random_2 = Random(Range=dom_2, Number=number_slider, Seed=item.Item1, Integers=True)
# quantity
random_3 = Random(Range=dom_3, Number=number_slider, Seed=item.Item2, Integers=True)
rectangle = Rectangle(Plane=PlaneXY(0, 0, 0), XSize=random, YSize=random_2, Radius=0)  # -> graft(Rectangle), Length
graft = GraftTree(Tree=random_3, IncludeEmptyLists=True, IncludeNullItems=True)
merge = Merge(Data1=rectangle.Rectangle, Data2=graft)
R = ClusterOutput(merge)

# ==== cluster Cluster_2
pln = ClusterInput()
crv = ClusterInput()
panel = Panel("""200
100""")
pln_2 = Plane(pln)
crv_2 = Curve(crv)
A = ClusterInput()
deplane = DeconstructPlane(Plane=pln_2)  # -> Origin, XAxis, YAxis, ZAxis
dash = DashPattern(Curve=crv_2, Pattern=panel)  # -> Dashes, Gaps
amp = Amplitude(Vector=deplane.ZAxis, Amplitude=A)
move = Move(Geometry=dash.Dashes, Motion=amp)  # -> Geometry, Transform
G = ClusterOutput(move.Geometry)
