# Grasshopper definition wallSystem2.gh (Grasshopper 1.0.7)
# plug-ins: Human

# thickness
# distance
# direction
toggle = BooleanToggle(True)  # disabled
# Inner Material Setting
# width
# thickness
toggle_2 = BooleanToggle(True)  # disabled
# direction
toggle_3 = BooleanToggle(True)  # disabled
# thickness
# distance
# direction
toggle_4 = BooleanToggle(False)  # disabled
# length
panel = Panel("3000")  # disabled
panel_2 = Panel("800")  # disabled
panel_3 = Panel("20")  # disabled
# subStruct + infill
# width
panel_4 = Panel("20")  # disabled
panel_5 = Panel("50")  # disabled
panel_6 = Panel("500")  # disabled
# thickness
panel_7 = Panel("5")  # disabled
# width
panel_8 = Panel("20")  # disabled
panel_9 = Panel("50")  # disabled
panel_10 = Panel("200")  # disabled
panel_11 = Panel("DB\JSON_data\JSON")  # disabled
python = GhPythonScript()  # -> out, a; disabled
# ---------- python: Python ----------
import sys
import os

path = ghenv.Component.OnPingDocument().FilePath
parentdir = os.path.dirname(path)
grandparentdir = os.path.dirname(parentdir)
dire = os.path.join(grandparentdir, 'py')
if dire not in sys.path:
    sys.path.append(dire)

# Import your module
import testing
# Reload the module to ensure any changes are reflected
reload(testing)

from testing import JoJo

ohoh = JoJo(12,3)

ohoh.addd()
ohoh.mult()
# ---------- end python ----------
python_2 = GhPythonScript()  # -> out, a; inputs brep: Guid; disabled
# ---------- python_2: Python ----------
import Rhino
import scriptcontext as sc
import rhinoscriptsyntax as rs

# Set scriptcontext.doc to Rhino's document to access its objects
sc.doc = Rhino.RhinoDoc.ActiveDoc


def get_user_text_from_object(object_id, key=None):
    """
    Get user text from an object by its ID.
    """
    if object_id is None:
        print("No object ID provided.")
        return None

    rhino_object = sc.doc.Objects.Find(object_id)
    if not rhino_object:
        print("Object not found.")
        return None

    if key:
        value = rhino_object.Attributes.GetUserString(key)
        print("User text for key '{}': {}".format(key, value))
        return value
    else:
        all_user_text = rhino_object.Attributes.GetUserStrings()
        for k in all_user_text.AllKeys:
            print("Key: '{}', Value: '{}'".format(k, all_user_text[k]))
        return all_user_text

# Get the object ID by the referenced Brep geometry
#object_id = find_object_id_by_guid(brep)  # Assuming 'brep' is your input Brep

#print(object_id)
# To get user text
get_user_text_from_object(brep)
# ---------- end python_2 ----------

# ----
# json folder path
c__grasshoppername = CSharpScript(inputName=panel_11)  # -> ghParentPath, filePath; inputs inputName: String; disabled; same code as c__grasshoppername

# ----
# json folder path
c__grasshoppername_2 = CSharpScript(inputName="DB\JSON_data\JSON")  # -> ghParentPath, filePath; inputs inputName: String; same code as c__grasshoppername

panel_12 = Panel("DB\Pictures_gruner")  # disabled
panel_13 = Panel(python_2.out)  # disabled

# ----
# Title List
panel_14 = Panel("""bauteil_obergruppe
bauteil_gruner
uuid
kosten
zustand
material
ref_gebauede_geschoss
breite
hoehe
tiefe
flaeche
masse
anzahl
foto1
foto2
co2
url""")  # disabled

# ----
# img folder path
c__grasshoppername_3 = CSharpScript(inputName=panel_12)  # -> ghParentPath, filePath; inputs inputName: String; disabled; same code as c__grasshoppername

# ----
# read json file
python_3 = GhPythonScript(folder_path=c__grasshoppername.filePath)  # -> title, data; disabled
# ---------- python_3: Python ----------
import os
import json
import ghpythonlib.treehelpers as th

item_list = ['bauteil_obergruppe', 'bauteil_gruner', 'uuid', 'kosten', 'zustand', 'material', 'ref_gebauede_geschoss', 'breite', 'hoehe', 'tiefe', 'flaeche', 'masse', 'anzahl', 'foto1', 'foto2', 'co2', "kategorie"]

nameDict = {
"Befoerderungsanlage.json":"Befoerderungs_Anlage", #
"Bodenbelag.json":"Bodenbelag", #
"Deckenbekleidung.json":"Deckenbekleidung", #
"Deckenkonstruktion Dachkonstruktion.json":"Deckenkonstruktion", #
"Einbauten Schutzeinrichtung zu Ausbau.json":"Schutzeinrichtung", #
"Element in Aussenwand.json":"Aussenwand", #
"Element zu Dach.json":"ElementZuDach", #
"Fundament Bodenplatte.json":"Bodenplatte", #
#"Gastechnische Anlage.json":"Gastechnische_Anlage", 
"Gruenflaeche.json":"Gruenflaeche", #
"Kleininventar.json":"Kleininventar", #
"Lufttechnische Anlage.json":"Lufttechnische_Anlage", #
"Mobiliar.json":"Mobiliar", #
#"Sicherheitsanlage.json":"Sicherheit_Anlage", 
"Stuetzenkonstruktion.json":"Stuetzenkonstruktion", #
"Textilien.json":"Textilien", #
"Trennwand Innentuer Innentor.json":"Trennwand", #
"Waermetechnische Anlage.json":"Waermetechnische_Anlage", #
"Wandbekleidung.json":"Wandbekleidung", #
"Wandkonstruktion.json":"Wandkonstruktion", #
"Wassertechnische Anlage.json":"Wassertechnische_Anlage", #
"Weitere nutzungsspezifische Anlage.json":"Nutzungsspezifische_Anlage" #
}

def read_json_files(folder_path):
    # List to hold all items, with each item's sub-items as sub-lists
    all_items = []
    
    # Iterate over all files in the given folder
    for file_name in os.listdir(folder_path):
        # Check if the file is a JSON file
        if file_name.endswith('.json'):
            full_path = os.path.join(folder_path, file_name)
            
            # Read the JSON file
            with open(full_path, 'r') as json_file:
                data = json.load(json_file)
                
                # Assuming 'data' is a list of items
                for item in data:
                    # Add each item (and its sub-items, if any) to the list
                    
                    if file_name not in nameDict.keys():
                        continue
                    item["kategorie"] = nameDict[file_name]
                    temp = []
                    for key in item_list:
                        if key not in item.keys():
                            temp.append("FALSE")
                        else:
                            temp.append(item[key])
                    
                    all_items.append(temp)
    
    # Convert the list of lists into a data tree, with each top-level list as a branch
    return th.list_to_tree(all_items)

# Call the function and store the result
data = read_json_files(folder_path)

# The 'data_tree' can now be used as output in your Grasshopper Python component
title = item_list
# ---------- end python_3 ----------

# ----
# img folder path
c__grasshoppername_4 = CSharpScript(inputName="DB\Pictures_gruner")  # -> ghParentPath, filePath; inputs inputName: String; same code as c__grasshoppername

# ----
# read json file
python_4 = GhPythonScript(folder_path=c__grasshoppername_2.filePath)  # -> title, data; same code as python_3

changeimgpath = ChangeImgPath(parent_folder=c__grasshoppername_4.filePath, relay=python_4.data)
changeimgpath_2 = ChangeImgPath(parent_folder=c__grasshoppername_3.filePath, relay=python_3.data)  # disabled
cluster = Cluster_8(bauteil_obergruppe="Trennwand, Innentuer, Innentor", bauteil_obergruppe_2="Innentuer", data=changeimgpath)  # -> data_4, num_2
data = Data(changeimgpath_2)  # disabled
title = Data(panel_14)  # disabled
panel_15 = Panel(cluster.num_2)

# ----
# Filter for Category
# This filter module is specifically for content that is 'category.'
list = ValueList({"bauteil_obergruppe", "bauteil_gruner", "material"}, selected="bauteil_obergruppe")  # disabled
# Filter Block
# Filter Blocks can be copied to apply multiple filters.
# Users can select a topic to view the involved items.
# By selecting the items, materials whose content matches the filter will be retained.
panel_16 = Panel("""bauteil_obergruppe
bauteil_gruner
material""")  # disabled
cluster_2 = Cluster_4(S=title, M=list, data=data)  # -> S_2, M_2, L; disabled
panel_17 = Panel(cluster_2.L)  # disabled
list_2 = ItemSelector(
    cluster_2.S_2,
    {"Befoerderungsanlage", "Bodenbelag", "Deckenbekleidung", "Deckenkonstruktion, Dachkonstruktion", "Einbauten, Schutzeinrichtung zu Ausbau", "Element in Aussenwand", "Element zu Dach", "Fundament, Bodenplatte", "Gruenflaeche", "Kleininventar", "Lufttechnische Anlage", "Mobiliar", "Stuetzenkonstruktion", "Textilien", "Trennwand, Innentuer, Innentor", "Waermetechnische Anlage", "Wandbekleidung", "Wandkonstruktion", "Wassertechnische Anlage", "Weitere nutzungsspezifische Anlage"}, selected="Trennwand, Innentuer, Innentor")  # disabled
cluster_3 = Cluster_5(category=cluster_2.S_2, chosenitem=list_2, dataid=cluster_2.M_2)  # disabled

# ----
# UI item setting
# Tick the items which you
# want  to show inside UI.
list_3 = ValueList({"bauteil_obergruppe", "bauteil_gruner", "uuid", "kosten", "zustand", "material", "ref_gebauede_geschoss", "breite", "hoehe", "tiefe", "flaeche", "masse", "anzahl"}, selected=["bauteil_obergruppe", "bauteil_gruner", "material", "breite", "hoehe", "tiefe", "anzahl"])

# ----
# Sort list by which item,
# Original order if disable.
list_4 = ValueList({"breite", "hoehe", "tiefe", "anzahl"}, selected="anzahl")

# ----
# True: Large -> Small
# False: Small -> Large
toggle_5 = BooleanToggle(True)

# ----
# Script Reader
panel_18 = Panel("py\tileDefinition.py")
# Wall_Tile Facade
panel_19 = Panel("py\wallDefinition3.py")
c__grasshoppername_5 = CSharpScript(inputName=panel_19)  # -> ghParentPath, filePath; inputs inputName: String; same code as c__grasshoppername
c__grasshoppername_6 = CSharpScript(inputName=panel_18)  # -> ghParentPath, filePath; inputs inputName: String; same code as c__grasshoppername
c__grasshoppername_7 = CSharpScript(inputName="py\boardDefinition.py")  # -> ghParentPath, filePath; inputs inputName: String; same code as c__grasshoppername
c__grasshoppername_8 = CSharpScript(inputName="py\structAndFillDefinition.py")  # -> ghParentPath, filePath; inputs inputName: String; same code as c__grasshoppername
c__grasshoppername_9 = CSharpScript(inputName="py\substructionDefinition.py")  # -> ghParentPath, filePath; inputs inputName: String; same code as c__grasshoppername
c__grasshoppername_10 = CSharpScript(inputName="py\paintDefinition.py")  # -> ghParentPath, filePath; inputs inputName: String; same code as c__grasshoppername

# ----
# press it when you want to open UI
button = Button()

# ----
# UI Engine
number_slider = Slider(8, range=6..10, expression="x*100")
cluster_4 = Cluster_7(
    openui=button,
    winheight=number_slider,
    rownum=Slider(4, range=0..10),
    showitemnum=Slider(200, range=0..1000),
    page=Slider(1, range=0..10),
    topic=["bauteil_obergruppe", "bauteil_gruner", "uuid", "kosten", "zustand", "material", "ref_gebauede_geschoss", "breite", "hoehe", "tiefe", "flaeche", "masse", "anzahl", "foto1", "foto2", "co2", "url"],
    chosenitem=list_3,
    data=cluster.data_4,
    sortitem=list_4,
    sortreverse=toggle_5)  # -> data_5, checkbox_states

# ----
# Script Reader
panel_20 = Panel("py\tileDefinition.py")
# Wall_Normal Facade
panel_21 = Panel("py\wallDefinition3.py")
c__grasshoppername_11 = CSharpScript(inputName=panel_21)  # -> ghParentPath, filePath; inputs inputName: String; same code as c__grasshoppername
c__grasshoppername_12 = CSharpScript(inputName=panel_20)  # -> ghParentPath, filePath; inputs inputName: String; same code as c__grasshoppername
c__grasshoppername_13 = CSharpScript(inputName="py\boardDefinition.py")  # -> ghParentPath, filePath; inputs inputName: String; same code as c__grasshoppername
c__grasshoppername_14 = CSharpScript(inputName="py\structAndFillDefinition.py")  # -> ghParentPath, filePath; inputs inputName: String; same code as c__grasshoppername
c__grasshoppername_15 = CSharpScript(inputName="py\substructionDefinition.py")  # -> ghParentPath, filePath; inputs inputName: String; same code as c__grasshoppername
c__grasshoppername_16 = CSharpScript(inputName="py\paintDefinition.py")  # -> ghParentPath, filePath; inputs inputName: String; same code as c__grasshoppername

# ----
# paint
file = ReadFile(File=c__grasshoppername_16.filePath, PerLineParse=False)

# ----
# Inner Material Setting
# board
file_2 = ReadFile(File=c__grasshoppername_13.filePath, PerLineParse=False)

# ----
# subStruct + infill
file_3 = ReadFile(File=c__grasshoppername_14.filePath, PerLineParse=False)

# ----
# subStruct
file_4 = ReadFile(File=c__grasshoppername_15.filePath, PerLineParse=False)

# ----
# paint
file_5 = ReadFile(File=c__grasshoppername_10.filePath, PerLineParse=False)

# ----
# paint
paint_material = GhPythonScript(Code=file_5, Thickness=panel_7)  # -> Out, Paint_obj; disabled

# ----
# board
file_6 = ReadFile(File=c__grasshoppername_7.filePath, PerLineParse=False)

# ----
# board
board_material = GhPythonScript(Code=file_6, Length=panel, Width=panel_2, Thickness=panel_3, SearchDB=toggle_2, Direction=toggle_3)  # -> Out, Board_obj; disabled

# ----
# subStruct + infill
file_7 = ReadFile(File=c__grasshoppername_8.filePath, PerLineParse=False)

substruct_infill_material = GhPythonScript(Code=file_7, Width=panel_4, Thickness=panel_5, Distance=panel_6, Direction=toggle)  # -> Out, SubstructInfill_obj; disabled

# ----
# subStruct
file_8 = ReadFile(File=c__grasshoppername_9.filePath, PerLineParse=False)

# ----
# subStruct
substruct_infill_material_2 = GhPythonScript(Code=file_8, Width=panel_8, Thickness=panel_9, Distance=panel_10, Direction=toggle_4)  # -> Out, Substruct_obj; disabled
panel_22 = Panel(c__grasshoppername_6.filePath)
data_topic = Data(title)  # disabled
alldata = Data(data)  # disabled
objattr = GhPythonScript(
    bauteil_obergruppe="1234",
    uuid="customized_uuid heeee",
    breite="65",
    hoehe="250",
    tiefe="5",
    anzahl=Slider(999, range=0..1000))  # -> newObj; inputs anzahl: Int32
# ---------- objattr: Python ----------
class ObjFromRH:
    def __init__(self, **kwargs):
        for key, value in kwargs.items():
            setattr(self, key, value)


variables = {
    'bauteil_obergruppe': bauteil_obergruppe,
    'bauteil_gruner': bauteil_gruner,
    'uuid': uuid,
    'kosten': kosten,
    'zustand': zustand,
    'material': material,
    'ref_gebauede_geschoss': ref_gebauede_geschoss,
    'breite': breite,
    'hoehe': hoehe,
    'tiefe': tiefe,
    'flaeche': flaeche,
    'masse': masse,
    'anzahl': anzahl,
    'foto1': foto1,
    'foto2': foto2,
    'co2': co2,
    'url': url,
}

# Update each variable in the dictionary if it's None
for key in variables:
    if variables[key] is None:
        variables[key] = "unknown"



newObj = ObjFromRH(**variables)
# ---------- end objattr ----------
objattr_2 = GhPythonScript(
    bauteil_obergruppe="1234",
    uuid="customized_uuid heeee",
    breite="65",
    hoehe="250",
    tiefe="1",
    anzahl=Slider(999, range=0..1000))  # -> newObj; inputs anzahl: Int32; same code as objattr
entwine = Entwine(Branch00=cluster_3, FlattenInputs=True)  # disabled

# ----
# claddingWidth
number_slider_2 = Slider(33, range=0..1000)
int = Integer(number_slider_2)

# ----
# claddingLength
number_slider_3 = Slider(60, range=0..1000)
int_2 = Integer(number_slider_3)

# ----
# kindNum
number_slider_4 = Slider(4, range=0..10)
int_3 = Integer(number_slider_4)

# ----
# wWeight
number_slider_5 = Slider(5, range=2..6)

# ----
# lWeight
number_slider_6 = Slider(4, range=2..6)

crv = Curve(<curve referenced from the Rhino model>)
brep = Brep(<brep referenced from the Rhino model>)

# ----
# Geometry of Opening
brep_2 = Brep(<brep referenced from the Rhino model>)
brep_3 = Brep(<brep referenced from the Rhino model>)
brep_4 = Brep(<brep referenced from the Rhino model>)
brep_5 = Brep(<brep referenced from the Rhino model>)
brep_6 = Brep(<brep referenced from the Rhino model>)
brep_7 = Brep(<brep referenced from the Rhino model>)
merge = Merge(Data1=brep_2, Data2=brep_3, Data3=brep_6, Data4=brep)
merge_2 = Merge(Data1=brep_4, Data2=brep_5)
brep_8 = Brep(merge_2)
brep_9 = Brep(brep_7)
brep_10 = Brep(merge)
cluster_5 = Cluster(brep=[merge, brep_8])
cluster_6 = Cluster(brep=brep_9)
plnaxis = PlaneAxis(P=cluster_5, B=Slider(700, range=0..1000))
plnaxis_2 = PlaneAxis(P=cluster_6, B=Slider(957, range=0..1000))

pt = Point(<point referenced from the Rhino model>)
pt_2 = Point(<point referenced from the Rhino model>)

# ----
# substructThickness
number_slider_7 = Slider(2, range=0..100)

boundary = BoundarySurfaces(Edges=crv)

brep_11 = Brep(<brep referenced from the Rhino model>)
brep_12 = Brep(<brep referenced from the Rhino model>)
brep_13 = Brep(<brep referenced from the Rhino model>)
brep_14 = Brep(<brep referenced from the Rhino model>)
brep_15 = Brep(<brep referenced from the Rhino model>)
winfromrh = GhPythonScript(brep=[brep_11, brep_12, brep_13])  # -> out, newObj, width, height, depth; inputs brep: Guid
# ---------- winfromrh: Python ----------
import Rhino
import scriptcontext as sc
import rhinoscriptsyntax as rs
import Grasshopper.Kernel as ghkernel

class ObjFromRH:
    def __init__(self, **kwargs):
        for key, value in kwargs.items():
            setattr(self, key, value)


# Set scriptcontext.doc to Rhino's document to access its objects
sc.doc = Rhino.RhinoDoc.ActiveDoc

def get_attribute(object_id, key=None):
    """
    Get user text from an object by its ID.
    """
    if object_id is None:
        print("No object ID provided.")
        return None

    rhino_object = sc.doc.Objects.Find(object_id)
    if not rhino_object:
        print("Object not found.")
        return None

    if key:
        value = rhino_object.Attributes.GetUserString(key)
        print("User text for key '{}': {}".format(key, value))
        return value
    else:
        all_user_text = rhino_object.Attributes.GetUserStrings()
        objDict = {}
        for k in all_user_text.AllKeys:
            objDict[k] =  all_user_text[k]
        
        objDict["geo"] = rhino_object.Geometry
        print(type(rhino_object))
        return objDict


if brep == None:
    ghenv.Component.AddRuntimeMessage(ghkernel.GH_RuntimeMessageLevel.Warning, "brep is empty.")
else:
    # To get user text
    obj_dict = get_attribute(brep)
    newObj = ObjFromRH(**obj_dict)
#    newObj.geo = 
    
    
    width = get_attribute(brep, "breite")
    height = get_attribute(brep, "hoehe")
    depth = get_attribute(brep, "tiefe")
    
    width = width if width != "FALSE" else 1
    height = height if height != "FALSE" else 1
    depth = depth if depth != "FALSE" else 1
    
    width = int(width)
    height = int(height)
    depth = int(depth)
# ---------- end winfromrh ----------
merge_3 = Merge(Data1=brep_14, Data2=brep_15)

brep_16 = Brep(<brep referenced from the Rhino model>)
brep_17 = Brep(<brep referenced from the Rhino model>)
brep_18 = Brep(<brep referenced from the Rhino model>)
brep_19 = Brep(<brep referenced from the Rhino model>)
brep_20 = Brep(<brep referenced from the Rhino model>)
brep_21 = Brep(<brep referenced from the Rhino model>)
brep_22 = Brep(<brep referenced from the Rhino model>)
winfromrh_2 = GhPythonScript(brep=[brep_19, brep_21, brep_22, brep_20])  # -> out, newObj, width, height, depth; inputs brep: Guid; same code as winfromrh
merge_4 = Merge(Data1=brep_16, Data2=brep_17, Data4=brep_18)

# ----
# substructWidth
number_slider_8 = Slider(4, range=0..100)

crv_2 = Curve(<curve referenced from the Rhino model>)
# Geometry of Opening
brep_23 = Brep(<brep referenced from the Rhino model>)

# ----
# vertiAngle
number_slider_9 = Slider(0, range=0..60)

# ----
# horiAngle
number_slider_10 = Slider(5, range=0..100)

# ----
# vertiOverlap
number_slider_11 = Slider(0, range=0..1000)

# ----
# horiOverlap
number_slider_12 = Slider(1, range=0..10)

# ----
# Mock DataBase
tiledb = TileDB()
doordb = DoorDB()
boarddb = BoardDB()
windowdb = WindowDB()
data_2 = Data(simplify(boarddb))
data_3 = Data(simplify(tiledb))
db_collection = GhPythonScript(windowDB=windowdb, doorDB=doordb, tileDB=data_3, boardDB=data_2)  # -> out, allDB; inputs windowDB: list, doorDB: list, tileDB: list, boardDB: list
# ---------- db_collection: Python ----------
allDict = {}
allDict["windowDB"] = windowDB
allDict["doorDB"] = doorDB
allDict["tileDB"] = tileDB
allDict["boardDB"] = boardDB

class classForOutput:
    def __init__(self):
        pass

allData = classForOutput()
allData.all_DB = allDict

allDB = allData
# ---------- end db_collection ----------

boundary_2 = BoundarySurfaces(Edges=crv_2)

# ----
# Mock DataBase
tiledb_2 = TileDB()
doordb_2 = DoorDB()
boarddb_2 = BoardDB()
windowdb_2 = WindowDB()
data_4 = Data(simplify(boarddb_2))
data_5 = Data(simplify(tiledb_2))
db_collection_2 = GhPythonScript(windowDB=windowdb_2, doorDB=doordb_2, tileDB=data_5, boardDB=data_4)  # -> out, allDB; inputs windowDB: list, doorDB: list, tileDB: list, boardDB: list; same code as db_collection

# ----
# Condition 1:
# Input from rhino
# board
brep_24 = Brep(<brep referenced from the Rhino model>)
geofromrh = GhPythonScript(brep=brep_24)  # -> out, newObj, width, height, depth; inputs brep: Guid
# ---------- geofromrh: Python ----------
import Rhino
import scriptcontext as sc
import rhinoscriptsyntax as rs
import Grasshopper.Kernel as ghkernel

class ObjFromRH:
    def __init__(self, **kwargs):
        for key, value in kwargs.items():
            setattr(self, key, value)


# Set scriptcontext.doc to Rhino's document to access its objects
sc.doc = Rhino.RhinoDoc.ActiveDoc

def get_attribute(object_id, key=None):
    """
    Get user text from an object by its ID.
    """
    if object_id is None:
        print("No object ID provided.")
        return None

    rhino_object = sc.doc.Objects.Find(object_id)
    if not rhino_object:
        print("Object not found.")
        return None

    if key:
        value = rhino_object.Attributes.GetUserString(key)
        print("User text for key '{}': {}".format(key, value))
        return value
    else:
        all_user_text = rhino_object.Attributes.GetUserStrings()
        objDict = {}
        for k in all_user_text.AllKeys:
            objDict[k] =  all_user_text[k]
        return objDict


if brep == None:
    ghenv.Component.AddRuntimeMessage(ghkernel.GH_RuntimeMessageLevel.Warning, "brep is empty.")
else:
    # To get user text
    obj_dict = get_attribute(brep)
    newObj = ObjFromRH(**obj_dict)
    
    
    width = get_attribute(brep, "breite")
    height = get_attribute(brep, "hoehe")
    depth = get_attribute(brep, "tiefe")
    
    width = width if width != "FALSE" else 1
    height = height if height != "FALSE" else 1
    depth = depth if depth != "FALSE" else 1
    
    width = int(width)
    height = int(height)
    depth = int(depth)
# ---------- end geofromrh ----------
board_material_2 = GhPythonScript(
    Code=file_6,
    ObjAttr=geofromrh.newObj,
    Width=geofromrh.width,
    Length=geofromrh.height,
    Thickness=geofromrh.depth,
    Pt=pt_2,
    SearchDB=Toggle(False),
    Direction=Toggle(True))  # -> Out, Board_obj

# ----
# thickness
# distance
# direction
toggle_6 = BooleanToggle(False)  # disabled

# ----
# Condition 3:
# Search from DB by inputing dimension
# board
toggle_7 = BooleanToggle(True)
board_material_3 = GhPythonScript(Code=file_6, Width="65", Length="250", Thickness="1", Pt=pt_2, SearchDB=toggle_7, Direction=Toggle(True))  # -> Out, Board_obj

# ----
# Condition 2:
# Customize by inputing dimension
# board
toggle_8 = BooleanToggle(False)
board_material_4 = GhPythonScript(
    Code=file_6,
    ObjAttr=objattr,
    Width="65",
    Length="250",
    Thickness="5",
    Pt=pt_2,
    SearchDB=toggle_8,
    Direction=Toggle(True))  # -> Out, Board_obj

# ----
# thickness
# distance
# direction
toggle_9 = BooleanToggle(False)

# ----
# Condition 3:
# Search from DB by inputing dimension
# board
toggle_10 = BooleanToggle(True)
board_material_5 = GhPythonScript(Code=file_2, Width="65", Length="250", Thickness="1", Pt=pt, SearchDB=toggle_10, Direction=Toggle(True))  # -> Out, Board_obj

# ----
# Condition 1:
# Input from rhino
# board
brep_25 = Brep(<brep referenced from the Rhino model>)
geofromrh_2 = GhPythonScript(brep=brep_25)  # -> out, newObj, width, height, depth; inputs brep: Guid; same code as geofromrh
board_material_6 = GhPythonScript(
    Code=file_2,
    ObjAttr=geofromrh_2.newObj,
    Width=geofromrh_2.width,
    Length=geofromrh_2.height,
    Thickness=geofromrh_2.depth,
    Pt=pt,
    SearchDB=Toggle(False),
    Direction=Toggle(True))  # -> Out, Board_obj

# ----
# Condition 1:
# Input from rhino
# board
brep_26 = Brep(<brep referenced from the Rhino model>)
geofromrh_3 = GhPythonScript(brep=brep_26)  # -> out, newObj, width, height, depth; inputs brep: Guid; same code as geofromrh
board_material_7 = GhPythonScript(
    Code=file_2,
    ObjAttr=geofromrh_3.newObj,
    Width=geofromrh_3.width,
    Length=geofromrh_3.height,
    Thickness=geofromrh_3.depth,
    Pt=pt,
    SearchDB=Toggle(False),
    Direction=Toggle(True))  # -> Out, Board_obj

# ----
# Condition 1:
# Input from rhino
# board
brep_27 = Brep(<brep referenced from the Rhino model>)
geofromrh_4 = GhPythonScript(brep=brep_27)  # -> out, newObj, width, height, depth; inputs brep: Guid; same code as geofromrh
board_material_8 = GhPythonScript(
    Code=file_2,
    ObjAttr=geofromrh_4.newObj,
    Width=geofromrh_4.width,
    Length=geofromrh_4.height,
    Thickness=geofromrh_4.depth,
    Pt=pt,
    SearchDB=Toggle(False),
    Direction=Toggle(False))  # -> Out, Board_obj

# ----
# Condition 2:
# Customize by inputing dimension
# board
toggle_11 = BooleanToggle(False)
board_material_9 = GhPythonScript(
    Code=file_2,
    ObjAttr=objattr_2,
    Width="65",
    Length="250",
    Thickness="1",
    Pt=pt,
    SearchDB=toggle_11,
    Direction=Toggle(True))  # -> Out, Board_obj

# ----
# Condition 1:
# Input from rhino
# board
brep_28 = Brep(<brep referenced from the Rhino model>)
geofromrh_5 = GhPythonScript(brep=brep_28)  # -> out, newObj, width, height, depth; inputs brep: Guid; same code as geofromrh
board_material_10 = GhPythonScript(
    Code=file_2,
    ObjAttr=geofromrh_5.newObj,
    Width=geofromrh_5.width,
    Length=geofromrh_5.height,
    Thickness=geofromrh_5.depth,
    Pt=pt,
    SearchDB=Toggle(False),
    Direction=Toggle(False))  # -> Out, Board_obj

# ----
# width
panel_23 = Panel("3")  # disabled
panel_24 = Panel("5")  # disabled
panel_25 = Panel("30")  # disabled

# ----
# UI item setting
# Tick the items which you
# want  to show inside UI.
list_5 = ValueList({"bauteil_obergruppe", "bauteil_gruner", "uuid", "kosten", "zustand", "material", "ref_gebauede_geschoss", "breite", "hoehe", "tiefe", "flaeche", "masse", "anzahl"}, selected=["bauteil_obergruppe", "bauteil_gruner", "material", "breite", "hoehe", "tiefe", "anzahl"])  # disabled

# ----
# width
panel_26 = Panel("3")
python_5 = GhPythonScript(data=entwine)  # -> union, quan; inputs data: tree; disabled; same code as python
# subStruct
substruct_infill_material_3 = GhPythonScript(Code=file_8, Width=panel_23, Thickness=panel_24, Distance=panel_25, Direction=toggle_6)  # -> Out, Substruct_obj; disabled

# ----
# Cladding Normal Type
# subStruct
# width
# thickness
# distance
# direction
# board
# length
# width
# thickness
# direction
toggle_12 = BooleanToggle(False)
substruct_infill_material_4 = GhPythonScript(Code=file_4, Width="3", Thickness="5", Distance="30", Direction=toggle_12)  # -> Out, Substruct_obj
board_material_11 = GhPythonScript(Code=file_2, Length="100", Width="300", Thickness="5", Pt=pt, SearchDB=Toggle(False), Direction=Toggle(False))  # -> Out, Board_obj
merge_5 = Merge(Data1=substruct_infill_material_4.Substruct_obj, Data2=board_material_11.Board_obj)

# ----
# Sort list by which item,
# Original order if disable.
list_6 = ValueList({"breite", "hoehe", "tiefe", "anzahl"}, selected="anzahl")  # disabled

# ----
# True: Large -> Small
# False: Small -> Large
toggle_13 = BooleanToggle(True)  # disabled

# ----
# subStruct
substruct_infill_material_5 = GhPythonScript(Code=file_4, Width=panel_26, Thickness="5", Distance="30", Direction=toggle_9)  # -> Out, Substruct_obj

# ----
# Quantity of items matching filters
panel_27 = Panel(python_5.quan)  # disabled

cluster_7 = BranchLook(data=alldata, i=python_5.union)  # disabled
brep_29 = Brep(brep_23)

brep_30 = Brep(merge_3)
data_6 = Data(winfromrh.newObj)

brep_31 = Brep(merge_4)
data_7 = Data(winfromrh_2.newObj)

# ----
# Cladding Setting
num = Number(number_slider_11)
num_2 = Number(number_slider_12)
num_3 = Number(number_slider_10)
num_4 = Number(number_slider_9)
num_5 = Number(number_slider_8)
num_6 = Number(number_slider_7)

# ----
# press it when you want to open UI
button_2 = Button()  # disabled

# ----
# UI Engine
# OpenUI => Opens the Menu Window.
# winHeight => set Height of UI.
# rowNum => set quantity of items in a row.
# ShowItemNum => Specifies the number of items displayed in the Menu.
# Page => Go to specific page
number_slider_13 = Slider(8, range=6..10, expression="x*100")  # disabled
number_slider_14 = Slider(200, range=0..1000)  # disabled
number_slider_15 = Slider(1, range=0..10)  # disabled
number_slider_16 = Slider(4, range=0..10)  # disabled
cluster_8 = Cluster_7(
    openui=button_2,
    winheight=number_slider_13,
    rownum=number_slider_16,
    showitemnum=number_slider_14,
    page=number_slider_15,
    topic=data_topic,
    chosenitem=list_5,
    data=cluster_7,
    sortitem=list_6,
    sortreverse=toggle_13)  # -> data_5, checkbox_states; disabled

# ----
# You need to use this component called "trigger" to
# keep updating the output of UI.
trigger = Trigger(Interval=500, TimerInterval=500, Target=cluster_8)  # disabled

merge_6 = Merge(
    Data1=board_material_2.Board_obj,
    Data2=board_material_4.Board_obj,
    Data3=board_material_3.Board_obj,
    Data4=substruct_infill_material_3.Substruct_obj)
merge_7 = Merge(
    Data1=board_material_6.Board_obj,
    Data2=board_material_7.Board_obj,
    Data3=board_material_8.Board_obj,
    Data4=board_material_10.Board_obj,
    Data5=board_material_9.Board_obj,
    Data6=board_material_5.Board_obj)

# ----
# click this button to
# bake brep
button_3 = Button()  # disabled

# ----
# Show/Bake in Rhino
number_slider_17 = Slider(23, range=0..100)  # disabled
number_slider_18 = Slider(8, range=0..100)  # disabled
show_in_rh = ShowInRh(x=number_slider_17, y=number_slider_18, L=cluster_8.data_5, P=graft(cluster_8.checkbox_states))  # -> geo_2, layername_2, text_2, data_2; disabled
geo = Geometry(show_in_rh.geo_2)  # disabled
objattr_3 = ObjAttr(b=button_3, layername=show_in_rh.layername_2, data=show_in_rh.data_2)  # disabled
item = ListItem(List=show_in_rh.text_2, Index=0, Wrap=True)  # -> Item, Item1; disabled
bake = BakeGeometry(Bake=button_3, Geometry=geo, Attributes=objattr_3, DeleteOldBakes=False, PreserveTrees=False)  # disabled

# ----
# Module Setting
number_slider_19 = Slider(233, range=0..1000)
crv_3 = Curve([<curve referenced from the Rhino model> x2])

panel_28 = Panel(show_in_rh.data_2)  # disabled

# ----
# Module Setting
number_slider_20 = Slider(200, range=0..1000)
crv_4 = Curve([<curve referenced from the Rhino model> x2])

# ----
# When "trigger" is running, this show-text component
# takes a lot of time. Thus, I suggest open it only when
# you want to bake the geometry.
justified_text = JustifiedText3d(
    Location=item.Item,
    Text=item.Item1,
    Size=1,
    HorizontalAlignment=0,
    VerticalAlginment=0,
    UseMeshes=False,
    Attributes=objattr_3,
    Bake=button_3)  # disabled

file_9 = ReadFile(File=c__grasshoppername_5.filePath, PerLineParse=False)
normalfacade = Data(merge_5)
file_10 = ReadFile(File=c__grasshoppername_11.filePath, PerLineParse=False)

# ----
# Cladding Engine
python_6 = GhPythonScript(
    Code=file_10,
    DB=db_collection.allDB,
    CarrierGeo=brep_29,
    WindowGeo=data_7,
    DoorGeo=data_6,
    SetTile=normalfacade,
    CladdingDirection=Toggle(True),
    Material_collection=merge_7,
    ModuleCurve=crv_4,
    ModuleCrvDist=Slider(30, range=10..30),
    Init=Button())  # -> Out, Comb, OriginalCoTileGeo, WallFrame, WindowForFinalList, DoorForFinalList, SubstructureGeo, AllTypeMaterial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

python_7 = GhPythonScript()  # -> out, a
# ---------- python_7: Python ----------
import Rhino
import scriptcontext as sc
import Grasshopper

# Define the input name you are looking for
input_name_to_check = "z"

# Access the list of inputs on the current component
input_params = ghenv.Component.Params.Input

# Initialize a flag to indicate the presence of the input
input_exists = False

# Loop through each input parameter and check its name
for param in input_params:
    if param.Name == input_name_to_check:
        input_exists = True
        break

# Output the result
if input_exists:
    print("Input named '{}' exists on the component.".format(input_name_to_check))
else:
    print("Input named '{}' does not exist on the component.".format(input_name_to_check))
# ---------- end python_7 ----------
python_8 = GhPythonScript(x=Slider(2, range=0..10))  # -> out, a
# ---------- python_8: Python ----------
print(globals()["x"])
# ---------- end python_8 ----------
panel_29 = Panel(python_6.Out)

# ----
# Opening Visualization
number_slider_21 = Slider(12, range=0..1000)
geo_2 = Geometry([python_6.WindowForFinalList, python_6.DoorForFinalList])
cluster_9 = Cluster_2(crv=geo_2, pln=python_6.WallFrame, A=number_slider_21)
previewlw = CustomPreviewLineweights(Geometry=cluster_9, Shader=ColourSwatch(SwatchColor=RGB(0, 255, 238)), Thickness=Slider(4, range=0..10), Absolute=False)

list_7 = ValueList({"bauteil_obergruppe", "bauteil_gruner", "uuid", "kosten", "zustand", "material", "ref_gebauede_geschoss", "breite", "hoehe", "tiefe", "flaeche", "masse", "anzahl"}, selected=["bauteil_obergruppe", "bauteil_gruner", "material", "breite", "hoehe", "tiefe", "anzahl"])
c__grasshoppername_17 = CSharpScript(inputName="py\UI_usedMaterial.py")  # -> ghParentPath, filePath; inputs inputName: String; same code as c__grasshoppername
winheight = Data(Slider(8, range=6..10, expression="x*100"))
chosenitem = Data(list_7)
rownum = Data(Slider(4, range=0..10))
file_11 = ReadFile(File=c__grasshoppername_17.filePath, PerLineParse=False)
openui = Data(Button())
python_9 = GhPythonScript(Code=file_11, Open=openui, WinHeight=winheight, RowNum=rownum, ChosenItem=chosenitem, ShowData=python_6.UsedMatDict)  # -> Out, SelectedIndices, graft(Checkbox_states)

# ----
# Explode wall
number_slider_22 = Slider(0, range=0..100)

# ----
# Wall Visualization
cluster_10 = Cluster_3(
    relay_2=python_6.Comb,
    relay_3=python_6.OriginalCoTileGeo,
    G=python_6.SubstructureGeo,
    relay=python_6.AllTypeMaterial,
    N=number_slider_22,
    P=python_6.WallFrame)  # -> C_2, G_2, en, ei, geo_4, crv_2, geo_3, C
preview = CustomPreview(Geometry=cluster_10.geo_3, Material=graft(cluster_10.C))
previewmat = CustomPreviewMaterials(Geometry=cluster_10.geo_4, DiffuseColor=RGB(255, 255, 255))
previewmat_2 = CustomPreviewMaterials(Geometry=cluster_10.G_2, DiffuseColor=cluster_10.C_2)
previewlw_2 = CustomPreviewLineweights(Geometry=[cluster_10.en, cluster_10.ei, cluster_10.crv_2], Shader=ColourSwatch(SwatchColor=RGB(0, 0, 0)), Absolute=False)

# ----
# Module Index
number_slider_23 = Slider(1, range=0..10)

# ----
# Layer Index
number_slider_24 = Slider(4, range=0..10)

# ----
# Module Index
number_slider_25 = Slider(1, range=0..10)

# ----
# Layer Index
number_slider_26 = Slider(4, range=0..10)

# ----
# Material Index
number_slider_27 = Slider(0, range=0..10)

# ----
# Module Index
number_slider_28 = Slider(0, range=0..10)

# ----
# Material Index
number_slider_29 = Slider(0, range=0..10)

# ----
# Module Index
number_slider_30 = Slider(1, range=0..10)

# ----
# Module Visualization
data_8 = Data(simplify(python_6.AllTypeMaterialModule))
findmodule = GhPythonScript(data=data_8, y=number_slider_25)  # -> out, A; inputs data: tree, y: Int32
# ---------- findmodule: Python ----------
from Grasshopper import DataTree
from Grasshopper.Kernel.Data import GH_Path
from System import Object
import ghpythonlib.treehelpers as th

selected = []
for path in data.Paths:
    if path[1] == y:
        items = data.Branch(path)
        selected.append(items)
    else:
        print("cannot find")

# Output the selected data
A = th.list_to_tree(selected)
# ---------- end findmodule ----------
findlayer = GhPythonScript(data=data_8, y=number_slider_26)  # -> out, A; inputs data: tree, y: Int32
# ---------- findlayer: Python ----------
from Grasshopper import DataTree
from Grasshopper.Kernel.Data import GH_Path
from System import Object
import ghpythonlib.treehelpers as th

selected = []
for path in data.Paths:
    if path[0] == y:
        items = data.Branch(path)
        selected.append(items)
    else:
        print("cannot find")

# Output the selected data
A = th.list_to_tree(selected)
# ---------- end findlayer ----------
cluster_11 = BranchLook(data=findmodule.A, i=number_slider_29)
cluster_12 = BranchLook(data=findlayer.A, i=number_slider_30)

# ----
# Filter for Dimension
# This filter module is specifically for content that is 'number.'
# breite [cm]
# hoehe [cm]
# tiefe [cm]
list_8 = ValueList({"breite [cm]": "breite", "hoehe [cm]": "hoehe", "tiefe [cm]": "tiefe"}, selected="breite [cm]")  # disabled
cluster_13 = Cluster_6(S=title, M=list_8, data=data)  # -> S_2, M_2, S_3; disabled
number_slider_31 = Slider(209, range=0..1000)  # disabled
number_slider_32 = Slider(5, range=0..1000)  # disabled

# ----
# Here is the range for the item you selected.
panel_30 = Panel(cluster_13.S_3)  # disabled

# ----
# You can input minimum and maximum numbers (minNum and maxNum)
#  to find items within the domain.
# Alternatively, you can leave either minNum or maxNum blank.
number_filter = GhPythonScript(Category=cluster_13.S_2)  # -> out, chosenItem; inputs Category: list; disabled
# ---------- number_filter: Python ----------
"""
This component is used for finding item that within minNum and maxNum.
If the item is "FALSE" or the one that can't transfer to float, this item will still be output.
"""
import Grasshopper.Kernel as ghkernel
import math

if len(Category) == 0:
    ghenv.Component.AddRuntimeMessage(ghkernel.GH_RuntimeMessageLevel.Warning, "Category is empty.")

else:
    if minNum is None:
        minNum = float('-inf')
    if maxNum is None:
        maxNum = float('inf')
    
    if minNum > maxNum:
        ghenv.Component.AddRuntimeMessage(ghkernel.GH_RuntimeMessageLevel.Warning, "minNum should smaller than or equal to maxNum.")
    
    matchedItem = []
    for item in Category:
        try:
            float_item = float(item)
            if float_item>=minNum and float_item<=maxNum:
                matchedItem.append(item)
        except:
            matchedItem.append(item)
            
    if len(matchedItem) == 0:
        ghenv.Component.AddRuntimeMessage(ghkernel.GH_RuntimeMessageLevel.Warning, "Nothing matches filter.")

    chosenItem = matchedItem
# ---------- end number_filter ----------

cluster_14 = Cluster_5(category=cluster_13.S_2, chosenitem=number_filter.chosenItem, dataid=cluster_13.M_2)  # disabled

# ----
# Filter for Quantity
# This filter module is specifically for content that is 'number.'
list_9 = ValueList({"anzahl"}, selected="anzahl")  # disabled
panel_31 = Panel("anzahl")  # disabled
cluster_15 = Cluster_6(S=title, M=list_9, data=data)  # -> S_2, M_2, S_3; disabled
number_slider_33 = Slider(100, range=0..1000)  # disabled
number_slider_34 = Slider(5, range=0..1000)  # disabled

# ----
# Here is the range for the item you selected.
panel_32 = Panel(cluster_15.S_3)  # disabled

# ----
# You can input minimum and maximum numbers (minNum and maxNum)
#  to find items within the domain.
# Alternatively, you can leave either minNum or maxNum blank.
number_filter_2 = GhPythonScript(Category=cluster_15.S_2)  # -> out, chosenItem; inputs Category: list; disabled; same code as number_filter

cluster_16 = Cluster_5(category=cluster_15.S_2, chosenitem=number_filter_2.chosenItem, dataid=cluster_15.M_2)  # disabled

# ----
# Tile Setting
file_12 = ReadFile(File=c__grasshoppername_6.filePath, PerLineParse=False)
search_tile = GhPythonScript(claddingWidth=int, claddingLength=int_2, kindNum=int_3, wWeight=number_slider_5, lWeight=number_slider_6)  # -> out, searchTileSetting; inputs kindNum: Int32, wWeight: Int32, lWeight: Int32
# ---------- search_tile: Python ----------
allDict = {}
allDict["claddingWidth"] = claddingWidth
allDict["claddingLength"] = claddingLength
allDict["kindNum"] = kindNum
allDict["wWeight"] = wWeight
allDict["lWeight"] = lWeight


class classForOutput:
    def __init__(self):
        pass

allData = classForOutput()
allData.searchTileData = allDict
allData.identity = "searchTile"

searchTileSetting = allData
# ---------- end search_tile ----------

# ----
# Customized Tile Component
number_slider_35 = Slider(100, range=0..100)
customizetile = GhPythonScript(Code=file_12, Width=Slider(30, range=0..1000), Height=Slider(35, range=0..1000), Quantity=number_slider_35)  # -> Out, Tile_obj
customizetile_2 = GhPythonScript(Code=file_12, Width=Slider(31, range=0..1000), Height=Slider(32, range=0..1000), Quantity=Slider(60, range=0..100))  # -> Out, Tile_obj
customizetile_3 = GhPythonScript(Code=file_12, Width=Slider(38, range=0..1000), Height=Slider(40, range=0..1000), Quantity=Slider(70, range=0..100))  # -> Out, Tile_obj
customizetile_4 = GhPythonScript(Code=file_12, Width=Slider(42, range=0..1000), Height=Slider(44, range=0..1000), Quantity=Slider(100, range=0..100))  # -> Out, Tile_obj
customizetile_5 = GhPythonScript(Code=file_12, Width=Slider(37, range=0..1000), Height=Slider(38, range=0..1000), Quantity=Slider(90, range=0..100))  # -> Out, Tile_obj

merge_8 = Merge(
    Data1=customizetile.Tile_obj,
    Data2=customizetile_2.Tile_obj,
    Data3=customizetile_3.Tile_obj,
    Data4=customizetile_4.Tile_obj,
    Data5=customizetile_5.Tile_obj)

customizetile_6 = Data(merge_8)
searchdbtile = Data(search_tile.searchTileSetting)

# ----
# Cladding Engine
python_10 = GhPythonScript(
    Code=file_9,
    DB=db_collection_2.allDB,
    CarrierGeo=brep_9,
    WindowGeo=brep_10,
    DoorGeo=brep_8,
    SetTile=customizetile_6,
    CladdingDirection=Toggle(False),
    HoriOverlap=num_2,
    VertiOverlap=num,
    HoriAngle=num_3,
    VertiAngle=num_4,
    SubstructWidth=num_5,
    SubstructThickness=num_6,
    Material_collection=merge_6,
    ModuleDistance=number_slider_19,
    ModuleCurve=crv_3,
    ModuleCrvDist=Slider(20, range=10..30),
    Init=Button())  # -> Out, Comb, OriginalCoTileGeo, WallFrame, WindowForFinalList, DoorForFinalList, SubstructureGeo, AllTypeMaterial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

panel_33 = Panel(python_10.Out)
geo_3 = Geometry(python_10.OriginalCoTileGeo)

list_10 = ValueList({"bauteil_obergruppe", "bauteil_gruner", "uuid", "kosten", "zustand", "material", "ref_gebauede_geschoss", "breite", "hoehe", "tiefe", "flaeche", "masse", "anzahl"}, selected=["bauteil_obergruppe", "bauteil_gruner", "material", "breite", "hoehe", "tiefe", "anzahl"])
c__grasshoppername_18 = CSharpScript(inputName="py\UI_usedMaterial.py")  # -> ghParentPath, filePath; inputs inputName: String; same code as c__grasshoppername
winheight_2 = Data(Slider(8, range=6..10, expression="x*100"))
chosenitem_2 = Data(list_10)
rownum_2 = Data(Slider(4, range=0..10))
file_13 = ReadFile(File=c__grasshoppername_18.filePath, PerLineParse=False)
openui_2 = Data(Button())
python_11 = GhPythonScript(
    Code=file_13,
    Open=openui_2,
    WinHeight=winheight_2,
    RowNum=rownum_2,
    ChosenItem=chosenitem_2,
    ShowData=python_10.UsedMatDict)  # -> Out, SelectedIndices, graft(Checkbox_states)

# ----
# Opening Visualization
geo_4 = Geometry([python_10.WindowForFinalList, python_10.DoorForFinalList])
cluster_17 = Cluster_2(crv=geo_4, pln=python_10.WallFrame, A=Slider(10, range=0..1000))

# ----
# Wall Visualization
# Explode wall
cluster_18 = Cluster_3(
    relay_2=python_10.Comb,
    relay_3=python_10.OriginalCoTileGeo,
    G=python_10.SubstructureGeo,
    relay=python_10.AllTypeMaterial,
    N=Slider(0, range=0..100),
    P=python_10.WallFrame)  # -> C_2, G_2, en, ei, geo_4, crv_2, geo_3, C
preview_2 = CustomPreview(Geometry=cluster_18.geo_3, Material=graft(cluster_18.C))
previewmat_3 = CustomPreviewMaterials(Geometry=cluster_18.geo_4, DiffuseColor=RGB(255, 255, 255))
previewmat_4 = CustomPreviewMaterials(Geometry=cluster_18.G_2, DiffuseColor=cluster_18.C_2)
previewlw_3 = CustomPreviewLineweights(Geometry=[cluster_18.en, cluster_18.ei, cluster_18.crv_2], Shader=ColourSwatch(SwatchColor=RGB(0, 0, 0)), Absolute=False)

previewlw_4 = CustomPreviewLineweights(Geometry=cluster_17, Shader=ColourSwatch(SwatchColor=RGB(0, 255, 238)), Thickness=Slider(4, range=0..10), Absolute=False)

# ----
# Module Visualization
data_9 = Data(simplify(python_10.AllTypeMaterialModule))
findmodule_2 = GhPythonScript(data=data_9, y=number_slider_23)  # -> out, A; inputs data: tree, y: Int32; same code as findmodule
findlayer_2 = GhPythonScript(data=data_9, y=number_slider_24)  # -> out, A; inputs data: tree, y: Int32; same code as findlayer
cluster_19 = BranchLook(data=findmodule_2.A, i=number_slider_27)
cluster_20 = BranchLook(data=findlayer_2.A, i=number_slider_28)

# ==== cluster BranchLook: To see the condition of branch data.
data = ClusterInput()
data_2 = Data(data)
tstat = TreeStatistics(Tree=data_2)  # -> Paths, Length, Count
i = ClusterInput()
item = ListItem(List=tstat.Paths, Index=i, Wrap=True)
branch = TreeBranch(Tree=data_2, Path=item, MaintainPaths=True)
B = ClusterOutput(branch)

# ==== cluster PlaneAxis: show plane X Y Z axis.
P = ClusterInput()
B = ClusterInput()
deplane = DeconstructPlane(Plane=graft(P))  # -> Origin, XAxis, YAxis, ZAxis
multiplication = Multiplication(A=[deplane.XAxis, deplane.YAxis, deplane.ZAxis], B=B)
vdisex = VectorDisplayEx(
    Point=deplane.Origin,
    Vector=multiplication,
    Colour=[ColourSwatch(SwatchColor=RGB(235, 52, 52)), ColourSwatch(SwatchColor=RGB(90, 207, 48)), ColourSwatch(SwatchColor=RGB(54, 126, 227))],
    Width=2)

# ==== cluster Cluster
brep = ClusterInput()
brep_2 = Brep(brep)
area = Area(Geometry=brep_2)  # -> Area, Centroid
srf_cp = SurfaceClosestPoint(Point=area.Centroid, Surface=brep_2)  # -> Point, UVPoint, Distance
evalsrf = EvaluateSurface(Surface=brep_2, Point=srf_cp.UVPoint)  # -> Point, Normal, UDirection, VDirection, Frame
F = ClusterOutput(evalsrf.Frame)
vdis = VectorDisplay(Anchor=evalsrf.Point, Vector=evalsrf.Normal)

# ==== cluster BoardDB
series = Series(Start=0, Step=1, Count="3")
item = ListItem(List=series, Index=0, Wrap=True)  # -> Item, Item1, Item2
number_slider = Slider(700, range=0..1000)
dom = ConstructDomain(DomainStart=Slider(40, range=0..1000), DomainEnd=Slider(100, range=0..1000))
dom_2 = ConstructDomain(DomainStart=Slider(50, range=0..1000), DomainEnd=Slider(300, range=0..10000))
dom_3 = ConstructDomain(DomainStart=Slider(116, range=0..300), DomainEnd=Slider(177, range=0..300))
dom_4 = ConstructDomain(DomainStart=Slider(2, range=0..1000), DomainEnd=Slider(4, range=0..10000))
# width
random = Random(Range=dom, Number=number_slider, Seed=item.Item, Integers=True)
# length
random_2 = Random(Range=dom_2, Number=number_slider, Seed=item.Item1, Integers=True)
# quantity
random_3 = Random(Range=dom_3, Number=number_slider, Seed=item.Item2, Integers=True)
random_4 = Random(Range=dom_4, Number=number_slider, Seed=item.Item1, Integers=True)
repeat = RepeatData(Data="uuid_DB_", Length=number_slider)  # -> simplify(graft(Data))
series_2 = Series(Start=0, Step=1, Count=number_slider)  # -> simplify(graft(Series))
repeat_2 = RepeatData(Data="bauteil_obergruppe", Length=number_slider)  # -> simplify(graft(Data))
repeat_3 = RepeatData(Data="bauteil_gruner", Length=number_slider)  # -> simplify(graft(Data))
series_3 = Series(Start=0, Step=1, Count=number_slider)  # -> simplify(graft(Series))
series_4 = Series(Start=0, Step=1, Count=number_slider)  # -> simplify(graft(Series))
graft = GraftTree(Tree=random_3, IncludeEmptyLists=True, IncludeNullItems=True)
merge = Merge(Data1=repeat, Data2=series_2)
merge_2 = Merge(Data1=repeat_2, Data2=series_3)
merge_3 = Merge(Data1=repeat_3, Data2=series_4)
graft_2 = GraftTree(Tree=random, IncludeEmptyLists=True, IncludeNullItems=True)
graft_3 = GraftTree(Tree=random_2, IncludeEmptyLists=True, IncludeNullItems=True)
graft_4 = GraftTree(Tree=random_4, IncludeEmptyLists=True, IncludeNullItems=True)
join = TextJoin(Text=merge)
join_2 = TextJoin(Text=merge_2)
join_3 = TextJoin(Text=merge_3)
rectangle = Rectangle(Plane=PlaneXY(0, 0, 0), XSize=random, YSize=random_2, Radius=0)  # -> simplify(graft(Rectangle)), Length
area = Area(Geometry=flatten(rectangle.Rectangle))  # -> Area, Centroid; disabled
objattr = GhPythonScript(bauteil_obergruppe=join_2, bauteil_gruner=join_3, uuid=join, breite=graft_2, hoehe=graft_3, tiefe=graft_4, anzahl=graft)  # -> flatten(newObj); inputs anzahl: Int32
# ---------- objattr: Python ----------
class ObjFromRH:
    def __init__(self, **kwargs):
        for key, value in kwargs.items():
            setattr(self, key, value)

variables = {
    'bauteil_obergruppe': bauteil_obergruppe,
    'bauteil_gruner': bauteil_gruner,
    'uuid': uuid,
    'kosten': kosten,
    'zustand': zustand,
    'material': material,
    'ref_gebauede_geschoss': ref_gebauede_geschoss,
    'breite': breite,
    'hoehe': hoehe,
    'tiefe': tiefe,
    'flaeche': flaeche,
    'masse': masse,
    'anzahl': anzahl,
    'foto1': foto1,
    'foto2': foto2,
    'co2': co2,
    'url': url,
}

# Update each variable in the dictionary if it's None
for key in variables:
    if variables[key] is None:
        variables[key] = "unknown"



newObj = ObjFromRH(**variables)
# ---------- end objattr ----------
sort = SortList(Keys=area.Area, ValuesA=flatten(rectangle.Rectangle))  # -> Keys, ValuesA; disabled
python = GhPythonScript(
    identity="board",
    geometry=rectangle.Rectangle,
    quantity=graft,
    name=join_2,
    width=graft_2,
    height=graft_3,
    depth=graft_4)  # -> out, objList; inputs geometry: tree of Rectangle3d, quantity: tree of Int32, name: tree, width: tree, height: tree, depth: tree; disabled
# ---------- python: Python ----------
class BuildingComponent:
    def __init__(self, identity, geometry, quantity, name, width, height, depth):
        self.identity = identity
        self.geometry = geometry
        self.quantity = quantity
        self.name = name
        self.width = width
        self.height = height
        self.depth = depth

objList = []
for geo, qua, na, wi, he, de in zip(geometry.Branches, quantity.Branches, name.Branches, width.Branches, height.Branches, depth.Branches):
    obj = BuildingComponent(identity, geo[0], qua[0], na[0], wi[0], he[0], de[0])
    objList.append(obj)
# ---------- end python ----------
item_2 = ListItem(List=sort.ValuesA, Index=0, Wrap=True)  # disabled
newobj = ClusterOutput(objattr)

# ==== cluster Cluster_2
pln = ClusterInput()
crv = ClusterInput()
panel = Panel("""20
10""")
pln_2 = Plane(pln)
crv_2 = Curve(crv)
A = ClusterInput()
deplane = DeconstructPlane(Plane=pln_2)  # -> Origin, XAxis, YAxis, ZAxis
dash = DashPattern(Curve=crv_2, Pattern=panel)  # -> Dashes, Gaps
amp = Amplitude(Vector=deplane.ZAxis, Amplitude=A)
move = Move(Geometry=dash.Dashes, Motion=amp)  # -> Geometry, Transform
G = ClusterOutput(move.Geometry)

# ==== cluster Cluster_3
relay = ClusterInput()
panel = Panel(relay)
python = GhPythonScript(x=relay)  # -> out, a
# ---------- python: Python ----------
a =x
# ---------- end python ----------
tstat = TreeStatistics(Tree=relay)  # -> Paths, Length, Count
N = ClusterInput()
P = ClusterInput()
relay_2 = ClusterInput()
relay_3 = ClusterInput()
series = Series(Start=0, Step=N, Count=expr("x+1", tstat.Count))
series_2 = Series(Start=0, Step=1, Count=tstat.Count)
pshift = ShiftPaths(Data=python.a, Offset=-1)
python_2 = GhPythonScript(x=series)  # -> out, a, b; inputs x: list
# ---------- python_2: Python ----------
a = x[:-1]
b = x[-1]
# ---------- end python_2 ----------
deplane = DeconstructPlane(Plane=P)  # -> Origin, XAxis, YAxis, ZAxis
python_3 = GhPythonScript(x=relay_3)  # -> out, a; same code as python
panel_2 = Panel(relay_3)
item = ListItem(List=flatten(relay_2), Index=0, Wrap=True)
amp = Amplitude(Vector=deplane.ZAxis, Amplitude=python_2.a)  # -> graft(Vector)
null = NullItem(Item=item)  # -> NullFlags, InvalidFlags, Description
cladding_catergory = CladdingCatergory(data=relay_2, geo=relay_3)  # -> geo_5, data_4
gradient = Gradient(
    LowerLimit="0",
    UpperLimit=tstat.Count,
    Parameter=series_2,
    stops=[0: RGB(234, 38, 0), 0.25: RGB(234, 126, 0), 0.5: RGB(254, 244, 84), 0.75: RGB(173, 203, 249), 1: RGB(75, 107, 169)])
move = Move(Geometry=pshift, Motion=amp)  # -> Geometry, Transform
filter = StreamFilter(Gate=null.NullFlags, Stream0=cladding_catergory.geo_5, Stream1=python_3.a)
amp_2 = Amplitude(Vector=deplane.ZAxis, Amplitude=python_2.b)  # -> graft(Vector)
filter_2 = StreamFilter(Gate=null.NullFlags, Stream0=cladding_catergory.geo_5, Stream1=python_3.a)
tstat_2 = TreeStatistics(Tree=cladding_catergory.geo_5)  # -> Paths, Length, Count
G = ClusterInput()
C = ClusterOutput(gradient)
tstat_3 = TreeStatistics(Tree=filter)  # -> Paths, Length, Count
series_3 = Series(Start=0, Step=1, Count=tstat_3.Count)  # -> graft(Series)
move_2 = Move(Geometry=G, Motion=amp_2)  # -> Geometry, Transform
edges = BrepEdges(Brep=move.Geometry)  # -> Naked, Interior, NonManifold
move_3 = Move(Geometry=filter_2, Motion=amp_2)  # -> Geometry, Transform
geo = Geometry(move.Geometry)
filter_3 = StreamFilter(Gate=null.NullFlags, Stream0=tstat_2.Count, Stream1=tstat_3.Count)
filter_4 = StreamFilter(Gate=null.NullFlags, Stream0=cladding_catergory.data_4, Stream1=series_3)
geo_2 = Geometry(move_2.Geometry)
crv = Curve([edges.Interior, edges.Naked])
geo_3 = ClusterOutput(geo)
G_2 = ClusterOutput(move_3.Geometry)
geo_4 = ClusterOutput(geo_2)
edges_2 = BrepEdges(Brep=move_3.Geometry)  # -> Naked, Interior, NonManifold
crv_2 = ClusterOutput(crv)
gradient_2 = Gradient(
    LowerLimit=0,
    UpperLimit=filter_3,
    Parameter=filter_4,
    stops=[0: RGB(145, 107, 64), 0.267: RGB(234, 126, 0), 0.498: RGB(245, 207, 81), 0.772: RGB(235, 221, 185), 1: RGB(199, 98, 58)])
en = ClusterOutput(edges_2.Naked)
ei = ClusterOutput(edges_2.Interior)
C_2 = ClusterOutput(gradient_2)

# ==== cluster WindowDB
number_slider = Slider(500, range=0..1000)
series = Series(Start=0, Step=1, Count="3")
item = ListItem(List=series, Index=0, Wrap=True)  # -> Item, Item1, Item2
dom = ConstructDomain(DomainStart="100", DomainEnd="200")
dom_2 = ConstructDomain(DomainStart="100", DomainEnd="200")
dom_3 = ConstructDomain(DomainStart=Slider(191, range=0..300), DomainEnd=Slider(262, range=0..300))
repeat = RepeatData(Data="windowName_", Length=number_slider)  # -> simplify(graft(Data))
series_2 = Series(Start=0, Step=1, Count=number_slider)  # -> simplify(graft(Series))
# quantity
random = Random(Range=dom_3, Number=number_slider, Seed=item.Item2, Integers=True)
random_2 = Random(Range=dom_2, Number=number_slider, Seed=item.Item)
random_3 = Random(Range=dom, Number=number_slider, Seed=item.Item1)
merge = Merge(Data1=repeat, Data2=series_2)
rectangle = Rectangle(Plane=PlaneXY(0, 0, 0), XSize=random_2, YSize=random_3, Radius=0)  # -> simplify(graft(Rectangle)), Length
graft = GraftTree(Tree=random, IncludeEmptyLists=True, IncludeNullItems=True)  # -> simplify(Tree)
join = TextJoin(Text=merge)
merge_2 = Merge(Data1=rectangle.Rectangle, Data2=graft, Data3=join)  # disabled
python = GhPythonScript(identity="window", geometry=rectangle.Rectangle, quantity=graft, name=join)  # -> out, objList; inputs geometry: tree of Rectangle3d, quantity: tree of Int32, name: tree
# ---------- python: Python ----------
class BuildingComponent:
    def __init__(self, identity, geometry, quantity, name):
        self.identity = identity
        self.geometry = geometry
        self.quantity = quantity
        self.name = name

objList = []
for geo, qua, na in zip(geometry.Branches, quantity.Branches, name.Branches):
    obj = BuildingComponent(identity, geo[0], qua[0], na[0])
    objList.append(obj)
# ---------- end python ----------
objlist = ClusterOutput(python.objList)

# ==== cluster DoorDB
number_slider = Slider(500, range=0..1000)
series = Series(Start=0, Step=1, Count="3")
item = ListItem(List=series, Index=0, Wrap=True)  # -> Item, Item1, Item2
dom = ConstructDomain(DomainStart="190", DomainEnd="250")
dom_2 = ConstructDomain(DomainStart="100", DomainEnd="200")
dom_3 = ConstructDomain(DomainStart=Slider(191, range=0..300), DomainEnd=Slider(262, range=0..300))
repeat = RepeatData(Data="doorName_", Length=number_slider)  # -> simplify(graft(Data))
series_2 = Series(Start=0, Step=1, Count=number_slider)  # -> simplify(graft(Series))
# quantity
random = Random(Range=dom_3, Number=number_slider, Seed=item.Item2, Integers=True)
random_2 = Random(Range=dom_2, Number=number_slider, Seed=item.Item)
random_3 = Random(Range=dom, Number=number_slider, Seed=item.Item1)
merge = Merge(Data1=repeat, Data2=series_2)
rectangle = Rectangle(Plane=PlaneXY(0, 0, 0), XSize=random_2, YSize=random_3, Radius=0)  # -> simplify(graft(Rectangle)), Length
graft = GraftTree(Tree=random, IncludeEmptyLists=True, IncludeNullItems=True)  # -> simplify(Tree)
join = TextJoin(Text=merge)
python = GhPythonScript(identity="door", geometry=rectangle.Rectangle, quantity=graft, name=join)  # -> out, objList; inputs geometry: tree of Rectangle3d, quantity: tree of Int32, name: tree; same code as python
objlist = ClusterOutput(python.objList)

# ==== cluster TileDB
number_slider = Slider(200, range=0..1000)
series = Series(Start=0, Step=1, Count="3")
item = ListItem(List=series, Index=0, Wrap=True)  # -> Item, Item1, Item2
dom = ConstructDomain(DomainStart=Slider(10, range=0..10), DomainEnd=Slider(60, range=0..100))
dom_2 = ConstructDomain(DomainStart=Slider(10, range=0..10), DomainEnd=Slider(1120, range=0..10000))
dom_3 = ConstructDomain(DomainStart=Slider(191, range=0..300), DomainEnd=Slider(262, range=0..300))
# width
random = Random(Range=dom, Number=number_slider, Seed=item.Item, Integers=True)
# length
random_2 = Random(Range=dom_2, Number=number_slider, Seed=item.Item1, Integers=True)
# quantity
random_3 = Random(Range=dom_3, Number=number_slider, Seed=item.Item2, Integers=True)
rectangle = Rectangle(Plane=PlaneXY(0, 0, 0), XSize=random, YSize=random_2, Radius=0)  # -> simplify(graft(Rectangle)), Length
graft = GraftTree(Tree=random_3, IncludeEmptyLists=True, IncludeNullItems=True)
repeat = RepeatData(Data="tileName_", Length=number_slider)  # -> simplify(graft(Data))
series_2 = Series(Start=0, Step=1, Count=number_slider)  # -> simplify(graft(Series))
merge = Merge(Data1=repeat, Data2=series_2)
join = TextJoin(Text=merge)
python = GhPythonScript(identity="tile", geometry=rectangle.Rectangle, quantity=graft, name=join)  # -> out, objList; inputs geometry: tree of Rectangle3d, quantity: tree of Int32, name: tree; same code as python
objlist = ClusterOutput(python.objList)

# ==== cluster Cluster_4
S = ClusterInput()
M = ClusterInput()
data = ClusterInput()
mindex = MemberIndex(Set=S, Member=M)  # -> Index, Count
data_2 = Data(data)
item = ListItem(List=data_2, Index=mindex.Index, Wrap=True)
cset = CreateSet(List=flatten(item))  # -> Set, Map
lng = ListLength(List=cset.Set)
S_2 = ClusterOutput(cset.Set)
M_2 = ClusterOutput(cset.Map)
L = ClusterOutput(lng)

# ==== cluster Cluster_5
category = ClusterInput()
chosenitem = ClusterInput()
dataid = ClusterInput()
category_2 = Data(category)
chosenitem_2 = Data(chosenitem)
dataid_2 = Data(dataid)
null = NullItem(Item=chosenitem_2)  # -> flatten(NullFlags), InvalidFlags, Description
item = ListItem(List=null.NullFlags, Index=0, Wrap=True)
filter = StreamFilter(Gate=item, Stream0=chosenitem_2, Stream1=category_2)
mindex = MemberIndex(Set=category_2, Member=filter)  # -> flatten(Index), Count
python = GhPythonScript(choose=mindex.Index, data=dataid_2)  # -> out, a; inputs choose: list, data: list
# ---------- python: Python ----------
a = []
for id, d in enumerate(data):
    if d in choose:
        a.append(id)
# ---------- end python ----------
a = ClusterOutput(python.a)

# ==== cluster Cluster_6
S = ClusterInput()
M = ClusterInput()
data = ClusterInput()
mindex = MemberIndex(Set=S, Member=M)  # -> Index, Count
data_2 = Data(data)
item = ListItem(List=data_2, Index=mindex.Index, Wrap=True)
cset = CreateSet(List=flatten(item))  # -> Set, Map
bnd = Bounds(Numbers=cset.Map)
dedomain = DeconstructDomain(Domain=bnd)  # -> Start, End
S_2 = ClusterOutput(cset.Set)
M_2 = ClusterOutput(cset.Map)
S_3 = ClusterOutput([dedomain.Start, dedomain.End])

# ==== cluster ChangeImgPath
relay = ClusterInput()
panel = Panel("""13
14""")
parent_folder = ClusterInput()
item = ListItem(List=relay, Index=panel, Wrap=True)

# ----
# alter img
python = GhPythonScript(parent_folder=parent_folder, picture_path=item)  # -> out, found_path_list; inputs picture_path: tree
# ---------- python: Python ----------
import os
import ghpythonlib.treehelpers as th

def build_file_map(parent_folder):
    file_map = {}
    for root, dirs, files in os.walk(parent_folder):
        for file in files:
            if file not in file_map:  # This check adds the first found instance if multiple files with the same name exist
                file_map[file] = os.path.join(root, file)
    return file_map

def find_picture(file_map, picture_name):
    return file_map.get(picture_name, None)

# Assuming 'parent_folder' and 'picture_path' are defined
file_map = build_file_map(parent_folder)

total_found = 0
total_not_found = 0

found_path_list = []
for pic_path in picture_path.Branches:
    temp = []
    for pic in pic_path:
        file_name = os.path.basename(pic)
        found_path = find_picture(file_map, file_name)
        if found_path:
            total_found += 1
            temp.append(found_path)
        else:
            total_not_found += 1
            temp.append(os.path.join(parent_folder, "notFound.jpg"))
    found_path_list.append(temp)

found_path_list = th.list_to_tree(found_path_list)
print("found img: %d" % (total_found))
print("not found img: %d" % (total_not_found))
# ---------- end python ----------

panel_2 = Panel("""16
2""")
replace = ReplaceItems(List=relay, Item=python.found_path_list, Indices=panel, Wrap=False)
item_2 = ListItem(List=replace, Index=panel_2, Wrap=True)

# ----
# alter url
python_2 = GhPythonScript(data=item_2)  # -> out, simplify(graft(urlList)); inputs data: tree
# ---------- python_2: Python ----------
import ghpythonlib.treehelpers as th
urlList = []
for d in data.Branches:
    bautStr = d[0]
    if bautStr.find(","):
        print("heee")
        print(bautStr)
    alterStr = str(d[0]).replace(" ", "_")
    urlString = "https://bfhreuse24.site/shop/" + alterStr + "/" + str(d[1])
    url = urlString 
    urlList.append(url)

urlList = th.list_to_tree(urlList)
# ---------- end python_2 ----------

replace_2 = ReplaceItems(List=replace, Item=python_2.urlList, Indices="16", Wrap=False)
L = ClusterOutput(replace_2)

# ==== cluster ShowInRh
L = ClusterInput()
P = ClusterInput()
dispatch = Dispatch(List=L, DispatchPattern=P)  # -> ListA, ListB
clean = CleanTree(RemoveNulls=True, RemoveInvalid=True, RemoveEmpty=invert(False), Tree=dispatch.ListA)
panel = Panel("""bauteil_obergruppe
bauteil_gruner
uuid
kosten
zustand
material
ref_ge_gebauede_geschoss
breite
hoehe
tiefe
flaeche
masse
anzahl
foto1
foto2
co2
url""")
panel_2 = Panel("""7
8
9""")
item = ListItem(List=clean, Index=panel_2, Wrap=True)
item_2 = ListItem(List=clean, Index="12", Wrap=True)
x = ClusterInput()
y = ClusterInput()
number_slider = Slider(10, range=0..10)
number_slider_2 = Slider(23, range=0..100)
alterfalse = GhPythonScript(data=item)  # -> a; inputs data: tree
# ---------- alterfalse: Python ----------
import ghpythonlib.treehelpers as th
o = []
for dd in data.Branches:
    temp = []
    for d in dd:
        if d == 0:
            d = 1
        temp.append(d)
    o.append(temp)

a = th.list_to_tree(o)
# ---------- end alterfalse ----------
y_2 = Data(y)
x_2 = Data(x)
item_3 = ListItem(List=alterfalse, Index=0, Wrap=True)  # -> Item, Item1, Item2
rectangle = Rectangle(Plane=PlaneXY(0, 0, 0), XSize=item_3.Item, YSize=item_3.Item1, Radius=0)  # -> Rectangle, Length
ma = MassAddition(Input=flatten(item_3.Item))  # -> Result, PartialResults
panel_3 = Panel(ma.PartialResults)
boundary = BoundarySurfaces(Edges=rectangle.Rectangle)
Z = UnitZ(Factor=item_3.Item2)
addition = Addition(A=item_3.Item1, B=y_2)
extr = Extrude(Base=boundary, Direction=Z)
python = GhPythonScript(x=ma.PartialResults, y=x_2)  # -> a; inputs x: list
# ---------- python: Python ----------
x = [i + y * (id+1) for id, i in enumerate(x)]
x.insert(0,0)
a = x[:-1]
# ---------- end python ----------
series = Series(Start=0, Step=addition, Count=item_2)
panel_4 = Panel(python)

panel_5 = Panel("""bauteil_gruner
uuid
material""")
panel_6 = Panel("""1
2
5""")

X = UnitX(Factor=python)
item_4 = ListItem(List=clean, Index=panel_6, Wrap=True)
item_5 = ListItem(List=clean, Index=0, Wrap=True)  # -> Item, Item1
move = Move(Geometry=extr, Motion=graft(X))  # -> Geometry, Transform
Y = UnitY(Factor=series)
xy = XYPlane(Origin=Point(0, 0, 0))
python_2 = GhPythonScript(data=item_4, name=panel_5)  # -> out, simplify(treeContainer); inputs data: tree, name: list
# ---------- python_2: Python ----------
from Grasshopper.Kernel.Data import GH_Path
import System.Array as array
from Grasshopper import DataTree

treeContainer = DataTree[object]()

for id, d in enumerate(data.Branches):
    new_d = ""
    for n, info in zip(name, d):
        st = " : ".join((n, info)) + "\n"
        new_d += st
    path = data.Paths[id]
    treeContainer.AddRange([new_d], path)
# ---------- end python_2 ----------
pt = Point(xy)
join = TextJoin(Text=[item_5.Item, item_5.Item1], Join=" _ ")
move_2 = Move(Geometry=move.Geometry, Motion=Y)  # -> Geometry, Transform
move_3 = Move(Geometry=pt, Motion=graft(X))  # -> Geometry, Transform
Y_2 = UnitY(Factor=expr("-x", Slider(4, range=0..10)))
move_4 = Move(Geometry=move_3.Geometry, Motion=Y_2)  # -> simplify(Geometry), Transform
tstat = TreeStatistics(Tree=move_4.Geometry)  # -> Paths, Length, Count
tstat_2 = TreeStatistics(Tree=python_2.treeContainer)  # -> Paths, Length, Count
panel_7 = Panel(move_4.Geometry)
replace = ReplacePaths(Data=python_2.treeContainer, Search=tstat_2.Paths, Replace=tstat.Paths)
merge = Merge(Data1=move_4.Geometry, Data2=replace)
layername = Data(join)
text = Data(merge)
data = Data(clean)
geo = Geometry(move_2.Geometry)
text_2 = ClusterOutput(text)
data_2 = ClusterOutput(data)
geo_2 = ClusterOutput(geo)
layername_2 = ClusterOutput(layername)

# ==== cluster ObjAttr
layername = ClusterInput()
data = ClusterInput()
layername_2 = Data(layername)
data_2 = Data(data)
b = ClusterInput()
emptyreplace = GhPythonScript(x=data_2)  # -> a; inputs x: tree
# ---------- emptyreplace: Python ----------
import ghpythonlib.treehelpers as th

a = []
for b in x.Branches:
    t = []
    for i in b:
        if i == "":
            t.append("FALSE")
        else:
            t.append(i)
    a.append(t)

a = th.list_to_tree(a)
# ---------- end emptyreplace ----------
ghpython_script = GhPythonScript(b=b, data=layername_2)  # -> oData; inputs b: Boolean, data: tree
# ---------- ghpython_script: Python ----------
if b:
    oData = data
# ---------- end ghpython_script ----------
panel = Panel("""bauteil_obergruppe
bauteil_gruner
uuid
kosten
zustand
material
ref_gebauede_geschoss
breite
hoehe
tiefe
flaeche
masse
anzahl
foto1
foto2
co2
url""")
create_modify_layers = CreateModifyLayers(LayerName=ghpython_script, DeleteLayer=False, enableFullPath=True)  # -> LayerNames, LayerFullPath
createattributes = CreateAttributes(
    Name=create_modify_layers.LayerNames,
    LayerName=create_modify_layers.LayerNames,
    UserDataKeys=panel,
    UserDataValues=emptyreplace,
    enableFullPath=False)
object_attributes = ClusterOutput(createattributes)

# ==== cluster Cluster_7
showitemnum = ClusterInput()
page = ClusterInput()
sortreverse = ClusterInput()
chosenitem = ClusterInput()
sortitem = ClusterInput()
winheight = ClusterInput()
topic = ClusterInput()
data = ClusterInput()
openui = ClusterInput()
rownum = ClusterInput()
showitemnum_2 = Data(showitemnum)
sortreverse_2 = Data(sortreverse)
chosenitem_2 = Data(chosenitem)
page_2 = Data(page)
sortitem_2 = Data(sortitem)
winheight_2 = Data(winheight)
topic_2 = Data(topic)
data_2 = Data(data)
openui_2 = Data(openui)
rownum_2 = Data(rownum)
item = ListItem(List=flatten(sortitem_2), Index=0, Wrap=True)
mindex = MemberIndex(Set=topic_2, Member=item)  # -> flatten(Index), Count
null = NullItem(Item=item)  # -> NullFlags, InvalidFlags, Description
python = GhPythonScript(Data=data_2, item=mindex.Index, sortReverse=sortreverse_2)  # -> out, sorted_branches; inputs Data: tree, sortReverse: Boolean
# ---------- python: Python ----------
import ghpythonlib.treehelpers as th

def sort_branches_by_item(branches, index, reverseBool):
    
    branches_with_false = []
    other_branches = []
    for branch in branches:
        try:
            floatItem = float(branch[index])
            other_branches.append(branch)
        except:
            branches_with_false.append(branch)
    
    # Sort the valid branches based on the item at the specified index
    sorted_other_branches = sorted(other_branches, key=lambda branch: float(branch[index]), reverse=reverseBool)
    
    # Append the branches with False at the end
    sorted_branches = sorted_other_branches + branches_with_false
    
    return sorted_branches

# Example usage
branches = [list(b) for b in Data.Branches]
sorted_branches = sort_branches_by_item(branches, item, sortReverse)
sorted_branches = th.list_to_tree(sorted_branches)
# ---------- end python ----------
filter = StreamFilter(Gate=null.NullFlags, Stream0=python.sorted_branches, Stream1=data_2)
data_3 = Data(filter)
null_2 = NullItem(Item=chosenitem_2)  # -> flatten(NullFlags), InvalidFlags, Description
item_2 = ListItem(List=null_2.NullFlags, Index=0, Wrap=True)
filter_2 = StreamFilter(Gate=item_2, Stream0=chosenitem_2, Stream1=topic_2)

# ----
# search Image & url path
panel = Panel("foto1")
mindex_2 = MemberIndex(Set=topic_2, Member="foto2")  # -> flatten(Index), Count
mindex_3 = MemberIndex(Set=topic_2, Member=panel)  # -> flatten(Index), Count
item_3 = ListItem(List=data_3, Index=mindex_2.Index, Wrap=True)
item_4 = ListItem(List=data_3, Index=mindex_3.Index, Wrap=True)
merge = Merge(Data1=item_4, Data2=item_3)

mindex_4 = MemberIndex(Set=topic_2, Member=filter_2)  # -> flatten(Index), Count
tstat = TreeStatistics(Tree=data_3)  # -> Paths, Length, Count
item_5 = ListItem(List=data_3, Index=mindex_4.Index, Wrap=True)
dup = DuplicateData(Data=filter_2, Number=tstat.Count, Order=True)
unflatten = UnflattenTree(Tree=dup, Guide=item_5)
graft = GraftTree(Tree=item_5, IncludeEmptyLists=True, IncludeNullItems=True)
graft_2 = GraftTree(Tree=unflatten, IncludeEmptyLists=True, IncludeNullItems=True)
merge_2 = Merge(Data1=graft_2, Data2=graft)
join = TextJoin(Text=merge_2, Join=": ")
pshift = ShiftPaths(Data=join, Offset=-1)
tstat_2 = TreeStatistics(Tree=pshift)  # -> Paths, Length, Count
series = Series(Start=0, Step=1, Count=tstat_2.Count)
partition = PartitionList(List=series, Size=showitemnum_2)
tstat_3 = TreeStatistics(Tree=partition)  # -> Paths, Length, expr("x-1", Count)
min = Minimum(A=page_2, B=tstat_3.Count)
cluster = BranchLook(data=partition, i=min)
cluster_2 = BranchLook(data=data_3, i=cluster)
cluster_3 = BranchLook(data=pshift, i=cluster)
cluster_4 = BranchLook(data=merge, i=cluster)
item_6 = ListItem(List=cluster_2, Index="16", Wrap=True)
c__grasshoppername = CSharpScript(inputName="py\UI_usedMaterial.py")  # -> ghParentPath, filePath; inputs inputName: String
# ---------- c__grasshoppername: C# usings ----------
using System.IO;
# ---------- c__grasshoppername: C# ----------
    if(this.GrasshopperDocument.IsFilePathDefined)
    {
      string p = this.GrasshopperDocument.FilePath;
      DirectoryInfo directoryInfo = new DirectoryInfo(p);
      string parentFolderPath = directoryInfo.Parent.Parent.FullName;

      string filePath_ = string.Format("{0}\\{1}", parentFolderPath, inputName);

      ghParentPath = parentFolderPath;
      filePath = filePath_;

    }
# ---------- end c__grasshoppername ----------
item_7 = ListItem(List=cluster_4, Index=0, Wrap=True)
python_2 = GhPythonScript(
    open=Button(),
    showNum=showitemnum_2,
    winHeight=winheight_2,
    rowNum=rownum_2,
    imagePaths=item_7,
    urlList=item_6,
    data=cluster_3)  # -> out, selectedIndices, graft(checkbox_states); inputs open: Boolean, showNum: Int32, rowNum: Int32, imagePaths: tree, urlList: tree, data: tree
# ---------- python_2: Python ----------
import Rhino
import Eto.Forms as forms
import Eto.Drawing as drawing
import webbrowser
import scriptcontext as sc

if winHeight is None:
    winHeight = 800
if rowNum is None:
    rowNum = 4

def create_label_with_font(text, font_size, font_family="Arial"):
    label = forms.Label(Text=text)
    label.Font = drawing.Font(font_family, font_size)
    return label

# Assume 'selectedIndices' is a global list defined outside this class 
# to store the indices of selected items. This is a simplification for demonstration.

selectedIndices = []  # This will be used to store the indices of selected items.
selectedBool = []

class TestWindow(forms.Form):  # Use Dialog[bool] for a modal dialog
    def __init__(self):
        super(TestWindow, self).__init__()
        self.Title = "Image Viewer"
#        self.MinimumSize = drawing.Size(100, 50)
        
        self.Location = drawing.Point(100, 100)


        self.checkBoxes = []

        self.layout = forms.DynamicLayout()
        self.layout.Height = winHeight

        self.scrollable = forms.Scrollable()
        self.imageLayout = forms.DynamicLayout()
        self.imageLayout.Padding = drawing.Padding(0, 10, 10, 60)
        self.scrollable.Content = self.imageLayout
        self.layout.AddRow(self.scrollable)

        self.Content = self.layout

        self.imagePaths = imagePaths
        self.urlList = urlList
        self.dataList = dataList
        self.populate_images()


    def populate_images(self):
        images_per_row = rowNum
        row = []
        count = 0
        
        for path, data, urrl in zip(self.imagePaths, self.dataList, self.urlList):
            try:
                unitLayout = forms.StackLayout()
                unitLayout.Orientation = forms.Orientation.Vertical
                unitLayout.Spacing = 5
                unitLayout.Padding = drawing.Padding(10)
    
                image = drawing.Bitmap(path)
                imageView = forms.ImageView()
                imageView.Image = image
                imageView.Size = drawing.Size(250, 250)  # Fixed size for the image
    
                # Create a horizontal StackLayout for descriptions
                descriptionsLayout = forms.StackLayout()
                descriptionsLayout.Spacing = 3
                
                descriptions = data
                
                desired_font_size = 10
                
                for desc in descriptions:
                    # Create and add labels with the desired font size to the layout.
                    descriptionsLayout.Items.Add(create_label_with_font(desc, desired_font_size))
                
                # Encapsulate descriptionsLayout in a Scrollable for horizontal scrolling
                descriptionScrollable = forms.Scrollable()
                descriptionScrollable.Content = descriptionsLayout
                
                # Set the size of the Scrollable to match the imageView's size
                # Here, the height is arbitrary since it's a horizontal scroll
                descriptionScrollable.Width = imageView.Width
                
                link_button = forms.LinkButton(Text="Open Website")
                link_button.Click += lambda sender, e, url=urrl: webbrowser.open(url)
                
                
                # Checkbox and Label Pair
                checkBoxLabelLayout = forms.StackLayout()  # Horizontal layout for checkbox and label
                checkBoxLabelLayout.Orientation = forms.Orientation.Horizontal
                checkBoxLabelLayout.Spacing = 5
                
                checkBox = forms.CheckBox() #####################################
                checkBox.CheckedChanged += self.on_checked_changed
                self.checkBoxes.append(checkBox)
                
                checkBoxLabel = forms.Label(Text="Show in Rhino")  # Custom font label
                checkBoxLabel.Font = drawing.Font("Arial Bold", 13)  # Set the font here
                
                checkBoxLabelLayout.Items.Add(checkBox)
                checkBoxLabelLayout.Items.Add(checkBoxLabel)
                
                
                # Add the imageView, descriptionScrollable, and checkBox to the unitLayout
                unitLayout.Items.Add(imageView)
                unitLayout.Items.Add(descriptionScrollable)  # Add the scrollable descriptions
                unitLayout.Items.Add(link_button)
                unitLayout.Items.Add(checkBoxLabelLayout)
    
                row.append(unitLayout)
    
                count += 1
                if count == images_per_row:
                    self.imageLayout.AddRow(*row)
                    row = []
                    count = 0
    
            except Exception as e:
                forms.MessageBox.Show("Failed to load image: " + str(e))
    
        if row:
            self.imageLayout.AddRow(*row)
    
    
    def on_checked_changed(self, sender, e):
        # Update the stored state when a checkbox is changed
        states = [checkBox.Checked for checkBox in self.checkBoxes]
        sc.sticky['checkbox_states'] = states



imagePaths = [image[0] for image in imagePaths.Branches]
urlList = [urll[0] for urll in urlList.Branches]
dataList = [d for d in data.Branches]


def show_check_box_form():
    form = TestWindow()
    form.Show()

# A simple function to simulate a value listener that polls for checkbox state changes
def poll_checkbox_states():
    # Default to all False if not set
    return sc.sticky.get('checkbox_states', [False] * showNum)

# This would be your Grasshopper component's main run function
# Use a timer to periodically trigger this function
checkbox_states = poll_checkbox_states()


# Assuming 'showForm' is a boolean input to trigger the form display
if open:
    sc.sticky['checkbox_states'] = [False] * showNum
    show_check_box_form()
# ---------- end python_2 ----------
python_3 = GhPythonScript(
    open=openui_2,
    showNum=showitemnum_2,
    winHeight=winheight_2,
    rowNum=rownum_2,
    imagePaths=item_7,
    urlList=item_6,
    data=cluster_3)  # -> out, selectedIndices, graft(checkbox_states); inputs open: Boolean, showNum: Int32, rowNum: Int32, imagePaths: tree, urlList: tree, data: tree; same code as python_2
data_4 = Data(cluster_2)
checkbox_states = ClusterOutput(python_3.checkbox_states)
data_5 = ClusterOutput(data_4)

# ==== cluster Cluster_8

# ----
# Title List
panel = Panel("""bauteil_obergruppe
bauteil_gruner
uuid
kosten
zustand
material
ref_gebauede_geschoss
breite
hoehe
tiefe
flaeche
masse
anzahl
foto1
foto2
co2
url""")

bauteil_obergruppe = ClusterInput()
bauteil_obergruppe_2 = ClusterInput()
data = ClusterInput()
data_2 = Data(data)
title = Data(panel)
bauteil_obergruppe_3 = Data(bauteil_obergruppe)
bauteil_gruner = Data(bauteil_obergruppe_2)
list = ValueList({"bauteil_obergruppe", "bauteil_gruner", "material"}, selected="bauteil_gruner")
list_2 = ValueList({"bauteil_obergruppe", "bauteil_gruner", "material"}, selected="bauteil_obergruppe")
panel_2 = Panel("""bauteil_obergruppe
bauteil_gruner
material""")
cluster = Cluster_4(S=title, M=list_2, data=data_2)  # -> S_2, M_2, L
panel_4 = Panel(cluster.L)
cluster_2 = Cluster_5(category=cluster.S_2, chosenitem=bauteil_obergruppe_3, dataid=cluster.M_2)
data_topic = Data(title)
alldata = Data(data_2)
python = GhPythonScript(data=cluster_2)  # -> union, quan; inputs data: tree
# ---------- python: Python ----------
def intersection_of_lists(nested_list):
    # Check if the nested list is empty or contains only empty lists
    if not nested_list or all(len(sublist) == 0 for sublist in nested_list):
        return [], 0

    # Initialize the intersection set with the first sublist to compare with others
    intersection_set = set(nested_list[0])
    
    # Iterate over each sublist in the nested list starting from the second sublist
    for sublist in nested_list[1:]:
        # Update the intersection set to keep only elements also found in the current sublist
        intersection_set.intersection_update(sublist)
    
    # Convert the set back to a list to get the final intersection list
    intersection_list = list(intersection_set)
    
    # Return the intersection list and the number of elements in the intersection
    return intersection_list, len(intersection_list)

listList = []
for d in data.Branches:
    if len(d) == 0:
        continue
    listList.append(d)

union, quan = intersection_of_lists(listList)
# ---------- end python ----------

# ----
# Quantity of items matching filters
panel_5 = Panel(python.quan)

cluster_3 = BranchLook(data=alldata, i=python.union)
cluster_4 = Cluster_4(S=title, M=list, data=cluster_3)  # -> S_2, M_2, L
panel_6 = Panel(cluster_4.L)
cluster_5 = Cluster_5(category=cluster_4.S_2, chosenitem=bauteil_gruner, dataid=cluster_4.M_2)
python_2 = GhPythonScript(data=cluster_5)  # -> union, quan; inputs data: tree; same code as python

# ----
# Quantity of items matching filters
panel_7 = Panel(python_2.quan)

cluster_6 = BranchLook(data=cluster_3, i=python_2.union)
data_3 = Data(cluster_6)
num = Data(python_2.quan)
data_4 = ClusterOutput(data_3)
num_2 = ClusterOutput(num)

# ==== cluster CladdingCatergory
geo = ClusterInput()
data = ClusterInput()
geo_2 = Geometry(geo)
data_2 = Data(data)
int = Integer(flatten(data_2))
cset = CreateSet(List=int)  # -> Set, Map
sort = SortList(Keys=cset.Set)  # -> Keys, ValuesA
lng = ListLength(List=cset.Set)
series = Series(Start=0, Step=1, Count=lng)
panel = Panel(sort.Keys)
python = GhPythonScript(become=series, changed=sort.Keys, changeList=data_2)  # -> out, newList; inputs become: list, changed: list, changeList: tree of Int32
# ---------- python: Python ----------
import ghpythonlib.treehelpers as th

width = become
length = changed

number_mapping = {}
for w, l in zip(width, length):
    number_mapping[l] = w

newList = []
for chList in changeList.Branches:
    newList.append([number_mapping[number] if number in number_mapping else number for number in chList])

newList = th.list_to_tree(newList)
# ---------- end python ----------
unflatten = UnflattenTree(Tree=python.newList, Guide=data_2)
geo_3 = Geometry(flatten(geo_2))
flatten = FlattenTree(Tree=unflatten, Path="{0}")  # -> graft(Tree)
graft = GraftTree(Tree=geo_3, IncludeEmptyLists=True, IncludeNullItems=True)
path = ConstructPath(Indices=flatten)  # -> flatten(Branch)
tstat = TreeStatistics(Tree=graft)  # -> Paths, Length, Count
replace = ReplacePaths(Data=graft, Search=tstat.Paths, Replace=path)
replace_2 = ReplacePaths(Data=flatten, Search=tstat.Paths, Replace=path)
data_3 = Data(replace_2)
geo_4 = Geometry(replace)
data_4 = ClusterOutput(data_3)
geo_5 = ClusterOutput(geo_4)
