# Grasshopper definition wallSystem4_EA Comments.gh (Grasshopper 1.0.7)
# plug-ins: Human, Kangaroo Components

panel = Panel("py\categorize.py")  # disabled
brep = Brep([<brep referenced from the Rhino model> x2])  # disabled
brep_2 = Brep([<brep referenced from the Rhino model> x3])  # disabled
brep_3 = Brep([<brep referenced from the Rhino model> x3])  # disabled
brep_4 = Brep([<brep referenced from the Rhino model> x3])  # disabled
crv = Curve([<curve referenced from the Rhino model> x4])  # disabled
c__grasshoppername = CSharpScript(inputName=panel)  # -> ghParentPath, filePath; inputs inputName: String; disabled
# ---------- c__grasshoppername: C# usings ----------
using System.IO;
# ---------- c__grasshoppername: C# ----------
    if(this.GrasshopperDocument.IsFilePathDefined)
    {
      string p = this.GrasshopperDocument.FilePath;
      DirectoryInfo directoryInfo = new DirectoryInfo(p);
      string parentFolderPath = directoryInfo.Parent.Parent.FullName;

      string filePath_ = string.Format("{0}\\{1}", parentFolderPath, inputName);

      ghParentPath = parentFolderPath;
      filePath = filePath_;

    }
# ---------- end c__grasshoppername ----------
file = ReadFile(File=c__grasshoppername.filePath, PerLineParse=False)  # disabled
windowfromrh = GhPythonScript(brep=brep)  # -> out, newObj, width, height, depth; inputs brep: Guid; disabled
# ---------- windowfromrh: Python ----------
import Rhino
import scriptcontext as sc
import rhinoscriptsyntax as rs
import Grasshopper.Kernel as ghkernel

class ObjFromRH:
    def __init__(self, **kwargs):
        for key, value in kwargs.items():
            setattr(self, key, value)


# Set scriptcontext.doc to Rhino's document to access its objects
sc.doc = Rhino.RhinoDoc.ActiveDoc

def get_attribute(object_id, key=None):
    """
    Get user text from an object by its ID.
    """
    if object_id is None:
        print("No object ID provided.")
        return None

    rhino_object = sc.doc.Objects.Find(object_id)
    if not rhino_object:
        print("Object not found.")
        return None

    if key:
        value = rhino_object.Attributes.GetUserString(key)
        print("User text for key '{}': {}".format(key, value))
        return value
    else:
        all_user_text = rhino_object.Attributes.GetUserStrings()
        objDict = {}
        for k in all_user_text.AllKeys:
            objDict[k] =  all_user_text[k]
        
        objDict["geo"] = rhino_object.Geometry
        return objDict


if brep == None:
    ghenv.Component.AddRuntimeMessage(ghkernel.GH_RuntimeMessageLevel.Warning, "brep is empty.")
else:
    # To get user text
    obj_dict = get_attribute(brep)
    newObj = ObjFromRH(**obj_dict)
    newObj.attr = obj_dict
    
    
    
    width = get_attribute(brep, "breite")
    height = get_attribute(brep, "hoehe")
    depth = get_attribute(brep, "tiefe")
    
    width = width if width != "FALSE" else 1
    height = height if height != "FALSE" else 1
    depth = depth if depth != "FALSE" else 1
    
    width = int(width)
    height = int(height)
    depth = int(depth)
# ---------- end windowfromrh ----------
number_slider = Slider(64, range=0..100)  # disabled
area = Area(Geometry=brep_2)  # -> Area, Centroid; disabled
area_2 = Area(Geometry=brep_3)  # -> Area, Centroid; disabled
area_3 = Area(Geometry=brep_4)  # -> Area, Centroid; disabled
python = GhPythonScript(Code=file, Carrier=brep_2, Window=windowfromrh.newObj, Door=brep_4, ModuleCrv=crv)  # -> Out, A, B, C, D; disabled
points = PointList(Points=area_2.Centroid, Size=number_slider)  # disabled
points_2 = PointList(Points=area.Centroid, Size=number_slider)  # disabled
points_3 = PointList(Points=area_3.Centroid, Size=number_slider)  # disabled
panel_2 = Panel(python.Out)  # disabled
merge = Merge(Data1=python.A, Data2=python.B, Data3=python.C, Data4=python.D)  # disabled
number_slider_2 = Slider(0, range=0..2)  # disabled
cluster = BranchLook(data=merge, i=number_slider_2)  # disabled
python_2 = GhPythonScript(x=python.A)  # -> out, a; inputs x: tree
# ---------- python_2: Python ----------
import Rhino.Geometry as rg
from Grasshopper.Kernel.Data import GH_Path
import System.Array as array
from Grasshopper import DataTree

path = GH_Path(array[int]([5]))
#p = x.Path(0)
#print(p)
#print(x.Paths)
#
#print(x.Branch(path))
windowData = x.Branch(path)
window = windowData if not windowData==None else []
print(window)
# ---------- end python_2 ----------

# ----
# Comments of Edyta
# 
# 1. For the clarity mark the clearly the chunks of the script and mark it by color. Use the clear color settings per type. Add short descriptions.
#  I tried to do it, please correct it / finish it.
# 
# - Make a clear distinction of the input - boundary of the facade and openings.
# - Mark where is the facade panelling, where are the insulation layers etc.
# - many students work with text description of the components and not icons. therefore it`s important to have clear descriptin og the inputs and outputs.
# 
# 2. Remove all unnecessary parts of the script (also started to do it. It should be as concise as possible, otherwise students will be terrified.
# 
# 4. Remove all inputs from the script, which are based on the objects with attributes. Read the dimensions directly from the input geometry.
# 
# 5. If there are different options for the inputs, use boolean-based filter
# 
# 6. My input don`t work (neither for the boundary surfaces of the facade as well as for the openings). Why? I marked them in pink
# 
#  7. Windows and doors should recognize the surface to which it belong. the script should take care of the data strucutre, not the students.
# Alternatively, we limit it just to one facade.
# 
# 8. As the data from the Roche DB is smaller than the data from Salza catalogue, many students look for materials in the Salza catalogue and not
# Roche. Therefore I am not sure how useful the direct connection to the DB will be. but let`s keep it here as a proof of concept.
# 
# 9. split normal and shingle facades to 2 different files.
# 
# 10. Add the button to bake geometry (with atributes).
# 
# 11. Add easy control of the number of layers. With the slider, or other intuitive method
# Script Reader
panel_3 = Panel("py\wallDefinition3.py")
c__grasshoppername_2 = CSharpScript(inputName=panel_3)  # -> ghParentPath, filePath; inputs inputName: String; same code as c__grasshoppername

xz = XZPlane(Origin=Point(0, 0, 0))
xz_2 = XZPlane(Origin=Point(0, 0, 0))
recgrid = Rectangular(Plane=xz, SizeX=Slider(100, range=0..100), SizeY=Slider(54, range=0..100), ExtentX=10, ExtentY=5)  # -> Cells, Points
explode = Explode(Curve=recgrid.Cells, Recursive=True)  # -> Segments, Vertices
number_slider_3 = Slider(46, range=0..100)
number_slider_4 = Slider(46, range=0..100)
pt = Point(Point(343.0749014, -5.49793914, 141.8267457))
number_slider_5 = Slider(31, range=0..100)
number_slider_6 = Slider(31, range=0..100)
pt_2 = Point(Point(274.1432895, -3.568335323, 123.2507544))
item = ListItem(List=explode.Segments, Index=0, Wrap=True)  # -> flatten(Item), flatten(Item1), flatten(Item2), flatten(Item3)
project = Project(Geometry=pt_2, Plane=xz_2)  # -> Geometry, Transform
project_2 = Project(Geometry=pt, Plane=xz_2)  # -> Geometry, Transform
dupln = RemoveDuplicateLines(Lines=[item.Item, item.Item2], Tolerance=0.01)
dupln_2 = RemoveDuplicateLines(Lines=[item.Item1, item.Item3], Tolerance=0.01)
dom = ConstructDomain(DomainStart=expr("-x", number_slider_5), DomainEnd=number_slider_5)
dom_2 = ConstructDomain(DomainStart=expr("-x", number_slider_6), DomainEnd=number_slider_6)
dom_3 = ConstructDomain(DomainStart=expr("-x", number_slider_3), DomainEnd=number_slider_3)
dom_4 = ConstructDomain(DomainStart=expr("-x", number_slider_4), DomainEnd=number_slider_4)
xz_3 = XZPlane(Origin=project.Geometry)
xz_4 = XZPlane(Origin=project_2.Geometry)
c__grasshoppername_3 = CSharpScript(inputName="py\alignSystem.py")  # -> ghParentPath, filePath; inputs inputName: String; same code as c__grasshoppername
join = JoinCurves(Curves=dupln, Preserve=False)
join_2 = JoinCurves(Curves=dupln_2, Preserve=False)
file_2 = ReadFile(File=c__grasshoppername_3.filePath, PerLineParse=False)
rectangle = Rectangle(Plane=xz_4, XSize=dom, YSize=dom_3, Radius=0)  # -> Rectangle, Length
rectangle_2 = Rectangle(Plane=xz_3, XSize=dom_2, YSize=dom_4, Radius=0)  # -> Rectangle, Length
crv_2 = Curve([join, join_2])
merge_2 = Merge(Data1=rectangle.Rectangle, Data2=rectangle_2.Rectangle)

# ----
# Synthetic data, should be changed
number_slider_7 = Slider(200, range=0..1000)
tilemockdata = TileMockData(num=number_slider_7)

python_3 = GhPythonScript(Code=file_2, WindowGeo=merge_2, Grid=crv_2, Toler=Slider(10, range=0..10), BasePlane=xz)  # -> Out, A, B, C, D
python_4 = GhPythonScript(x=python_3.C)  # -> out, a
# ---------- python_4: Python ----------
a = x
# ---------- end python_4 ----------
panel_4 = Panel(python_3.Out)
move = Move(Geometry=merge_2, Motion=python_3.A)  # -> Geometry, Transform
previewlw = CustomPreviewLineweights(
    Geometry=move.Geometry,
    Shader={diffuse=RGB(255, 105, 180), emission=RGB(76, 32, 54), shine=0.5, specular=RGB(255, 255, 255), transparency=0},
    Thickness=Slider(5, range=0..10),
    Absolute=False)
python_5 = GhPythonScript()  # -> out, a
# ---------- python_5: Python ----------
import Rhino.Geometry as rg
from ghpythonlib.components import LineSDL, CurveXCurve

a = rg.Point3d(0,0,0)
b = rg.Point3d(0,0,0)

print(a == b)
# ---------- end python_5 ----------

# ----
# where do I set the layers???
# Let`s split the shingle facade and normal facade to 2 different files, for the clarity
# Wall_Normal Facade
# Script Reader
panel_5 = Panel("py\wallDefinition3.py")
c__grasshoppername_4 = CSharpScript(inputName="py\tileDefinition.py")  # -> ghParentPath, filePath; inputs inputName: String; same code as c__grasshoppername
c__grasshoppername_5 = CSharpScript(inputName="py\boardDefinition.py")  # -> ghParentPath, filePath; inputs inputName: String; same code as c__grasshoppername
c__grasshoppername_6 = CSharpScript(inputName="py\structAndFillDefinition.py")  # -> ghParentPath, filePath; inputs inputName: String; same code as c__grasshoppername
c__grasshoppername_7 = CSharpScript(inputName="py\substructionDefinition.py")  # -> ghParentPath, filePath; inputs inputName: String; same code as c__grasshoppername
c__grasshoppername_8 = CSharpScript(inputName="py\paintDefinition.py")  # -> ghParentPath, filePath; inputs inputName: String; same code as c__grasshoppername
c__grasshoppername_9 = CSharpScript(inputName=panel_5)  # -> ghParentPath, filePath; inputs inputName: String; same code as c__grasshoppername

# ----
# paint
file_3 = ReadFile(File=c__grasshoppername_8.filePath, PerLineParse=False)

# ----
# Inner Material Setting
# board
file_4 = ReadFile(File=c__grasshoppername_5.filePath, PerLineParse=False)

# ----
# subStruct
file_5 = ReadFile(File=c__grasshoppername_7.filePath, PerLineParse=False)

# ----
# subStruct + infill
file_6 = ReadFile(File=c__grasshoppername_6.filePath, PerLineParse=False)

# ----
# claddingWidth
cladding_w = Slider(30, range=0..1000)
cladding_w_2 = Integer(cladding_w)

# ----
# Shingle Overlap settings
cladding_direction_vertical_true_horizon = BooleanToggle(True)  # "Cladding Direction (vertical True, horizontal False)"

# ----
# kindNum
# What is the width Weight and length Weight?
kind_numbe = Slider(5, range=0..10)
kind_number = Integer(kind_numbe)

# ----
# horiOverlap
horizontal_overlap = Slider(1, range=0..10)

# ----
# vertiOverlap
vertical_overlap = Slider(0, range=0..1000)

# ----
# horiAngle
horizontal_angle = Slider(10, range=0..100)

# ----
# vertiAngle
vertical_angle = Slider(0, range=0..60)

# ----
# substructThickness
substrucutre_thickness = Slider(2, range=0..100)

# ----
# substructWidth
substrucutre_width = Slider(4, range=0..100)

# ----
# claddingLength
cladding_l = Slider(60, range=0..1000)
cladding_l_2 = Integer(cladding_l)

# ----
# Door
# Use geometry to find opening from DB.
# I don``t understand the difference between these inputs.
# the top one are the elements with atributes? for the simplification reasons,
# I would remove this option completely.
# 
#  Let`s just make 1 type of input- surface based
# 
#  I don`t understand why you have input for every object separately.
# 
# Describe the names of the input components. Use only one input component for one type of objects, instead of 4.
# 
# 
#  Each input and output should be clearly descripbed
# Set geometry from rhino
# same comments to windows as to doors:
brep_input_true_data_input_false = BooleanToggle(True)
brep_5 = Brep(<brep referenced from the Rhino model>)
brep_6 = Brep(<brep referenced from the Rhino model>)
# My input brep doesn`t work.if inputted here. it does work if I connect it below
brep_7 = Brep(<brep referenced from the Rhino model>)
door_edyta = Brep(<brep referenced from the Rhino model>)
brep_8 = Brep(<brep referenced from the Rhino model>)
doorfromrh = GhPythonScript(brep=[brep_5, brep_6])  # -> out, newObj, width, height, depth; inputs brep: Guid
# ---------- doorfromrh: Python ----------
import Rhino
import scriptcontext as sc
import rhinoscriptsyntax as rs
import Grasshopper.Kernel as ghkernel

class ObjFromRH:
    def __init__(self, **kwargs):
        for key, value in kwargs.items():
            setattr(self, key, value)


# Set scriptcontext.doc to Rhino's document to access its objects
sc.doc = Rhino.RhinoDoc.ActiveDoc

def get_attribute(object_id, key=None):
    """
    Get user text from an object by its ID.
    """
    if object_id is None:
        print("No object ID provided.")
        return None

    rhino_object = sc.doc.Objects.Find(object_id)
    if not rhino_object:
        print("Object not found.")
        return None

    if key:
        value = rhino_object.Attributes.GetUserString(key)
        print("User text for key '{}': {}".format(key, value))
        return value
    else:
        all_user_text = rhino_object.Attributes.GetUserStrings()
        objDict = {}
        for k in all_user_text.AllKeys:
            objDict[k] =  all_user_text[k]
        
        objDict["geo"] = rhino_object.Geometry
        return objDict


if brep == None:
    ghenv.Component.AddRuntimeMessage(ghkernel.GH_RuntimeMessageLevel.Warning, "brep is empty.")
else:
    # To get user text
    obj_dict = get_attribute(brep)
    newObj = ObjFromRH(**obj_dict)
    newObj.attr = obj_dict
    
    
    width = get_attribute(brep, "breite")
    height = get_attribute(brep, "hoehe")
    depth = get_attribute(brep, "tiefe")
    
    width = width if width != "FALSE" else 1
    height = height if height != "FALSE" else 1
    depth = depth if depth != "FALSE" else 1
    
    width = int(width)
    height = int(height)
    depth = int(depth)
# ---------- end doorfromrh ----------
merge_3 = Merge(Data1=brep_8, Data2=brep_7)

# ----
# Window
# Use geometry to find opening from DB.
# Set geometry from rhino
# Use Boolean switch to change the input type
brep_input_true_data_input_false_2 = BooleanToggle(False)
brep_9 = Brep(<brep referenced from the Rhino model>)
brep_10 = Brep(<brep referenced from the Rhino model>)
brep_11 = Brep(<brep referenced from the Rhino model>)
brep_12 = Brep(<brep referenced from the Rhino model>)
brep_13 = Brep(<brep referenced from the Rhino model>)
brep_14 = Brep(<brep referenced from the Rhino model>)
windowfromrh_2 = GhPythonScript(brep=[brep_9, brep_11])  # -> out, newObj, width, height, depth; inputs brep: Guid; same code as windowfromrh
merge_4 = Merge(Data1=brep_10, Data2=brep_13, Data3=brep_14, Data4=brep_12)

# ----
# width Weight
number_slider_8 = Slider(5, range=2..6)

# ----
# length Weight
number_slider_9 = Slider(4, range=2..6)

boundary_curve_of_the_facade_ea = Curve(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)

# ----
# Facade outline
# Can be curve or surface
boundary_surface_of_the_facade = Brep(<brep referenced from the Rhino model>)
boundary_curve_of_the_facade = Curve(<curve referenced from the Rhino model>)
boundary = BoundarySurfaces(Edges=boundary_curve_of_the_facade)

windows_edyta = Brep(<brep referenced from the Rhino model>)
objattr = GhPythonScript(bauteil_obergruppe="1234", breite="65", hoehe="250", tiefe="1", anzahl=Slider(999, range=0..1000))  # -> newObj; inputs anzahl: Int32
# ---------- objattr: Python ----------
import uuid as uu

class customizedObj:
    def __init__(self, **kwargs):
        for key, value in kwargs.items():
            setattr(self, key, value)


variables = {
    'bauteil_obergruppe': bauteil_obergruppe,
    'bauteil_gruner': bauteil_gruner,
    'uuid': uuid,
    'kosten': kosten,
    'zustand': zustand,
    'material': material,
    'ref_gebauede_geschoss': ref_gebauede_geschoss,
    'breite': breite,
    'hoehe': hoehe,
    'tiefe': tiefe,
    'flaeche': flaeche,
    'masse': masse,
    'anzahl': anzahl,
    'foto1': foto1,
    'foto2': foto2,
    'co2': co2,
    'url': url,
}

# Update each variable in the dictionary if it's None
for key in variables:
    if variables[key] is None:
        variables[key] = "unknown"
        if key == 'uuid':
            variables[key] = "customizedObj_" + str(uu.uuid4())



newObj = customizedObj(**variables)
newObj.attrDict = variables
# ---------- end objattr ----------

# ----
# align point
pt_3 = Point(<point referenced from the Rhino model>)

brep_15 = Brep(<brep referenced from the Rhino model>)
brep_16 = Brep(<brep referenced from the Rhino model>)
brep_17 = Brep(<brep referenced from the Rhino model>)
brep_18 = Brep(<brep referenced from the Rhino model>)
brep_19 = Brep(<brep referenced from the Rhino model>)
doorfromrh_2 = GhPythonScript(brep=[brep_15, brep_16, brep_17])  # -> out, newObj, width, height, depth; inputs brep: Guid; same code as doorfromrh
merge_5 = Merge(Data1=brep_18, Data2=brep_19)

# ----
# Cladding Normal Type
brep_20 = Brep(<brep referenced from the Rhino model>)

brep_21 = Brep(<brep referenced from the Rhino model>)
brep_22 = Brep(<brep referenced from the Rhino model>)
brep_23 = Brep(<brep referenced from the Rhino model>)
brep_24 = Brep(<brep referenced from the Rhino model>)
brep_25 = Brep(<brep referenced from the Rhino model>)
brep_26 = Brep(<brep referenced from the Rhino model>)
brep_27 = Brep(<brep referenced from the Rhino model>)
winfromrh = GhPythonScript(brep=[brep_24, brep_26, brep_27, brep_25, brep_20])  # -> out, newObj, width, height, depth; inputs brep: Guid; same code as windowfromrh
merge_6 = Merge(Data1=brep_21, Data2=brep_22, Data4=brep_23)

crv_3 = Curve(<curve referenced from the Rhino model>)
# Geometry of Opening
brep_28 = Brep(<brep referenced from the Rhino model>)
objattr_2 = GhPythonScript(bauteil_obergruppe="1234", breite="65", hoehe="250", tiefe="1", anzahl=Slider(999, range=0..1000))  # -> newObj; inputs anzahl: Int32; same code as objattr
boundary_2 = BoundarySurfaces(Edges=crv_3)

# ----
# interval distance
interval_distances_between_the_modules = Slider(200, range=0..1000)

# ----
# distance between the modules
number_slider_10 = Slider(15, range=10..30)

# ----
# Tile 4
number_slider_11 = Slider(42, range=0..1000)

# ----
# Tile 1
number_slider_12 = Slider(30, range=0..1000)

# ----
# Tile 5
number_slider_13 = Slider(37, range=0..1000)

# ----
# Tile 2
number_slider_14 = Slider(31, range=0..1000)

# ----
# Tile 3
number_slider_15 = Slider(38, range=0..1000)

# ----
# Define here the sizes of your shingles:
# Customized Tile Component
# If you want to have less tiles,
# disconnect the tiles from the Merge component
# If this is optional, I would kick it out.
panel_6 = Panel("ThisIsMud")
objattr_3 = GhPythonScript(
    bauteil_obergruppe="1234",
    material=panel_6,
    breite="65",
    hoehe="250",
    tiefe="5",
    anzahl=Slider(999, range=0..1000),
    url="customized_url heeee")  # -> newObj; inputs anzahl: Int32; same code as objattr
customizetile = GhPythonScript(objAttr=objattr_3, width=number_slider_12, height=Slider(35, range=0..1000), quantity=Slider(100, range=0..100))  # -> out, tile_obj; inputs height: Int32
# ---------- customizetile: Python ----------
fileName = "tileDefinition.py"
folderName = "py"

import sys
import os
import Grasshopper

# Access the current Grasshopper document
gh_doc = ghenv.Component.OnPingDocument()

# Get the file path of the current document
file_path = gh_doc.FilePath

# Verify that the document has been saved and file_path is valid
if not file_path:
    raise ValueError("The Grasshopper document needs to be saved to access its path.")

# Construct the path to the external script
script_dir = os.path.dirname(file_path)  # One level up from the file
script_dir = os.path.dirname(script_dir)  # Two levels up from the file
script_path = os.path.join(script_dir, folderName, fileName)  # Path to the script

# Ensure the script directory is in sys.path
script_dir = os.path.dirname(script_path)
if script_dir not in sys.path:
    sys.path.append(script_dir)

# Read and execute the script safely
try:
    with open(script_path, 'r') as file:
        script_content = file.read()
        exec(script_content, globals())
except IOError:
    print("Failed to open or read the script file at {}".format(script_path))
except Exception as e:
    print("Error executing the script: {}".format(e))
# ---------- end customizetile ----------
customizetile_2 = GhPythonScript(width=number_slider_14, height=Slider(32, range=0..1000), quantity=Slider(60, range=0..100))  # -> out, tile_obj; inputs height: Int32; same code as customizetile
customizetile_3 = GhPythonScript(width=number_slider_15, height=Slider(40, range=0..1000), quantity=Slider(70, range=0..100))  # -> out, tile_obj; inputs height: Int32; same code as customizetile
customizetile_4 = GhPythonScript(width=number_slider_11, height=Slider(44, range=0..1000), quantity=Slider(100, range=0..100))  # -> out, tile_obj; inputs height: Int32; same code as customizetile
customizetile_5 = GhPythonScript(width=number_slider_13, height=Slider(38, range=0..1000), quantity=Slider(90, range=0..100))  # -> out, tile_obj; inputs height: Int32; same code as customizetile
merge_7 = Merge(
    Data1=customizetile.tile_obj,
    Data2=customizetile_2.tile_obj,
    Data3=customizetile_3.tile_obj,
    Data4=customizetile_4.tile_obj,
    Data5=customizetile_5.tile_obj)

# ----
# module crv
curves_splitting_the_modules = Curve([<curve referenced from the Rhino model> x3])

# ----
# Module Setting
divide_facade_in_modules_by_curves_true = BooleanToggle(True)  # "Divide facade in modules by curves (True) or distance (False)"
# I would also make the automatic recognition of the curves per facade based on distance.
#  I would relying on the students in the data strucuture.
entwine = Entwine(Branch00=curves_splitting_the_modules, FlattenInputs=True)
filter = StreamFilter(Gate=divide_facade_in_modules_by_curves_true, Stream1=entwine)  # -> flatten(Stream)

horizontal_angle_2 = Number(horizontal_angle)
vertical_overlap_2 = Number(vertical_overlap)
substrucutre_width_2 = Number(substrucutre_width)
vertical_angle_2 = Number(vertical_angle)
horizontal_overlap_2 = Number(horizontal_overlap)
substrucutre_thickness_2 = Number(substrucutre_thickness)

# ----
# thickness
# distance
# direction
toggle = BooleanToggle(True)

# ----
# Condition 3:
# Search from DB by inputing dimension
# board
toggle_2 = BooleanToggle(True)
board_material = GhPythonScript(Code=file_4, Width="65", Length="250", Thickness="1", Pt=pt_3, SearchDB=toggle_2, Direction=Toggle(True))  # -> Out, Board_obj

# ----
# Condition 1:
# Input from rhino
# board
brep_29 = Brep(<brep referenced from the Rhino model>)
geofromrh = GhPythonScript(brep=brep_29)  # -> out, newObj, width, height, depth; inputs brep: Guid
# ---------- geofromrh: Python ----------
import Rhino
import scriptcontext as sc
import rhinoscriptsyntax as rs
import Grasshopper.Kernel as ghkernel

class ObjFromRH:
    def __init__(self, **kwargs):
        for key, value in kwargs.items():
            setattr(self, key, value)


# Set scriptcontext.doc to Rhino's document to access its objects
sc.doc = Rhino.RhinoDoc.ActiveDoc

def get_attribute(object_id, key=None):
    """
    Get user text from an object by its ID.
    """
    if object_id is None:
        print("No object ID provided.")
        return None

    rhino_object = sc.doc.Objects.Find(object_id)
    if not rhino_object:
        print("Object not found.")
        return None

    if key:
        value = rhino_object.Attributes.GetUserString(key)
        print("User text for key '{}': {}".format(key, value))
        return value
    else:
        all_user_text = rhino_object.Attributes.GetUserStrings()
        objDict = {}
        for k in all_user_text.AllKeys:
            objDict[k] =  all_user_text[k]
        return objDict


if brep == None:
    ghenv.Component.AddRuntimeMessage(ghkernel.GH_RuntimeMessageLevel.Warning, "brep is empty.")
else:
    # To get user text
    obj_dict = get_attribute(brep)
    newObj = ObjFromRH(**obj_dict)
    
    
    width = get_attribute(brep, "breite")
    height = get_attribute(brep, "hoehe")
    depth = get_attribute(brep, "tiefe")
    
    width = width if width != "FALSE" else 1
    height = height if height != "FALSE" else 1
    depth = depth if depth != "FALSE" else 1
    
    width = int(width)
    height = int(height)
    depth = int(depth)
# ---------- end geofromrh ----------
board_material_2 = GhPythonScript(
    Code=file_4,
    ObjAttr=geofromrh.newObj,
    Width=geofromrh.width,
    Length=geofromrh.height,
    Thickness=geofromrh.depth,
    Pt=pt_3,
    SearchDB=Toggle(False),
    Direction=Toggle(False))  # -> Out, Board_obj

# ----
# Condition 2:
# Customize by inputing dimension
# board
toggle_3 = BooleanToggle(False)
board_material_3 = GhPythonScript(
    Code=file_4,
    ObjAttr=objattr,
    Width="65",
    Length="250",
    Thickness="1",
    Pt=pt_3,
    SearchDB=toggle_3,
    Direction=Toggle(True))  # -> Out, Board_obj

brep_windows = Brep(merge_4)
data_windows = Data(windowfromrh_2.newObj)

# ----
# Facade and Openings
# Preferably (if possible) Only 1 output.
brep_doors = Brep(merge_3)
# Make clear descriptions of the input and outputs:
brep_facade_outline = Brep(boundary)
filter_2 = StreamFilter(Gate=brep_input_true_data_input_false_2, Stream0=data_windows, Stream1=brep_windows)

# ----
# width
panel_7 = Panel("2")
data = Data(doorfromrh.newObj)
# thickness
panel_8 = Panel("0.5")
# width
# thickness
toggle_4 = BooleanToggle(True)
# direction
toggle_5 = BooleanToggle(False)
# subStruct
substruct_infill_material = GhPythonScript(Code=file_5, ObjAttr=objattr_2, Width="3", Thickness="5", Distance="30", Direction=Toggle(False))  # -> Out, Substruct_obj
# subStruct + infill
substruct_infill_material_2 = GhPythonScript(Code=file_6, Width=panel_7, Thickness="5", Distance="50", Direction=toggle)  # -> Out, SubstructInfill_obj
# length
panel_9 = Panel("100")
brep_30 = Brep(boundary_2)

brep_31 = Brep(merge_5)
data_2 = Data(doorfromrh_2.newObj)

brep_32 = Brep(merge_6)
data_3 = Data(winfromrh.newObj)

# ----
# Search Tile from DB
search_tile = GhPythonScript(
    claddingWidth=cladding_w_2,
    claddingLength=cladding_l_2,
    kindNum=kind_number,
    wWeight=number_slider_8,
    lWeight=number_slider_9)  # -> out, searchTileSetting; inputs kindNum: Int32, wWeight: Int32, lWeight: Int32
# ---------- search_tile: Python ----------
allDict = {}
allDict["claddingWidth"] = claddingWidth
allDict["claddingLength"] = claddingLength
allDict["kindNum"] = kindNum
allDict["wWeight"] = wWeight
allDict["lWeight"] = lWeight


class classForOutput:
    def __init__(self):
        pass

allData = classForOutput()
allData.searchTileData = allDict
allData.identity = "searchTile"

searchTileSetting = allData
# ---------- end search_tile ----------

# ----
# paint
paint_material = GhPythonScript(Code=file_3, Thickness=panel_8)  # -> Out, Paint_obj
filter_3 = StreamFilter(Gate=brep_input_true_data_input_false, Stream0=data, Stream1=brep_doors)
# subStruct
substruct_infill_material_3 = GhPythonScript(Code=file_5, Width="3", Thickness="5", Distance="30", Direction=Toggle(False))  # -> Out, Substruct_obj
# board
board_material_4 = GhPythonScript(Code=file_4, Length=panel_9, Width="300", Thickness="5", Pt=pt_3, SearchDB=toggle_4, Direction=toggle_5)  # -> Out, Board_obj
panel_10 = Panel(brep_8)
merge_8 = Merge(Data1=substruct_infill_material_3.Substruct_obj, Data2=board_material_4.Board_obj)
panel_11 = Panel(brep_facade_outline)

customizetile_6 = Data(merge_7)
searchdbtile = Data(search_tile.searchTileSetting)

# ----
# Shingle Setting
# Use Boolean switch to change the input type
numeric_input_true_data_input_false = BooleanToggle(True)
filter_4 = StreamFilter(Gate=numeric_input_true_data_input_false, Stream0=searchdbtile, Stream1=customizetile_6)

merge_9 = Merge(
    Data1=board_material_2.Board_obj,
    Data2=board_material_3.Board_obj,
    Data3=board_material.Board_obj,
    Data4=substruct_infill_material.Substruct_obj,
    Data5=substruct_infill_material_2.SubstructInfill_obj,
    Data6=paint_material.Paint_obj)
brep_33 = Brep(<brep referenced from the Rhino model>)
# Avoid this solutions, as the input is divided . Hard to figure out what kind of input works where.
# All input of a specific type shoul be given by he students  in 1 location only
brep_34 = Brep(boundary_curve_of_the_facade_ea)
brep_35 = Brep([<brep referenced from the Rhino model> x2])
brep_36 = Brep(door_edyta)
merge_10 = Merge(Data1=filter_2, Data2=brep_36)  # -> flatten(Result)
merge_11 = Merge(Data1=brep_facade_outline, Data2=brep_34, Data3=brep_33)  # -> flatten(Result)
merge_12 = Merge(Data1=filter_3, Data2=brep_35)  # -> flatten(Result)

# ----
# Module Setting
number_slider_16 = Slider(260, range=0..1000)
crv_4 = Curve([<curve referenced from the Rhino model> x2])

crv_5 = Curve([<curve referenced from the Rhino model> x3])
brep_37 = Brep([<brep referenced from the Rhino model> x2])
brep_38 = Brep([<brep referenced from the Rhino model> x4])
brep_39 = Brep(<brep referenced from the Rhino model>)
file_7 = ReadFile(File=c__grasshoppername_2.filePath, PerLineParse=False)
file_8 = ReadFile(File=c__grasshoppername_2.filePath, PerLineParse=False)

# ----
# Explode wall
number_slider_17 = Slider(0, range=0..100)

# ----
# Explode wall
number_slider_18 = Slider(0, range=0..100)

# ----
# Module Index
number_slider_19 = Slider(2, range=0..10)  # disabled

# ----
# Layer Index
number_slider_20 = Slider(0, range=0..10)  # disabled

# ----
# Layer Index
number_slider_21 = Slider(0, range=0..10)  # disabled

# ----
# Module Index
number_slider_22 = Slider(1, range=0..10)  # disabled

# ----
# Material Index
number_slider_23 = Slider(0, range=0..10)  # disabled

# ----
# Module Index
number_slider_24 = Slider(1, range=0..10)  # disabled

# ----
# Material Index
number_slider_25 = Slider(0, range=0..10)  # disabled

# ----
# Module Index
number_slider_26 = Slider(0, range=0..10)  # disabled

# ----
# Connection to Data base.
# It is important to keep the folder structure of the original file
panel_12 = Panel("DB\JSON_data\24-03-07_V2_JSON")

# ----
# json folder path
c__grasshoppername_10 = CSharpScript(inputName=panel_12)  # -> ghParentPath, filePath; inputs inputName: String; same code as c__grasshoppername

# ----
# img folder path
c__grasshoppername_11 = CSharpScript(inputName="DB\Pictures_gruner_compressed")  # -> ghParentPath, filePath; inputs inputName: String; same code as c__grasshoppername

# ----
# read json file
python_6 = GhPythonScript(folder_path=c__grasshoppername_10.filePath)  # -> title, data
# ---------- python_6: Python ----------
import os
import json
import ghpythonlib.treehelpers as th

item_list = ['bauteil_obergruppe', 'bauteil_gruner', 'uuid', 'kosten', 'zustand', 'material', 'ref_gebauede_geschoss', 'breite', 'hoehe', 'tiefe', 'flaeche', 'masse', 'anzahl', 'foto1', 'foto2', 'co2', "kategorie"]

nameDict = {
"Befoerderungsanlage.json":"Befoerderungs_Anlage", #
"Bodenbelag.json":"Bodenbelag", #
"Deckenbekleidung.json":"Deckenbekleidung", #
"Deckenkonstruktion Dachkonstruktion.json":"Deckenkonstruktion", #
"Einbauten Schutzeinrichtung zu Ausbau.json":"Schutzeinrichtung", #
"Element in Aussenwand.json":"Aussenwand", #
"Element zu Dach.json":"ElementZuDach", #
"Fundament Bodenplatte.json":"Bodenplatte", #
#"Gastechnische Anlage.json":"Gastechnische_Anlage", 
"Gruenflaeche.json":"Gruenflaeche", #
"Kleininventar.json":"Kleininventar", #
"Lufttechnische Anlage.json":"Lufttechnische_Anlage", #
"Mobiliar.json":"Mobiliar", #
#"Sicherheitsanlage.json":"Sicherheit_Anlage", 
"Stuetzenkonstruktion.json":"Stuetzenkonstruktion", #
"Textilien.json":"Textilien", #
"Trennwand Innentuer Innentor.json":"Trennwand", #
"Waermetechnische Anlage.json":"Waermetechnische_Anlage", #
"Wandbekleidung.json":"Wandbekleidung", #
"Wandkonstruktion.json":"Wandkonstruktion", #
"Wassertechnische Anlage.json":"Wassertechnische_Anlage", #
"Weitere nutzungsspezifische Anlage.json":"Nutzungsspezifische_Anlage" #
}

def read_json_files(folder_path):
    # List to hold all items, with each item's sub-items as sub-lists
    all_items = []
    
    # Iterate over all files in the given folder
    for file_name in os.listdir(folder_path):
        # Check if the file is a JSON file
        if file_name.endswith('.json'):
            full_path = os.path.join(folder_path, file_name)
            
            # Read the JSON file
            with open(full_path, 'r') as json_file:
                data = json.load(json_file)
                
                # Assuming 'data' is a list of items
                for item in data:
                    # Add each item (and its sub-items, if any) to the list
                    
                    if file_name not in nameDict.keys():
                        continue
                    item["kategorie"] = nameDict[file_name]
                    temp = []
                    for key in item_list:
                        if key not in item.keys():
                            temp.append("FALSE")
                        else:
                            temp.append(item[key])
                    
                    all_items.append(temp)
    
    # Convert the list of lists into a data tree, with each top-level list as a branch
    return th.list_to_tree(all_items)

# Call the function and store the result
data = read_json_files(folder_path)

# The 'data_tree' can now be used as output in your Grasshopper Python component
title = item_list
# ---------- end python_6 ----------

changeimgpath = ChangeImgPath(parent_folder=c__grasshoppername_11.filePath, relay=python_6.data)
cluster_2 = Cluster_3(bauteil_obergruppe="Trennwand Innentuer Innentor", bauteil_obergruppe_2="Innentuer", data=changeimgpath)  # -> data_4, num_2
cluster_3 = Cluster_3(bauteil_obergruppe="Element in Aussenwand", bauteil_obergruppe_2="Fenster", data=changeimgpath)  # -> data_4, num_2
panel_13 = Panel(cluster_2.num_2)
panel_14 = Panel(cluster_3.num_2)
doordb = DoorDB(data=cluster_2.data_4)
windowdb = WindowDB(data=cluster_3.data_4)

# ----
# This one is temporary, should be changed
panel_15 = Panel("Innentuer")
cluster_4 = Cluster_3(bauteil_obergruppe="Trennwand Innentuer Innentor", bauteil_obergruppe_2=panel_15, data=changeimgpath)  # -> data_4, num_2
panel_16 = Panel(cluster_4.num_2)
boarddb = BoardDB_2(data=cluster_4.data_4)

# ----
# DataBase_Receiver
# When I am inputing other curve, the script doesn`t work.
# for the simplicity reason, let`s use only 1 type of input- surface of curve,
# but let`s don`t leave too many options.
boarddb_2 = Data(simplify(boarddb))
tiledb = Data(tilemockdata)
# OpenUI => Opens the Menu Window.
# winHeight => set Height of UI.
# rowNum => set quantity of items in a row.
# ShowItemNum => Specifies the number of items displayed in the Menu.
# Page => Go to specific page
# press it when you want to open UI
# True: Large -> Small
# False: Small -> Large
# You need to use this component called "trigger" to
# keep updating the output of UI.
# Here is the range for the item you selected.
# You can input minimum and maximum numbers (minNum and maxNum)
#  to find items within the domain.
# Alternatively, you can leave either minNum or maxNum blank.
# Here is the range for the item you selected.
# You can input minimum and maximum numbers (minNum and maxNum)
#  to find items within the domain.
# Alternatively, you can leave either minNum or maxNum blank.
# Wall_Tile Facade
windowdb_2 = Data(windowdb)
doordb_2 = Data(doordb)
data_4 = Data(simplify(tiledb))
# When "trigger" is running, this show-text component
# takes a lot of time. Thus, I suggest open it only when
# you want to bake the geometry.
db_collection = GhPythonScript(windowDB=windowdb_2, doorDB=doordb_2, tileDB=data_4, boardDB=boarddb_2)  # -> out, allDB; inputs windowDB: list, doorDB: list, tileDB: list, boardDB: list
# ---------- db_collection: Python ----------
allDict = {}
allDict["windowDB"] = windowDB
allDict["doorDB"] = doorDB
allDict["tileDB"] = tileDB
allDict["boardDB"] = boardDB

class classForOutput:
    def __init__(self):
        pass

allData = classForOutput()
allData.all_DB = allDict

allDB = allData
# ---------- end db_collection ----------

boarddb_3 = Data(simplify(boarddb))

# ----
# DataBase
boarddb_4 = BoardDB()  # disabled
tiledb_2 = TileDB()  # disabled
windowdb_3 = Data(windowdb)
doordb_3 = Data(doordb)
data_5 = Data(simplify(boarddb_4))  # disabled
data_6 = Data(simplify(tiledb_2))  # disabled
db_collection_2 = GhPythonScript(windowDB=windowdb_3, doorDB=doordb_3, tileDB=data_6, boardDB=boarddb_3)  # -> out, allDB; inputs windowDB: list, doorDB: list, tileDB: list, boardDB: list; same code as db_collection

# ----
# Cladding Engine
normalfacade = Data(merge_8)
normalfacade_2 = GhPythonScript(
    Code=file_8,
    Database_collection=db_collection_2.allDB,
    Carrier_Geometry=[brep_30, brep_39],
    Window_Geometry=[brep_32, brep_38],
    Door_Geometry=[brep_31, brep_37],
    SetTile=normalfacade,
    CladdingDirection=Toggle(False),
    Material_collection=merge_9,
    ModuleCurve=[crv_4, crv_5],
    ModuleCrvDist=Slider(30, range=10..30),
    Init=Button())  # -> Out, ORuler, OVisualObj, AllTypeMaterialModule, OMatRecordObj
panel_17 = Panel(normalfacade_2.Out)

crv_6 = Curve(normalfacade_2.ORuler)
normalfacadeviewer = NormalFacadeViewer(relay=flatten(normalfacade_2.OVisualObj), relay_2=number_slider_18, relay_3=Slider(0, range=0..100))  # -> movegeo, C, crv_3, geo_5, D, door_2, window_2

# ----
# Module Visualization
data_7 = Data(simplify(normalfacade_2.AllTypeMaterialModule))  # disabled
findmodule = GhPythonScript(data=data_7, y=number_slider_19)  # -> out, A; inputs data: tree, y: Int32; disabled
# ---------- findmodule: Python ----------
from Grasshopper import DataTree
from Grasshopper.Kernel.Data import GH_Path
from System import Object
import ghpythonlib.treehelpers as th

selected = []
for path in data.Paths:
    if path[1] == y:
        items = data.Branch(path)
        selected.append(items)
    else:
        print("cannot find")

# Output the selected data
A = th.list_to_tree(selected)
# ---------- end findmodule ----------
findlayer = GhPythonScript(data=data_7, y=number_slider_20)  # -> out, A; inputs data: tree, y: Int32; disabled
# ---------- findlayer: Python ----------
from Grasshopper import DataTree
from Grasshopper.Kernel.Data import GH_Path
from System import Object
import ghpythonlib.treehelpers as th

selected = []
for path in data.Paths:
    if path[0] == y:
        items = data.Branch(path)
        selected.append(items)
    else:
        print("cannot find")

# Output the selected data
A = th.list_to_tree(selected)
# ---------- end findlayer ----------
cluster_5 = BranchLook(data=findmodule.A, i=number_slider_23)  # disabled
cluster_6 = BranchLook(data=findlayer.A, i=number_slider_24)  # disabled

preview = CustomPreview(Geometry=normalfacadeviewer.geo_5, Material=graft(normalfacadeviewer.D))
previewlw_2 = CustomPreviewLineweights(
    Geometry=[normalfacadeviewer.door_2, normalfacadeviewer.window_2],
    Shader=ColourSwatch(SwatchColor=RGB(0, 255, 238)),
    Thickness=Slider(4, range=0..10),
    Absolute=False)
previewmat = CustomPreviewMaterials(Geometry=normalfacadeviewer.movegeo, DiffuseColor=normalfacadeviewer.C)
previewlw_3 = CustomPreviewLineweights(Geometry=normalfacadeviewer.crv_3, Shader=ColourSwatch(SwatchColor=RGB(0, 0, 0)), Absolute=False)

# ----
# InnerMaterial Setting
# Make the input based on the geometry not on the attributes of the RHino Object
number_slider_27 = Slider(999, range=0..1000)
# Make the input based on the geometry not on the attributes of the RHino Object
panel_18 = Panel("customized_uuid heeee")
starting_point_for_the_division_of_the_f = Point(<point referenced from the Rhino model>)  # "Starting point for the division of the facade inner layers"
objattr_4 = GhPythonScript(bauteil_obergruppe="1234", uuid=panel_18, breite="65", hoehe="250", tiefe="5", anzahl=number_slider_27)  # -> newObj; inputs anzahl: Int32; same code as objattr

# ----
# Method 1:
# Input from rhino
input_brep_for_the_inner_layers = Brep(<brep referenced from the Rhino model>)
geofromrh_2 = GhPythonScript(brep=input_brep_for_the_inner_layers)  # -> out, newObj, width, height, depth; inputs brep: Guid; same code as geofromrh
board_material_5 = GhPythonScript(
    objAttr=geofromrh_2.newObj,
    width=geofromrh_2.width,
    length=geofromrh_2.height,
    thickness=geofromrh_2.depth,
    pt=starting_point_for_the_division_of_the_f,
    searchDB=Toggle(False),
    direction=Toggle(True))  # -> out, board_obj; inputs pt: Point3d, searchDB: Boolean, direction: Boolean
# ---------- board_material_5: Python ----------
fileName = "boardDefinition.py"
folderName = "py"

import sys
import os
import Grasshopper

# Access the current Grasshopper document
gh_doc = ghenv.Component.OnPingDocument()

# Get the file path of the current document
file_path = gh_doc.FilePath

# Verify that the document has been saved and file_path is valid
if not file_path:
    raise ValueError("The Grasshopper document needs to be saved to access its path.")

# Construct the path to the external script
script_dir = os.path.dirname(file_path)  # One level up from the file
script_dir = os.path.dirname(script_dir)  # Two levels up from the file
script_path = os.path.join(script_dir, folderName, fileName)  # Path to the script

# Ensure the script directory is in sys.path
script_dir = os.path.dirname(script_path)
if script_dir not in sys.path:
    sys.path.append(script_dir)

# Read and execute the script safely
try:
    with open(script_path, 'r') as file:
        script_content = file.read()
        exec(script_content, globals())
except IOError:
    print("Failed to open or read the script file at {}".format(script_path))
except Exception as e:
    print("Error executing the script: {}".format(e))
# ---------- end board_material_5 ----------

# ----
# Method 3:
# Search from DB by inputing dimension
# board
toggle_6 = BooleanToggle(True)
board_material_6 = GhPythonScript(
    width="65",
    length="250",
    thickness="1",
    pt=starting_point_for_the_division_of_the_f,
    searchDB=Toggle(True),
    direction=toggle_6)  # -> out, board_obj; inputs pt: Point3d, searchDB: Boolean, direction: Boolean; same code as board_material_5

# ----
# Method 2:
# Customize by inputing dimension
# Can we just have sliders here?
toggle_7 = BooleanToggle(False)
board_material_7 = GhPythonScript(
    objAttr=objattr_4,
    width="65",
    length="250",
    thickness="5",
    pt=starting_point_for_the_division_of_the_f,
    searchDB=toggle_7,
    direction=Toggle(True))  # -> out, board_obj; inputs pt: Point3d, searchDB: Boolean, direction: Boolean; same code as board_material_5

entwine_2 = Entwine(
    Branch00=board_material_5.board_obj,
    Branch01=board_material_7.board_obj,
    Branch02=board_material_6.board_obj,
    FlattenInputs=True)  # -> flatten(Result)

# ----
# Cladding Engine
button = Button()
tilefacade = GhPythonScript(
    Code=file_7,
    Database_collection=db_collection.allDB,
    Carrier_Geometry=merge_11,
    Window_Geometry=merge_10,
    Door_Geometry=merge_12,
    SetTile=filter_4,
    CladdingDirection=cladding_direction_vertical_true_horizon,
    HoriOverlap=horizontal_overlap_2,
    VertiOverlap=vertical_overlap_2,
    HoriAngle=horizontal_angle_2,
    VertiAngle=vertical_angle_2,
    SubstructWidth=substrucutre_width_2,
    SubstructThickness=substrucutre_thickness_2,
    Material_collection=entwine_2,
    ModuleDistance=interval_distances_between_the_modules,
    ModuleCurve=filter,
    ModuleCrvDist=number_slider_10,
    Init=button)  # -> Out, OVisualObj, AllTypeMaterialModule, OMatRecordObj

panel_19 = Panel(tilefacade.Out)

# ----
# If this is optional, I would kick it out.
number_slider_28 = Slider(0, range=0..100)
tilefacadeviewer = TileFacadeViewer(visualobj=flatten(tilefacade.OVisualObj), N=number_slider_17, openingdist=number_slider_28)  # -> movegeo, T, crv_3, geo_5, geo_6, D, door_2, window_2
preview_2 = CustomPreview(Geometry=tilefacadeviewer.geo_6, Material=graft(tilefacadeviewer.D))
previewmat_2 = CustomPreviewMaterials(Geometry=tilefacadeviewer.geo_5, DiffuseColor=RGB(255, 255, 255))
previewmat_3 = CustomPreviewMaterials(Geometry=tilefacadeviewer.movegeo, DiffuseColor=tilefacadeviewer.T)
previewlw_4 = CustomPreviewLineweights(Geometry=tilefacadeviewer.crv_3, Shader=ColourSwatch(SwatchColor=RGB(0, 0, 0)), Absolute=False)
previewlw_5 = CustomPreviewLineweights(
    Geometry=[tilefacadeviewer.door_2, tilefacadeviewer.window_2],
    Shader=ColourSwatch(SwatchColor=RGB(0, 255, 238)),
    Thickness=Slider(4, range=0..10),
    Absolute=False)

# ----
# Module Visualization
data_8 = Data(simplify(tilefacade.AllTypeMaterialModule))  # disabled
findmodule_2 = GhPythonScript(data=data_8, y=number_slider_22)  # -> out, A; inputs data: tree, y: Int32; disabled; same code as findmodule
findlayer_2 = GhPythonScript(data=data_8, y=number_slider_21)  # -> out, A; inputs data: tree, y: Int32; disabled; same code as findlayer
cluster_7 = BranchLook(data=findmodule_2.A, i=number_slider_25)  # disabled
cluster_8 = BranchLook(data=findlayer_2.A, i=number_slider_26)  # disabled

# ----
# Show materials used from the data base
list = ValueList({"bauteil_obergruppe", "bauteil_gruner", "uuid", "kosten", "zustand", "material", "ref_gebauede_geschoss", "breite", "hoehe", "tiefe", "flaeche", "masse", "anzahl"}, selected=["bauteil_obergruppe", "bauteil_gruner", "uuid", "material", "breite", "hoehe", "tiefe", "anzahl"])
c__grasshoppername_12 = CSharpScript(inputName="py\UI_usedMaterial2.py")  # -> ghParentPath, filePath; inputs inputName: String; same code as c__grasshoppername
list_2 = ValueList({"InnerMaterial": "innerMaterial", "outerMaterial", "Opening": "opening"}, selected="outerMaterial")
file_9 = ReadFile(File=c__grasshoppername_12.filePath, PerLineParse=False)
merge_13 = Merge(Data1=tilefacade.OMatRecordObj, Data3=normalfacade_2.OMatRecordObj)
chosenitem = Data(list)
winheight = Data(Slider(8, range=6..10, expression="x*100"))
openui = Data(Toggle(False))
rownum = Data(Slider(4, range=0..10))
python_7 = GhPythonScript(
    Code=file_9,
    Open=openui,
    ShowType=list_2,
    ShowDes=Toggle(False),
    WinHeight=winheight,
    RowNum=rownum,
    ChosenItem=chosenitem,
    ShowData=flatten(merge_13))
panel_20 = Panel(python_7)

# ==== cluster BranchLook: To see the condition of branch data.
data = ClusterInput()
data_2 = Data(data)
tstat = TreeStatistics(Tree=data_2)  # -> Paths, Length, Count
i = ClusterInput()
item = ListItem(List=tstat.Paths, Index=i, Wrap=True)
branch = TreeBranch(Tree=data_2, Path=item, MaintainPaths=True)
B = ClusterOutput(branch)

# ==== cluster BoardDB
series = Series(Start=0, Step=1, Count="3")
item = ListItem(List=series, Index=0, Wrap=True)  # -> Item, Item1, Item2
number_slider = Slider(700, range=0..1000)
dom = ConstructDomain(DomainStart=Slider(40, range=0..1000), DomainEnd=Slider(100, range=0..1000))
dom_2 = ConstructDomain(DomainStart=Slider(50, range=0..1000), DomainEnd=Slider(300, range=0..10000))
dom_3 = ConstructDomain(DomainStart=Slider(116, range=0..300), DomainEnd=Slider(177, range=0..300))
dom_4 = ConstructDomain(DomainStart=Slider(2, range=0..1000), DomainEnd=Slider(4, range=0..10000))
# width
random = Random(Range=dom, Number=number_slider, Seed=item.Item, Integers=True)
# length
random_2 = Random(Range=dom_2, Number=number_slider, Seed=item.Item1, Integers=True)
# quantity
random_3 = Random(Range=dom_3, Number=number_slider, Seed=item.Item2, Integers=True)
random_4 = Random(Range=dom_4, Number=number_slider, Seed=item.Item1, Integers=True)
repeat = RepeatData(Data="uuid_DB_", Length=number_slider)  # -> simplify(graft(Data))
series_2 = Series(Start=0, Step=1, Count=number_slider)  # -> simplify(graft(Series))
repeat_2 = RepeatData(Data="bauteil_obergruppe", Length=number_slider)  # -> simplify(graft(Data))
repeat_3 = RepeatData(Data="bauteil_gruner", Length=number_slider)  # -> simplify(graft(Data))
series_3 = Series(Start=0, Step=1, Count=number_slider)  # -> simplify(graft(Series))
series_4 = Series(Start=0, Step=1, Count=number_slider)  # -> simplify(graft(Series))
graft = GraftTree(Tree=random_3, IncludeEmptyLists=True, IncludeNullItems=True)
merge = Merge(Data1=repeat, Data2=series_2)
merge_2 = Merge(Data1=repeat_2, Data2=series_3)
merge_3 = Merge(Data1=repeat_3, Data2=series_4)
graft_2 = GraftTree(Tree=random, IncludeEmptyLists=True, IncludeNullItems=True)
graft_3 = GraftTree(Tree=random_2, IncludeEmptyLists=True, IncludeNullItems=True)
graft_4 = GraftTree(Tree=random_4, IncludeEmptyLists=True, IncludeNullItems=True)
join = TextJoin(Text=merge)
join_2 = TextJoin(Text=merge_2)
join_3 = TextJoin(Text=merge_3)
rectangle = Rectangle(Plane=PlaneXY(0, 0, 0), XSize=random, YSize=random_2, Radius=0)  # -> simplify(graft(Rectangle)), Length
area = Area(Geometry=flatten(rectangle.Rectangle))  # -> Area, Centroid; disabled
objattr = GhPythonScript(bauteil_obergruppe=join_2, bauteil_gruner=join_3, uuid=join, breite=graft_2, hoehe=graft_3, tiefe=graft_4, anzahl=graft)  # -> flatten(newObj); inputs anzahl: Int32
# ---------- objattr: Python ----------
class ObjFromRH:
    def __init__(self, **kwargs):
        for key, value in kwargs.items():
            setattr(self, key, value)

variables = {
    'bauteil_obergruppe': bauteil_obergruppe,
    'bauteil_gruner': bauteil_gruner,
    'uuid': uuid,
    'kosten': kosten,
    'zustand': zustand,
    'material': material,
    'ref_gebauede_geschoss': ref_gebauede_geschoss,
    'breite': breite,
    'hoehe': hoehe,
    'tiefe': tiefe,
    'flaeche': flaeche,
    'masse': masse,
    'anzahl': anzahl,
    'foto1': foto1,
    'foto2': foto2,
    'co2': co2,
    'url': url,
}

# Update each variable in the dictionary if it's None
for key in variables:
    if variables[key] is None:
        variables[key] = "unknown"



newObj = ObjFromRH(**variables)
# ---------- end objattr ----------
sort = SortList(Keys=area.Area, ValuesA=flatten(rectangle.Rectangle))  # -> Keys, ValuesA; disabled
python = GhPythonScript(
    identity="board",
    geometry=rectangle.Rectangle,
    quantity=graft,
    name=join_2,
    width=graft_2,
    height=graft_3,
    depth=graft_4)  # -> out, objList; inputs geometry: tree of Rectangle3d, quantity: tree of Int32, name: tree, width: tree, height: tree, depth: tree; disabled
# ---------- python: Python ----------
class BuildingComponent:
    def __init__(self, identity, geometry, quantity, name, width, height, depth):
        self.identity = identity
        self.geometry = geometry
        self.quantity = quantity
        self.name = name
        self.width = width
        self.height = height
        self.depth = depth

objList = []
for geo, qua, na, wi, he, de in zip(geometry.Branches, quantity.Branches, name.Branches, width.Branches, height.Branches, depth.Branches):
    obj = BuildingComponent(identity, geo[0], qua[0], na[0], wi[0], he[0], de[0])
    objList.append(obj)
# ---------- end python ----------
item_2 = ListItem(List=sort.ValuesA, Index=0, Wrap=True)  # disabled
newobj = ClusterOutput(objattr)

# ==== cluster TileDB
number_slider = Slider(200, range=0..1000)
series = Series(Start=0, Step=1, Count="3")
item = ListItem(List=series, Index=0, Wrap=True)  # -> Item, Item1, Item2
dom = ConstructDomain(DomainStart=Slider(10, range=0..10), DomainEnd=Slider(60, range=0..100))
dom_2 = ConstructDomain(DomainStart=Slider(10, range=0..10), DomainEnd=Slider(1120, range=0..10000))
dom_3 = ConstructDomain(DomainStart=Slider(191, range=0..300), DomainEnd=Slider(262, range=0..300))
# width
random = Random(Range=dom, Number=number_slider, Seed=item.Item, Integers=True)
# length
random_2 = Random(Range=dom_2, Number=number_slider, Seed=item.Item1, Integers=True)
# quantity
random_3 = Random(Range=dom_3, Number=number_slider, Seed=item.Item2, Integers=True)
rectangle = Rectangle(Plane=PlaneXY(0, 0, 0), XSize=random, YSize=random_2, Radius=0)  # -> simplify(graft(Rectangle)), Length
graft = GraftTree(Tree=random_3, IncludeEmptyLists=True, IncludeNullItems=True)
repeat = RepeatData(Data="tileName_", Length=number_slider)  # -> simplify(graft(Data))
series_2 = Series(Start=0, Step=1, Count=number_slider)  # -> simplify(graft(Series))
merge = Merge(Data1=repeat, Data2=series_2)
join = TextJoin(Text=merge)
python = GhPythonScript(identity="tile", geometry=rectangle.Rectangle, quantity=graft, name=join)  # -> out, objList; inputs geometry: tree of Rectangle3d, quantity: tree of Int32, name: tree
# ---------- python: Python ----------
class BuildingComponent:
    def __init__(self, identity, geometry, quantity, name):
        self.identity = identity
        self.geometry = geometry
        self.quantity = quantity
        self.name = name

objList = []
for geo, qua, na in zip(geometry.Branches, quantity.Branches, name.Branches):
    obj = BuildingComponent(identity, geo[0], qua[0], na[0])
    objList.append(obj)
# ---------- end python ----------
objlist = ClusterOutput(python.objList)

# ==== cluster ChangeImgPath
relay = ClusterInput()
panel = Panel("""13
14""")
parent_folder = ClusterInput()
item = ListItem(List=relay, Index=panel, Wrap=True)

# ----
# alter img
python = GhPythonScript(parent_folder=parent_folder, picture_path=item)  # -> out, found_path_list; inputs picture_path: tree
# ---------- python: Python ----------
import os
import ghpythonlib.treehelpers as th

def build_file_map(parent_folder):
    file_map = {}
    for root, dirs, files in os.walk(parent_folder):
        for file in files:
            if file not in file_map:  # This check adds the first found instance if multiple files with the same name exist
                file_map[file] = os.path.join(root, file)
    return file_map

def find_picture(file_map, picture_name):
    return file_map.get(picture_name, None)

# Assuming 'parent_folder' and 'picture_path' are defined
file_map = build_file_map(parent_folder)

total_found = 0
total_not_found = 0

found_path_list = []
for pic_path in picture_path.Branches:
    temp = []
    for pic in pic_path:
        file_name = os.path.basename(pic)
        found_path = find_picture(file_map, file_name)
        if found_path:
            total_found += 1
            temp.append(found_path)
        else:
            total_not_found += 1
            temp.append(os.path.join(parent_folder, "notFound.jpg"))
    found_path_list.append(temp)

found_path_list = th.list_to_tree(found_path_list)
print("found img: %d" % (total_found))
print("not found img: %d" % (total_not_found))
# ---------- end python ----------

panel_2 = Panel("""16
2""")
replace = ReplaceItems(List=relay, Item=python.found_path_list, Indices=panel, Wrap=False)
item_2 = ListItem(List=replace, Index=panel_2, Wrap=True)

# ----
# alter url
python_2 = GhPythonScript(data=item_2)  # -> out, simplify(graft(urlList)); inputs data: tree
# ---------- python_2: Python ----------
import ghpythonlib.treehelpers as th
urlList = []
for d in data.Branches:
    bautStr = d[0]
    if bautStr.find(","):
        print("heee")
        print(bautStr)
    alterStr = str(d[0]).replace(" ", "_")
    urlString = "https://bfhreuse24.site/shop/" + alterStr + "/" + str(d[1])
    url = urlString 
    urlList.append(url)

urlList = th.list_to_tree(urlList)
# ---------- end python_2 ----------

replace_2 = ReplaceItems(List=replace, Item=python_2.urlList, Indices="16", Wrap=False)
L = ClusterOutput(replace_2)

# ==== cluster Cluster_3

# ----
# Title List
panel = Panel("""bauteil_obergruppe
bauteil_gruner
uuid
kosten
zustand
material
ref_gebauede_geschoss
breite
hoehe
tiefe
flaeche
masse
anzahl
foto1
foto2
co2
url""")

bauteil_obergruppe = ClusterInput()
bauteil_obergruppe_2 = ClusterInput()
data = ClusterInput()
data_2 = Data(data)
title = Data(panel)
bauteil_obergruppe_3 = Data(bauteil_obergruppe)
bauteil_gruner = Data(bauteil_obergruppe_2)
list = ValueList({"bauteil_obergruppe", "bauteil_gruner", "material"}, selected="bauteil_gruner")
list_2 = ValueList({"bauteil_obergruppe", "bauteil_gruner", "material"}, selected="bauteil_obergruppe")
panel_2 = Panel("""bauteil_obergruppe
bauteil_gruner
material""")
cluster = Cluster(S=title, M=list_2, data=data_2)  # -> S_2, M_2, L
panel_4 = Panel(cluster.L)
cluster_2 = Cluster_2(category=cluster.S_2, chosenitem=bauteil_obergruppe_3, dataid=cluster.M_2)
data_topic = Data(title)
alldata = Data(data_2)
python = GhPythonScript(data=cluster_2)  # -> union, quan; inputs data: tree
# ---------- python: Python ----------
def intersection_of_lists(nested_list):
    # Check if the nested list is empty or contains only empty lists
    if not nested_list or all(len(sublist) == 0 for sublist in nested_list):
        return [], 0

    # Initialize the intersection set with the first sublist to compare with others
    intersection_set = set(nested_list[0])
    
    # Iterate over each sublist in the nested list starting from the second sublist
    for sublist in nested_list[1:]:
        # Update the intersection set to keep only elements also found in the current sublist
        intersection_set.intersection_update(sublist)
    
    # Convert the set back to a list to get the final intersection list
    intersection_list = list(intersection_set)
    
    # Return the intersection list and the number of elements in the intersection
    return intersection_list, len(intersection_list)

listList = []
for d in data.Branches:
    if len(d) == 0:
        continue
    listList.append(d)

union, quan = intersection_of_lists(listList)
# ---------- end python ----------

# ----
# Quantity of items matching filters
panel_5 = Panel(python.quan)

cluster_3 = BranchLook(data=alldata, i=python.union)
cluster_4 = Cluster(S=title, M=list, data=cluster_3)  # -> S_2, M_2, L
panel_6 = Panel(cluster_4.L)
cluster_5 = Cluster_2(category=cluster_4.S_2, chosenitem=bauteil_gruner, dataid=cluster_4.M_2)
python_2 = GhPythonScript(data=cluster_5)  # -> union, quan; inputs data: tree; same code as python

# ----
# Quantity of items matching filters
panel_7 = Panel(python_2.quan)

cluster_6 = BranchLook(data=cluster_3, i=python_2.union)
data_3 = Data(cluster_6)
num = Data(python_2.quan)
data_4 = ClusterOutput(data_3)
num_2 = ClusterOutput(num)

# ==== cluster DoorDB
data = ClusterInput()
data_2 = Data(data)
panel = Panel("""7
8
12""")
item = ListItem(List=data_2, Index=panel, Wrap=True)
panel_2 = Panel("""bauteil_obergruppe
bauteil_gruner
uuid
kosten
zustand
material
ref_gebauede_geschoss
breite
hoehe
tiefe
flaeche
masse
anzahl
foto1
foto2
co2
url""")
python = GhPythonScript(x=item, y=data_2)  # -> out, filt_data, filt_attr; inputs x: tree, y: tree
# ---------- python: Python ----------
import ghpythonlib.treehelpers as th

filt_data = []
filt_attr = []
for data, attr in zip(x.Branches, y.Branches):
    addBool = 1
    for d in data:
        if str(d) == "FALSE":
            addBool = 0

    if addBool:
        filt_data.append(data)
        filt_attr.append(attr)

filt_data = th.list_to_tree(filt_data)
filt_attr = th.list_to_tree(filt_attr)
# ---------- end python ----------
item_2 = ListItem(List=python.filt_data, Index=0, Wrap=True)  # -> flatten(Item), flatten(Item1), flatten(Item2)
python_2 = GhPythonScript(attr=python.filt_attr, item=panel_2)  # -> out, graft(all_dict_list); inputs attr: tree, item: list
# ---------- python_2: Python ----------
import ghpythonlib.treehelpers as th

class openingAttr:
    def __init__(self, attr, **kwargs):
        self.attr = attr
        for key, value in kwargs.items():
            setattr(self, key, value)

all_dict_list = []
for at in attr.Branches:
    tempDict = {}
    for key, data in zip(item, at):
        tempDict[key] = data
        
    attrObj = openingAttr(tempDict, **tempDict) 
    all_dict_list.append(attrObj)

all_dict_list = th.list_to_tree(all_dict_list)
# ---------- end python_2 ----------
rectangle = Rectangle(Plane=PlaneXY(0, 0, 0), XSize=item_2.Item, YSize=item_2.Item1, Radius=0)  # -> simplify(graft(Rectangle)), Length
graft = GraftTree(Tree=item_2.Item2, IncludeEmptyLists=True, IncludeNullItems=True)  # -> simplify(Tree)
python_3 = GhPythonScript(identity="door", geometry=rectangle.Rectangle, quantity=graft, attr=python_2.all_dict_list)  # -> out, objList; inputs geometry: tree of Rectangle3d, quantity: tree of Int32, attr: tree
# ---------- python_3: Python ----------
class BuildingComponent:
    def __init__(self, identity, geometry, quantity, attr):
        self.identity = identity
        self.geometry = geometry
        self.quantity = quantity
        self.attr = attr.attr
        for key, value in attr.attr.items():
            setattr(self, key, value)

objList = []
for geo, qua, at in zip(geometry.Branches, quantity.Branches, attr.Branches):
    obj = BuildingComponent(identity, geo[0], qua[0], at[0])
    objList.append(obj)
# ---------- end python_3 ----------
data_3 = Data(python_3.objList)
data_4 = ClusterOutput(data_3)

# ==== cluster WindowDB
data = ClusterInput()
data_2 = Data(data)
panel = Panel("""7
8
12""")
item = ListItem(List=data_2, Index=panel, Wrap=True)
panel_2 = Panel("""bauteil_obergruppe
bauteil_gruner
uuid
kosten
zustand
material
ref_gebauede_geschoss
breite
hoehe
tiefe
flaeche
masse
anzahl
foto1
foto2
co2
url""")
python = GhPythonScript(x=item, y=data_2)  # -> out, filt_data, filt_attr; inputs x: tree, y: tree; same code as python
item_2 = ListItem(List=python.filt_data, Index=0, Wrap=True)  # -> flatten(Item), flatten(Item1), flatten(Item2)
python_2 = GhPythonScript(attr=python.filt_attr, item=panel_2)  # -> out, graft(all_dict_list); inputs attr: tree, item: list; same code as python_2
rectangle = Rectangle(Plane=PlaneXY(0, 0, 0), XSize=item_2.Item, YSize=item_2.Item1, Radius=0)  # -> simplify(graft(Rectangle)), Length
graft = GraftTree(Tree=item_2.Item2, IncludeEmptyLists=True, IncludeNullItems=True)  # -> simplify(Tree)
python_3 = GhPythonScript(identity="window", geometry=rectangle.Rectangle, quantity=graft, attr=python_2.all_dict_list)  # -> out, objList; inputs geometry: tree of Rectangle3d, quantity: tree of Int32, attr: tree; same code as python_3
data_3 = Data(python_3.objList)
data_4 = ClusterOutput(data_3)

# ==== cluster TileFacadeViewer
sddp = ShapeDiverDocumentPayload()
# This component is the visualization of tile facade style.
# This one can input mutiple wall information
visualobj = ClusterInput()
N = ClusterInput()
openingdist = ClusterInput()
python = GhPythonScript(visualObj=visualobj)  # -> out, comb, tileGeometry, allTypeMaterial, substructureGeo, wallFrame, offsetCladdingDist, doorGeo, windowGeo; inputs visualObj: list
# ---------- python: Python ----------
from Grasshopper.Kernel.Data import GH_Path
from Grasshopper import DataTree
import System.Array as array
import ghpythonlib.treehelpers as th

attrList = ['comb', 'tileGeometry', 'allTypeMaterial', 'substructureGeo', 'wallFrame', 'offsetCladdingDist', 'doorGeo', 'windowGeo']
for name in attrList:
    globals()[name] = DataTree[object]()

for i, obj in enumerate(visualObj):
    def treeGenerate(obj, name):
        data = getattr(obj, name)
        
        if isinstance(data, DataTree[object]):
            for j, (d, pList) in enumerate(zip(data.Branches, data.Paths)):
                pList[0] = i
                path = GH_Path(array[int](list(pList)))
                globals()[name].AddRange(d, path)
                
        elif isinstance(data, list):
            path = GH_Path(array[int]([i]))
            globals()[name].AddRange(data, path)
        
        elif len([data])==1:
            path = GH_Path(array[int]([i]))
            globals()[name].AddRange([data], path)
            
        
    for n in attrList:
        treeGenerate(obj, n)
# ---------- end python ----------
deplane = DeconstructPlane(Plane=python.wallFrame)  # -> Origin, XAxis, YAxis, ZAxis
neg = Negative(Value=deplane.ZAxis)
amp = Amplitude(Vector=neg, Amplitude=python.offsetCladdingDist)
lng = ListLength(List=flatten(python.wallFrame))
tstat = TreeStatistics(Tree=python.allTypeMaterial)  # -> Paths, Length, Count
division = Division(A=tstat.Count, B=lng)
python_2 = GhPythonScript(x=python.allTypeMaterial)  # -> out, a
# ---------- python_2: Python ----------
a =x
# ---------- end python_2 ----------
openingdist_2 = Data(openingdist)
geo = Geometry(python.doorGeo)
geo_2 = Geometry(python.windowGeo)
series = Series(Start=0, Step=N, Count=expr("x+1", division))
series_2 = Series(Start=0, Step=1, Count=division)
pln = Plane(python.wallFrame)
deplane_2 = DeconstructPlane(Plane=pln)  # -> Origin, XAxis, YAxis, ZAxis
python_3 = GhPythonScript(x=series)  # -> out, a, b; inputs x: list
# ---------- python_3: Python ----------
a = x[:-1]
b = x[-1]
# ---------- end python_3 ----------
deplane_3 = DeconstructPlane(Plane=python.wallFrame)  # -> Origin, XAxis, YAxis, ZAxis
python_4 = GhPythonScript(x=python.tileGeometry)  # -> out, a; same code as python_2
panel = Panel(python.tileGeometry)
item = ListItem(List=flatten(python.comb), Index=0, Wrap=True)
move_ver1 = GhPythonScript(geoData=python_2.a, vecData=amp)  # -> out, moveGeo; inputs geoData: tree of Brep, vecData: tree
# ---------- move_ver1: Python ----------
import Rhino.Geometry as rg
from Grasshopper.Kernel.Data import GH_Path
from Grasshopper import DataTree
import System.Array as array
import ghpythonlib.treehelpers as th

moveGeo = DataTree[object]()
for geoList, path in zip(geoData.Branches, geoData.Paths):
    n = path[0]
    vec = vecData.Branches[n][0]
    matrix = rg.Transform.Translation(vec)

    for geo in geoList:
        geo.Transform(matrix)
    
    moveGeo.AddRange(geoList, path)
# ---------- end move_ver1 ----------
amp_2 = Amplitude(Vector=deplane_2.ZAxis, Amplitude=openingdist_2)
null = NullItem(Item=item)  # -> NullFlags, InvalidFlags, Description
cladding_catergory = CladdingCatergory(data=python.comb, geo=python.tileGeometry)  # -> geo_5, data_4
move_ver1_2 = GhPythonScript(geoData=geo, vecData=amp_2)  # -> out, moveGeo; inputs geoData: tree of Brep, vecData: tree; same code as move_ver1
gradient = Gradient(
    LowerLimit="0",
    UpperLimit=division,
    Parameter=series_2,
    stops=[0: RGB(234, 38, 0), 0.25: RGB(234, 126, 0), 0.5: RGB(254, 244, 84), 0.75: RGB(173, 203, 249), 1: RGB(75, 107, 169)])
move_ver1_3 = GhPythonScript(geoData=geo_2, vecData=amp_2)  # -> out, moveGeo; inputs geoData: tree of Brep, vecData: tree; same code as move_ver1
amp_3 = Amplitude(Vector=deplane_3.ZAxis, Amplitude=python_3.a)
pshift = ShiftPaths(Data=move_ver1.moveGeo, Offset=-1)
amp_4 = Amplitude(Vector=deplane_3.ZAxis, Amplitude=python_3.b)  # -> graft(Vector)
tstat_2 = TreeStatistics(Tree=cladding_catergory.geo_5)  # -> Paths, Length, Count
filter = StreamFilter(Gate=null.NullFlags, Stream0=cladding_catergory.geo_5, Stream1=python_4.a)
filter_2 = StreamFilter(Gate=null.NullFlags, Stream0=cladding_catergory.geo_5, Stream1=python_4.a)
move_ver2 = GhPythonScript(geoData=pshift, vecData=amp_3)  # -> out, moveGeo; inputs geoData: tree of Brep, vecData: tree
# ---------- move_ver2: Python ----------
import Rhino.Geometry as rg
from Grasshopper.Kernel.Data import GH_Path
from Grasshopper import DataTree
import System.Array as array
import ghpythonlib.treehelpers as th

moveGeo = DataTree[object]()
for geoList, path in zip(geoData.Branches, geoData.Paths):
    wallNum = path[0]
    layerNum = path[path.Length-1]
    vec = vecData.Branches[wallNum]
    matrix = rg.Transform.Translation(vec[layerNum])

    for geo in geoList:
        geo.Transform(matrix)
    
    moveGeo.AddRange(geoList, path)
# ---------- end move_ver2 ----------
move_ver1_4 = GhPythonScript(geoData=move_ver1_2.moveGeo, vecData=amp)  # -> out, moveGeo; inputs geoData: tree of Brep, vecData: tree; same code as move_ver1
move_ver1_5 = GhPythonScript(geoData=move_ver1_3.moveGeo, vecData=amp)  # -> out, moveGeo; inputs geoData: tree of Brep, vecData: tree; same code as move_ver1
division_2 = Division(A=tstat_2.Count, B=lng)
move_ver1_6 = GhPythonScript(geoData=filter, vecData=amp)  # -> out, moveGeo; inputs geoData: tree of Brep, vecData: tree; same code as move_ver1
tstat_3 = TreeStatistics(Tree=filter_2)  # -> Paths, Length, Count
dup = DuplicateData(Data=gradient, Number=lng, Order=True)  # -> graft(Data)
series_3 = Series(Start=0, Step=1, Count=tstat_3.Count)  # -> graft(Series)
move = Move(Geometry=python.substructureGeo, Motion=amp)  # -> Geometry, Transform
edges = BrepEdges(Brep=move_ver2.moveGeo)  # -> Naked, Interior, NonManifold
panel_2 = Panel("""20
10""")
panel_3 = Panel("""20
10""")
geo_3 = Geometry(move_ver2.moveGeo)
filter_3 = StreamFilter(Gate=null.NullFlags, Stream0=division_2, Stream1=tstat_3.Count)
filter_4 = StreamFilter(Gate=null.NullFlags, Stream0=cladding_catergory.data_4, Stream1=series_3)
move_ver1_7 = GhPythonScript(geoData=move_ver1_6.moveGeo, vecData=amp_4)  # -> out, moveGeo; inputs geoData: tree of Brep, vecData: tree; same code as move_ver1
move_2 = Move(Geometry=move.Geometry, Motion=amp_4)  # -> Geometry, Transform
dash = DashPattern(Curve=move_ver1_4.moveGeo, Pattern=panel_2)  # -> Dashes, Gaps
dash_2 = DashPattern(Curve=move_ver1_5.moveGeo, Pattern=panel_3)  # -> Dashes, Gaps
crv = Curve([edges.Interior, edges.Naked])
gradient_2 = Gradient(
    LowerLimit=0,
    UpperLimit=filter_3,
    Parameter=filter_4,
    stops=[0: RGB(145, 107, 64), 0.267: RGB(234, 126, 0), 0.498: RGB(245, 207, 81), 0.772: RGB(235, 221, 185), 1: RGB(199, 98, 58)])
geo_4 = Geometry(move_2.Geometry)
door = Data(dash.Dashes)
window = Data(dash_2.Dashes)
edges_2 = BrepEdges(Brep=move_ver1_7.moveGeo)  # -> Naked, Interior, NonManifold
edges_3 = BrepEdges(Brep=geo_4)  # -> Naked, Interior, NonManifold
unflatten = UnflattenTree(Tree=gradient_2, Guide=move_ver1_7.moveGeo)
crv_2 = Curve([edges_2.Naked, edges_2.Interior, crv, edges_3.Naked, edges_3.Interior])
movegeo = ClusterOutput(move_ver1_7.moveGeo)
window_2 = ClusterOutput(window)
T = ClusterOutput(unflatten)
crv_3 = ClusterOutput(crv_2)
geo_5 = ClusterOutput(geo_4)
geo_6 = ClusterOutput(geo_3)
D = ClusterOutput(dup)
door_2 = ClusterOutput(door)

# ==== cluster NormalFacadeViewer
# This component is the visualization of normal facade style.
# This one can input mutiple wall information
relay = ClusterInput()
relay_2 = ClusterInput()
relay_3 = ClusterInput()
python = GhPythonScript(visualObj=relay)  # -> out, comb, tileGeometry, allTypeMaterial, substructureGeo, wallFrame, offsetCladdingDist, doorGeo, windowGeo; inputs visualObj: list; same code as python
deplane = DeconstructPlane(Plane=python.wallFrame)  # -> Origin, XAxis, YAxis, ZAxis
neg = Negative(Value=deplane.ZAxis)
amp = Amplitude(Vector=neg, Amplitude=python.offsetCladdingDist)
lng = ListLength(List=flatten(python.wallFrame))
tstat = TreeStatistics(Tree=python.allTypeMaterial)  # -> Paths, Length, Count
division = Division(A=tstat.Count, B=lng)
python_2 = GhPythonScript(x=python.allTypeMaterial)  # -> out, a; same code as python_2
series = Series(Start=0, Step=relay_2, Count=expr("x+1", division))
series_2 = Series(Start=0, Step=1, Count=division)
python_3 = GhPythonScript(x=series)  # -> out, a, b; inputs x: list; same code as python_3
deplane_2 = DeconstructPlane(Plane=python.wallFrame)  # -> Origin, XAxis, YAxis, ZAxis
python_4 = GhPythonScript(x=python.tileGeometry)  # -> out, a; same code as python_2
item = ListItem(List=flatten(python.comb), Index=0, Wrap=True)
move_ver1 = GhPythonScript(geoData=python_2.a, vecData=amp)  # -> out, moveGeo; inputs geoData: tree of Brep, vecData: tree; same code as move_ver1
null = NullItem(Item=item)  # -> NullFlags, InvalidFlags, Description
openingdist = Data(relay_3)
geo = Geometry(python.doorGeo)
geo_2 = Geometry(python.windowGeo)
cladding_catergory = CladdingCatergory(data=python.comb, geo=python.tileGeometry)  # -> geo_5, data_4; disabled
gradient = Gradient(
    LowerLimit="0",
    UpperLimit=division,
    Parameter=series_2,
    stops=[0: RGB(234, 38, 0), 0.25: RGB(234, 126, 0), 0.5: RGB(254, 244, 84), 0.75: RGB(173, 203, 249), 1: RGB(75, 107, 169)])
amp_2 = Amplitude(Vector=deplane_2.ZAxis, Amplitude=python_3.a)
pshift = ShiftPaths(Data=move_ver1.moveGeo, Offset=-1)
pln = Plane(python.wallFrame)
amp_3 = Amplitude(Vector=deplane_2.ZAxis, Amplitude=python_3.b)  # -> graft(Vector)
tstat_2 = TreeStatistics(Tree=cladding_catergory.geo_5)  # -> Paths, Length, Count
filter = StreamFilter(Gate=null.NullFlags, Stream0=cladding_catergory.geo_5, Stream1=python_4.a)
filter_2 = StreamFilter(Gate=null.NullFlags, Stream0=cladding_catergory.geo_5, Stream1=python_4.a)
move_ver2 = GhPythonScript(geoData=pshift, vecData=amp_2)  # -> out, moveGeo; inputs geoData: tree of Brep, vecData: tree; same code as move_ver2
deplane_3 = DeconstructPlane(Plane=pln)  # -> Origin, XAxis, YAxis, ZAxis
tstat_3 = TreeStatistics(Tree=filter)  # -> Paths, Length, Count
amp_4 = Amplitude(Vector=deplane_3.ZAxis, Amplitude=openingdist)
dup = DuplicateData(Data=gradient, Number=lng, Order=True)  # -> graft(Data)
move_ver1_2 = GhPythonScript(geoData=filter_2, vecData=amp)  # -> out, moveGeo; inputs geoData: tree of Brep, vecData: tree; same code as move_ver1
division_2 = Division(A=tstat_2.Count, B=lng)
division_3 = Division(A=tstat_3.Count, B=lng)
move = Move(Geometry=python.substructureGeo, Motion=amp)  # -> Geometry, Transform
edges = BrepEdges(Brep=move_ver2.moveGeo)  # -> Naked, Interior, NonManifold
move_ver1_3 = GhPythonScript(geoData=geo, vecData=amp_4)  # -> out, moveGeo; inputs geoData: tree of Brep, vecData: tree; same code as move_ver1
move_ver1_4 = GhPythonScript(geoData=geo_2, vecData=amp_4)  # -> out, moveGeo; inputs geoData: tree of Brep, vecData: tree; same code as move_ver1
geo_3 = Geometry(move_ver2.moveGeo)
series_3 = Series(Start=0, Step=1, Count=division_3)  # -> graft(Series)
move_ver1_5 = GhPythonScript(geoData=move_ver1_2.moveGeo, vecData=amp_3)  # -> out, moveGeo; inputs geoData: tree of Brep, vecData: tree; same code as move_ver1
move_2 = Move(Geometry=move.Geometry, Motion=amp_3)  # -> Geometry, Transform
crv = Curve([edges.Interior, edges.Naked])
filter_3 = StreamFilter(Gate=null.NullFlags, Stream0=division_2, Stream1=division_3)
filter_4 = StreamFilter(Gate=null.NullFlags, Stream0=cladding_catergory.data_4, Stream1=series_3)
move_ver1_6 = GhPythonScript(geoData=move_ver1_3.moveGeo, vecData=amp)  # -> out, moveGeo; inputs geoData: tree of Brep, vecData: tree; same code as move_ver1
move_ver1_7 = GhPythonScript(geoData=move_ver1_4.moveGeo, vecData=amp)  # -> out, moveGeo; inputs geoData: tree of Brep, vecData: tree; same code as move_ver1
geo_4 = Geometry(move_2.Geometry)
edges_2 = BrepEdges(Brep=move_ver1_5.moveGeo)  # -> Naked, Interior, NonManifold
edges_3 = BrepEdges(Brep=geo_4)  # -> Naked, Interior, NonManifold
gradient_2 = Gradient(
    LowerLimit=0,
    UpperLimit=filter_3,
    Parameter=filter_4,
    stops=[0: RGB(145, 107, 64), 0.267: RGB(234, 126, 0), 0.498: RGB(245, 207, 81), 0.772: RGB(235, 221, 185), 1: RGB(199, 98, 58)])
panel = Panel("""20
10""")
panel_2 = Panel("""20
10""")
dash = DashPattern(Curve=move_ver1_6.moveGeo, Pattern=panel)  # -> Dashes, Gaps
dash_2 = DashPattern(Curve=move_ver1_7.moveGeo, Pattern=panel_2)  # -> Dashes, Gaps
crv_2 = Curve([edges_2.Naked, edges_2.Interior, crv, edges_3.Naked, edges_3.Interior])
unflatten = UnflattenTree(Tree=gradient_2, Guide=move_ver1_5.moveGeo)  # disabled
door = Data(dash.Dashes)
window = Data(dash_2.Dashes)
window_2 = ClusterOutput(window)
movegeo = ClusterOutput(move_ver1_5.moveGeo)
C = ClusterOutput(gradient_2)
crv_3 = ClusterOutput(crv_2)
geo_5 = ClusterOutput(geo_3)
D = ClusterOutput(dup)
door_2 = ClusterOutput(door)

# ==== cluster TileMockData
num = ClusterInput()
num_2 = Data(num)
series = Series(Start=0, Step=1, Count="3")
panel = Panel("""bauteil_obergruppe
bauteil_gruner
uuid
kosten
zustand
material
ref_gebauede_geschoss
breite
hoehe
tiefe
flaeche
masse
anzahl
foto1
foto2
co2
url""")
item = ListItem(List=series, Index=0, Wrap=True)  # -> Item, Item1, Item2
dom = ConstructDomain(DomainStart=Slider(10, range=0..10), DomainEnd=Slider(60, range=0..100))
dom_2 = ConstructDomain(DomainStart=Slider(10, range=0..10), DomainEnd=Slider(1120, range=0..10000))
dom_3 = ConstructDomain(DomainStart=Slider(191, range=0..300), DomainEnd=Slider(262, range=0..300))
# width
random = Random(Range=dom, Number=num_2, Seed=item.Item, Integers=True)
# length
random_2 = Random(Range=dom_2, Number=num_2, Seed=item.Item1, Integers=True)
# quantity
random_3 = Random(Range=dom_3, Number=num_2, Seed=item.Item2, Integers=True)
python = GhPythonScript(x=num_2)  # -> out, a; inputs x: Int32
# ---------- python: Python ----------
import uuid
a = []
for i in range(x):
    a.append("MockTile_uuid_" + str(uuid.uuid4()))
# ---------- end python ----------
panel_2 = Panel("""7
8
12
2""")
python_2 = GhPythonScript(x=panel)  # -> out, a; inputs x: list
# ---------- python_2: Python ----------
a = []
for st in x:
    a.append("MockData_"+st)
# ---------- end python_2 ----------
dup = DuplicateData(Data=graft(python_2.a), Number=num_2, Order=True)
merge = Merge(
    Data1=simplify(graft(random)),
    Data2=simplify(graft(random_2)),
    Data3=simplify(graft(random_3)),
    Data4=simplify(graft(python.a)))
flip = FlipMatrix(Data=dup)
replace = ReplaceItems(List=flip, Item=merge, Indices=panel_2, Wrap=False)
data = Data(replace)
item_2 = ListItem(List=data, Index=panel_2, Wrap=True)
python_3 = GhPythonScript(x=item_2, y=data)  # -> out, filt_data, filt_attr; inputs x: tree, y: tree; same code as python
item_3 = ListItem(List=python_3.filt_data, Index=0, Wrap=True)  # -> flatten(Item), flatten(Item1), flatten(Item2)
python_4 = GhPythonScript(attr=python_3.filt_attr, item=panel)  # -> out, graft(all_dict_list); inputs attr: tree, item: list; same code as python_2
rectangle = Rectangle(Plane=PlaneXY(0, 0, 0), XSize=item_3.Item, YSize=item_3.Item1, Radius=0)  # -> simplify(graft(Rectangle)), Length
graft = GraftTree(Tree=item_3.Item2, IncludeEmptyLists=True, IncludeNullItems=True)  # -> simplify(Tree)
# Should check if I need to add attrObj
panel_3 = Panel("tile")
python_5 = GhPythonScript(identity=panel_3, geometry=rectangle.Rectangle, quantity=graft, attr=python_4.all_dict_list)  # -> out, objList; inputs geometry: tree of Rectangle3d, quantity: tree of Int32, attr: tree
# ---------- python_5: Python ----------
class BuildingComponent:
    def __init__(self, identity, geometry, quantity, attr):
        self.identity = identity
        self.geometry = geometry
        self.quantity = quantity
        self.attr = attr.attr
        self.attrObj = attr

objList = []
for geo, qua, at in zip(geometry.Branches, quantity.Branches, attr.Branches):
    obj = BuildingComponent(identity, geo[0], qua[0], at[0])
    objList.append(obj)
# ---------- end python_5 ----------
data_2 = Data(python_5.objList)
data_3 = ClusterOutput(data_2)

# ==== cluster BoardDB_2
data = ClusterInput()
data_2 = Data(data)
panel = Panel("""7
8
12""")
item = ListItem(List=data_2, Index=panel, Wrap=True)
panel_2 = Panel("""bauteil_obergruppe
bauteil_gruner
uuid
kosten
zustand
material
ref_gebauede_geschoss
breite
hoehe
tiefe
flaeche
masse
anzahl
foto1
foto2
co2
url""")
python = GhPythonScript(x=item, y=data_2)  # -> out, filt_data, filt_attr; inputs x: tree, y: tree
# ---------- python: Python ----------
import ghpythonlib.treehelpers as th

filt_data = []
filt_attr = []
for data, attr in zip(x.Branches, y.Branches):
    addBool = 1
    for d in data:
        if str(d) == "FALSE":
            addBool = 0
    
    # check if tiefe is FALSE
    if attr[9] == "FALSE":
        attr[9] = 1
    
    if addBool:
        attr[7] = float(attr[7])
        attr[8] = float(attr[8])
        attr[9] = float(attr[9])
        filt_data.append(data)
        filt_attr.append(attr)

filt_data = th.list_to_tree(filt_data)
filt_attr = th.list_to_tree(filt_attr)
# ---------- end python ----------
item_2 = ListItem(List=python.filt_data, Index=0, Wrap=True)  # -> flatten(Item), flatten(Item1), flatten(Item2)
python_2 = GhPythonScript(attr=python.filt_attr, item=panel_2)  # -> out, graft(all_dict_list); inputs attr: tree, item: list; same code as python_2
rectangle = Rectangle(Plane=PlaneXY(0, 0, 0), XSize=item_2.Item, YSize=item_2.Item1, Radius=0)  # -> simplify(graft(Rectangle)), Length
graft = GraftTree(Tree=item_2.Item2, IncludeEmptyLists=True, IncludeNullItems=True)  # -> simplify(Tree)
python_3 = GhPythonScript(identity="door", geometry=rectangle.Rectangle, quantity=graft, attr=python_2.all_dict_list)  # -> out, objList; inputs geometry: tree of Rectangle3d, quantity: tree of Int32, attr: tree; same code as python_3
data_3 = Data(python_3.objList)
data_4 = ClusterOutput(data_3)

# ==== cluster Cluster
S = ClusterInput()
M = ClusterInput()
data = ClusterInput()
mindex = MemberIndex(Set=S, Member=M)  # -> Index, Count
data_2 = Data(data)
item = ListItem(List=data_2, Index=mindex.Index, Wrap=True)
cset = CreateSet(List=flatten(item))  # -> Set, Map
lng = ListLength(List=cset.Set)
S_2 = ClusterOutput(cset.Set)
M_2 = ClusterOutput(cset.Map)
L = ClusterOutput(lng)

# ==== cluster Cluster_2
category = ClusterInput()
chosenitem = ClusterInput()
dataid = ClusterInput()
category_2 = Data(category)
chosenitem_2 = Data(chosenitem)
dataid_2 = Data(dataid)
null = NullItem(Item=chosenitem_2)  # -> flatten(NullFlags), InvalidFlags, Description
item = ListItem(List=null.NullFlags, Index=0, Wrap=True)
filter = StreamFilter(Gate=item, Stream0=chosenitem_2, Stream1=category_2)
mindex = MemberIndex(Set=category_2, Member=filter)  # -> flatten(Index), Count
python = GhPythonScript(choose=mindex.Index, data=dataid_2)  # -> out, a; inputs choose: list, data: list
# ---------- python: Python ----------
a = []
for id, d in enumerate(data):
    if d in choose:
        a.append(id)
# ---------- end python ----------
a = ClusterOutput(python.a)

# ==== cluster CladdingCatergory
sddp = ShapeDiverDocumentPayload()
geo = ClusterInput()
data = ClusterInput()
geo_2 = Geometry(geo)
data_2 = Data(data)
int = Integer(flatten(data_2))
cset = CreateSet(List=int)  # -> Set, Map
sort = SortList(Keys=cset.Set)  # -> Keys, ValuesA
lng = ListLength(List=cset.Set)
series = Series(Start=0, Step=1, Count=lng)
python = GhPythonScript(become=series, changed=sort.Keys, changeList=data_2)  # -> out, newList; inputs become: list, changed: list, changeList: tree of Int32
# ---------- python: Python ----------
import ghpythonlib.treehelpers as th

width = become
length = changed

number_mapping = {}
for w, l in zip(width, length):
    number_mapping[l] = w

newList = []
for chList in changeList.Branches:
    newList.append([number_mapping[number] if number in number_mapping else number for number in chList])

newList = th.list_to_tree(newList)
# ---------- end python ----------
unflatten = UnflattenTree(Tree=python.newList, Guide=data_2)
tstat = TreeStatistics(Tree=graft(unflatten))  # -> Paths, Length, Count
dpath = DeconstructPath(Branch=tstat.Paths)
flatten = FlattenTree(Tree=unflatten, Path="{0}")  # -> simplify(graft(Tree))
geo_3 = Geometry(graft(geo_2))
item = ListItem(List=dpath, Index=0, Wrap=True)  # -> simplify(Item)
merge = Merge(Data1=item, Data2=flatten)
tstat_2 = TreeStatistics(Tree=geo_3)  # -> Paths, Length, Count
path = ConstructPath(Indices=merge)  # -> flatten(Branch)
tstat_3 = TreeStatistics(Tree=flatten)  # -> Paths, Length, Count
replace = ReplacePaths(Data=flatten, Search=tstat_3.Paths, Replace=path)
replace_2 = ReplacePaths(Data=geo_3, Search=tstat_2.Paths, Replace=path)
data_3 = Data(replace)
geo_4 = Geometry(replace_2)
geo_5 = ClusterOutput(geo_4)
data_4 = ClusterOutput(data_3)
