# Grasshopper definition wallSystem_demo.gh (Grasshopper 1.0.7)
# plug-ins: Human

python = GhPythonScript()  # -> out, a; disabled
# ---------- python: Python ----------
import sys
import os

path = ghenv.Component.OnPingDocument().FilePath
parentdir = os.path.dirname(path)
grandparentdir = os.path.dirname(parentdir)
dire = os.path.join(grandparentdir, 'py')
if dire not in sys.path:
    sys.path.append(dire)

# Import your module
import testing
# Reload the module to ensure any changes are reflected
reload(testing)

from testing import JoJo

ohoh = JoJo(12,3)

ohoh.addd()
ohoh.mult()
# ---------- end python ----------
python_2 = GhPythonScript()  # -> out, a; inputs brep: Guid; disabled
# ---------- python_2: Python ----------
import Rhino
import scriptcontext as sc
import rhinoscriptsyntax as rs

# Set scriptcontext.doc to Rhino's document to access its objects
sc.doc = Rhino.RhinoDoc.ActiveDoc


def get_user_text_from_object(object_id, key=None):
    """
    Get user text from an object by its ID.
    """
    if object_id is None:
        print("No object ID provided.")
        return None

    rhino_object = sc.doc.Objects.Find(object_id)
    if not rhino_object:
        print("Object not found.")
        return None

    if key:
        value = rhino_object.Attributes.GetUserString(key)
        print("User text for key '{}': {}".format(key, value))
        return value
    else:
        all_user_text = rhino_object.Attributes.GetUserStrings()
        for k in all_user_text.AllKeys:
            print("Key: '{}', Value: '{}'".format(k, all_user_text[k]))
        return all_user_text

# Get the object ID by the referenced Brep geometry
#object_id = find_object_id_by_guid(brep)  # Assuming 'brep' is your input Brep

#print(object_id)
# To get user text
get_user_text_from_object(brep)
# ---------- end python_2 ----------
panel = Panel(python_2.out)  # disabled

# ----
# Script Reader
panel_2 = Panel("py\tileDefinition.py")
# Wall_1
panel_3 = Panel("py\wallDefinition3.py")
c__grasshoppername = CSharpScript(inputName=panel_3)  # -> ghParentPath, filePath; inputs inputName: String
# ---------- c__grasshoppername: C# usings ----------
using System.IO;
# ---------- c__grasshoppername: C# ----------
    if(this.GrasshopperDocument.IsFilePathDefined)
    {
      string p = this.GrasshopperDocument.FilePath;
      DirectoryInfo directoryInfo = new DirectoryInfo(p);
      string parentFolderPath = directoryInfo.Parent.Parent.FullName;

      string filePath_ = string.Format("{0}\\{1}", parentFolderPath, inputName);

      ghParentPath = parentFolderPath;
      filePath = filePath_;

    }
# ---------- end c__grasshoppername ----------
c__grasshoppername_2 = CSharpScript(inputName=panel_2)  # -> ghParentPath, filePath; inputs inputName: String; same code as c__grasshoppername
c__grasshoppername_3 = CSharpScript(inputName="py\boardDefinition.py")  # -> ghParentPath, filePath; inputs inputName: String; same code as c__grasshoppername
c__grasshoppername_4 = CSharpScript(inputName="py\structAndFillDefinition.py")  # -> ghParentPath, filePath; inputs inputName: String; same code as c__grasshoppername
c__grasshoppername_5 = CSharpScript(inputName="py\substructionDefinition.py")  # -> ghParentPath, filePath; inputs inputName: String; same code as c__grasshoppername
c__grasshoppername_6 = CSharpScript(inputName="py\paintDefinition.py")  # -> ghParentPath, filePath; inputs inputName: String; same code as c__grasshoppername

panel_4 = Panel(c__grasshoppername_2.filePath)

# ----
# paint
file = ReadFile(File=c__grasshoppername_6.filePath, PerLineParse=False)

# ----
# Inner Material Setting
# board
file_2 = ReadFile(File=c__grasshoppername_3.filePath, PerLineParse=False)

# ----
# subStruct + infill
file_3 = ReadFile(File=c__grasshoppername_4.filePath, PerLineParse=False)

# ----
# subStruct
file_4 = ReadFile(File=c__grasshoppername_5.filePath, PerLineParse=False)

# ----
# claddingLength
number_slider = Slider(600, range=0..1000)
int = Integer(number_slider)

# ----
# claddingWidth
number_slider_2 = Slider(333, range=0..1000)
int_2 = Integer(number_slider_2)

# ----
# substructThickness
number_slider_3 = Slider(20, range=0..100)

# ----
# kindNum
number_slider_4 = Slider(4, range=0..10)
int_3 = Integer(number_slider_4)

# ----
# wall
brep = Brep(<brep referenced from the Rhino model>)

# ----
# window
brep_2 = Brep(<brep referenced from the Rhino model>)
brep_3 = Brep(<brep referenced from the Rhino model>)
brep_4 = Brep(<brep referenced from the Rhino model>)
brep_5 = Brep(<brep referenced from the Rhino model>)

# ----
# substructWidth
number_slider_5 = Slider(41, range=0..100)

# ----
# door
brep_6 = Brep(<brep referenced from the Rhino model>)
brep_7 = Brep(<brep referenced from the Rhino model>)

# ----
# vertiAngle
number_slider_6 = Slider(0, range=0..60)

# ----
# wWeight
number_slider_7 = Slider(5, range=2..6)

# ----
# horiAngle
number_slider_8 = Slider(5, range=0..100)

# ----
# lWeight
number_slider_9 = Slider(4, range=2..6)

# ----
# vertiOverlap
number_slider_10 = Slider(0, range=0..1000)

# ----
# horiOverlap
number_slider_11 = Slider(1, range=0..100)

# ----
# Geometry of Opening
merge = Merge(Data1=brep_2, Data2=brep_3, Data3=brep_5, Data4=brep_4)
merge_2 = Merge(Data1=brep_6, Data2=brep_7)
brep_8 = Brep(merge_2)
brep_9 = Brep(brep)
brep_10 = Brep(merge)
cluster = Cluster(brep=[merge, brep_8])
cluster_2 = Cluster(brep=brep_9)
plnaxis = PlaneAxis(P=cluster, B=Slider(700, range=0..1000))
plnaxis_2 = PlaneAxis(P=cluster_2, B=Slider(957, range=0..1000))

# ----
# Mock DataBase
tiledb = TileDB()
doordb = DoorDB()
boarddb = BoardDB()
windowdb = WindowDB()
data = Data(simplify(boarddb))
data_2 = Data(simplify(tiledb))
db_collection = GhPythonScript(windowDB=windowdb, doorDB=doordb, tileDB=data_2, boardDB=data)  # -> out, allDB; inputs windowDB: list, doorDB: list, tileDB: list, boardDB: list
# ---------- db_collection: Python ----------
allDict = {}
allDict["windowDB"] = windowDB
allDict["doorDB"] = doorDB
allDict["tileDB"] = tileDB
allDict["boardDB"] = boardDB

class classForOutput:
    def __init__(self):
        pass

allData = classForOutput()
allData.all_DB = allDict

allDB = allData
# ---------- end db_collection ----------

brep_11 = Brep(<brep referenced from the Rhino model>)
brep_12 = Brep(<brep referenced from the Rhino model>)
brep_13 = Brep(<brep referenced from the Rhino model>)
# thickness
# distance
# direction
toggle = BooleanToggle(True)  # disabled
python_3 = GhPythonScript(brep=brep_11)  # -> out, width, height, depth; inputs brep: Guid
# ---------- python_3: Python ----------
import Rhino
import scriptcontext as sc
import rhinoscriptsyntax as rs
import Grasshopper.Kernel as ghkernel


# Set scriptcontext.doc to Rhino's document to access its objects
sc.doc = Rhino.RhinoDoc.ActiveDoc

def get_attribute(object_id, key=None):
    """
    Get user text from an object by its ID.
    """
    if object_id is None:
        print("No object ID provided.")
        return None

    rhino_object = sc.doc.Objects.Find(object_id)
    if not rhino_object:
        print("Object not found.")
        return None

    if key:
        value = rhino_object.Attributes.GetUserString(key)
        print("User text for key '{}': {}".format(key, value))
        return value
    else:
        all_user_text = rhino_object.Attributes.GetUserStrings()
        for k in all_user_text.AllKeys:
            print("Key: '{}', Value: '{}'".format(k, all_user_text[k]))
        return all_user_text


if brep == None:
    ghenv.Component.AddRuntimeMessage(ghkernel.GH_RuntimeMessageLevel.Warning, "brep is empty.")
else:
    # To get user text
    width = get_attribute(brep, "breite")
    height = get_attribute(brep, "hoehe")
    depth = get_attribute(brep, "tiefe")
    
    width = width if width != "FALSE" else 1
    height = height if height != "FALSE" else 1
    depth = depth if depth != "FALSE" else 1
    
    width = 10 * int(width)
    height = 10 * int(height)
    depth = 10 * int(depth)
# ---------- end python_3 ----------
python_4 = GhPythonScript(brep=brep_12)  # -> out, width, height, depth; inputs brep: Guid; same code as python_3
python_5 = GhPythonScript(brep=brep_13)  # -> out, width, height, depth; inputs brep: Guid; same code as python_3
# subStruct + infill
# width
panel_5 = Panel("20")  # disabled
panel_6 = Panel("50")  # disabled
panel_7 = Panel("500")  # disabled
# thickness
panel_8 = Panel("5")  # disabled
substruct_infill_material = GhPythonScript(Code=file_3, Width=panel_5, Thickness=panel_6, Distance=panel_7, Direction=toggle)  # -> Out, SubstructInfill_obj; disabled
# paint
paint_material = GhPythonScript(Code=file, Thickness=panel_8)  # -> Out, Paint_obj; disabled
# subStruct
substruct_infill_material_2 = GhPythonScript(Code=file_4, Width="30", Thickness="10", Distance="300", Direction=Toggle(True))  # -> Out, Substruct_obj
# board
board_material = GhPythonScript(
    Code=file_2,
    Width=python_3.width,
    Length=python_3.height,
    Thickness=python_3.depth,
    SearchDB=Toggle(False),
    Direction=Toggle(True))  # -> Out, Board_obj
# board
board_material_2 = GhPythonScript(
    Code=file_2,
    Width=python_4.width,
    Length=python_4.height,
    Thickness=python_4.depth,
    SearchDB=Toggle(False),
    Direction=Toggle(True))  # -> Out, Board_obj

# ----
# Cladding Setting
num = Number(number_slider_10)
num_2 = Number(number_slider_11)
num_3 = Number(number_slider_8)
num_4 = Number(number_slider_6)
num_5 = Number(number_slider_5)
num_6 = Number(number_slider_3)

# ----
# board
board_material_3 = GhPythonScript(
    Code=file_2,
    Width=python_5.width,
    Length=python_5.height,
    Thickness=python_5.depth,
    SearchDB=Toggle(False),
    Direction=Toggle(True))  # -> Out, Board_obj

search_tile = GhPythonScript(claddingWidth=int_2, claddingLength=int, kindNum=int_3, wWeight=number_slider_7, lWeight=number_slider_9)  # -> out, searchTileSetting; inputs kindNum: Int32, wWeight: Int32, lWeight: Int32
# ---------- search_tile: Python ----------
allDict = {}
allDict["claddingWidth"] = claddingWidth
allDict["claddingLength"] = claddingLength
allDict["kindNum"] = kindNum
allDict["wWeight"] = wWeight
allDict["lWeight"] = lWeight


class classForOutput:
    def __init__(self):
        pass

allData = classForOutput()
allData.searchTileData = allDict
allData.identity = "searchTile"

searchTileSetting = allData
# ---------- end search_tile ----------

merge_3 = Merge(
    Data1=board_material_2.Board_obj,
    Data2=substruct_infill_material_2.Substruct_obj,
    Data3=board_material.Board_obj,
    Data4=board_material_3.Board_obj)

# ----
# Module Setting
number_slider_12 = Slider(1800, range=0..10000)
crv = Curve([<curve referenced from the Rhino model> x2])

searchdbtile = Data(search_tile.searchTileSetting)
file_5 = ReadFile(File=c__grasshoppername.filePath, PerLineParse=False)

# ----
# Cladding Engine
python_6 = GhPythonScript(
    Code=file_5,
    DB=db_collection.allDB,
    CarrierGeo=brep_9,
    WindowGeo=brep_10,
    DoorGeo=brep_8,
    SetTile=searchdbtile,
    CladdingDirection=Toggle(True),
    HoriOverlap=num_2,
    VertiOverlap=num,
    HoriAngle=num_3,
    VertiAngle=num_4,
    SubstructWidth=num_5,
    SubstructThickness=num_6,
    Material_collection=merge_3,
    ModuleCurve=crv,
    ModuleCrvDist=Slider(266, range=0..1000),
    Init=Button())  # -> Out, Comb, OriginalCoTileGeo, WallFrame, WindowForFinalList, DoorForFinalList, SubstructureGeo, AllTypeMaterial, AllTypeMaterialModule, MaterialInfo

panel_9 = Panel(python_6.MaterialInfo)
panel_10 = Panel(python_6.Out)
# Opening Visualization
geo = Geometry([python_6.WindowForFinalList, python_6.DoorForFinalList])

# ----
# Explode wall
number_slider_13 = Slider(2699, range=0..3000)

cluster_3 = Cluster_2(crv=geo, pln=python_6.WallFrame, A=Slider(123, range=0..1000))
previewlw = CustomPreviewLineweights(Geometry=cluster_3, Shader=ColourSwatch(SwatchColor=RGB(0, 255, 238)), Thickness=Slider(4, range=0..10), Absolute=False)

# ----
# Wall Visualization
cluster_4 = Cluster_3(
    relay_2=python_6.Comb,
    relay_3=python_6.OriginalCoTileGeo,
    G=python_6.SubstructureGeo,
    relay=python_6.AllTypeMaterial,
    N=number_slider_13,
    P=python_6.WallFrame)  # -> C_2, G_2, en, ei, geo_4, crv_2, geo_3, C
preview = CustomPreview(Geometry=cluster_4.geo_3, Material=graft(cluster_4.C))
previewmat = CustomPreviewMaterials(Geometry=cluster_4.geo_4, DiffuseColor=RGB(255, 255, 255))
previewmat_2 = CustomPreviewMaterials(Geometry=cluster_4.G_2, DiffuseColor=cluster_4.C_2)
previewlw_2 = CustomPreviewLineweights(Geometry=[cluster_4.en, cluster_4.ei, cluster_4.crv_2], Shader=ColourSwatch(SwatchColor=RGB(0, 0, 0)), Absolute=False)

# ----
# Module Index
number_slider_14 = Slider(1, range=0..10)

# ----
# Layer Index
number_slider_15 = Slider(4, range=0..10)

# ----
# Material Index
number_slider_16 = Slider(0, range=0..10)

# ----
# Module Index
number_slider_17 = Slider(0, range=0..10)

# ----
# Module Visualization
data_3 = Data(simplify(python_6.AllTypeMaterialModule))
findmodule = GhPythonScript(data=data_3, y=number_slider_14)  # -> out, A; inputs data: tree, y: Int32
# ---------- findmodule: Python ----------
from Grasshopper import DataTree
from Grasshopper.Kernel.Data import GH_Path
from System import Object
import ghpythonlib.treehelpers as th

selected = []
for path in data.Paths:
    if path[1] == y:
        items = data.Branch(path)
        selected.append(items)
    else:
        print("cannot find")

# Output the selected data
A = th.list_to_tree(selected)
# ---------- end findmodule ----------
findlayer = GhPythonScript(data=data_3, y=number_slider_15)  # -> out, A; inputs data: tree, y: Int32
# ---------- findlayer: Python ----------
from Grasshopper import DataTree
from Grasshopper.Kernel.Data import GH_Path
from System import Object
import ghpythonlib.treehelpers as th

selected = []
for path in data.Paths:
    if path[0] == y:
        items = data.Branch(path)
        selected.append(items)
    else:
        print("cannot find")

# Output the selected data
A = th.list_to_tree(selected)
# ---------- end findlayer ----------
cluster_5 = BranchLook(data=findmodule.A, i=number_slider_16)
# Explode wall
# Layer Index
# Module Index
# Module Index
# Material Index
cluster_6 = BranchLook(data=findlayer.A, i=number_slider_17)

# ==== cluster BranchLook: To see the condition of branch data.
data = ClusterInput()
data_2 = Data(data)
tstat = TreeStatistics(Tree=data_2)  # -> Paths, Length, Count
i = ClusterInput()
item = ListItem(List=tstat.Paths, Index=i, Wrap=True)
branch = TreeBranch(Tree=data_2, Path=item, MaintainPaths=True)
B = ClusterOutput(branch)

# ==== cluster PlaneAxis: show plane X Y Z axis.
P = ClusterInput()
B = ClusterInput()
deplane = DeconstructPlane(Plane=graft(P))  # -> Origin, XAxis, YAxis, ZAxis
multiplication = Multiplication(A=[deplane.XAxis, deplane.YAxis, deplane.ZAxis], B=B)
vdisex = VectorDisplayEx(
    Point=deplane.Origin,
    Vector=multiplication,
    Colour=[ColourSwatch(SwatchColor=RGB(235, 52, 52)), ColourSwatch(SwatchColor=RGB(90, 207, 48)), ColourSwatch(SwatchColor=RGB(54, 126, 227))],
    Width=2)

# ==== cluster Cluster
brep = ClusterInput()
brep_2 = Brep(brep)
area = Area(Geometry=brep_2)  # -> Area, Centroid
srf_cp = SurfaceClosestPoint(Point=area.Centroid, Surface=brep_2)  # -> Point, UVPoint, Distance
evalsrf = EvaluateSurface(Surface=brep_2, Point=srf_cp.UVPoint)  # -> Point, Normal, UDirection, VDirection, Frame
F = ClusterOutput(evalsrf.Frame)
vdis = VectorDisplay(Anchor=evalsrf.Point, Vector=evalsrf.Normal)

# ==== cluster BoardDB
series = Series(Start=0, Step=1, Count="3")
item = ListItem(List=series, Index=0, Wrap=True)  # -> Item, Item1, Item2
number_slider = Slider(700, range=0..1000)
dom = ConstructDomain(DomainStart=Slider(400, range=0..1000), DomainEnd=Slider(1000, range=0..1000))
dom_2 = ConstructDomain(DomainStart=Slider(800, range=0..1000), DomainEnd=Slider(1500, range=0..10000))
dom_3 = ConstructDomain(DomainStart=Slider(116, range=0..300), DomainEnd=Slider(177, range=0..300))
dom_4 = ConstructDomain(DomainStart=Slider(20, range=0..1000), DomainEnd=Slider(40, range=0..10000))
# width
random = Random(Range=dom, Number=number_slider, Seed=item.Item, Integers=True)
# length
random_2 = Random(Range=dom_2, Number=number_slider, Seed=item.Item1, Integers=True)
# quantity
random_3 = Random(Range=dom_3, Number=number_slider, Seed=item.Item2, Integers=True)
# length
random_4 = Random(Range=dom_4, Number=number_slider, Seed=item.Item1, Integers=True)
repeat = RepeatData(Data="boardName_", Length=number_slider)  # -> simplify(graft(Data))
series_2 = Series(Start=0, Step=1, Count=number_slider)  # -> simplify(graft(Series))
graft = GraftTree(Tree=random_3, IncludeEmptyLists=True, IncludeNullItems=True)
graft_2 = GraftTree(Tree=random, IncludeEmptyLists=True, IncludeNullItems=True)
graft_3 = GraftTree(Tree=random_2, IncludeEmptyLists=True, IncludeNullItems=True)
graft_4 = GraftTree(Tree=random_4, IncludeEmptyLists=True, IncludeNullItems=True)
merge = Merge(Data1=repeat, Data2=series_2)
rectangle = Rectangle(Plane=PlaneXY(0, 0, 0), XSize=random, YSize=random_2, Radius=0)  # -> simplify(graft(Rectangle)), Length
join = TextJoin(Text=merge)
python = GhPythonScript(identity="board", geometry=rectangle.Rectangle, quantity=graft, name=join, width=graft_2, height=graft_3, depth=graft_4)  # -> out, objList; inputs geometry: tree of Rectangle3d, quantity: tree of Int32, name: tree, width: tree, height: tree, depth: tree
# ---------- python: Python ----------
class BuildingComponent:
    def __init__(self, identity, geometry, quantity, name, width, height, depth):
        self.identity = identity
        self.geometry = geometry
        self.quantity = quantity
        self.name = name
        self.width = width
        self.height = height
        self.depth = depth

objList = []
for geo, qua, na, wi, he, de in zip(geometry.Branches, quantity.Branches, name.Branches, width.Branches, height.Branches, depth.Branches):
    obj = BuildingComponent(identity, geo[0], qua[0], na[0], wi[0], he[0], de[0])
    objList.append(obj)
# ---------- end python ----------
objlist = ClusterOutput(python.objList)

# ==== cluster Cluster_2
pln = ClusterInput()
crv = ClusterInput()
panel = Panel("""200
100""")
pln_2 = Plane(pln)
crv_2 = Curve(crv)
A = ClusterInput()
deplane = DeconstructPlane(Plane=pln_2)  # -> Origin, XAxis, YAxis, ZAxis
dash = DashPattern(Curve=crv_2, Pattern=panel)  # -> Dashes, Gaps
amp = Amplitude(Vector=deplane.ZAxis, Amplitude=A)
move = Move(Geometry=dash.Dashes, Motion=amp)  # -> Geometry, Transform
G = ClusterOutput(move.Geometry)

# ==== cluster Cluster_3
relay = ClusterInput()
panel = Panel(relay)
python = GhPythonScript(x=relay)  # -> out, a
# ---------- python: Python ----------
a =x
# ---------- end python ----------
tstat = TreeStatistics(Tree=relay)  # -> Paths, Length, Count
N = ClusterInput()
relay_2 = ClusterInput()
relay_3 = ClusterInput()
series = Series(Start=0, Step=N, Count=expr("x+1", tstat.Count))
series_2 = Series(Start=0, Step=1, Count=tstat.Count)
P = ClusterInput()
pshift = ShiftPaths(Data=python.a, Offset=-1)
python_2 = GhPythonScript(x=series)  # -> out, a, b; inputs x: list
# ---------- python_2: Python ----------
a = x[:-1]
b = x[-1]
# ---------- end python_2 ----------
deplane = DeconstructPlane(Plane=P)  # -> Origin, XAxis, YAxis, ZAxis
python_3 = GhPythonScript(x=relay_3)  # -> out, a; same code as python
panel_2 = Panel(relay_3)
item = ListItem(List=flatten(relay_2), Index=0, Wrap=True)
amp = Amplitude(Vector=deplane.ZAxis, Amplitude=python_2.a)  # -> graft(Vector)
null = NullItem(Item=item)  # -> NullFlags, InvalidFlags, Description
cladding_catergory = CladdingCatergory(data=relay_2, geo=relay_3)  # -> geo_5, data_4
gradient = Gradient(
    LowerLimit="0",
    UpperLimit=tstat.Count,
    Parameter=series_2,
    stops=[0: RGB(234, 38, 0), 0.25: RGB(234, 126, 0), 0.5: RGB(254, 244, 84), 0.75: RGB(173, 203, 249), 1: RGB(75, 107, 169)])
move = Move(Geometry=pshift, Motion=amp)  # -> Geometry, Transform
amp_2 = Amplitude(Vector=deplane.ZAxis, Amplitude=python_2.b)  # -> graft(Vector)
filter = StreamFilter(Gate=null.NullFlags, Stream0=cladding_catergory.geo_5, Stream1=python_3.a)
filter_2 = StreamFilter(Gate=null.NullFlags, Stream0=cladding_catergory.geo_5, Stream1=python_3.a)
tstat_2 = TreeStatistics(Tree=cladding_catergory.geo_5)  # -> Paths, Length, Count
G = ClusterInput()
C = ClusterOutput(gradient)
tstat_3 = TreeStatistics(Tree=filter_2)  # -> Paths, Length, Count
series_3 = Series(Start=0, Step=1, Count=tstat_3.Count)  # -> graft(Series)
move_2 = Move(Geometry=G, Motion=amp_2)  # -> Geometry, Transform
edges = BrepEdges(Brep=move.Geometry)  # -> Naked, Interior, NonManifold
move_3 = Move(Geometry=filter, Motion=amp_2)  # -> Geometry, Transform
geo = Geometry(move.Geometry)
filter_3 = StreamFilter(Gate=null.NullFlags, Stream0=tstat_2.Count, Stream1=tstat_3.Count)
filter_4 = StreamFilter(Gate=null.NullFlags, Stream0=cladding_catergory.data_4, Stream1=series_3)
geo_2 = Geometry(move_2.Geometry)
crv = Curve([edges.Interior, edges.Naked])
geo_3 = ClusterOutput(geo)
G_2 = ClusterOutput(move_3.Geometry)
geo_4 = ClusterOutput(geo_2)
edges_2 = BrepEdges(Brep=move_3.Geometry)  # -> Naked, Interior, NonManifold
crv_2 = ClusterOutput(crv)
gradient_2 = Gradient(
    LowerLimit=0,
    UpperLimit=filter_3,
    Parameter=filter_4,
    stops=[0: RGB(145, 107, 64), 0.267: RGB(234, 126, 0), 0.498: RGB(245, 207, 81), 0.772: RGB(235, 221, 185), 1: RGB(199, 98, 58)])
en = ClusterOutput(edges_2.Naked)
ei = ClusterOutput(edges_2.Interior)
C_2 = ClusterOutput(gradient_2)

# ==== cluster WindowDB
number_slider = Slider(500, range=0..1000)
series = Series(Start=0, Step=1, Count="3")
item = ListItem(List=series, Index=0, Wrap=True)  # -> Item, Item1, Item2
dom = ConstructDomain(DomainStart="1000", DomainEnd="2000")
dom_2 = ConstructDomain(DomainStart="1000", DomainEnd="2000")
dom_3 = ConstructDomain(DomainStart=Slider(191, range=0..300), DomainEnd=Slider(262, range=0..300))
repeat = RepeatData(Data="windowName_", Length=number_slider)  # -> simplify(graft(Data))
series_2 = Series(Start=0, Step=1, Count=number_slider)  # -> simplify(graft(Series))
# quantity
random = Random(Range=dom_3, Number=number_slider, Seed=item.Item2, Integers=True)
random_2 = Random(Range=dom_2, Number=number_slider, Seed=item.Item)
random_3 = Random(Range=dom, Number=number_slider, Seed=item.Item1)
merge = Merge(Data1=repeat, Data2=series_2)
rectangle = Rectangle(Plane=PlaneXY(0, 0, 0), XSize=random_2, YSize=random_3, Radius=0)  # -> simplify(graft(Rectangle)), Length
graft = GraftTree(Tree=random, IncludeEmptyLists=True, IncludeNullItems=True)  # -> simplify(Tree)
join = TextJoin(Text=merge)
merge_2 = Merge(Data1=rectangle.Rectangle, Data2=graft, Data3=join)  # disabled
python = GhPythonScript(identity="window", geometry=rectangle.Rectangle, quantity=graft, name=join)  # -> out, objList; inputs geometry: tree of Rectangle3d, quantity: tree of Int32, name: tree
# ---------- python: Python ----------
class BuildingComponent:
    def __init__(self, identity, geometry, quantity, name):
        self.identity = identity
        self.geometry = geometry
        self.quantity = quantity
        self.name = name

objList = []
for geo, qua, na in zip(geometry.Branches, quantity.Branches, name.Branches):
    obj = BuildingComponent(identity, geo[0], qua[0], na[0])
    objList.append(obj)
# ---------- end python ----------
objlist = ClusterOutput(python.objList)

# ==== cluster DoorDB
number_slider = Slider(500, range=0..1000)
series = Series(Start=0, Step=1, Count="3")
item = ListItem(List=series, Index=0, Wrap=True)  # -> Item, Item1, Item2
dom = ConstructDomain(DomainStart="1900", DomainEnd="2500")
dom_2 = ConstructDomain(DomainStart="1000", DomainEnd="2000")
dom_3 = ConstructDomain(DomainStart=Slider(191, range=0..300), DomainEnd=Slider(262, range=0..300))
repeat = RepeatData(Data="doorName_", Length=number_slider)  # -> simplify(graft(Data))
series_2 = Series(Start=0, Step=1, Count=number_slider)  # -> simplify(graft(Series))
# quantity
random = Random(Range=dom_3, Number=number_slider, Seed=item.Item2, Integers=True)
random_2 = Random(Range=dom_2, Number=number_slider, Seed=item.Item)
random_3 = Random(Range=dom, Number=number_slider, Seed=item.Item1)
merge = Merge(Data1=repeat, Data2=series_2)
rectangle = Rectangle(Plane=PlaneXY(0, 0, 0), XSize=random_2, YSize=random_3, Radius=0)  # -> simplify(graft(Rectangle)), Length
graft = GraftTree(Tree=random, IncludeEmptyLists=True, IncludeNullItems=True)  # -> simplify(Tree)
join = TextJoin(Text=merge)
python = GhPythonScript(identity="door", geometry=rectangle.Rectangle, quantity=graft, name=join)  # -> out, objList; inputs geometry: tree of Rectangle3d, quantity: tree of Int32, name: tree; same code as python
objlist = ClusterOutput(python.objList)

# ==== cluster TileDB
number_slider = Slider(200, range=0..1000)
series = Series(Start=0, Step=1, Count="3")
item = ListItem(List=series, Index=0, Wrap=True)  # -> Item, Item1, Item2
dom = ConstructDomain(DomainStart=Slider(100, range=0..1000), DomainEnd=Slider(600, range=0..1000))
dom_2 = ConstructDomain(DomainStart=Slider(100, range=0..1000), DomainEnd=Slider(1200, range=0..10000))
dom_3 = ConstructDomain(DomainStart=Slider(191, range=0..300), DomainEnd=Slider(262, range=0..300))
# width
random = Random(Range=dom, Number=number_slider, Seed=item.Item, Integers=True)
# length
random_2 = Random(Range=dom_2, Number=number_slider, Seed=item.Item1, Integers=True)
# quantity
random_3 = Random(Range=dom_3, Number=number_slider, Seed=item.Item2, Integers=True)
rectangle = Rectangle(Plane=PlaneXY(0, 0, 0), XSize=random, YSize=random_2, Radius=0)  # -> simplify(graft(Rectangle)), Length
graft = GraftTree(Tree=random_3, IncludeEmptyLists=True, IncludeNullItems=True)
repeat = RepeatData(Data="tileName_", Length=number_slider)  # -> simplify(graft(Data))
series_2 = Series(Start=0, Step=1, Count=number_slider)  # -> simplify(graft(Series))
merge = Merge(Data1=repeat, Data2=series_2)
join = TextJoin(Text=merge)
python = GhPythonScript(identity="tile", geometry=rectangle.Rectangle, quantity=graft, name=join)  # -> out, objList; inputs geometry: tree of Rectangle3d, quantity: tree of Int32, name: tree; same code as python
objlist = ClusterOutput(python.objList)

# ==== cluster CladdingCatergory
geo = ClusterInput()
data = ClusterInput()
geo_2 = Geometry(geo)
data_2 = Data(data)
int = Integer(flatten(data_2))
cset = CreateSet(List=int)  # -> Set, Map
sort = SortList(Keys=cset.Set)  # -> Keys, ValuesA
lng = ListLength(List=cset.Set)
series = Series(Start=0, Step=1, Count=lng)
panel = Panel(sort.Keys)
python = GhPythonScript(become=series, changed=sort.Keys, changeList=data_2)  # -> out, newList; inputs become: list, changed: list, changeList: tree of Int32
# ---------- python: Python ----------
import ghpythonlib.treehelpers as th

width = become
length = changed

number_mapping = {}
for w, l in zip(width, length):
    number_mapping[l] = w

newList = []
for chList in changeList.Branches:
    newList.append([number_mapping[number] if number in number_mapping else number for number in chList])

newList = th.list_to_tree(newList)
# ---------- end python ----------
unflatten = UnflattenTree(Tree=python.newList, Guide=data_2)
geo_3 = Geometry(flatten(geo_2))
flatten = FlattenTree(Tree=unflatten, Path="{0}")  # -> graft(Tree)
graft = GraftTree(Tree=geo_3, IncludeEmptyLists=True, IncludeNullItems=True)
path = ConstructPath(Indices=flatten)  # -> flatten(Branch)
tstat = TreeStatistics(Tree=graft)  # -> Paths, Length, Count
replace = ReplacePaths(Data=graft, Search=tstat.Paths, Replace=path)
replace_2 = ReplacePaths(Data=flatten, Search=tstat.Paths, Replace=path)
data_3 = Data(replace_2)
geo_4 = Geometry(replace)
data_4 = ClusterOutput(data_3)
geo_5 = ClusterOutput(geo_4)
