# Grasshopper definition wallSystem_normalFacade.gh (Grasshopper 1.0.7)
# plug-ins: Human, ShapeDiverForGrasshopper

sddp = ShapeDiverDocumentPayload({AbsoluteTolerance=0, AngleTolerance=0, DistanceDisplayPrecision=0, GltfVersion="Gltf2", GrasshopperVersion="1.0.0007", InputGroups="{}", OutputGroups="{}", RelativeTolerance=0, RhinoVersion="7.30.23163.13001", UnitSystem=0, VersionCreated="1.16.1.0", VersionSaved="1.16.1.0"})

# ----
# Script Reader
panel = Panel("py\wallDefinition3.py")
c__grasshoppername = CSharpScript(inputName=panel)  # -> ghParentPath, filePath; inputs inputName: String
# ---------- c__grasshoppername: C# usings ----------
using System.IO;
# ---------- c__grasshoppername: C# ----------
    if(this.GrasshopperDocument.IsFilePathDefined)
    {
      string p = this.GrasshopperDocument.FilePath;
      DirectoryInfo directoryInfo = new DirectoryInfo(p);
      string parentFolderPath = directoryInfo.Parent.Parent.FullName;

      string filePath_ = string.Format("{0}\\{1}", parentFolderPath, inputName);

      ghParentPath = parentFolderPath;
      filePath = filePath_;

    }
# ---------- end c__grasshoppername ----------

# ----
# Synthetic data, should be changed
number_slider = Slider(200, range=0..1000)
tilemockdata = TileMockData(num=number_slider)

# ----
# Let`s split the shingle facade and normal facade to 2 different files, for the clarity
# Wall_Normal Facade
# Script Reader
panel_2 = Panel("py\wallDefinition3.py")
c__grasshoppername_2 = CSharpScript(inputName="py\tileDefinition.py")  # -> ghParentPath, filePath; inputs inputName: String; same code as c__grasshoppername
c__grasshoppername_3 = CSharpScript(inputName="py\boardDefinition.py")  # -> ghParentPath, filePath; inputs inputName: String; same code as c__grasshoppername
c__grasshoppername_4 = CSharpScript(inputName="py\structAndFillDefinition.py")  # -> ghParentPath, filePath; inputs inputName: String; same code as c__grasshoppername
c__grasshoppername_5 = CSharpScript(inputName="py\substructionDefinition.py")  # -> ghParentPath, filePath; inputs inputName: String; same code as c__grasshoppername
c__grasshoppername_6 = CSharpScript(inputName="py\paintDefinition.py")  # -> ghParentPath, filePath; inputs inputName: String; same code as c__grasshoppername
c__grasshoppername_7 = CSharpScript(inputName=panel_2)  # -> ghParentPath, filePath; inputs inputName: String; same code as c__grasshoppername

file = ReadFile(File=c__grasshoppername_6.filePath, PerLineParse=False)
# Inner Material Setting
file_2 = ReadFile(File=c__grasshoppername_3.filePath, PerLineParse=False)
file_3 = ReadFile(File=c__grasshoppername_5.filePath, PerLineParse=False)
file_4 = ReadFile(File=c__grasshoppername_4.filePath, PerLineParse=False)
objattr = GhPythonScript(bauteil_obergruppe="1234", breite="65", hoehe="250", tiefe="1", anzahl=Slider(555, range=0..1000))  # -> newObj; inputs anzahl: Int32
# ---------- objattr: Python ----------
import uuid as uu

class customizedObj:
    def __init__(self, **kwargs):
        for key, value in kwargs.items():
            setattr(self, key, value)


variables = {
    'bauteil_obergruppe': bauteil_obergruppe,
    'bauteil_gruner': bauteil_gruner,
    'uuid': uuid,
    'kosten': kosten,
    'zustand': zustand,
    'material': material,
    'ref_gebauede_geschoss': ref_gebauede_geschoss,
    'breite': breite,
    'hoehe': hoehe,
    'tiefe': tiefe,
    'flaeche': flaeche,
    'masse': masse,
    'anzahl': anzahl,
    'foto1': foto1,
    'foto2': foto2,
    'co2': co2,
    'url': url,
}

# Update each variable in the dictionary if it's None
for key in variables:
    if variables[key] is None:
        variables[key] = "unknown"
        if key == 'uuid':
            variables[key] = "customizedObj_" + str(uu.uuid4())



newObj = customizedObj(**variables)
newObj.attrDict = variables
# ---------- end objattr ----------
objattr_2 = GhPythonScript(bauteil_obergruppe="1234", breite="65", hoehe="9999", tiefe="1", anzahl=Slider(555, range=0..1000))  # -> newObj; inputs anzahl: Int32; same code as objattr
objattr_3 = GhPythonScript(bauteil_obergruppe="1234", breite="65", hoehe="250", tiefe="1", anzahl=Slider(999, range=0..1000))  # -> newObj; inputs anzahl: Int32; same code as objattr
pt = Point(<point referenced from the Rhino model>)
brep = Brep([<brep referenced from the Rhino model> x2])
crv = Curve(<curve referenced from the Rhino model>)
# Geometry of Opening
brep_2 = Brep(<brep referenced from the Rhino model>)

brep_3 = Brep(<brep referenced from the Rhino model>)
brep_4 = Brep(<brep referenced from the Rhino model>)
brep_5 = Brep(<brep referenced from the Rhino model>)
brep_6 = Brep(<brep referenced from the Rhino model>)
brep_7 = Brep(<brep referenced from the Rhino model>)
doorfromrh = GhPythonScript(brep=[brep_3, brep_4, brep_5])  # -> out, newObj, width, height, depth; inputs brep: Guid
# ---------- doorfromrh: Python ----------
import Rhino
import scriptcontext as sc
import rhinoscriptsyntax as rs
import Grasshopper.Kernel as ghkernel

class ObjFromRH:
    def __init__(self, **kwargs):
        for key, value in kwargs.items():
            setattr(self, key, value)


# Set scriptcontext.doc to Rhino's document to access its objects
sc.doc = Rhino.RhinoDoc.ActiveDoc

def get_attribute(object_id, key=None):
    """
    Get user text from an object by its ID.
    """
    if object_id is None:
        print("No object ID provided.")
        return None

    rhino_object = sc.doc.Objects.Find(object_id)
    if not rhino_object:
        print("Object not found.")
        return None

    if key:
        value = rhino_object.Attributes.GetUserString(key)
        print("User text for key '{}': {}".format(key, value))
        return value
    else:
        all_user_text = rhino_object.Attributes.GetUserStrings()
        objDict = {}
        for k in all_user_text.AllKeys:
            objDict[k] =  all_user_text[k]
        
        objDict["geo"] = rhino_object.Geometry
        return objDict


if brep == None:
    ghenv.Component.AddRuntimeMessage(ghkernel.GH_RuntimeMessageLevel.Warning, "brep is empty.")
else:
    # To get user text
    obj_dict = get_attribute(brep)
    newObj = ObjFromRH(**obj_dict)
    newObj.attr = obj_dict
    
    
    width = get_attribute(brep, "breite")
    height = get_attribute(brep, "hoehe")
    depth = get_attribute(brep, "tiefe")
    
    width = width if width != "FALSE" else 1
    height = height if height != "FALSE" else 1
    depth = depth if depth != "FALSE" else 1
    
    width = int(width)
    height = int(height)
    depth = int(depth)
# ---------- end doorfromrh ----------
merge = Merge(Data1=brep_6, Data2=brep_7)

# ----
# Cladding Normal Type
brep_8 = Brep(<brep referenced from the Rhino model>)
brep_9 = Brep(<brep referenced from the Rhino model>)  # disabled

brep_10 = Brep(<brep referenced from the Rhino model>)
brep_11 = Brep(<brep referenced from the Rhino model>)
brep_12 = Brep(<brep referenced from the Rhino model>)  # disabled
brep_13 = Brep(<brep referenced from the Rhino model>)
brep_14 = Brep(<brep referenced from the Rhino model>)  # disabled
brep_15 = Brep(<brep referenced from the Rhino model>)
brep_16 = Brep(<brep referenced from the Rhino model>)  # disabled
winfromrh = GhPythonScript(brep=[brep_13, brep_15, brep_16, brep_14, brep_9])  # -> out, newObj, width, height, depth; inputs brep: Guid
# ---------- winfromrh: Python ----------
import Rhino
import scriptcontext as sc
import rhinoscriptsyntax as rs
import Grasshopper.Kernel as ghkernel

class ObjFromRH:
    def __init__(self, **kwargs):
        for key, value in kwargs.items():
            setattr(self, key, value)


# Set scriptcontext.doc to Rhino's document to access its objects
sc.doc = Rhino.RhinoDoc.ActiveDoc

def get_attribute(object_id, key=None):
    """
    Get user text from an object by its ID.
    """
    if object_id is None:
        print("No object ID provided.")
        return None

    rhino_object = sc.doc.Objects.Find(object_id)
    if not rhino_object:
        print("Object not found.")
        return None

    if key:
        value = rhino_object.Attributes.GetUserString(key)
        print("User text for key '{}': {}".format(key, value))
        return value
    else:
        all_user_text = rhino_object.Attributes.GetUserStrings()
        objDict = {}
        for k in all_user_text.AllKeys:
            objDict[k] =  all_user_text[k]
        
        objDict["geo"] = rhino_object.Geometry
        return objDict


if brep == None:
    ghenv.Component.AddRuntimeMessage(ghkernel.GH_RuntimeMessageLevel.Warning, "brep is empty.")
else:
    # To get user text
    obj_dict = get_attribute(brep)
    newObj = ObjFromRH(**obj_dict)
    newObj.attr = obj_dict
    
    
    
    width = get_attribute(brep, "breite")
    height = get_attribute(brep, "hoehe")
    depth = get_attribute(brep, "tiefe")
    
    width = width if width != "FALSE" else 1
    height = height if height != "FALSE" else 1
    depth = depth if depth != "FALSE" else 1
    
    width = int(width)
    height = int(height)
    depth = int(depth)
# ---------- end winfromrh ----------
merge_2 = Merge(Data1=brep_10, Data2=brep_11, Data4=brep_12)

objattr_4 = GhPythonScript(bauteil_obergruppe="1234", breite="65", hoehe="250", tiefe="1", anzahl=Slider(999, range=0..1000))  # -> newObj; inputs anzahl: Int32; same code as objattr
boundary = BoundarySurfaces(Edges=crv)
createwindow = GhPythonScript(windowGeo=brep, objAttr=objattr_2)  # -> out, newObj; inputs windowGeo: Brep
# ---------- createwindow: Python ----------
import Rhino.Geometry as rg
from copy import copy
from ghpythonlib.components import AlignPlane
import math
import Grasshopper.Kernel as ghkernel
import uuid


class ObjFromRH:
    def __init__(self, **kwargs):
        for key, value in kwargs.items():
            setattr(self, key, value)

run = True
if windowGeo == None:
    ghenv.Component.AddRuntimeMessage(ghkernel.GH_RuntimeMessageLevel.Warning, "Input windowGeo")
    run = False
if objAttr == None:
    attr_dict = {
    'bauteil_obergruppe': 'other_' + str(uuid.uuid4()),
    'bauteil_gruner': 'other_' + str(uuid.uuid4()),
    'uuid': 'board_uuid_' + str(uuid.uuid4()),
    'kosten': 'unknown',
    'zustand': 'unknown',
    'material': 'unknown',
    'ref_gebauede_geschoss': 'unknown',
    'breite': 'unknown',
    'hoehe': 'unknown',
    'tiefe': 'unknown',
    'flaeche': 'unknown',
    'masse': 'unknown',
    'anzahl': 'unknown',
    'foto1': 'unknown',
    'foto2': 'unknown',
    'co2': 'unknown',
    'url': 'unknown'}
    objAttr = ObjFromRH(**attr_dict)
    objAttr.attrDict = attr_dict




def alignToZ(targetPlane):
    finalPlane = copy(targetPlane)
    finalPlane = AlignPlane(finalPlane, rg.Vector3d.ZAxis)[0]
    finalPlane.Rotate(-math.pi/2, finalPlane.ZAxis, finalPlane.Origin)

    return finalPlane

def _sortPoints(points, surf):
    if isinstance(surf, rg.Surface) or isinstance(surf, rg.Brep):
        # Ensure surf is a Surface for the operations (if Brep, use its faces)
        if isinstance(surf, rg.Brep):
            surf = surf.Faces[0]

        area_properties = rg.AreaMassProperties.Compute(surf)
        if area_properties is not None:
            centroid = area_properties.Centroid
            success, uvPU, uvPV = surf.ClosestPoint(centroid)
            if success:
                success, surf_Frame = surf.FrameAt(uvPU, uvPV)
                surf_Frame = alignToZ(surf_Frame)

            else:
                print("Failed to find the closest point on the surface.")
        else:
            print("Failed to compute area properties.")
    else:
        print("The input 'surf' is not a valid surface or brep.")


    rTo = rg.Transform.ChangeBasis(rg.Plane.WorldXY, surf_Frame)
    rFro = rg.Transform.ChangeBasis(surf_Frame, rg.Plane.WorldXY)
    
    for pt in points:
        pt.Transform(rTo)
        if pt.X>0 and pt.Y>0:
            pt.Transform(rFro)
            pointHighFirst = pt
        elif pt.X<0 and pt.Y>0:
            pt.Transform(rFro)
            pointHighSecond = pt
        elif pt.X>0 and pt.Y<0:
            pt.Transform(rFro)
            pointLowFirst = pt
        elif pt.X<0 and pt.Y<0:
            pt.Transform(rFro)
            pointLowSecond = pt
    surf_Frame.Rotate(math.pi/2, surf_Frame.ZAxis)
    return (pointLowSecond, pointHighSecond, pointLowFirst, pointHighFirst, surf_Frame)

if run:
    ptList = [vertex.Location for vertex in windowGeo.Vertices]
    ptList = _sortPoints(ptList, windowGeo)
    height = int(ptList[0].DistanceTo(ptList[1]))
    width = int(ptList[0].DistanceTo(ptList[2]))
    
    newObj = copy(objAttr)
    if objAttr.hoehe == "unknown":
        objAttr.hoehe = height
        objAttr.attrDict['hoehe'] = height
        newObj.hoehe = height
    if abs(height - float(objAttr.hoehe))>1:
        ghenv.Component.AddRuntimeMessage(ghkernel.GH_RuntimeMessageLevel.Warning, "Height is not match. We will take Geometry dimension")
        newObj.hoehe = height
        objAttr.attrDict['hoehe'] = height
    
    if objAttr.breite == "unknown":
        objAttr.breite = width
        objAttr.attrDict['breite'] = width
        newObj.breite = width
    if abs(width - float(objAttr.breite))>1:
        ghenv.Component.AddRuntimeMessage(ghkernel.GH_RuntimeMessageLevel.Warning, "Width is not match. We will take Geometry dimension")
        newObj.breite = width
        objAttr.attrDict['breite'] = width
    
    newObj.geo = windowGeo
    newObj.attr = objAttr.attrDict
    if hasattr(newObj, 'attrDict'):
        delattr(newObj, 'attrDict')
# ---------- end createwindow ----------
createdoor = GhPythonScript(doorGeo=brep_8, objAttr=objattr)  # -> out, newObj; inputs doorGeo: Brep
# ---------- createdoor: Python ----------
import Rhino.Geometry as rg
from copy import copy
from ghpythonlib.components import AlignPlane
import math
import Grasshopper.Kernel as ghkernel
import uuid


class ObjFromRH:
    def __init__(self, **kwargs):
        for key, value in kwargs.items():
            setattr(self, key, value)

run = True
if doorGeo == None:
    ghenv.Component.AddRuntimeMessage(ghkernel.GH_RuntimeMessageLevel.Warning, "Input doorGeo")
    run = False
if objAttr == None:
    attr_dict = {
    'bauteil_obergruppe': 'other_' + str(uuid.uuid4()),
    'bauteil_gruner': 'other_' + str(uuid.uuid4()),
    'uuid': 'board_uuid_' + str(uuid.uuid4()),
    'kosten': 'unknown',
    'zustand': 'unknown',
    'material': 'unknown',
    'ref_gebauede_geschoss': 'unknown',
    'breite': 'unknown',
    'hoehe': 'unknown',
    'tiefe': 'unknown',
    'flaeche': 'unknown',
    'masse': 'unknown',
    'anzahl': 'unknown',
    'foto1': 'unknown',
    'foto2': 'unknown',
    'co2': 'unknown',
    'url': 'unknown'}
    objAttr = ObjFromRH(**attr_dict)
    objAttr.attrDict = attr_dict




def alignToZ(targetPlane):
    finalPlane = copy(targetPlane)
    finalPlane = AlignPlane(finalPlane, rg.Vector3d.ZAxis)[0]
    finalPlane.Rotate(-math.pi/2, finalPlane.ZAxis, finalPlane.Origin)

    return finalPlane

def _sortPoints(points, surf):
    if isinstance(surf, rg.Surface) or isinstance(surf, rg.Brep):
        # Ensure surf is a Surface for the operations (if Brep, use its faces)
        if isinstance(surf, rg.Brep):
            surf = surf.Faces[0]

        area_properties = rg.AreaMassProperties.Compute(surf)
        if area_properties is not None:
            centroid = area_properties.Centroid
            success, uvPU, uvPV = surf.ClosestPoint(centroid)
            if success:
                success, surf_Frame = surf.FrameAt(uvPU, uvPV)
                surf_Frame = alignToZ(surf_Frame)

            else:
                print("Failed to find the closest point on the surface.")
        else:
            print("Failed to compute area properties.")
    else:
        print("The input 'surf' is not a valid surface or brep.")


    rTo = rg.Transform.ChangeBasis(rg.Plane.WorldXY, surf_Frame)
    rFro = rg.Transform.ChangeBasis(surf_Frame, rg.Plane.WorldXY)
    
    for pt in points:
        pt.Transform(rTo)
        if pt.X>0 and pt.Y>0:
            pt.Transform(rFro)
            pointHighFirst = pt
        elif pt.X<0 and pt.Y>0:
            pt.Transform(rFro)
            pointHighSecond = pt
        elif pt.X>0 and pt.Y<0:
            pt.Transform(rFro)
            pointLowFirst = pt
        elif pt.X<0 and pt.Y<0:
            pt.Transform(rFro)
            pointLowSecond = pt
    surf_Frame.Rotate(math.pi/2, surf_Frame.ZAxis)
    return (pointLowSecond, pointHighSecond, pointLowFirst, pointHighFirst, surf_Frame)

if run:
    ptList = [vertex.Location for vertex in doorGeo.Vertices]
    ptList = _sortPoints(ptList, doorGeo)
    height = int(ptList[0].DistanceTo(ptList[1]))
    width = int(ptList[0].DistanceTo(ptList[2]))
    
    newObj = copy(objAttr)
    if objAttr.hoehe == "unknown":
        objAttr.hoehe = height
        objAttr.attrDict['hoehe'] = height
        newObj.hoehe = height
    if abs(height - float(objAttr.hoehe))>1:
        ghenv.Component.AddRuntimeMessage(ghkernel.GH_RuntimeMessageLevel.Warning, "Height is not match. We will take Geometry dimension")
        newObj.hoehe = height
        objAttr.attrDict['hoehe'] = height
    
    if objAttr.breite == "unknown":
        objAttr.breite = width
        objAttr.attrDict['breite'] = width
        newObj.breite = width
    if abs(width - float(objAttr.breite))>1:
        ghenv.Component.AddRuntimeMessage(ghkernel.GH_RuntimeMessageLevel.Warning, "Width is not match. We will take Geometry dimension")
        newObj.breite = width
        objAttr.attrDict['breite'] = width
    
    newObj.geo = doorGeo
    newObj.attr = objAttr.attrDict
    if hasattr(newObj, 'attrDict'):
        delattr(newObj, 'attrDict')
# ---------- end createdoor ----------

# ----
# Condition 3:
# Search from DB by inputing dimension
toggle = BooleanToggle(True)
board_material = GhPythonScript(Code=file_2, Width="65", Length="250", Thickness="1", Pt=pt, SearchDB=toggle, Direction=Toggle(True))  # -> Out, Board_obj

# ----
# Condition 1:
# Input from rhino
brep_17 = Brep(<brep referenced from the Rhino model>)
geofromrh = GhPythonScript(brep=brep_17)  # -> out, newObj, width, height, depth; inputs brep: Guid
# ---------- geofromrh: Python ----------
import Rhino
import scriptcontext as sc
import rhinoscriptsyntax as rs
import Grasshopper.Kernel as ghkernel

class ObjFromRH:
    def __init__(self, **kwargs):
        for key, value in kwargs.items():
            setattr(self, key, value)


# Set scriptcontext.doc to Rhino's document to access its objects
sc.doc = Rhino.RhinoDoc.ActiveDoc

def get_attribute(object_id, key=None):
    """
    Get user text from an object by its ID.
    """
    if object_id is None:
        print("No object ID provided.")
        return None

    rhino_object = sc.doc.Objects.Find(object_id)
    if not rhino_object:
        print("Object not found.")
        return None

    if key:
        value = rhino_object.Attributes.GetUserString(key)
        print("User text for key '{}': {}".format(key, value))
        return value
    else:
        all_user_text = rhino_object.Attributes.GetUserStrings()
        objDict = {}
        for k in all_user_text.AllKeys:
            objDict[k] =  all_user_text[k]
        return objDict


if brep == None:
    ghenv.Component.AddRuntimeMessage(ghkernel.GH_RuntimeMessageLevel.Warning, "brep is empty.")
else:
    # To get user text
    obj_dict = get_attribute(brep)
    newObj = ObjFromRH(**obj_dict)
    
    
    width = get_attribute(brep, "breite")
    height = get_attribute(brep, "hoehe")
    depth = get_attribute(brep, "tiefe")
    
    width = width if width != "FALSE" else 1
    height = height if height != "FALSE" else 1
    depth = depth if depth != "FALSE" else 1
    
    width = int(width)
    height = int(height)
    depth = int(depth)
# ---------- end geofromrh ----------
board_material_2 = GhPythonScript(
    Code=file_2,
    ObjAttr=geofromrh.newObj,
    Width=geofromrh.width,
    Length=geofromrh.height,
    Thickness=geofromrh.depth,
    Pt=pt,
    SearchDB=Toggle(False),
    Direction=Toggle(False))  # -> Out, Board_obj

# ----
# Condition 2:
# Customize by inputing dimension
toggle_2 = BooleanToggle(False)
board_material_3 = GhPythonScript(
    Code=file_2,
    ObjAttr=objattr_3,
    Width="65",
    Length="250",
    Thickness="1",
    Pt=pt,
    SearchDB=toggle_2,
    Direction=Toggle(True))  # -> Out, Board_obj

# ----
# width
# thickness
toggle_3 = BooleanToggle(True)
brep_18 = Brep(boundary)
substruct_infill_material = GhPythonScript(Code=file_3, ObjAttr=objattr_4, Width="3", Thickness="5", Distance="30", Direction=Toggle(False))  # -> Out, Substruct_obj
substruct_infill_material_2 = GhPythonScript(Code=file_4, Width="2", Thickness="5", Distance="50", Direction=Toggle(True))  # -> Out, SubstructInfill_obj
data = Data(createdoor.newObj)

brep_19 = Brep(merge)
data_2 = Data(doorfromrh.newObj)

# ----
# length
panel_3 = Panel("100")

brep_20 = Brep(merge_2)
data_3 = Data(winfromrh.newObj)

data_4 = Data(createwindow.newObj)
paint_material = GhPythonScript(Code=file, Thickness="0.5")  # -> Out, Paint_obj
# subStruct
substructure_material = GhPythonScript(Code=file_3, Width="3", Thickness="5", Distance="30", Direction=Toggle(False))  # -> Out, Substruct_obj
# board
board_material_4 = GhPythonScript(Code=file_2, Length=panel_3, Width="300", Thickness="5", Pt=pt, SearchDB=toggle_3, Direction=Toggle(False))  # -> Out, Board_obj
merge_3 = Merge(Data1=brep_19, Data2=data_2, Data3=data)
merge_4 = Merge(Data1=brep_20, Data2=data_3, Data3=data_4)
merge_5 = Merge(Data1=substructure_material.Substruct_obj, Data2=board_material_4.Board_obj)
merge_6 = Merge(
    Data1=board_material_2.Board_obj,
    Data2=board_material_3.Board_obj,
    Data3=board_material.Board_obj,
    Data4=substruct_infill_material.Substruct_obj,
    Data5=substruct_infill_material_2.SubstructInfill_obj,
    Data6=paint_material.Paint_obj)

# ----
# Module Setting
number_slider_2 = Slider(260, range=0..1000)
crv_2 = Curve([<curve referenced from the Rhino model> x2])

crv_3 = Curve([<curve referenced from the Rhino model> x3])
brep_21 = Brep([<brep referenced from the Rhino model> x4])
brep_22 = Brep(<brep referenced from the Rhino model>)
brep_23 = Brep([<brep referenced from the Rhino model> x2])
file_5 = ReadFile(File=c__grasshoppername.filePath, PerLineParse=False)

# ----
# Explode wall
number_slider_3 = Slider(0, range=0..100)

button = Button()

# ----
# Connection to Data base.
# It is important to keep the folder structure of the original file
panel_4 = Panel("DB\JSON_data\24-03-07_V2_JSON")

# ----
# json folder path
c__grasshoppername_8 = CSharpScript(inputName=panel_4)  # -> ghParentPath, filePath; inputs inputName: String; same code as c__grasshoppername

# ----
# img folder path
c__grasshoppername_9 = CSharpScript(inputName="DB\Pictures_gruner_compressed")  # -> ghParentPath, filePath; inputs inputName: String; same code as c__grasshoppername

# ----
# read json file
python = GhPythonScript(folder_path=c__grasshoppername_8.filePath)  # -> title, data
# ---------- python: Python ----------
import os
import json
import ghpythonlib.treehelpers as th

item_list = ['bauteil_obergruppe', 'bauteil_gruner', 'uuid', 'kosten', 'zustand', 'material', 'ref_gebauede_geschoss', 'breite', 'hoehe', 'tiefe', 'flaeche', 'masse', 'anzahl', 'foto1', 'foto2', 'co2', "kategorie"]

nameDict = {
"Befoerderungsanlage.json":"Befoerderungs_Anlage", #
"Bodenbelag.json":"Bodenbelag", #
"Deckenbekleidung.json":"Deckenbekleidung", #
"Deckenkonstruktion Dachkonstruktion.json":"Deckenkonstruktion", #
"Einbauten Schutzeinrichtung zu Ausbau.json":"Schutzeinrichtung", #
"Element in Aussenwand.json":"Aussenwand", #
"Element zu Dach.json":"ElementZuDach", #
"Fundament Bodenplatte.json":"Bodenplatte", #
#"Gastechnische Anlage.json":"Gastechnische_Anlage", 
"Gruenflaeche.json":"Gruenflaeche", #
"Kleininventar.json":"Kleininventar", #
"Lufttechnische Anlage.json":"Lufttechnische_Anlage", #
"Mobiliar.json":"Mobiliar", #
#"Sicherheitsanlage.json":"Sicherheit_Anlage", 
"Stuetzenkonstruktion.json":"Stuetzenkonstruktion", #
"Textilien.json":"Textilien", #
"Trennwand Innentuer Innentor.json":"Trennwand", #
"Waermetechnische Anlage.json":"Waermetechnische_Anlage", #
"Wandbekleidung.json":"Wandbekleidung", #
"Wandkonstruktion.json":"Wandkonstruktion", #
"Wassertechnische Anlage.json":"Wassertechnische_Anlage", #
"Weitere nutzungsspezifische Anlage.json":"Nutzungsspezifische_Anlage" #
}

def read_json_files(folder_path):
    # List to hold all items, with each item's sub-items as sub-lists
    all_items = []
    
    # Iterate over all files in the given folder
    for file_name in os.listdir(folder_path):
        # Check if the file is a JSON file
        if file_name.endswith('.json'):
            full_path = os.path.join(folder_path, file_name)
            
            # Read the JSON file
            with open(full_path, 'r') as json_file:
                data = json.load(json_file)
                
                # Assuming 'data' is a list of items
                for item in data:
                    # Add each item (and its sub-items, if any) to the list
                    
                    if file_name not in nameDict.keys():
                        continue
                    item["kategorie"] = nameDict[file_name]
                    temp = []
                    for key in item_list:
                        if key not in item.keys():
                            temp.append("FALSE")
                        else:
                            temp.append(item[key])
                    
                    all_items.append(temp)
    
    # Convert the list of lists into a data tree, with each top-level list as a branch
    return th.list_to_tree(all_items)

# Call the function and store the result
data = read_json_files(folder_path)

# The 'data_tree' can now be used as output in your Grasshopper Python component
title = item_list
# ---------- end python ----------

changeimgpath = ChangeImgPath(parent_folder=c__grasshoppername_9.filePath, relay=python.data)
cluster = Cluster_3(bauteil_obergruppe="Trennwand Innentuer Innentor", bauteil_obergruppe_2="Innentuer", data=changeimgpath)  # -> data_4, num_2
cluster_2 = Cluster_3(bauteil_obergruppe="Element in Aussenwand", bauteil_obergruppe_2="Fenster", data=changeimgpath)  # -> data_4, num_2
panel_5 = Panel(cluster.num_2)
panel_6 = Panel(cluster_2.num_2)
doordb = DoorDB(data=cluster.data_4)
windowdb = WindowDB(data=cluster_2.data_4)

# ----
# This one is temporary, should be changed
panel_7 = Panel("Innentuer")
cluster_3 = Cluster_3(bauteil_obergruppe="Trennwand Innentuer Innentor", bauteil_obergruppe_2=panel_7, data=changeimgpath)  # -> data_4, num_2
panel_8 = Panel(cluster_3.num_2)
boarddb = BoardDB_2(data=cluster_3.data_4)

boarddb_2 = Data(simplify(boarddb))

# ----
# DataBase
boarddb_3 = BoardDB()  # disabled
tiledb = TileDB()  # disabled
windowdb_2 = Data(windowdb)
doordb_2 = Data(doordb)
data_5 = Data(simplify(boarddb_3))  # disabled
data_6 = Data(simplify(tiledb))  # disabled
db_collection = GhPythonScript(windowDB=windowdb_2, doorDB=doordb_2, tileDB=data_6, boardDB=boarddb_2)  # -> out, allDB; inputs windowDB: list, doorDB: list, tileDB: list, boardDB: list
# ---------- db_collection: Python ----------
allDict = {}
allDict["windowDB"] = windowDB
allDict["doorDB"] = doorDB
allDict["tileDB"] = tileDB
allDict["boardDB"] = boardDB

class classForOutput:
    def __init__(self):
        pass

allData = classForOutput()
allData.all_DB = allDict

allDB = allData
# ---------- end db_collection ----------

# ----
# Cladding Engine
normalfacade = Data(merge_5)
normalfacade_2 = GhPythonScript(
    Code=file_5,
    Database_collection=db_collection.allDB,
    Carrier_Geometry=[brep_18, brep_22],
    Window_Geometry=[merge_4, brep_21],
    Door_Geometry=[merge_3, brep_23],
    SetTile=normalfacade,
    CladdingDirection=Toggle(False),
    Material_collection=merge_6,
    ModuleCurve=[crv_2, crv_3],
    ModuleCrvDist=Slider(30, range=10..30),
    Init=Button())  # -> Out, ORuler, OVisualObj, AllTypeMaterialModule, OMatRecordObj
panel_9 = Panel(normalfacade_2.Out)

crv_4 = Curve(normalfacade_2.ORuler)

# ----
# Show materials used from the data base
list = ValueList({"bauteil_obergruppe", "bauteil_gruner", "uuid", "kosten", "zustand", "material", "ref_gebauede_geschoss", "breite", "hoehe", "tiefe", "flaeche", "masse", "anzahl"}, selected=["bauteil_obergruppe", "bauteil_gruner", "uuid", "material", "breite", "hoehe", "tiefe", "anzahl"])
c__grasshoppername_10 = CSharpScript(inputName="py\UI_usedMaterial2.py")  # -> ghParentPath, filePath; inputs inputName: String; same code as c__grasshoppername
list_2 = ValueList({"InnerMaterial": "innerMaterial", "outerMaterial", "Opening": "opening"}, selected="Opening")
file_6 = ReadFile(File=c__grasshoppername_10.filePath, PerLineParse=False)
merge_7 = Merge(Data1=normalfacade_2.OMatRecordObj)
chosenitem = Data(list)
winheight = Data(Slider(8, range=6..10, expression="x*100"))
openui = Data(Toggle(True))
rownum = Data(Slider(4, range=0..10))
python_2 = GhPythonScript(
    Code=file_6,
    Open=openui,
    ShowType=list_2,
    ShowDes=Toggle(True),
    WinHeight=winheight,
    RowNum=rownum,
    ChosenItem=chosenitem,
    ShowData=flatten(merge_7))
panel_10 = Panel(python_2)

normalfacadeviewer = NormalFacadeViewer(
    b=button,
    username="Kevin",
    relay=flatten(normalfacade_2.OVisualObj),
    relay_2=number_slider_3,
    relay_3=Slider(0, range=0..100))  # -> R_2, R, movegeo, D, crv_3, s_0, s_0_2, door_2, window_2

# ----
# Module Visualization
data_7 = Data(simplify(normalfacade_2.AllTypeMaterialModule))  # disabled
number_slider_4 = Slider(2, range=0..10)  # disabled
number_slider_5 = Slider(0, range=0..10)  # disabled
number_slider_6 = Slider(0, range=0..10)  # disabled
number_slider_7 = Slider(1, range=0..10)  # disabled
findmodule = GhPythonScript(data=data_7, y=number_slider_4)  # -> out, A; inputs data: tree, y: Int32; disabled
# ---------- findmodule: Python ----------
from Grasshopper import DataTree
from Grasshopper.Kernel.Data import GH_Path
from System import Object
import ghpythonlib.treehelpers as th

selected = []
for path in data.Paths:
    if path[1] == y:
        items = data.Branch(path)
        selected.append(items)
    else:
        print("cannot find")

# Output the selected data
A = th.list_to_tree(selected)
# ---------- end findmodule ----------
findlayer = GhPythonScript(data=data_7, y=number_slider_5)  # -> out, A; inputs data: tree, y: Int32; disabled
# ---------- findlayer: Python ----------
from Grasshopper import DataTree
from Grasshopper.Kernel.Data import GH_Path
from System import Object
import ghpythonlib.treehelpers as th

selected = []
for path in data.Paths:
    if path[0] == y:
        items = data.Branch(path)
        selected.append(items)
    else:
        print("cannot find")

# Output the selected data
A = th.list_to_tree(selected)
# ---------- end findlayer ----------
cluster_4 = BranchLook(data=findmodule.A, i=number_slider_6)  # disabled
cluster_5 = BranchLook(data=findlayer.A, i=number_slider_7)  # disabled

bake = BakeGeometry(Bake=button, Geometry=normalfacadeviewer.R_2, Attributes=normalfacadeviewer.R, DeleteOldBakes=False, PreserveTrees=False)
preview = CustomPreview(Geometry=normalfacadeviewer.s_0, Material=graft(normalfacadeviewer.s_0_2))
previewlw = CustomPreviewLineweights(
    Geometry=[normalfacadeviewer.door_2, normalfacadeviewer.window_2],
    Shader=ColourSwatch(SwatchColor=RGB(0, 255, 238)),
    Thickness=Slider(4, range=0..10),
    Absolute=False)
previewmat = CustomPreviewMaterials(Geometry=normalfacadeviewer.movegeo, DiffuseColor=normalfacadeviewer.D)
previewlw_2 = CustomPreviewLineweights(Geometry=normalfacadeviewer.crv_3, Shader=ColourSwatch(SwatchColor=RGB(0, 0, 0)), Absolute=False)

# ==== cluster BranchLook: To see the condition of branch data.
data = ClusterInput()
data_2 = Data(data)
tstat = TreeStatistics(Tree=data_2)  # -> Paths, Length, Count
i = ClusterInput()
item = ListItem(List=tstat.Paths, Index=i, Wrap=True)
branch = TreeBranch(Tree=data_2, Path=item, MaintainPaths=True)
B = ClusterOutput(branch)

# ==== cluster BoardDB
series = Series(Start=0, Step=1, Count="3")
item = ListItem(List=series, Index=0, Wrap=True)  # -> Item, Item1, Item2
number_slider = Slider(700, range=0..1000)
dom = ConstructDomain(DomainStart=Slider(40, range=0..1000), DomainEnd=Slider(100, range=0..1000))
dom_2 = ConstructDomain(DomainStart=Slider(50, range=0..1000), DomainEnd=Slider(300, range=0..10000))
dom_3 = ConstructDomain(DomainStart=Slider(116, range=0..300), DomainEnd=Slider(177, range=0..300))
dom_4 = ConstructDomain(DomainStart=Slider(2, range=0..1000), DomainEnd=Slider(4, range=0..10000))
# width
random = Random(Range=dom, Number=number_slider, Seed=item.Item, Integers=True)
# length
random_2 = Random(Range=dom_2, Number=number_slider, Seed=item.Item1, Integers=True)
# quantity
random_3 = Random(Range=dom_3, Number=number_slider, Seed=item.Item2, Integers=True)
random_4 = Random(Range=dom_4, Number=number_slider, Seed=item.Item1, Integers=True)
repeat = RepeatData(Data="uuid_DB_", Length=number_slider)  # -> simplify(graft(Data))
series_2 = Series(Start=0, Step=1, Count=number_slider)  # -> simplify(graft(Series))
repeat_2 = RepeatData(Data="bauteil_obergruppe", Length=number_slider)  # -> simplify(graft(Data))
repeat_3 = RepeatData(Data="bauteil_gruner", Length=number_slider)  # -> simplify(graft(Data))
series_3 = Series(Start=0, Step=1, Count=number_slider)  # -> simplify(graft(Series))
series_4 = Series(Start=0, Step=1, Count=number_slider)  # -> simplify(graft(Series))
graft = GraftTree(Tree=random_3, IncludeEmptyLists=True, IncludeNullItems=True)
merge = Merge(Data1=repeat, Data2=series_2)
merge_2 = Merge(Data1=repeat_2, Data2=series_3)
merge_3 = Merge(Data1=repeat_3, Data2=series_4)
graft_2 = GraftTree(Tree=random, IncludeEmptyLists=True, IncludeNullItems=True)
graft_3 = GraftTree(Tree=random_2, IncludeEmptyLists=True, IncludeNullItems=True)
graft_4 = GraftTree(Tree=random_4, IncludeEmptyLists=True, IncludeNullItems=True)
join = TextJoin(Text=merge)
join_2 = TextJoin(Text=merge_2)
join_3 = TextJoin(Text=merge_3)
rectangle = Rectangle(Plane=PlaneXY(0, 0, 0), XSize=random, YSize=random_2, Radius=0)  # -> simplify(graft(Rectangle)), Length
area = Area(Geometry=flatten(rectangle.Rectangle))  # -> Area, Centroid; disabled
objattr = GhPythonScript(bauteil_obergruppe=join_2, bauteil_gruner=join_3, uuid=join, breite=graft_2, hoehe=graft_3, tiefe=graft_4, anzahl=graft)  # -> flatten(newObj); inputs anzahl: Int32
# ---------- objattr: Python ----------
class ObjFromRH:
    def __init__(self, **kwargs):
        for key, value in kwargs.items():
            setattr(self, key, value)

variables = {
    'bauteil_obergruppe': bauteil_obergruppe,
    'bauteil_gruner': bauteil_gruner,
    'uuid': uuid,
    'kosten': kosten,
    'zustand': zustand,
    'material': material,
    'ref_gebauede_geschoss': ref_gebauede_geschoss,
    'breite': breite,
    'hoehe': hoehe,
    'tiefe': tiefe,
    'flaeche': flaeche,
    'masse': masse,
    'anzahl': anzahl,
    'foto1': foto1,
    'foto2': foto2,
    'co2': co2,
    'url': url,
}

# Update each variable in the dictionary if it's None
for key in variables:
    if variables[key] is None:
        variables[key] = "unknown"



newObj = ObjFromRH(**variables)
# ---------- end objattr ----------
sort = SortList(Keys=area.Area, ValuesA=flatten(rectangle.Rectangle))  # -> Keys, ValuesA; disabled
python = GhPythonScript(
    identity="board",
    geometry=rectangle.Rectangle,
    quantity=graft,
    name=join_2,
    width=graft_2,
    height=graft_3,
    depth=graft_4)  # -> out, objList; inputs geometry: tree of Rectangle3d, quantity: tree of Int32, name: tree, width: tree, height: tree, depth: tree; disabled
# ---------- python: Python ----------
class BuildingComponent:
    def __init__(self, identity, geometry, quantity, name, width, height, depth):
        self.identity = identity
        self.geometry = geometry
        self.quantity = quantity
        self.name = name
        self.width = width
        self.height = height
        self.depth = depth

objList = []
for geo, qua, na, wi, he, de in zip(geometry.Branches, quantity.Branches, name.Branches, width.Branches, height.Branches, depth.Branches):
    obj = BuildingComponent(identity, geo[0], qua[0], na[0], wi[0], he[0], de[0])
    objList.append(obj)
# ---------- end python ----------
item_2 = ListItem(List=sort.ValuesA, Index=0, Wrap=True)  # disabled
newobj = ClusterOutput(objattr)

# ==== cluster TileDB
number_slider = Slider(200, range=0..1000)
series = Series(Start=0, Step=1, Count="3")
item = ListItem(List=series, Index=0, Wrap=True)  # -> Item, Item1, Item2
dom = ConstructDomain(DomainStart=Slider(10, range=0..10), DomainEnd=Slider(60, range=0..100))
dom_2 = ConstructDomain(DomainStart=Slider(10, range=0..10), DomainEnd=Slider(1120, range=0..10000))
dom_3 = ConstructDomain(DomainStart=Slider(191, range=0..300), DomainEnd=Slider(262, range=0..300))
# width
random = Random(Range=dom, Number=number_slider, Seed=item.Item, Integers=True)
# length
random_2 = Random(Range=dom_2, Number=number_slider, Seed=item.Item1, Integers=True)
# quantity
random_3 = Random(Range=dom_3, Number=number_slider, Seed=item.Item2, Integers=True)
rectangle = Rectangle(Plane=PlaneXY(0, 0, 0), XSize=random, YSize=random_2, Radius=0)  # -> simplify(graft(Rectangle)), Length
graft = GraftTree(Tree=random_3, IncludeEmptyLists=True, IncludeNullItems=True)
repeat = RepeatData(Data="tileName_", Length=number_slider)  # -> simplify(graft(Data))
series_2 = Series(Start=0, Step=1, Count=number_slider)  # -> simplify(graft(Series))
merge = Merge(Data1=repeat, Data2=series_2)
join = TextJoin(Text=merge)
python = GhPythonScript(identity="tile", geometry=rectangle.Rectangle, quantity=graft, name=join)  # -> out, objList; inputs geometry: tree of Rectangle3d, quantity: tree of Int32, name: tree
# ---------- python: Python ----------
class BuildingComponent:
    def __init__(self, identity, geometry, quantity, name):
        self.identity = identity
        self.geometry = geometry
        self.quantity = quantity
        self.name = name

objList = []
for geo, qua, na in zip(geometry.Branches, quantity.Branches, name.Branches):
    obj = BuildingComponent(identity, geo[0], qua[0], na[0])
    objList.append(obj)
# ---------- end python ----------
objlist = ClusterOutput(python.objList)

# ==== cluster ChangeImgPath
relay = ClusterInput()
panel = Panel("""13
14""")
parent_folder = ClusterInput()
item = ListItem(List=relay, Index=panel, Wrap=True)

# ----
# alter img
python = GhPythonScript(parent_folder=parent_folder, picture_path=item)  # -> out, found_path_list; inputs picture_path: tree
# ---------- python: Python ----------
import os
import ghpythonlib.treehelpers as th

def build_file_map(parent_folder):
    file_map = {}
    for root, dirs, files in os.walk(parent_folder):
        for file in files:
            if file not in file_map:  # This check adds the first found instance if multiple files with the same name exist
                file_map[file] = os.path.join(root, file)
    return file_map

def find_picture(file_map, picture_name):
    return file_map.get(picture_name, None)

# Assuming 'parent_folder' and 'picture_path' are defined
file_map = build_file_map(parent_folder)

total_found = 0
total_not_found = 0

found_path_list = []
for pic_path in picture_path.Branches:
    temp = []
    for pic in pic_path:
        file_name = os.path.basename(pic)
        found_path = find_picture(file_map, file_name)
        if found_path:
            total_found += 1
            temp.append(found_path)
        else:
            total_not_found += 1
            temp.append(os.path.join(parent_folder, "notFound.jpg"))
    found_path_list.append(temp)

found_path_list = th.list_to_tree(found_path_list)
print("found img: %d" % (total_found))
print("not found img: %d" % (total_not_found))
# ---------- end python ----------

panel_2 = Panel("""16
2""")
replace = ReplaceItems(List=relay, Item=python.found_path_list, Indices=panel, Wrap=False)
item_2 = ListItem(List=replace, Index=panel_2, Wrap=True)

# ----
# alter url
python_2 = GhPythonScript(data=item_2)  # -> out, simplify(graft(urlList)); inputs data: tree
# ---------- python_2: Python ----------
import ghpythonlib.treehelpers as th
urlList = []
for d in data.Branches:
    bautStr = d[0]
    if bautStr.find(","):
        print("heee")
        print(bautStr)
    alterStr = str(d[0]).replace(" ", "_")
    urlString = "https://bfhreuse24.site/shop/" + alterStr + "/" + str(d[1])
    url = urlString 
    urlList.append(url)

urlList = th.list_to_tree(urlList)
# ---------- end python_2 ----------

replace_2 = ReplaceItems(List=replace, Item=python_2.urlList, Indices="16", Wrap=False)
L = ClusterOutput(replace_2)

# ==== cluster Cluster_3

# ----
# Title List
panel = Panel("""bauteil_obergruppe
bauteil_gruner
uuid
kosten
zustand
material
ref_gebauede_geschoss
breite
hoehe
tiefe
flaeche
masse
anzahl
foto1
foto2
co2
url""")

bauteil_obergruppe = ClusterInput()
bauteil_obergruppe_2 = ClusterInput()
data = ClusterInput()
data_2 = Data(data)
title = Data(panel)
bauteil_obergruppe_3 = Data(bauteil_obergruppe)
bauteil_gruner = Data(bauteil_obergruppe_2)
list = ValueList({"bauteil_obergruppe", "bauteil_gruner", "material"}, selected="bauteil_gruner")
list_2 = ValueList({"bauteil_obergruppe", "bauteil_gruner", "material"}, selected="bauteil_obergruppe")
panel_2 = Panel("""bauteil_obergruppe
bauteil_gruner
material""")
cluster = Cluster(S=title, M=list_2, data=data_2)  # -> S_2, M_2, L
panel_4 = Panel(cluster.L)
cluster_2 = Cluster_2(category=cluster.S_2, chosenitem=bauteil_obergruppe_3, dataid=cluster.M_2)
data_topic = Data(title)
alldata = Data(data_2)
python = GhPythonScript(data=cluster_2)  # -> union, quan; inputs data: tree
# ---------- python: Python ----------
def intersection_of_lists(nested_list):
    # Check if the nested list is empty or contains only empty lists
    if not nested_list or all(len(sublist) == 0 for sublist in nested_list):
        return [], 0

    # Initialize the intersection set with the first sublist to compare with others
    intersection_set = set(nested_list[0])
    
    # Iterate over each sublist in the nested list starting from the second sublist
    for sublist in nested_list[1:]:
        # Update the intersection set to keep only elements also found in the current sublist
        intersection_set.intersection_update(sublist)
    
    # Convert the set back to a list to get the final intersection list
    intersection_list = list(intersection_set)
    
    # Return the intersection list and the number of elements in the intersection
    return intersection_list, len(intersection_list)

listList = []
for d in data.Branches:
    if len(d) == 0:
        continue
    listList.append(d)

union, quan = intersection_of_lists(listList)
# ---------- end python ----------

# ----
# Quantity of items matching filters
panel_5 = Panel(python.quan)

cluster_3 = BranchLook(data=alldata, i=python.union)
cluster_4 = Cluster(S=title, M=list, data=cluster_3)  # -> S_2, M_2, L
panel_6 = Panel(cluster_4.L)
cluster_5 = Cluster_2(category=cluster_4.S_2, chosenitem=bauteil_gruner, dataid=cluster_4.M_2)
python_2 = GhPythonScript(data=cluster_5)  # -> union, quan; inputs data: tree; same code as python

# ----
# Quantity of items matching filters
panel_7 = Panel(python_2.quan)

cluster_6 = BranchLook(data=cluster_3, i=python_2.union)
data_3 = Data(cluster_6)
num = Data(python_2.quan)
data_4 = ClusterOutput(data_3)
num_2 = ClusterOutput(num)

# ==== cluster DoorDB
data = ClusterInput()
data_2 = Data(data)
panel = Panel("""7
8
12""")
item = ListItem(List=data_2, Index=panel, Wrap=True)
panel_2 = Panel("""bauteil_obergruppe
bauteil_gruner
uuid
kosten
zustand
material
ref_gebauede_geschoss
breite
hoehe
tiefe
flaeche
masse
anzahl
foto1
foto2
co2
url""")
python = GhPythonScript(x=item, y=data_2)  # -> out, filt_data, filt_attr; inputs x: tree, y: tree
# ---------- python: Python ----------
import ghpythonlib.treehelpers as th

filt_data = []
filt_attr = []
for data, attr in zip(x.Branches, y.Branches):
    addBool = 1
    for d in data:
        if str(d) == "FALSE":
            addBool = 0

    if addBool:
        filt_data.append(data)
        filt_attr.append(attr)

filt_data = th.list_to_tree(filt_data)
filt_attr = th.list_to_tree(filt_attr)
# ---------- end python ----------
item_2 = ListItem(List=python.filt_data, Index=0, Wrap=True)  # -> flatten(Item), flatten(Item1), flatten(Item2)
python_2 = GhPythonScript(attr=python.filt_attr, item=panel_2)  # -> out, graft(all_dict_list); inputs attr: tree, item: list
# ---------- python_2: Python ----------
import ghpythonlib.treehelpers as th

class openingAttr:
    def __init__(self, attr, **kwargs):
        self.attr = attr
        for key, value in kwargs.items():
            setattr(self, key, value)

all_dict_list = []
for at in attr.Branches:
    tempDict = {}
    for key, data in zip(item, at):
        tempDict[key] = data
        
    attrObj = openingAttr(tempDict, **tempDict) 
    all_dict_list.append(attrObj)

all_dict_list = th.list_to_tree(all_dict_list)
# ---------- end python_2 ----------
rectangle = Rectangle(Plane=PlaneXY(0, 0, 0), XSize=item_2.Item, YSize=item_2.Item1, Radius=0)  # -> simplify(graft(Rectangle)), Length
graft = GraftTree(Tree=item_2.Item2, IncludeEmptyLists=True, IncludeNullItems=True)  # -> simplify(Tree)
python_3 = GhPythonScript(identity="door", geometry=rectangle.Rectangle, quantity=graft, attr=python_2.all_dict_list)  # -> out, objList; inputs geometry: tree of Rectangle3d, quantity: tree of Int32, attr: tree
# ---------- python_3: Python ----------
class BuildingComponent:
    def __init__(self, identity, geometry, quantity, attr):
        self.identity = identity
        self.geometry = geometry
        self.quantity = quantity
        self.attr = attr.attr
        for key, value in attr.attr.items():
            setattr(self, key, value)

objList = []
for geo, qua, at in zip(geometry.Branches, quantity.Branches, attr.Branches):
    obj = BuildingComponent(identity, geo[0], qua[0], at[0])
    objList.append(obj)
# ---------- end python_3 ----------
data_3 = Data(python_3.objList)
data_4 = ClusterOutput(data_3)

# ==== cluster WindowDB
data = ClusterInput()
data_2 = Data(data)
panel = Panel("""7
8
12""")
item = ListItem(List=data_2, Index=panel, Wrap=True)
panel_2 = Panel("""bauteil_obergruppe
bauteil_gruner
uuid
kosten
zustand
material
ref_gebauede_geschoss
breite
hoehe
tiefe
flaeche
masse
anzahl
foto1
foto2
co2
url""")
python = GhPythonScript(x=item, y=data_2)  # -> out, filt_data, filt_attr; inputs x: tree, y: tree; same code as python
item_2 = ListItem(List=python.filt_data, Index=0, Wrap=True)  # -> flatten(Item), flatten(Item1), flatten(Item2)
python_2 = GhPythonScript(attr=python.filt_attr, item=panel_2)  # -> out, graft(all_dict_list); inputs attr: tree, item: list; same code as python_2
rectangle = Rectangle(Plane=PlaneXY(0, 0, 0), XSize=item_2.Item, YSize=item_2.Item1, Radius=0)  # -> simplify(graft(Rectangle)), Length
graft = GraftTree(Tree=item_2.Item2, IncludeEmptyLists=True, IncludeNullItems=True)  # -> simplify(Tree)
python_3 = GhPythonScript(identity="window", geometry=rectangle.Rectangle, quantity=graft, attr=python_2.all_dict_list)  # -> out, objList; inputs geometry: tree of Rectangle3d, quantity: tree of Int32, attr: tree; same code as python_3
data_3 = Data(python_3.objList)
data_4 = ClusterOutput(data_3)

# ==== cluster NormalFacadeViewer
# This component is the visualization of normal facade style.
# This one can input mutiple wall information
relay = ClusterInput()
relay_2 = ClusterInput()
relay_3 = ClusterInput()
python = GhPythonScript(visualObj=relay)  # -> out, comb, tileGeometry, allTypeMaterial, substructureGeo, wallFrame, offsetCladdingDist, doorGeo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; inputs visualObj: list
# ---------- python: Python ----------
from Grasshopper.Kernel.Data import GH_Path
from Grasshopper import DataTree
import System.Array as array
import ghpythonlib.treehelpers as th

attrList = ['comb', 'tileGeometry', 'allTypeMaterial', 'substructureGeo', 'wallFrame', 'offsetCladdingDist', 'doorGeo', 'windowGeo', 'usedMatDict', 'visualEmpty']
for name in attrList:
    globals()[name] = DataTree[object]()

for i, obj in enumerate(visualObj):
    def treeGenerate(obj, name):
        data = getattr(obj, name)
        
        if isinstance(data, DataTree[object]):
            for j, (d, pList) in enumerate(zip(data.Branches, data.Paths)):
                pList[0] = i
                path = GH_Path(array[int](list(pList)))
                globals()[name].AddRange(d, path)
                
        elif isinstance(data, list):
            path = GH_Path(array[int]([i]))
            globals()[name].AddRange(data, path)
        
        elif len([data])==1:
            path = GH_Path(array[int]([i]))
            globals()[name].AddRange([data], path)
            
        
    for n in attrList:
        treeGenerate(obj, n)
# ---------- end python ----------
item = ListItem(List=flatten(python.visualEmpty), Index=0, Wrap=True)
deplane = DeconstructPlane(Plane=python.wallFrame)  # -> Origin, XAxis, YAxis, ZAxis
neg = Negative(Value=deplane.ZAxis)
amp = Amplitude(Vector=neg, Amplitude=python.offsetCladdingDist)
lng = ListLength(List=flatten(python.wallFrame))
tstat = TreeStatistics(Tree=python.allTypeMaterial)  # -> Paths, Length, Count
division = Division(A=tstat.Count, B=lng)
python_2 = GhPythonScript(x=python.allTypeMaterial)  # -> out, a
# ---------- python_2: Python ----------
a =x
# ---------- end python_2 ----------
series = Series(Start=0, Step=relay_2, Count=expr("x+1", division))
series_2 = Series(Start=0, Step=1, Count=division)
python_3 = GhPythonScript(x=series)  # -> out, a, b; inputs x: list
# ---------- python_3: Python ----------
a = x[:-1]
b = x[-1]
# ---------- end python_3 ----------
deplane_2 = DeconstructPlane(Plane=python.wallFrame)  # -> Origin, XAxis, YAxis, ZAxis
python_4 = GhPythonScript(x=python.tileGeometry)  # -> out, a; same code as python_2
item_2 = ListItem(List=flatten(python.comb), Index=0, Wrap=True)
move_ver1 = GhPythonScript(geoData=python_2.a, vecData=amp)  # -> out, moveGeo; inputs geoData: tree of Brep, vecData: tree
# ---------- move_ver1: Python ----------
import Rhino.Geometry as rg
from Grasshopper.Kernel.Data import GH_Path
from Grasshopper import DataTree
import System.Array as array
import ghpythonlib.treehelpers as th

moveGeo = DataTree[object]()
for geoList, path in zip(geoData.Branches, geoData.Paths):
    n = path[0]
    vec = vecData.Branches[n][0]
    matrix = rg.Transform.Translation(vec)

    for geo in geoList:
        geo.Transform(matrix)
    
    moveGeo.AddRange(geoList, path)
# ---------- end move_ver1 ----------
null = NullItem(Item=item_2)  # -> NullFlags, InvalidFlags, Description
openingdist = Data(relay_3)
geo = Geometry(python.doorGeo)
geo_2 = Geometry(python.windowGeo)
cladding_catergory = CladdingCatergory(data=python.comb, geo=python.tileGeometry)  # -> geo_5, data_4; disabled
gradient = Gradient(
    LowerLimit="0",
    UpperLimit=division,
    Parameter=series_2,
    stops=[0: RGB(234, 38, 0), 0.25: RGB(234, 126, 0), 0.5: RGB(254, 244, 84), 0.75: RGB(173, 203, 249), 1: RGB(75, 107, 169)])
pshift = ShiftPaths(Data=move_ver1.moveGeo, Offset=-1)
amp_2 = Amplitude(Vector=deplane_2.ZAxis, Amplitude=python_3.a)
pln = Plane(python.wallFrame)
panel = Panel("""bauteil_obergruppe
bauteil_gruner
uuid
kosten
zustand
material
ref_gebauede_geschoss
breite
hoehe
tiefe
flaeche
masse
anzahl
foto1
foto2
co2
url""")
amp_3 = Amplitude(Vector=deplane_2.ZAxis, Amplitude=python_3.b)  # -> graft(Vector)
tstat_2 = TreeStatistics(Tree=cladding_catergory.geo_5)  # -> Paths, Length, Count
filter = StreamFilter(Gate=null.NullFlags, Stream0=cladding_catergory.geo_5, Stream1=python_4.a)
filter_2 = StreamFilter(Gate=null.NullFlags, Stream0=cladding_catergory.geo_5, Stream1=python_4.a)
move_ver2 = GhPythonScript(geoData=pshift, vecData=amp_2)  # -> out, moveGeo; inputs geoData: tree of Brep, vecData: tree
# ---------- move_ver2: Python ----------
import Rhino.Geometry as rg
from Grasshopper.Kernel.Data import GH_Path
from Grasshopper import DataTree
import System.Array as array
import ghpythonlib.treehelpers as th

moveGeo = DataTree[object]()
for geoList, path in zip(geoData.Branches, geoData.Paths):
    wallNum = path[0]
    layerNum = path[path.Length-1]
    vec = vecData.Branches[wallNum]
    matrix = rg.Transform.Translation(vec[layerNum])

    for geo in geoList:
        geo.Transform(matrix)
    
    moveGeo.AddRange(geoList, path)
# ---------- end move_ver2 ----------
deplane_3 = DeconstructPlane(Plane=pln)  # -> Origin, XAxis, YAxis, ZAxis
tstat_3 = TreeStatistics(Tree=filter)  # -> Paths, Length, Count
dup = DuplicateData(Data=gradient, Number=lng, Order=True)  # -> graft(Data)
amp_4 = Amplitude(Vector=deplane_3.ZAxis, Amplitude=openingdist)
move_ver1_2 = GhPythonScript(geoData=filter_2, vecData=amp)  # -> out, moveGeo; inputs geoData: tree of Brep, vecData: tree; same code as move_ver1
division_2 = Division(A=tstat_2.Count, B=lng)
username = ClusterInput()
b = ClusterInput()
division_3 = Division(A=tstat_3.Count, B=lng)
move = Move(Geometry=python.substructureGeo, Motion=amp)  # -> Geometry, Transform
move_ver1_3 = GhPythonScript(geoData=geo, vecData=amp_4)  # -> out, moveGeo; inputs geoData: tree of Brep, vecData: tree; same code as move_ver1
move_ver1_4 = GhPythonScript(geoData=geo_2, vecData=amp_4)  # -> out, moveGeo; inputs geoData: tree of Brep, vecData: tree; same code as move_ver1
edges = BrepEdges(Brep=move_ver2.moveGeo)  # -> Naked, Interior, NonManifold
series_3 = Series(Start=0, Step=1, Count=division_3)  # -> graft(Series)
move_ver1_5 = GhPythonScript(geoData=move_ver1_2.moveGeo, vecData=amp_3)  # -> out, moveGeo; inputs geoData: tree of Brep, vecData: tree; same code as move_ver1
move_2 = Move(Geometry=move.Geometry, Motion=amp_3)  # -> Geometry, Transform
geo_3 = Geometry(move_ver1_5.moveGeo)
crv = Curve([edges.Interior, edges.Naked])
geo_4 = Geometry(move_ver2.moveGeo)
filter_3 = StreamFilter(Gate=null.NullFlags, Stream0=division_2, Stream1=division_3)
filter_4 = StreamFilter(Gate=null.NullFlags, Stream0=cladding_catergory.data_4, Stream1=series_3)
move_ver1_6 = GhPythonScript(geoData=move_ver1_3.moveGeo, vecData=amp)  # -> out, moveGeo; inputs geoData: tree of Brep, vecData: tree; same code as move_ver1
move_ver1_7 = GhPythonScript(geoData=move_ver1_4.moveGeo, vecData=amp)  # -> out, moveGeo; inputs geoData: tree of Brep, vecData: tree; same code as move_ver1
geo_5 = Geometry(move_2.Geometry)
filter_5 = StreamFilter(Gate=item, Stream0=geo_4)
geo_6 = Geometry(filter_5)
python_5 = GhPythonScript(usedMatDict=python.usedMatDict, innerMatGeo=geo_6, normalGeo=geo_3, dataItems=panel, userName=username)  # -> out, innerLayerNameTree, innerLayerDataTree, normalLayerNameTree, normalLayerDataTree; inputs usedMatDict: tree, innerMatGeo: tree, normalGeo: tree, dataItems: list
# ---------- python_5: Python ----------
#print(usedMatDict.Branches[0][0]['outerMaterial']['matInfo'])
#print(usedMatDict.Branches[0][0]['innerMaterial'][0][0]['info'])
#print(usedMatDict.Branches[0][0]['window'])
#print(usedMatDict.Branches[0][0]['door'])

from Grasshopper.Kernel.Data import GH_Path
from Grasshopper import DataTree
import System.Array as array

if userName == None:
    userName = ""

innerLayerNameTree = DataTree[object]()
innerLayerDataTree = DataTree[object]()
normalLayerNameTree = DataTree[object]()
normalLayerDataTree = DataTree[object]()

for layerId in innerMatGeo.Paths:
    infoObj = usedMatDict.Branches[0][0]['innerMaterial'][layerId[2]][0]['info']
    bauteil_obergruppe = infoObj.bauteil_obergruppe
    bauteil_gruner = infoObj.bauteil_gruner
    layerName = userName + ":innerMaterial:" + "layer_" + str(layerId[2]) + ":" + bauteil_obergruppe + "_" + bauteil_gruner + "_" + infoObj.uuid[-5:]
    innerLayerNameTree.AddRange([layerName], layerId)
    
    temp = []
    for item in dataItems:
        data = getattr(infoObj, item)
        temp.append(data)
    innerLayerDataTree.AddRange(temp, layerId)


for layerId in normalGeo.Paths:
    infoObj = usedMatDict.Branches[0][0]['outerMaterial']['matInfo'][layerId[2]][0]['info']
    bauteil_obergruppe = infoObj.bauteil_obergruppe
    bauteil_gruner = infoObj.bauteil_gruner
    layerName = userName + ":normalFacadeMaterial:" + "layer_" + str(layerId[2]) + ":" + bauteil_obergruppe + "_" + bauteil_gruner + "_" + infoObj.uuid[-5:]
    normalLayerNameTree.AddRange([layerName], layerId)
    
    temp = []
    for item in dataItems:
        data = getattr(infoObj, item)
        temp.append(data)
    normalLayerDataTree.AddRange(temp, layerId)
# ---------- end python_5 ----------
filter_6 = StreamFilter(Gate=item, Stream0=crv)
filter_7 = StreamFilter(Gate=item, Stream0=dup)
edges_2 = BrepEdges(Brep=move_ver1_5.moveGeo)  # -> Naked, Interior, NonManifold
edges_3 = BrepEdges(Brep=geo_5)  # -> Naked, Interior, NonManifold
gradient_2 = Gradient(
    LowerLimit=0,
    UpperLimit=filter_3,
    Parameter=filter_4,
    stops=[0: RGB(145, 107, 64), 0.267: RGB(234, 126, 0), 0.498: RGB(245, 207, 81), 0.772: RGB(235, 221, 185), 1: RGB(199, 98, 58)])
panel_2 = Panel("""20
10""")
panel_3 = Panel("""20
10""")
dash = DashPattern(Curve=move_ver1_6.moveGeo, Pattern=panel_2)  # -> Dashes, Gaps
dash_2 = DashPattern(Curve=move_ver1_7.moveGeo, Pattern=panel_3)  # -> Dashes, Gaps
crv_2 = Curve([edges_2.Naked, edges_2.Interior, filter_6, edges_3.Naked, edges_3.Interior])
ghpython_script = GhPythonScript(b=b, data=python_5.normalLayerNameTree)  # -> oData; inputs b: Boolean, data: tree
# ---------- ghpython_script: Python ----------
if b:
    oData = data
# ---------- end ghpython_script ----------
ghpython_script_2 = GhPythonScript(b=b, data=python_5.innerLayerNameTree)  # -> oData; inputs b: Boolean, data: tree; same code as ghpython_script
panel_4 = Panel(gradient_2)
unflatten = UnflattenTree(Tree=gradient_2, Guide=move_ver1_5.moveGeo)  # disabled
door = Data(dash.Dashes)
dup_2 = DuplicateData(Data=flatten(gradient_2), Number=lng, Order=True)  # -> graft(Data)
window = Data(dash_2.Dashes)
create_modify_layers = CreateModifyLayers(LayerName=ghpython_script, LayerColor=dup_2, DeleteLayer=False, enableFullPath=True)  # -> LayerNames, LayerFullPath
create_modify_layers_2 = CreateModifyLayers(LayerName=ghpython_script_2, LayerColor=filter_7, DeleteLayer=False, enableFullPath=True)  # -> LayerNames, LayerFullPath
createattributes = CreateAttributes(
    Name=create_modify_layers_2.LayerNames,
    LayerName=create_modify_layers_2.LayerNames,
    UserDataKeys=panel,
    UserDataValues=python_5.innerLayerDataTree,
    enableFullPath=False)
createattributes_2 = CreateAttributes(
    Name=create_modify_layers.LayerNames,
    LayerName=create_modify_layers.LayerNames,
    UserDataKeys=panel,
    UserDataValues=python_5.normalLayerDataTree,
    enableFullPath=False)
filter_8 = StreamFilter(Gate=item, Stream0=createattributes)
entwine = Entwine(Branch0X=geo_6, Branch1X=geo_3, FlattenInputs=False)
entwine_2 = Entwine(Branch0X=filter_8, Branch1X=createattributes_2, FlattenInputs=False)
R = ClusterOutput(entwine_2)
R_2 = ClusterOutput(entwine)
window_2 = ClusterOutput(window)
movegeo = ClusterOutput(move_ver1_5.moveGeo)
D = ClusterOutput(dup_2)
crv_3 = ClusterOutput(crv_2)
s_0 = ClusterOutput(filter_5)
s_0_2 = ClusterOutput(filter_7)
door_2 = ClusterOutput(door)

# ==== cluster TileMockData
num = ClusterInput()
num_2 = Data(num)
series = Series(Start=0, Step=1, Count="3")
panel = Panel("""bauteil_obergruppe
bauteil_gruner
uuid
kosten
zustand
material
ref_gebauede_geschoss
breite
hoehe
tiefe
flaeche
masse
anzahl
foto1
foto2
co2
url""")
item = ListItem(List=series, Index=0, Wrap=True)  # -> Item, Item1, Item2
dom = ConstructDomain(DomainStart=Slider(10, range=0..10), DomainEnd=Slider(60, range=0..100))
dom_2 = ConstructDomain(DomainStart=Slider(10, range=0..10), DomainEnd=Slider(1120, range=0..10000))
dom_3 = ConstructDomain(DomainStart=Slider(191, range=0..300), DomainEnd=Slider(262, range=0..300))
# width
random = Random(Range=dom, Number=num_2, Seed=item.Item, Integers=True)
# length
random_2 = Random(Range=dom_2, Number=num_2, Seed=item.Item1, Integers=True)
# quantity
random_3 = Random(Range=dom_3, Number=num_2, Seed=item.Item2, Integers=True)
python = GhPythonScript(x=num_2)  # -> out, a; inputs x: Int32
# ---------- python: Python ----------
import uuid
a = []
for i in range(x):
    a.append("MockTile_uuid_" + str(uuid.uuid4()))
# ---------- end python ----------
panel_2 = Panel("""7
8
12
2""")
python_2 = GhPythonScript(x=panel)  # -> out, a; inputs x: list
# ---------- python_2: Python ----------
a = []
for st in x:
    a.append("MockData_"+st)
# ---------- end python_2 ----------
dup = DuplicateData(Data=graft(python_2.a), Number=num_2, Order=True)
merge = Merge(
    Data1=simplify(graft(random)),
    Data2=simplify(graft(random_2)),
    Data3=simplify(graft(random_3)),
    Data4=simplify(graft(python.a)))
flip = FlipMatrix(Data=dup)
replace = ReplaceItems(List=flip, Item=merge, Indices=panel_2, Wrap=False)
data = Data(replace)
item_2 = ListItem(List=data, Index=panel_2, Wrap=True)
python_3 = GhPythonScript(x=item_2, y=data)  # -> out, filt_data, filt_attr; inputs x: tree, y: tree; same code as python
item_3 = ListItem(List=python_3.filt_data, Index=0, Wrap=True)  # -> flatten(Item), flatten(Item1), flatten(Item2)
python_4 = GhPythonScript(attr=python_3.filt_attr, item=panel)  # -> out, graft(all_dict_list); inputs attr: tree, item: list; same code as python_2
rectangle = Rectangle(Plane=PlaneXY(0, 0, 0), XSize=item_3.Item, YSize=item_3.Item1, Radius=0)  # -> simplify(graft(Rectangle)), Length
graft = GraftTree(Tree=item_3.Item2, IncludeEmptyLists=True, IncludeNullItems=True)  # -> simplify(Tree)
# Should check if I need to add attrObj
panel_3 = Panel("tile")
python_5 = GhPythonScript(identity=panel_3, geometry=rectangle.Rectangle, quantity=graft, attr=python_4.all_dict_list)  # -> out, objList; inputs geometry: tree of Rectangle3d, quantity: tree of Int32, attr: tree
# ---------- python_5: Python ----------
class BuildingComponent:
    def __init__(self, identity, geometry, quantity, attr):
        self.identity = identity
        self.geometry = geometry
        self.quantity = quantity
        self.attr = attr.attr
        self.attrObj = attr

objList = []
for geo, qua, at in zip(geometry.Branches, quantity.Branches, attr.Branches):
    obj = BuildingComponent(identity, geo[0], qua[0], at[0])
    objList.append(obj)
# ---------- end python_5 ----------
data_2 = Data(python_5.objList)
data_3 = ClusterOutput(data_2)

# ==== cluster BoardDB_2
data = ClusterInput()
data_2 = Data(data)
panel = Panel("""7
8
12""")
item = ListItem(List=data_2, Index=panel, Wrap=True)
panel_2 = Panel("""bauteil_obergruppe
bauteil_gruner
uuid
kosten
zustand
material
ref_gebauede_geschoss
breite
hoehe
tiefe
flaeche
masse
anzahl
foto1
foto2
co2
url""")
python = GhPythonScript(x=item, y=data_2)  # -> out, filt_data, filt_attr; inputs x: tree, y: tree
# ---------- python: Python ----------
import ghpythonlib.treehelpers as th

filt_data = []
filt_attr = []
for data, attr in zip(x.Branches, y.Branches):
    addBool = 1
    for d in data:
        if str(d) == "FALSE":
            addBool = 0
    
    # check if tiefe is FALSE
    if attr[9] == "FALSE":
        attr[9] = 1
    
    if addBool:
        attr[7] = float(attr[7])
        attr[8] = float(attr[8])
        attr[9] = float(attr[9])
        filt_data.append(data)
        filt_attr.append(attr)

filt_data = th.list_to_tree(filt_data)
filt_attr = th.list_to_tree(filt_attr)
# ---------- end python ----------
item_2 = ListItem(List=python.filt_data, Index=0, Wrap=True)  # -> flatten(Item), flatten(Item1), flatten(Item2)
python_2 = GhPythonScript(attr=python.filt_attr, item=panel_2)  # -> out, graft(all_dict_list); inputs attr: tree, item: list; same code as python_2
rectangle = Rectangle(Plane=PlaneXY(0, 0, 0), XSize=item_2.Item, YSize=item_2.Item1, Radius=0)  # -> simplify(graft(Rectangle)), Length
graft = GraftTree(Tree=item_2.Item2, IncludeEmptyLists=True, IncludeNullItems=True)  # -> simplify(Tree)
python_3 = GhPythonScript(identity="door", geometry=rectangle.Rectangle, quantity=graft, attr=python_2.all_dict_list)  # -> out, objList; inputs geometry: tree of Rectangle3d, quantity: tree of Int32, attr: tree; same code as python_3
data_3 = Data(python_3.objList)
data_4 = ClusterOutput(data_3)

# ==== cluster Cluster
S = ClusterInput()
M = ClusterInput()
data = ClusterInput()
mindex = MemberIndex(Set=S, Member=M)  # -> Index, Count
data_2 = Data(data)
item = ListItem(List=data_2, Index=mindex.Index, Wrap=True)
cset = CreateSet(List=flatten(item))  # -> Set, Map
lng = ListLength(List=cset.Set)
S_2 = ClusterOutput(cset.Set)
M_2 = ClusterOutput(cset.Map)
L = ClusterOutput(lng)

# ==== cluster Cluster_2
category = ClusterInput()
chosenitem = ClusterInput()
dataid = ClusterInput()
category_2 = Data(category)
chosenitem_2 = Data(chosenitem)
dataid_2 = Data(dataid)
null = NullItem(Item=chosenitem_2)  # -> flatten(NullFlags), InvalidFlags, Description
item = ListItem(List=null.NullFlags, Index=0, Wrap=True)
filter = StreamFilter(Gate=item, Stream0=chosenitem_2, Stream1=category_2)
mindex = MemberIndex(Set=category_2, Member=filter)  # -> flatten(Index), Count
python = GhPythonScript(choose=mindex.Index, data=dataid_2)  # -> out, a; inputs choose: list, data: list
# ---------- python: Python ----------
a = []
for id, d in enumerate(data):
    if d in choose:
        a.append(id)
# ---------- end python ----------
a = ClusterOutput(python.a)

# ==== cluster CladdingCatergory
sddp = ShapeDiverDocumentPayload()
geo = ClusterInput()
data = ClusterInput()
geo_2 = Geometry(geo)
data_2 = Data(data)
int = Integer(flatten(data_2))
cset = CreateSet(List=int)  # -> Set, Map
sort = SortList(Keys=cset.Set)  # -> Keys, ValuesA
lng = ListLength(List=cset.Set)
series = Series(Start=0, Step=1, Count=lng)
python = GhPythonScript(become=series, changed=sort.Keys, changeList=data_2)  # -> out, newList; inputs become: list, changed: list, changeList: tree of Int32
# ---------- python: Python ----------
import ghpythonlib.treehelpers as th

width = become
length = changed

number_mapping = {}
for w, l in zip(width, length):
    number_mapping[l] = w

newList = []
for chList in changeList.Branches:
    newList.append([number_mapping[number] if number in number_mapping else number for number in chList])

newList = th.list_to_tree(newList)
# ---------- end python ----------
unflatten = UnflattenTree(Tree=python.newList, Guide=data_2)
tstat = TreeStatistics(Tree=graft(unflatten))  # -> Paths, Length, Count
dpath = DeconstructPath(Branch=tstat.Paths)
flatten = FlattenTree(Tree=unflatten, Path="{0}")  # -> simplify(graft(Tree))
geo_3 = Geometry(graft(geo_2))
item = ListItem(List=dpath, Index=0, Wrap=True)  # -> simplify(Item)
merge = Merge(Data1=item, Data2=flatten)
tstat_2 = TreeStatistics(Tree=geo_3)  # -> Paths, Length, Count
path = ConstructPath(Indices=merge)  # -> flatten(Branch)
tstat_3 = TreeStatistics(Tree=flatten)  # -> Paths, Length, Count
replace = ReplacePaths(Data=flatten, Search=tstat_3.Paths, Replace=path)
replace_2 = ReplacePaths(Data=geo_3, Search=tstat_2.Paths, Replace=path)
data_3 = Data(replace)
geo_4 = Geometry(replace_2)
geo_5 = ClusterOutput(geo_4)
data_4 = ClusterOutput(data_3)
