# Grasshopper definition SynapseExample.gh (Grasshopper 1.0.7)
# plug-ins: Synapse

properties = ValueList({"Text", "Command", "CommandParameter", "Image", "ImagePosition", "MinimumSize", "Size", "Width", "Height", "TextColor", "Font", "Tag", "IsVisualControl", "Enabled", "Visible", "VisualParent", "BackgroundColor", "Cursor", "ToolTip", "TabIndex", "AllowDrop", "Parent", "DataContext", "Handler", "ID", "Style", "IsDisposed"}, selected="Image")  # disabled
panel = Panel("C:\Users\User\Documents\GitHub\BFH_Reuse24\Kevin\DB\BFH_DB\Pictures_gruner\1_221114_Foto_Bau09\Foto_Bau09")  # disabled
python = GhPythonScript(folder_path=panel)  # -> out, image_paths; disabled
# ---------- python: Python ----------
import os

def get_image_paths(folder_path):
    # Define a list of common image file extensions
    image_extensions = ['.jpg', '.jpeg', '.png', '.gif', '.bmp', '.tiff']
    
    # List to store the paths of image files
    image_paths = []
    
    # Iterate over all files in the given folder
    for filename in os.listdir(folder_path):
        print(filename)
        # Check if the file is an image by comparing its extension
        if any(filename.lower().endswith(ext) for ext in image_extensions):
            # If it is, add its full path to the list
            full_path = os.path.join(folder_path, filename)
            image_paths.append(full_path)
    
    return image_paths


# Example usage
image_paths = get_image_paths(folder_path)
# ---------- end python ----------
panel_2 = Panel("Lucida Console")  # disabled
panel_3 = Panel("""DecimalPlaces
Increment""")  # disabled
number_slider = Slider(20, range=0..100)  # disabled
panel_4 = Panel("C:\Users\User\Documents\GitHub\BFH_Reuse24\Kevin\demoSeries\demo_materialManu_29020204\DB\Pictures_gruner\BVB project\bauelemente_20231107082757335.JPG")  # disabled
genes = GenePool(Decimals=0, Maximum=99, Minimum=1, Value=[35.98291824, 41, 36, 72])  # disabled
genes_2 = GenePool(Decimals=0, Maximum=99, Minimum=1, Value=[75, 40, 74, 74])  # disabled
color1 = Slider(0.56, range=0.01..1)  # disabled
color2 = Slider(0.43, range=0.01..1)  # disabled
color3 = Slider(0.81, range=0.01..1)  # disabled
color0 = Slider(0.12, range=0.01..1)  # disabled
panel_5 = Panel("""sliderwidth
maxvalue
minvalue
steps""")  # disabled
swatch = ColourSwatch(SwatchColor=RGB(50, 132, 209))  # disabled
panel_6 = Panel("C:\Users\User\Documents\GitHub\BFH_Reuse24\Kevin\demoSeries\demo_materialManu_29020204\DB\Pictures_gruner\notFound.jpg")  # disabled
number_slider_2 = Slider(463, range=0..1000)  # disabled
number_slider_3 = Slider(333, range=0..1000)  # disabled
genes_3 = GenePool(Decimals=0, Maximum=99, Minimum=1, Value=[19, 19, 21, 31])  # disabled
genes_4 = GenePool(Decimals=0, Maximum=99, Minimum=1, Value=[31, 16, 32, 20])  # disabled
panel_7 = Panel("1")  # disabled
panel_8 = Panel("0")  # disabled
argb = SplitARGB(Colour=swatch, IntegerChannels=True)  # -> Alpha, Red, Green, Blue; disabled
number_slider_4 = Slider(1, range=0..100)  # disabled
panel_9 = Panel("TextColor")  # disabled
sicon = SnpIcon(FileLocation=panel_4)  # disabled
sfont = SynapseFont(FontFamily=panel_2, FontSize=8.25, FontStyle=0, Decoration=0)  # disabled
split = SplitList(List=python.image_paths, Index=number_slider)  # -> ListA, ListB; disabled
panel_10 = Panel("""115
20
5
5""")  # disabled
panel_11 = Panel("""2
2""")  # disabled
panel_12 = Panel("TextColor")  # disabled
gradient = Gradient(
    LowerLimit=panel_8,
    UpperLimit=panel_7,
    Parameter=[color0, color1, color2, color3],
    stops=[0: RGB(243, 57, 0), 0.1: RGB(236, 27, 60), 0.2: RGB(210, 0, 118), 0.3: RGB(103, 0, 120), 0.4: RGB(39, 72, 161), 0.5: RGB(1, 192, 229), 0.6: RGB(18, 178, 90), 0.7: RGB(79, 186, 8), 0.8: RGB(220, 237, 32), 0.9: RGB(247, 159, 20), 1: RGB(243, 57, 0)])  # disabled
panel_13 = Panel("object name")  # disabled
panel_14 = Panel("C:\Users\User\Documents\GitHub\BFH_Reuse24\Kevin\demoSeries\demo_materialManu_29020204\DB\Pictures_gruner\notFound.jpg")  # disabled
merge = Merge(Data1=graft(genes_3), Data2=graft(genes), Data3=graft(genes_2), Data4=graft(genes_4))  # disabled
panel_15 = Panel("C:/Users/User/Documents/GitHub/BFH_Reuse24/Kevin/demoSeries/demo_materialManu_29020204/DB/Pictures_gruner/notFound.jpg")  # disabled
swatch_2 = ColourSwatch(SwatchColor=RGB(178, 43, 154))  # disabled
number_slider_5 = Slider(99, range=50..200)  # disabled
scolor = SynapseColor(Alpha=argb.Alpha, Red=argb.Red, Green=argb.Green, Blue=argb.Blue)  # disabled

# ---- group: stack properties
number_slider_6 = Slider(356, range=100..800)  # disabled
number_slider_7 = Slider(200, range=100..800)  # disabled
D = Slider(10, range=5..20)  # disabled
D_2 = Slider(5, range=5..20)  # disabled
int = Integer(D_2)  # disabled
int_2 = Integer(D)  # disabled
size = SynapseSize(Width=number_slider_6, Height=number_slider_7)  # disabled

# ----
number_slider_8 = Slider(23, range=1..99)  # disabled
number_slider_9 = Slider(12, range=1..99)  # disabled
number_slider_10 = Slider(60, range=1..99)  # disabled
number_slider_11 = Slider(40, range=1..99)  # disabled
panel_16 = Panel("Image")  # disabled
panel_17 = Panel("Font")  # disabled
button = Button()  # disabled
panel_18 = Panel("text")  # disabled
int_3 = Integer(panel_11)  # disabled
number_slider_12 = Slider(117, range=50..200)  # disabled
number_slider_13 = Slider(6, range=0..10)  # disabled
series = Series(Start=number_slider_3, Step=1, Count=number_slider)  # disabled
series_2 = Series(Start=number_slider_2, Step=1, Count=number_slider)  # disabled
item = ListItem(List=gradient, Index=0, Wrap=True)  # -> Item, Item1, Item2, Item3; disabled
flip = FlipMatrix(Data=merge)  # -> simplify(Data); disabled
stb = SynapseTextBox(Property=flatten(panel_9), PropertyValue=flatten(scolor), live=False)  # -> AllProperties, Control; disabled
snud = SynapseNumUpDn(Property=flatten(panel_3), PropertyValue=flatten(int_3))  # -> AllProperties, Control; disabled
ss = SynapseSlider(Property=flatten(panel_5), PropertyValue=flatten(panel_10), Coefficient=0.1)  # -> AllProperties, Control; disabled
sbtn = SynapseButton(Property=flatten(panel_17), PropertyValue=flatten(sfont))  # -> AllProperties, Control; disabled
scb = SynapseCheckBox(Property=flatten(panel_12), PropertyValue=flatten(swatch_2))  # -> AllProperties, Control; disabled
slbl = SynapseLabel(Property=flatten(panel_18), PropertyValue=flatten(panel_13))  # -> AllProperties, Control; disabled
repeat = RepeatData(Data=sicon, Length=number_slider_4)  # disabled
panel_19 = Panel("4")  # disabled
number_slider_14 = Slider(1000, range=0..1000)  # disabled
number_slider_15 = Slider(124, range=100..800)  # disabled
python_2 = GhPythonScript()  # -> out, a; disabled
# ---------- python_2: Python ----------
#"C:/Users/User/Documents/GitHub/BFH_Reuse24/Kevin/demoSeries/demo_materialManu_29020204/DB/Pictures_gruner/notFound.jpg"


from Rhino.UI import RhinoEtoApp
import Eto.Forms as forms
import Eto.Drawing as drawing

class SimpleDialog(forms.Dialog[bool]):

    def __init__(self):
        self.Title = "Simple Dialog"
        self.ClientSize = drawing.Size(800, 800)
        self.Padding = drawing.Padding(10)
        
        # Create a DynamicLayout
        layout = forms.DynamicLayout()
        layout.Spacing = drawing.Size(5, 5)
        
        # Create and add a label to the layout
        label = forms.Label(Text="This is a label")
        layout.AddRow(label)
        
        # Load an image and create an ImageView to display it
        image_path = "C:/Users/User/Documents/GitHub/BFH_Reuse24/Kevin/demoSeries/demo_materialManu_29020204/DB/Pictures_gruner/notFound.jpg"  # Update this path to your image
        try:
            bitmap = drawing.Bitmap(image_path)
            image_view1 = forms.ImageView()
            image_view1.Image = bitmap
#            layout.AddRow(image_view1)
        except Exception as e:
            print("Failed to load image:", e)
        
        try:
            bitmap = drawing.Bitmap(image_path)
            image_view2 = forms.ImageView()
            image_view2.Image = bitmap
#            layout.AddRow(image_view2)
        except Exception as e:
            print("Failed to load image:", e)
        
        layout.AddRow(image_view1, image_view2)
        
        # Create OK button
        okButton = forms.Button(Text="OK")
        okButton.Click += self.on_ok_button_click
        layout.AddRow(None)  # Add a spacer
        
        # Create Cancel button
        cancelButton = forms.Button(Text="Cancel")
        cancelButton.Click += self.on_cancel_button_click
        
        # Add buttons to the layout
        layout.AddRow(okButton, cancelButton)
        
        # Set the dialog's content to the layout
        self.Content = layout

    # OK button event handler
    def on_ok_button_click(self, sender, e):
        self.Close(True)  # Close dialog and return True

    # Cancel button event handler
    def on_cancel_button_click(self, sender, e):
        self.Close(False)  # Close dialog and return False

# Function to show the dialog
def ShowSimpleDialog():
    dialog = SimpleDialog()
    result = dialog.ShowModal(RhinoEtoApp.MainWindow)
    if result:
        print("OK clicked")
    else:
        print("Cancel clicked or dialog closed")

# Call the function to show the dialog
ShowSimpleDialog()
# ---------- end python_2 ----------
toggle = BooleanToggle(False)  # disabled
python_3 = GhPythonScript()  # -> out, a; disabled
# ---------- python_3: Python ----------
################################################################################
# SampleEtoRebuildCurve.py
# MIT License - Copyright (c) 2017 Robert McNeel & Associates.
# See License.md in the root of this repository for details.
################################################################################

# Imports from
from Rhino.UI import *
from Eto.Forms import *
from Eto.Drawing import *

# Imports
import Rhino
import scriptcontext as sc

################################################################################
# Class to hold rebuild arguments
################################################################################
class RebuildCurveArgs():
    
    # Initializer
    def __init__(self):
        self.PointCount = 0
        self.Degree = 0
        self.PreserveTangents = False
        self.DeleteInput = True
    
    # Validator
    def IsValid(self):
        if self.PointCount < 2 or self.PointCount > 32767: return False
        if self.Degree < 1 or self.Degree > 11: return False
        return True
    
################################################################################
# Rebuild curve dialog class
################################################################################
class RebuildCurveDialog(Dialog[bool]):
    
    # Initializer
    def __init__(self, args):
        self.Args = args
        # Initialize dialog box
        self.Title = 'Rebuild'
        self.Padding = Padding(5)
        # Create layout
        layout = TableLayout()
        layout.Padding = Padding(5)
        layout.Spacing = Size(5, 5)
        layout.Rows.Add(self.CreateSteppers())
        layout.Rows.Add(None) # spacer
        layout.Rows.Add(self.CreateCheckBoxes())
        layout.Rows.Add(None) # spacer
        layout.Rows.Add(self.CreateButtons())
        # Set the dialog content
        self.Content = layout
    
    # Creates numeric stepper controls
    def CreateSteppers(self):
        # Create labels
        label0 = Label(Text = 'Point count:')
        label1 = Label(Text = 'Degree:')
        label2 = Label(Text = '({})'.format(self.Args.PointCount))
        label3 = Label(Text = '({})'.format(self.Args.Degree))
        # Create numeric steppers
        self.PointCount = NumericStepper(
            Value = self.Args.PointCount,
            MinValue = 2,
            MaxValue = 32767
            )
        self.Degree = NumericStepper(
            Value = self.Args.Degree,
            MinValue = 1,
            MaxValue = 11
            )
        # Create table layout
        layout = TableLayout()
        layout.Spacing = Size(5, 5)
        layout.Rows.Add(TableRow(label0, label2, self.PointCount))
        layout.Rows.Add(TableRow(label1, label3, self.Degree))
        return layout
    
    # Creates checkbox controls
    def CreateCheckBoxes(self):
        # Create checkboxes
        self.DeleteInput = CheckBox(
            Text = 'Delete input', 
            Checked = self.Args.DeleteInput,
            ThreeState = False
            )
        self.PreserveTangents = CheckBox(
            Text = 'Preserve tangent end directions', 
            Checked = self.Args.PreserveTangents,
            ThreeState = False
            )
        # Create table layout
        layout = TableLayout()
        layout.Spacing = Size(5, 5)
        layout.Rows.Add(TableRow(self.DeleteInput))
        layout.Rows.Add(TableRow(self.PreserveTangents))
        return layout
    
    # OK button click handler
    def OnOkButtonClick(self, sender, e):
        # Harvest control values before closing
        self.Args.PointCount = self.PointCount.Value
        self.Args.Degree = self.Degree.Value
        self.Args.PreserveTangents = self.PreserveTangents.Checked
        self.Args.DeleteInput = self.DeleteInput.Checked
        self.Close(True)
    
    # Cancel button click handler
    def OnCancelButtonClick(self, sender, e):
        self.Close(False)
    
    # Create button controls
    def CreateButtons(self):
        # Create the default button
        self.DefaultButton = Button(Text = 'OK')
        self.DefaultButton.Click += self.OnOkButtonClick
        # Create the abort button
        self.AbortButton = Button(Text = 'Cancel')
        self.AbortButton.Click += self.OnCancelButtonClick
        # Create button layout
        button_layout = TableLayout()
        button_layout.Spacing = Size(5, 5)
        button_layout.Rows.Add(TableRow(None, self.DefaultButton, self.AbortButton, None))
        return button_layout
    
################################################################################
# Function to test the rebuild curve dialog
################################################################################
def TestRebuildCurve():
    
    res, objref = Rhino.Input.RhinoGet.GetOneObject(
        "Select curve to rebuild", 
        True, 
        Rhino.DocObjects.ObjectType.Curve
        )
    if res != Rhino.Commands.Result.Success: return
    
    curve = objref.Curve()
    if curve is None: return
        
    nurb = curve.ToNurbsCurve()
    if curve is None: return    
    
    args = RebuildCurveArgs()
    args.PointCount = nurb.Points.Count
    args.Degree = nurb.Degree
    
    dlg = RebuildCurveDialog(args)
    rc = dlg.ShowModal(RhinoEtoApp.MainWindow)
    if rc and args.IsValid():
        nurb = curve.Rebuild(args.PointCount, args.Degree, args.PreserveTangents)
        if nurb:
            if args.DeleteInput:
                sc.doc.Objects.Replace(objref, nurb)
            else:
                sc.doc.Objects.Add(nurb, objref.Object().Attributes)
            sc.doc.Views.Redraw()
    
################################################################################
# Check to see if this file is being executed as the "main" python
# script instead of being used as a module by some other python script
# This allows us to use the module which ever way we want.
################################################################################
if __name__ == "__main__":
    TestRebuildCurve()
# ---------- end python_3 ----------
toggle_2 = BooleanToggle(False)  # disabled
python_4 = GhPythonScript()  # -> out, a
# ---------- python_4: Python ----------
from Rhino.UI import *
from Eto.Forms import *
from Eto.Drawing import *

################################################################################
# Sample dialog
################################################################################
def TestSampleEtoDialog():
    dialog = Dialog()
    dialog.Title = "Sample Eto Dialog"
    dialog.ClientSize = Size(200, 200)
    dialog.Padding = Padding(5)
    dialog.Resizable = False

    label = Label()
    label.Text = "Hello Rhino.Python!"
    dialog.Content = label

    dialog.ShowModal(RhinoEtoApp.MainWindow)
    
################################################################################
# Check to see if this file is being executed as the "main" python
# script instead of being used as a module by some other python script
# This allows us to use the module which ever way we want.
################################################################################
TestSampleEtoDialog()
# ---------- end python_4 ----------
python_5 = GhPythonScript()  # -> out, a; disabled
# ---------- python_5: Python ----------
################################################################################
# SampleEtoCollapsibleDialog.py
# MIT License - Copyright (c) 2017 Robert McNeel & Associates.
# See License.md in the root of this repository for details.
################################################################################
import scriptcontext
import rhinoscriptsyntax as rs
import clr
import sys

from Rhino.UI import *
from Eto.Forms import Form, Dialog, Label, TextBox, StackLayout, Orientation, Button, HorizontalAlignment, VerticalAlignment, TextAlignment, NumericUpDown, MessageBox, DropDown, CheckBox, TableLayout, StackLayoutItem, DynamicLayout, Control, Panel, Form
from Eto.Drawing import *

# Custom label helper to set alignment
def L(text):
	return Label(Text = text, VerticalAlignment = VerticalAlignment.Center, TextAlignment = TextAlignment.Right)

form = Dialog[bool]() # return True or False from ShowModal()
form.Title = "My Collapsible Eto Form"
form.Resizable = False
form.Padding = Padding(5)

# set content of the collapsed section
collapsePanel = DynamicLayout(Visible = False, Padding = Padding(40, 10), DefaultSpacing = Size(5, 5))
collapsePanel.BeginVertical()
collapsePanel.AddRow(None, L("Density:"), NumericUpDown())
collapsePanel.AddRow(None, L("Maximum angle:"), NumericUpDown())
collapsePanel.AddRow(None, L("Maximum aspect ratio:"), NumericUpDown())
collapsePanel.AddRow(None, L("Minimum edge length:"), NumericUpDown())
collapsePanel.AddRow(None, L("Maximum edge length:"), NumericUpDown())
collapsePanel.AddRow(None, L("Maximum distance, edge to surface:"), NumericUpDown())
collapsePanel.AddRow(None, L("Minimum initial grid quads:"), NumericUpDown())
collapsePanel.EndVertical()
collapsePanel.BeginVertical()
collapsePanel.AddRow(None, CheckBox(Text = "Refine mesh"))
collapsePanel.AddRow(None, CheckBox(Text = "Jagged seams"), CheckBox(Text = "Pack textures"), None)
collapsePanel.AddRow(None, CheckBox(Text = "Simple planes"))
collapsePanel.EndVertical()

# button to toggle collapsing
collapseButton = Button(Text = "v", MinimumSize = Size.Empty)
def collapseButton_Click(sender, e):
	try:
		if collapsePanel.Visible:
			form.ClientSize = Size(form.ClientSize.Width, form.ClientSize.Height - collapsePanel.Height)
			collapsePanel.Visible = False
			collapseButton.Text = "^"
		else:
			collapsePanel.Visible = True
			collapseButton.Text = "v"
			form.ClientSize = Size(max(form.ClientSize.Width, collapsePanel.Width), form.ClientSize.Height + collapsePanel.Height)
	except:
		print "Unexpected error:", sys.exc_info()[0]
		pass # so we don't bring down rhino if there's a bug in the script

collapseButton.Click += collapseButton_Click


# a few buttons always shown at the bottom
previewButton = Button(Text = "Preview")

cancelButton = Button(Text = "Cancel")
def cancelButton_Click (sender, e):
	try:
		form.Close(False)
	except:
		print "Unexpected error:", sys.exc_info()[0]
		pass # so we don't bring down rhino if there's a bug in the script
cancelButton.Click += cancelButton_Click;

okButton = Button(Text = "OK")
def okButton_Click (sender, e):
	try:
		form.Close(True)
	except:
		print "Unexpected error:", sys.exc_info()[0]
		pass # so we don't bring down rhino if there's a bug in the script
okButton.Click += okButton_Click

# set default buttons when user presses enter or escape anywhere on the form
form.DefaultButton = okButton
form.AbortButton = cancelButton
toleranceUpDown = NumericUpDown()

# our main layout
layout = DynamicLayout(DefaultSpacing = Size(2,2))
layout.AddSeparateRow(None, L("Tolerance"), toleranceUpDown, L("millimeters"), collapseButton)
layout.AddCentered(collapsePanel) # we need this auto-sized so we can get its width to adjust form height
layout.Add(None); # expanding space, in case you want the form re-sizable
layout.AddSeparateRow(None, previewButton, cancelButton, okButton);
form.Content = layout;
	
	
if form.ShowModal():
	print "Do something, user clicked OK"
# ---------- end python_5 ----------
python_6 = GhPythonScript()  # -> out, a; disabled
# ---------- python_6: Python ----------
import Rhino
import Eto

################################################################################
# Viewports dialog class
################################################################################
class ViewportsDialog(Eto.Forms.Dialog[bool]):
    
    # Initializer
    def __init__(self):
        # Initialize dialog box
        self.Title = 'Rhino Viewport in an Eto Control'
        self.Padding = Eto.Drawing.Padding(5)
        self.Resizable = True
        # Create viewport controls
        viewport0 = Rhino.UI.Controls.ViewportControl(Size = Eto.Drawing.Size(400, 200))
        viewport1 = Rhino.UI.Controls.ViewportControl(Size = Eto.Drawing.Size(400, 200))
        # Create layout
        layout = Eto.Forms.StackLayout()
        layout.Padding = Eto.Drawing.Padding(5)
        layout.Spacing = 5
        layout.HorizontalContentAlignment = Eto.Forms.HorizontalAlignment.Stretch
        layout.Items.Add(viewport0)
        layout.Items.Add(viewport1)
        layout.Items.Add(None)
        layout.Items.Add(self.CloseButton())
        # Set the dialog content
        self.Content = layout
   
    # Close button click handler
    def OnCloseButtonClick(self, sender, e):
        self.Close(True)
   
    # Create button control
    def CloseButton(self):
        # Create the default button
        self.DefaultButton = Eto.Forms.Button(Text = 'Close')
        self.DefaultButton.Click += self.OnCloseButtonClick
        return self.DefaultButton
    
################################################################################
# Function to test the viewport dialog
################################################################################
def TestViewportsDialog():
    dlg = ViewportsDialog()
    dlg.ShowModal(Rhino.UI.RhinoEtoApp.MainWindow)
     
################################################################################
# Check to see if this file is being executed as the "main" python
# script instead of being used as a module by some other python script
# This allows us to use the module which ever way we want.
################################################################################
if __name__ == "__main__":
    TestViewportsDialog()
# ---------- end python_6 ----------
series_3 = Series(Start=0, Step=1, Count=panel_19)  # disabled
toggle_3 = BooleanToggle(False)  # disabled
toggle_4 = BooleanToggle(False)  # disabled
merge_2 = Merge(Data1=item.Item, Data2=item.Item1, Data3=item.Item2, Data4=item.Item3)  # disabled
merge_3 = Merge(Data1=number_slider_8, Data2=number_slider_11, Data3=number_slider_9, Data4=number_slider_10)  # disabled
python_7 = GhPythonScript()  # -> out, a; disabled
# ---------- python_7: Python ----------
################################################################################
# SampleEtoViewCaptureDialog.py
# MIT License - Copyright (c) 2017 Robert McNeel & Associates.
# See License.md in the root of this repository for details.
################################################################################

# Imports from
from Rhino.UI import *
from Eto.Forms import *
from Eto.Drawing import *

# Imports
import Rhino
import Rhino.UI
import Eto
import scriptcontext
import System

################################################################################
# SampleEtoViewCaptureDialog dialog class
################################################################################
class SampleEtoViewCaptureDialog(Eto.Forms.Dialog[bool]):
    
    # Class initializer
    def __init__(self):
        # Initialize dialog box
        self.Title = 'SampleEtoViewCaptureDialog'
        self.Padding = Padding(10)
        # Create a table layout and add all the controls
        layout = TableLayout()
        layout.Padding = Padding(10)
        layout.Spacing = Size(5, 5)
        layout.Rows.Add(self.CreateLabel())
        layout.Rows.Add(self.CreateImageView())
        layout.Rows.Add(None) # spacer
        layout.Rows.Add(self.CreateButtons())
        # Set the dialog content
        self.Content = layout
    
    # Create the dialog label
    def CreateLabel(self):
        self.m_label = Label(Text = 'Click the "Capture" button...')
        return self.m_label
    
    # Create the dialog image list
    def CreateImageView(self):
        self.m_image_view = ImageView()
        self.m_image_view.Size = Size(300, 200)
        self.m_image_view.Image = None
        return self.m_image_view
    
    # Close button click handler
    def OnCloseButtonClick(self, sender, e):
        rc = self.m_image_view.Image is not None
        if rc:
            self.Close(True)
        else:
            self.Close(False)
        
    # Capture button click handler 
    def OnCaptureButtonClick(self, sender, e): 
        # Capture the active view to a System.Drawing.Bitmap
        view = scriptcontext.doc.Views.ActiveView
        bitmap = view.CaptureToBitmap()
        # Convert the System.Drawing.Bitmap to an Eto.Drawing.Bitmap
        # which is required for an Eto image view control
        stream = System.IO.MemoryStream()
        format = System.Drawing.Imaging.ImageFormat.Png
        System.Drawing.Bitmap.Save(bitmap, stream, format)
        if stream.Length != 0:
          self.m_image_view.Image = Bitmap(stream)
        stream.Dispose()
        # Update the text label
        self.m_label.Text = 'Captured view: {}'.format(view.ActiveViewport.Name)
        # Disable the default button
        self.DefaultButton.Enabled = False

    # Create the dialog buttons
    def CreateButtons(self):
        # Create the default button
        self.DefaultButton = Button(Text = 'Capture')
        self.DefaultButton.Click += self.OnCaptureButtonClick
        # Create the abort button
        self.AbortButton = Button(Text = 'Close')
        self.AbortButton.Click += self.OnCloseButtonClick
        # Create button layout
        button_layout = TableLayout()
        button_layout.Spacing = Size(5, 5)
        if Rhino.Runtime.HostUtils.RunningOnWindows:
            button_layout.Rows.Add(TableRow(None, self.DefaultButton, self.AbortButton))
        else:
            button_layout.Rows.Add(TableRow(None, self.AbortButton, self.DefaultButton))
        return button_layout
        
    # Returns the captured image
    def Image(self):
        return self.m_image_view.Image
    
################################################################################
# Function to test the capture dialog
################################################################################
def TestSampleEtoViewCaptureDialog():
    dialog = SampleEtoViewCaptureDialog();
    rc = dialog.ShowModal(RhinoEtoApp.MainWindow)
    if (rc):
        print 'have image'
    
################################################################################
# Check to see if this file is being executed as the "main" python
# script instead of being used as a module by some other python script
# This allows us to use the module which ever way we want.
################################################################################
if __name__ == "__main__":
    TestSampleEtoViewCaptureDialog()
# ---------- end python_7 ----------
toggle_5 = BooleanToggle(False)  # disabled
toggle_6 = BooleanToggle(False)  # disabled
complex = CreateComplex(Real=number_slider_12, Imaginary=number_slider_5)  # disabled
toggle_7 = BooleanToggle(False)  # disabled
sbtn_2 = SnpButton(Property=flatten(panel_16), PropertyValue=graft(repeat))  # -> AllProperties, Control; disabled
repeat_2 = RepeatData(Data=panel_15, Length=number_slider_13)  # disabled
panel_20 = Panel("horizontal")  # disabled
panel_21 = Panel("Orientation")  # disabled
panel_22 = Panel("Size")  # disabled
size_2 = SynapseSize(Width=number_slider_15, Height=number_slider_14)  # disabled
panel_23 = Panel("""Some option A
A better option B
Another option C
Last option D""")  # disabled
scombo = SynapseComboBox(Options=flatten(["Alpha", "Beta", "Omega"]))  # -> AllProperties, Control; disabled
sdm = SynapseDropMenu(Options=flatten(["Alpha", "Beta", "Omega"]))  # -> AllProperties, Control; disabled
python_8 = GhPythonScript(x=toggle, imagePath=panel_15)  # -> out, a; inputs x: Boolean; disabled
# ---------- python_8: Python ----------
import Rhino
import Eto.Forms as forms
import Eto.Drawing as drawing
import random as rnd

class TestWindow(forms.Form):
    def __init__(self):
        self.Size = drawing.Size(400, 400)
        
        layout = forms.DynamicLayout()
        layout.Spacing = drawing.Size(5, 5)

        # ImageView for displaying the image
        self.imageView = forms.ImageView()
        self.imageView.Size = drawing.Size(200, 200) # Adjust size as needed
        layout.AddRow(self.imageView)
        
        self.Content = layout

        # Load the image directly without button trigger
        self.LoadImage(imagePath)
    
    def LoadImage(self, imagePath):
        try:
            image = drawing.Bitmap(imagePath)
            self.imageView.Image = image
        except Exception as e:
            forms.MessageBox.Show("Failed to load image: " + str(e))

# Creating and showing the window
window = TestWindow()
if x: window.Show()
# ---------- end python_8 ----------
python_9 = GhPythonScript(x=toggle_2, imagePath=panel_15)  # -> out, a; inputs x: Boolean; disabled
# ---------- python_9: Python ----------
import Rhino
import Eto.Forms as forms
import Eto.Drawing as drawing
import random as rnd

class TestWindow(forms.Form):
    def __init__(self):
        self.Size = drawing.Size(400, 400)
        
        layout = forms.DynamicLayout()
        layout.Spacing = drawing.Size(5, 5)

#        # Button to load the image
        loadButton = forms.Button(Text="Load Image")
        loadButton.Click += self.OnLoadImage
        layout.AddRow(loadButton)

        # ImageView for displaying the image
        self.imageView = forms.ImageView()
        self.imageView.Size = drawing.Size(200, 200) # Adjust size as needed
        layout.AddRow(self.imageView)
        
        
        self.Content = layout
    
    def OnLoadImage(self, sender, event):
#        imagePath = self.pathInput.Text
        try:
            image = drawing.Bitmap(imagePath)
            self.imageView.Image = image
        except Exception as e:
            forms.MessageBox.Show("Failed to load image: " + str(e))
    
    def OnClick(self, sender, event):
        try:
            # Corrected to call rnd.random() as a function
            color = drawing.Color(rnd.random(), rnd.random(), rnd.random(), 1)
            sender.BackgroundColor = color  # Changing to BackgroundColor for visibility
        except Exception as e:
            forms.MessageBox.Show("Error changing color: " + str(e))

# Creating and showing the window
window = TestWindow()
if x: window.Show()
# ---------- end python_9 ----------
python_10 = GhPythonScript(x=toggle_4, imagePaths=repeat_2)  # -> out, a; inputs x: Boolean, imagePaths: list; disabled
# ---------- python_10: Python ----------
import Rhino
import Eto.Forms as forms
import Eto.Drawing as drawing
import random as rnd

class TestWindow(forms.Form):
    def __init__(self):
        # Window setup
        self.Title = "Image Viewer"
        self.Size = drawing.Size(400, 800)  # Adjusted for vertical layout
        
        # Main layout container
        layout = forms.DynamicLayout()
        layout.Spacing = drawing.Size(5, 5)
        
        # Create and add an ImageView for each image path
        for path in imagePaths:
            imageView = forms.ImageView()
            imageView.Size = drawing.Size(200, 200)  # Adjust size as needed
            self.LoadImage(imageView, path)
            layout.AddRow(imageView)
        
        self.Content = layout

    def LoadImage(self, imageView, imagePath):
        try:
            image = drawing.Bitmap(imagePath)
            imageView.Image = image
        except Exception as e:
            forms.MessageBox.Show("Failed to load image: " + str(e))

# Creating and showing the window
window = TestWindow()
if x: window.Show()
# ---------- end python_10 ----------
stb_2 = SynapseTextBox(Mask="(000) 000 0000")  # -> AllProperties, Control, AllMasks; disabled
python_11 = GhPythonScript(x=toggle_7, imagePaths=split.ListA, text1=series, text2=series_2)  # -> out, a; inputs x: Boolean, imagePaths: list, text1: list, text2: list; disabled
# ---------- python_11: Python ----------
import Rhino
import Eto.Forms as forms
import Eto.Drawing as drawing

class ImageTextCell(forms.StackLayout):
    def __init__(self, imagePath, text1a, text2a):
        super(ImageTextCell, self).__init__(Orientation=forms.Orientation.Vertical, Spacing=10)
        
        # Load and set the image
        try:
            image = drawing.Bitmap(imagePath)
            imageView = forms.ImageView()
            imageView.Image = image
            imageView.Size = drawing.Size(190, 190)  # Fixed size for images
        except Exception as e:
            imageView = forms.ImageView()  # Placeholder in case of error
            print("Failed to load image: " + str(e))
        
        # Create labels for the text
        label1 = forms.Label(Text=text1a)
#        label2 = forms.Label(Text=text2a)
        
        # Add the image view and labels to the cell layout
        self.Items.Add(imageView)
        self.Items.Add(label1)
#        self.Items.Add(label2)

class TestWindow(forms.Form):
    def __init__(self):
        self.Title = "Image Viewer"
        self.MinimumSize = drawing.Size(800, 400)
        self.scrollable = forms.Scrollable()
        self.imageLayout = forms.DynamicLayout()
        self.scrollable.Content = self.imageLayout
        self.Content = self.scrollable
        self.imageData = imagePaths
        self.textlist1 = text1
        self.textlist2 = text2
        self.populate_images()

    def populate_images(self):
        images_per_row = 1
        row = []

        for imagePath, text_1, text_2 in zip(self.imageData, self.textlist1, self.textlist2):
            cell = ImageTextCell(imagePath, text_1, text_2)
            row.append(cell)
            if len(row) == images_per_row:
                self.imageLayout.AddRow(*row)
                row = []
        
        if row:  # Add any remaining images to complete the last row
            while len(row) < images_per_row:  # Fill the rest of the row with placeholders if necessary
                row.append(forms.Label(Text=""))
            self.imageLayout.AddRow(*row)


# Creating and showing the window
window = TestWindow()
if x: window.Show()
# ---------- end python_11 ----------
python_12 = GhPythonScript(x=toggle_3, imagePath=panel_15)  # -> out, a; inputs x: Boolean; disabled
# ---------- python_12: Python ----------
import Rhino
import Eto.Forms as forms
import Eto.Drawing as drawing
import random as rnd

class TestWindow(forms.Form):
    def __init__(self):
        self.Size = drawing.Size(400, 400)
        
        layout = forms.DynamicLayout()
        layout.Spacing = drawing.Size(5, 5)
        
        # Input field for image path
        self.pathInput = forms.TextBox(PlaceholderText="Enter path to image")
        layout.AddRow(self.pathInput)
        
        # Button to load the image
        loadButton = forms.Button(Text="Load Image")
        loadButton.Click += self.OnLoadImage
        layout.AddRow(loadButton)
        
        # ImageView for displaying the image
        self.imageView = forms.ImageView()
        self.imageView.Size = drawing.Size(200, 200) # Adjust size as needed
        layout.AddRow(self.imageView)
        
#        # Buttons with actions
#        b1 = forms.Button(Text="Don't click me")
#        b1.Click += self.OnClick
#        b2 = forms.Button(Text="Whatever...")
#        layout.AddRow(b1, b2)
        
        self.Content = layout
    
    def OnLoadImage(self, sender, event):
        imagePath = self.pathInput.Text
        try:
            image = drawing.Bitmap(imagePath)
            self.imageView.Image = image
            forms.MessageBox.Show(imagePath)
        except Exception as e:
            forms.MessageBox.Show("Failed to load image: " + str(e))
    
    def OnClick(self, sender, event):
        try:
            # Corrected to call rnd.random() as a function
            color = drawing.Color(rnd.random(), rnd.random(), rnd.random(), 1)
            sender.BackgroundColor = color  # Changing to BackgroundColor for visibility
        except Exception as e:
            forms.MessageBox.Show("Error changing color: " + str(e))

# Creating and showing the window
window = TestWindow()
if x: window.Show()
# ---------- end python_12 ----------
python_13 = GhPythonScript(x=toggle_5, imagePath=panel_14)  # -> out, a; inputs x: Boolean; disabled
# ---------- python_13: Python ----------
import Rhino
import Eto.Forms as forms
import Eto.Drawing as drawing
import random as rnd

class TestWindow(forms.Form):
    def __init__(self):
        self.Size = drawing.Size(300, 300)
        
        column_of_buttons = forms.StackLayout()
        column_of_buttons.Spacing = 5
        b0 = forms.StackLayoutItem(forms.Button(Text="click me"))
        b0.HorizontalAlignment = forms.HorizontalAlignment.Center
        b1 = forms.Button(Text = "don\'t click me")
        b1.Click += self.OnClick
        b2 = forms.Button(Text="whatever...")
        column_of_buttons.Items.Add(b0)
        column_of_buttons.Items.Add(b1)
        column_of_buttons.Items.Add(b2)
        self.Content = column_of_buttons
    
    def OnClick(self, sender, event):
        try:
            color = drawing.Color(rnd.random(), rnd.random, rnd.random(), 1)
            sender.TextColor = color
        
        except: pass

window = TestWindow()

if x: window.Show()
# ---------- end python_13 ----------
python_14 = GhPythonScript(x=toggle_6, imagePath=panel_14)  # -> out, a; inputs x: Boolean; disabled
# ---------- python_14: Python ----------
import Rhino
import Eto.Forms as forms
import Eto.Drawing as drawing

class SimpleDialog(forms.Dialog):
    def __init__(self, imagePath):
        # Set up the dialog
        self.Title = "My Eto Dialog with Image"
        self.Resizable = True
        self.Padding = drawing.Padding(10)
        self.Size = drawing.Size(400, 300)

        # Create a text box
        self.textbox = forms.TextBox()

        # Create a button and its click event
        self.button = forms.Button(Text="Click Me")
        self.button.Click += self.OnButtonClick

        # Create an ImageView and load an image
        self.imageView = forms.ImageView()
        self.imageView.Size = drawing.Size(200, 200) # Adjust size as needed
        self.LoadImage(imagePath)

        # Create a layout and add the controls
        layout = forms.DynamicLayout()
        layout.AddRow(self.imageView)
        layout.AddRow(self.textbox)
        layout.AddRow(self.button)

        # Set the dialog content
        self.Content = layout

    def LoadImage(self, imagePath):
        try:
            image = drawing.Bitmap(imagePath)
            self.imageView.Image = image
        except Exception as e:
            forms.MessageBox.Show("Failed to load image: " + str(e))

    # Button click event handler
    def OnButtonClick(self, sender, e):
        forms.MessageBox.Show(self.textbox.Text)

def ShowSimpleDialogWithImage(imagePath):
    dialog = SimpleDialog(imagePath)
    dialog.ShowModal(Rhino.UI.RhinoEtoApp.MainWindow)

# Call the function to show the dialog
if x:
    ShowSimpleDialogWithImage(imagePath)
# ---------- end python_14 ----------
panel_24 = Panel(sicon)  # disabled
python_15 = GhPythonScript()  # -> out, a; disabled
# ---------- python_15: Python ----------
import Rhino
import scriptcontext
import System
import Rhino.UI
import Eto.Drawing as drawing
import Eto.Forms as forms
 
# SampleEtoRoomNumber dialog class
class SampleEtoRoomNumberDialog(forms.Dialog[bool]):

    def __init__(self, **kwargs):
        super(SampleEtoRoomNumberDialog, self).__init__(**kwargs)
        # Initialize dialog box
        self.Title = 'Sample Eto: Room Number'
        self.Padding = drawing.Padding(10)
        self.Resizable = False
 
        # Create controls for the dialog
        self.m_label = forms.Label()
        self.m_label.Text = 'Enter the Room Number:'
        self.m_textbox = forms.TextBox()
        self.m_textbox.Text = ""
 
        # Create the default button
        self.DefaultButton = forms.Button()
        self.DefaultButton.Text ='OK'
        self.DefaultButton.Click += self.OnOKButtonClick
 
        # Create the abort button
        self.AbortButton = forms.Button()
        self.AbortButton.Text ='Cancel'
        self.AbortButton.Click += self.OnCloseButtonClick
 
        # Create a table layout and add all the controls
        layout = forms.DynamicLayout()
        layout.Spacing = drawing.Size(5, 5)
        layout.AddRow(self.m_label, self.m_textbox)
        layout.AddRow(None) # spacer
        layout.AddRow(self.DefaultButton, self.AbortButton)
 
        # Set the dialog content
        self.Content = layout
 
    # Start of the class functions
 
    # Get the value of the textbox
    def GetText(self):
        return self.m_textbox.Text
 
    # Close button click handler
    def OnCloseButtonClick(self, sender, e):
        self.m_textbox.Text = ""
        self.Close(False)
 
    # OK button click handler
    def OnOKButtonClick(self, sender, e):
        if self.m_textbox.Text == "":
            self.Close(False)
        else:
            self.Close(True)
 
    ## End of Dialog Class ##
 
# The script that will be using the dialog.
def RequestRoomNumber():
    dialog = SampleEtoRoomNumberDialog();
    rc = dialog.ShowModal(Rhino.UI.RhinoEtoApp.MainWindow)
    if (rc):
        print(dialog.GetText()) #Print the Room Number from the dialog control
 
##########################################################################
# Check to see if this file is being executed as the "main" python
# script instead of being used as a module by some other python script
# This allows us to use the module which ever way we want.

RequestRoomNumber()
# ---------- end python_15 ----------
panel_25 = Panel(sbtn_2.Control)  # disabled
O = Options(flatten(["Alpha", "Beta", "Omega"]))  # disabled
number_slider_16 = Slider(1000, range=0..1000)  # disabled
number_slider_17 = Slider(1000, range=0..1000)  # disabled
panel_26 = Panel("""Size
Spacing""")  # disabled
strends = SynapseTrends(Size=complex, Numbers=flip, Name=graft(series_3), Color=graft(merge_2))  # -> ChartObject, ChartData; disabled
list = ValueList({"bullet", "box", "pointer", "arrow", "heart", "diamond", "circle", "pyramid"}, selected="bullet")  # disabled
sstack = SynapseStack(Property=flatten(panel_22), PropertyValue=flatten(size_2))  # -> AllProperties, Control; disabled
shrrchy = SynapseHierarchy(Size=complex, Numbers=merge_3, Colors=merge_2)  # -> ChartObject, ChartData; disabled
panel_27 = Panel("Marker")  # disabled
panel_28 = Panel("horizontal")  # disabled
sdomsl = SnpDomSlider()  # -> AllProperties, Control; disabled
panel_29 = Panel(O)  # disabled
X = Slider(42, range=1..50, expression="x*10")  # disabled
X_2 = Slider(50, range=1..50, expression="x*10")  # disabled
# some properties won't convert
# data type automatically
# manually enforce the integer type
D_3 = Slider(6, range=5..20)  # disabled
panel_30 = Panel("""Orientation
Size
Spacing""")  # disabled
number_slider_18 = Slider(4, range=1..4)  # disabled
panel_31 = Panel("Expanded")  # disabled
toggle_8 = BooleanToggle(True)  # disabled
panel_32 = Panel("200")  # disabled
pickone = SynapseSingleSelect(Options=flatten(panel_23))  # -> AllProperties, Control; disabled
slb = SynapseListBox(Options=flatten(panel_29))  # -> AllProperties, Control; disabled
merge_4 = Merge(Data1=flatten(panel_28), Data2=flatten(size), Data3=flatten(int))  # disabled
sstack_2 = SynapseStack(
    Property=flatten(panel_26),
    PropertyValue=flatten([size, int]),
    Controls=flatten([scombo.Control, sdm.Control, stb_2.Control]))  # -> AllProperties, Control; disabled
merge_5 = Merge(
    Data1=flatten(scb.Control),
    Data2=flatten(sbtn.Control),
    Data3=flatten(slbl.Control),
    Data4=flatten(snud.Control),
    Data5=flatten(ss.Control),
    Data6=flatten(stb.Control),
    Data7=flatten(sstack.Control))  # disabled
panel_33 = Panel("""Text|.txt
3D Files|.3dm,.obj,.skp
2D Files|.pdf,.dwg""")  # disabled
legend = SynapseLegend(Property=flatten(panel_27), PropertyValue=flatten(list), Data=shrrchy.ChartData)  # -> AllProperties, Legend; disabled
legend_2 = SynapseLegend(Property=flatten(panel_27), PropertyValue=flatten(list), Data=strends.ChartData)  # -> AllProperties, Legend; disabled
panel_34 = Panel("Width")  # disabled
int_4 = Integer(panel_32)  # disabled
int_5 = Integer(number_slider_16)  # disabled
int_6 = Integer(number_slider_17)  # disabled
int_7 = Integer(D_3)  # disabled
panel_35 = Panel("""Size
Padding
Spacing""")  # disabled
panel_36 = Panel("""padding
spacing
Width
Height""")  # disabled
smt = SynapseMultiTexts(Property=flatten(panel_34), PropertyValue=flatten(int_4))  # -> AllProperties, Control; disabled
sxpdr = SynapseExpander(Property=flatten(panel_31), PropertyValue=flatten(toggle_8), Controls=flatten([sdomsl.Control, pickone.Control]))  # -> AllProperties, Control; disabled
merge_6 = Merge(Data1=flatten(int_7), Data2=flatten(int_7), Data3=flatten(int_6), Data4=flatten(int_5))  # disabled
svalq = SnpValueQuery(SynapseObject=pickone.Control, Update=True)  # disabled
panel_37 = Panel("""Size
Padding
Spacing""")  # disabled
list_2 = ValueList({"graph 0": 0, "graph 1": 1}, selected="graph 1")  # disabled
stxy = SynapseTableXY(Controls=merge_5, Rows=number_slider_18)  # -> Coordinates, Dimensions; disabled
chart_legend = Data([shrrchy.ChartObject, legend.Legend])  # disabled
panel_38 = Panel("Filters")  # disabled
chart_legen = Data([strends.ChartObject, legend_2.Legend])  # disabled
sstack_3 = SynapseStack(Property=flatten(panel_30), PropertyValue=flatten(merge_4), Controls=flatten([slb.Control, sstack_2.Control]))  # -> AllProperties, Control; disabled
panel_39 = Panel("10")  # disabled
toggle_9 = BooleanToggle(True)  # disabled

toggle_10 = BooleanToggle(False)  # disabled
python_16 = GhPythonScript(x=toggle_10, imagePaths=split.ListA)  # -> out, a; inputs x: Boolean, imagePaths: list; disabled
# ---------- python_16: Python ----------
import Rhino
import Eto.Forms as forms
import Eto.Drawing as drawing

class TestWindow(forms.Form):
    def __init__(self):
        self.Title = "Image Viewer"
        self.MinimumSize = drawing.Size(100, 200)
        self.scrollable = forms.Scrollable()
        self.imageLayout = forms.DynamicLayout()
        
        
        self.scrollable.Content = self.imageLayout
        self.Content = self.scrollable
        
        self.imagePaths = imagePaths
        self.populate_images()

    def populate_images(self):
        images_per_row = 4
        row = []
        
        self.imageLayout2 = forms.DynamicLayout()
        count = 0
        temp = []

        for path in self.imagePaths:
            try:
                image = drawing.Bitmap(path)
                imageView = forms.ImageView()
                imageView.Image = image
                imageView.Size = drawing.Size(190, 190)  # Fixed size
                
                self.imageLayout2.AddRow(imageView)
                self.imageLayout2.AddRow(forms.Label(Text="asdf"))
                self.imageLayout2.AddRow(forms.Label(Text="qwerqwer"))
                
                
                temp.append(self.imageLayout2)
                self.imageLayout2 = forms.DynamicLayout()
                
                count += 1
                if count == 4:
                    count = 0
                    self.imageLayout.AddRow(*temp)
                    temp = []
                
            except Exception as e:
                forms.MessageBox.Show("Failed to load image: " + str(e))


# Creating and showing the window
window = TestWindow()
if x: window.Show()
# ---------- end python_16 ----------
panel_40 = Panel(python_16.out)  # disabled

toggle_11 = BooleanToggle(True)  # disabled
toggle_12 = BooleanToggle(False)  # disabled
int_8 = Integer([panel_39, number_slider_6])  # disabled
panel_41 = Panel("""Padding
Width""")  # disabled
table = SynapseTable(
    Property=flatten(panel_36),
    PropertyValue=flatten(merge_6),
    Controls=flatten(merge_5),
    ControlLocation=flatten(stxy.Coordinates),
    TableDimension=stxy.Dimensions)  # -> AllProperties, Control; disabled
sstack_4 = SynapseStack(Property=flatten(panel_37), PropertyValue=flatten([size, int_2, int]), Controls=flatten(sstack_3.Control))  # -> AllProperties, Control; disabled
sfile = SnpFilePicker(Property=flatten(panel_38), PropertyValue=flatten(panel_33))  # -> AllProperties, Control; disabled
filter = StreamFilter(Gate=list_2, Stream0=chart_legend, Stream1=chart_legen)  # disabled
sstack_5 = SynapseStack(Property=flatten(panel_35), PropertyValue=flatten([size, int_2, int]), Controls=flatten([smt.Control, sxpdr.Control]))  # -> AllProperties, Control; disabled
python_17 = GhPythonScript(x=toggle_9, imagePaths=split.ListA)  # -> out, a; inputs x: Boolean, imagePaths: list; disabled
# ---------- python_17: Python ----------
import Rhino
import Eto.Forms as forms
import Eto.Drawing as drawing

class TestWindow(forms.Form):
    def __init__(self):
        self.Title = "Image Viewer"
        self.MinimumSize = drawing.Size(100, 200)
        self.scrollable = forms.Scrollable()
        self.imageLayout = forms.DynamicLayout()
        self.scrollable.Content = self.imageLayout
        self.Content = self.scrollable
        self.imagePaths = imagePaths
        self.populate_images()

    def populate_images(self):
        images_per_row = 4
        row = []
        count = 0

        for path in self.imagePaths:
            try:
                # Create a StackLayout for each unit
                unitLayout = forms.StackLayout()
                unitLayout.Orientation = forms.Orientation.Vertical
                unitLayout.Spacing = 5  # Spacing between elements inside the unit
                unitLayout.Padding = drawing.Padding(10)  # Padding around the unit

                # Load the image
                image = drawing.Bitmap(path)
                imageView = forms.ImageView()
                imageView.Image = image
                imageView.Size = drawing.Size(190, 190)
                
                # Create a checkbox with the label "Select me"
                checkBox = forms.CheckBox(Text="Select me")
                
                
                # Add image, labels, and checkbox to the unit layout
                unitLayout.Items.Add(imageView)
                unitLayout.Items.Add(forms.Label(Text="asdf"))
                unitLayout.Items.Add(forms.Label(Text="qwerqwer"))
                unitLayout.Items.Add(checkBox)  # Add the checkbox to the unit

                # Add the unit layout to the row
                row.append(unitLayout)
                
                count += 1
                if count == images_per_row:
                    # Add the row to the main layout and reset for the next row
                    self.imageLayout.AddRow(*row)
                    row = []
                    count = 0
                
            except Exception as e:
                forms.MessageBox.Show("Failed to load image: " + str(e))
        
        # Add any remaining units to the layout
        if row:  # If there are items left in the row
            while len(row) < images_per_row:  # Optionally fill the rest of the row with placeholders
                row.append(forms.Label(Text=""))
            self.imageLayout.AddRow(*row)


# Creating and showing the window
window = TestWindow()
if x: window.Show()
# ---------- end python_17 ----------
python_18 = GhPythonScript(open=toggle_12, imagePaths=split.ListA)  # -> out, selectedIndices; inputs open: Boolean, imagePaths: list; disabled
# ---------- python_18: Python ----------
import Rhino
import Eto.Forms as forms
import Eto.Drawing as drawing

# Assume 'selectedIndices' is a global list defined outside this class 
# to store the indices of selected items. This is a simplification for demonstration.

selectedIndices = []  # This will be used to store the indices of selected items.

class TestWindow(forms.Dialog[bool]):  # Use Dialog[bool] for a modal dialog
    def __init__(self, imagePaths):
        super(TestWindow, self).__init__()
        self.Title = "Image Viewer"
        self.MinimumSize = drawing.Size(100, 100)
        
        self.Location = drawing.Point(100, 100)

        self.button = forms.Button(Text="Check Selected")
        self.button.Click += self.on_button_click

        self.checkBoxes = []

        self.layout = forms.DynamicLayout()
        self.layout.AddRow(self.button)

        self.scrollable = forms.Scrollable()
        self.imageLayout = forms.DynamicLayout()
        self.scrollable.Content = self.imageLayout
        self.layout.AddRow(self.scrollable)

        self.Content = self.layout

        self.imagePaths = imagePaths
        self.populate_images()

    def populate_images(self):
        images_per_row = 4
        row = []
        count = 0

        for path in self.imagePaths:
            try:
                unitLayout = forms.StackLayout()
                unitLayout.Orientation = forms.Orientation.Vertical
                unitLayout.Spacing = 5
                unitLayout.Padding = drawing.Padding(10)

                image = drawing.Bitmap(path)
                imageView = forms.ImageView()
                imageView.Image = image
                imageView.Size = drawing.Size(190, 190)

                checkBox = forms.CheckBox(Text="Select me")
                self.checkBoxes.append(checkBox)

                unitLayout.Items.Add(imageView)
                unitLayout.Items.Add(forms.Label(Text="Image Description1"))
                unitLayout.Items.Add(forms.Label(Text="Image Description2"))
                unitLayout.Items.Add(forms.Label(Text="Image Description3"))
                unitLayout.Items.Add(forms.Label(Text="Image Description4"))
                unitLayout.Items.Add(checkBox)

                row.append(unitLayout)

                count += 1
                if count == images_per_row:
                    self.imageLayout.AddRow(*row)
                    row = []
                    count = 0

            except Exception as e:
                forms.MessageBox.Show("Failed to load image: " + str(e))

        if row:
            self.imageLayout.AddRow(*row)

    def on_button_click(self, sender, e):
#        selectedIndices.clear()  # Clear the global list first
        for index, checkBox in enumerate(self.checkBoxes):
            if checkBox.Checked:
                selectedIndices.append(index)  # Update the global list with selected indices
        self.Close(True)  # Close the dialog

# Assuming 'showForm' is a boolean input to trigger the form display
if open:
    form = TestWindow(imagePaths)
    dialogResult = form.ShowModal(Rhino.UI.RhinoEtoApp.MainWindow)
# ---------- end python_18 ----------
python_19 = GhPythonScript(x=toggle_11, imagePaths=split.ListA)  # -> out, a; inputs x: Boolean, imagePaths: list; disabled
# ---------- python_19: Python ----------
import Rhino
import Eto.Forms as forms
import Eto.Drawing as drawing

class TestWindow(forms.Form):
    def __init__(self):
        self.Title = "Image Viewer"
        self.MinimumSize = drawing.Size(100, 200)
        self.scrollable = forms.Scrollable()
        self.imageLayout = forms.DynamicLayout()
        self.scrollable.Content = self.imageLayout
        self.Content = self.scrollable
        self.imagePaths = imagePaths
        self.populate_images()

    def populate_images(self):
        images_per_row = 4
        row = []
        count = 0

        for path in self.imagePaths:
            try:
                # Create a StackLayout for each unit
                unitLayout = forms.StackLayout()
                unitLayout.Orientation = forms.Orientation.Vertical
                unitLayout.Spacing = 5  # Spacing between elements inside the unit
                unitLayout.Padding = drawing.Padding(10)  # Padding around the unit

                # Load the image
                image = drawing.Bitmap(path)
                imageView = forms.ImageView()
                imageView.Image = image
                imageView.Size = drawing.Size(190, 190)
                
                # Add image and labels to the unit layout
                unitLayout.Items.Add(imageView)
                unitLayout.Items.Add(forms.Label(Text="asdf"))
                unitLayout.Items.Add(forms.Label(Text="qwerqwer"))

                # Add the unit layout to the row
                row.append(unitLayout)
                
                count += 1
                if count == images_per_row:
                    # Add the row to the main layout and reset for the next row
                    self.imageLayout.AddRow(*row)
                    row = []
                    count = 0
                
            except Exception as e:
                forms.MessageBox.Show("Failed to load image: " + str(e))
        
        # Add any remaining units to the layout
        if row:  # If there are items left in the row
            while len(row) < images_per_row:  # Optionally fill the rest of the row with placeholders
                row.append(forms.Label(Text=""))
            self.imageLayout.AddRow(*row)


# Creating and showing the window
window = TestWindow()
if x: window.Show()
# ---------- end python_19 ----------
sdlo = SynapseDynamicLayout(Property=flatten(panel_41), PropertyValue=flatten(int_8), Controls=flatten(filter))  # -> AllProperties, Control; disabled
sdylo = SnpDynaLayout(Controls=flatten(table.Control))  # -> AllProperties, Control; disabled
panel_42 = Panel(python_18.selectedIndices)  # disabled
Y = Slider(50, range=1..50, expression="x*10")  # disabled
X_3 = Slider(50, range=1..50, expression="x*10")  # disabled
number_slider_19 = Slider(10, range=1..50, expression="x*10")  # disabled
number_slider_20 = Slider(9, range=1..50, expression="x*10")  # disabled
swatch_3 = ColourSwatch(SwatchColor=RGB(50, 132, 209))  # disabled
panel_43 = Panel("NimbleDashboard")  # disabled
argb_2 = SplitARGB(Colour=swatch_3, IntegerChannels=True)  # -> Alpha, Red, Green, Blue; disabled
padding = Slider(1, range=1..15)  # disabled
merge_7 = Merge(
    Data1=flatten(sdylo.Control),
    Data2=flatten(sstack_5.Control),
    Data3=flatten(sstack_4.Control),
    Data4=flatten(sdlo.Control))  # disabled
vec = VectorXYZ(XComponent=X_3, YComponent=Y, ZComponent=0)  # -> Vector, Length; disabled
pypt = GhPythonScript(x=number_slider_20, y=number_slider_19)  # -> out, p; inputs x: Int32, y: Int32; disabled
# ---------- pypt: Python ----------
"""creating an Eto.Drawing.Point object for Synapse plugin to consume.
    Inputs:
        x: x coordinate
        y: y coordinate
    Output:
        p: point object"""

__author__ = "wwang"
__version__ = "2021.02.19"

import Eto.Drawing as drw

p = drw.Point(x,y)
# ---------- end pypt ----------
scolor_2 = SynapseColor(Alpha=argb_2.Alpha, Red=argb_2.Red, Green=argb_2.Green, Blue=argb_2.Blue)  # disabled
panel_44 = Panel("SelectedIndex")  # disabled
list_3 = ValueList({"1st": 0, "2nd": 1, "3rd": 2, "4th": 3}, selected="1st")  # disabled
resizable = BooleanToggle(True)  # disabled
topmost = BooleanToggle(True)  # disabled
panel_45 = Panel("""Alpha
Beta
Gamma
Delta""")  # disabled
panel_46 = Panel("""Alpha
Beta""")  # disabled
int_9 = Integer(padding)  # disabled
int_10 = Integer(list_3)  # disabled
panel_47 = Panel("""color
title
Location
size
Topmost
Padding
Resizable""")  # disabled
merge_8 = Merge(
    Data1=flatten(scolor_2),
    Data2=flatten(panel_43),
    Data3=flatten(pypt.p),
    Data4=flatten(vec.Vector),
    Data5=flatten(topmost),
    Data6=flatten(int_9),
    Data7=flatten(resizable))  # disabled
tab = SynapseTabs(Property=flatten(panel_44), PropertyValue=flatten(int_10), Controls=flatten(merge_7), TabName=flatten(panel_45))  # -> AllProperties, Control; disabled
showwindow = BooleanToggle(True)  # disabled
swindow = SynapseWindow(
    Show=showwindow,
    Property=flatten(panel_47),
    PropertyValue=flatten(merge_8),
    Contents=flatten(tab.Control),
    ctrlfill=True,
    ctrlredo=True,
    ghowned=False)  # -> AllProperties, Window; disabled
sendtorhpanel = BooleanToggle(True)  # disabled
rcp = RemotePanel(Send=sendtorhpanel, Window=swindow.Window)  # disabled
