# Grasshopper definition 231204_GenScript.gh (Grasshopper 1.0.7)
# plug-ins: RhinoCodePluginGH

# General goal is to go through all the previous precidents and come up with digital tools that can leviate parts of the burden from the student espeacill in area/ co2/ cost estimation but not to help them build the whole house
panel = Panel("Type Selection")
panel_2 = Panel("holz")
panel_3 = Panel("beton")
panel_4 = Panel("stein")
# goal for tomorrow
# 1.get UUID script
# 2.define input shape after query
# 3.Orient Script
function = ValueList({"structure": 0, "boden": 1, "fassaden": 2, "dach": 3}, selected="structure")
# Rule Generation based on Type of materials and purposes
script = Script(material="stahl", function=function)  # -> out, ruleDisplay, rule; inputs material: String, function: Int32
# ---------- script: Python ----------
if material == "stahl" and function == 0:
    ruleDisplay = "Stahl could be extended and cut"

if material == "holz" and function == 0:
    ruleDisplay = "holz could only be cut but could not be extended"

rule = [material, function]
print(rule, ruleDisplay)
# ---------- end script ----------
panel_5 = Panel(script.ruleDisplay)
geometry = Geometry([<extrusion referenced from the Rhino model> x6])
geometry_2 = Geometry([<curve referenced from the Rhino model> x4])
geometry_3 = Geometry(<extrusion referenced from the Rhino model>)
line = Line(Line((5468.8517, 4333.3966, 6781.594301), (7486.975825, 2580.961498, 6063.05932)))
panel_6 = Panel("Algorithm provider")
uuid_generator = Script(things=geometry, lines=geometry_2)  # -> out, GUID_THINGS, GUID_LINES; inputs things: list of Brep, lines: list of Line
# ---------- uuid_generator: Python ----------
import uuid

# Namespace definition
# -------------------------------------------------
class GUID:
    def __init__ (self, ID, Geometry, Height = None, Width = None, Length = None):
        self.ID = ID
        self.Geometry = Geometry #saving the rhino geometry
        self.Height = Height
        self.Width = Width
        self.Length = Length

class NODE:
    def __init__(self,value):
        self.next = None
        self.value = value #self.value = GUID(ID, Geometry)
class LINKEDLIST:
    def __init__ (self):
        self.node = None
        self.head = None
        self.length = 0
    
    def append(self, value):
        newNode = NODE(value)
        current = self.head
        self.length += 1
        if self.head == None:
            self.head = newNode
            return newNode
        while current.next != None:
            current = current.next
        current.next = newNode
        return newNode

    def traverse(self):
        current = self.head
        while current != None:
            print(current.value)
            current = current.next

    def goto(self, position):
        current = self.head
        for i in range(position):
            current = current.next
        return current

    def pop(self, position = None):
        if position == 0:
            self.head = self.head.next
        if position == None:
             positon = self.length
        if position > self.length or position < 0:
            raise Exception("index out of range")

        current = self.goto(position- 1 )
        current.next = current.next.next
        self.length -= 1
        return current.next
    
    def insert(self, value, position):
        # pass exception here eg position > self.length
        node = NODE(value)
        pointer1 = self.goto(position -1 )
        pointer2 = pointer1.next.next
        pointer1.next = node
        node.next = pointer2
        self.lenth += 1
        return node


# -------------------------------------------------
GUID_LINES = LINKEDLIST()
GUID_THINGS = LINKEDLIST()

# for test purpose
length = [4000, 4000, 4000, 6000, 6000, 5500]

for i,thing in enumerate(things):
    # things id are unnecessary as it is provided by the query.
    thingID = uuid.uuid1()
    obj = GUID(thingID, thing, Length = length[i])
    GUID_THINGS.append(obj)
    
for line in lines:
    lineID = uuid.uuid1()
    obj = GUID(lineID, thing, Length =line.Length)
    GUID_LINES.append(obj)



GUID_THINGS.traverse()


# order is not important unless it is sorted 
# dimensions are important
# few things you wanna know which piece of woods/ steel it comes from
# the list will extend as you cut it 
Input = [
    {
        "object": "rhino object",
        "quantity":56,
        "length":12,
        "height": 20,
        "width": 65

    }
]
# ---------- end uuid_generator ----------
script_2 = Script(rule=script.rule, things=uuid_generator.GUID_THINGS, lines=uuid_generator.GUID_LINES)  # -> out, a
# ---------- script_2: Python ----------
import Rhino.Geometry as rg


Alg1 = "LengthAlgorithm"
Alg2 = "PackingAlgorithm" 


# Later need to convert the below code to be search for linkedlist
print("haha")
print(things.head.value)

def list_export():
    list = []
    current = things.head
    while current != None:
        current = current.next
        list.append()

things.traverse()

# LengthAlgorithm Meow
# -------------------------------------------------
# nearest neighbour
def find_closest_element(target, lst):
    return min(lst, key=lambda x: abs(x - target))

# nearest positive neighbour return null if no bigger is found
def find_closest_larger_element(target, lst):
    temp = [list(filter(lambda x: x>=0, map(lambda x: (x-num), target)))
    for num in lst]
    temp = [sublist[0] if len(sublist) != 0 else None for sublist in temp]
    return temp


def find_closest_elements(list_a, list_b, mode):
    if mode == "cloest":
        return [find_closest_element(target, list_a) for target in list_b]
    elif mode == "cloestPositive":
        return [find_closest_larger_element(target, list_a) if target != None else None
        for target in list_b]

# List_a should contain UUID of the object 
# ideallly it should be a list of dictionary of 
# {UUID, Length, Quantity}
# list_a = [4000, 4000, 4000, 6000, 6000, 5500]
# UUID_a = ["a", "b", "c", "d", "e"]
# list_b = [line.Length for line in lines]

# result = find_closest_elements(list_a, list_b, "cloest")
# print(find_closest_larger_element(list_a, list_b))

# On what cases are possible to add ? 
# for line in lines:
#     print(line.Length)


# print(result)
# ---------- end script_2 ----------
script_3 = Script(things=geometry_3, lines=line)  # -> out, a
# ---------- script_3: Python ----------
# Script for orient
import Rhino.Geometry as rg
# use the following but we need to first define the planes cryyyy
# rg.Transform.PlaneToPlane(p1,p2)
# ---------- end script_3 ----------
panel_7 = Panel(uuid_generator.GUID_THINGS)
panel_8 = Panel(uuid_generator.GUID_LINES)
panel_9 = Panel("Optimization")
panel_10 = Panel("Visualization")
