# Grasshopper definition 231204_GenScript2.gh (Grasshopper 1.0.7)
# plug-ins: RhinoCodePluginGH

# General goal is to go through all the previous precidents and come up with digital tools that can leviate parts of the burden from the student espeacill in area/ co2/ cost estimation but not to help them build the whole house
panel = Panel("Type Selection")
panel_2 = Panel("holz")
panel_3 = Panel("beton")
panel_4 = Panel("stein")
# goal for tomorrow
# 1.get UUID script
# 2.define input shape after query
# 3.Orient Script
function = ValueList({"structure": 0, "boden": 1, "fassaden": 2, "dach": 3}, selected="structure")
# Rule Generation based on Type of materials and purposes
script = Script(material="stahl", function=function)  # -> out, ruleDisplay, rule; inputs material: String, function: Int32
# ---------- script: Python ----------
if material == "stahl" and function == 0:
    ruleDisplay = "Stahl could be extended and cut"

if material == "holz" and function == 0:
    ruleDisplay = "holz could only be cut but could not be extended"

rule = [material, function]
print(rule, ruleDisplay)
# ---------- end script ----------
panel_5 = Panel(script.ruleDisplay)
run = BooleanToggle(False)
reset = Button()
interval = Slider(800, range=0..1000)
geometry = Geometry(<extrusion referenced from the Rhino model>)
# Task today
# - Orient object based on UUID
# 
# - Cut something and automatically add it into the linked list
# 
# - Set the script automatic for detecting cut in layers
line = Line(Line((7486.975825, 2580.961498, 6063.05932), (5468.8517, 4333.3966, 6781.594301)))
panel_6 = Panel("Algorithm provider")
automatic_updates_on_the_2_layers = Script(Run=run, Reset=reset, Target=10000, Interval=interval)  # -> out, Counter, things, lines; inputs Run: Boolean, Target: Int32, Interval: Int32
# ---------- automatic_updates_on_the_2_layers: Python ----------
import Rhino
import Grasshopper as gh
doc = Rhino.RhinoDoc.ActiveDoc
LWorkspace = doc.Layers[2]
LStructure = doc.Layers[3]
things = [thing for thing in doc.Objects.FindByLayer(LWorkspace)]
lines = [line for line in doc.Objects.FindByLayer(LStructure)]

a = len(things)
b= len (lines)
def updateComponent(interval):
    
    """ Update this component similar to using a grasshopper timer """
    
    def callBack(e):
        ghenv.Component.ExpireSolution(False)

        if len(things) != a:
            things = [thing for thing in doc.Objects.FindByLayer(LWorkspace)]
        if len(lines) != b:
            lines = [line for line in doc.Objects.FindByLayer(LStructure)]

    ghenv.Component.OnPingDocument().ScheduleSolution(interval,
    gh.Kernel.GH_Document.GH_ScheduleDelegate(callBack))

# Instantiate or reset persistent counter variable
if "count" not in globals() or Reset:
    count = 0

# Update the variable and component
if Run and not Reset and count < Target:
    count +=1
    updateComponent(Interval)

# Output counter
Counter = count
# ---------- end automatic_updates_on_the_2_layers ----------
uuid_generator = Script(
    things=automatic_updates_on_the_2_layers.things,
    lines=automatic_updates_on_the_2_layers.lines,
    run=Button(ExpressionNormal="True"))  # -> out, GUID_THINGS, GUID_LINES, workspace; inputs things: list, lines: list, run: Boolean
# ---------- uuid_generator: Python ----------
import rhinoscriptsyntax as rs
import Rhino


# Namespace definition
# -------------------------------------------------
class GUID:
    def __init__ (self, ID, Geometry, Height = None, Width = None, Length = None):
        self.ID = ID
        self.Geometry = Geometry #saving the rhino geometry
        self.Height = Height
        self.Width = Width
        self.Length = Length
class NODE:
    def __init__(self,value):
        self.next = None
        self.value = value #self.value = GUID(ID, Geometry)
class LINKEDLIST:
    def __init__ (self):
        self.node = None
        self.head = None
        self.length = 0
    
    def append(self, value):
        newNode = NODE(value)
        current = self.head
        self.length += 1
        if self.head == None:
            self.head = newNode
            return newNode
        while current.next != None:
            current = current.next
        current.next = newNode
        return newNode

    def traverse(self):
        current = self.head
        while current != None:
            print(current.value)
            current = current.next

    def goto(self, position):
        current = self.head
        for i in range(position):
            current = current.next
        return current

    def pop(self, position = None):
        if position == 0:
            self.head = self.head.next
        if position == None:
             positon = self.length
        if position > self.length or position < 0:
            raise Exception("index out of range")

        current = self.goto(position- 1 )
        current.next = current.next.next
        self.length -= 1
        return current.next
    
    def insert(self, value, position):
        # pass exception here eg position > self.length
        node = NODE(value)
        pointer1 = self.goto(position -1 )
        pointer2 = pointer1.next.next
        pointer1.next = node
        node.next = pointer2
        self.lenth += 1
        return node
    
    def list_export(self, attribute):
        lst = []
        current = self.head
        while current != None:
            value_attribute = getattr(current.value, attribute)
            lst.append(value_attribute)
            current = current.next
        return lst


# -------------------------------------------------
GUID_LINES = LINKEDLIST()
GUID_THINGS = LINKEDLIST()

# for test purpose
length = [4000, 4000, 4000, 6000, 6000, 5500] + [4000] * 20




if run:
    for i,thing in enumerate(things):
        # things id are unnecessary as it is provided by the query.
        thingID = thing.Id
        geo = thing.Geometry
        # print(geo.Edges[2].Dimension)

        try:
            obj = GUID(thingID, geo, Length = length[i])
        except:
            obj = GUID(thingID, thing.Geometry)
        GUID_THINGS.append(obj)
        
    for line in lines:
        lineID = line.Id
        l = line.CurveGeometry
        obj = GUID(lineID, l, Length =l.GetLength())
        GUID_LINES.append(obj)



GUID_THINGS.traverse()
workspace = [thing.Geometry for thing in things]

# order is not important unless it is sorted 
# dimensions are important
# few things you wanna know which piece of woods/ steel it comes from
# the list will extend as you cut it
# ---------- end uuid_generator ----------
script_2 = Script(rule=script.rule, things=uuid_generator.GUID_THINGS, lines=uuid_generator.GUID_LINES)  # -> out, result
# ---------- script_2: Python ----------
import Rhino.Geometry as rg


# Later need to convert the below code to be search for linkedlist
# print(things.head.value.ID)
list_a = things.list_export("Length")
list_b = lines.list_export("Length")


# LengthAlgorithm Meow
# -------------------------------------------------
# nearest neighbour

# input linked list of lines, and linked list of 

def find_closest_element(linked_list_a, linked_list_b, attribute):
    result = []

    current_b = linked_list_b.head
    while current_b != None:
        target = getattr(current_b.value, attribute)
        current_a = linked_list_a.head
        closest_value = None
        closest_distance = abs(getattr(linked_list_a.head.value, attribute)- target)

        while current_a.next != None:
            distance = abs(getattr(current_a.value, attribute)- target)
            if distance <= closest_distance:
                closest_distance = distance
                closest_value = current_a.value
            current_a = current_a.next

        result.append(closest_value.Geometry)
        current_b = current_b.next

    return result 

result = find_closest_element(things, lines, "Length")
print(result)

def find_closest_element(target, lst):
    return min(lst, key=lambda x: abs(x - target))

# nearest positive neighbour return null if no bigger is found
def find_closest_larger_element(target, lst):
    temp = [list(filter(lambda x: x>=0, map(lambda x: (x-num), target)))
    for num in lst]
    temp = [sublist[0] if len(sublist) != 0 else None for sublist in temp]
    return temp


def find_closest_elements(list_a, list_b, mode):
    if mode == "cloest":
        return [find_closest_element(target, list_a) for target in list_b]
    elif mode == "cloestPositive":
        return [find_closest_larger_element(target, list_a) if target != None else None
        for target in list_b]
# ---------- end script_2 ----------
script_3 = Script(things=geometry, lines=line)  # -> out, a, b; inputs things: Brep
# ---------- script_3: Python ----------
import Rhino.Geometry as rg

def bounding_box_center_axis(brep):
    # Get the bounding box of the BRep
    bounding_box = brep.GetBoundingBox(False)

    # Calculate the center of the bounding box
    center = bounding_box.Center

    # Get the dimensions of the bounding box
    x_extent = bounding_box.Max.X - bounding_box.Min.X
    y_extent = bounding_box.Max.Y - bounding_box.Min.Y
    z_extent = bounding_box.Max.Z - bounding_box.Min.Z

    # Create the start and end points of the central axis
    start_point = rg.Point3d(center.X - x_extent / 2, center.Y - y_extent / 2, center.Z - z_extent / 2)
    end_point = rg.Point3d(center.X + x_extent / 2, center.Y + y_extent / 2, center.Z + z_extent / 2)

    # Create a plane using WorldXY as a reference plane
    reference_plane = rg.Plane.WorldXY

    # Translate the plane to the start point
    start_plane = reference_plane.Clone()
    start_plane.Origin = start_point

    # Translate the plane to the end point
    end_plane = reference_plane.Clone()
    end_plane.Origin = end_point

    return rg.LineCurve(start_point, end_point)

a = bounding_box_center_axis(things)
print(a)
# ---------- end script_3 ----------
orient = Orient(Geometry=geometry, Source=script_3.a, Target=line)  # -> Geometry, Transform
panel_7 = Panel(script_3.a)
panel_8 = Panel(uuid_generator.GUID_THINGS)
panel_9 = Panel(script_2.result)
panel_10 = Panel(automatic_updates_on_the_2_layers.Counter)
brep = Brep(uuid_generator.workspace)
panel_11 = Panel(uuid_generator.GUID_LINES)
panel_12 = Panel("Optimization")
panel_13 = Panel("Visualization")
