# Grasshopper definition 240118_GenScript.gh (Grasshopper 1.0.7)
# plug-ins: RhinoCodePluginGH, Pufferfish

panel = Panel("beton")
panel_2 = Panel("stein")
function = ValueList({"structure": 0, "boden": 1, "fassaden": 2, "dach": 3}, selected="structure")
# General goal is to go through all the previous precidents and come up with digital tools that can leviate parts of the burden from the student espeacill in area/ co2/ cost estimation but not to help them build the whole house
# Task today
# - Orient object based on UUID
# 
# - Cut something and automatically add it into the linked list
# 
# - Set the script automatic for detecting cut in layers
# Task today
# - Solve Duplicate Problem with linked list
# 
# - Look at Dynamic progrtamming
# 
# - Check why the new geometry are not taken into account
# 
# - Optimizatzion no need to create a new linked list everytime things are added but need to add node and recalculate best match
# 
# - Mapping the Text Name
# 
# - The order of the list will affect which one is best match
panel_3 = Panel("Type Selection")
panel_4 = Panel("stahl")
# Rule Generation based on Type of materials and purposes
script = Script(material="holz", function=function)  # -> out, ruleDisplay, rule; inputs material: String, function: Int32
# ---------- script: Python ----------
if material == "stahl" and function == 0:
    ruleDisplay = "Stahl could be extended and cut"

if material == "holz" and function == 0:
    ruleDisplay = "holz could only be cut but could not be extended"

rule = [material, function]
print(rule, ruleDisplay)
# ---------- end script ----------
panel_5 = Panel(script.ruleDisplay)
run = Button(ExpressionNormal="True", ExpressionPressed="False")
boolean_toggle = BooleanToggle(False)
number_slider = Slider(11, range=0..100)
run_2 = Button(ExpressionNormal="True", ExpressionPressed="False")
button = Button(ExpressionNormal="True", ExpressionPressed="False")
number_slider_2 = Slider(11, range=0..100)
geometry_pipeline = GeometryPipeline(
    GroupByLayer=False,
    GroupByType=False,
    IncludeHidden=True,
    IncludeLocked=True,
    LayerFilter="BFH_ReUse24::Structure2::C2",
    NameFilter="*",
    SublayerFiltering=True,
    TypeFilter=4)
geometry_pipeline_2 = GeometryPipeline(
    GroupByLayer=False,
    GroupByType=False,
    IncludeHidden=True,
    IncludeLocked=True,
    LayerFilter="BFH_ReUse24::Workspace2",
    NameFilter="*",
    SublayerFiltering=True,
    TypeFilter=1073741848)
geometry_pipeline_3 = GeometryPipeline(
    GroupByLayer=False,
    GroupByType=False,
    IncludeHidden=True,
    IncludeLocked=True,
    LayerFilter="BFH_ReUse24::Structure2::A",
    NameFilter="*",
    SublayerFiltering=True,
    TypeFilter=4)
geometry_pipeline_4 = GeometryPipeline(
    GroupByLayer=False,
    GroupByType=False,
    IncludeHidden=True,
    IncludeLocked=True,
    LayerFilter="BFH_ReUse24::Structure2::B",
    NameFilter="*",
    SublayerFiltering=True,
    TypeFilter=4)
geometry_pipeline_5 = GeometryPipeline(
    GroupByLayer=False,
    GroupByType=False,
    IncludeHidden=True,
    IncludeLocked=True,
    LayerFilter="BFH_ReUse24::Structure2::C",
    NameFilter="*",
    SublayerFiltering=True,
    TypeFilter=4)
geometry_pipeline_6 = GeometryPipeline(
    GroupByLayer=False,
    GroupByType=False,
    IncludeHidden=True,
    IncludeLocked=True,
    LayerFilter="BFH_ReUse24::Structure2::D",
    NameFilter="*",
    SublayerFiltering=True,
    TypeFilter=4)
# The original Material shiould have one linked list and keep appending/ prepending to that list.
# Opt1- Greedy
# Algorithm
# Opt2- Dynamic Programming
# Opt 3 - Sorted Linked List
# define connectors
# what kind of connectors should there be
# parameter to decide
# optimisation
# Task Today
# 
# 
# 2. Research a bit on connectors and infill between structure and  cladding
# 3.Study DSA and Dynamic Programming
# task it to do a 1. connector script
# 2. To combine multiple things for the length of one line.
# 3. Minimise cut/ minimise waste
panel_6 = Panel("Algorithm provider")
geometry_pipeline_7 = GeometryPipeline(
    GroupByLayer=False,
    GroupByType=False,
    IncludeHidden=True,
    IncludeLocked=True,
    LayerFilter="BFH_ReUse24::Workspace",
    NameFilter="*",
    SublayerFiltering=True,
    TypeFilter=1073741848)
geometry_pipeline_8 = GeometryPipeline(
    GroupByLayer=False,
    GroupByType=False,
    IncludeHidden=True,
    IncludeLocked=True,
    LayerFilter="BFH_ReUse24::Structure::A",
    NameFilter="*",
    SublayerFiltering=True,
    TypeFilter=4)
geometry_pipeline_9 = GeometryPipeline(
    GroupByLayer=False,
    GroupByType=False,
    IncludeHidden=True,
    IncludeLocked=True,
    LayerFilter="BFH_ReUse24::Structure::B",
    NameFilter="*",
    SublayerFiltering=True,
    TypeFilter=4)
geometry_pipeline_10 = GeometryPipeline(
    GroupByLayer=False,
    GroupByType=False,
    IncludeHidden=True,
    IncludeLocked=True,
    LayerFilter="BFH_ReUse24::Structure::C",
    NameFilter="*",
    SublayerFiltering=True,
    TypeFilter=4)
uuid_generator = Script(
    things=geometry_pipeline_2,
    A=geometry_pipeline_3,
    B=geometry_pipeline_4,
    C=geometry_pipeline_5,
    C2=geometry_pipeline,
    run=run_2,
    rule=run_2,
    shuffle=Toggle(False))  # -> out, GUID_THINGS, GUID_LINES_A, GUID_LINES_B, GUID_LINES_C, GUID_LINES_C2, ThingsLengthT, LinesLengthT; inputs things: list, A: list of Curve, B: list of Curve, C: list of Curve, C2: list of Curve, run: Boolean, seed: Int32
# ---------- uuid_generator: Python ----------
import Rhino
import copy
import rhinoscriptsyntax as rs
import Rhino.Geometry as rg
import random

# Namespace definition
# -------------------------------------------------
class GUID:
    def __init__ (self, ID, Geometry, Type):
        self.ID = ID
        self.Geometry = Geometry #saving the rhino geometry
        self.Type = Type
        self.Cut = None
        self.Connector = None
        self.update_info()

    def update_info(self, mode = None, manual = None):
        if self.Type == "Brep":
            self.info = self.bounding_box_dimensions(self.Geometry)
            self.Length = self.info[0][0]
            self.Width = self.info[0][1]
            self.Height = self.info[0][2]
            self.AxisX = self.info[1][0]
            self.AxisY = self.info[1][1]
            self.AxisZ = self.info[1][2]
            self.x_cut_plane = self.info[2][0]
            self.y_cut_plane = self.info[2][1]
            self.z_cut_plane = self.info[2][2]
            self.Bbox = self.info[3]
        elif self.Type == "Line":
            self.Connector = self.Geometry.PointAtStart
            if type(self.Geometry) == rg.Line:
                self.Length = self.Geometry.Length
                return
            self.Length = rg.Curve.GetLength(self.Geometry)


    def bounding_box_dimensions(self, obj):
        if type(obj) == rg.Brep:
            vertices = [vertex.Location for vertex in obj.Vertices]
            bounding_box = rg.BoundingBox(vertices)
        else:
            vertices = [vertex.Location for vertex in obj.ToBrep().Vertices]
            bounding_box = rg.BoundingBox(vertices)

        # Calculate the dimensions of the bounding box
       
        x_extent = bounding_box.Max.X - bounding_box.Min.X
        y_extent = bounding_box.Max.Y - bounding_box.Min.Y
        z_extent = bounding_box.Max.Z - bounding_box.Min.Z
        


        # Create the start and end points of the central axis
        center = bounding_box.Center
        start_pointX = rg.Point3d(center.X - x_extent / 2, center.Y, center.Z)
        end_pointX = rg.Point3d(center.X + x_extent / 2, center.Y, center.Z)

        start_pointY = rg.Point3d(center.X , center.Y - y_extent / 2, center.Z)
        end_pointY = rg.Point3d(center.X , center.Y + y_extent / 2, center.Z)

        start_pointZ = rg.Point3d(center.X, center.Y, center.Z -z_extent/2)
        end_pointZ = rg.Point3d(center.X, center.Y, center.Z + z_extent)


        x_line = rg.LineCurve(start_pointX, end_pointX)
        y_line = rg.LineCurve(start_pointY, end_pointY)
        z_line = rg.LineCurve(start_pointZ, end_pointZ)

        x_cut_plane = rg.Plane(rg.Point3d(start_pointX.X, start_pointX.Y-y_extent/2, start_pointX.Z),
        rg.Vector3d(0,1,0))
        y_cut_plane = rg.Plane(rg.Point3d(start_pointY.X - x_extent/2, start_pointY.Y, start_pointY.Z), 
        rg.Vector3d(1,0,0))
        z_cut_plane = rg.Plane(rg.Point3d(start_pointZ.X , start_pointZ.Y, start_pointZ.Z),
        rg.Vector3d(0,0,1))

        return ((x_extent, y_extent, z_extent),
                (x_line, y_line, z_line),
                (x_cut_plane, y_cut_plane, z_cut_plane),
                bounding_box)

    def factory_method(self, ID, Geometry, Type):
        G = GUID(ID, Geometry,Type)
        return G

class NODE:
    def __init__(self, value):
        self.next = None
        self.prev = None
        self.value = value #self.value = GUID(ID, Geometry)
        self.closest = None #for lines, the cloest one to other link list
        self.CD = 100000000

    def split(self, obj, linked_list, obj_type, length = None):
        # Caution: Brep here is a Brep List !!!
        if self.value is not None:
            if obj_type == "Brep":
                self.value.Geometry = obj[0]
                self.value.update_info()
                splited_Node = NODE(GUID(self.value.ID + "/", obj[1], "Brep"))
                splited_Node.next = self.next
                self.next = splited_Node
            if obj_type == "Line":
                # Line is just a single line cryyy so dumb RG
                start_pt = rg.PointAtStart
                end_pt = rg.PointAtEnd
                pt = obj.DivideByLength(length, True, False)
                line1 = rg.Line(start_pt, pt)
                line2 = rg.Line(pt, end_pt)
                self.value.Geometry = line1
                self.value.update_info()
                splited_Node = NODE(GUID(self.value.ID + "/", line2, "Line"))
                splited_Node.next = self.next
                self.next = splited_Node
            
            linked_list.length += 1

    def factory_method(self, ID, obj, obj_type = "Line"):
        N = NODE(value = GUID(ID, obj, obj_type))
        return N

class LINKEDLIST:
    def __init__ (self):
        self.node = None
        self.head = None
        self.tail = None
        self.length = 0
    
    def append(self, value):
        newNode = NODE(value)
        current = self.head
        self.length += 1
        if self.head == None:
            self.head = newNode
            self.tail = newNode
            return newNode
        while current.next != None:
            current = current.next
            
        newNode.prev = current
        current.next = newNode
        self.tail = newNode
        return newNode

    def prepend(self, value):
        newNode = NODE(value)
        self.length +=1

        if self.head == None:
            self.head = newNode
            self.tail = newNode
            return self
        self.head.prev = newNode
        newNode.next = self.head
        self.head = newNode
        return self

    def traverse(self, action = None):
        current = self.head
        while current != None:
            if action:
                action()
            else:
                print(current)
            current = current.next

    def goto(self, position):
        current = self.head
        for i in range(position):
            if current != None:
                current = current.next
            else:
                raise IndexError("Index out of range")

        return current

    def pop(self, position = None):
        if position == None:
            position = self.length -1
            self.length -= 1
        if position == 0:
            if self.head != None:
                pop = self.goto(position)
                self.head = self.head.next
                self.length -= 1
                return pop
            else: 
                raise IndexError("Index out of range")
        if position >= self.length or position < 0:
            raise Exception("index out of range")

        previous = self.goto(position- 1)
        if previous != None and previous.next != None:
            previous.next = previous.next.next
            self.length -= 1
        else:
            raise IndexError("Index out of range")
        return previous

    
    def insert(self, value, position):
        # pass exception here eg position > self.length
        node = NODE(value)
        pointer1 = self.goto(position -1 )
        pointer2 = pointer1.next.next
        pointer1.next = node
        node.prev = pointer1 
        node.next = pointer2
        self.lenth += 1
        return node
    
    def list_export(self, attribute):
        lst = []
        current = self.head
        while current != None:
            value_attribute = getattr(current.value, attribute)
            lst.append(value_attribute)
            current = current.next
        return lst

    def copy(self):
        LS = LINKEDLIST()
        current = self.head
        while current != None:
            new_node = NODE(copy.deepcopy(current.value))
            LS.append(new_node)
            current = current.next
        return LS
    
    def concat(self, linked_list):
        if linked_list.head == None or self.head == None:
            raise Exception("Sorry both list must not be empty la")
        linked_list_tail = linked_list.tail
        linked_list.head.prev = self.tail
        self.tail.next = linked_list.head
        self.tail = linked_list_tail
        self.length += linked_list.length
        return self

    def reverse(self):
        prev = None
        current = self.head
        while(current is not None):
            next = current.next
            current.next = prev
            prev = current
            current = next
        self.head = prev
    
    def factory_method(self):
        LS = LINKEDLIST()
        return LS



# -------------------------------------------------
GUID_LINES_A = LINKEDLIST()
GUID_LINES_B = LINKEDLIST()
GUID_LINES_C = LINKEDLIST()
GUID_LINES_C2 = LINKEDLIST()
GUID_THINGS = LINKEDLIST()

# for test purpose

def shuffle_array(arr, seed=None):
    if seed is not None:
        random.seed(seed)
    n = len(arr)
    for i in range(n-1, 0, -1):
        j = random.randint(0, i)
        arr[i], arr[j] = arr[j], arr[i]

    return arr


if shuffle:
    things= shuffle_array(things, seed= None)
    A = shuffle_array(A, seed= None)
    B = shuffle_array(B, seed= None)
    C = shuffle_array(C, seed= None)
    C2 = shuffle_array(C2, seed= None)
    D = shuffle_array(D, seed= None)


def line_rebuild(line):
    if line.PointAtStart.Z > line.PointAtEnd.Z:
        line = rg.Line(line.PointAtEnd,line.PointAtStart).ToNurbsCurve()
    return line

if run:
    LinesLengthT = 0
    ThingsLengthT = 0

    for i,thing in enumerate(things):
        thingID = "thing" + str(i)        
        obj = GUID(thingID, thing, "Brep")
        GUID_THINGS.prepend(obj)
        ThingsLengthT += obj.Length
        
    for i, line in enumerate(A):
        lineID = "line" + "A" + str(i)
        obj = GUID(lineID, line.ToNurbsCurve(), "Line")
        GUID_LINES_A.prepend(obj)
        LinesLengthT += obj.Length
    
    for i, line in enumerate(B):
        lineID = "line" + "B" + str(i)
        obj = GUID(lineID, line.ToNurbsCurve(), "Line")
        GUID_LINES_B.prepend(obj)
        LinesLengthT += obj.Length
    
    for i, line in enumerate(C):
        lineID = "line" + "C" + str(i)
        obj = GUID(lineID, line.ToNurbsCurve(), "Line")
        GUID_LINES_C.prepend(obj)
        LinesLengthT += obj.Length

    for i, line in enumerate(C2):
        line = line_rebuild(line)
        lineID = "line" + "C2" + str(i)
        obj = GUID(lineID, line.ToNurbsCurve(), "Line")
        GUID_LINES_C2.prepend(obj)
        LinesLengthT += obj.Length
# ---------- end uuid_generator ----------
panel_7 = Panel("find_closest_with_bound")
panel_8 = Panel("structure_cut")
uuid_generator_2 = Script(
    things=geometry_pipeline_7,
    A=geometry_pipeline_8,
    B=geometry_pipeline_9,
    C=geometry_pipeline_10,
    run=run,
    rule=run,
    shuffle=Button(ExpressionNormal="True", ExpressionPressed="False"))  # -> out, GUID_THINGS, GUID_LINES_A, GUID_LINES_B, GUID_LINES_C, ThingsLengthT, LinesLengthT; inputs things: list, A: list of Curve, B: list of Curve, C: list of Curve, run: Boolean, seed: Int32
# ---------- uuid_generator_2: Python ----------
import Rhino
import copy
import rhinoscriptsyntax as rs
import Rhino.Geometry as rg
import random

# Namespace definition
# -------------------------------------------------
class GUID:
    def __init__ (self, ID, Geometry, Type):
        self.ID = ID
        self.Geometry = Geometry #saving the rhino geometry
        self.Type = Type
        self.Cut = None
        self.Connector = None
        self.update_info()

    def update_info(self, mode = None, manual = None):
        if mode == "Manual":
            self.Length -= manual[0]
            T = rg.Transform.Translatation(manual[1])
            self.AxisX.PointAtStart.Transform(T)
            self.y_cut_plan = manual[2]
        if self.Type == "Brep":
            self.info = self.bounding_box_dimensions(self.Geometry)
            self.Length = self.info[0][0]
            self.Width = self.info[0][1]
            self.Height = self.info[0][2]
            self.AxisX = self.info[1][0]
            self.AxisY = self.info[1][1]
            self.AxisZ = self.info[1][2]
            self.x_cut_plane = self.info[2][0]
            self.y_cut_plane = self.info[2][1]
            self.z_cut_plane = self.info[2][2]
            self.Bbox = self.info[3]
        elif self.Type == "Line":
            self.Connector = self.Geometry.PointAtStart
            if type(self.Geometry) == rg.Line:
                self.Length = self.Geometry.Length
                return
            self.Length = rg.Curve.GetLength(self.Geometry)


    def bounding_box_dimensions(self, obj):
        if type(obj) == rg.Brep:
            vertices = [vertex.Location for vertex in obj.Vertices]
            bounding_box = rg.BoundingBox(vertices)
        else:
            vertices = [vertex.Location for vertex in obj.ToBrep().Vertices]
            bounding_box = rg.BoundingBox(vertices)

        # Calculate the dimensions of the bounding box
       
        x_extent = bounding_box.Max.X - bounding_box.Min.X
        y_extent = bounding_box.Max.Y - bounding_box.Min.Y
        z_extent = bounding_box.Max.Z - bounding_box.Min.Z
        


        # Create the start and end points of the central axis
        center = bounding_box.Center
        start_pointX = rg.Point3d(center.X - x_extent / 2, center.Y, center.Z)
        end_pointX = rg.Point3d(center.X + x_extent / 2, center.Y, center.Z)

        start_pointY = rg.Point3d(center.X , center.Y - y_extent / 2, center.Z)
        end_pointY = rg.Point3d(center.X , center.Y + y_extent / 2, center.Z)

        start_pointZ = rg.Point3d(center.X, center.Y, center.Z -z_extent/2)
        end_pointZ = rg.Point3d(center.X, center.Y, center.Z + z_extent)


        x_line = rg.LineCurve(start_pointX, end_pointX)
        y_line = rg.LineCurve(start_pointY, end_pointY)
        z_line = rg.LineCurve(start_pointZ, end_pointZ)

        x_cut_plane = rg.Plane(rg.Point3d(start_pointX.X, start_pointX.Y-y_extent/2, start_pointX.Z),
        rg.Vector3d(0,1,0))
        y_cut_plane = rg.Plane(rg.Point3d(start_pointY.X - x_extent/2, start_pointY.Y, start_pointY.Z), 
        rg.Vector3d(1,0,0))
        z_cut_plane = rg.Plane(rg.Point3d(start_pointZ.X , start_pointZ.Y, start_pointZ.Z),
        rg.Vector3d(0,0,1))

        return ((x_extent, y_extent, z_extent),
                (x_line, y_line, z_line),
                (x_cut_plane, y_cut_plane, z_cut_plane),
                bounding_box)

    def factory_method(self, ID, Geometry, Type):
        G = GUID(ID, Geometry,Type)
        return G

class NODE:
    def __init__(self, value):
        self.next = None
        self.value = value #self.value = GUID(ID, Geometry)
        self.closest = None #for lines, the cloest one to other link list
        self.CD = 100000000

    def split(self, obj, linked_list, obj_type, length = None):
        # Caution: Brep here is a Brep List !!!
        if self.value is not None:
            if obj_type == "Brep":
                self.value.Geometry = obj[0]
                self.value.update_info()
                splited_Node = NODE(GUID(self.value.ID + "/", obj[1], "Brep"))
                splited_Node.next = self.next
                self.next = splited_Node
            if obj_type == "Line":
                # Line is just a single line cryyy so dumb RG
                start_pt = rg.PointAtStart
                end_pt = rg.PointAtEnd
                pt = obj.DivideByLength(length, True, False)
                line1 = rg.Line(start_pt, pt)
                line2 = rg.Line(pt, end_pt)
                self.value.Geometry = line1
                self.value.update_info()
                splited_Node = NODE(GUID(self.value.ID + "/", line2, "Line"))
                splited_Node.next = self.next
                self.next = splited_Node
            
            linked_list.length += 1

    def factory_method(self, ID, obj, obj_type = "Line"):
        N = NODE(value = GUID(ID, obj, obj_type))
        return N

class LINKEDLIST:
    def __init__ (self):
        self.node = None
        self.head = None
        self.tail = None
        self.length = 0
    
    def append(self, value):
        newNode = NODE(value)
        current = self.head
        self.length += 1
        if self.head == None:
            self.head = newNode
            self.tail = newNode
            return newNode
        while current.next != None:
            current = current.next
        current.next = newNode
        self.tail = newNode
        return newNode

    def prepend(self, value):
        newNode = NODE(value)
        self.length +=1
        if self.head == None:
            self.head = newNode
            self.tail = newNode
            return self
        newNode.next = self.head
        self.head = newNode
        return self

    def traverse(self, action = None):
        current = self.head
        while current != None:
            if action:
                action()
            else:
                print(current)
            current = current.next

    def goto(self, position):
        current = self.head
        for i in range(position):
            if current != None:
                current = current.next
            else:
                raise IndexError("Index out of range")

        return current

    def pop(self, position = None):
        if position == None:
            position = self.length -1
            self.length -= 1
        if position == 0:
            if self.head != None:
                pop = self.goto(position)
                self.head = self.head.next
                self.length -= 1
                return pop
            else: 
                raise IndexError("Index out of range")
        if position >= self.length or position < 0:
            raise Exception("index out of range")

        previous = self.goto(position- 1)
        if previous != None and previous.next != None:
            previous.next = previous.next.next
            self.length -= 1
        else:
            raise IndexError("Index out of range")
        return previous

    
    def insert(self, value, position):
        # pass exception here eg position > self.length
        node = NODE(value)
        pointer1 = self.goto(position -1 )
        pointer2 = pointer1.next.next
        pointer1.next = node
        node.next = pointer2
        self.lenth += 1
        return node
    
    def list_export(self, attribute):
        lst = []
        current = self.head
        while current != None:
            value_attribute = getattr(current.value, attribute)
            lst.append(value_attribute)
            current = current.next
        return lst

    def copy(self):
        LS = LINKEDLIST()
        current = self.head
        while current != None:
            new_node = NODE(copy.deepcopy(current.value))
            LS.append(new_node)
            current = current.next
        return LS
    
    def concat(self, linked_list):
        if linked_list.head == None or self.head == None:
            raise Exception("Sorry both list must not be empty la")
        linked_list_tail = linked_list.tail
        self.tail.next = linked_list.head
        self.tail = linked_list_tail
        self.length += linked_list.length
        return self
    
    def factory_method(self):
        LS = LINKEDLIST()
        return LS



# -------------------------------------------------
GUID_LINES_A = LINKEDLIST()
GUID_LINES_B = LINKEDLIST()
GUID_LINES_C = LINKEDLIST()
GUID_THINGS = LINKEDLIST()

# for test purpose

def shuffle_array(arr, seed=None):
    if seed is not None:
        random.seed(seed)
    n = len(arr)
    for i in range(n-1, 0, -1):
        j = random.randint(0, i)
        arr[i], arr[j] = arr[j], arr[i]

    return arr


if shuffle:
    things= shuffle_array(things, seed= None)
    A = shuffle_array(A, seed= None)
    B = shuffle_array(B, seed= None)
    C = shuffle_array(C, seed= None)


if run:
    LinesLengthT = 0
    ThingsLengthT = 0

    for i,thing in enumerate(things):

        thingID = "thing" + str(i)        
        obj = GUID(thingID, thing, "Brep")
        GUID_THINGS.prepend(obj)
        ThingsLengthT += obj.Length
        
    for i, line in enumerate(A):
        lineID = "line" + "A" + str(i)
        obj = GUID(lineID, line.ToNurbsCurve(), "Line")
        GUID_LINES_A.prepend(obj)
        LinesLengthT += obj.Length
    
    for i, line in enumerate(B):
        lineID = "line" + "B" + str(i)
        obj = GUID(lineID, line.ToNurbsCurve(), "Line")
        GUID_LINES_B.prepend(obj)
        LinesLengthT += obj.Length
    
    for i, line in enumerate(C):
        lineID = "line" + "C" + str(i)
        obj = GUID(lineID, line.ToNurbsCurve(), "Line")
        GUID_LINES_C.prepend(obj)
        LinesLengthT += obj.Length
# ---------- end uuid_generator_2 ----------
panel_9 = Panel(uuid_generator_2.ThingsLengthT)
panel_10 = Panel(uuid_generator_2.LinesLengthT)
panel_13 = Panel(geometry_pipeline_8)
number_slider_3 = Slider(20, range=0..100)  # disabled
number_slider_4 = Slider(1, range=0..10)  # disabled
number_slider_5 = Slider(10000, range=0..20000)  # disabled
number_slider_6 = Slider(10000, range=0..20000)  # disabled
number_slider_7 = Slider(0, range=0..4000)  # disabled
number_slider_8 = Slider(20, range=0..100)  # disabled
number_slider_9 = Slider(4, range=0..10)  # disabled
number_slider_10 = Slider(10000, range=0..20000)  # disabled
number_slider_11 = Slider(10000, range=0..20000)  # disabled
number_slider_12 = Slider(10, range=0..4000)  # disabled
boolean_toggle_2 = BooleanToggle(True)  # disabled
number_slider_13 = Slider(1, range=0..10)  # disabled
number_slider_14 = Slider(10000, range=0..20000)  # disabled
number_slider_15 = Slider(20, range=0..100)  # disabled
number_slider_16 = Slider(10000, range=0..20000)  # disabled
number_slider_17 = Slider(10, range=0..4000)  # disabled
number_slider_18 = Slider(20, range=0..100)  # disabled
number_slider_19 = Slider(0, range=0..10000)  # disabled
number_slider_20 = Slider(0, range=0..4000)  # disabled
number_slider_21 = Slider(1, range=0..10)  # disabled
number_slider_22 = Slider(10000, range=0..10000)  # disabled
panel_14 = Panel(uuid_generator_2.GUID_THINGS)
script_2 = Script(
    things=uuid_generator_2.GUID_THINGS,
    lines=uuid_generator_2.GUID_LINES_A,
    attribute="Length",
    max_cut=number_slider_3,
    max_cycle=number_slider_4,
    upper_bound=number_slider_5,
    lower_bound=number_slider_6,
    min_len=number_slider_7,
    mode="find_within_bound",
    prior="material_cut")  # -> out, things, lines, result; inputs attribute: String, max_cut: Int32, max_cycle: Int32, upper_bound: Int32, lower_bound: Int32, min_len: Int32, mode: String, prior: String; disabled
# ---------- script_2: Python ----------
import rhinoscriptsyntax as rs
import Rhino.Geometry as rg

"""
1. Find closest match using greedy
2. return a list of length difference with pos and neg numbers
3. for the neg number => Cut extra and hence reduce the neg to 0
4. Add the extra piece back to the input and the length.
Stopping conditions are all reaches to 0 or 10 times
"""

# Add stopping Condition and Cycle time
# in Greedy(), it is measuring the length of the line to find best match
# now we have to split the line and push it to linked list a 

def split_by_plane_length(obj, pln, obj_type):

    # pln could be length if obj_type is line
    if obj_type == "Brep":
        bb = rg.Brep.GetBoundingBox(obj,rg.Plane.WorldXY)
        
        
        _,extU,extV = rg.Plane.ExtendThroughBox(pln,bb)
        extU.T0 = extU.T0 - 1
        extU.T1 = extU.T1 + 1
        extV.T0 = extV.T0 - 1
        extV.T1 = extV.T1 + 1
        
        planeSrf = rg.PlaneSurface(pln,extU,extV)
        splitter = planeSrf.ToBrep()

        brep = rs.coercebrep(obj)
        pieces = brep.Split(splitter,0.001)
        pieces = [piece.CapPlanarHoles(0.01)  for piece in pieces]
    if obj_type == "Line":
        start_pt = obj.PointAtStart
        end_pt = obj.PointAtEnd
        pt = obj.PointAtLength(pln)
        line1 = rg.Line(start_pt, pt).ToNurbsCurve()
        line2 = rg.Line(pt, end_pt).ToNurbsCurve()
        pieces = [line2, line1]
    return pieces

def find_closest_element(linked_list_a, linked_list_b, 
attribute, max_cycle, max_cut, upper_bound, lower_bound, min_len,mode, prior = None, result= None):
    step = 0
    cut_count = 0
    prev = linked_list_b.length

    if result == None:
        result = {}
    else:
        result = result.obj

    if linked_list_b.length > linked_list_a.length:
        raise Exception("Number of input lines are more than available object")
        return

    def Greedy(linked_list_a, linked_list_b, attribute):
        current_b = linked_list_b.head
        pointer = 0 

        while current_b != None and current_b.CD != 0:
            if pointer <= prev:
                current_a = linked_list_a.head
                closest_node = None
                
                while current_a != None and current_a.value.Length > min_len:
                    d1 = current_b.value.Length - getattr(current_a.value, attribute)
                    if mode == "find_closest":
                        if prior == "material_cut":
                            if d1 < 0 and abs(d1) <= abs(current_b.CD) and current_a.value.ID not in result:
                                current_b.CD = d1
                                closest_node = current_a
                        if prior == "structure_cut":
                            if d1 >= 0 and abs(d1) <= abs(current_b.CD) and current_a.value.ID not in result:
                                current_b.CD = d1
                                closest_node = current_a
                        if prior == None:
                            # Default
                            if abs(d1) <= abs(current_b.CD)  and current_a.value.ID not in result:
                                current_b.CD = d1
                                closest_node = current_a
                    elif mode == "find_closest_with_bound":
                        if prior == None:
                            # Default
                            if abs(d1) <= abs(current_b.CD) and  -lower_bound <= d1 <= upper_bound and current_a.value.ID not in result:
                                    current_b.CD = d1
                                    closest_node = current_a
                        if prior == "material_cut":
                            if d1<0 and abs(d1) <= abs(current_b.CD) and  -lower_bound <= d1 <= upper_bound and current_a.value.ID not in result:
                                    current_b.CD = d1
                                    closest_node = current_a
                        if prior == "structure_cut":
                            if d1>0 and abs(d1) <= abs(current_b.CD) and  -lower_bound <= d1 <= upper_bound and current_a.value.ID not in result:
                                    current_b.CD = d1
                                    closest_node = current_a
                    elif mode == "find_within_bound":
                        if prior == "material_cut":
                            if d1 < 0 and -lower_bound <= d1 <= upper_bound and current_a.value.ID not in result:
                                current_b.CD = d1
                                closest_node = current_a
                                break
                        if prior == "structure_cut":
                            if d1 >= 0 and -lower_bound <= d1 <= upper_bound and current_a.value.ID not in result:
                                current_b.CD = d1
                                closest_node = current_a
                                break
                        if prior == None:
                            # Default
                            if -lower_bound <= d1 <= upper_bound and current_a.value.ID not in result:
                                current_b.CD = d1
                                closest_node = current_a
                                break

                    current_a = current_a.next
                
            if closest_node != None:
                result[closest_node.value.ID] = 1
                result[current_b.value.ID] = 1
            current_b.closest = closest_node
            
            current_b = current_b.next
            pointer += 1
        return 
    
    def Cut(result, linked_list_a, linked_list_b):
        current = linked_list_b.head #iterate through lines 
        LS = linked_list_b.factory_method()
        pointer = 0
        nonlocal prev
        nonlocal cut_count
        while current and pointer <= prev:
            # split things if things are in excess
            if current.CD < 0 and current.closest != None:
                scalar = abs(current.CD)
                if attribute == "Length":
                    v = rg.Vector3d(scalar,0,0)
                    pln = current.closest.value.y_cut_plane.Clone()
                elif attribute == "Width":
                    v = rg.Vector3d(0, scalar,0)
                    pln = current.closest.value.x_cut_plane.Clone()
                elif attribute == "Height":
                    v = rg.Vector3d(0,0, scalar)
                    pln = current.closest.value.z_cut_plane.Clone()

                # Split original object according to length difference
                brp = current.closest.value.Geometry
                pln.Translate(v)
                current.closest.value.Cut = pln

                # Split the Brep and lines
                splited = split_by_plane_length(brp, pln, "Brep")
                # split Node
                
                if (len(splited)):
                    current.closest.split(splited, linked_list_a, "Brep")
                    cut_count += 1

            # split the lines if the lines are in excess
            if current.CD >0 and current.closest != None:
                splited = split_by_plane_length(
                    current.value.Geometry,
                    current.CD,
                    "Line")

                current.value.Geometry = splited[0]
                current.value.update_info()

                GUID = current.value.factory_method(
                    current.value.ID + "/", splited[1], "Line")
                LS.prepend(GUID)

            #once splited reduce CD to 0
            current.CD = 0
            current = current.next
            pointer += 1
        prev = LS.length
        if LS.length == 0:
            return linked_list_b
        return LS.concat(linked_list_b)

        
    while step < max_cycle:
        print(linked_list_a.length, linked_list_b.length)
        Greedy(linked_list_a, linked_list_b, attribute)
        print("Cut Start!")
        # if step != 1:
        linked_list_b = Cut(result, linked_list_a, linked_list_b)
        print(linked_list_a.length,linked_list_b.length)
        step +=1

    return result,linked_list_a, linked_list_b



result,things,lines = find_closest_element(things, lines, 
attribute, max_cycle, max_cut, upper_bound, lower_bound, min_len, mode, prior)

# Stupid GH cant pass dictionary
class DICT:
    def __init__ (self, obj):
        self.obj = obj
result = DICT(result)
# ---------- end script_2 ----------
script_3 = Script(
    things=uuid_generator_2.GUID_THINGS,
    lines=uuid_generator_2.GUID_LINES_B,
    attribute="Length",
    max_cut=number_slider_18,
    max_cycle=number_slider_21,
    upper_bound=number_slider_19,
    lower_bound=number_slider_22,
    min_len=number_slider_20,
    mode="find_closest",
    result=script_2.result)  # -> out, things, lines, result; inputs attribute: String, max_cut: Int32, max_cycle: Int32, upper_bound: Int32, lower_bound: Int32, min_len: Int32, mode: String, prior: String; disabled
# ---------- script_3: Python ----------
import rhinoscriptsyntax as rs
import Rhino.Geometry as rg

"""
1. Find closest match using greedy
2. return a list of length difference with pos and neg numbers
3. for the neg number => Cut extra and hence reduce the neg to 0
4. Add the extra piece back to the input and the length.
Stopping conditions are all reaches to 0 or 10 times
"""

# Add stopping Condition and Cycle time
# in Greedy(), it is measuring the length of the line to find best match
# now we have to split the line and push it to linked list a 

def split_by_plane_length(obj, pln, obj_type):

    # pln could be length if obj_type is line
    if obj_type == "Brep":
        bb = rg.Brep.GetBoundingBox(obj,rg.Plane.WorldXY)
        
        
        _,extU,extV = rg.Plane.ExtendThroughBox(pln,bb)
        extU.T0 = extU.T0 - 1
        extU.T1 = extU.T1 + 1
        extV.T0 = extV.T0 - 1
        extV.T1 = extV.T1 + 1
        
        planeSrf = rg.PlaneSurface(pln,extU,extV)
        splitter = planeSrf.ToBrep()

        brep = rs.coercebrep(obj)
        pieces = brep.Split(splitter,0.001)
        pieces = [piece.CapPlanarHoles(0.01)  for piece in pieces]
    if obj_type == "Line":
        start_pt = obj.PointAtStart
        end_pt = obj.PointAtEnd
        pt = obj.PointAtLength(pln)
        line1 = rg.Line(start_pt, pt).ToNurbsCurve()
        line2 = rg.Line(pt, end_pt).ToNurbsCurve()
        pieces = [line2, line1]
    return pieces

def find_closest_element(linked_list_a, linked_list_b, 
attribute, max_cycle, max_cut, upper_bound, lower_bound, min_len,mode, prior = None, result= None):
    step = 0
    cut_count = 0
    prev = linked_list_b.length

    if result == None:
        result = {}
    else:
        result = result.obj
    
    if linked_list_b.length > linked_list_a.length:
        raise Exception("Number of input lines are more than available object")
        return

    def Greedy(linked_list_a, linked_list_b, attribute):
        current_b = linked_list_b.head
        pointer = 0 

        while current_b != None and current_b.CD != 0:
            if pointer <= prev:
                current_a = linked_list_a.head
                closest_node = None
                
                while current_a != None and current_a.value.Length > min_len:
                    d1 = current_b.value.Length - getattr(current_a.value, attribute)
                    if mode == "find_closest":
                        if prior == "material_cut":
                            if d1 < 0 and abs(d1) <= abs(current_b.CD) and current_a.value.ID not in result:
                                current_b.CD = d1
                                closest_node = current_a
                        if prior == "structure_cut":
                            if d1 >= 0 and abs(d1) <= abs(current_b.CD) and current_a.value.ID not in result:
                                current_b.CD = d1
                                closest_node = current_a
                        if prior == None:
                            # Default
                            if abs(d1) <= abs(current_b.CD)  and current_a.value.ID not in result:
                                current_b.CD = d1
                                closest_node = current_a
                    elif mode == "find_closest_with_bound":
                        if prior == None:
                            # Default
                            if abs(d1) <= abs(current_b.CD) and  -lower_bound <= d1 <= upper_bound and current_a.value.ID not in result:
                                    current_b.CD = d1
                                    closest_node = current_a
                        if prior == "material_cut":
                            if d1<0 and abs(d1) <= abs(current_b.CD) and  -lower_bound <= d1 <= upper_bound and current_a.value.ID not in result:
                                    current_b.CD = d1
                                    closest_node = current_a
                        if prior == "structure_cut":
                            if d1>0 and abs(d1) <= abs(current_b.CD) and  -lower_bound <= d1 <= upper_bound and current_a.value.ID not in result:
                                    current_b.CD = d1
                                    closest_node = current_a
                    elif mode == "find_within_bound":
                        if prior == "material_cut":
                            if d1 < 0 and -lower_bound <= d1 <= upper_bound and current_a.value.ID not in result:
                                current_b.CD = d1
                                closest_node = current_a
                                break
                        if prior == "structure_cut":
                            if d1 >= 0 and -lower_bound <= d1 <= upper_bound and current_a.value.ID not in result:
                                current_b.CD = d1
                                closest_node = current_a
                                break
                        if prior == None:
                            # Default
                            if -lower_bound <= d1 <= upper_bound and current_a.value.ID not in result:
                                current_b.CD = d1
                                closest_node = current_a
                                break

                    current_a = current_a.next
                
            if closest_node != None:
                result[closest_node.value.ID] = 1
                result[current_b.value.ID] = 1
            current_b.closest = closest_node
            
            current_b = current_b.next
            pointer += 1
        return 
    
    def Cut(result, linked_list_a, linked_list_b):
        current = linked_list_b.head #iterate through lines 
        LS = linked_list_b.factory_method()
        pointer = 0
        nonlocal prev
        nonlocal cut_count
        while current and pointer <= prev:
            # split things if things are in excess
            if current.CD < 0 and current.closest != None:
                scalar = abs(current.CD)
                if attribute == "Length":
                    v = rg.Vector3d(scalar,0,0)
                    pln = current.closest.value.y_cut_plane.Clone()
                elif attribute == "Width":
                    v = rg.Vector3d(0, scalar,0)
                    pln = current.closest.value.x_cut_plane.Clone()
                elif attribute == "Height":
                    v = rg.Vector3d(0,0, scalar)
                    pln = current.closest.value.z_cut_plane.Clone()

                # Split original object according to length difference
                brp = current.closest.value.Geometry
                pln.Translate(v)
                current.closest.value.Cut = pln

                # Split the Brep and lines
                splited = split_by_plane_length(brp, pln, "Brep")
                # split Node
                
                if (len(splited)):
                    current.closest.split(splited, linked_list_a, "Brep")
                    cut_count += 1

            # split the lines if the lines are in excess
            if current.CD >0 and current.closest != None:
                splited = split_by_plane_length(
                    current.value.Geometry,
                    current.CD,
                    "Line")

                current.value.Geometry = splited[0]
                current.value.update_info()

                GUID = current.value.factory_method(
                    current.value.ID + "/", splited[1], "Line")
                LS.prepend(GUID)

            #once splited reduce CD to 0
            current.CD = 0
            current = current.next
            pointer += 1
        prev = LS.length
        if LS.length == 0:
            return linked_list_b
        return LS.concat(linked_list_b)

        
    while step < max_cycle:
        print(linked_list_a.length, linked_list_b.length)
        Greedy(linked_list_a, linked_list_b, attribute)
        print("Cut Start!")
        # if step != 1:
        linked_list_b = Cut(result, linked_list_a, linked_list_b)
        print(linked_list_a.length,linked_list_b.length)
        step +=1

    return result,linked_list_a, linked_list_b


result,things,lines = find_closest_element(things, lines, 
attribute, max_cycle, max_cut, upper_bound, lower_bound, min_len, mode, prior, result)


# Stupid GH cant pass dictionary
class DICT:
    def __init__ (self, obj):
        self.obj = obj
result = DICT(result)
# ---------- end script_3 ----------
script_4 = Script(
    things=uuid_generator_2.GUID_THINGS,
    lines=uuid_generator_2.GUID_LINES_C,
    attribute="Length",
    max_cut=number_slider_8,
    max_cycle=number_slider_9,
    upper_bound=number_slider_10,
    lower_bound=number_slider_11,
    min_len=number_slider_12,
    mode="find_closest",
    result=script_3.result)  # -> out, things, lines, result, test; inputs attribute: String, max_cut: Int32, max_cycle: Int32, upper_bound: Int32, lower_bound: Int32, min_len: Int32, mode: String, prior: String; disabled
# ---------- script_4: Python ----------
import rhinoscriptsyntax as rs
import Rhino.Geometry as rg

"""
1. Find closest match using greedy
2. return a list of length difference with pos and neg numbers
3. for the neg number => Cut extra and hence reduce the neg to 0
4. Add the extra piece back to the input and the length.
Stopping conditions are all reaches to 0 or 10 times
"""

# Add stopping Condition and Cycle time
# in Greedy(), it is measuring the length of the line to find best match
# now we have to split the line and push it to linked list a 

def split_by_plane_length(obj, pln, obj_type):

    # pln could be length if obj_type is line
    if obj_type == "Brep":
        bb = rg.Brep.GetBoundingBox(obj,rg.Plane.WorldXY)
        
        
        _,extU,extV = rg.Plane.ExtendThroughBox(pln,bb)
        extU.T0 = extU.T0 - 1
        extU.T1 = extU.T1 + 1
        extV.T0 = extV.T0 - 1
        extV.T1 = extV.T1 + 1
        
        planeSrf = rg.PlaneSurface(pln,extU,extV)
        splitter = planeSrf.ToBrep()

        brep = rs.coercebrep(obj)
        pieces = brep.Split(splitter,0.001)
        pieces = [piece.CapPlanarHoles(0.01)  for piece in pieces]
    if obj_type == "Line":
        start_pt = obj.PointAtStart
        end_pt = obj.PointAtEnd
        pt = obj.PointAtLength(pln)
        line1 = rg.Line(start_pt, pt).ToNurbsCurve()
        line2 = rg.Line(pt, end_pt).ToNurbsCurve()
        pieces = [line2, line1]
    return pieces

def find_closest_element(linked_list_a, linked_list_b, 
attribute, max_cycle, max_cut, upper_bound, lower_bound, min_len,mode, prior = None, result= None):
    step = 0
    cut_count = 0
    prev = linked_list_b.length

    if result == None:
        result = {}
    else:
        result = result.obj

    if linked_list_b.length > linked_list_a.length:
        print(linked_list_b.length)
        raise Exception("Number of input lines are more than available object")
        return

    def Greedy(linked_list_a, linked_list_b, attribute):
        current_b = linked_list_b.head
        pointer = 0 

        while current_b != None and current_b.CD != 0:
            if pointer <= prev:
                current_a = linked_list_a.head
                closest_node = None
                
                while current_a != None and current_a.value.Length > min_len:
                    d1 = current_b.value.Length - getattr(current_a.value, attribute)
                    if mode == "find_closest":
                        if prior == "material_cut":
                            if d1 < 0 and abs(d1) <= abs(current_b.CD) and current_a.value.ID not in result:
                                current_b.CD = d1
                                closest_node = current_a
                        if prior == "structure_cut":
                            if d1 >= 0 and abs(d1) <= abs(current_b.CD) and current_a.value.ID not in result:
                                current_b.CD = d1
                                closest_node = current_a
                        if prior == None:
                            # Default
                            if abs(d1) <= abs(current_b.CD)  and current_a.value.ID not in result:
                                current_b.CD = d1
                                closest_node = current_a
                    elif mode == "find_closest_with_bound":
                        if prior == None:
                            # Default
                            if abs(d1) <= abs(current_b.CD) and  -lower_bound <= d1 <= upper_bound and current_a.value.ID not in result:
                                    current_b.CD = d1
                                    closest_node = current_a
                        if prior == "material_cut":
                            if d1<0 and abs(d1) <= abs(current_b.CD) and  -lower_bound <= d1 <= upper_bound and current_a.value.ID not in result:
                                    current_b.CD = d1
                                    closest_node = current_a
                        if prior == "structure_cut":
                            if d1>0 and abs(d1) <= abs(current_b.CD) and  -lower_bound <= d1 <= upper_bound and current_a.value.ID not in result:
                                    current_b.CD = d1
                                    closest_node = current_a
                    elif mode == "find_within_bound":
                        if prior == "material_cut":
                            if d1 < 0 and -lower_bound <= d1 <= upper_bound and current_a.value.ID not in result:
                                current_b.CD = d1
                                closest_node = current_a
                                break
                        if prior == "structure_cut":
                            if d1 >= 0 and -lower_bound <= d1 <= upper_bound and current_a.value.ID not in result:
                                current_b.CD = d1
                                closest_node = current_a
                                break
                        if prior == None:
                            # Default
                            if -lower_bound <= d1 <= upper_bound and current_a.value.ID not in result:
                                current_b.CD = d1
                                closest_node = current_a
                                break

                    current_a = current_a.next
                
            if closest_node != None:
                result[closest_node.value.ID] = 1
                result[current_b.value.ID] = 1
            current_b.closest = closest_node
            
            current_b = current_b.next
            pointer += 1
        return 
    
    def Cut(result, linked_list_a, linked_list_b):
        current = linked_list_b.head #iterate through lines 
        LS = linked_list_b.factory_method()
        pointer = 0
        nonlocal prev
        nonlocal cut_count
        while current and pointer <= prev:
            # split things if things are in excess
            if current.CD < 0 and current.closest != None:
                scalar = abs(current.CD)
                if attribute == "Length":
                    v = rg.Vector3d(scalar,0,0)
                    pln = current.closest.value.y_cut_plane.Clone()
                elif attribute == "Width":
                    v = rg.Vector3d(0, scalar,0)
                    pln = current.closest.value.x_cut_plane.Clone()
                elif attribute == "Height":
                    v = rg.Vector3d(0,0, scalar)
                    pln = current.closest.value.z_cut_plane.Clone()

                # Split original object according to length difference
                brp = current.closest.value.Geometry
                pln.Translate(v)
                current.closest.value.Cut = pln

                # Split the Brep and lines
                splited = split_by_plane_length(brp, pln, "Brep")
                # split Node

                if (len(splited)):
                    if current.value.Length < abs(current.CD):
                        splited = splited[::-1]
                    current.closest.split(splited, linked_list_a, "Brep")
                    print(current.closest.value.Length)
                    print(current.closest.next.value.Length)
                    cut_count += 1

            # split the lines if the lines are in excess
            if current.CD >0 and current.closest != None:
                splited = split_by_plane_length(
                    current.value.Geometry,
                    current.CD,
                    "Line")

                current.value.Geometry = splited[0]
                current.value.update_info()

                GUID = current.value.factory_method(
                    current.value.ID + "/", splited[1], "Line")
                LS.prepend(GUID)

            #once splited reduce CD to 0
            current.CD = 0
            current = current.next
            pointer += 1
        prev = LS.length
        if LS.length == 0:
            return linked_list_b
        return LS.concat(linked_list_b)
        
    while step < max_cycle:
        if step == 0:
            print("================================================")
        print(linked_list_a.length, linked_list_b.length)
        Greedy(linked_list_a, linked_list_b, attribute)
        print("Cut Start!")
        # if step <max_cycle -1:
        linked_list_b = Cut(result, linked_list_a, linked_list_b)
        print(linked_list_a.length,linked_list_b.length)
        step +=1

    return result,linked_list_a, linked_list_b


result,things,lines = find_closest_element(things, lines, 
attribute, max_cycle, max_cut, upper_bound, lower_bound, min_len, mode, prior, result)


# Stupid GH cant pass dictionary
class DICT:
    def __init__ (self, obj):
        self.obj = obj
result = DICT(result)
# ---------- end script_4 ----------
script_5 = Script(
    things=uuid_generator.GUID_THINGS,
    lines=uuid_generator.GUID_LINES_A,
    attribute="Length",
    max_cut=Slider(20, range=0..100),
    max_cycle=Slider(1, range=0..10),
    upper_bound=Slider(0, range=0..20000),
    lower_bound=Slider(10000, range=0..20000),
    min_len=Slider(10, range=0..4000),
    mode="find_within_bound",
    prior="material_cut",
    result=script_3.result)  # -> out, things, lines, result, test; inputs attribute: String, max_cut: Int32, max_cycle: Int32, upper_bound: Int32, lower_bound: Int32, min_len: Int32, mode: String, prior: String
# ---------- script_5: Python ----------
import rhinoscriptsyntax as rs
import Rhino.Geometry as rg

"""
1. Find closest match using greedy
2. return a list of length difference with pos and neg numbers
3. for the neg number => Cut extra and hence reduce the neg to 0
4. Add the extra piece back to the input and the length.
Stopping conditions are all reaches to 0 or 10 times
"""

# Add stopping Condition and Cycle time
# in Greedy(), it is measuring the length of the line to find best match
# now we have to split the line and push it to linked list a 

def split_by_plane_length(obj, pln, obj_type):

    # pln could be length if obj_type is line
    if obj_type == "Brep":
        bb = rg.Brep.GetBoundingBox(obj,rg.Plane.WorldXY)
        
        
        _,extU,extV = rg.Plane.ExtendThroughBox(pln,bb)
        extU.T0 = extU.T0 - 1
        extU.T1 = extU.T1 + 1
        extV.T0 = extV.T0 - 1
        extV.T1 = extV.T1 + 1
        
        planeSrf = rg.PlaneSurface(pln,extU,extV)
        splitter = planeSrf.ToBrep()

        brep = rs.coercebrep(obj)
        pieces = brep.Split(splitter,0.001)
        pieces = [piece.CapPlanarHoles(0.01)  for piece in pieces]
    if obj_type == "Line":
        start_pt = obj.PointAtStart
        end_pt = obj.PointAtEnd
        pt = obj.PointAtLength(pln)
        line1 = rg.Line(start_pt, pt).ToNurbsCurve()
        line2 = rg.Line(pt, end_pt).ToNurbsCurve()
        pieces = [line2, line1]
    return pieces

def find_closest_element(linked_list_a, linked_list_b, 
attribute, max_cycle, max_cut, upper_bound, lower_bound, min_len,mode, prior = None, result= None):
    step = 0
    cut_count = 0
    prev = linked_list_b.length

    if result == None:
        result = {}
    else:
        result = result.obj

    if linked_list_b.length > linked_list_a.length:
        print(linked_list_b.length)
        raise Exception("Number of input lines are more than available object")
        return

    def Greedy(linked_list_a, linked_list_b, attribute):
        current_b = linked_list_b.head
        pointer = 0 

        while current_b != None and current_b.CD != 0:
            if pointer <= prev:
                current_a = linked_list_a.head
                closest_node = None
                
                while current_a != None and current_a.value.Length > min_len:
                    d1 = current_b.value.Length - getattr(current_a.value, attribute)
                    if mode == "find_closest":
                        if prior == "material_cut":
                            if d1 < 0 and abs(d1) <= abs(current_b.CD) and current_a.value.ID not in result:
                                current_b.CD = d1
                                closest_node = current_a
                        if prior == "structure_cut":
                            if d1 >= 0 and abs(d1) <= abs(current_b.CD) and current_a.value.ID not in result:
                                current_b.CD = d1
                                closest_node = current_a
                        if prior == None:
                            # Default
                            if abs(d1) <= abs(current_b.CD)  and current_a.value.ID not in result:
                                current_b.CD = d1
                                closest_node = current_a
                    elif mode == "find_closest_with_bound":
                        if prior == None:
                            # Default
                            if abs(d1) <= abs(current_b.CD) and  -lower_bound <= d1 <= upper_bound and current_a.value.ID not in result:
                                    current_b.CD = d1
                                    closest_node = current_a
                        if prior == "material_cut":
                            if d1<0 and abs(d1) <= abs(current_b.CD) and  -lower_bound <= d1 <= upper_bound and current_a.value.ID not in result:
                                    current_b.CD = d1
                                    closest_node = current_a
                        if prior == "structure_cut":
                            if d1>0 and abs(d1) <= abs(current_b.CD) and  -lower_bound <= d1 <= upper_bound and current_a.value.ID not in result:
                                    current_b.CD = d1
                                    closest_node = current_a
                    elif mode == "find_within_bound":
                        if prior == "material_cut":
                            if d1 < 0 and -lower_bound <= d1 <= upper_bound and current_a.value.ID not in result:
                                current_b.CD = d1
                                closest_node = current_a
                                break
                        if prior == "structure_cut":
                            if d1 >= 0 and -lower_bound <= d1 <= upper_bound and current_a.value.ID not in result:
                                current_b.CD = d1
                                closest_node = current_a
                                break
                        if prior == None:
                            # Default
                            if -lower_bound <= d1 <= upper_bound and current_a.value.ID not in result:
                                current_b.CD = d1
                                closest_node = current_a
                                break

                    current_a = current_a.next
                
            if closest_node != None:
                result[closest_node.value.ID] = 1
                result[current_b.value.ID] = 1
            current_b.closest = closest_node
            
            current_b = current_b.next
            pointer += 1
        return 
    
    def Cut(result, linked_list_a, linked_list_b):
        current = linked_list_b.head #iterate through lines 
        LS = linked_list_b.factory_method()
        pointer = 0
        nonlocal prev
        nonlocal cut_count
        while current and pointer <= prev:
            # split things if things are in excess
            if current.CD < 0 and current.closest != None:
                scalar = abs(current.CD)
                if attribute == "Length":
                    v = rg.Vector3d(scalar,0,0)
                    pln = current.closest.value.y_cut_plane.Clone()
                elif attribute == "Width":
                    v = rg.Vector3d(0, scalar,0)
                    pln = current.closest.value.x_cut_plane.Clone()
                elif attribute == "Height":
                    v = rg.Vector3d(0,0, scalar)
                    pln = current.closest.value.z_cut_plane.Clone()

                # Split original object according to length difference
                brp = current.closest.value.Geometry
                pln.Translate(v)
                current.closest.value.Cut = pln

                # Split the Brep and lines
                splited = split_by_plane_length(brp, pln, "Brep")
                # split Node

                if (len(splited)):
                    if current.value.Length < abs(current.CD):
                        splited = splited[::-1]
                    current.closest.split(splited, linked_list_a, "Brep")
                    print(current.closest.value.Length)
                    print(current.closest.next.value.Length)
                    cut_count += 1

            # split the lines if the lines are in excess
            if current.CD >0 and current.closest != None:
                splited = split_by_plane_length(
                    current.value.Geometry,
                    current.CD,
                    "Line")

                current.value.Geometry = splited[0]
                current.value.update_info()

                GUID = current.value.factory_method(
                    current.value.ID + "/", splited[1], "Line")
                LS.prepend(GUID)

            #once splited reduce CD to 0
            current.CD = 0
            current = current.next
            pointer += 1
        prev = LS.length
        if LS.length == 0:
            return linked_list_b
        return LS.concat(linked_list_b)
        
    while step < max_cycle:
        if step == 0:
            print("================================================")
        print(linked_list_a.length, linked_list_b.length)
        Greedy(linked_list_a, linked_list_b, attribute)
        print("Cut Start!")
        linked_list_b = Cut(result, linked_list_a, linked_list_b)
        print(linked_list_a.length,linked_list_b.length)
        step +=1

    return result,linked_list_a, linked_list_b


result,things,lines = find_closest_element(things, lines, 
attribute, max_cycle, max_cut, upper_bound, lower_bound, min_len, mode, prior, result)


# Stupid GH cant pass dictionary
class DICT:
    def __init__ (self, obj):
        self.obj = obj
result = DICT(result)
# ---------- end script_5 ----------
script_6 = Script(
    things=uuid_generator.GUID_THINGS,
    lines=uuid_generator.GUID_LINES_C,
    cut=Toggle(False),
    attribute="Length",
    max_cut=Slider(20, range=0..100),
    max_cycle=Slider(1, range=0..10),
    upper_bound=Slider(10000, range=0..20000),
    lower_bound=Slider(10000, range=0..20000),
    min_len=Slider(10, range=0..4000),
    mode="find_closest",
    result=script_5.result)  # -> out, things, lines, GUID_LINES_D, result; inputs cut: Boolean, attribute: String, max_cut: Int32, max_cycle: Int32, upper_bound: Int32, lower_bound: Int32, min_len: Int32, mode: String, prior: String
# ---------- script_6: Python ----------
import rhinoscriptsyntax as rs
import Rhino.Geometry as rg

"""
1. Find closest match using greedy
2. return a list of length difference with pos and neg numbers
3. for the neg number => Cut extra and hence reduce the neg to 0
4. Add the extra piece back to the input and the length.
Stopping conditions are all reaches to 0 or 10 times
"""

# Add stopping Condition and Cycle time
# in Greedy(), it is measuring the length of the line to find best match
# now we have to split the line and push it to linked list a 

def split_by_plane_length(obj, pln, obj_type):

    # pln could be length if obj_type is line
    if obj_type == "Brep":
        bb = rg.Brep.GetBoundingBox(obj,rg.Plane.WorldXY)
        
        
        _,extU,extV = rg.Plane.ExtendThroughBox(pln,bb)
        extU.T0 = extU.T0 - 1
        extU.T1 = extU.T1 + 1
        extV.T0 = extV.T0 - 1
        extV.T1 = extV.T1 + 1
        
        planeSrf = rg.PlaneSurface(pln,extU,extV)
        splitter = planeSrf.ToBrep()

        brep = rs.coercebrep(obj)
        pieces = brep.Split(splitter,0.001)
        pieces = [piece.CapPlanarHoles(0.01)  for piece in pieces]
    if obj_type == "Line":
        start_pt = obj.PointAtStart
        end_pt = obj.PointAtEnd
        pt = obj.PointAtLength(pln)
        line1 = rg.Line(start_pt, pt).ToNurbsCurve()
        line2 = rg.Line(pt, end_pt).ToNurbsCurve()
        pieces = [line2, line1]
    return pieces

def find_closest_element(linked_list_a, linked_list_b, 
attribute, max_cycle, max_cut, upper_bound, lower_bound, min_len,mode, prior = None, result= None):
    step = 0
    cut_count = 0
    prev = linked_list_b.length

    if result == None:
        result = {}
    else:
        result = result.obj

    if linked_list_b.length > linked_list_a.length:
        print(linked_list_b.length)
        raise Exception("Number of input lines are more than available object")
        return

    def Greedy(linked_list_a, linked_list_b, attribute):
        current_b = linked_list_b.head
        pointer = 0 

        while current_b != None and current_b.CD != 0:
            if pointer <= prev:
                current_a = linked_list_a.head
                closest_node = None
                
                while current_a != None and current_a.value.Length > min_len:
                    d1 = current_b.value.Length - getattr(current_a.value, attribute)
                    if mode == "find_closest":
                        if prior == "material_cut":
                            if d1 < 0 and abs(d1) <= abs(current_b.CD) and current_a.value.ID not in result:
                                current_b.CD = d1
                                closest_node = current_a
                        if prior == "structure_cut":
                            if d1 >= 0 and abs(d1) <= abs(current_b.CD) and current_a.value.ID not in result:
                                current_b.CD = d1
                                closest_node = current_a
                            # Default
                        if prior == None:
                            if abs(d1) <= abs(current_b.CD)  and current_a.value.ID not in result:
                                current_b.CD = d1
                                closest_node = current_a
                    elif mode == "find_closest_with_bound":
                        if prior == None:
                            # Default
                            if abs(d1) <= abs(current_b.CD) and  -lower_bound <= d1 <= upper_bound and current_a.value.ID not in result:
                                    current_b.CD = d1
                                    closest_node = current_a
                        if prior == "material_cut":
                            if d1<0 and abs(d1) <= abs(current_b.CD) and  -lower_bound <= d1 <= upper_bound and current_a.value.ID not in result:
                                    current_b.CD = d1
                                    closest_node = current_a
                        if prior == "structure_cut":
                            if d1>0 and abs(d1) <= abs(current_b.CD) and  -lower_bound <= d1 <= upper_bound and current_a.value.ID not in result:
                                    current_b.CD = d1
                                    closest_node = current_a
                    elif mode == "find_within_bound":
                        if prior == "material_cut":
                            if d1 < 0 and -lower_bound <= d1 <= upper_bound and current_a.value.ID not in result:
                                current_b.CD = d1
                                closest_node = current_a
                                break
                        if prior == "structure_cut":
                            if d1 >= 0 and -lower_bound <= d1 <= upper_bound and current_a.value.ID not in result:
                                current_b.CD = d1
                                closest_node = current_a
                                break
                        if prior == None:
                            # Default
                            if -lower_bound <= d1 <= upper_bound and current_a.value.ID not in result:
                                current_b.CD = d1
                                closest_node = current_a
                                break

                    current_a = current_a.next
                
            if closest_node != None:
                result[closest_node.value.ID] = 1
                result[current_b.value.ID] = 1
            current_b.closest = closest_node
            
            current_b = current_b.next
            pointer += 1
        return 

    def transform(result, linked_list_a, linked_list_b):
        current = linked_list_b.head
        pointer = 0
        queue = [None] * linked_list_b.length
        LS = linked_list_b.factory_method()
        nonlocal prev
        while current:
            v = current.value.Geometry.PointAtStart - current.value.Geometry.PointAtEnd
            v =(v/v.Length * current.CD)
            end_pt =  current.value.Geometry.PointAtEnd + v
            line = rg.Line(current.value.Geometry.PointAtStart, end_pt).ToNurbsCurve()        
            queue[pointer] = end_pt

            current.value.Geometry = line
            current.value.update_info()
            current = current.next
            

            pointer +=1 

        queue = queue[::-1]
        queue.append(queue[0])
        for i in range(len(queue)-1):
            st_pt = queue[i]
            end_pt = queue[i+1]
            line = rg.Line(st_pt, end_pt).ToNurbsCurve()
            GUID = linked_list_b.head.value.factory_method("lineD" + str(i), line, "Line")
            LS.prepend(GUID)


        return LS
    
    def Cut(result, linked_list_a, linked_list_b):
        current = linked_list_b.head #iterate through lines 
        LS = linked_list_b.factory_method()
        pointer = 0
        nonlocal prev
        nonlocal cut_count
        while current and pointer <= prev:
            # split things if things are in excess
            if current.CD < 0 and current.closest != None:
                scalar = abs(current.CD)
                if attribute == "Length":
                    v = rg.Vector3d(scalar,0,0)
                    pln = current.closest.value.y_cut_plane.Clone()
                elif attribute == "Width":
                    v = rg.Vector3d(0, scalar,0)
                    pln = current.closest.value.x_cut_plane.Clone()
                elif attribute == "Height":
                    v = rg.Vector3d(0,0, scalar)
                    pln = current.closest.value.z_cut_plane.Clone()

                # Split original object according to length difference
                brp = current.closest.value.Geometry
                pln.Translate(v)
                current.closest.value.Cut = pln

                # Split the Brep and lines
                splited = split_by_plane_length(brp, pln, "Brep")
                # split Node

                if (len(splited)):
                    if current.value.Length < abs(current.CD):
                        splited = splited[::-1]
                    current.closest.split(splited, linked_list_a, "Brep")
                    print(current.closest.value.Length)
                    print(current.closest.next.value.Length)
                    cut_count += 1

            # split the lines if the lines are in excess
            if current.CD >0 and current.closest != None:
                splited = split_by_plane_length(
                    current.value.Geometry,
                    current.CD,
                    "Line")

                current.value.Geometry = splited[0]
                current.value.update_info()

                GUID = current.value.factory_method(
                    current.value.ID + "/", splited[1], "Line")
                LS.prepend(GUID)

            #once splited reduce CD to 0
            current.CD = 0
            current = current.next
            pointer += 1
        prev = LS.length
        if LS.length == 0:
            return linked_list_b
        return LS.concat(linked_list_b)
        
    while step < max_cycle:
        if step == 0:
            print("================================================")
        print(linked_list_a.length, linked_list_b.length)
        Greedy(linked_list_a, linked_list_b, attribute)
        print("Cut Start!")
        if cut:
            linked_list_b = Cut(result, linked_list_a, linked_list_b)
        else:
            GUID_LINES_D = transform(result, linked_list_a, linked_list_b)
        print(linked_list_a.length,linked_list_b.length)
        step +=1

    return result, linked_list_a, linked_list_b, GUID_LINES_D


result,things,lines, GUID_LINES_D = find_closest_element(things, lines, 
attribute, max_cycle, max_cut, upper_bound, lower_bound, min_len, mode, prior, result)


# Stupid GH cant pass dictionary
class DICT:
    def __init__ (self, obj):
        self.obj = obj
result = DICT(result)
# ---------- end script_6 ----------
script_7 = Script(
    things=uuid_generator.GUID_THINGS,
    lines=script_6.GUID_LINES_D,
    cut=Toggle(False),
    attribute="Length",
    max_cut=Slider(20, range=0..100),
    max_cycle=Slider(1, range=0..10),
    upper_bound=Slider(10000, range=0..20000),
    lower_bound=Slider(10000, range=0..20000),
    min_len=Slider(10, range=0..4000),
    mode="find_closest",
    result=script_6.result)  # -> out, things, lines, result; inputs cut: Boolean, attribute: String, max_cut: Int32, max_cycle: Int32, upper_bound: Int32, lower_bound: Int32, min_len: Int32, mode: String, prior: String
# ---------- script_7: Python ----------
import rhinoscriptsyntax as rs
import Rhino.Geometry as rg

"""
1. Find closest match using greedy
2. return a list of length difference with pos and neg numbers
3. for the neg number => Cut extra and hence reduce the neg to 0
4. Add the extra piece back to the input and the length.
Stopping conditions are all reaches to 0 or 10 times
"""

# Add stopping Condition and Cycle time
# in Greedy(), it is measuring the length of the line to find best match
# now we have to split the line and push it to linked list a 

def split_by_plane_length(obj, pln, obj_type):

    # pln could be length if obj_type is line
    if obj_type == "Brep":
        bb = rg.Brep.GetBoundingBox(obj,rg.Plane.WorldXY)
        
        
        _,extU,extV = rg.Plane.ExtendThroughBox(pln,bb)
        extU.T0 = extU.T0 - 1
        extU.T1 = extU.T1 + 1
        extV.T0 = extV.T0 - 1
        extV.T1 = extV.T1 + 1
        
        planeSrf = rg.PlaneSurface(pln,extU,extV)
        splitter = planeSrf.ToBrep()

        brep = rs.coercebrep(obj)
        pieces = brep.Split(splitter,0.001)
        pieces = [piece.CapPlanarHoles(0.01)  for piece in pieces]
    if obj_type == "Line":
        start_pt = obj.PointAtStart
        end_pt = obj.PointAtEnd
        pt = obj.PointAtLength(pln)
        line1 = rg.Line(start_pt, pt).ToNurbsCurve()
        line2 = rg.Line(pt, end_pt).ToNurbsCurve()
        pieces = [line2, line1]
    return pieces

def find_closest_element(linked_list_a, linked_list_b, 
attribute, max_cycle, max_cut, upper_bound, lower_bound, min_len,mode, prior = None, result= None):
    step = 0
    cut_count = 0
    prev = linked_list_b.length

    if result == None:
        result = {}
    else:
        result = result.obj

    if linked_list_b.length > linked_list_a.length:
        print(linked_list_b.length)
        raise Exception("Number of input lines are more than available object")
        return

    def Greedy(linked_list_a, linked_list_b, attribute):
        current_b = linked_list_b.head
        pointer = 0 

        while current_b != None and current_b.CD != 0:
            if pointer <= prev:
                current_a = linked_list_a.head
                closest_node = None
                
                while current_a != None and current_a.value.Length > min_len:
                    d1 = current_b.value.Length - getattr(current_a.value, attribute)
                    if mode == "find_closest":
                        if prior == "material_cut":
                            if d1 < 0 and abs(d1) <= abs(current_b.CD) and current_a.value.ID not in result:
                                current_b.CD = d1
                                closest_node = current_a
                        if prior == "structure_cut":
                            if d1 >= 0 and abs(d1) <= abs(current_b.CD) and current_a.value.ID not in result:
                                current_b.CD = d1
                                closest_node = current_a
                            # Default
                        if prior == None:
                            if abs(d1) <= abs(current_b.CD)  and current_a.value.ID not in result:
                                current_b.CD = d1
                                closest_node = current_a
                    elif mode == "find_closest_with_bound":
                        if prior == None:
                            # Default
                            if abs(d1) <= abs(current_b.CD) and  -lower_bound <= d1 <= upper_bound and current_a.value.ID not in result:
                                    current_b.CD = d1
                                    closest_node = current_a
                        if prior == "material_cut":
                            if d1<0 and abs(d1) <= abs(current_b.CD) and  -lower_bound <= d1 <= upper_bound and current_a.value.ID not in result:
                                    current_b.CD = d1
                                    closest_node = current_a
                        if prior == "structure_cut":
                            if d1>0 and abs(d1) <= abs(current_b.CD) and  -lower_bound <= d1 <= upper_bound and current_a.value.ID not in result:
                                    current_b.CD = d1
                                    closest_node = current_a
                    elif mode == "find_within_bound":
                        if prior == "material_cut":
                            if d1 < 0 and -lower_bound <= d1 <= upper_bound and current_a.value.ID not in result:
                                current_b.CD = d1
                                closest_node = current_a
                                break
                        if prior == "structure_cut":
                            if d1 >= 0 and -lower_bound <= d1 <= upper_bound and current_a.value.ID not in result:
                                current_b.CD = d1
                                closest_node = current_a
                                break
                        if prior == None:
                            # Default
                            if -lower_bound <= d1 <= upper_bound and current_a.value.ID not in result:
                                current_b.CD = d1
                                closest_node = current_a
                                break

                    current_a = current_a.next
                
            if closest_node != None:
                result[closest_node.value.ID] = 1
                result[current_b.value.ID] = 1
            current_b.closest = closest_node
            
            current_b = current_b.next
            pointer += 1
        return 

    def transform(result, linked_list_a, linked_list_b):
        current = linked_list_b.head
        pointer = 0
        LS = linked_list_b.factory_method()
        nonlocal prev
        nonlocal cut_count
        while current:
            v = current.value.Geometry.PointAtStart - current.value.Geometry.PointAtEnd
            v =(v/v.Length * current.CD)
            end_pt =  current.value.Geometry.PointAtEnd + v
            line = rg.Line(current.value.Geometry.PointAtStart, end_pt)
            current.value.Geometry = line.ToNurbsCurve()
            current.value.update_info()
            current = current.next

        return
    
    def Cut(result, linked_list_a, linked_list_b):
        current = linked_list_b.head #iterate through lines 
        LS = linked_list_b.factory_method()
        pointer = 0
        nonlocal prev
        nonlocal cut_count
        while current and pointer <= prev:
            # split things if things are in excess
            if current.CD < 0 and current.closest != None:
                scalar = abs(current.CD)
                if attribute == "Length":
                    v = rg.Vector3d(scalar,0,0)
                    pln = current.closest.value.y_cut_plane.Clone()
                elif attribute == "Width":
                    v = rg.Vector3d(0, scalar,0)
                    pln = current.closest.value.x_cut_plane.Clone()
                elif attribute == "Height":
                    v = rg.Vector3d(0,0, scalar)
                    pln = current.closest.value.z_cut_plane.Clone()

                # Split original object according to length difference
                brp = current.closest.value.Geometry
                pln.Translate(v)
                current.closest.value.Cut = pln

                # Split the Brep and lines
                splited = split_by_plane_length(brp, pln, "Brep")
                # split Node

                if (len(splited)):
                    if current.value.Length < abs(current.CD):
                        splited = splited[::-1]
                    current.closest.split(splited, linked_list_a, "Brep")
                    print(current.closest.value.Length)
                    print(current.closest.next.value.Length)
                    cut_count += 1

            # split the lines if the lines are in excess
            if current.CD >0 and current.closest != None:
                splited = split_by_plane_length(
                    current.value.Geometry,
                    current.CD,
                    "Line")

                current.value.Geometry = splited[0]
                current.value.update_info()

                GUID = current.value.factory_method(
                    current.value.ID + "/", splited[1], "Line")
                LS.prepend(GUID)

            #once splited reduce CD to 0
            current.CD = 0
            current = current.next
            pointer += 1
        prev = LS.length
        if LS.length == 0:
            return linked_list_b
        return LS.concat(linked_list_b)
        
    while step < max_cycle:
        if step == 0:
            print("================================================")
        print(linked_list_a.length, linked_list_b.length)
        Greedy(linked_list_a, linked_list_b, attribute)
        print("Cut Start!")
        if cut:
            linked_list_b = Cut(result, linked_list_a, linked_list_b)
        else:
            transform(result, linked_list_a, linked_list_b)
        print(linked_list_a.length,linked_list_b.length)
        step +=1

    return result,linked_list_a, linked_list_b



result,things,lines = find_closest_element(things, lines, 
attribute, max_cycle, max_cut, upper_bound, lower_bound, min_len, mode, prior, result)


# Stupid GH cant pass dictionary
class DICT:
    def __init__ (self, obj):
        self.obj = obj
result = DICT(result)
# ---------- end script_7 ----------
script_8 = Script(
    things=uuid_generator.GUID_THINGS,
    lines=uuid_generator.GUID_LINES_C2,
    cut=boolean_toggle_2,
    attribute="Length",
    max_cut=number_slider_15,
    max_cycle=number_slider_13,
    upper_bound=number_slider_16,
    lower_bound=number_slider_14,
    min_len=number_slider_17,
    mode="find_closest",
    result=script_6.result)  # -> out, things, lines, result; inputs cut: Boolean, attribute: String, max_cut: Int32, max_cycle: Int32, upper_bound: Int32, lower_bound: Int32, min_len: Int32, mode: String, prior: String; disabled; same code as script_7
script_9 = Script(GUID_LINES_C=script_6.lines, GUID_LINES_D=script_7.lines)  # -> out, a, b, lines
# ---------- script_9: Python ----------
import Rhino
import Rhino.Geometry as rg

# ====================================================================================================

def get_center_of_lines(lines):
    """
    Calculate the center point (centroid) of the midpoints of multiple lines.

    :param lines: List of Line objects.
    :return: The center point as a Point3d object.
    """
    if not lines:
        return None

    total_x, total_y, total_z = 0, 0, 0
    count = 0

    for line in lines:
        if line.IsValid:  # Check if the line is valid
            # Calculate the midpoint
            midpoint = line.PointAt(0.5)
            total_x += midpoint.X
            total_y += midpoint.Y
            total_z += midpoint.Z
            count += 1

    if count == 0:
        return None

    # Calculate the average of the coordinates
    center = rg.Point3d(total_x / count, total_y / count, total_z / count)

    return center

def intersect_spheres(line1, line2):

    center1, center2 = line1.PointAtStart, line2.PointAtStart
    radius1,radius2 = line1.GetLength(), line2.GetLength()

    # Create sphere objects
    sphere1 = rg.Sphere(center1, radius1)
    sphere2 = rg.Sphere(center2, radius2)

    # Calculate intersection
    intersection = rg.Intersect.Intersection.BrepBrep(sphere1.ToBrep(), sphere2.ToBrep(), 0.01)

    # Return the intersection curve(s)
    if intersection[0] == True:
        return intersection[1][0]
    else:
        return None

def find_point_from_curve(curve, target_pt, length, sort_key = None, tolerance =0.01):

    if not curve.IsValid:
        return None

    # Ensure the curve is reparameterized for accurate calculations
    curve.Domain = rg.Interval(0, 1)
    sphere = rg.Sphere(target_pt, length)

    # Increment along the curve and check distances
    intersection = rg.Intersect.Intersection.CurveBrep(curve, sphere.ToBrep(), tolerance)
    if intersection[0] == True:
        point_list = list(intersection[2])
        if sort_key:
            point_list.sort(key = lambda x : x.DistanceTo(sort_key))
        else:
            point_list.sort(key = lambda x : x.DistanceTo(target_pt))
        return rg.Line(target_pt, point_list[0]).ToNurbsCurve()

    return None


# ====================================================================================================

a = []
b = []
c = []

# Now only for 4 sides with ordered lines input need to check for 3 sides
currentC = GUID_LINES_C.head
currentD = GUID_LINES_D.head
pointer = 0
while currentC != None:
    if pointer ==0 or pointer ==2:
        # if 0 get 3 end pt if 2 get 1 from C
        line1 = currentC.value.Geometry
        line2 = currentD.next.value.Geometry
        target_length = currentD.value.Length
        a.append(line1.PointAtEnd)
        if pointer -1 <0:
            target_pt = GUID_LINES_C.tail.value.Geometry.PointAtEnd
        else:
            target_pt = currentC.prev.value.Geometry.PointAtEnd

        intersection_circle = intersect_spheres(line1, line2)
        final_curve  = find_point_from_curve(intersection_circle, target_pt, target_length,
        sort_key = line1.PointAtEnd)

        # Update Geometry
        currentC.value.Geometry = rg.Line(line1.PointAtStart, final_curve.PointAtEnd).ToNurbsCurve()
        currentD.value.Geometry = final_curve
        currentD.next.value.Geometry = rg.Line(line2.PointAtStart, final_curve.PointAtEnd).ToNurbsCurve()

        currentC.value.update_info()
        currentD.value.update_info()
        currentD.next.value.update_info()


        b.append(intersection_circle)
        # c.append(currentC.value.Geometry)
        # c.append(currentD.next.value.Geometry)
        # c.append(final_curve)

    currentC = currentC.next
    currentD = currentD.next
    pointer += 1

lines = GUID_LINES_D

d = GUID_LINES_D.list_export("Geometry")
# ---------- end script_9 ----------
script_10 = Script(lines=script_8.lines)  # -> out, a
# ---------- script_10: Python ----------
a = lines.list_export("Geometry")
# ---------- end script_10 ----------
script_11 = Script(GUID_LINES_C2=script_8.lines)  # -> out, a
# ---------- script_11: Python ----------
import Rhino.Geometry as rg

def intersect_spheres(line_list):
    queue = [rg.Sphere(line_list[0].PointAtStart, line_list[0].GetLength()).ToBrep()]

    for line in line_list[1:]:
        sphere = rg.Sphere(line.PointAtStart, line.GetLength()).ToBrep()
        intersection = rg.Brep.CreateBooleanIntersection(queue[0], sphere, 0.01)
        if intersection:
            queue[0] = intersection[0]
    
    vertices = list(queue[0].Vertices)
    return  vertices


def find_point_from_curve(curve, target_pt, length, sort_key = None, tolerance =0.01):

    if not curve.IsValid:
        return None

    # Ensure the curve is reparameterized for accurate calculations
    curve.Domain = rg.Interval(0, 1)
    sphere = rg.Sphere(target_pt, length)

    # Increment along the curve and check distances
    intersection = rg.Intersect.Intersection.CurveBrep(curve, sphere.ToBrep(), tolerance)
    if intersection[0] == True:
        point_list = list(intersection[2])
        if sort_key:
            point_list.sort(key = lambda x : x.DistanceTo(sort_key))
        else:
            point_list.sort(key = lambda x : x.DistanceTo(target_pt))
        return rg.Line(target_pt, point_list[0]).ToNurbsCurve()

    return None


line_list = GUID_LINES_C2.list_export("Geometry")
a = intersect_spheres(line_list)[-1]
print(a)
# ---------- end script_11 ----------
script_12 = Script(lines=script_6.GUID_LINES_D)  # -> out, a; same code as script_10
script_13 = Script(GUID_LINES_C=script_6.lines, GUID_LINES_D=script_7.lines)  # -> out, a, b, lines; same code as script_9
visualizer = Script(things=[script_2.things, script_4.things, script_3.things], lines=[script_2.lines, script_4.lines, script_3.lines])  # -> out, plns, a, b, c, d, e, msg; disabled
# ---------- visualizer: Python ----------
plns = things.list_export("Cut")
plnS = things.list_export("y_cut_plane")


a = []
b = []
c = []
d = []
e = []

msg = 0
current = lines.head
while current != None:
    if current.closest:
        a.append(current.closest.value.Geometry)
        b.append(current.closest.value.AxisX)
        c.append(current.value.Geometry)
        msg += current.closest.value.Length
    d.append(current.value.Geometry)
    e.append(current.value.Connector)
    current = current.next
# ---------- end visualizer ----------
end_points = EndPoints(Curve=script_10.a)  # -> Start, End
# Line Types
# 
# A:Beams that can't move, fixed length
# B:Beams that  can move in X,Y but length is fixed
# C:Beams rotate around a fixed point, but length is fixed
# D: Beams that can be moved in X,Y,Z direction
visualizer_2 = Script(things=uuid_generator.GUID_THINGS, lines=[script_5.lines, script_6.lines, script_7.lines, script_13.lines])  # -> out, plns, a, b, c, d, e, msg; same code as visualizer
geometry = Geometry([<curve referenced from the Rhino model> x4])  # disabled
mass_addition = MassAddition(Input=visualizer.msg)  # -> Result, PartialResults; disabled
geometry_2 = Geometry(script_10.a)
geometry_3 = Geometry(script_11.a)
geometry_4 = Geometry(script_12.a)
bounding_box = BoundingBox(Content=geometry, Plane=PlaneXY(0, 0, 0), UnionBox=True)  # -> Box, Box_2; disabled
orient = Orient(Geometry=visualizer.a, Source=visualizer.b, Target=visualizer.c)  # -> Geometry, Transform; disabled
panel_15 = Panel(mass_addition.Result)  # disabled
line = Line(StartPoint=geometry_3, EndPoint=end_points.Start)
geometry_5 = Geometry(<curve referenced from the Rhino model>)
geometry_6 = Geometry(<curve referenced from the Rhino model>)
geometry_7 = Geometry(visualizer.e)  # disabled
surface = Surface(visualizer.plns)  # disabled
geometry_8 = Geometry(visualizer.a)  # disabled
geometry_9 = Geometry(visualizer.d)  # disabled
geometry_10 = Geometry(visualizer_2.c)
orient_2 = Orient(Geometry=visualizer_2.a, Source=visualizer_2.b, Target=visualizer_2.c)  # -> Geometry, Transform
volume = Volume(Geometry=bounding_box.Box)  # -> Volume, Centroid; disabled
point = Point(script_9.a)
geometry_11 = Geometry(script_9.b)
surface_2 = Surface(visualizer_2.plns)
# 1. 2 modes priporitise cut and prioritise not cut
# 
# 2. Connector part
# problems to solve
# 
# 1. Maybe change the split to start from the other side of the curve, this is not the most important part
# 
# Add space to connector
# 
# 
# 2. Add stopping conditions eg maximum cut, minimise cut
geometry_12 = Geometry(visualizer_2.a)
geometry_13 = Geometry(visualizer_2.d)
colour_swatch = ColourSwatch(SwatchColor=RGB(13, 150, 181))  # disabled
panel_16 = Panel("Optimization")
point_2 = Point(script_13.a)
geometry_14 = Geometry(script_13.b)
script_14 = Script(x=geometry_5, y=geometry_6)  # -> out, a; inputs x: Curve, y: Curve
# ---------- script_14: Python ----------
import Rhino.Geometry as rg

def orient_line(source_line, target_line):
    # Ensure that both source and target are valid lines
    if not source_line.IsValid or not target_line.IsValid:
        return None

    # Get line extremities
    source_start, source_end = source_line.PointAtStart, source_line.PointAtEnd
    target_start, target_end = target_line.PointAtStart, target_line.PointAtEnd

    # Calculate transformation
    translation = rg.Transform.Translation(target_start - source_start)
    source_dir = source_end - source_start
    target_dir = target_end - target_start
    rotation = rg.Transform.Rotation(source_dir, target_dir, source_start)

    # Combine transformations
    transform = translation * rotation

    # Apply the transformation
    oriented_line = source_line.ToNurbsCurve()
    oriented_line.Transform(transform)

    return oriented_line

# Example usage in Grasshopper:
# Connect the source line and target line to the inputs of this Python component
a = orient_line(x, y)
# ---------- end script_14 ----------
area = Area(Geometry=surface)  # -> Area, Centroid; disabled
point_3 = Point(<point referenced from the Rhino model>)  # disabled
list_item = ListItem(List=geometry_10, Index=Slider(0, range=0..100), Wrap=True)
group = Group(Objects=geometry_10)
custom_preview = CustomPreview(Geometry=geometry_8, Material=colour_swatch)  # disabled
area_2 = Area(Geometry=surface_2)  # -> Area, Centroid
point_4 = Point(volume.Centroid)  # disabled
geometry_15 = Geometry(script_14.a)
end_points_2 = EndPoints(Curve=geometry_9)  # -> Start, End; disabled
script_15 = Script()  # -> out, a; disabled
# ---------- script_15: Python ----------
def find_combinations(nums, target):
    def backtrack(start, path, target):
        # Base case: if target is zero, add the current combination
        if target == 0:
            result.append(path)
            return
        # If target becomes negative, no need to continue
        if target < 0:
            return
        for i in range(start, len(nums)):
            # Include the number in the combination and proceed
            backtrack(i, path + [nums[i]], target - nums[i])

    result = []
    backtrack(0, [], target)
    return result

# Example usage
target = 5
nums = [1, 2, 1, 2, 1, 1, 3]
combinations = find_combinations(nums, target)
print(combinations)
# ---------- end script_15 ----------
move_to_point = MoveToPoint(Geometry=geometry, PointA=point_4, PointB=point_3)  # -> Moved, Vector, Transform; disabled
custom_preview_2 = CustomPreview(Geometry=geometry_12, Material=ColourSwatch(SwatchColor=RGB(13, 150, 181)))
end_points_3 = EndPoints(Curve=geometry_13)  # -> Start, End
scale = Scale(Geometry=surface, Center=area.Centroid, Factor=222)  # -> Geometry, Transform; disabled
script_16 = Script()  # -> out, a; disabled
# ---------- script_16: Python ----------
import math

class NODE:
    def __init__ (self,value):
        self.value = value
        self.right = None
        self.left = None


#sorted array into BST 
Arr = [0,3,9,15,18]

def BST_transform(Arr):
    if not Arr:
        return None
    if len(Arr) == 1:
        return NODE(Arr[0])

    mid_pointer = len(Arr)//2
    left = Arr[:mid_pointer]
    right = Arr[mid_pointer +1:]
    

    ROOT = NODE(Arr[mid_pointer])
    ROOT.Left = BST_transform(left)
    ROOT.Right = BST_transform(right)
    
    return ROOT
# ---------- end script_16 ----------
group_2 = Group(Objects=move_to_point.Moved)  # disabled
geometry_16 = Geometry(end_points_2.Start)  # disabled
scale_2 = Scale(Geometry=surface_2, Center=area_2.Centroid, Factor=222)  # -> Geometry, Transform
# sort out two linked list
# such that the index is the one touching
geometry_17 = Geometry(<curve referenced from the Rhino model>)  # disabled
geometry_18 = Geometry(end_points_3.Start)
script_17 = Script(x=geometry_17)  # -> out, a; inputs x: Curve; disabled
# ---------- script_17: Python ----------
import Rhino.Geometry as rg

def scale_nurbscurve_uniformly(curve, new_length):
    """
    Uniformly scale a NurbsCurve from its midpoint so that its length is a specific value.

    :param curve: The NurbsCurve object to scale.
    :param new_length: The desired length of the curve.
    :return: A new scaled NurbsCurve object.
    """
    if not curve.IsValid or new_length <= 0:
        return None

    # Calculate the current length of the curve
    current_length = curve.GetLength()
    if current_length == 0:
        return None  # Cannot scale a zero-length curve

    # Calculate the scale factor
    scale_factor = new_length / current_length

    # Get the midpoint of the curve
    midpoint = curve.PointAt(curve.Domain.Mid)

    # Scale the curve about its midpoint
    xform = rg.Transform.Scale(midpoint, scale_factor)
    scaled_curve = curve.DuplicateCurve()
    scaled_curve.Transform(xform)

    return scaled_curve

# Example usage
# Assuming 'curve' is a Rhino.Geometry.NurbsCurve object
# new_length = 10  # for example
# scaled_curve = scale_nurbscurve_uniformly(curve, new_length)
# print(scaled_curve)



# Example usage
a = scale_nurbscurve_uniformly(x, 2300)
# ---------- end script_17 ----------
geometry_19 = Geometry(script_17.a)  # disabled
panel_17 = Panel("Visualization")
geometry_20 = Geometry(<curve referenced from the Rhino model>)
geometry_21 = Geometry(<curve referenced from the Rhino model>)
# Problem
# 1.min lenth doesnt work
# 
# 4.Add exception when no materials are available
# 5. Save different varation to JSON file and record missing length
# 5. Add functionality when all the pieces are used
script_18 = Script()  # -> out, a
# ---------- script_18: Python ----------
class NODE:
    def __init__ (self,value):
        self.value = value
        self.right = None
        self.left = None

class BST:
    def __init__ (self):
        self.root = None
    
    def insert(self, value):
        new_node = NODE(value)
        if self.root == None:
            self.root = new_node
            return self
        
        current = self.root
        while current != None:
            if value >= current.value:
                if current.right == None:
                    current.right = new_node
                    return self
                else:
                    current = current.right
            else:
                if current.left == None:
                    current.left = new_node
                    return self
                else:
                    current = current.left
    
    def look_up(self,value):
        if self.root == None:
            return False

        current = self.root
        while current != None:
            if value == current.value:
                return True              
            if value > current.value:
                current = current.right
            elif value < current.value:
                current = current.left
        return False
    
    def BFS(self):
        if self.root == None:
            return False

        current = self.root
        while current != None:
            current = current.left
        return

    @classmethod
    def array_transform(cls, Arr):
        def BST_transform(Arr):
            if not Arr:
                return None
            if len(Arr) == 1:
                return NODE(Arr[0])

            mid_pointer = len(Arr)//2
            left = Arr[:mid_pointer]
            right = Arr[mid_pointer +1:]
            

            ROOT = NODE(Arr[mid_pointer])
            ROOT.Left = BST_transform(left)
            ROOT.Right = BST_transform(right)
            
            return ROOT
        
        BST = cls()
        BST.root = BST_transform(Arr)
        return BST
# ---------- end script_18 ----------
geometry_22 = Geometry(<curve referenced from the Rhino model>)
geometry_23 = Geometry(<curve referenced from the Rhino model>)
script_19 = Script(x=geometry_22, y=geometry_23)  # -> out, a
# ---------- script_19: Python ----------
import Rhino.Geometry as rg

def find_point_from_curve(curve, line, tolerance =0.01):
    """
    Find a point on a curve that is a specified distance from a target point.

    :param curve: The curve to search (Rhino.Geometry.Curve).
    :param length: The specified distance from the target point.
    :param target_pt: The target point (Rhino.Geometry.Point3d).
    :return: The point on the curve or None if no such point exists.
    """
    if not curve.IsValid:
        return None

    # Ensure the curve is reparameterized for accurate calculations
    curve.Domain = rg.Interval(0, 1)
    length = line.GetLength()
    target_pt = line.PointAtStart
    sphere = rg.Sphere(target_pt, length)

    # Increment along the curve and check distances
    intersection = rg.Intersect.Intersection.CurveBrep(curve, sphere.ToBrep(), tolerance)
    if intersection[0] == True:
        point_list = list(intersection[2])
        point_list.sort(key = lambda x : x.DistanceTo(target_pt))
        return rg.Line(target_pt, point_list[0]).ToNurbsCurve()

    return None


a = find_point_from_curve(x,y)
# ---------- end script_19 ----------
length = Length(Curve=[geometry_20, geometry_21])
end_points_4 = EndPoints(Curve=[geometry_20, geometry_21])  # -> Start, End
geometry_24 = Geometry(script_19.a)
script_20 = Script(x=geometry_20, y=geometry_21)  # -> out, a; inputs x: Line, y: Line
# ---------- script_20: Python ----------
import Rhino.Geometry as rg
import math

def find_shared_endpoint(line1, line2):
    """
    Find a shared endpoint for two lines with fixed start points and lengths.
    
    :param line1: The first line (Rhino.Geometry.Line).
    :param line2: The second line (Rhino.Geometry.Line).
    :return: A shared endpoint (Rhino.Geometry.Point3d) or None if no solution.
    """
    start1, start2 = line1.From, line2.From
    len1, len2 = line1.Length, line2.Length

    # Distance between start points
    d = start1.DistanceTo(start2)

    # Check if a solution is possible
    if d > len1 + len2 or d < abs(len1 - len2):
        return None  # Lines can't meet due to length constraints

    # Trilateration to find the intersection points of two spheres
    a = (len1**2 - len2**2 + d**2) / (2 * d)
    h = math.sqrt(len1**2 - a**2)
    mid_point = start1 + (a/d) * (start2 - start1)

    # Potential intersection points
    x3 = mid_point.X + h * (start2.Y - start1.Y) / d
    y3 = mid_point.Y - h * (start2.X - start1.X) / d
    z3 = mid_point.Z

    x4 = mid_point.X - h * (start2.Y - start1.Y) / d
    y4 = mid_point.Y + h * (start2.X - start1.X) / d
    z4 = mid_point.Z

    intersection1 = rg.Point3d(x3, y3, z3)
    intersection2 = rg.Point3d(x4, y4, z4)

    # Select the intersection point that is in the direction of the initial lines
    if (intersection1 - start1).IsParallelTo(line1.Direction) and \
       (intersection1 - start2).IsParallelTo(line2.Direction):
        return intersection1
    elif (intersection2 - start1).IsParallelTo(line1.Direction) and \
         (intersection2 - start2).IsParallelTo(line2.Direction):
        return intersection2

    return None

# Example usage
# Assuming 'line1' and 'line2' are Rhino.Geometry.Line objects
a = find_shared_endpoint(x, y)
# ---------- end script_20 ----------
geometry_25 = Geometry(script_20.a)
script_21 = Script(x=geometry_20, y=geometry_21)  # -> out, a
# ---------- script_21: Python ----------
import Rhino.Geometry as rg

def intersect_spheres(center1, radius1, center2, radius2):

    """
    Find the intersection curve of two spheres.

    :param center1: Center of the first sphere (Point3d).
    :param radius1: Radius of the first sphere.
    :param center2: Center of the second sphere (Point3d).
    :param radius2: Radius of the second sphere.
    :return: Intersection curve if it exists.
    """
    # Create sphere objects
    sphere1 = rg.Sphere(center1, radius1)
    sphere2 = rg.Sphere(center2, radius2)

    # Calculate intersection
    intersection = rg.Intersect.Intersection.BrepBrep(sphere1.ToBrep(), sphere2.ToBrep(), 0.01)

    # Return the intersection curve(s)
    if intersection[0] == True:
        print(intersection)
        return intersection[1]
    else:
        return None


center1, center2 = x.PointAtStart, y.PointAtStart
radius1, radius2 = x.GetLength(), y.GetLength()
a = intersect_spheres(center1, radius1, center2, radius2)
# ---------- end script_21 ----------
script_22 = Script(x=geometry_20, y=geometry_21)  # -> out, a; inputs x: Line, y: Line
# ---------- script_22: Python ----------
import Rhino.Geometry as rg
import math

def find_common_endpoint(line1, line2):
    """
    Find a common endpoint for two lines with fixed start points and lengths.

    :param line1: The first line.
    :param line2: The second line.
    :return: A common endpoint or None if no such point exists.
    """
    start1, start2 = line1.From, line2.From
    radius1, radius2 = line1.Length, line2.Length

    # Calculate the distance between the start points
    d = start1.DistanceTo(start2)
    if d > radius1 + radius2 or d < abs(radius1 - radius2) or d == 0:
        # No solution: the spheres do not intersect or one is inside the other
        return None

    # Calculate the intersection point
    a = (radius1**2 - radius2**2 + d**2) / (2 * d)
    h = math.sqrt(radius1**2 - a**2)

    # Find the point P2, which is the base of the perpendicular from P3
    P2_x = start1.X + a * (start2.X - start1.X) / d
    P2_y = start1.Y + a * (start2.Y - start1.Y) / d
    P2_z = start1.Z + a * (start2.Z - start1.Z) / d
    P2 = rg.Point3d(P2_x, P2_y, P2_z)

    # Calculate the intersection points (there are two)
    i1_x = P2.X + h * (start2.Y - start1.Y) / d
    i1_y = P2.Y - h * (start2.X - start1.X) / d
    i1_z = P2.Z
    i2_x = P2.X - h * (start2.Y - start1.Y) / d
    i2_y = P2.Y + h * (start2.X - start1.X) / d
    i2_z = P2.Z

    intersection1 = rg.Point3d(i1_x, i1_y, i1_z)
    intersection2 = rg.Point3d(i2_x, i2_y, i2_z)

    # Depending on your specific needs, you can return one or both points
    # For example, returning the first intersection point:
    return [intersection1, intersection2]


a = find_common_endpoint(x, y)
# ---------- end script_22 ----------
sphere = Sphere(Base=end_points_4.Start, Radius=length)
geometry_26 = Geometry(script_22.a)
geometry_27 = Geometry(script_21.a)
