# Grasshopper definition 240122_Graph_Script.gh (Grasshopper 1.0.7)
# plug-ins: RhinoCodePluginGH

geometry_pipeline = GeometryPipeline(
    GroupByLayer=False,
    GroupByType=False,
    IncludeHidden=True,
    IncludeLocked=True,
    LayerFilter="Structure_Types::Typ A",
    NameFilter="*",
    SublayerFiltering=True,
    TypeFilter=4)
geometry_pipeline_2 = GeometryPipeline(
    GroupByLayer=False,
    GroupByType=False,
    IncludeHidden=True,
    IncludeLocked=True,
    LayerFilter="Structure_Types::Typ B",
    NameFilter="*",
    SublayerFiltering=True,
    TypeFilter=4)
geometry_pipeline_3 = GeometryPipeline(
    GroupByLayer=False,
    GroupByType=False,
    IncludeHidden=True,
    IncludeLocked=True,
    LayerFilter="Structure_Types::Typ C",
    NameFilter="*",
    SublayerFiltering=True,
    TypeFilter=4)
geometry_pipeline_4 = GeometryPipeline(
    GroupByLayer=False,
    GroupByType=False,
    IncludeHidden=True,
    IncludeLocked=True,
    LayerFilter="Structure_Types::Typ D",
    NameFilter="*",
    SublayerFiltering=True,
    TypeFilter=4)
geometry_pipeline_5 = GeometryPipeline(
    GroupByLayer=False,
    GroupByType=False,
    IncludeHidden=True,
    IncludeLocked=True,
    LayerFilter="Structure_Types::Typ E",
    NameFilter="*",
    SublayerFiltering=True,
    TypeFilter=4)
geometry_pipeline_6 = GeometryPipeline(
    GroupByLayer=False,
    GroupByType=False,
    IncludeHidden=True,
    IncludeLocked=True,
    LayerFilter="Structure_Types::Typ F",
    NameFilter="*",
    SublayerFiltering=True,
    TypeFilter=4)
geometry_pipeline_7 = GeometryPipeline(
    GroupByLayer=False,
    GroupByType=False,
    IncludeHidden=True,
    IncludeLocked=True,
    LayerFilter="Structure_Types::Typ G",
    NameFilter="*",
    SublayerFiltering=True,
    TypeFilter=4)
geometry_pipeline_8 = GeometryPipeline(
    GroupByLayer=False,
    GroupByType=False,
    IncludeHidden=True,
    IncludeLocked=True,
    LayerFilter="Structure_Types::Typ H",
    NameFilter="*",
    SublayerFiltering=True,
    TypeFilter=4)
geometry = Geometry(geometry_pipeline_8)
geometry_2 = Geometry([<curve referenced from the Rhino model> x12])
geometry_3 = Geometry(<point referenced from the Rhino model>)
script = Script(lines=geometry_2, x=geometry_3)  # -> out, a; inputs lines: list of Curve, x: Point3d
# ---------- script: Python ----------
import Rhino.Geometry as rg

# NameSpace
# ==================================================================================================    
class Edge:
    def __init__(self, key, line, edge_type):
        self.to = key
        self.edge_type = edge_type
        self.edge_length = line.GetLength()
class Node:
    def __init__(self, point):
        self.point = point
        self.edge = []

class Graph:
    def __init__(self, adjacency_list):
        self.number_of_nodes = len(adjacency_list)
        self.adjacency_list = adjacency_list

    def get_edge(self, pt):
        coordinate = (pt.X, pt.Y, pt.Z)
        key =  f"{int(pt.X)}_{int(pt.Y)}_{int(pt.Z)}"
        if key in self.adjacency_list:
            print(self.adjacency_list[key].edge)
            edge = map(lambda x:  self.adjacency_list[x.to].point,
            self.adjacency_list[key].edge)
            return list(edge)
        else:
            return None


    @classmethod
    def get_graph(cls, lines):

        def get_adjacency_list(lines):
            adjacency_list = {}

            for line in lines:
                st_pt = line.PointAtStart
                end_pt = line.PointAtEnd
                coordinate1 = (st_pt.X, st_pt.Y, st_pt.Z)
                coordinate2 = (end_pt.X, end_pt.Y, end_pt.Z)
                key1 = f"{int(st_pt.X)}_{int(st_pt.Y)}_{int(st_pt.Z)}"
                key2 = f"{int(end_pt.X)}_{int(end_pt.Y)}_{int(end_pt.Z)}"

                # Test the layer to see if lines length are changable
                edge1 = Edge(key1, line, "typA")
                edge2 = Edge(key2, line, "typA")

                if key1 not in adjacency_list:
                    adjacency_list[key1] = Node(st_pt)
                    adjacency_list[key1].edge.append(edge2)
                    
                else:
                    adjacency_list[key1].edge.append(edge2)
                     
                if key2 not in adjacency_list:
                    adjacency_list[key2] = Node(end_pt)
                    adjacency_list[key2].edge.append(edge1)
                else:
                    adjacency_list[key2].edge.append(edge1)

            return adjacency_list
        
        adjacency_list = get_adjacency_list(lines)
        return cls(adjacency_list)
# ==================================================================================================

graph1 = Graph.get_graph(lines)
a = graph1.get_edge(x)
# ---------- end script ----------
geometry_4 = Geometry(script.a)
line = Line(StartPoint=geometry_3, EndPoint=geometry_4)
panel = Panel(script.a)
