# Grasshopper definition 240305_Graph_Script.gh (Grasshopper 1.0.7)
# plug-ins: RhinoCodePluginGH

geometry_pipeline = GeometryPipeline(
    GroupByLayer=False,
    GroupByType=False,
    IncludeHidden=True,
    IncludeLocked=True,
    LayerFilter="BFH_ReUse24::Workspace",
    NameFilter="*",
    SublayerFiltering=True,
    TypeFilter=1073741848)
geometry_pipeline_2 = GeometryPipeline(
    GroupByLayer=False,
    GroupByType=False,
    IncludeHidden=True,
    IncludeLocked=True,
    LayerFilter="Structure_Types::Typ A",
    NameFilter="*",
    SublayerFiltering=True,
    TypeFilter=4)
geometry_pipeline_3 = GeometryPipeline(
    GroupByLayer=False,
    GroupByType=False,
    IncludeHidden=True,
    IncludeLocked=True,
    LayerFilter="Structure_Types::Typ B",
    NameFilter="*",
    SublayerFiltering=True,
    TypeFilter=4)
geometry_pipeline_4 = GeometryPipeline(
    GroupByLayer=False,
    GroupByType=False,
    IncludeHidden=True,
    IncludeLocked=True,
    LayerFilter="Structure_Types::Typ C",
    NameFilter="*",
    SublayerFiltering=True,
    TypeFilter=4)
geometry_pipeline_5 = GeometryPipeline(
    GroupByLayer=False,
    GroupByType=False,
    IncludeHidden=True,
    IncludeLocked=True,
    LayerFilter="Structure_Types::Typ D",
    NameFilter="*",
    SublayerFiltering=True,
    TypeFilter=4)
geometry_pipeline_6 = GeometryPipeline(
    GroupByLayer=False,
    GroupByType=False,
    IncludeHidden=True,
    IncludeLocked=True,
    LayerFilter="Structure_Types::Typ E",
    NameFilter="*",
    SublayerFiltering=True,
    TypeFilter=4)
geometry_pipeline_7 = GeometryPipeline(
    GroupByLayer=False,
    GroupByType=False,
    IncludeHidden=True,
    IncludeLocked=True,
    LayerFilter="Structure_Types::Typ F",
    NameFilter="*",
    SublayerFiltering=True,
    TypeFilter=4)
panel = Panel("find_within_bound")
panel_2 = Panel("find_closest_with_bound")
panel_3 = Panel("structure_cut")
panel_4 = Panel("material_cut")

# ---- group: Fetch from DB
script = Script(api="https://api.nasa.gov/planetary/apod?api_key=DEMO_KEY")  # -> out, result; inputs api: String
# ---------- script: Python ----------
import urllib.request
import json

def fetch_data(url):
    try:
        with urllib.request.urlopen(url) as response:
            data = json.loads(response.read().decode('utf-8'))
            return data
    except urllib.error.URLError as e:
        print(f"Error: {e}")
        return None
# Main
result = fetch_data(api)

print(result)
# ---------- end script ----------

# ----
run = Button(ExpressionNormal="True", ExpressionPressed="False")
button = Button(ExpressionNormal="True", ExpressionPressed="False")
number_slider = Slider(11, range=0..100)
boolean_toggle = BooleanToggle(False)  # disabled
number_slider_2 = Slider(20, range=0..100)  # disabled
number_slider_3 = Slider(1, range=0..10)  # disabled
number_slider_4 = Slider(10000, range=0..20000)  # disabled
number_slider_5 = Slider(10000, range=0..20000)  # disabled
number_slider_6 = Slider(0, range=0..4000)  # disabled
geometry = Geometry([<curve referenced from the Rhino model> x6])
geometry_2 = Geometry([<curve referenced from the Rhino model> x4])
geometry_3 = Geometry(<curve referenced from the Rhino model>)
panel_5 = Panel(script.result)
geometry_4 = Geometry([<curve referenced from the Rhino model> x6])
geometry_5 = Geometry([<curve referenced from the Rhino model> x4])
geometry_6 = Geometry(<curve referenced from the Rhino model>)
geometry_7 = Geometry([<curve referenced from the Rhino model> x6])
geometry_8 = Geometry([<curve referenced from the Rhino model> x4])
geometry_9 = Geometry(<curve referenced from the Rhino model>)
colour_swatch = ColourSwatch(SwatchColor=RGB(13, 150, 181))  # disabled

geometry_10 = Geometry([<curve referenced from the Rhino model> x6])
geometry_11 = Geometry([<curve referenced from the Rhino model> x4])
geometry_12 = Geometry(<curve referenced from the Rhino model>)

geometry_13 = Geometry([<curve referenced from the Rhino model> x6])
geometry_14 = Geometry([<curve referenced from the Rhino model> x5])
geometry_15 = Geometry([<curve referenced from the Rhino model> x3])

geometry_16 = Geometry([<curve referenced from the Rhino model> x6])
geometry_17 = Geometry([<curve referenced from the Rhino model> x4])
geometry_18 = Geometry([<curve referenced from the Rhino model> x3])
button_2 = Button(ExpressionNormal="True", ExpressionPressed="False")
script_2 = Script(a=geometry_13, c=geometry_2, e=geometry_14, f=geometry_15)  # -> out, lines; inputs a: list of Curve, b: list of Curve, c: list of Curve, d: list of Curve, e: list of Curve, f: list of Curve
# ---------- script_2: Python ----------
class dict_obj:
    def __init__(self, obj):
        self.obj = obj

lines = dict_obj( {
    "A":a,
    "B":b,
    "C":c,
    "D":d,
    "E":e,
    "F":f
})
# ---------- end script_2 ----------
uuid_generator = Script(things=geometry_pipeline, lines=script_2.lines, run=run, shuffle=Toggle(False))  # -> out, GUID_THINGS, GUID_LINES_A, GUID_LINES; inputs things: list, run: Boolean, seed: Int32
# ---------- uuid_generator: Python ----------
import Rhino
import copy
import rhinoscriptsyntax as rs
import Rhino.Geometry as rg
import random

# Namespace definition
# -------------------------------------------------
class GUID:
    def __init__ (self, ID, Geometry, Type):
        self.ID = ID
        self.Geometry = Geometry 
        self.Type = Type
        self.Cut = None
        self.Connector = None
        self.update_info()
        if self.Type == "Line":
            self.line_type = None

    def update_info(self, mode = None, manual = None):
        if self.Type == "Brep":
            self.info = self.bounding_box_dimensions(self.Geometry)
            self.Length = self.info[0][0]
            self.Width = self.info[0][1]
            self.Height = self.info[0][2]
            self.AxisX = self.info[1][0]
            self.AxisY = self.info[1][1]
            self.AxisZ = self.info[1][2]
            self.x_cut_plane = self.info[2][0]
            self.y_cut_plane = self.info[2][1]
            self.z_cut_plane = self.info[2][2]
            self.Bbox = self.info[3]
        elif self.Type == "Line":
            self.Connector = self.Geometry.PointAtStart
            if type(self.Geometry) == rg.Line:
                self.Length = self.rounding(self.Geometry.Length)
                return
            self.Length = self.rounding(rg.Curve.GetLength(self.Geometry))

    def bounding_box_dimensions(self, obj):
        if type(obj) == rg.Brep:
            vertices = [vertex.Location for vertex in obj.Vertices]
            bounding_box = rg.BoundingBox(vertices)
        else:
            vertices = [vertex.Location for vertex in obj.ToBrep().Vertices]
            bounding_box = rg.BoundingBox(vertices)

        # Calculate the dimensions of the bounding box
       
        x_extent = self.rounding(bounding_box.Max.X - bounding_box.Min.X)
        y_extent = self.rounding(bounding_box.Max.Y - bounding_box.Min.Y)
        z_extent = self.rounding(bounding_box.Max.Z - bounding_box.Min.Z)
        
        # Create the start and end points of the central axis
        center = bounding_box.Center
        start_pointX = rg.Point3d(center.X - x_extent / 2, center.Y, center.Z)
        end_pointX = rg.Point3d(center.X + x_extent / 2, center.Y, center.Z)

        start_pointY = rg.Point3d(center.X , center.Y - y_extent / 2, center.Z)
        end_pointY = rg.Point3d(center.X , center.Y + y_extent / 2, center.Z)

        start_pointZ = rg.Point3d(center.X, center.Y, center.Z -z_extent/2)
        end_pointZ = rg.Point3d(center.X, center.Y, center.Z + z_extent)

        x_line = rg.LineCurve(start_pointX, end_pointX)
        y_line = rg.LineCurve(start_pointY, end_pointY)
        z_line = rg.LineCurve(start_pointZ, end_pointZ)

        x_cut_plane = rg.Plane(rg.Point3d(start_pointX.X, start_pointX.Y-y_extent/2, start_pointX.Z),
        rg.Vector3d(0,1,0))
        y_cut_plane = rg.Plane(rg.Point3d(start_pointY.X - x_extent/2, start_pointY.Y, start_pointY.Z), 
        rg.Vector3d(1,0,0))
        z_cut_plane = rg.Plane(rg.Point3d(start_pointZ.X , start_pointZ.Y, start_pointZ.Z),
        rg.Vector3d(0,0,1))

        return ((x_extent, y_extent, z_extent),
                (x_line, y_line, z_line),
                (x_cut_plane, y_cut_plane, z_cut_plane),
                bounding_box)

    def factory_method(self, ID, Geometry, Type):
        G = GUID(ID, Geometry,Type)
        return G

    def rounding(self, num, decimal_place = 1):
        return round(num, decimal_place)

class NODE:
    def __init__(self, value):
        self.next = None
        self.prev = None
        self.value = value #self.value = GUID(ID, Geometry)
        self.closest = None #for lines, the cloest one to other link list
        self.CD = 100000000

    def split(self, obj, linked_list, obj_type, length = None):
        # Caution: Brep here is a Brep List !!!
        if self.value is not None:
            if obj_type == "Brep":
                self.value.Geometry = obj[0]
                self.value.update_info()
                splited_Node = NODE(GUID(self.value.ID + "/", obj[1], "Brep"))
                splited_Node.next = self.next
                self.next = splited_Node
            if obj_type == "Line":
                # Line is just a single line cryyy so dumb RG
                start_pt = rg.PointAtStart
                end_pt = rg.PointAtEnd
                pt = obj.DivideByLength(length, True, False)
                line1 = rg.Line(start_pt, pt)
                line2 = rg.Line(pt, end_pt)
                self.value.Geometry = line1
                self.value.update_info()
                splited_Node = NODE(GUID(self.value.ID + "/", line2, "Line"))
                splited_Node.next = self.next
                self.next = splited_Node
            
            linked_list.length += 1

    def factory_method(self, ID, obj, obj_type = "Line"):
        N = NODE(value = GUID(ID, obj, obj_type))
        return N


class LINKEDLIST:
    def __init__ (self):
        self.node = None
        self.head = None
        self.tail = None
        self.length = 0
    
    def append(self, value):
        newNode = NODE(value)
        current = self.head
        self.length += 1
        if self.head == None:
            self.head = newNode
            self.tail = newNode
            return newNode
        while current.next != None:
            current = current.next
            
        newNode.prev = current
        current.next = newNode
        self.tail = newNode
        return newNode

    def prepend(self, value):
        newNode = NODE(value)
        self.length +=1

        if self.head == None:
            self.head = newNode
            self.tail = newNode
            return self
        self.head.prev = newNode
        newNode.next = self.head
        self.head = newNode
        return self

    def traverse(self, action = None):
        current = self.head
        while current != None:
            if action:
                action()
            else:
                print(current)
            current = current.next

    def goto(self, position):
        current = self.head
        for i in range(position):
            if current != None:
                current = current.next
            else:
                raise IndexError("Index out of range")

        return current

    def pop(self, position = None):
        if position == None:
            position = self.length -1
            self.length -= 1
        if position == 0:
            if self.head != None:
                pop = self.goto(position)
                self.head = self.head.next
                self.length -= 1
                return pop
            else: 
                raise IndexError("Index out of range")
        if position >= self.length or position < 0:
            raise Exception("index out of range")

        previous = self.goto(position- 1)
        if previous != None and previous.next != None:
            previous.next = previous.next.next
            self.length -= 1
        else:
            raise IndexError("Index out of range")
        return previous

    
    def insert(self, value, position):
        # pass exception here eg position > self.length
        node = NODE(value)
        pointer1 = self.goto(position -1 )
        pointer2 = pointer1.next.next
        pointer1.next = node
        node.prev = pointer1 
        node.next = pointer2
        self.lenth += 1
        return node
    
    def list_export(self, attribute):
        lst = []
        current = self.head
        while current != None:
            value_attribute = getattr(current.value, attribute)
            lst.append(value_attribute)
            current = current.next
        return lst

    def copy(self):
        LS = LINKEDLIST()
        current = self.head
        while current != None:
            new_node = NODE(copy.deepcopy(current.value))
            LS.append(new_node)
            current = current.next
        return LS
    
    def concat(self, linked_list):
        if linked_list.head == None or self.head == None:
            raise Exception("Sorry both list must not be empty la")
        linked_list_tail = linked_list.tail
        linked_list.head.prev = self.tail
        self.tail.next = linked_list.head
        self.tail = linked_list_tail
        self.length += linked_list.length
        return self

    def reverse(self):
        prev = None
        current = self.head
        while(current is not None):
            next = current.next
            current.next = prev
            prev = current
            current = next
        self.head = prev
    
    def factory_method(self):
        LS = LINKEDLIST()
        return LS
# ==============================================================
GUID_LINES= LINKEDLIST()
GUID_LINES_A= LINKEDLIST()
GUID_THINGS = LINKEDLIST()

def shuffle_array(arr, seed=None):
    if seed is not None:
        random.seed(seed)
    n = len(arr)
    for i in range(n-1, 0, -1):
        j = random.randint(0, i)
        arr[i], arr[j] = arr[j], arr[i]
    return arr


if shuffle:
    things= shuffle_array(things, seed= None)
    lines = shuffle_array(lines, seed= None)

def line_rebuild(line):
    if line.PointAtStart.Z > line.PointAtEnd.Z:
        line = rg.Line(line.PointAtEnd,line.PointAtStart).ToNurbsCurve()
    return line

if run:
    for i,thing in enumerate(things):
        thingID = "thing" + str(i)        
        obj = GUID(thingID, thing, "Brep")
        GUID_THINGS.prepend(obj)
        
    for typ in lines.obj:
        if lines.obj[typ]:
            for i, line in enumerate(lines.obj[typ]):
                lineID = "line" + typ + str(i)
                obj = GUID(lineID, line_rebuild(line), "Line")
                obj.line_type = typ
                GUID_LINES.prepend(obj)
# ---------- end uuid_generator ----------
script_3 = Script(
    things=uuid_generator.GUID_THINGS,
    lines=uuid_generator.GUID_LINES,
    attribute="Length",
    cut=boolean_toggle,
    max_cut=number_slider_2,
    max_cycle=number_slider_3,
    upper_bound=number_slider_4,
    lower_bound=number_slider_5,
    min_len=number_slider_6,
    mode="find_closest")  # -> out, things, lines, result, a; inputs attribute: String, cut: Boolean, max_cut: Int32, max_cycle: Int32, upper_bound: Int32, lower_bound: Int32, min_len: Int32, mode: String, prior: String; disabled
# ---------- script_3: Python ----------
import rhinoscriptsyntax as rs
import Rhino.Geometry as rg

"""
1. Find closest match using greedy
2. return a list of length difference with pos and neg numbers
3. for the neg number => Cut extra and hence reduce the neg to 0
4. Add the extra piece back to the input and the length.
Stopping conditions are all reaches to 0 or 10 times
"""

# Add stopping Condition and Cycle time
# in Greedy(), it is measuring the length of the line to find best match
# now we have to split the line and push it to linked list a 

def split_by_plane_length(obj, pln, obj_type):

    # pln could be length if obj_type is line
    if obj_type == "Brep":
        bb = rg.Brep.GetBoundingBox(obj,rg.Plane.WorldXY)
        
        
        _,extU,extV = rg.Plane.ExtendThroughBox(pln,bb)
        extU.T0 = extU.T0 - 1
        extU.T1 = extU.T1 + 1
        extV.T0 = extV.T0 - 1
        extV.T1 = extV.T1 + 1
        
        planeSrf = rg.PlaneSurface(pln,extU,extV)
        splitter = planeSrf.ToBrep()

        brep = rs.coercebrep(obj)
        pieces = brep.Split(splitter,0.001)
        pieces = [piece.CapPlanarHoles(0.01)  for piece in pieces]
    if obj_type == "Line":
        start_pt = obj.PointAtStart
        end_pt = obj.PointAtEnd
        pt = obj.PointAtLength(pln)
        line1 = rg.Line(start_pt, pt).ToNurbsCurve()
        line2 = rg.Line(pt, end_pt).ToNurbsCurve()
        pieces = [line2, line1]
    return pieces

def find_closest_element(linked_list_a, linked_list_b, 
attribute, max_cycle, max_cut, upper_bound, lower_bound, min_len,mode, prior = None, result= None):
    step = 0
    cut_count = 0
    prev = linked_list_b.length

    if result == None:
        result = {}
    else:
        result = result.obj

    if linked_list_b.length > linked_list_a.length:
        raise Exception("Number of input lines are more than available object")
        return

    def Greedy(linked_list_a, linked_list_b, attribute):
        current_b = linked_list_b.head
        pointer = 0 
        while current_b != None and current_b.CD != 0:
            closest_node = None
            if pointer <= prev and current_b.value.line_type != "A":
                current_a = linked_list_a.head
                while current_a != None and current_a.value.Length > min_len:
                    d1 = current_b.value.Length - getattr(current_a.value, attribute)
                    if mode == "find_closest":
                        if prior == None:
                            # Default
                            if abs(d1) <= abs(current_b.CD)  and current_a.value.ID not in result:
                                current_b.CD = d1
                                closest_node = current_a
                    elif mode == "find_closest_with_bound":
                        if prior == None:
                            # Default
                            if abs(d1) <= abs(current_b.CD) and  -lower_bound <= d1 <= upper_bound and current_a.value.ID not in result:
                                    current_b.CD = d1
                                    closest_node = current_a
                    elif mode == "find_within_bound":
                        if prior == None:
                            # Default
                            if -lower_bound <= d1 <= upper_bound and current_a.value.ID not in result:
                                current_b.CD = d1
                                closest_node = current_a
                                break

                    current_a = current_a.next
                
            if closest_node != None:
                result[closest_node.value.ID] = 1
                result[current_b.value.ID] = 1
            current_b.closest = closest_node
            
            current_b = current_b.next
            pointer += 1
        return 
    
    def Cut(result, linked_list_a, linked_list_b):
        current = linked_list_b.head #iterate through lines 
        LS = linked_list_b.factory_method()
        pointer = 0
        nonlocal prev
        nonlocal cut_count
        while current and pointer <= prev:
            # split things if things are in excess
            if current.CD < 0 and current.closest != None:
                scalar = abs(current.CD)
                if attribute == "Length":
                    v = rg.Vector3d(scalar,0,0)
                    pln = current.closest.value.y_cut_plane.Clone()
                elif attribute == "Width":
                    v = rg.Vector3d(0, scalar,0)
                    pln = current.closest.value.x_cut_plane.Clone()
                elif attribute == "Height":
                    v = rg.Vector3d(0,0, scalar)
                    pln = current.closest.value.z_cut_plane.Clone()

                # Split original object according to length difference
                brp = current.closest.value.Geometry
                pln.Translate(v)
                current.closest.value.Cut = pln

                # Split the Brep and lines                
                splited = split_by_plane_length(brp, pln, "Brep")
                # split Node
            
                if (len(splited)):
                    current.closest.split(splited, linked_list_a, "Brep")
                    cut_count += 1

            # split the lines if the lines are in excess
            if current.CD >0 and current.closest != None:
                splited = split_by_plane_length(
                    current.value.Geometry,
                    current.CD,
                    "Line")

                current.value.Geometry = splited[0]
                current.value.update_info()

                GUID = current.value.factory_method(
                    current.value.ID + "/", splited[1], "Line")
                LS.prepend(GUID)

            #once splited reduce CD to 0
            current.CD = 0
            current = current.next
            pointer += 1
        prev = LS.length
        if LS.length == 0:
            return linked_list_b
        return LS.concat(linked_list_b)

    def Transform(result, linked_list_a, linked_list_b):
        current = linked_list_b.head
        pointer = 0
        LS = linked_list_b.factory_method()
        nonlocal prev
        nonlocal cut_count
        while current:
            v = current.value.Geometry.PointAtStart - current.value.Geometry.PointAtEnd
            v =(v/v.Length * current.CD)
            end_pt =  current.value.Geometry.PointAtEnd + v
            line = rg.Line(current.value.Geometry.PointAtStart, end_pt)
            current.value.Geometry = line.ToNurbsCurve()
            current.value.update_info()
            current = current.next
        return
        
    while step < max_cycle:
        print(linked_list_a.length, linked_list_b.length)
        Greedy(linked_list_a, linked_list_b, attribute)
        Transform(result,linked_list_a, linked_list_b)
        print("Cut Start!")
        if cut:
            linked_list_b = Cut(result, linked_list_a, linked_list_b)
            print(linked_list_a.length,linked_list_b.length)
        step +=1
    return result,linked_list_a, linked_list_b



result,things,lines = find_closest_element(things, lines, 
attribute, max_cycle, max_cut, upper_bound, lower_bound, min_len, mode, prior)


current = lines.head
a = []
pointer = 0
while current:
    print(pointer, current.closest, current.CD)
    current = current.next
    pointer +=1


# Stupid GH cant pass dictionary
class DICT:
    def __init__ (self, obj):
        self.obj = obj
result = DICT(result)
# ---------- end script_3 ----------
visualizer = Script(things=script_3.things, lines=script_3.lines)  # -> out, plns, a, b, c, d, e, msg; disabled
# ---------- visualizer: Python ----------
plns = things.list_export("Cut")
# plnS = things.list_export("y_cut_plane")


a = []
b = []
c = []
d = []
e = []

msg = 0
current = lines.head
while current != None:
    if current.closest:
        a.append(current.closest.value.Geometry)
        b.append(current.closest.value.AxisX)
        c.append(current.value.Geometry)
        msg += current.closest.value.Length
    d.append(current.value.Geometry)
    e.append(current.value.Connector)
    current = current.next
# ---------- end visualizer ----------
geometry_19 = Geometry(visualizer.c)  # disabled
orient = Orient(Geometry=visualizer.a, Source=visualizer.b, Target=visualizer.c)  # -> Geometry, Transform; disabled
surface = Surface(visualizer.plns)  # disabled
geometry_20 = Geometry(visualizer.d)  # disabled
group = Group(Objects=geometry_19)  # disabled
area = Area(Geometry=surface)  # -> Area, Centroid; disabled
custom_preview = CustomPreview(Geometry=visualizer.a, Material=colour_swatch)  # disabled
end_points = EndPoints(Curve=geometry_20)  # -> Start, End; disabled
scale = Scale(Geometry=surface, Center=area.Centroid, Factor=222)  # -> Geometry, Transform; disabled
list_item = ListItem(List=script_3.a, Index=0, Wrap=True)  # disabled
geometry_21 = Geometry(script_3.a)  # disabled
geometry_22 = Geometry(end_points.Start)  # disabled
geometry_23 = Geometry(<point referenced from the Rhino model>)
curve = Curve(<curve referenced from the Rhino model>)
# if the student already knows what is in the DB,
script_4 = Script(x=curve)  # -> out, a; inputs x: Curve
# ---------- script_4: Python ----------
print(x.SegmentCount)
# ---------- end script_4 ----------
script_5 = Script(lines=script_2.lines, run=button_2)  # -> out, a, graph
# ---------- script_5: Python ----------
import Rhino.Geometry as rg


# NameSpace
# ==================================================================================================    
class Edge:
    def __init__(self, nodes, _type):
        self.graph = None
        self.nodes = nodes  #the other nodes it links to
        self.closest = None
        self.CD = 10000000
        self._type = _type

    def build(self):
        if len(self.nodes) == 2 and self.graph != None:
            adj = self.graph.adjacency_list
            line = rg.Line(adj[self.nodes[0]].geometry, adj[self.nodes[1]].geometry).ToNurbsCurve()
            
            self.geometry = line
            self.length = int(line.GetLength())
            return line
        return None
class Node:
    def __init__(self, geometry, _type = None):
        self.graph = None
        self.geometry = geometry
        self.edges = []
        self._type = _type

    def set_geometry(self, geometry):
        return rg.Point3d(round(geometry.X), round(geometry.Y), round(geometry.Z))
        # -----------------------------------------------------------------
class Graph:
    def __init__(self, adjacency_list, edge_list):
        self.adjacency_list = adjacency_list
        self.edge_list = edge_list
        self.number_of_nodes = len(adjacency_list)
        self.number_of_edges = len(edge_list)

        
    def get_edge(self, pt = None, key1 = None, key2 = None, search_type = "point", return_type = "obj"):
        # use a point to find adjacent edges
        if search_type == "point":
            coordinate = (pt.X, pt.Y, pt.Z)
            node_key =  f"{int(pt.X)}_{int(pt.Y)}_{int(pt.Z)}"
            if node_key in self.adjacency_list:
                node = self.adjacency_list[node_key]
                A_edge = node.edges
                print([self.edge_list[edge_key]._type for edge_key in A_edge])
                edge = [self.edge_list[edge_key].geometry for edge_key in A_edge]
                return edge

        # or use the node keys to find connecting edges
        if search_type == "key":
            edge_key = key1 + "::" + key2
            if edge_key not in self.edge_list:
                edge_key = key2 + "::" + key1
            
            if edge_key in self.edge_list:
                if return_type == "obj":
                    return self.edge_list[edge_key]
                elif return_type == "key":
                    return edge_key
        return None   

    def get_node(self,pt):
        coordinate = (pt.X, pt.Y, pt.Z)
        key =  f"{int(pt.X)}_{int(pt.Y)}_{int(pt.Z)}"
        if key in self.adjacency_list:
            return self.adjacency_list[key]
        else:
            return None
            
    def get_adjacent_nodes(self, node_key, return_type= None):
        node = self.adjacency_list[node_key]
        # return key when needed
        if return_type == "key":
            a_node = [a_node_key
            for edge_key in node.edges
            for a_node_key in self.edge_list[edge_key].nodes 
            if a_node_key != node_key]
        elif return_type == "obj":
            a_node = [graph.adjacency_list[a_node_key]
            for edge_key in node.edges
            for a_node_key in self.edge_list[edge_key].nodes 
            if a_node_key != node_key]         
        return a_node
        

    def get_edge_from_pt(self, pt1, pt2):
        key1 = f"{int(pt1.X)}_{int(pt1.Y)}_{int(pt1.Z)}"
        key2 = f"{int(pt2.X)}_{int(pt2.Y)}_{int(pt2.Z)}"
        line_UID = key1 + "::" + key2
        if line_UID not in graph.edge_list:
            line_UID = key2 + "::" + key1
        return self.edge_list[line_UID]

    @classmethod
    def get_graph(cls, lines):
        # lines is an object containing a dictionary eg lines.obj
        def get_adjacency_list(lines):
            adjacency_list = {}
            edge_list = {}
            for typ in lines.obj:
                if lines.obj[typ] !=None:
                    for line in lines.obj[typ]:
                        # rebuild curve first
                        if line.PointAtStart.Z > line.PointAtEnd.Z:
                            line = rg.Line(line.PointAtEnd,line.PointAtStart).ToNurbsCurve()
                        # if line.Degree >1:

                        #points are turn to integer
                        st_pt = line.PointAtStart
                        st_pt = rg.Point3d(int(st_pt.X), int(st_pt.Y), int(st_pt.Z))
                        end_pt = line.PointAtEnd
                        end_pt = rg.Point3d(int(end_pt.X), int(end_pt.Y), int(end_pt.Z))
                        coordinate1 = (st_pt.X, st_pt.Y, st_pt.Z)
                        coordinate2 = (end_pt.X, end_pt.Y, end_pt.Z)
                        key1 = f"{int(st_pt.X)}_{int(st_pt.Y)}_{int(st_pt.Z)}"
                        key2 = f"{int(end_pt.X)}_{int(end_pt.Y)}_{int(end_pt.Z)}"
                        nodes = [key1, key2]

                        line_UID = key1 + "::" + key2
                        edge = Edge(nodes, typ)
                        edge_list[line_UID] = edge

                        if key1 not in adjacency_list:
                            adjacency_list[key1] = Node(st_pt, _type= typ)
                            adjacency_list[key1].edges.append(line_UID)
                            
                        else:
                            adjacency_list[key1].edges.append(line_UID)
                                
                        if key2 not in adjacency_list:
                            adjacency_list[key2] = Node(end_pt, _type= typ)
                            adjacency_list[key2].edges.append(line_UID)
                
                        else:
                            adjacency_list[key2].edges.append(line_UID)

            return adjacency_list, edge_list
        
        adjacency_list, edge_list = get_adjacency_list(lines)
        return cls(adjacency_list, edge_list)
# ==================================================================================================
# dicitony on if the length is changable for the  type, 0 = fixed length
dependecy_list = {"A":0,"B":1,"C":1,"D":0,"E":1,"F":0,}

if run:
    graph = Graph.get_graph(lines)

    for edge in graph.edge_list.values():
        edge.graph = graph
        edge.build()
    for node in graph.adjacency_list.values():
        node.graph = graph



b = [edge.geometry for edge in graph.edge_list.values()]
# ---------- end script_5 ----------
bst = Script(things=geometry_pipeline, run=button_2)  # -> out, BST; inputs things: list of Brep, run: Boolean
# ---------- bst: Python ----------
import Rhino.Geometry as rg
from collections import deque
# ============================================================
class Guid:
    def __init__(self, _id, geometry, quantity):
        self._id = _id
        self.geometry = geometry
        self.quantity = quantity
        self.update_info()

    def update_info(self):
        self.info = Guid.bounding_box_dimensions(self.geometry)
        self.length = self.info[0][0]
        self.width = self.info[0][1]
        self.height = self.info[0][2]
        self.axisX = self.info[1][0]
        self.axisY = self.info[1][1]
        self.axisZ = self.info[1][2]
        self.x_cut_plane = self.info[2][0]
        self.y_cut_plane = self.info[2][1]
        self.z_cut_plane = self.info[2][2]
    
    @staticmethod
    def bounding_box_dimensions(obj, sort_type= None):

        if type(obj) == rg.Brep:
            vertices = [vertex.Location for vertex in obj.Vertices]
            bounding_box = rg.BoundingBox(vertices)
        else:
            vertices = [vertex.Location for vertex in obj.ToBrep().Vertices]
            bounding_box = rg.BoundingBox(vertices)
        # Calculate the dimensions of the bounding box
       
        x_extent = int(bounding_box.Max.X - bounding_box.Min.X)
        y_extent = int(bounding_box.Max.Y - bounding_box.Min.Y)
        z_extent = int(bounding_box.Max.Z - bounding_box.Min.Z)


        # for outer usage 
        if sort_type == "length":
            return x_extent
        elif sort_type == "width":
            return y_extent
        elif sort_type == "height":
            return z_extent


        # Create the start and end points of the central axis
        center = bounding_box.Center
        start_pointX = rg.Point3d(center.X - x_extent / 2, center.Y, center.Z)
        end_pointX = rg.Point3d(center.X + x_extent / 2, center.Y, center.Z)

        start_pointY = rg.Point3d(center.X , center.Y - y_extent / 2, center.Z)
        end_pointY = rg.Point3d(center.X , center.Y + y_extent / 2, center.Z)

        start_pointZ = rg.Point3d(center.X, center.Y, center.Z -z_extent/2)
        end_pointZ = rg.Point3d(center.X, center.Y, center.Z + z_extent)


        x_line = rg.LineCurve(start_pointX, end_pointX)
        y_line = rg.LineCurve(start_pointY, end_pointY)
        z_line = rg.LineCurve(start_pointZ, end_pointZ)

        x_cut_plane = rg.Plane(rg.Point3d(start_pointX.X, start_pointX.Y-y_extent/2, start_pointX.Z),
        rg.Vector3d(0,1,0))
        y_cut_plane = rg.Plane(rg.Point3d(start_pointY.X - x_extent/2, start_pointY.Y, start_pointY.Z), 
        rg.Vector3d(1,0,0))
        z_cut_plane = rg.Plane(rg.Point3d(start_pointZ.X , start_pointZ.Y, start_pointZ.Z),
        rg.Vector3d(0,0,1))

        return ((x_extent, y_extent, z_extent),
                (x_line, y_line, z_line),
                (x_cut_plane, y_cut_plane, z_cut_plane))
class BST_Node:
    def __init__ (self, value):
        self.value = value
        self.right = None
        self.left = None
# --------------------------------------------------------------
class BST:
    def __init__ (self):
        self.root = None
        self.unique_length = None
    
    def insert(self, value):
        new_BST_Node = BST_Node(value)
        if self.root == None:
            self.root = new_BST_Node
            return self
        
        current = self.root
        while current != None:
            if value >= current.value:
                if current.right == None:
                    current.right = new_BST_Node
                    return self
                else:
                    current = current.right
            else:
                if current.left == None:
                    current.left = new_BST_Node
                    return self
                else:
                    current = current.left
    
    def look_up(self, target_value, tolerance, attr ="length"):
        if self.root == None:
            return False

        current = self.root
        while current != None:
            current_attr_value = getattr(current.value, attr)
            if target_value == current_attr_value or abs(target_value - current_attr_value) <= tolerance:
                return current              
            if target_value > current_attr_value:
                current = current.right
            elif target_value < current_attr_value:
                current = current.left
        return False

    def find_closest(self, target_value, attr ="length"):
        #assuming the target_value does not exisit in the BST
        # the list is assumed to be sorted by length
        current = self.root
        min_node = self.root
        min_diff = target_value- getattr(current.value, attr)
        while current != None:
            current_value = getattr(current.value, attr)
            current_diff = target_value- current_value
            if abs(current_diff) < abs(min_diff):
                min_node = current
                min_diff = current_diff
                # accept find cloest with a tolerance
            if target_value > current_value:
                current = current.right
            else:
                current = current.left
        return min_node.value, min_diff

    def find_closest_larger(self, target_value, attr ="length"):
        #assuming the target_value does not exisit in the BST
        # the list is assumed to be sorted by length
        current = self.root
        min_node = self.root
        min_diff = target_value- getattr(current.value, attr)
        while current != None:
            current_value = getattr(current.value, attr)
            current_diff = target_value- current_value
            if abs(current_diff) < abs(min_diff):
                min_node = current
                min_diff = current_diff
                # accept find cloest with a tolerance
            if target_value > current_value:
                current = current.right
            else:
                current = current.left
        return min_node.value, min_diff

    def bfs(self, attr = None):
        if not self.root:
            return []

        queue = deque([self.root])
        result = []

        while queue:
            BST_node = queue.popleft()  # Remove and return the leftmost BST_node
            if attr:
                result.append(getattr(BST_node.value, attr))
            else:
                result.append(BST_node.value)  # Process the current BST_node
            
            # Add the child BST_nodes to the queue if they exist
            if BST_node.left:
                queue.append(BST_node.left)
            if BST_node.right:
                queue.append(BST_node.right)
        return result

    @classmethod
    def array_transform(cls, Arr):
        def BST_transform(Arr):
            if not Arr:
                return None
            if len(Arr) == 1:
                return BST_Node(Arr[0])

            mid_pointer = len(Arr)//2
            left = Arr[:mid_pointer]
            right = Arr[mid_pointer +1:]

            Root = BST_Node(Arr[mid_pointer])
            Root.left = BST_transform(left)
            Root.right = BST_transform(right)
            
            return Root
        
        BST = cls()
        BST.root = BST_transform(Arr)
        return BST
# ============================================================
# sort the list and store the occurence of the same length
# this wont be necessary for the future.
length_dict = {}
things = sorted(things, key = lambda thing: 
Guid.bounding_box_dimensions(thing, sort_type= "length"))

for thing in things:
    length = Guid.bounding_box_dimensions(thing, sort_type= "length")
    count = 0
    if length not in length_dict:
        length_dict[length] = Guid(f"thing{count}", thing, 1)
        count +=1
    else:
        length_dict[length].quantity += 1
# ============================================================
guid_lst = [length_dict[length_key] for i, length_key in enumerate(length_dict)]
BST = BST.array_transform(guid_lst)
BST.unique_length = length_dict
print(BST.unique_length)
a = guid_lst[0].geometry
# ---------- end bst ----------
script_6 = Script()  # -> out, Function
# ---------- script_6: Python ----------
import Rhino.Geometry as rg
import random
import math
# =======================================================================
class Function():

    def to_point(self, result):
            return(rg.Point3d(result[0], result[1], result[2]))


    def find_point_from_curve(self, curve, target_pt, length):
        if type(curve) != rg.NurbsCurve:
            curve = curve.ToNurbsCurve()
        curve.Domain = rg.Interval(0, 1)
        sphere = rg.Sphere(target_pt, length)

        intersection = rg.Intersect.Intersection.CurveBrep(curve, sphere.ToBrep(), 0.01)
        if len(intersection[2]) > 0:
            point_list= list(intersection[2])
            point_list.sort(key = lambda x : x.DistanceTo(target_pt))
            return rg.Point3d(round(point_list[0].X), round(point_list[0].Y), round(point_list[0].Z))
        return None

    def rotation_trajectory(self, st_pt, end_pt, max_angle = 30):

        x,y,z = (st_pt.X + end_pt.X)/2, (st_pt.Y + end_pt.Y)/2,(st_pt.Z + end_pt.Z)/2
        mid_pt = rg.Point3d(x,y,z)

        # circle = rg.Circle(mid_pt, st_pt.DistanceTo(end_pt))

        local_x_axis = (end_pt - st_pt)
        local_y_axis = rg.Vector3d.CrossProduct(local_x_axis, rg.Vector3d(0, 0, 1))

        local_x_axis.Unitize()
        local_y_axis.Unitize()

        arc_solution = []
        increment = 0
        up_vectors = [0, 300, 600]
        vectors = [local_y_axis, rg.Vector3d.ZAxis]

        for up_v in up_vectors:
                for v in  vectors:
                    rotate1 = rg.Transform.Rotation(max_angle, v, mid_pt)
                    rotate2 = rg.Transform.Rotation(-max_angle, v, mid_pt)
                    
                    arc_pt1 = rg.Point3d(st_pt + rg.Vector3d(0,0,up_v))
                    arc_pt2 = rg.Point3d(arc_pt1)

                    arc_pt1.Transform(rotate1)
                    arc_pt2.Transform(rotate2)

                    # arc = rg.Arc(arc_pt1, st_pt, arc_pt2)
                    arc = rg.Curve.CreateInterpolatedCurve([arc_pt1, st_pt, arc_pt2],3)
                    # arc.Domain = rg.Interval(0, 1)

                    arc_solution.append(arc)
        return arc_solution, mid_pt

# =======================================================================

    def get_newpts_from_sub(self, graph, F_node_A, F_node_B, edge_type, **kwargs):
        #F_node_A and F_node_B are the nodes from the fixed edge_type
        # target_pt are the other node for the edge for substitution 

        def B():
            # st_pt_A = F_node_A.geomety
            # edges_A = [graph.edge_list[edge_key].geometry for edge_key in F_node_A.edges]
            # vectors_A = [self.to_vector(edge) for edge in edges_A]
            return
        def D():
            # set the lowest point to ground
            # st_pt_A = F_node_A.geometry
            st_pt_A = rg.Point3d(F_node_A.geometry.X,F_node_A.geometry.Y,0)
            length1 = kwargs["length1"]
            target_node1 = kwargs["target_node1"]
            trajectory_A = rg.Line(st_pt_A, rg.Vector3d(0,0,1), 10000).ToNurbsCurve()
            v = F_node_B.geometry -  F_node_A.geometry
            Pt_A = self.find_point_from_curve(trajectory_A, target_node1.geometry, length1)
            if Pt_A:
                Pt_B = Pt_A +v
                return Pt_A, Pt_B
            return  None, None
        
        def F():
            st_pt_A =  F_node_A.geometry
            end_pt_B = F_node_B.geometry
            length1 = kwargs["length1"]
            target_node1 = kwargs["target_node1"]
            #Get list of Arc Trajectory.
            arc_solution, mid_pt = self.rotation_trajectory(st_pt_A, end_pt_B)
            # Test if Pt_A exist in the closest 
            solution = []
            for arc in arc_solution:
                Pt_A = self.find_point_from_curve(arc, target_node1.geometry, length1)
                if Pt_A:
                    param, _ = arc.ClosestPoint(Pt_A)
                    tangent_Pt_A = arc.TangentAt(param)
                    normal = rg.Vector3d.CrossProduct(tangent_Pt_A, rg.Vector3d(0, 0, 1))
                    normal.Unitize()
                    v =  mid_pt - Pt_A
                    Pt_B = Pt_A + normal * st_pt_A.DistanceTo(end_pt_B)
                    solution.append((Pt_A, Pt_B))
            return solution
            # Get a list of solution for rotation in xy and yz plane 

            # # two length to substitue each side
            # st_pt_A = F_node_A.geomety
            # length1 = kwargs["length1 "]
            # length2 = kwargs["length2"]
            # target_node1 = kwargs["target_node1"]
            # target_node2 = kwargs["target_node2"]
            # target_node3 = kwargs["target_node3"]
            # trajectory_A = rg.Line(st_pt_A, rg.Vector3d(0,0,1), 10000).ToNurbsCurve()
            
            # #Assume A for Z movement first
            # Pt_A = self.find_point_from_curve(trajectory_A, target_node1.geometry, length1)

            # sphere1 = rg.Sphere(Pt_A, F_node_A.geomety.DistanceTo(F_node_B.geomety))
            # sphere2 = rg.Sphere(target_node2, length2)

            # #calculate position of Pt_B
            # intersection = rg.Intersect.Intersection.BrepBrep(sphere1.ToBrep(), sphere2.ToBrep(), 0.01)
            # # Return the intersection curve(s)
            # if intersection[0] == True:
            #     intersection = intersection[1][0]
            # else:
            #     return None


            return
        
        locus_conversion = {
            "A":None,
            "B":B,
            "C":None,
            "D":D,
            "E":None,
            "F":F
            }
        return locus_conversion[edge_type]()

# =======================================================================
    def Translate(self, graph, node_key):

        def find_point_from_lotus(graph, locus, pt, A_pt):
        
            if not locus.IsValid:
                return None
            edge = graph.get_edge_from_pt(pt, A_pt)
            # Ensure the curve is reparameterized for accurate calculations
            locus.Domain = rg.Interval(0, 1)
            sphere = rg.Sphere(A_pt, edge.length)

            intersection = rg.Intersect.Intersection.CurveBrep(locus, sphere.ToBrep(), 0.01)
            if intersection[0] == True:
                
                point_list = list(intersection[2])
                point_list.sort(key = lambda x : x.DistanceTo(locus.PointAtStart))

                coordinate = (int(point_list[0].X), int(point_list[0].Y), int(point_list[0].Z))
                # node.temp = rg.Point3d(int(point_list[0].X), int(point_list[0].Y), int(point_list[0].Z))
                return coordinate
            return None
        
        # ----------------------------------------------
        def B(graph, node, adjacent_nodes):
            # changable length, move along direction of edges
            return
        def C(graph, node, adjacent_nodes):
            # changable length, move z
            locus = rg.Line(node.geometry, rg.Vector3d(0,0,1), 10000).ToNurbsCurve()

            result = set([find_point_from_lotus(graph, locus, node.geometry, A_pt.geometry)
            for A_pt in adjacent_nodes])
            # handle the case if result is not 1

            # result is a set of tuples, update curve geometry in edge
            return result
        def D(graph, node, adjacent_nodes):
            locus = rg.Line(node.geometry, rg.Vector3d(0,0,1), 10000).ToNurbsCurve()
            #fixed length move z
            return
        def E(graph, node, adjacent_nodes):
            #changeable lenhgh move XYZ
            return
        def F(graph, node, adjacent_nodes):
            #fixed length move xyz
            return
        # ----------------------------------------------
        FC_conversion = {"B":B,"C":C,"D":D,"E":E,"F":F}
        ED_conversion= {"A":0,"B":1,"C":1,"D":0,"E":1,"F":0}





        node = graph.adjacency_list[node_key]
        adjacent_edges = [graph.edge_list[a_edge] for a_edge in node.edges]
        adjacent_nodes = list({graph.adjacency_list[a_node_key] for edge in adjacent_edges for a_node_key in edge.nodes
        if a_node_key != node_key})
        print(adjacent_nodes)
        edge_type_keys = [edge._type for edge in adjacent_edges]
        edge_converted = [ED_conversion[key] for key in edge_type_keys]
        # ----------------------------------------------
        return FC_conversion[node._type](graph, node, adjacent_nodes)
# =======================================================================
Function = Function()
# ---------- end script_6 ----------
geometry_24 = Geometry(script_5.a)
script_7 = Script(things=uuid_generator.GUID_THINGS, Function=script_6.Function, x=geometry_23)  # -> out, things, graph, a, b, c, d, e; inputs x: Point3d; disabled
# ---------- script_7: Python ----------
import Rhino.Geometry as rg

# Function name space
# =======================================================================
def Greedy(graph, things, graph_edge, result):
    current = things.head
    closest_node = None
    while current:
        d1 = graph_edge.length - current.value.Length
        if abs(d1) <= abs(graph_edge.CD)  and current.value.ID not in result:
            graph_edge.CD = d1
            closest_node = current
        current = current.next
    if closest_node != None:
        result[closest_node.value.ID] = 1
    graph_edge.closest = closest_node
    return result
    # ----------------------------------------------
def Greedy_Cut(graph, things, graph_edge, result):
    return
    # ----------------------------------------------
def Greedy_Transform_edge(graph, graph_edge, nodes4update, FC = None):
    # type B for update_edge for testing
    v = graph_edge.geometry.PointAtStart - graph_edge.geometry.PointAtEnd
    v =(v/v.Length * graph_edge.CD)
    end_pt =  graph_edge.geometry.PointAtEnd + v
    line = rg.Line(graph_edge.geometry.PointAtStart, end_pt)
    graph_edge.geometry = line.ToNurbsCurve()
    # graph_edge.update_info()
    # add to the nodes for update with no duplicates and no type A      
    [nodes4update.add(node_key) for node_key in graph_edge.nodes 
    if graph.adjacency_list[node_key]._type != "A"]
    return
    # ----------------------------------------------
def Transform_node(graph, graph_edge, node_key, FC= None):
    conversion= {"A":0,"B":1,"C":1,"D":0,"E":1,"F":0}
    result = []
    node = graph.adjacency_list[node_key]
    FC_result = FC.Translate(graph, node_key)
    print(FC_result)

    # handle the result is result is more than 1. 
    # first check where that point that edge belongs to
    # and whether 
    result.extend(FC_result)
    # update node and update edge
    return [FC.to_point(coordinate) for coordinate in result]
# Main
# =======================================================================
'''
# Interat all the edges
    1. Find Cloest Match using Greedy
    2. Transform all the edge based on the newly found match
    3. Get a list of nodes that needs to be update
# Loop end for the edge 
    4. Update the list of nodes
'''
# =======================================================================
a = []
b = []
c = []
e = []
result = {}
nodes4update = set()

for edge_key in graph.edge_list:
    edge = graph.edge_list[edge_key]
    if edge._type != "A":
        Greedy(graph, things, edge, result)
        Greedy_Transform_edge(graph, edge, nodes4update)

    if edge.closest:
        a.append(edge.closest.value.Geometry)
        b.append(edge.closest.value.AxisX)
        c.append(edge.geometry)
for node_key in nodes4update:
    e.extend(Transform_node(graph, edge, node_key, Function))
# print(result)
# print(nodes4update)
d = graph.get_edge(x)
# ---------- end script_7 ----------
script_8 = Script(graph=script_5.graph, FC=script_6.Function, BST=bst.BST, tolerance=Slider(500, range=0..1000))  # -> out, things, graph, a, b, c, d, e; inputs tolerance: Int32
# ---------- script_8: Python ----------
import Rhino.Geometry as rg
from collections import Counter
# Function name space
# ====================================================================================================== 

# ====================================================================================================== 
def substitute_and_search(BST, graph, node_for_trajectory, edge, tolerance, global_memory):
    key0 = node_for_trajectory[0]
    key1 = node_for_trajectory[1]
    node_A = graph.adjacency_list[key0]
    node_B = graph.adjacency_list[key1]
    fixed_edge_types = {"A", "D", "F"}

    Adj_keys_A = graph.get_adjacent_nodes(key0, return_type = "key")
    Adj_edges_A =  [graph.get_edge(key1 =key0, key2 =node_key,search_type = "key") for node_key in Adj_keys_A
    if node_key not in node_for_trajectory]
    Adj_edges_A = [edge for edge in Adj_edges_A if edge._type not in fixed_edge_types]
    Adj_nodes_A = [graph.adjacency_list[node_key] for edge in Adj_edges_A for node_key in edge.nodes 
    if node_key not in node_for_trajectory]

    #Recursive Function to bundle all connecting fixed Edges
    # -------------------------------------------------------------------------
    Current_adj_edges = set(node_B.edges)
    def recursive_dispatch(Current_adj_edges, current_type = edge._type, global_memory = global_memory):
        F_nodes = set()
        F_adj_nodes = set()
        memory = set()
        counter = 0
        max_iter = 5

        def dispatch(Current_adj_edges, F_nodes, F_adj_nodes, memory, counter, global_memory):
            memory |= Current_adj_edges
            Current_adj_edges_obj = {graph.edge_list[key] for key in Current_adj_edges}

            # stop condition
            if all({edge._type not in fixed_edge_types for edge in Current_adj_edges_obj}) or counter>= max_iter:
                print("[INFO]", f"Fixed nodes: {F_nodes }")
                return F_nodes, F_adj_nodes

            for edge in Current_adj_edges_obj:
                if edge._type == current_type:
                    global_memory.add(edge)
                    for key in edge.nodes:
                        F_nodes.add(key)
                else:
                    for key in edge.nodes:
                        F_adj_nodes.add(key)
                
                F_adj_nodes -=  F_nodes
            union = F_nodes.union(F_adj_nodes)
            result = set()
            for key in F_nodes:
                Current_adj_nodes = graph.get_adjacent_nodes(key, "key")
                temp = {graph.get_edge(key1 = key, key2= node_key, search_type = "key", return_type = "key") 
                for node_key in Current_adj_nodes}
                result |= temp
            
            result -= memory
            Current_adj_edges = result
            counter +=1
            return dispatch(Current_adj_edges, F_nodes, F_adj_nodes, memory, counter, global_memory)    

        return dispatch(Current_adj_edges, F_nodes, F_adj_nodes, memory, counter, global_memory)

    new_F, F_adj_nodes = recursive_dispatch(Current_adj_edges)
    print("adj", F_adj_nodes)
    # adj_edges = F_adj_nodes

    Adj_keys_B = graph.get_adjacent_nodes(key1, return_type = "key")
    Adj_edges_B =  [graph.get_edge(key1 =key1, key2 =node_key,search_type = "key") for node_key in Adj_keys_B
    if node_key not in node_for_trajectory]
    Adj_edges_B = [edge for edge in Adj_edges_B if edge._type not in fixed_edge_types]
    Adj_nodes_B = [graph.adjacency_list[node_key] for edge in Adj_edges_B for node_key in edge.nodes 
    if node_key not in node_for_trajectory]

    Adj_edges =  Adj_edges_A + Adj_edges_B
    
    # -------------------------------------------------------------------------
    def default():
        _bool = True
        length_combination_A = [int(Pt_A.DistanceTo(node.geometry)) for node in Adj_nodes_A]
        length_combination_B = [int(Pt_B.DistanceTo(node.geometry)) for node in Adj_nodes_B]
        combined = length_combination_A + length_combination_B
        temp = []
        total_diff = 0
        for l in combined:
            # diff = line.length - thing.length so positive meaning smaller thing
            closest_node, diff = BST.find_closest(l)
            if diff >0:
                return
            if abs(diff)> tolerance:
                return
            total_diff += abs(diff)
            temp.append(closest_node.length)
        if _bool:
            count_unique = Counter(temp)
            print(length)
            if all([ BST.unique_length[key].quantity >= amount for key, amount in count_unique.items()]):
                print(temp)

                print(f"[INFO] Solution for type {edge._type} fixed edge with length {edge.length}: ")
                print(f"{count_unique} with a total difference of {total_diff} mm")
                for key, amount in count_unique.items():
                    BST.unique_length[key].quantity -= amount
                node_A.geometry = Pt_A
                node_B.geometry = Pt_B

                for i,a_edge in enumerate(Adj_edges):
                    closest = BST.unique_length[temp[i]]
                    a_edge.closest = closest
                    a_edge.CD = int(edge.length - closest.length)

                return True
            else:
                print(f"Combination: {combined} requires more items than in stock")
                return False
        return False
    # instantiate it with one of the length from the DB
    # -------------------------------------------------------------------------
    for length in BST.unique_length:
        FC_result = FC.get_newpts_from_sub(graph, node_A, node_B, edge._type, 
        length1 = length, target_node1 = Adj_nodes_A[0])
        if edge._type == "D":
            Pt_A, Pt_B = FC_result
            if default():
                return
        elif edge._type == "F":
            # FC_result = [(Pt_A, Pt_B), ()...]
            for result in FC_result:
                Pt_A, Pt_B = result
                if default():
                    return 
    print(f"[INFO] No Result for type {edge._type} fixed edge with length {edge.length}")
    return
# Main
# =======================================================================
a = []
b = []
c = []
d = []
result = {}
nodes4update = set()
ED_conversion= {"A":0,"B":1,"C":1,"D":0,"E":1,"F":0}
fixed_edge_types = ["A" , "D" , "F"]
global_memory = set()
for edge in graph.edge_list.values():
    # Take all the fixed length and assign it 
    if edge._type in fixed_edge_types:
        try: 
            edge.closest = BST.unique_length[edge.length]
        except KeyError:
            edge.closest = BST.find_closest(edge.length)[0]
    if edge._type != "A" and ED_conversion[edge._type] == 0:
        # Length not changable, assuming student know it must exist

        # movement of the edge is determined by the node
        nodes_for_trajectory = [node_key
        for node_key in edge.nodes]
        print(nodes_for_trajectory)
        # the edge could only move xyz if all connecting edge are typeE,F
        # D => Z movement F=> XYZ
        
        node_types = [graph.adjacency_list[node_key]._type for node_key in edge.nodes]
        if "A" in node_types:
            if "E" in node_types or "F" in node_types:
                print("special case")
                break

        if node_types[0] == node_types[1]:
            edge._type = node_types[0]
        else:
            # one is C, D and the other E,F
            if "C" in node_types or "D" in node_types:
                edge._type = "D"
            else:
                edge._type = "F"
        # if C= D, if E =F, their movement are the same but better to 
        #  align it with the layer
        if edge._type == "C":
            edge._type = "D"
        if edge._type == "E":
            edge._type = "F" 

        # last num
        if edge not in global_memory:
            e = substitute_and_search(BST, graph, nodes_for_trajectory, edge, tolerance, global_memory)

for edge in graph.edge_list.values():
    if edge.closest:
        a.append(edge.closest.geometry)
        b.append(edge.closest.axisX)
        c.append(edge.build())
    d.append(edge.build())
#pick one of the edge
# instatiate it with the length of an existing DB item ? 
# random or cloest match a bit longer?
# calculate the require length for the other edge and check if they are in the DB
# if  yes map them 
# if no, move on to another item
# in cases where there are no matches, can pass a tolerance 
# or memorise the combination with least distance error 
# eg sum[L1, LN] comparing with sum[L1.. LN] from DB



"""
knowing that there is a trajectory  and a given list of length.
and a list of other lines i would like to find a sets of length from the list such that 

if you dont move it then it is find closest match with a vector of 0 
along the trajectory

1. Get list of L1 to LN meaning all connecting edges to the fixed
edge whose length can not be changed

2. [L1, L2, ... LN] 

3. Use the smallest length i.e. L1 of them and test moving along the trajectory
whethere there are solutions !!! NOT EFFICINET !!!

3. MORE efficient:  assuming L1 is one of the element from DB => 
should i perform find cloest on this edge ? 
however still need to loop through? which item should we assume ? still cloest match
the DB maybe use BST ? And the initial guess, could we get a sense of direction
sth like ML algorithm ?
since now cutting wont happen until the end, insertion is 
also log(n) ? any ways to narrow the search ?

4.use the length of the found element in DB, calculate the corresponding point
on the trajectory, then the length of the other L2 - LN. 
if any of the value not in the DB, break and use another value for L1

5. is it possible to memorise the L2-LN value ? so we dont need to recalculate?
eg [L1, L2 = 0,928L1, 0.998L1] representing others all with A1? seems not :(

6. ways to narrow down search include looking for duplicates in the 
length list eg if L2 = L1 then you have to look for quantity which is not yet implemented
in the script but should be for the DB

7. L1 to Ln how spread out they are maybe has an significance on the search ?
for narrowing it ?

8. Since it is a combination of best matches, meaning that it is harder acquire
ther are high possibilities that there is no solution








To discuss:
1. for the edges that do not match which is better: closest or longer ? longer allows cut cloest i dunno
2. Remove Type B, type C and type F merge all as black changable 
3. for move F it is still first move D(z-direction) but with 2 pieces from the DB picked





MedieNutzung
Einleitung: 
Welche Typen eg Podcast, TV, Youtube


Vorteil: Lernen, Globalizierung, kommunikation, vie arbeit Platz erzeugen, Katastrophen
Nachteil: Vergleicen FakeNEWs with USA
"""
# ---------- end script_8 ----------
geometry_25 = Geometry(script_8.e)
# Task today
# finding tracecotry of points and lines
# fixed problem for the edge
orient_2 = Orient(Geometry=script_7.a, Source=script_7.b, Target=script_7.c)  # -> Geometry, Transform; disabled
geometry_26 = Geometry(script_8.a)
geometry_27 = Geometry(script_8.b)
geometry_28 = Geometry(script_8.c)
geometry_29 = Geometry(script_8.d)
geometry_30 = Geometry(<curve referenced from the Rhino model>)  # disabled
geometry_31 = Geometry(<curve referenced from the Rhino model>)  # disabled
geometry_32 = Geometry(script_7.c)
geometry_33 = Geometry(script_7.d)
# Task today
# 1.Recursive Function on getting all fixed connected edges and their nodes
geometry_34 = Geometry(script_7.e)
end_points_2 = EndPoints(Curve=geometry_30)  # -> Start, End; disabled
orient_3 = Orient(Geometry=geometry_26, Source=geometry_27, Target=geometry_28)  # -> Geometry, Transform
script_9 = Script(x=geometry_31, y=end_points_2.End)  # -> out, a, b, c, d, e; inputs x: Curve; disabled
# ---------- script_9: Python ----------
import Rhino.Geometry as rg
import math

def arc_cloest_point(arc, point):
    return arc.ClosestPoint(point)

def arc_furtherest_point(arc, point):
    v_opposite = arc.Center - arc.ClosestPoint(point)
    opposite_point = arc.Center + v_opposite
    return arc_cloest_point(arc, opposite_point)

def find_point_from_curve(curve, target_pt, length):
        print(type(curve) == rg.NurbsCurve)
        curve.Domain = rg.Interval(0, 1)
        sphere = rg.Sphere(target_pt, length)

        intersection = rg.Intersect.Intersection.CurveBrep(curve.ToNurbsCurve(), sphere.ToBrep(), 0.01)

        if len(intersection[2]) > 0:
            point_list= list(intersection[2])
            point_list.sort(key = lambda x : x.DistanceTo(target_pt))
            return rg.Point3d(round(point_list[0].X), round(point_list[0].Y), round(point_list[0].Z))
        return None

def get_opposite_point_on_circle(center, point):

    v = center - point

    opposite_point = center + v

    return opposite_point

def rotation_trajectory(st_pt, end_pt, step = 3, max_angle = 45):

    x,y,z = (st_pt.X + end_pt.X)/2, (st_pt.Y + end_pt.Y)/2,(st_pt.Z + end_pt.Z)/2
    mid_pt = rg.Point3d(x,y,z)

    
    solution = []
    increment = 0
    up_vectors = [0, 250, 500]
    vectors = [rg.Vector3d.XAxis, rg.Vector3d.YAxis, rg.Vector3d.ZAxis]
    vectors.sort(key = lambda v: rg.Vector3d.VectorAngle(v, end_pt - st_pt, rg.Plane.WorldXY))

    for up_v in up_vectors:
        for i in range(step):
            increment +=  max_angle/step
            angle_radians = math.radians(increment)

            for v in  vectors[:-1]:
                rotate1 = rg.Transform.Rotation(angle_radians, v, mid_pt)
                rotate2 = rg.Transform.Rotation(-angle_radians, v, mid_pt)
                
                arc_pt1 = rg.Point3d(mid_pt)
                arc_pt2 = rg.Point3d(arc_pt1)

                arc_pt1.Transform(rotate1)
                arc_pt2.Transform(rotate2)

                arc = rg.Arc(arc_pt1, st_pt, arc_pt2)

                solution.append(arc)
    return solution




st_pt = x.PointAtStart
end_pt = x.PointAtEnd
trajectory = rotation_trajectory(st_pt, end_pt)
e = trajectory
# Print or use the rotated line
a = trajectory[0]
b = find_point_from_curve(a, y, 3000)
c = arc_cloest_point(a, y)
d = arc_furtherest_point(a, y)
print(int(c.DistanceTo(y)), int(d.DistanceTo(y)))
print(len(trajectory))
'''
#Assuming the adjacent points are not within the imaginary sphere of the fixed- component 
itself

1. Get Arc based on angle
2. Get Shortest and furthest distance
3. Using that distance range to locate the substitue range
4. Substitute it with the unique length and find out the length of the other lines.




1. Get Random Position from the maximum angle and step
2. from the circle it forms we could get a range of smallest and maximum value 
by getting the cloest point from the circle to that point and the maximum is the distance to 
the opposite point
3. 
'''
# ---------- end script_9 ----------
script_10 = Script()  # -> out, a
# ---------- script_10: Python ----------
import Rhino.Geometry as rg
# import scipy.optimize as optimize
# import numpy as np

def find_common_meeting_point(lines):
    """
    Finds a common meeting point for a list of lines where the lines can rotate
    around one of their endpoints without changing their length.

    :param lines: List of Rhino.Geometry.Line objects.
    :return: Rhino.Geometry.Point3d object representing the meeting point, or None.
    """

    def objective_function(point, lines):
        x, y, z = point
        meeting_point = rg.Point3d(x, y, z)
        # Calculate the sum of squared distances from the movable endpoints
        # to the proposed meeting point
        total_distance = sum([(line.To - meeting_point).Length ** 2 for line in lines])
        return total_distance

    # Use the midpoint of the first line as an initial guess
    initial_guess = np.array([lines[0].PointAt(0.5).X, lines[0].PointAt(0.5).Y, lines[0].PointAt(0.5).Z])

    # Optimize (minimize) the objective function
    result = optimize.minimize(objective_function, initial_guess, args=(lines,), method='BFGS')

    if result.success:
        optimal_point = result.x
        return rg.Point3d(optimal_point[0], optimal_point[1], optimal_point[2])
    else:
        return None

# Example usage
# lines = [rg.Line(rg.Point3d(0,0,0), rg.Point3d(5,0,0)), rg.Line(rg.Point3d(3,3,0), rg.Point3d(8,3,0))]
# meeting_point = find_common_meeting_point(lines)
# print(meeting_point)
# ---------- end script_10 ----------
geometry_35 = Geometry(script_9.e)  # disabled
geometry_36 = Geometry(script_9.d)  # disabled
geometry_37 = Geometry(script_9.a)  # disabled
geometry_38 = Geometry(script_9.b)  # disabled
geometry_39 = Geometry(script_9.c)  # disabled
uuid_generator_2 = Script()  # -> out, GUID_THINGS, GUID_LINES_A, GUID_LINES_B; inputs things: list, A: list of Curve, B: list of Curve, C: list of Curve
# ---------- uuid_generator_2: Python ----------
import Rhino
import copy
import rhinoscriptsyntax as rs
import Rhino.Geometry as rg
import random

# Namespace definition
# -------------------------------------------------
class GUID:
    def __init__ (self, ID, Geometry, Type):
        self.ID = ID
        self.Geometry = Geometry #saving the rhino geometry
        self.Type = Type
        self.Cut = None
        self.Connector = None
        self.update_info()

    def update_info(self, mode = None, manual = None):
        if self.Type == "Brep":
            self.info = self.bounding_box_dimensions(self.Geometry)
            self.Length = self.info[0][0]
            self.Width = self.info[0][1]
            self.Height = self.info[0][2]
            self.AxisX = self.info[1][0]
            self.AxisY = self.info[1][1]
            self.AxisZ = self.info[1][2]
            self.x_cut_plane = self.info[2][0]
            self.y_cut_plane = self.info[2][1]
            self.z_cut_plane = self.info[2][2]
            self.Bbox = self.info[3]
        elif self.Type == "Line":
            self.Connector = self.Geometry.PointAtStart
            if type(self.Geometry) == rg.Line:
                self.Length = self.Geometry.Length
                return
            self.Length = rg.Curve.GetLength(self.Geometry)


    def bounding_box_dimensions(self, obj):
        if type(obj) == rg.Brep:
            vertices = [vertex.Location for vertex in obj.Vertices]
            bounding_box = rg.BoundingBox(vertices)
        else:
            vertices = [vertex.Location for vertex in obj.ToBrep().Vertices]
            bounding_box = rg.BoundingBox(vertices)

        # Calculate the dimensions of the bounding box
       
        x_extent = bounding_box.Max.X - bounding_box.Min.X
        y_extent = bounding_box.Max.Y - bounding_box.Min.Y
        z_extent = bounding_box.Max.Z - bounding_box.Min.Z
        


        # Create the start and end points of the central axis
        center = bounding_box.Center
        start_pointX = rg.Point3d(center.X - x_extent / 2, center.Y, center.Z)
        end_pointX = rg.Point3d(center.X + x_extent / 2, center.Y, center.Z)

        start_pointY = rg.Point3d(center.X , center.Y - y_extent / 2, center.Z)
        end_pointY = rg.Point3d(center.X , center.Y + y_extent / 2, center.Z)

        start_pointZ = rg.Point3d(center.X, center.Y, center.Z -z_extent/2)
        end_pointZ = rg.Point3d(center.X, center.Y, center.Z + z_extent)


        x_line = rg.LineCurve(start_pointX, end_pointX)
        y_line = rg.LineCurve(start_pointY, end_pointY)
        z_line = rg.LineCurve(start_pointZ, end_pointZ)

        x_cut_plane = rg.Plane(rg.Point3d(start_pointX.X, start_pointX.Y-y_extent/2, start_pointX.Z),
        rg.Vector3d(0,1,0))
        y_cut_plane = rg.Plane(rg.Point3d(start_pointY.X - x_extent/2, start_pointY.Y, start_pointY.Z), 
        rg.Vector3d(1,0,0))
        z_cut_plane = rg.Plane(rg.Point3d(start_pointZ.X , start_pointZ.Y, start_pointZ.Z),
        rg.Vector3d(0,0,1))

        return ((x_extent, y_extent, z_extent),
                (x_line, y_line, z_line),
                (x_cut_plane, y_cut_plane, z_cut_plane),
                bounding_box)

    def factory_method(self, ID, Geometry, Type):
        G = GUID(ID, Geometry,Type)
        return G

class NODE:
    def __init__(self, value):
        self.next = None
        self.prev = None
        self.value = value #self.value = GUID(ID, Geometry)
        self.closest = None #for lines, the cloest one to other link list
        self.CD = 100000000

    def split(self, obj, linked_list, obj_type, length = None):
        # Caution: Brep here is a Brep List !!!
        if self.value is not None:
            if obj_type == "Brep":
                self.value.Geometry = obj[0]
                self.value.update_info()
                splited_Node = NODE(GUID(self.value.ID + "/", obj[1], "Brep"))
                splited_Node.next = self.next
                self.next = splited_Node
            if obj_type == "Line":
                # Line is just a single line cryyy so dumb RG
                start_pt = rg.PointAtStart
                end_pt = rg.PointAtEnd
                pt = obj.DivideByLength(length, True, False)
                line1 = rg.Line(start_pt, pt)
                line2 = rg.Line(pt, end_pt)
                self.value.Geometry = line1
                self.value.update_info()
                splited_Node = NODE(GUID(self.value.ID + "/", line2, "Line"))
                splited_Node.next = self.next
                self.next = splited_Node
            
            linked_list.length += 1

    def factory_method(self, ID, obj, obj_type = "Line"):
        N = NODE(value = GUID(ID, obj, obj_type))
        return N

class LINKEDLIST:
    def __init__ (self):
        self.node = None
        self.head = None
        self.tail = None
        self.length = 0
    
    def append(self, value):
        newNode = NODE(value)
        current = self.head
        self.length += 1
        if self.head == None:
            self.head = newNode
            self.tail = newNode
            return newNode
        while current.next != None:
            current = current.next
            
        newNode.prev = current
        current.next = newNode
        self.tail = newNode
        return newNode

    def prepend(self, value):
        newNode = NODE(value)
        self.length +=1

        if self.head == None:
            self.head = newNode
            self.tail = newNode
            return self
        self.head.prev = newNode
        newNode.next = self.head
        self.head = newNode
        return self

    def traverse(self, action = None):
        current = self.head
        while current != None:
            if action:
                action()
            else:
                print(current)
            current = current.next

    def goto(self, position):
        current = self.head
        for i in range(position):
            if current != None:
                current = current.next
            else:
                raise IndexError("Index out of range")

        return current

    def pop(self, position = None):
        if position == None:
            position = self.length -1
            self.length -= 1
        if position == 0:
            if self.head != None:
                pop = self.goto(position)
                self.head = self.head.next
                self.length -= 1
                return pop
            else: 
                raise IndexError("Index out of range")
        if position >= self.length or position < 0:
            raise Exception("index out of range")

        previous = self.goto(position- 1)
        if previous != None and previous.next != None:
            previous.next = previous.next.next
            self.length -= 1
        else:
            raise IndexError("Index out of range")
        return previous

    
    def insert(self, value, position):
        # pass exception here eg position > self.length
        node = NODE(value)
        pointer1 = self.goto(position -1 )
        pointer2 = pointer1.next.next
        pointer1.next = node
        node.prev = pointer1 
        node.next = pointer2
        self.lenth += 1
        return node
    
    def list_export(self, attribute):
        lst = []
        current = self.head
        while current != None:
            value_attribute = getattr(current.value, attribute)
            lst.append(value_attribute)
            current = current.next
        return lst

    def copy(self):
        LS = LINKEDLIST()
        current = self.head
        while current != None:
            new_node = NODE(copy.deepcopy(current.value))
            LS.append(new_node)
            current = current.next
        return LS
    
    def concat(self, linked_list):
        if linked_list.head == None or self.head == None:
            raise Exception("Sorry both list must not be empty la")
        linked_list_tail = linked_list.tail
        linked_list.head.prev = self.tail
        self.tail.next = linked_list.head
        self.tail = linked_list_tail
        self.length += linked_list.length
        return self

    def reverse(self):
        prev = None
        current = self.head
        while(current is not None):
            next = current.next
            current.next = prev
            prev = current
            current = next
        self.head = prev
    
    def factory_method(self):
        LS = LINKEDLIST()
        return LS



# -------------------------------------------------
GUID_LINES_A = LINKEDLIST()
GUID_LINES_B = LINKEDLIST()
GUID_LINES_C = LINKEDLIST()
GUID_LINES_D = LINKEDLIST()
GUID_THINGS = LINKEDLIST()

# for test purpose

def shuffle_array(arr, seed=None):
    if seed is not None:
        random.seed(seed)
    n = len(arr)
    for i in range(n-1, 0, -1):
        j = random.randint(0, i)
        arr[i], arr[j] = arr[j], arr[i]

    return arr


if shuffle:
    things= shuffle_array(things, seed= None)
    A = shuffle_array(A, seed= None)
    B = shuffle_array(B, seed= None)
    C = shuffle_array(C, seed= None)
    D = shuffle_array(D, seed= None)


if run:
    LinesLengthT = 0
    ThingsLengthT = 0

    for i,thing in enumerate(things):

        thingID = "thing" + str(i)        
        obj = GUID(thingID, thing, "Brep")
        GUID_THINGS.prepend(obj)
        ThingsLengthT += obj.Length
        
    for i, line in enumerate(A):
        lineID = "line" + "A" + str(i)
        obj = GUID(lineID, line.ToNurbsCurve(), "Line")
        GUID_LINES_A.prepend(obj)
        LinesLengthT += obj.Length
    
    for i, line in enumerate(B):
        lineID = "line" + "B" + str(i)
        obj = GUID(lineID, line.ToNurbsCurve(), "Line")
        GUID_LINES_B.prepend(obj)
        LinesLengthT += obj.Length
    
    for i, line in enumerate(C):
        lineID = "line" + "C" + str(i)
        obj = GUID(lineID, line.ToNurbsCurve(), "Line")
        GUID_LINES_C.prepend(obj)
        LinesLengthT += obj.Length

    # for i, line in enumerate(D):
    #     lineID = "line" + "D" + str(i)
    #     obj = GUID(lineID, line.ToNurbsCurve(), "Line")
    #     GUID_LINES_D.prepend(obj)
    #     LinesLengthT += obj.Length
# ---------- end uuid_generator_2 ----------
geometry_40 = Geometry()
geometry_41 = Geometry(<curve referenced from the Rhino model>)  # disabled
script_11 = Script(x=geometry_41)  # -> out, a; inputs x: Curve; disabled
# ---------- script_11: Python ----------
import Rhino.Geometry as rg

def scale_nurbscurve_uniformly(curve, new_length):
    """
    Uniformly scale a NurbsCurve from its midpoint so that its length is a specific value.

    :param curve: The NurbsCurve object to scale.
    :param new_length: The desired length of the curve.
    :return: A new scaled NurbsCurve object.
    """
    if not curve.IsValid or new_length <= 0:
        return None

    # Calculate the current length of the curve
    current_length = curve.GetLength()
    if current_length == 0:
        return None  # Cannot scale a zero-length curve

    # Calculate the scale factor
    scale_factor = new_length / current_length

    # Get the midpoint of the curve
    midpoint = curve.PointAt(curve.Domain.Mid)

    # Scale the curve about its midpoint
    xform = rg.Transform.Scale(midpoint, scale_factor)
    scaled_curve = curve.DuplicateCurve()
    scaled_curve.Transform(xform)

    return scaled_curve

# Example usage
# Assuming 'curve' is a Rhino.Geometry.NurbsCurve object
# new_length = 10  # for example
# scaled_curve = scale_nurbscurve_uniformly(curve, new_length)
# print(scaled_curve)



# Example usage
a = scale_nurbscurve_uniformly(x, 2300)
# ---------- end script_11 ----------
geometry_42 = Geometry(<curve referenced from the Rhino model>)
geometry_43 = Geometry(<curve referenced from the Rhino model>)
geometry_44 = Geometry(<curve referenced from the Rhino model>)
geometry_45 = Geometry(<curve referenced from the Rhino model>)  # disabled
geometry_46 = Geometry(<curve referenced from the Rhino model>)  # disabled
geometry_47 = Geometry(script_11.a)  # disabled
script_12 = Script(x=geometry_45, y=geometry_46)  # -> out, a; disabled
# ---------- script_12: Python ----------
import Rhino.Geometry as rg

def find_point_from_curve(curve, line, tolerance =0.01):
    """
    Find a point on a curve that is a specified distance from a target point.

    :param curve: The curve to search (Rhino.Geometry.Curve).
    :param length: The specified distance from the target point.
    :param target_pt: The target point (Rhino.Geometry.Point3d).
    :return: The point on the curve or None if no such point exists.
    """
    if not curve.IsValid:
        return None

    # Ensure the curve is reparameterized for accurate calculations
    curve.Domain = rg.Interval(0, 1)
    length = line.GetLength()
    target_pt = line.PointAtStart
    sphere = rg.Sphere(target_pt, length)

    # Increment along the curve and check distances
    intersection = rg.Intersect.Intersection.CurveBrep(curve, sphere.ToBrep(), tolerance)
    if intersection[0] == True:
        point_list = list(intersection[2])
        point_list.sort(key = lambda x : x.DistanceTo(target_pt))
        return rg.Line(target_pt, point_list[0]).ToNurbsCurve()

    return None


a = find_point_from_curve(x,y)
# ---------- end script_12 ----------
geometry_48 = Geometry(script_12.a)  # disabled
script_13 = Script(x=geometry_42, y=geometry_43)  # -> out, a; disabled
# ---------- script_13: Python ----------
import Rhino.Geometry as rg

def intersect_spheres(node, adjacent_nodes):

    # Create sphere objects
    spheres = [rg.Sphere(A_node.geometry, A_node.geometry.DistanceTo(node.geometry)) 
    for A_node in adjacent_nodes]

    result_brep = spheres[0]
    for sphere in spheres[1:]:
        temp = rg.Brep.CreateBooleanIntersection(result_brep, sphere, 0.01)
        if temp:
            result_brep = temp
        else:
            return None

    # Calculate intersection

    intersection = rg.Intersect.Intersection.BrepBrep(sphere1.ToBrep(), sphere2.ToBrep(), 0.01)

    # Return the intersection curve(s)
    if intersection[0] == True:
        print(intersection)
        return intersection[1]
    else:
        return None
# ---------- end script_13 ----------
geometry_49 = Geometry(script_13.a)  # disabled
script_14 = Script(x=geometry_42, y=geometry_43)  # -> out, a
# ---------- script_14: Python ----------
import Rhino.Geometry as rg

def intersect_spheres(center1, radius1, center2, radius2):
    # Create sphere objects
    sphere1 = rg.Sphere(center1, radius1)
    sphere2 = rg.Sphere(center2, radius2)

    # Calculate intersection
    intersection = rg.Intersect.Intersection.BrepBrep(sphere1.ToBrep(), sphere2.ToBrep(), 0.01)

    # Return the intersection curve(s)
    if intersection[0] == True:
        print(intersection)
        return intersection[1]
    else:
        return None


center1, center2 = x.PointAtEnd, y.PointAtEnd
radius1, radius2 = x.GetLength(), y.GetLength()
a = intersect_spheres(center1, radius1, center2, radius2)
# ---------- end script_14 ----------
script_15 = Script(x=geometry_42, y=geometry_43)  # -> out, a; inputs x: Line, y: Line
# ---------- script_15: Python ----------
import Rhino.Geometry as rg
import math

def find_common_endpoint(line1, line2):
    """
    Find a common endpoint for two lines with fixed start points and lengths.

    :param line1: The first line.
    :param line2: The second line.
    :return: A common endpoint or None if no such point exists.
    """
    start1, start2 = line1.From, line2.From
    radius1, radius2 = line1.Length, line2.Length

    # Calculate the distance between the start points
    d = start1.DistanceTo(start2)
    if d > radius1 + radius2 or d < abs(radius1 - radius2) or d == 0:
        # No solution: the spheres do not intersect or one is inside the other
        return None

    # Calculate the intersection point
    a = (radius1**2 - radius2**2 + d**2) / (2 * d)
    h = math.sqrt(radius1**2 - a**2)

    # Find the point P2, which is the base of the perpendicular from P3
    P2_x = start1.X + a * (start2.X - start1.X) / d
    P2_y = start1.Y + a * (start2.Y - start1.Y) / d
    P2_z = start1.Z + a * (start2.Z - start1.Z) / d
    P2 = rg.Point3d(P2_x, P2_y, P2_z)

    # Calculate the intersection points (there are two)
    i1_x = P2.X + h * (start2.Y - start1.Y) / d
    i1_y = P2.Y - h * (start2.X - start1.X) / d
    i1_z = P2.Z
    i2_x = P2.X - h * (start2.Y - start1.Y) / d
    i2_y = P2.Y + h * (start2.X - start1.X) / d
    i2_z = P2.Z

    intersection1 = rg.Point3d(i1_x, i1_y, i1_z)
    intersection2 = rg.Point3d(i2_x, i2_y, i2_z)

    # Depending on your specific needs, you can return one or both points
    # For example, returning the first intersection point:
    return [intersection1, intersection2]


a = find_common_endpoint(x, y)
# ---------- end script_15 ----------
script_16 = Script()  # -> out, a; disabled
# ---------- script_16: Python ----------
import Rhino.Geometry as rg

def find_point_from_curve(curve, target_pt, length, sort_key = None, tolerance =0.01):

    if not curve.IsValid:
        return None

    # Ensure the curve is reparameterized for accurate calculations
    curve.Domain = rg.Interval(0, 1)
    sphere = rg.Sphere(target_pt, length)

    # Increment along the curve and check distances
    intersection = rg.Intersect.Intersection.CurveBrep(curve, sphere.ToBrep(), tolerance)
    if intersection[0] == True:
        point_list = list(intersection[2])
        if sort_key:
            point_list.sort(key = lambda x : x.DistanceTo(sort_key))
        else:
            point_list.sort(key = lambda x : x.DistanceTo(target_pt))
        return rg.Line(target_pt, point_list[0]).ToNurbsCurve()
    return None
# ---------- end script_16 ----------
script_17 = Script(x=geometry_42, y=geometry_43)  # -> out, a; inputs x: Line, y: Line; disabled
# ---------- script_17: Python ----------
import Rhino.Geometry as rg
import math

def find_shared_endpoint(line1, line2):
    """
    Find a shared endpoint for two lines with fixed start points and lengths.
    
    :param line1: The first line (Rhino.Geometry.Line).
    :param line2: The second line (Rhino.Geometry.Line).
    :return: A shared endpoint (Rhino.Geometry.Point3d) or None if no solution.
    """
    start1, start2 = line1.From, line2.From
    len1, len2 = line1.Length, line2.Length

    # Distance between start points
    d = start1.DistanceTo(start2)

    # Check if a solution is possible
    if d > len1 + len2 or d < abs(len1 - len2):
        return None  # Lines can't meet due to length constraints

    # Trilateration to find the intersection points of two spheres
    a = (len1**2 - len2**2 + d**2) / (2 * d)
    h = math.sqrt(len1**2 - a**2)
    mid_point = start1 + (a/d) * (start2 - start1)

    # Potential intersection points
    x3 = mid_point.X + h * (start2.Y - start1.Y) / d
    y3 = mid_point.Y - h * (start2.X - start1.X) / d
    z3 = mid_point.Z

    x4 = mid_point.X - h * (start2.Y - start1.Y) / d
    y4 = mid_point.Y + h * (start2.X - start1.X) / d
    z4 = mid_point.Z

    intersection1 = rg.Point3d(x3, y3, z3)
    intersection2 = rg.Point3d(x4, y4, z4)

    # Select the intersection point that is in the direction of the initial lines
    if (intersection1 - start1).IsParallelTo(line1.Direction) and \
       (intersection1 - start2).IsParallelTo(line2.Direction):
        return intersection1
    elif (intersection2 - start1).IsParallelTo(line1.Direction) and \
         (intersection2 - start2).IsParallelTo(line2.Direction):
        return intersection2

    return None

# Example usage
# Assuming 'line1' and 'line2' are Rhino.Geometry.Line objects
a = find_shared_endpoint(x, y)
# ---------- end script_17 ----------
geometry_50 = Geometry(script_15.a)
# one of the point fixed
# the other substitute
panel_6 = Panel(script_14.a)
geometry_51 = Geometry(script_14.a)
geometry_52 = Geometry(script_17.a)  # disabled
# find trajectory on all the lines that could change length
# however, prioritse on not changing
script_18 = Script(x=geometry_51, y=geometry_44)  # -> out, a; disabled
# ---------- script_18: Python ----------
import Rhino.Geometry as rg

def intersect_spheres(center1, radius1, center2, radius2):
    # Create sphere objects
    sphere1 = rg.Sphere(center1, radius1)
    sphere2 = rg.Sphere(center2, radius2)

    # Calculate intersection
    intersection = rg.Intersect.Intersection.BrepBrep(sphere1.ToBrep(), sphere2.ToBrep(), 0.01)

    # Return the intersection curve(s)
    if intersection[0] == True:
        return intersection[1]
    else:
        return None


center1, center2 = x.PointAtStart, y.PointAtStart
radius1, radius2 = x.GetLength(), y.GetLength()
a = intersect_spheres(center1, radius1, center2, radius2)
for i in a:
    print(i)
# ---------- end script_18 ----------
geometry_53 = Geometry(script_18.a)  # disabled
panel_7 = Panel(script_18.a)  # disabled
