# Grasshopper definition 240123_Graph_Script.gh (Grasshopper 1.0.7)
# plug-ins: RhinoCodePluginGH

geometry_pipeline = GeometryPipeline(
    GroupByLayer=False,
    GroupByType=False,
    IncludeHidden=True,
    IncludeLocked=True,
    LayerFilter="Structure_Types::Typ A",
    NameFilter="*",
    SublayerFiltering=True,
    TypeFilter=4)
geometry_pipeline_2 = GeometryPipeline(
    GroupByLayer=False,
    GroupByType=False,
    IncludeHidden=True,
    IncludeLocked=True,
    LayerFilter="Structure_Types::Typ B",
    NameFilter="*",
    SublayerFiltering=True,
    TypeFilter=4)
geometry_pipeline_3 = GeometryPipeline(
    GroupByLayer=False,
    GroupByType=False,
    IncludeHidden=True,
    IncludeLocked=True,
    LayerFilter="Structure_Types::Typ C",
    NameFilter="*",
    SublayerFiltering=True,
    TypeFilter=4)
geometry_pipeline_4 = GeometryPipeline(
    GroupByLayer=False,
    GroupByType=False,
    IncludeHidden=True,
    IncludeLocked=True,
    LayerFilter="Structure_Types::Typ D",
    NameFilter="*",
    SublayerFiltering=True,
    TypeFilter=4)
geometry_pipeline_5 = GeometryPipeline(
    GroupByLayer=False,
    GroupByType=False,
    IncludeHidden=True,
    IncludeLocked=True,
    LayerFilter="Structure_Types::Typ E",
    NameFilter="*",
    SublayerFiltering=True,
    TypeFilter=4)
geometry_pipeline_6 = GeometryPipeline(
    GroupByLayer=False,
    GroupByType=False,
    IncludeHidden=True,
    IncludeLocked=True,
    LayerFilter="Structure_Types::Typ F",
    NameFilter="*",
    SublayerFiltering=True,
    TypeFilter=4)
geometry_pipeline_7 = GeometryPipeline(
    GroupByLayer=False,
    GroupByType=False,
    IncludeHidden=True,
    IncludeLocked=True,
    LayerFilter="BFH_ReUse24::Workspace",
    NameFilter="*",
    SublayerFiltering=True,
    TypeFilter=1073741848)
run = Button(ExpressionNormal="True", ExpressionPressed="False")
button = Button(ExpressionNormal="True", ExpressionPressed="False")
number_slider = Slider(11, range=0..100)
geometry = Geometry(<curve referenced from the Rhino model>)
geometry_2 = Geometry([<curve referenced from the Rhino model> x4])
geometry_3 = Geometry([<curve referenced from the Rhino model> x6])
panel = Panel("find_within_bound")
panel_2 = Panel("find_closest_with_bound")
panel_3 = Panel("structure_cut")
panel_4 = Panel("material_cut")
script = Script(a=geometry_3, c=geometry_2, e=geometry)  # -> out, lines; inputs a: list of Curve, b: list of Curve, c: list of Curve, d: list of Curve, e: list of Curve, f: list of Curve
# ---------- script: Python ----------
class dict_obj:
    def __init__(self, obj):
        self.obj = obj

lines = dict_obj( {
    "A":a,
    "B":b,
    "C":c,
    "D":d,
    "E":e,
})
# ---------- end script ----------
uuid_generator = Script(things=geometry_pipeline_7, lines=script.lines, run=run, shuffle=Toggle(False))  # -> out, GUID_THINGS, GUID_LINES_A, GUID_LINES; inputs things: list, run: Boolean, seed: Int32
# ---------- uuid_generator: Python ----------
import Rhino
import copy
import rhinoscriptsyntax as rs
import Rhino.Geometry as rg
import random

# Namespace definition
# -------------------------------------------------
class GUID:
    def __init__ (self, ID, Geometry, Type):
        self.ID = ID
        self.Geometry = Geometry 
        self.Type = Type
        self.Cut = None
        self.Connector = None
        self.update_info()
        if self.Type == "Line":
            self.line_type = None

    def update_info(self, mode = None, manual = None):
        if self.Type == "Brep":
            self.info = self.bounding_box_dimensions(self.Geometry)
            self.Length = self.info[0][0]
            self.Width = self.info[0][1]
            self.Height = self.info[0][2]
            self.AxisX = self.info[1][0]
            self.AxisY = self.info[1][1]
            self.AxisZ = self.info[1][2]
            self.x_cut_plane = self.info[2][0]
            self.y_cut_plane = self.info[2][1]
            self.z_cut_plane = self.info[2][2]
            self.Bbox = self.info[3]
        elif self.Type == "Line":
            self.Connector = self.Geometry.PointAtStart
            if type(self.Geometry) == rg.Line:
                self.Length = self.rounding(self.Geometry.Length)
                return
            self.Length = self.rounding(rg.Curve.GetLength(self.Geometry))

    def bounding_box_dimensions(self, obj):
        if type(obj) == rg.Brep:
            vertices = [vertex.Location for vertex in obj.Vertices]
            bounding_box = rg.BoundingBox(vertices)
        else:
            vertices = [vertex.Location for vertex in obj.ToBrep().Vertices]
            bounding_box = rg.BoundingBox(vertices)

        # Calculate the dimensions of the bounding box
       
        x_extent = self.rounding(bounding_box.Max.X - bounding_box.Min.X)
        y_extent = self.rounding(bounding_box.Max.Y - bounding_box.Min.Y)
        z_extent = self.rounding(bounding_box.Max.Z - bounding_box.Min.Z)
        
        # Create the start and end points of the central axis
        center = bounding_box.Center
        start_pointX = rg.Point3d(center.X - x_extent / 2, center.Y, center.Z)
        end_pointX = rg.Point3d(center.X + x_extent / 2, center.Y, center.Z)

        start_pointY = rg.Point3d(center.X , center.Y - y_extent / 2, center.Z)
        end_pointY = rg.Point3d(center.X , center.Y + y_extent / 2, center.Z)

        start_pointZ = rg.Point3d(center.X, center.Y, center.Z -z_extent/2)
        end_pointZ = rg.Point3d(center.X, center.Y, center.Z + z_extent)

        x_line = rg.LineCurve(start_pointX, end_pointX)
        y_line = rg.LineCurve(start_pointY, end_pointY)
        z_line = rg.LineCurve(start_pointZ, end_pointZ)

        x_cut_plane = rg.Plane(rg.Point3d(start_pointX.X, start_pointX.Y-y_extent/2, start_pointX.Z),
        rg.Vector3d(0,1,0))
        y_cut_plane = rg.Plane(rg.Point3d(start_pointY.X - x_extent/2, start_pointY.Y, start_pointY.Z), 
        rg.Vector3d(1,0,0))
        z_cut_plane = rg.Plane(rg.Point3d(start_pointZ.X , start_pointZ.Y, start_pointZ.Z),
        rg.Vector3d(0,0,1))

        return ((x_extent, y_extent, z_extent),
                (x_line, y_line, z_line),
                (x_cut_plane, y_cut_plane, z_cut_plane),
                bounding_box)

    def factory_method(self, ID, Geometry, Type):
        G = GUID(ID, Geometry,Type)
        return G

    def rounding(self, num, decimal_place = 1):
        return round(num, decimal_place)

class NODE:
    def __init__(self, value):
        self.next = None
        self.prev = None
        self.value = value #self.value = GUID(ID, Geometry)
        self.closest = None #for lines, the cloest one to other link list
        self.CD = 100000000

    def split(self, obj, linked_list, obj_type, length = None):
        # Caution: Brep here is a Brep List !!!
        if self.value is not None:
            if obj_type == "Brep":
                self.value.Geometry = obj[0]
                self.value.update_info()
                splited_Node = NODE(GUID(self.value.ID + "/", obj[1], "Brep"))
                splited_Node.next = self.next
                self.next = splited_Node
            if obj_type == "Line":
                # Line is just a single line cryyy so dumb RG
                start_pt = rg.PointAtStart
                end_pt = rg.PointAtEnd
                pt = obj.DivideByLength(length, True, False)
                line1 = rg.Line(start_pt, pt)
                line2 = rg.Line(pt, end_pt)
                self.value.Geometry = line1
                self.value.update_info()
                splited_Node = NODE(GUID(self.value.ID + "/", line2, "Line"))
                splited_Node.next = self.next
                self.next = splited_Node
            
            linked_list.length += 1

    def factory_method(self, ID, obj, obj_type = "Line"):
        N = NODE(value = GUID(ID, obj, obj_type))
        return N


class LINKEDLIST:
    def __init__ (self):
        self.node = None
        self.head = None
        self.tail = None
        self.length = 0
    
    def append(self, value):
        newNode = NODE(value)
        current = self.head
        self.length += 1
        if self.head == None:
            self.head = newNode
            self.tail = newNode
            return newNode
        while current.next != None:
            current = current.next
            
        newNode.prev = current
        current.next = newNode
        self.tail = newNode
        return newNode

    def prepend(self, value):
        newNode = NODE(value)
        self.length +=1

        if self.head == None:
            self.head = newNode
            self.tail = newNode
            return self
        self.head.prev = newNode
        newNode.next = self.head
        self.head = newNode
        return self

    def traverse(self, action = None):
        current = self.head
        while current != None:
            if action:
                action()
            else:
                print(current)
            current = current.next

    def goto(self, position):
        current = self.head
        for i in range(position):
            if current != None:
                current = current.next
            else:
                raise IndexError("Index out of range")

        return current

    def pop(self, position = None):
        if position == None:
            position = self.length -1
            self.length -= 1
        if position == 0:
            if self.head != None:
                pop = self.goto(position)
                self.head = self.head.next
                self.length -= 1
                return pop
            else: 
                raise IndexError("Index out of range")
        if position >= self.length or position < 0:
            raise Exception("index out of range")

        previous = self.goto(position- 1)
        if previous != None and previous.next != None:
            previous.next = previous.next.next
            self.length -= 1
        else:
            raise IndexError("Index out of range")
        return previous

    
    def insert(self, value, position):
        # pass exception here eg position > self.length
        node = NODE(value)
        pointer1 = self.goto(position -1 )
        pointer2 = pointer1.next.next
        pointer1.next = node
        node.prev = pointer1 
        node.next = pointer2
        self.lenth += 1
        return node
    
    def list_export(self, attribute):
        lst = []
        current = self.head
        while current != None:
            value_attribute = getattr(current.value, attribute)
            lst.append(value_attribute)
            current = current.next
        return lst

    def copy(self):
        LS = LINKEDLIST()
        current = self.head
        while current != None:
            new_node = NODE(copy.deepcopy(current.value))
            LS.append(new_node)
            current = current.next
        return LS
    
    def concat(self, linked_list):
        if linked_list.head == None or self.head == None:
            raise Exception("Sorry both list must not be empty la")
        linked_list_tail = linked_list.tail
        linked_list.head.prev = self.tail
        self.tail.next = linked_list.head
        self.tail = linked_list_tail
        self.length += linked_list.length
        return self

    def reverse(self):
        prev = None
        current = self.head
        while(current is not None):
            next = current.next
            current.next = prev
            prev = current
            current = next
        self.head = prev
    
    def factory_method(self):
        LS = LINKEDLIST()
        return LS
# ==============================================================
GUID_LINES= LINKEDLIST()
GUID_LINES_A= LINKEDLIST()
GUID_THINGS = LINKEDLIST()

def shuffle_array(arr, seed=None):
    if seed is not None:
        random.seed(seed)
    n = len(arr)
    for i in range(n-1, 0, -1):
        j = random.randint(0, i)
        arr[i], arr[j] = arr[j], arr[i]
    return arr


if shuffle:
    things= shuffle_array(things, seed= None)
    lines = shuffle_array(lines, seed= None)

def line_rebuild(line):
    if line.PointAtStart.Z > line.PointAtEnd.Z:
        line = rg.Line(line.PointAtEnd,line.PointAtStart).ToNurbsCurve()
    return line

if run:
    for i,thing in enumerate(things):
        thingID = "thing" + str(i)        
        obj = GUID(thingID, thing, "Brep")
        GUID_THINGS.prepend(obj)
        
    for typ in lines.obj:
        if lines.obj[typ]:
            for i, line in enumerate(lines.obj[typ]):
                lineID = "line" + typ + str(i)
                obj = GUID(lineID, line_rebuild(line), "Line")
                obj.line_type = typ
                GUID_LINES.prepend(obj)
# ---------- end uuid_generator ----------
script_2 = Script(
    things=uuid_generator.GUID_THINGS,
    lines=uuid_generator.GUID_LINES,
    attribute="Length",
    cut=Toggle(False),
    max_cut=Slider(20, range=0..100),
    max_cycle=Slider(1, range=0..10),
    upper_bound=Slider(10000, range=0..20000),
    lower_bound=Slider(10000, range=0..20000),
    min_len=Slider(0, range=0..4000),
    mode="find_closest")  # -> out, things, lines, result, a; inputs attribute: String, cut: Boolean, max_cut: Int32, max_cycle: Int32, upper_bound: Int32, lower_bound: Int32, min_len: Int32, mode: String, prior: String
# ---------- script_2: Python ----------
import rhinoscriptsyntax as rs
import Rhino.Geometry as rg

"""
1. Find closest match using greedy
2. return a list of length difference with pos and neg numbers
3. for the neg number => Cut extra and hence reduce the neg to 0
4. Add the extra piece back to the input and the length.
Stopping conditions are all reaches to 0 or 10 times
"""

# Add stopping Condition and Cycle time
# in Greedy(), it is measuring the length of the line to find best match
# now we have to split the line and push it to linked list a 

def split_by_plane_length(obj, pln, obj_type):

    # pln could be length if obj_type is line
    if obj_type == "Brep":
        bb = rg.Brep.GetBoundingBox(obj,rg.Plane.WorldXY)
        
        
        _,extU,extV = rg.Plane.ExtendThroughBox(pln,bb)
        extU.T0 = extU.T0 - 1
        extU.T1 = extU.T1 + 1
        extV.T0 = extV.T0 - 1
        extV.T1 = extV.T1 + 1
        
        planeSrf = rg.PlaneSurface(pln,extU,extV)
        splitter = planeSrf.ToBrep()

        brep = rs.coercebrep(obj)
        pieces = brep.Split(splitter,0.001)
        pieces = [piece.CapPlanarHoles(0.01)  for piece in pieces]
    if obj_type == "Line":
        start_pt = obj.PointAtStart
        end_pt = obj.PointAtEnd
        pt = obj.PointAtLength(pln)
        line1 = rg.Line(start_pt, pt).ToNurbsCurve()
        line2 = rg.Line(pt, end_pt).ToNurbsCurve()
        pieces = [line2, line1]
    return pieces

def find_closest_element(linked_list_a, linked_list_b, 
attribute, max_cycle, max_cut, upper_bound, lower_bound, min_len,mode, prior = None, result= None):
    step = 0
    cut_count = 0
    prev = linked_list_b.length

    if result == None:
        result = {}
    else:
        result = result.obj

    if linked_list_b.length > linked_list_a.length:
        raise Exception("Number of input lines are more than available object")
        return

    def Greedy(linked_list_a, linked_list_b, attribute):
        current_b = linked_list_b.head
        pointer = 0 
        while current_b != None and current_b.CD != 0:
            closest_node = None
            if pointer <= prev and current_b.value.line_type != "A":
                current_a = linked_list_a.head
                while current_a != None and current_a.value.Length > min_len:
                    d1 = current_b.value.Length - getattr(current_a.value, attribute)
                    if mode == "find_closest":
                        if prior == None:
                            # Default
                            if abs(d1) <= abs(current_b.CD)  and current_a.value.ID not in result:
                                current_b.CD = d1
                                closest_node = current_a
                    elif mode == "find_closest_with_bound":
                        if prior == None:
                            # Default
                            if abs(d1) <= abs(current_b.CD) and  -lower_bound <= d1 <= upper_bound and current_a.value.ID not in result:
                                    current_b.CD = d1
                                    closest_node = current_a
                    elif mode == "find_within_bound":
                        if prior == None:
                            # Default
                            if -lower_bound <= d1 <= upper_bound and current_a.value.ID not in result:
                                current_b.CD = d1
                                closest_node = current_a
                                break

                    current_a = current_a.next
                
            if closest_node != None:
                result[closest_node.value.ID] = 1
                result[current_b.value.ID] = 1
            current_b.closest = closest_node
            
            current_b = current_b.next
            pointer += 1
        return 
    
    def Cut(result, linked_list_a, linked_list_b):
        current = linked_list_b.head #iterate through lines 
        LS = linked_list_b.factory_method()
        pointer = 0
        nonlocal prev
        nonlocal cut_count
        while current and pointer <= prev:
            # split things if things are in excess
            if current.CD < 0 and current.closest != None:
                scalar = abs(current.CD)
                if attribute == "Length":
                    v = rg.Vector3d(scalar,0,0)
                    pln = current.closest.value.y_cut_plane.Clone()
                elif attribute == "Width":
                    v = rg.Vector3d(0, scalar,0)
                    pln = current.closest.value.x_cut_plane.Clone()
                elif attribute == "Height":
                    v = rg.Vector3d(0,0, scalar)
                    pln = current.closest.value.z_cut_plane.Clone()

                # Split original object according to length difference
                brp = current.closest.value.Geometry
                pln.Translate(v)
                current.closest.value.Cut = pln

                # Split the Brep and lines                
                splited = split_by_plane_length(brp, pln, "Brep")
                # split Node
            
                if (len(splited)):
                    current.closest.split(splited, linked_list_a, "Brep")
                    cut_count += 1

            # split the lines if the lines are in excess
            if current.CD >0 and current.closest != None:
                splited = split_by_plane_length(
                    current.value.Geometry,
                    current.CD,
                    "Line")

                current.value.Geometry = splited[0]
                current.value.update_info()

                GUID = current.value.factory_method(
                    current.value.ID + "/", splited[1], "Line")
                LS.prepend(GUID)

            #once splited reduce CD to 0
            current.CD = 0
            current = current.next
            pointer += 1
        prev = LS.length
        if LS.length == 0:
            return linked_list_b
        return LS.concat(linked_list_b)

    def Transform(result, linked_list_a, linked_list_b):
        current = linked_list_b.head
        pointer = 0
        LS = linked_list_b.factory_method()
        nonlocal prev
        nonlocal cut_count
        while current:
            v = current.value.Geometry.PointAtStart - current.value.Geometry.PointAtEnd
            v =(v/v.Length * current.CD)
            end_pt =  current.value.Geometry.PointAtEnd + v
            line = rg.Line(current.value.Geometry.PointAtStart, end_pt)
            current.value.Geometry = line.ToNurbsCurve()
            current.value.update_info()
            current = current.next
        return
        
    while step < max_cycle:
        print(linked_list_a.length, linked_list_b.length)
        Greedy(linked_list_a, linked_list_b, attribute)
        Transform(result,linked_list_a, linked_list_b)
        print("Cut Start!")
        if cut:
            linked_list_b = Cut(result, linked_list_a, linked_list_b)
            print(linked_list_a.length,linked_list_b.length)
        step +=1
    return result,linked_list_a, linked_list_b



result,things,lines = find_closest_element(things, lines, 
attribute, max_cycle, max_cut, upper_bound, lower_bound, min_len, mode, prior)


current = lines.head
a = []
pointer = 0
while current:
    print(pointer, current.closest, current.CD)
    current = current.next
    pointer +=1


# Stupid GH cant pass dictionary
class DICT:
    def __init__ (self, obj):
        self.obj = obj
result = DICT(result)
# ---------- end script_2 ----------
geometry_4 = Geometry(<point referenced from the Rhino model>)
script_3 = Script()  # -> out, a
# ---------- script_3: Python ----------
import Rhino.Geometry as rg
# =======================================================================
class Function():
    @classmethod
    def Move(self, graph, node_key):

        def B():
            # changable length, move along direction of edges
            return
        def C():
            # changable length, move z 
            return
        def D():
            #fixed length move z
            return
        def E():
            #changeable lenhgh move XYZ
            return
        def F():
            #fixed length move xyz
            return
        # ----------------------------------------------
        FC_conversion = {"B":B,"C":C,"D":D,"E":E,"F":F}
        ED_conversion= {"A":0,"B":1,"C":1,"D":0,"E":1,"F":0}
        node_type = graph.adjacency_list[node_key]._type
        edge_keys = [edge._type for edge in graph.adjacency_list[node_key].edge]
        edge_converted = [ED_conversion[key] for key in edge_keys]

        # invoke function
        function = FC_conversion[node_type]()
# ---------- end script_3 ----------
list_item = ListItem(List=script_2.a, Index=0, Wrap=True)
# Task today
# 1. update the point movment based on the type
# 2. Turn find cloest element into a function for graph
# 3. Type A immediately get length
geometry_5 = Geometry(script_2.a)
# if the student already knows what is in the DB,
script_4 = Script(lines=script.lines, x=geometry_4, run=Button(ExpressionNormal="True", ExpressionPressed="False"))  # -> out, a, graph
# ---------- script_4: Python ----------
import Rhino.Geometry as rg


# NameSpace
# ==================================================================================================    
class Edge:
    def __init__(self, nodes, geometry, _type):
        self.nodes = nodes  #the other nodes it links to
        self.closest = None
        self.CD = 10000000
        self.geometry = geometry
        self._type = _type
        self.length = self.rounding(geometry.GetLength())

    def rounding(self, num, decimal = 1):
        return round(num, decimal)
    def update_info(self):
        self.length = self.rounding(rg.Curve.GetLength(self.geometry))
class Node:
    def __init__(self, geometry, _type = None):
        self.geometry = geometry
        self.edge = []
        self._type = _type
# -----------------------------------------------------------------
class Graph:
    def __init__(self, adjacency_list, edge_list):
        self.adjacency_list = adjacency_list
        self.edge_list = edge_list
        self.number_of_nodes = len(adjacency_list)
        self.number_of_edges = len(edge_list)
        
    def get_edge(self, pt):
        coordinate = (pt.X, pt.Y, pt.Z)
        key =  f"{int(pt.X)}_{int(pt.Y)}_{int(pt.Z)}"
        if key in self.adjacency_list:
            print([i._type for i in self.adjacency_list[key].edge])
            edge = [self.adjacency_list[list(filter(lambda x: x!= key, i.nodes))[0]].geometry for i in self.adjacency_list[key].edge]
            return list(edge)
        else:
            return None    

    def traverse(self, function_call= None, mode ="edge"):
        if mode == "node":
            for node in self.adjacency_list:
                function_call(node)
                return
        if mode == "edge":
            for edge in self.edge_list:
                function_call(edge)
                return
    
    def get_node(self,pt):
        coordinate = (pt.X, pt.Y, pt.Z)
        key =  f"{int(pt.X)}_{int(pt.Y)}_{int(pt.Z)}"
        if key in self.adjacency_list:
            return self.adjacency_list[key]
        else:
            return None

    @classmethod
    def get_graph(cls, lines):
        # lines is an object containing a dictionary eg lines.obj
        def get_adjacency_list(lines):
            adjacency_list = {}
            edge_list = {}
            for typ in lines.obj:
                if lines.obj[typ] !=None:
                    for line in lines.obj[typ]:
                        # rebuild curve first
                        if line.PointAtStart.Z > line.PointAtEnd.Z:
                            line = rg.Line(line.PointAtEnd,line.PointAtStart).ToNurbsCurve()
                        st_pt = line.PointAtStart
                        end_pt = line.PointAtEnd
                        coordinate1 = (st_pt.X, st_pt.Y, st_pt.Z)
                        coordinate2 = (end_pt.X, end_pt.Y, end_pt.Z)
                        key1 = f"{int(st_pt.X)}_{int(st_pt.Y)}_{int(st_pt.Z)}"
                        key2 = f"{int(end_pt.X)}_{int(end_pt.Y)}_{int(end_pt.Z)}"
                        nodes = [key1, key2]

                        line_UID = key1 + "::" + key2
                        edge1 = Edge(nodes, line, typ)
                        edge2 = Edge(nodes, line, typ)
                        edge_list[line_UID] = edge1

                        if key1 not in adjacency_list:
                            adjacency_list[key1] = Node(st_pt, _type= typ)
                            adjacency_list[key1].edge.append(edge2)
                            
                        else:
                            adjacency_list[key1].edge.append(edge2)
                                
                        if key2 not in adjacency_list:
                            adjacency_list[key2] = Node(end_pt, _type= typ)
                            adjacency_list[key2].edge.append(edge1)
                
                        else:
                            adjacency_list[key2].edge.append(edge1)

            return adjacency_list, edge_list
        
        adjacency_list, edge_list = get_adjacency_list(lines)
        return cls(adjacency_list, edge_list)
# ==================================================================================================
# dicitony on if the length is changable for the  type, 0 = fixed length
dependecy_list = {"A":0,"B":1,"C":1,"D":0,"E":1,"F":0,}

if run:
    graph = Graph.get_graph(lines)
    a = graph.get_edge(x)
    graph.get_node(x)
# ---------- end script_4 ----------
script_5 = Script(graph=script_4.graph, things=uuid_generator.GUID_THINGS)  # -> out, things, graph, a, b, c
# ---------- script_5: Python ----------
import Rhino.Geometry as rg

# Function name space
# =======================================================================
def Greedy(graph, things, graph_edge, result):
    current = things.head
    closest_node = None
    while current:
        d1 = graph_edge.length - current.value.Length
        if abs(d1) <= abs(graph_edge.CD)  and current.value.ID not in result:
            graph_edge.CD = d1
            closest_node = current
        current = current.next
    if closest_node != None:
        result[closest_node.value.ID] = 1
    graph_edge.closest = closest_node
    return result
def Cut(graph, things, graph_edge, result):
    return
def Transform_edge(graph, graph_edge, nodes4update, function_call = None):
    # type B for update_edge for testing
    v = graph_edge.geometry.PointAtStart - graph_edge.geometry.PointAtEnd
    v =(v/v.Length * graph_edge.CD)
    end_pt =  graph_edge.geometry.PointAtEnd + v
    line = rg.Line(graph_edge.geometry.PointAtStart, end_pt)
    graph_edge.geometry = line.ToNurbsCurve()
    graph_edge.update_info()
    # add to the nodes for update with no duplicates and no type A      
    [nodes4update.add(node_key) for node_key in graph_edge.nodes 
    if graph.adjacency_list[node_key]._type != "A"]
    return
def Transform_node(graph, graph_edge, nodes4update, function_call = None):
    conversion= {"A":0,"B":1,"C":1,"D":0,"E":1,"F":0}
    for node_key in nodes4update:
        edge_keys = [edge._type for edge in graph.adjacency_list[node_key].edge]
        converted = [conversion[key] for key in edge_keys]
        print(edge_keys, converted)
        # function for different type of points

    return

# Main
# =======================================================================
'''
# Interat all the edges
    1. Find Cloest Match using Greedy
    2. Transform all the edge based on the newly found match
    3. Get a list of nodes that needs to be update
# Loop end for the edge 
    4. Update the nodes
'''
# =======================================================================
a = []
b = []
c = []
result = {}
nodes4update = set()

for edge_key in graph.edge_list:
    edge = graph.edge_list[edge_key]
    if edge._type != "A":
        Greedy(graph, things, edge, result)
        Transform_edge(graph, edge, nodes4update)
    # print(edge.edge_type, edge.closest)
    # print(edge.CD)
    if edge.closest:
        a.append(edge.closest.value.Geometry)
        b.append(edge.closest.value.AxisX)
        c.append(edge.geometry)
Transform_node(graph, edge, nodes4update)
# print(result)
print(nodes4update)
# ---------- end script_5 ----------
line = Line(StartPoint=geometry_4, EndPoint=script_4.a)
geometry_6 = Geometry(script_5.c)
orient = Orient(Geometry=script_5.a, Source=script_5.b, Target=script_5.c)  # -> Geometry, Transform
panel_5 = Panel(script_5.things)
visualizer = Script(things=script_2.things, lines=script_2.lines)  # -> out, plns, a, b, c, d, e, msg
# ---------- visualizer: Python ----------
plns = things.list_export("Cut")
# plnS = things.list_export("y_cut_plane")


a = []
b = []
c = []
d = []
e = []

msg = 0
current = lines.head
while current != None:
    if current.closest:
        a.append(current.closest.value.Geometry)
        b.append(current.closest.value.AxisX)
        c.append(current.value.Geometry)
        msg += current.closest.value.Length
    d.append(current.value.Geometry)
    e.append(current.value.Connector)
    current = current.next
# ---------- end visualizer ----------
geometry_7 = Geometry(visualizer.c)  # disabled
orient_2 = Orient(Geometry=visualizer.a, Source=visualizer.b, Target=visualizer.c)  # -> Geometry, Transform; disabled
surface = Surface(visualizer.plns)  # disabled
geometry_8 = Geometry(visualizer.d)  # disabled
colour_swatch = ColourSwatch(SwatchColor=RGB(13, 150, 181))  # disabled
group = Group(Objects=geometry_7)  # disabled
area = Area(Geometry=surface)  # -> Area, Centroid; disabled
custom_preview = CustomPreview(Geometry=visualizer.a, Material=colour_swatch)  # disabled
end_points = EndPoints(Curve=geometry_8)  # -> Start, End; disabled
scale = Scale(Geometry=surface, Center=area.Centroid, Factor=222)  # -> Geometry, Transform; disabled
geometry_9 = Geometry(end_points.Start)  # disabled
