# Grasshopper definition 240206_Graph_Script_C.gh (Grasshopper 1.0.7)
# plug-ins: RhinoCodePluginGH

geometry_pipeline = GeometryPipeline(
    GroupByLayer=False,
    GroupByType=False,
    IncludeHidden=True,
    IncludeLocked=True,
    LayerFilter="Structure_Types::Typ A",
    NameFilter="*",
    SublayerFiltering=True,
    TypeFilter=4)
geometry_pipeline_2 = GeometryPipeline(
    GroupByLayer=False,
    GroupByType=False,
    IncludeHidden=True,
    IncludeLocked=True,
    LayerFilter="Structure_Types::Typ B",
    NameFilter="*",
    SublayerFiltering=True,
    TypeFilter=4)
geometry_pipeline_3 = GeometryPipeline(
    GroupByLayer=False,
    GroupByType=False,
    IncludeHidden=True,
    IncludeLocked=True,
    LayerFilter="Structure_Types::Typ C",
    NameFilter="*",
    SublayerFiltering=True,
    TypeFilter=4)
geometry_pipeline_4 = GeometryPipeline(
    GroupByLayer=False,
    GroupByType=False,
    IncludeHidden=True,
    IncludeLocked=True,
    LayerFilter="Structure_Types::Typ D",
    NameFilter="*",
    SublayerFiltering=True,
    TypeFilter=4)
geometry_pipeline_5 = GeometryPipeline(
    GroupByLayer=False,
    GroupByType=False,
    IncludeHidden=True,
    IncludeLocked=True,
    LayerFilter="Structure_Types::Typ E",
    NameFilter="*",
    SublayerFiltering=True,
    TypeFilter=4)
geometry_pipeline_6 = GeometryPipeline(
    GroupByLayer=False,
    GroupByType=False,
    IncludeHidden=True,
    IncludeLocked=True,
    LayerFilter="Structure_Types::Typ F",
    NameFilter="*",
    SublayerFiltering=True,
    TypeFilter=4)
geometry_pipeline_7 = GeometryPipeline(
    GroupByLayer=False,
    GroupByType=False,
    IncludeHidden=True,
    IncludeLocked=True,
    LayerFilter="BFH_ReUse24::Workspace",
    NameFilter="*",
    SublayerFiltering=True,
    TypeFilter=1073741848)
run = Button(ExpressionNormal="True", ExpressionPressed="False")
button = Button(ExpressionNormal="True", ExpressionPressed="False")
number_slider = Slider(11, range=0..100)
geometry = Geometry([<curve referenced from the Rhino model> x6])
geometry_2 = Geometry([<curve referenced from the Rhino model> x4])
geometry_3 = Geometry(<curve referenced from the Rhino model>)
panel = Panel("find_within_bound")
panel_2 = Panel("find_closest_with_bound")
panel_3 = Panel("structure_cut")
panel_4 = Panel("material_cut")
script = Script(a=geometry, c=geometry_2, d=geometry_3)  # -> out, lines; inputs a: list of Curve, b: list of Curve, c: list of Curve, d: list of Curve, e: list of Curve, f: list of Curve
# ---------- script: Python ----------
class dict_obj:
    def __init__(self, obj):
        self.obj = obj

lines = dict_obj( {
    "A":a,
    "B":b,
    "C":c,
    "D":d,
    "E":e,
})
# ---------- end script ----------
uuid_generator = Script(things=geometry_pipeline_7, lines=script.lines, run=run, shuffle=Toggle(False))  # -> out, GUID_THINGS, GUID_LINES_A, GUID_LINES; inputs things: list, run: Boolean, seed: Int32
# ---------- uuid_generator: Python ----------
import Rhino
import copy
import rhinoscriptsyntax as rs
import Rhino.Geometry as rg
import random

# Namespace definition
# -------------------------------------------------
class GUID:
    def __init__ (self, ID, Geometry, Type):
        self.ID = ID
        self.Geometry = Geometry 
        self.Type = Type
        self.Cut = None
        self.Connector = None
        self.update_info()
        if self.Type == "Line":
            self.line_type = None

    def update_info(self, mode = None, manual = None):
        if self.Type == "Brep":
            self.info = self.bounding_box_dimensions(self.Geometry)
            self.Length = self.info[0][0]
            self.Width = self.info[0][1]
            self.Height = self.info[0][2]
            self.AxisX = self.info[1][0]
            self.AxisY = self.info[1][1]
            self.AxisZ = self.info[1][2]
            self.x_cut_plane = self.info[2][0]
            self.y_cut_plane = self.info[2][1]
            self.z_cut_plane = self.info[2][2]
            self.Bbox = self.info[3]
        elif self.Type == "Line":
            self.Connector = self.Geometry.PointAtStart
            if type(self.Geometry) == rg.Line:
                self.Length = self.rounding(self.Geometry.Length)
                return
            self.Length = self.rounding(rg.Curve.GetLength(self.Geometry))

    def bounding_box_dimensions(self, obj):
        if type(obj) == rg.Brep:
            vertices = [vertex.Location for vertex in obj.Vertices]
            bounding_box = rg.BoundingBox(vertices)
        else:
            vertices = [vertex.Location for vertex in obj.ToBrep().Vertices]
            bounding_box = rg.BoundingBox(vertices)

        # Calculate the dimensions of the bounding box
       
        x_extent = self.rounding(bounding_box.Max.X - bounding_box.Min.X)
        y_extent = self.rounding(bounding_box.Max.Y - bounding_box.Min.Y)
        z_extent = self.rounding(bounding_box.Max.Z - bounding_box.Min.Z)
        
        # Create the start and end points of the central axis
        center = bounding_box.Center
        start_pointX = rg.Point3d(center.X - x_extent / 2, center.Y, center.Z)
        end_pointX = rg.Point3d(center.X + x_extent / 2, center.Y, center.Z)

        start_pointY = rg.Point3d(center.X , center.Y - y_extent / 2, center.Z)
        end_pointY = rg.Point3d(center.X , center.Y + y_extent / 2, center.Z)

        start_pointZ = rg.Point3d(center.X, center.Y, center.Z -z_extent/2)
        end_pointZ = rg.Point3d(center.X, center.Y, center.Z + z_extent)

        x_line = rg.LineCurve(start_pointX, end_pointX)
        y_line = rg.LineCurve(start_pointY, end_pointY)
        z_line = rg.LineCurve(start_pointZ, end_pointZ)

        x_cut_plane = rg.Plane(rg.Point3d(start_pointX.X, start_pointX.Y-y_extent/2, start_pointX.Z),
        rg.Vector3d(0,1,0))
        y_cut_plane = rg.Plane(rg.Point3d(start_pointY.X - x_extent/2, start_pointY.Y, start_pointY.Z), 
        rg.Vector3d(1,0,0))
        z_cut_plane = rg.Plane(rg.Point3d(start_pointZ.X , start_pointZ.Y, start_pointZ.Z),
        rg.Vector3d(0,0,1))

        return ((x_extent, y_extent, z_extent),
                (x_line, y_line, z_line),
                (x_cut_plane, y_cut_plane, z_cut_plane),
                bounding_box)

    def factory_method(self, ID, Geometry, Type):
        G = GUID(ID, Geometry,Type)
        return G

    def rounding(self, num, decimal_place = 1):
        return round(num, decimal_place)

class NODE:
    def __init__(self, value):
        self.next = None
        self.prev = None
        self.value = value #self.value = GUID(ID, Geometry)
        self.closest = None #for lines, the cloest one to other link list
        self.CD = 100000000

    def split(self, obj, linked_list, obj_type, length = None):
        # Caution: Brep here is a Brep List !!!
        if self.value is not None:
            if obj_type == "Brep":
                self.value.Geometry = obj[0]
                self.value.update_info()
                splited_Node = NODE(GUID(self.value.ID + "/", obj[1], "Brep"))
                splited_Node.next = self.next
                self.next = splited_Node
            if obj_type == "Line":
                # Line is just a single line cryyy so dumb RG
                start_pt = rg.PointAtStart
                end_pt = rg.PointAtEnd
                pt = obj.DivideByLength(length, True, False)
                line1 = rg.Line(start_pt, pt)
                line2 = rg.Line(pt, end_pt)
                self.value.Geometry = line1
                self.value.update_info()
                splited_Node = NODE(GUID(self.value.ID + "/", line2, "Line"))
                splited_Node.next = self.next
                self.next = splited_Node
            
            linked_list.length += 1

    def factory_method(self, ID, obj, obj_type = "Line"):
        N = NODE(value = GUID(ID, obj, obj_type))
        return N


class LINKEDLIST:
    def __init__ (self):
        self.node = None
        self.head = None
        self.tail = None
        self.length = 0
    
    def append(self, value):
        newNode = NODE(value)
        current = self.head
        self.length += 1
        if self.head == None:
            self.head = newNode
            self.tail = newNode
            return newNode
        while current.next != None:
            current = current.next
            
        newNode.prev = current
        current.next = newNode
        self.tail = newNode
        return newNode

    def prepend(self, value):
        newNode = NODE(value)
        self.length +=1

        if self.head == None:
            self.head = newNode
            self.tail = newNode
            return self
        self.head.prev = newNode
        newNode.next = self.head
        self.head = newNode
        return self

    def traverse(self, action = None):
        current = self.head
        while current != None:
            if action:
                action()
            else:
                print(current)
            current = current.next

    def goto(self, position):
        current = self.head
        for i in range(position):
            if current != None:
                current = current.next
            else:
                raise IndexError("Index out of range")

        return current

    def pop(self, position = None):
        if position == None:
            position = self.length -1
            self.length -= 1
        if position == 0:
            if self.head != None:
                pop = self.goto(position)
                self.head = self.head.next
                self.length -= 1
                return pop
            else: 
                raise IndexError("Index out of range")
        if position >= self.length or position < 0:
            raise Exception("index out of range")

        previous = self.goto(position- 1)
        if previous != None and previous.next != None:
            previous.next = previous.next.next
            self.length -= 1
        else:
            raise IndexError("Index out of range")
        return previous

    
    def insert(self, value, position):
        # pass exception here eg position > self.length
        node = NODE(value)
        pointer1 = self.goto(position -1 )
        pointer2 = pointer1.next.next
        pointer1.next = node
        node.prev = pointer1 
        node.next = pointer2
        self.lenth += 1
        return node
    
    def list_export(self, attribute):
        lst = []
        current = self.head
        while current != None:
            value_attribute = getattr(current.value, attribute)
            lst.append(value_attribute)
            current = current.next
        return lst

    def copy(self):
        LS = LINKEDLIST()
        current = self.head
        while current != None:
            new_node = NODE(copy.deepcopy(current.value))
            LS.append(new_node)
            current = current.next
        return LS
    
    def concat(self, linked_list):
        if linked_list.head == None or self.head == None:
            raise Exception("Sorry both list must not be empty la")
        linked_list_tail = linked_list.tail
        linked_list.head.prev = self.tail
        self.tail.next = linked_list.head
        self.tail = linked_list_tail
        self.length += linked_list.length
        return self

    def reverse(self):
        prev = None
        current = self.head
        while(current is not None):
            next = current.next
            current.next = prev
            prev = current
            current = next
        self.head = prev
    
    def factory_method(self):
        LS = LINKEDLIST()
        return LS
# ==============================================================
GUID_LINES= LINKEDLIST()
GUID_LINES_A= LINKEDLIST()
GUID_THINGS = LINKEDLIST()

def shuffle_array(arr, seed=None):
    if seed is not None:
        random.seed(seed)
    n = len(arr)
    for i in range(n-1, 0, -1):
        j = random.randint(0, i)
        arr[i], arr[j] = arr[j], arr[i]
    return arr


if shuffle:
    things= shuffle_array(things, seed= None)
    lines = shuffle_array(lines, seed= None)

def line_rebuild(line):
    if line.PointAtStart.Z > line.PointAtEnd.Z:
        line = rg.Line(line.PointAtEnd,line.PointAtStart).ToNurbsCurve()
    return line

if run:
    for i,thing in enumerate(things):
        thingID = "thing" + str(i)        
        obj = GUID(thingID, thing, "Brep")
        GUID_THINGS.prepend(obj)
        
    for typ in lines.obj:
        if lines.obj[typ]:
            for i, line in enumerate(lines.obj[typ]):
                lineID = "line" + typ + str(i)
                obj = GUID(lineID, line_rebuild(line), "Line")
                obj.line_type = typ
                GUID_LINES.prepend(obj)
# ---------- end uuid_generator ----------
boolean_toggle = BooleanToggle(False)  # disabled
number_slider_2 = Slider(20, range=0..100)  # disabled
number_slider_3 = Slider(1, range=0..10)  # disabled
number_slider_4 = Slider(10000, range=0..20000)  # disabled
number_slider_5 = Slider(10000, range=0..20000)  # disabled
number_slider_6 = Slider(0, range=0..4000)  # disabled
script_2 = Script(
    things=uuid_generator.GUID_THINGS,
    lines=uuid_generator.GUID_LINES,
    attribute="Length",
    cut=boolean_toggle,
    max_cut=number_slider_2,
    max_cycle=number_slider_3,
    upper_bound=number_slider_4,
    lower_bound=number_slider_5,
    min_len=number_slider_6,
    mode="find_closest")  # -> out, things, lines, result, a; inputs attribute: String, cut: Boolean, max_cut: Int32, max_cycle: Int32, upper_bound: Int32, lower_bound: Int32, min_len: Int32, mode: String, prior: String; disabled
# ---------- script_2: Python ----------
import rhinoscriptsyntax as rs
import Rhino.Geometry as rg

"""
1. Find closest match using greedy
2. return a list of length difference with pos and neg numbers
3. for the neg number => Cut extra and hence reduce the neg to 0
4. Add the extra piece back to the input and the length.
Stopping conditions are all reaches to 0 or 10 times
"""

# Add stopping Condition and Cycle time
# in Greedy(), it is measuring the length of the line to find best match
# now we have to split the line and push it to linked list a 

def split_by_plane_length(obj, pln, obj_type):

    # pln could be length if obj_type is line
    if obj_type == "Brep":
        bb = rg.Brep.GetBoundingBox(obj,rg.Plane.WorldXY)
        
        
        _,extU,extV = rg.Plane.ExtendThroughBox(pln,bb)
        extU.T0 = extU.T0 - 1
        extU.T1 = extU.T1 + 1
        extV.T0 = extV.T0 - 1
        extV.T1 = extV.T1 + 1
        
        planeSrf = rg.PlaneSurface(pln,extU,extV)
        splitter = planeSrf.ToBrep()

        brep = rs.coercebrep(obj)
        pieces = brep.Split(splitter,0.001)
        pieces = [piece.CapPlanarHoles(0.01)  for piece in pieces]
    if obj_type == "Line":
        start_pt = obj.PointAtStart
        end_pt = obj.PointAtEnd
        pt = obj.PointAtLength(pln)
        line1 = rg.Line(start_pt, pt).ToNurbsCurve()
        line2 = rg.Line(pt, end_pt).ToNurbsCurve()
        pieces = [line2, line1]
    return pieces

def find_closest_element(linked_list_a, linked_list_b, 
attribute, max_cycle, max_cut, upper_bound, lower_bound, min_len,mode, prior = None, result= None):
    step = 0
    cut_count = 0
    prev = linked_list_b.length

    if result == None:
        result = {}
    else:
        result = result.obj

    if linked_list_b.length > linked_list_a.length:
        raise Exception("Number of input lines are more than available object")
        return

    def Greedy(linked_list_a, linked_list_b, attribute):
        current_b = linked_list_b.head
        pointer = 0 
        while current_b != None and current_b.CD != 0:
            closest_node = None
            if pointer <= prev and current_b.value.line_type != "A":
                current_a = linked_list_a.head
                while current_a != None and current_a.value.Length > min_len:
                    d1 = current_b.value.Length - getattr(current_a.value, attribute)
                    if mode == "find_closest":
                        if prior == None:
                            # Default
                            if abs(d1) <= abs(current_b.CD)  and current_a.value.ID not in result:
                                current_b.CD = d1
                                closest_node = current_a
                    elif mode == "find_closest_with_bound":
                        if prior == None:
                            # Default
                            if abs(d1) <= abs(current_b.CD) and  -lower_bound <= d1 <= upper_bound and current_a.value.ID not in result:
                                    current_b.CD = d1
                                    closest_node = current_a
                    elif mode == "find_within_bound":
                        if prior == None:
                            # Default
                            if -lower_bound <= d1 <= upper_bound and current_a.value.ID not in result:
                                current_b.CD = d1
                                closest_node = current_a
                                break

                    current_a = current_a.next
                
            if closest_node != None:
                result[closest_node.value.ID] = 1
                result[current_b.value.ID] = 1
            current_b.closest = closest_node
            
            current_b = current_b.next
            pointer += 1
        return 
    
    def Cut(result, linked_list_a, linked_list_b):
        current = linked_list_b.head #iterate through lines 
        LS = linked_list_b.factory_method()
        pointer = 0
        nonlocal prev
        nonlocal cut_count
        while current and pointer <= prev:
            # split things if things are in excess
            if current.CD < 0 and current.closest != None:
                scalar = abs(current.CD)
                if attribute == "Length":
                    v = rg.Vector3d(scalar,0,0)
                    pln = current.closest.value.y_cut_plane.Clone()
                elif attribute == "Width":
                    v = rg.Vector3d(0, scalar,0)
                    pln = current.closest.value.x_cut_plane.Clone()
                elif attribute == "Height":
                    v = rg.Vector3d(0,0, scalar)
                    pln = current.closest.value.z_cut_plane.Clone()

                # Split original object according to length difference
                brp = current.closest.value.Geometry
                pln.Translate(v)
                current.closest.value.Cut = pln

                # Split the Brep and lines                
                splited = split_by_plane_length(brp, pln, "Brep")
                # split Node
            
                if (len(splited)):
                    current.closest.split(splited, linked_list_a, "Brep")
                    cut_count += 1

            # split the lines if the lines are in excess
            if current.CD >0 and current.closest != None:
                splited = split_by_plane_length(
                    current.value.Geometry,
                    current.CD,
                    "Line")

                current.value.Geometry = splited[0]
                current.value.update_info()

                GUID = current.value.factory_method(
                    current.value.ID + "/", splited[1], "Line")
                LS.prepend(GUID)

            #once splited reduce CD to 0
            current.CD = 0
            current = current.next
            pointer += 1
        prev = LS.length
        if LS.length == 0:
            return linked_list_b
        return LS.concat(linked_list_b)

    def Transform(result, linked_list_a, linked_list_b):
        current = linked_list_b.head
        pointer = 0
        LS = linked_list_b.factory_method()
        nonlocal prev
        nonlocal cut_count
        while current:
            v = current.value.Geometry.PointAtStart - current.value.Geometry.PointAtEnd
            v =(v/v.Length * current.CD)
            end_pt =  current.value.Geometry.PointAtEnd + v
            line = rg.Line(current.value.Geometry.PointAtStart, end_pt)
            current.value.Geometry = line.ToNurbsCurve()
            current.value.update_info()
            current = current.next
        return
        
    while step < max_cycle:
        print(linked_list_a.length, linked_list_b.length)
        Greedy(linked_list_a, linked_list_b, attribute)
        Transform(result,linked_list_a, linked_list_b)
        print("Cut Start!")
        if cut:
            linked_list_b = Cut(result, linked_list_a, linked_list_b)
            print(linked_list_a.length,linked_list_b.length)
        step +=1
    return result,linked_list_a, linked_list_b



result,things,lines = find_closest_element(things, lines, 
attribute, max_cycle, max_cut, upper_bound, lower_bound, min_len, mode, prior)


current = lines.head
a = []
pointer = 0
while current:
    print(pointer, current.closest, current.CD)
    current = current.next
    pointer +=1


# Stupid GH cant pass dictionary
class DICT:
    def __init__ (self, obj):
        self.obj = obj
result = DICT(result)
# ---------- end script_2 ----------
geometry_4 = Geometry(<point referenced from the Rhino model>)
script_3 = Script()  # -> out, Function
# ---------- script_3: Python ----------
import Rhino.Geometry as rg
# =======================================================================
class Function():
    def to_point(self, result):
            return(rg.Point3d(result[0], result[1], result[2]))

    def Translate(self, graph, node_key):

        def Default(lines):
            # find common end points without changing the length
            return
        def find_intersection_from_lines(graph, pt, A_pt):
            return
        def find_point_from_lotus(graph, locus, pt, A_pt):
        
            if not locus.IsValid:
                return None
            edge = graph.get_edge_from_pt(pt, A_pt)
            # Ensure the curve is reparameterized for accurate calculations
            locus.Domain = rg.Interval(0, 1)
            sphere = rg.Sphere(A_pt, edge.length)

            intersection = rg.Intersect.Intersection.CurveBrep(locus, sphere.ToBrep(), 0.01)
            if intersection[0] == True:
                
                point_list = list(intersection[2])
                point_list.sort(key = lambda x : x.DistanceTo(locus.PointAtStart))

                coordinate = (int(point_list[0].X), int(point_list[0].Y), int(point_list[0].Z))
                # node.temp = rg.Point3d(int(point_list[0].X), int(point_list[0].Y), int(point_list[0].Z))
                return coordinate
            return None
        
        # ----------------------------------------------
        def B(graph, node, adjacent_nodes):
            # changable length, move along direction of edges
            return
        def C(graph, node, adjacent_nodes):
            # changable length, move z
            locus = rg.Line(node.geometry, rg.Vector3d(0,0,1), 1000000000).ToNurbsCurve()

            result = set([find_point_from_lotus(graph, locus, node.geometry, A_pt.geometry)
            for A_pt in adjacent_nodes])
            # handle the case if result is not 1

            # result is a set of tuples, update curve geometry in edge
            return result
        def D(graph, node, adjacent_nodes):
            #fixed length move z
            return
        def E(graph, node, adjacent_nodes):
            #changeable lenhgh move XYZ
            return
        def F(graph, node, adjacent_nodes):
            #fixed length move xyz
            return
        # ----------------------------------------------
        FC_conversion = {"B":B,"C":C,"D":D,"E":E,"F":F}
        ED_conversion= {"A":0,"B":1,"C":1,"D":0,"E":1,"F":0}
        node = graph.adjacency_list[node_key]
        adjacent_edges = [graph.edge_list[a_edge] for a_edge in node.edges]
        adjacent_nodes = list({graph.adjacency_list[a_node_key] for edge in adjacent_edges for a_node_key in edge.nodes
        if a_node_key != node_key})
        print(adjacent_nodes)
        edge_type_keys = [edge._type for edge in adjacent_edges]
        edge_converted = [ED_conversion[key] for key in edge_type_keys]
        # ----------------------------------------------
        return FC_conversion[node._type](graph, node, adjacent_nodes)
# =======================================================================
Function = Function()
# ---------- end script_3 ----------
list_item = ListItem(List=script_2.a, Index=0, Wrap=True)  # disabled
# Task today
# 1. update the point movment based on the type
# 2. Turn find cloest element into a function for graph
# 3. Type A immediately get length
geometry_5 = Geometry(script_2.a)  # disabled
# if the student already knows what is in the DB,
script_4 = Script(lines=script.lines, x=geometry_4, run=Button(ExpressionNormal="True", ExpressionPressed="False"))  # -> out, a, graph
# ---------- script_4: Python ----------
import Rhino.Geometry as rg


# NameSpace
# ==================================================================================================    
class Edge:
    def __init__(self, nodes, geometry, _type, Graph = None):
        self.nodes = nodes  #the other nodes it links to
        self.closest = None
        self.CD = 10000000
        self._type = _type
        self.geometry = self.update_from_nodes(geometry)
        self.length = self.rounding(self.geometry.GetLength())

    def rounding(self, num, decimal = 1):
        return round(num, decimal)
    def update_info(self):
        self.length = self.rounding(rg.Curve.GetLength(self.geometry))
    def update_from_nodes(self, geometry):
        # if len(self.nodes) ==2:
        #     return rg.Line(self.nodes[0].geometry, self.nodes[1].geometry).ToNurbsCurve()
        return geometry
class Node:
    def __init__(self, geometry, _type = None):
        self.geometry = geometry
        self.edges = []
        self._type = _type
        self.temp = None
# -----------------------------------------------------------------
class Graph:
    def __init__(self, adjacency_list, edge_list):
        self.adjacency_list = adjacency_list
        self.edge_list = edge_list
        self.number_of_nodes = len(adjacency_list)
        self.number_of_edges = len(edge_list)
        
    def get_edge(self, pt = None):
        coordinate = (pt.X, pt.Y, pt.Z)
        node_key =  f"{int(pt.X)}_{int(pt.Y)}_{int(pt.Z)}"
        ED_conversion= {"A":0,"B":1,"C":1,"D":0,"E":1,"F":0}
        if node_key in self.adjacency_list:
            node = self.adjacency_list[node_key]
            A_edge = node.edges
            print([self.edge_list[edge_key]._type for edge_key in A_edge])
            print([ED_conversion[self.edge_list[edge_key]._type] for edge_key in A_edge])
            edge = [self.edge_list[edge_key].geometry for edge_key in A_edge]
            return edge
        else:
            return None    

    def traverse(self, function_call= None, mode ="edge"):
        if mode == "node":
            for node in self.adjacency_list:
                function_call(node)
                return
        if mode == "edge":
            for edge in self.edge_list:
                function_call(edge)
                return
    
    def get_node(self,pt):
        coordinate = (pt.X, pt.Y, pt.Z)
        key =  f"{int(pt.X)}_{int(pt.Y)}_{int(pt.Z)}"
        if key in self.adjacency_list:
            return self.adjacency_list[key]
        else:
            return None
    def get_edge_from_pt(self, pt1, pt2):
        key1 = f"{int(pt1.X)}_{int(pt1.Y)}_{int(pt1.Z)}"
        key2 = f"{int(pt2.X)}_{int(pt2.Y)}_{int(pt2.Z)}"
        line_UID = key1 + "::" + key2
        if line_UID not in graph.edge_list:
            line_UID = key2 + "::" + key1
        return self.edge_list[line_UID]

    @classmethod
    def get_graph(cls, lines):
        # lines is an object containing a dictionary eg lines.obj
        def get_adjacency_list(lines):
            adjacency_list = {}
            edge_list = {}
            for typ in lines.obj:
                if lines.obj[typ] !=None:
                    for line in lines.obj[typ]:
                        # rebuild curve first
                        if line.PointAtStart.Z > line.PointAtEnd.Z:
                            line = rg.Line(line.PointAtEnd,line.PointAtStart).ToNurbsCurve()
                        st_pt = line.PointAtStart
                        end_pt = line.PointAtEnd
                        coordinate1 = (st_pt.X, st_pt.Y, st_pt.Z)
                        coordinate2 = (end_pt.X, end_pt.Y, end_pt.Z)
                        key1 = f"{int(st_pt.X)}_{int(st_pt.Y)}_{int(st_pt.Z)}"
                        key2 = f"{int(end_pt.X)}_{int(end_pt.Y)}_{int(end_pt.Z)}"
                        nodes = [key1, key2]

                        line_UID = key1 + "::" + key2
                        edge = Edge(nodes, line, typ)
                        edge_list[line_UID] = edge

                        if key1 not in adjacency_list:
                            adjacency_list[key1] = Node(st_pt, _type= typ)
                            adjacency_list[key1].edges.append(line_UID)
                            
                        else:
                            adjacency_list[key1].edges.append(line_UID)
                                
                        if key2 not in adjacency_list:
                            adjacency_list[key2] = Node(end_pt, _type= typ)
                            adjacency_list[key2].edges.append(line_UID)
                
                        else:
                            adjacency_list[key2].edges.append(line_UID)

            return adjacency_list, edge_list
        
        adjacency_list, edge_list = get_adjacency_list(lines)
        return cls(adjacency_list, edge_list)
# ==================================================================================================
# dicitony on if the length is changable for the  type, 0 = fixed length
dependecy_list = {"A":0,"B":1,"C":1,"D":0,"E":1,"F":0,}

if run:
    graph = Graph.get_graph(lines)
    a = graph.get_edge(x)
    graph.get_node(x)
# ---------- end script_4 ----------
script_5 = Script(graph=script_4.graph, things=uuid_generator.GUID_THINGS, Function=script_3.Function, x=geometry_4)  # -> out, things, graph, a, b, c, d, e; inputs x: Point3d
# ---------- script_5: Python ----------
import Rhino.Geometry as rg

# Function name space
# =======================================================================
def Greedy(graph, things, graph_edge, result):
    current = things.head
    closest_node = None
    while current:
        d1 = graph_edge.length - current.value.Length
        if abs(d1) <= abs(graph_edge.CD)  and current.value.ID not in result:
            graph_edge.CD = d1
            closest_node = current
        current = current.next
    if closest_node != None:
        result[closest_node.value.ID] = 1
    graph_edge.closest = closest_node
    return result
    # ----------------------------------------------
def Greedy_Cut(graph, things, graph_edge, result):
    return
    # ----------------------------------------------
def Greedy_Transform_edge(graph, graph_edge, nodes4update, FC = None):
    # type B for update_edge for testing
    v = graph_edge.geometry.PointAtStart - graph_edge.geometry.PointAtEnd
    v =(v/v.Length * graph_edge.CD)
    end_pt =  graph_edge.geometry.PointAtEnd + v
    line = rg.Line(graph_edge.geometry.PointAtStart, end_pt)
    graph_edge.geometry = line.ToNurbsCurve()
    graph_edge.update_info()
    # add to the nodes for update with no duplicates and no type A      
    [nodes4update.add(node_key) for node_key in graph_edge.nodes 
    if graph.adjacency_list[node_key]._type != "A"]
    return
    # ----------------------------------------------
def Transform_node(graph, graph_edge, node_key, FC= None):
    conversion= {"A":0,"B":1,"C":1,"D":0,"E":1,"F":0}
    result = []
    node = graph.adjacency_list[node_key]
    FC_result = FC.Translate(graph, node_key)
    print(FC_result)

    # handle the result is result is more than 1. 
    # first check where that point that edge belongs to
    # and whether 
    result.extend(FC_result)
    # update node and update edge
    return [FC.to_point(coordinate) for coordinate in result]
# Main
# =======================================================================
'''
# Interat all the edges
    1. Find Cloest Match using Greedy
    2. Transform all the edge based on the newly found match
    3. Get a list of nodes that needs to be update
# Loop end for the edge 
    4. Update the list of nodes
'''
# =======================================================================
a = []
b = []
c = []
e = []
result = {}
nodes4update = set()

for edge_key in graph.edge_list:
    edge = graph.edge_list[edge_key]
    if edge._type != "A":
        Greedy(graph, things, edge, result)
        Greedy_Transform_edge(graph, edge, nodes4update)

    if edge.closest:
        a.append(edge.closest.value.Geometry)
        b.append(edge.closest.value.AxisX)
        c.append(edge.geometry)
for node_key in nodes4update:
    e.extend(Transform_node(graph, edge, node_key, Function))
# print(result)
# print(nodes4update)
d = graph.get_edge(x)
# ---------- end script_5 ----------
script_6 = Script(graph=script_4.graph, things=uuid_generator.GUID_THINGS, Function=script_3.Function)  # -> out, things, graph
# ---------- script_6: Python ----------
import Rhino.Geometry as rg

# Function name space
# =======================================================================
def Greedy(graph, things, graph_edge, result):
    current = things.head
    closest_node = None
    while current:
        d1 = graph_edge.length - current.value.Length
        if abs(d1) <= abs(graph_edge.CD)  and current.value.ID not in result:
            graph_edge.CD = d1
            closest_node = current
        current = current.next
    if closest_node != None:
        result[closest_node.value.ID] = 1
    graph_edge.closest = closest_node
    return result
    # ----------------------------------------------
def Greedy_Cut(graph, things, graph_edge, result):
    return
    # ----------------------------------------------
def Greedy_Transform_edge(graph, graph_edge, nodes4update, FC = None):
    # type B for update_edge for testing
    v = graph_edge.geometry.PointAtStart - graph_edge.geometry.PointAtEnd
    v =(v/v.Length * graph_edge.CD)
    end_pt =  graph_edge.geometry.PointAtEnd + v
    line = rg.Line(graph_edge.geometry.PointAtStart, end_pt)
    graph_edge.geometry = line.ToNurbsCurve()
    graph_edge.update_info()
    # add to the nodes for update with no duplicates and no type A      
    [nodes4update.add(node_key) for node_key in graph_edge.nodes 
    if graph.adjacency_list[node_key]._type != "A"]
    return
    # ----------------------------------------------
def Transform_node(graph, graph_edge, node_key, FC= None):
    ED_conversion= {"A":0,"B":1,"C":1,"D":0,"E":1,"F":0}
    result = []
    node = graph.adjacency_list[node_key]
    FC_result = FC.Translate(graph, node_key)
    print(FC_result)

    # handle the result is result is more than 1. 
    # first check where that point that edge belongs to
    # and whether 
    result.extend(FC_result)
    # update node and update edge
    return [FC.to_point(coordinate) for coordinate in result]
# Main
# =======================================================================
'''
# Iterat all the edges
    1. Based on the edge with edge that can not move,
        find tracectory of the nodes.
    2. 
    3. 
# Loop end for the edge 
    4. Update the list of nodes
'''
# =======================================================================
a = []
b = []
c = []
e = []
result = {}
nodes4update = set()
ED_conversion= {"A":0,"B":1,"C":1,"D":0,"E":1,"F":0}

for edge_key in graph.edge_list:
    edge = graph.edge_list[edge_key]
    if edge._type != "A":
        if ED_conversion[edge._type] ==0:
            # the edge with fixed length
            print(edge._type, "meow")
            nodes_for_trajectory = [graph.adjacency_list[node_key]._type
            for node_key in edge.nodes]
            print(nodes_for_trajectory)

# for node_key in nodes4update:
#     e.extend(Transform_node(graph, edge, node_key, Function))
# print(result)
# print(nodes4update)
# ---------- end script_6 ----------
geometry_6 = Geometry(script_4.a)
orient = Orient(Geometry=script_5.a, Source=script_5.b, Target=script_5.c)  # -> Geometry, Transform; disabled
# automatically update edge when vertex move
panel_5 = Panel(script_5.things)
geometry_7 = Geometry(script_5.c)
geometry_8 = Geometry(script_5.d)
geometry_9 = Geometry(script_5.e)
script_7 = Script()  # -> out, a
# ---------- script_7: Python ----------
import Rhino.Geometry as rg

def find_point_on_line_near_points(line, list_of_pts, list_of_lengths):
    """
    Attempts to find a point on a line that maintains specified distances to a list of other points.
    
    :param line: The Rhino.Geometry.Line object.
    :param list_of_pts: List of Rhino.Geometry.Point3d objects.
    :param list_of_lengths: List of distances (floats) corresponding to each point in list_of_pts.
    :return: A Rhino.Geometry.Point3d on the line that satisfies the distance constraints, or None.
    """
    
    # Placeholder for solution finding logic
    # This should involve an iterative method to search for a point on the line
    # that satisfies the distance constraints to each point in list_of_pts
    
    # For illustration, this is a placeholder to demonstrate approach
    # In practice, you would replace this with actual solution finding logic
    for t in range(101):
        test_point = line.PointAt(t / 100.0)  # Parametrically iterate over the line
        distances_ok = True
        for pt, length in zip(list_of_pts, list_of_lengths):
            if abs(test_point.DistanceTo(pt) - length) > 0.01:  # Arbitrary tolerance
                distances_ok = False
                break
        if distances_ok:
            return test_point
    
    return None
# ---------- end script_7 ----------
script_8 = Script()  # -> out, a
# ---------- script_8: Python ----------
import Rhino.Geometry as rg
# import scipy.optimize as optimize
# import numpy as np

def find_common_meeting_point(lines):
    """
    Finds a common meeting point for a list of lines where the lines can rotate
    around one of their endpoints without changing their length.

    :param lines: List of Rhino.Geometry.Line objects.
    :return: Rhino.Geometry.Point3d object representing the meeting point, or None.
    """

    def objective_function(point, lines):
        x, y, z = point
        meeting_point = rg.Point3d(x, y, z)
        # Calculate the sum of squared distances from the movable endpoints
        # to the proposed meeting point
        total_distance = sum([(line.To - meeting_point).Length ** 2 for line in lines])
        return total_distance

    # Use the midpoint of the first line as an initial guess
    initial_guess = np.array([lines[0].PointAt(0.5).X, lines[0].PointAt(0.5).Y, lines[0].PointAt(0.5).Z])

    # Optimize (minimize) the objective function
    result = optimize.minimize(objective_function, initial_guess, args=(lines,), method='BFGS')

    if result.success:
        optimal_point = result.x
        return rg.Point3d(optimal_point[0], optimal_point[1], optimal_point[2])
    else:
        return None

# Example usage
# lines = [rg.Line(rg.Point3d(0,0,0), rg.Point3d(5,0,0)), rg.Line(rg.Point3d(3,3,0), rg.Point3d(8,3,0))]
# meeting_point = find_common_meeting_point(lines)
# print(meeting_point)
# ---------- end script_8 ----------
visualizer = Script(things=script_2.things, lines=script_2.lines)  # -> out, plns, a, b, c, d, e, msg; disabled
# ---------- visualizer: Python ----------
plns = things.list_export("Cut")
# plnS = things.list_export("y_cut_plane")


a = []
b = []
c = []
d = []
e = []

msg = 0
current = lines.head
while current != None:
    if current.closest:
        a.append(current.closest.value.Geometry)
        b.append(current.closest.value.AxisX)
        c.append(current.value.Geometry)
        msg += current.closest.value.Length
    d.append(current.value.Geometry)
    e.append(current.value.Connector)
    current = current.next
# ---------- end visualizer ----------
geometry_10 = Geometry(visualizer.c)  # disabled
orient_2 = Orient(Geometry=visualizer.a, Source=visualizer.b, Target=visualizer.c)  # -> Geometry, Transform; disabled
surface = Surface(visualizer.plns)  # disabled
geometry_11 = Geometry(visualizer.d)  # disabled
colour_swatch = ColourSwatch(SwatchColor=RGB(13, 150, 181))  # disabled
group = Group(Objects=geometry_10)  # disabled
area = Area(Geometry=surface)  # -> Area, Centroid; disabled
custom_preview = CustomPreview(Geometry=visualizer.a, Material=colour_swatch)  # disabled
end_points = EndPoints(Curve=geometry_11)  # -> Start, End; disabled
scale = Scale(Geometry=surface, Center=area.Centroid, Factor=222)  # -> Geometry, Transform; disabled
geometry_12 = Geometry(end_points.Start)  # disabled
geometry_13 = Geometry(<curve referenced from the Rhino model>)  # disabled
script_9 = Script(x=geometry_13)  # -> out, a; inputs x: Curve; disabled
# ---------- script_9: Python ----------
import Rhino.Geometry as rg

def scale_nurbscurve_uniformly(curve, new_length):
    """
    Uniformly scale a NurbsCurve from its midpoint so that its length is a specific value.

    :param curve: The NurbsCurve object to scale.
    :param new_length: The desired length of the curve.
    :return: A new scaled NurbsCurve object.
    """
    if not curve.IsValid or new_length <= 0:
        return None

    # Calculate the current length of the curve
    current_length = curve.GetLength()
    if current_length == 0:
        return None  # Cannot scale a zero-length curve

    # Calculate the scale factor
    scale_factor = new_length / current_length

    # Get the midpoint of the curve
    midpoint = curve.PointAt(curve.Domain.Mid)

    # Scale the curve about its midpoint
    xform = rg.Transform.Scale(midpoint, scale_factor)
    scaled_curve = curve.DuplicateCurve()
    scaled_curve.Transform(xform)

    return scaled_curve

# Example usage
# Assuming 'curve' is a Rhino.Geometry.NurbsCurve object
# new_length = 10  # for example
# scaled_curve = scale_nurbscurve_uniformly(curve, new_length)
# print(scaled_curve)



# Example usage
a = scale_nurbscurve_uniformly(x, 2300)
# ---------- end script_9 ----------
geometry_14 = Geometry(<curve referenced from the Rhino model>)
geometry_15 = Geometry(<curve referenced from the Rhino model>)
geometry_16 = Geometry(<curve referenced from the Rhino model>)
geometry_17 = Geometry(<curve referenced from the Rhino model>)  # disabled
geometry_18 = Geometry(<curve referenced from the Rhino model>)  # disabled
geometry_19 = Geometry(script_9.a)  # disabled
script_10 = Script(x=geometry_17, y=geometry_18)  # -> out, a; disabled
# ---------- script_10: Python ----------
import Rhino.Geometry as rg

def find_point_from_curve(curve, line, tolerance =0.01):
    """
    Find a point on a curve that is a specified distance from a target point.

    :param curve: The curve to search (Rhino.Geometry.Curve).
    :param length: The specified distance from the target point.
    :param target_pt: The target point (Rhino.Geometry.Point3d).
    :return: The point on the curve or None if no such point exists.
    """
    if not curve.IsValid:
        return None

    # Ensure the curve is reparameterized for accurate calculations
    curve.Domain = rg.Interval(0, 1)
    length = line.GetLength()
    target_pt = line.PointAtStart
    sphere = rg.Sphere(target_pt, length)

    # Increment along the curve and check distances
    intersection = rg.Intersect.Intersection.CurveBrep(curve, sphere.ToBrep(), tolerance)
    if intersection[0] == True:
        point_list = list(intersection[2])
        point_list.sort(key = lambda x : x.DistanceTo(target_pt))
        return rg.Line(target_pt, point_list[0]).ToNurbsCurve()

    return None


a = find_point_from_curve(x,y)
# ---------- end script_10 ----------
script_11 = Script(x=geometry_14, y=geometry_15)  # -> out, a
# ---------- script_11: Python ----------
import Rhino.Geometry as rg

def intersect_spheres(node, adjacent_nodes):

    # Create sphere objects
    spheres = [rg.Sphere(A_node.geometry, A_node.geometry.DistanceTo(node.geometry)) 
    for A_node in adjacent_nodes]

    result_brep = spheres[0]
    for sphere in spheres[1:]:
        temp = rg.Brep.CreateBooleanIntersection(result_brep, sphere, 0.01)
        if temp:
            result_brep = temp
        else:
            return None

    # Calculate intersection

    intersection = rg.Intersect.Intersection.BrepBrep(sphere1.ToBrep(), sphere2.ToBrep(), 0.01)

    # Return the intersection curve(s)
    if intersection[0] == True:
        print(intersection)
        return intersection[1]
    else:
        return None
# ---------- end script_11 ----------
geometry_20 = Geometry(script_10.a)  # disabled
script_12 = Script(x=geometry_14, y=geometry_15)  # -> out, a
# ---------- script_12: Python ----------
import Rhino.Geometry as rg

def intersect_spheres(center1, radius1, center2, radius2):
    # Create sphere objects
    sphere1 = rg.Sphere(center1, radius1)
    sphere2 = rg.Sphere(center2, radius2)

    # Calculate intersection
    intersection = rg.Intersect.Intersection.BrepBrep(sphere1.ToBrep(), sphere2.ToBrep(), 0.01)

    # Return the intersection curve(s)
    if intersection[0] == True:
        print(intersection)
        return intersection[1]
    else:
        return None


center1, center2 = x.PointAtStart, y.PointAtStart
radius1, radius2 = x.GetLength(), y.GetLength()
a = intersect_spheres(center1, radius1, center2, radius2)
# ---------- end script_12 ----------
script_13 = Script(x=geometry_14, y=geometry_15)  # -> out, a; inputs x: Line, y: Line
# ---------- script_13: Python ----------
import Rhino.Geometry as rg
import math

def find_common_endpoint(line1, line2):
    """
    Find a common endpoint for two lines with fixed start points and lengths.

    :param line1: The first line.
    :param line2: The second line.
    :return: A common endpoint or None if no such point exists.
    """
    start1, start2 = line1.From, line2.From
    radius1, radius2 = line1.Length, line2.Length

    # Calculate the distance between the start points
    d = start1.DistanceTo(start2)
    if d > radius1 + radius2 or d < abs(radius1 - radius2) or d == 0:
        # No solution: the spheres do not intersect or one is inside the other
        return None

    # Calculate the intersection point
    a = (radius1**2 - radius2**2 + d**2) / (2 * d)
    h = math.sqrt(radius1**2 - a**2)

    # Find the point P2, which is the base of the perpendicular from P3
    P2_x = start1.X + a * (start2.X - start1.X) / d
    P2_y = start1.Y + a * (start2.Y - start1.Y) / d
    P2_z = start1.Z + a * (start2.Z - start1.Z) / d
    P2 = rg.Point3d(P2_x, P2_y, P2_z)

    # Calculate the intersection points (there are two)
    i1_x = P2.X + h * (start2.Y - start1.Y) / d
    i1_y = P2.Y - h * (start2.X - start1.X) / d
    i1_z = P2.Z
    i2_x = P2.X - h * (start2.Y - start1.Y) / d
    i2_y = P2.Y + h * (start2.X - start1.X) / d
    i2_z = P2.Z

    intersection1 = rg.Point3d(i1_x, i1_y, i1_z)
    intersection2 = rg.Point3d(i2_x, i2_y, i2_z)

    # Depending on your specific needs, you can return one or both points
    # For example, returning the first intersection point:
    return [intersection1, intersection2]


a = find_common_endpoint(x, y)
# ---------- end script_13 ----------
script_14 = Script()  # -> out, a
# ---------- script_14: Python ----------
import Rhino.Geometry as rg

def find_point_from_curve(curve, target_pt, length, sort_key = None, tolerance =0.01):

    if not curve.IsValid:
        return None

    # Ensure the curve is reparameterized for accurate calculations
    curve.Domain = rg.Interval(0, 1)
    sphere = rg.Sphere(target_pt, length)

    # Increment along the curve and check distances
    intersection = rg.Intersect.Intersection.CurveBrep(curve, sphere.ToBrep(), tolerance)
    if intersection[0] == True:
        point_list = list(intersection[2])
        if sort_key:
            point_list.sort(key = lambda x : x.DistanceTo(sort_key))
        else:
            point_list.sort(key = lambda x : x.DistanceTo(target_pt))
        return rg.Line(target_pt, point_list[0]).ToNurbsCurve()
    return None
# ---------- end script_14 ----------
script_15 = Script(x=geometry_14, y=geometry_15)  # -> out, a; inputs x: Line, y: Line
# ---------- script_15: Python ----------
import Rhino.Geometry as rg
import math

def find_shared_endpoint(line1, line2):
    """
    Find a shared endpoint for two lines with fixed start points and lengths.
    
    :param line1: The first line (Rhino.Geometry.Line).
    :param line2: The second line (Rhino.Geometry.Line).
    :return: A shared endpoint (Rhino.Geometry.Point3d) or None if no solution.
    """
    start1, start2 = line1.From, line2.From
    len1, len2 = line1.Length, line2.Length

    # Distance between start points
    d = start1.DistanceTo(start2)

    # Check if a solution is possible
    if d > len1 + len2 or d < abs(len1 - len2):
        return None  # Lines can't meet due to length constraints

    # Trilateration to find the intersection points of two spheres
    a = (len1**2 - len2**2 + d**2) / (2 * d)
    h = math.sqrt(len1**2 - a**2)
    mid_point = start1 + (a/d) * (start2 - start1)

    # Potential intersection points
    x3 = mid_point.X + h * (start2.Y - start1.Y) / d
    y3 = mid_point.Y - h * (start2.X - start1.X) / d
    z3 = mid_point.Z

    x4 = mid_point.X - h * (start2.Y - start1.Y) / d
    y4 = mid_point.Y + h * (start2.X - start1.X) / d
    z4 = mid_point.Z

    intersection1 = rg.Point3d(x3, y3, z3)
    intersection2 = rg.Point3d(x4, y4, z4)

    # Select the intersection point that is in the direction of the initial lines
    if (intersection1 - start1).IsParallelTo(line1.Direction) and \
       (intersection1 - start2).IsParallelTo(line2.Direction):
        return intersection1
    elif (intersection2 - start1).IsParallelTo(line1.Direction) and \
         (intersection2 - start2).IsParallelTo(line2.Direction):
        return intersection2

    return None

# Example usage
# Assuming 'line1' and 'line2' are Rhino.Geometry.Line objects
a = find_shared_endpoint(x, y)
# ---------- end script_15 ----------
geometry_21 = Geometry(script_13.a)
geometry_22 = Geometry(script_12.a)
geometry_23 = Geometry(script_15.a)
# find trajectory on all the lines that could change length
# however, prioritse on not changing
script_16 = Script(x=geometry_22, y=geometry_16)  # -> out, a
# ---------- script_16: Python ----------
import Rhino.Geometry as rg

def intersect_spheres(center1, radius1, center2, radius2):
    # Create sphere objects
    sphere1 = rg.Sphere(center1, radius1)
    sphere2 = rg.Sphere(center2, radius2)

    # Calculate intersection
    intersection = rg.Intersect.Intersection.BrepBrep(sphere1.ToBrep(), sphere2.ToBrep(), 0.01)

    # Return the intersection curve(s)
    if intersection[0] == True:
        return intersection[1]
    else:
        return None


center1, center2 = x.PointAtStart, y.PointAtStart
radius1, radius2 = x.GetLength(), y.GetLength()
a = intersect_spheres(center1, radius1, center2, radius2)
for i in a:
    print(i)
# ---------- end script_16 ----------
geometry_24 = Geometry(script_16.a)
panel_6 = Panel(script_16.a)
